vi "BLER Calculation.gvi"   [LabVIEW NXG 4.0.0]
# Calculates the block error rate (BLER) based on the CRC pass counter and the packet counter.
inputs:
  "pass counter": u32  # Current value of the counter which counts the packets with CRC pass.
  "packet counter": u32  # Current value of the counter which counts all packets.
  "BLER array in": f64[]  # The array containing the block error rate of the previous N executions.
outputs:
  "current BLER": f64  # The current block error rate (BLER).
  "BLER array out": f64[]  # The array containing the block error rate of the current and the previous N-1 executions.
  "average BLER": f64  # The averaged block error rate (BLER). The length of the averaging window is determined by the array size of “BLER array in”.
diagram:
  Is Greater Than 0(x=$"packet counter") -> w1
  case (w1) {
    frame False, Default {
      w2 = default
      w3 = $"BLER array in"
    }
    frame True {
      Rotate 1D Array(array=$"BLER array in", n=-1) -> (array (last n elements first)=w4)
      Subtract(x=$"packet counter", y=$"pass counter") -> w5
      To Double Precision Float(number=w5) -> w6
      To Double Precision Float(number=$"packet counter") -> w7
      Divide(x=w6, y=w7) -> w2
      Replace Array Subset(inArray=w4, index=0, new=w2) -> w3
    }
  }
  $"current BLER" <- w2
  $"BLER array out" <- w3
  Add Array Elements(numeric array=w3) -> (sum=w8)
  Array Size(array=w3) -> (size(s)=w9)
  To Double Precision Float(number=w9) -> w10
  Divide(x=w8, y=w10) -> w11
  $"average BLER" <- w11
