vi "CRC32.gvi"   [LabVIEW NXG 4.0.0]
# Calculates the CRC32 value of the given byte array.
inputs:
  "CRCBuffer": u32 = 4294967295  # Defines the initial value the CRC calculation buffer. This parameter is optional.
  "in byte array": u8[]  # The byte array to calculate the CRC32 value on.
outputs:
  "CRC32Value": u32  # This return value is a DWORD that represents the 32 bit CRC for the input data.
diagram:
  s1 = uninitialised  # shift register
  while {
    Is First Call() -> w1
    case (w1) {
      frame False, Default {
        w2 = s1
      }
      frame True {
        for (N = 256) (iteration -> i1) {
          To Unsigned 32 Bit Integer(number=i1) -> w3
          # Initialize the 256 element Lookup Table
          # This is the official polynomial used by CRC32 in WinZip and CRC305.
          # Often times the 0x04C11DB7 polynomial is shown reversed as the
          # polynomial  = 0xEDB88320.
          s2 = w3  # shift register
          for (N = 8) {
            Logical And(1, s2) -> w4
            Is Equal To 0(x=w4) -> w5
            case (w5) {
              frame False, Default {
                Logical Shift(x=s2, y=-1) -> w7
                Logical Exclusive Or(0xEDB88320, w7) -> w6
              }
              frame True {
                Logical Shift(x=s2, y=-1) -> w6
              }
            }
            next s2 = w6
          }
          append s2 to w2
        }
      }
    }
    next s1 = w2
    stop if TRUE
  }
  s3 = $CRCBuffer  # shift register
  s4 = s1  # shift register
  for {
    w8 = each element of $"in byte array"
    # Calculate the CRC using values in the Lookup Table
    Logical Shift(x=s3, y=-8) -> w9
    Logical And(0xFFFFFF, w9) -> w10
    To Unsigned 32 Bit Integer(number=w8) -> w11
    Logical Exclusive Or(s3, w11) -> w12
    Logical And(0xFF, w12) -> w13
    To Signed 32 Bit Integer(number=w13) -> w14
    Array Index(array=s4) -> (out0[w14]=w15)
    Logical Exclusive Or(w10, w15) -> w16
    next s3 = w16
  }
  Logical Exclusive Or(0xFFFFFFFF, s3) -> w17
  $CRC32Value <- w17
