vi "Calculate Number of Packets.gvi"   [LabVIEW NXG 4.0.0]
# Calculates number of packets to send to reach a certain rate of packets per second. Packets to send are adapted from call to call to  keep as close as possible to the requested packet rate.
inputs:
  "packets per second": u32 = 1  # Number of packets to enqueue each second.
outputs:
  "packets to write": i32  # packets to be send to keep up with requested packet rate
diagram:
  Tick Count() -> (timer value=w1)
  Feedback Node(input=$"packets per second") -> w2
  Is Not Equal(x=$"packets per second", y=w2) -> w3
  Feedback Node(input=w1) -> w4
  Subtract(x=w1, y=w4) -> w5
  Is Greater(x=w5, y=1000) -> w6
  Logical Or(w3, w6) -> w7
  Feedback Node(input=w8) -> w9
  case (w7) {
    frame False, Default {
      w10 = w9
    }
    frame True {
      Property Node(instance in=w9, "Start Tick Count"=w1, "Packets sent"=0) -> (instance out=w10)
    }
  }
  Property Node(instance in=w10) -> ("Start Tick Count"=w11, "Packets sent"=w12, instance out=w13)
  Subtract(x=w1, y=w11) -> w14
  Multiply($"packets per second", w14) -> w15
  Quotient And Remainder(x=w15, y=1000) -> (floor(x/y)=w16)
  Property Node(instance in=w13, "Packets sent"=w16) -> (instance out=w8)
  Subtract(x=w16, y=w12) -> w17
  To Signed 32 Bit Integer(number=w17) -> w18
  $"packets to write" <- w18
