vi "Clear Stop.gvi"   [LabVIEW NXG 4.0.0]
# Clears pending stop notifications.
inputs:
  "error in": error
outputs:
  "error out": error
diagram:
  Call Chain() -> (callchain=w1)
  Delete From Array(inArray=w1) -> (deleted=w2)
  Format Into String(formatString="%s:stop notifier", errIn=$"error in", w2) -> (outString=w3, errOut=w4)
  Obtain Notifier(create if not found=FALSE, element data type=string "", error in=w4, name=w3) -> (error out=w5, notifier out=w6)
  Cancel Notification(error in (no error)=w5, notifier=w6) -> (error out=w7, notifier out=w8)
  Release Notifier(error in (no error)=w7, notifier=w8) -> (error out=w9)
  $"error out" <- w9
