vi "Random Unsigned.gvi"   [LabVIEW NXG 4.0.0]
# Generates a pseudo random sequence of U32 values.
inputs:
  "seed": i32 = 1  # The seed which initializes the noise generator which is used internally.
  "number of samples": i32 = 2  # Defines the length of the sequence.
  "max": u32 = 1  # Defines the maximal value of the generated sequence.
  "error in": error
  "reset": bool = TRUE  # Resets the noise generator which is used internally.
outputs:
  "samples": u32[]  # The resulting random sequence.
  "error out": error
uses:
  NI::Analysis::Generation::Uniform White Noise.gvi
diagram:
  Is Equal To 0(x=$"number of samples") -> w1
  case (w1) {
    frame True {
      # do not call randomizer for empty arrays
      w2 = f64[] []
      w3 = $"error in"
    }
    frame False {
      To Double Precision Float(number=$max) -> w4
      Divide(x=w4, y=2) -> w5
      call "Uniform White Noise.gvi"(samples=$"number of samples", amplitude=w5, seed=$seed, error in=$"error in", reset=$reset, offset=w5) -> (uniform white noise=w6, error out=w3)
      Round To Nearest(number=w6) -> w2
    }
  }
  To Unsigned 32 Bit Integer(number=w2) -> w7
  $samples <- w7
  $"error out" <- w3
