vi "Get Time.gvi"   [LabVIEW NXG 4.0.0]
inputs:
  "error in": error
  "error in_2": error
outputs:
  "error out": error
  "tick count (us)": u32
  "tick count (us) dup": u32
  "error out_2": error
diagram:
  sequence {
    frame 0 {
      Merge Errors($"error in", $"error in_2") -> (error out=w1)
      Tick Count[Units=Microseconds]() -> (timer value=w2)
    }
  }
  $"error out" <- w1
  $"error out_2" <- w1
  $"tick count (us)" <- w2
  $"tick count (us) dup" <- w2
