vi "Get and Hold Maximum.gvi"   [LabVIEW NXG 4.0.0]
inputs:
  "value": u32
outputs:
  "max value": u32
diagram:
  Feedback Node(input=w1) -> w2
  Max And Min(x=$value, y=w2) -> (max(x,y)=w1: u32)
  $"max value" <- w1
