vi "U32 to CFX1.15.gvi"   [LabVIEW NXG 4.0.0]
# Converts unsigned 32 bit integer to CFX2.14.
# The upper 16 bit are mapped to the imaginary part
# and the lower 16 bit to the real part.
# no latency
inputs:
  "data in": u32[]  # value as as unsigned 32 bit integer
outputs:
  "data out": CFXP(1.15)[]  # conversion result CFX2.14
diagram:
  Split Number(x=$"data in") -> (high(x)=w1, low(x)=w2)
  To Signed 16 Bit Integer(number=w2) -> w3
  Reinterpret Number[RestrictToSameWordLength=True](data in=w3, type=FXP(1.15) 0) -> (data out=w4)
  To Signed 16 Bit Integer(number=w1) -> w5
  Reinterpret Number[RestrictToSameWordLength=True](data in=w5, type=FXP(1.15) 0) -> (data out=w6)
  Real And Imaginary To Complex(x=w4, y=w6) -> w7
  $"data out" <- w7
