vi "Check USRP Data Clock Rate and Bandwidth.gvi"   [LabVIEW NXG 4.0.0]
# Checks if the used hardware matches the bitfiles.
inputs:
  "niusrprio session in": "niUsrpRio Session.gtype", required  # NI USRO RIO session needed when calling the NI USRO RIO driver nodes.
  "error in": error
outputs:
  "niusrprio session out": "niUsrpRio Session.gtype"  # NI USRO RIO session needed when calling the NI USRO RIO driver nodes.
  "error out": error
types:
  "Register Bus Session.gtype" = Queue<"Session Data.gtype">
  "Semaphore.gtype" = i32
  "DB Queue Reference.gtype" = Queue<"Daughterboard Data.gtype">
  "EEPROM Header.gtype" = cluster{"Checksum": u32, "Product Code": u16, "Hardware Current Version": u16, "Hardware Oldest Compatible Version": u16, "EEPROM Map Current Version": u16, "EEPROM Map Oldest Compatible Version": u16, "User Password": string, "Pointer to Factory Header": u32, "Pointer to User Header": u32, "Recommended Interval": u16, "Number of Reserved Bytes": i32, "Number of Daughterboards": u8, "Daughterboard IDs": u16[], "Daughterboard Serial Numbers": string[]}
  "EEPROM Device Data Header.gtype" = cluster{"Checksum": u32, "Number of Channels": u8, "Number of Gain Settings": u16[], "Pointer to Characterization Data": u32[], "Number of Reserved Bytes": i32, "Number of Frequencies": u16[]}
  "EEPROM Characterization Header.gtype" = cluster{"Checksum": u32, "Date": timestamp, "Temperature": f32, "Misc. Info": string, "Pointer to Device Data Header": u32, "Number of Reserved Bytes": i32}
  "Characterization Data.gtype" = cluster{"Gains[dB]": f64[], "Frequencies [Hz]": f64[], "IQ Imbalance Table": "IQ Imbalance.gtype"[], "Measured Gains[dB]": f64[][]}
  "niUsrpRio Session.gtype" = cluster{"FPGA Interface": any, "RIO Interface Number": u32, "Data Clock Rate": u32, "FPGA Data Clock Rate": u32, "Global Settings Register Bus": "Register Bus Session.gtype", "Radio 0 Settings Register Bus": "Register Bus Session.gtype", "Radio 1 Settings Register Bus": "Register Bus Session.gtype", "Radio Settings Bus Semaphore": "Semaphore.gtype", "DB Queues": "DB Queue Reference.gtype"[], "Characterization Data Valid?": bool, "EEPROM Header": "EEPROM Header.gtype", "Device Data Header": "EEPROM Device Data Header.gtype", "EEPROM Characterization Header": "EEPROM Characterization Header.gtype", "Characterization Data": "Characterization Data.gtype"[], "FPGA Current Version": u32, "FPGA Oldest Compatible Version": u32, "Fixed Logic Current Version": u32, "Fixed Logic Oldest Compatible Version": u32, "FPGA Radio Settings Bus Current Version": u32, "FPGA Radio Settings Bus Oldest Compatible Version": u32, "FPGA Board Config Current Version": u32, "FPGA Board Config Oldest Compatible Version": u32, "Daughterboard Clock Rate": u32}
uses:
  NI::G Core::Error::Build Error Cluster.gvi
diagram:
  $"niusrprio session out" <- $"niusrprio session in"
  Property Node(instance in=$"niusrprio session in") -> ("EEPROM Header:Daughterboard IDs"=w1, "Data Clock Rate"=w2)
  # VI derived from
  # C:\Program Files\National Instruments\LabVIEW Comms 2.0\Resources\vi.lib\Native\niUsrpRio Config v1 Host.lvlib__Check Data Clock Rate and Bandwidth.gvi
  w3 = [131, 130, 129, 128, 133, 132, 122, 121, 126, 125, 515, 514, 145, 147, 148]  # 200 MHz daughterboard IDs
  w4 = "The selected USRP bandwidth does not match the used hardware."
  call "Build Error Cluster.gvi"(code=-1, description=w4, include call chain=TRUE, make warning=FALSE) -> (error out=w5)
  case (w2) {
    frame Default {
      # check for 120 MHz boards,
      # if ID found -> error
      s1 = $"error in"  # shift register
      for {
        w7 = each element of w1
        Search 1D Array(1D array=w3, element=w7) -> (index of element=w8)
        case (w8) {
          frame Default {
            Merge Errors(s1, w5) -> (error out=w9)
          }
          frame -1 {
            w9 = s1
          }
        }
        next s1 = w9
      }
      w6 = s1
    }
    frame 200000000 {
      # check for 200 MHz boards,
      # if ID not found -> error
      s2 = $"error in"  # shift register
      for {
        w10 = each element of w1
        Search 1D Array(1D array=w3, element=w10) -> (index of element=w11)
        case (w11) {
          frame -1 {
            Merge Errors(s2, w5) -> (error out=w12)
          }
          frame Default {
            w12 = s2
          }
        }
        next s2 = w12
      }
      w6 = s2
    }
  }
  $"error out" <- w6
