vi "Determine Execution State.gvi"   [LabVIEW NXG 4.0.0]
inputs:
  "top level VI reference in": "FrontPanelCanvas reference"
  "error in": error
outputs:
  "top level VI reference out": "FrontPanelCanvas reference"
  "error out": error
  "running standalone": bool  # specific error cleared? indicates whether the error referenced by specific error code to clear has been cleared.
uses:
  NI::G Core::Error::Filter Error Code.gvi
diagram:
  Property Node(instance in=$"top level VI reference in", error in=$"error in") -> ("Window"=w1, error out=w2, instance out=w3)
  # Check whether window size can be read:
  # no error:	size could be read => running as executable
  # error 363550:	size could not be read => running in LV environment
  $"top level VI reference out" <- w3
  Property Node(instance in=w1, error in=w2) -> (error out=w4)
  call "Filter Error Code.gvi"(error in=w4, code to clear=363550) -> (error out=w5, error cleared?=w6)
  $"error out" <- w5
  Not(x=w6) -> w7
  $"running standalone" <- w7
