vi "Read Configuration Data.gvi"   [LabVIEW NXG 4.0.0]
inputs:
  "panel reference in": "FrontPanelCanvas reference", required
  "error in": error
  "section": string = "main"
  "configuration path": path
  "application component path": path, required
outputs:
  "panel reference out": "FrontPanelCanvas reference"
  "error out": error
  "configuration": cluster{"key": string, "value": string}[]
uses:
  AFW::Common::Configuration::Determine Execution State.gvi
  NI::G Core::File IO (General)::Is Path and Not Empty.gvi
  NI::G Core::Configuration File (INI)::Open Config Data.gvi
  NI::G Core::Error::Filter Error Code.gvi
  NI::G Core::Configuration File (INI)::Get Key Names.gvi
  NI::G Core::Configuration File (INI)::Read Key::Read Key (String).gvi
  NI::G Core::Configuration File (INI)::Close Config Data.gvi
diagram:
  call "Determine Execution State.gvi"(top level VI reference in=$"panel reference in", error in=$"error in") -> (top level VI reference out=w1, running standalone=w2, error out=w3)
  $"panel reference out" <- w1
  call "Is Path and Not Empty.gvi"(path=$"configuration path") -> (path and not empty?=w4)
  Logical Or(w4, w2) -> w5
  case (w5) {
    frame False {
      w6 = w3
      w7 = default
    }
    frame True {
      Build Path(base path=$"application component path", name or relative path="config.ini") -> (appended path=w8)
      Select(s=w4, t=$"configuration path", f=w8) -> w9
      call "Open Config Data.gvi"(configuration file=w9, create file if necessary=FALSE, error in=w3) -> (reference=w10, error out=w11)
      call "Filter Error Code.gvi"(error in=w11, code to clear=7) -> (error out=w12, error cleared?=w13)
      case (w13) {
        frame True {
          w6 = w12
          w7 = default
        }
        frame False {
          call "Get Key Names.gvi"(reference in=w10, error in=w12, section=$section) -> (reference out=w14, key names=w15, error out=w16)
          s1 = w14  # shift register
          s2 = w16  # shift register
          for {
            w17 = each element of w15
            call "Read Key (String).gvi"(reference in=s1, key=w17, error in=s2, section=$section) -> (reference out=w18, value=w19, error out=w20)
            Property Node(instance in=cluster{"key": string, "value": string} {all zero or empty}, "key"=w17, "value"=w19) -> (instance out=w21)
            append w21 to w7
            next s1 = w18
            next s2 = w20
          }
          call "Close Config Data.gvi"(reference=s1, error in=s2) -> (error out=w6)
        }
      }
    }
  }
  $configuration <- w7
  $"error out" <- w6
