vi "DTP Check Header and CRC.gvi"   [LabVIEW NXG 4.0.0]
# Checks if the input data array contains a DTP header at the specified offset. Also checks if the header CRC is valid.
inputs:
  "input data array": u8[]  # The input data array which contains the header.
  "array header offset": i32  # The offset at which the header is expected.
outputs:
  "counter": u16  # The counter value contained in the header.
  "length": u16  # The packet length.
  "header CRC ok": bool  # Indication whether the header CRC check was valid.
  "header found": bool  # Indication whether the header was found.
uses:
  AFW::Common::Data Transfer Protocol::DTP Header.gvi
diagram:
  call "DTP Header.gvi"() -> (DTP sync word=w1, sync word length=w2)
  To Signed 32 Bit Integer(number=w2) -> w3
  Array Subset(array=$"input data array", index0=$"array header offset", length0=w3) -> w4
  Type Cast(type=u32 0x0, x=w4) -> w5
  Is Equal(x=w1, y=w5) -> w6
  $"header found" <- w6
  Add($"array header offset", 4) -> w7
  Array Subset(array=$"input data array", index0=w7, length0=4) -> w8
  Type Cast(type=u32 0x0, x=w8) -> w9
  Split Number(x=w9) -> (high(x)=w10, low(x)=w11)
  $counter <- w10
  $length <- w11
  Add($"array header offset", 8) -> w12
  Array Subset(array=$"input data array", index0=w12, length0=4) -> w13
  Type Cast(type=u32 0x0, x=w13) -> w14
  Logical Exclusive Or(w5, w9) -> w15
  Is Equal(x=w15, y=w14) -> w16
  $"header CRC ok" <- w16
