vi "Clear Errno.gvi"   [LabVIEW NXG 4.0.0]
inputs:
  "error in": error
outputs:
  "error out": error
uses:
  NI::G Core::Error::Build Error Cluster.gvi
  AFW::Common::Linux Pipes::System Calls::system calls.sli::__errno_location
  AFW::Common::Linux Pipes::System Calls::system calls.sli::SetErrnoValue
diagram:
  disable {
    frame OS == "Win" {
      w2 = 1072  # not yet implemented
      call "Build Error Cluster.gvi"(code=w2, error in=$"error in") -> (error out=w1)
    }
    frame OS == "Linux", Default {
      call "__errno_location"(error in=$"error in") -> (return=w3, error out=w4)
      call "SetErrnoValue"(errno=0, value=w3, size=4, error in=w4) -> (error out=w1)
    }
  }
  $"error out" <- w1
