vi "Create FIFO.gvi"   [LabVIEW NXG 4.0.0]
# Creates a new FIFO at pathname. Uses mode for file permissions. This VI first calls unlink to ensure the FIFO does not exists.
inputs:
  "pathname": string  # Path to the FIFO to be created.
  "mode": u32 = 436  # Mode bits to use to create the FIFO. Defaults to 664 (
  "error in": error
outputs:
  "error out": error
uses:
  NI::G Core::Error::Build Error Cluster.gvi
  AFW::Common::Linux Pipes::System Calls::unlink.gvi
  NI::G Core::Error::Filter Error Code.gvi
  AFW::Common::Linux Pipes::Clear Errno.gvi
  AFW::Common::Linux Pipes::System Calls::system calls.sli::mkfifo
  AFW::Common::Linux Pipes::Convert Errno to LabVIEW Error.gvi
diagram:
  disable {
    frame OS == "Win" {
      w2 = 1072  # not yet implemented
      call "Build Error Cluster.gvi"(code=w2, error in=$"error in") -> (error out=w1)
    }
    frame OS == "Linux", Default {
      call "unlink.gvi"(error in=$"error in", pathname=$pathname) -> (error out=w3)
      w4 = 2  # ENOENT
      call "Filter Error Code.gvi"(code to clear=w4, error in=w3) -> (error cleared?=w5, error out=w6)
      case (w5) {
        frame False, Default {
          w7 = w6
        }
        frame True {
          call "Clear Errno.gvi"(error in=w6) -> (error out=w7)
        }
      }
      call "mkfifo"(pathname=$pathname, mode=$mode, error in=w7) -> (return=w8, error out=w9)
      Is Less Than 0(x=w8) -> w10
      case (w10) {
        frame False, Default {
          w1 = w9
        }
        frame True {
          call "Convert Errno to LabVIEW Error.gvi"(error in=w9) -> (error out=w1)
        }
      }
    }
  }
  $"error out" <- w1
