vi "Open Pipe Writer.gvi"   [LabVIEW NXG 4.0.0]
# Opens a Linux pipe for write. The pipe must be open for read already. If the pipe is not open for read the VI will block until a reader is connected.
inputs:
  "error in": error
  "file name": string
  "blocking": bool  # If enabled block writer until sufficient space is available. Set EAGAIN error otherwise.
outputs:
  "error out": error
  "pipe writer": "Pipe Writer.gtype"  # A cluster containing all references necessary to write to the pipe.
types:
  "Pipe Writer.gtype" = cluster{"file name": string, "pipe file descriptor": i32}
uses:
  AFW::Common::Linux Pipes::System Calls::open.gvi
diagram:
  case ($blocking) {
    frame True {
      w1 = 0
    }
    frame False {
      w2 = 2048  # O_NONBLOCK
      w1 = w2
    }
  }
  w3 = 1  # O_WRONLY
  Logical Or(w3, w1) -> w4
  call "open.gvi"(error in=$"error in", pathname=$"file name", flags=w4) -> (error out=w5, file descriptor=w6)
  Property Node(instance in="Pipe Writer.gtype" {all zero or empty}, "file name"=$"file name", "pipe file descriptor"=w6) -> (instance out=w7)
  $"pipe writer" <- w7
  $"error out" <- w5
