vi "Read Pipe.gvi"   [LabVIEW NXG 4.0.0]
# Try to read data from pipe.
# If bytes can be read from pipe the call exist immediatly although bytes read might be smaller than the size of buffer in.
# In case there are initially no bytes available in the pipe the reader waits timeout µs for data if timeout is >0. Once bytes are available they are read from pipe. Read Pipe might read less bytes than available in buffer. The number of bytes read is signaled in bytes read.
# If no data is available on the pipe timed out is True and bytes read 0.
inputs:
  "error in": error
  "pipe reader in": "Pipe Reader.gtype"  # A cluster containing all reference associated with the pipe reader.
  "buffer in": u8[]  # Preallocated buffer for pipe read operation.
  "timeout": i64  # Timeout for read operation in µs. A value of zero means no wait for read operation. negative values are handled like zero. Infinte wait is not supported.
  "bytes to read": i32 = -1
outputs:
  "Error": error
  "pipe reader out": "Pipe Reader.gtype"  # A cluster containing all reference associated with the pipe reader.
  "buffer out": u8[]  # A buffer containing read bytes. The buffer has the same size as buffer in. Only bytes read values of this buffer are valid.
  "bytes read": i32  # Number of bytes read from pipe.
  "timed out": bool
types:
  "Pipe Reader.gtype" = cluster{"file name": string, "pipe file descriptor": i32, "timer file descriptor": i32, "epoll file descriptor": i32}
  "timespec.gtype" = cluster{"sec": u64, "nsec": u64}
  "itimerspec.gtype" = cluster{"it_interval": "timespec.gtype", "it_value": "timespec.gtype"}
uses:
  AFW::Common::Linux Pipes::System Calls::read.gvi
  NI::G Core::Error::Filter Error Code.gvi
  AFW::Common::Linux Pipes::System Calls::timerfd_settime.gvi
  AFW::Common::Linux Pipes::System Calls::epoll_wait.gvi
diagram:
  $"pipe reader out" <- $"pipe reader in"
  Property Node(instance in=$"pipe reader in") -> ("epoll file descriptor"=w1, "timer file descriptor"=w2, "pipe file descriptor"=w3)
  call "read.gvi"(error in=$"error in", file descriptor in=w3, buffer in=$"buffer in", bytes to read=$"bytes to read") -> (error out=w4, file descriptor out=w5, buffer out=w6, bytes read=w7)
  w8 = 11  # EAGAIN
  call "Filter Error Code.gvi"(code to clear=w8, error in=w4) -> (error cleared?=w9, error out=w10)
  Is Greater Than 0(x=$timeout) -> w11
  Logical And(w9, w11) -> w12
  case (w12) {
    frame False, Default {
      w13 = w10
      w14 = w6
      w15 = w7
      w16 = FALSE
    }
    frame True {
      To Signed 64 Bit Integer(number=f64 default) -> w17
      In Range And Coerce(lower limit=0, upper limit=w17, x=$timeout) -> (coerced(x)=w18)
      To Unsigned 64 Bit Integer(number=w18) -> w19
      Multiply(w19, 1000) -> w20
      Quotient And Remainder(x=w20, y=1000000000) -> (floor(x/y)=w21, x-y*floor(x/y)=w22)
      Property Node(instance in="itimerspec.gtype" {all zero or empty}, "it_value:nsec"=w22, "it_value:sec"=w21) -> (instance out=w23)
      call "timerfd_settime.gvi"(file descirptor in=w2, new value=w23, error in=w10) -> (file descriptor out=w24, error out=w25)
      call "epoll_wait.gvi"(epoll file descriptor in=w1, max events=1, timeout=-1, error in=w25) -> (events out=w26, error out=w27)
      call "timerfd_settime.gvi"(file descirptor in=w24, new value="itimerspec.gtype" {all zero or empty}, error in=w27) -> (error out=w28)
      Array Index(array=w26) -> (out0[_]=w29)
      Property Node(instance in=w29) -> ("data"=w30)
      To Signed 32 Bit Integer(number=w30) -> w31
      Is Equal(x=w5, y=w31) -> w32
      case (w32) {
        frame False, Default {
          w13 = w28
          w14 = w6
          w15 = w7
        }
        frame True {
          call "read.gvi"(error in=w28, file descriptor in=w5, buffer in=w6) -> (error out=w13, buffer out=w14, bytes read=w15)
        }
      }
      Is Equal(x=w2, y=w31) -> w16
    }
  }
  $"buffer out" <- w14
  $"bytes read" <- w15
  $Error <- w13
  $"timed out" <- w16
