vi "Set Pipe Size.gvi"   [LabVIEW NXG 4.0.0]
# Change size of FIFO using file descriptor to FIFO.
# The resulting size of the FIFO can differ from the requested size if the requested size was out of range (system dependend) or does not fit the increment (system dependend).
inputs:
  "size": i32 = 65536  # requested size
  "error in": error
  "file descriptor in": i32  # File descriptor to FIFO.
outputs:
  "error out": error
  "file descriptor out": i32  # File descriptor to FIFO.
  "new size": i32  # actual size.
uses:
  NI::G Core::Error::Build Error Cluster.gvi
  AFW::Common::Linux Pipes::System Calls::system calls.sli::fcntl_int32
  AFW::Common::Linux Pipes::Convert Errno to LabVIEW Error.gvi
diagram:
  disable {
    frame OS == "Win" {
      w4 = 1072  # not yet implemented
      call "Build Error Cluster.gvi"(code=w4, error in=$"error in") -> (error out=w1)
      w2 = default
      w3 = default
    }
    frame OS == "Linux", Default {
      w5 = 1031  # F_SETPIPE_SZ
      call "fcntl_int32"(fd=$"file descriptor in", cmd=w5, value=$size, error in=$"error in") -> (return=w6, error out=w7)
      Is Less Than 0(x=w6) -> w8
      case (w8) {
        frame False, Default {
          w9 = w7
        }
        frame True {
          call "Convert Errno to LabVIEW Error.gvi"(error in=w7) -> (error out=w9)
        }
      }
      w10 = 1032  # F_GETPIPE_SZ
      call "fcntl_int32"(fd=$"file descriptor in", cmd=w10, value=0, error in=w9) -> (return=w2, error out=w11)
      Is Less Than 0(x=w2) -> w12
      case (w12) {
        frame False, Default {
          w1 = w11
        }
        frame True {
          call "Convert Errno to LabVIEW Error.gvi"(error in=w11) -> (error out=w1)
        }
      }
      w3 = $"file descriptor in"
    }
  }
  $"file descriptor out" <- w3
  $"new size" <- w2
  $"error out" <- w1
