vi "close.gvi"   [LabVIEW NXG 4.0.0]
# Encapsulate system call and evaluates errno if call returns -1.
inputs:
  "error in": error
  "file descriptor": i32
outputs:
  "error out": error
uses:
  NI::G Core::Error::Build Error Cluster.gvi
  AFW::Common::Linux Pipes::System Calls::system calls.sli::close
  AFW::Common::Linux Pipes::Convert Errno to LabVIEW Error.gvi
diagram:
  disable {
    frame OS == "Win" {
      w2 = 1072  # not yet implemented
      call "Build Error Cluster.gvi"(code=w2, error in=$"error in") -> (error out=w1)
    }
    frame OS == "Linux", Default {
      call "close"(fd=$"file descriptor", error in=$"error in") -> (return=w3, error out=w4)
      Is Less Than 0(x=w3) -> w5
      case (w5) {
        frame False, Default {
          w1 = w4
        }
        frame True {
          call "Convert Errno to LabVIEW Error.gvi"(error in=w4) -> (error out=w1)
        }
      }
    }
  }
  $"error out" <- w1
