vi "epoll_ctl.gvi"   [LabVIEW NXG 4.0.0]
# Encapsulate system call and evaluates errno if call returns -1.
inputs:
  "error in": error
  "epoll file descriptor in": i32
  "operation": "epoll_operations.gtype" = "NONE"
  "target file descriptor": i32
  "epoll data": u64
  "events": "epoll_event_names.gtype"[]
outputs:
  "error out": error
  "epoll file descriptor out": i32
  "event out": "epoll_event.gtype"
types:
  "epoll_operations.gtype" = enum{"NONE", "EPOLL_CTL_ADD", "EPOLL_CTL_MOD", "EPOLL_CTL_DEL", ""}
  "epoll_event_names.gtype" = u32
  "epoll_event.gtype" = cluster{"events": "epoll_event_names.gtype", "data": u64}
uses:
  NI::G Core::Error::Build Error Cluster.gvi
  AFW::Common::Linux Pipes::System Calls::system calls.sli::epoll_ctl
  AFW::Common::Linux Pipes::Convert Errno to LabVIEW Error.gvi
diagram:
  $"epoll file descriptor out" <- $"epoll file descriptor in"
  Type Cast(type=u32 0, x=$operation) -> w1
  s1 = 0  # shift register
  for {
    w2 = each element of $events
    Logical Or(s1, w2) -> w3
    next s1 = w3
  }
  Property Node(instance in="epoll_event.gtype" {all zero or empty}, "events"=s1, "data"=$"epoll data") -> (instance out=w4)
  disable {
    frame OS == "Win" {
      w7 = 1072  # not yet implemented
      call "Build Error Cluster.gvi"(code=w7, error in=$"error in") -> (error out=w5)
      w6 = default
    }
    frame OS == "Linux", Default {
      call "epoll_ctl"(epfd=$"epoll file descriptor in", operation=w1, fd=$"target file descriptor", event in=w4, error in=$"error in") -> (return=w8, event out=w6, error out=w9)
      Is Less Than 0(x=w8) -> w10
      case (w10) {
        frame False, Default {
          w5 = w9
        }
        frame True {
          call "Convert Errno to LabVIEW Error.gvi"(error in=w9) -> (error out=w5)
        }
      }
    }
  }
  $"event out" <- w6
  $"error out" <- w5
