vi "open.gvi"   [LabVIEW NXG 4.0.0]
# Encapsulate system call and evaluates errno if call returns -1.
inputs:
  "error in": error
  "pathname": string
  "flags": u32
outputs:
  "error out": error
  "file descriptor": i32
uses:
  NI::G Core::Error::Build Error Cluster.gvi
  AFW::Common::Linux Pipes::System Calls::system calls.sli::open
  AFW::Common::Linux Pipes::Convert Errno to LabVIEW Error.gvi
diagram:
  disable {
    frame OS == "Win" {
      w3 = 1072  # not yet implemented
      call "Build Error Cluster.gvi"(code=w3, error in=$"error in") -> (error out=w2)
      w1 = default
    }
    frame OS == "Linux", Default {
      call "open"(pathname=$pathname, flags=$flags, error in=$"error in") -> (return=w1, error out=w4)
      Is Less Than 0(x=w1) -> w5
      case (w5) {
        frame False, Default {
          w2 = w4
        }
        frame True {
          call "Convert Errno to LabVIEW Error.gvi"(error in=w4) -> (error out=w2)
        }
      }
    }
  }
  $"file descriptor" <- w1
  $"error out" <- w2
