vi "timerfd_create.gvi"   [LabVIEW NXG 4.0.0]
# Encapsulate system call and evaluates errno if call returns -1.
inputs:
  "error in": error
  "clock_id": "clockid.gtype" = "realtime"
outputs:
  "error out": error
  "file descriptor": i32
types:
  "clockid.gtype" = enum{"realtime", "monotonic"}
uses:
  NI::G Core::Error::Build Error Cluster.gvi
  AFW::Common::Linux Pipes::System Calls::system calls.sli::timerfd_create
  AFW::Common::Linux Pipes::Convert Errno to LabVIEW Error.gvi
diagram:
  disable {
    frame OS == "Win" {
      w3 = 1072  # not yet implemented
      call "Build Error Cluster.gvi"(code=w3, error in=$"error in") -> (error out=w1)
      w2 = default
    }
    frame OS == "Linux", Default {
      Type Cast(type=u16 0, x=$clock_id) -> w4
      call "timerfd_create"(clock_id=w4, flags=0, error in=$"error in") -> (return=w2, error out=w5)
      Is Less Than 0(x=w2) -> w6
      case (w6) {
        frame False, Default {
          w1 = w5
        }
        frame True {
          call "Convert Errno to LabVIEW Error.gvi"(error in=w5) -> (error out=w1)
        }
      }
    }
  }
  $"file descriptor" <- w2
  $"error out" <- w1
