vi "timerfd_settime.gvi"   [LabVIEW NXG 4.0.0]
# Encapsulate system call and evaluates errno if call returns -1.
inputs:
  "error in": error
  "new value": "itimerspec.gtype"
  "file descirptor in": i32
outputs:
  "error out": error
  "file descriptor out": i32
  "old value": "itimerspec.gtype"
types:
  "timespec.gtype" = cluster{"sec": u64, "nsec": u64}
  "itimerspec.gtype" = cluster{"it_interval": "timespec.gtype", "it_value": "timespec.gtype"}
uses:
  NI::G Core::Error::Build Error Cluster.gvi
  AFW::Common::Linux Pipes::System Calls::system calls.sli::timerfd_settime
  AFW::Common::Linux Pipes::Convert Errno to LabVIEW Error.gvi
diagram:
  disable {
    frame OS == "Win" {
      w4 = 1072  # not yet implemented
      call "Build Error Cluster.gvi"(code=w4, error in=$"error in") -> (error out=w1)
      w2 = default
      w3 = default
    }
    frame OS == "Linux", Default {
      call "timerfd_settime"(fd=$"file descirptor in", flags=0, new_value in=$"new value", old_value in="itimerspec.gtype" {all zero or empty}, error in=$"error in") -> (return=w5, old_value out=w2, error out=w6)
      Is Less Than 0(x=w5) -> w7
      case (w7) {
        frame False, Default {
          w1 = w6
        }
        frame True {
          call "Convert Errno to LabVIEW Error.gvi"(error in=w6) -> (error out=w1)
        }
      }
      w3 = $"file descirptor in"
    }
  }
  $"file descriptor out" <- w3
  $"old value" <- w2
  $"error out" <- w1
