vi "Write Pipe.gvi"   [LabVIEW NXG 4.0.0]
# Try to write data from buffer in to the pipe.
# The number of bytes written to the pipe might be smaller than buffer in and is signaled in bytes written.
inputs:
  "error in": error
  "pipe writer in": "Pipe Writer.gtype"  # A cluster containing all reference associated with the pipe writer.
  "buffer in": u8[]  # Bytes to be written to pipe.
outputs:
  "error out": error
  "pipe writer out": "Pipe Writer.gtype"  # A cluster containing all reference associated with the pipe writer.
  "bytes written": i32  # Number of bytes written to pipe
types:
  "Pipe Writer.gtype" = cluster{"file name": string, "pipe file descriptor": i32}
uses:
  AFW::Common::Linux Pipes::System Calls::write.gvi
diagram:
  $"pipe writer out" <- $"pipe writer in"
  Property Node(instance in=$"pipe writer in") -> ("pipe file descriptor"=w1)
  call "write.gvi"(error in=$"error in", file descriptor in=w1, buffer in=$"buffer in") -> (error out=w2, bytes written=w3)
  $"bytes written" <- w3
  $"error out" <- w2
