vi "Log Formatter.gvi"   [LabVIEW NXG 4.0.0]
# It initializes logging queue and enables a notifier on initial call. It flushes the queue of log entries. Then, it resorts the entries based on the time stamps. The logging cluster has the following information: the module name, the error message, the log level, and the time stamp. The log level has one of the following states: Trace, Debug, Info, Warn, Error, and Fatal.
inputs:
  "error in": error
  "queue name": string  # Given queue name. If it is embty, logger will be given as a default name.
outputs:
  "error out": error
  "log entries": string[]  # Resorted log entries based on the time stamp.
types:
  "Log Level.gtype" = enum{"Trace", "Debug", "Info", "Warn", "Error", "Fatal"}
  "Log Message.gtype" = cluster{"Time Stamp": u32, "log level": "Log Level.gtype", "module": string, "message": string}
diagram:
  Is Empty String Or Path(string/path=$"queue name") -> w1
  case (w1) {
    frame True {
      w2 = $"error in"
      w3 = "logger"
    }
    frame False {
      Call Chain() -> (callchain=w4)
      Delete From Array(inArray=w4) -> (deleted=w5)
      Concatenate Strings("%s:", $"queue name") -> w6
      Format Into String(formatString=w6, errIn=$"error in", w5) -> (outString=w3, errOut=w2)
    }
  }
  Is First Call() -> w7
  Feedback Node(input=w8) -> w9
  case (w7) {
    frame False, Default {
      w10 = w2
      w8 = w9
    }
    frame True {
      # Initialize logging queue and enable
      # notifier on initial call.
      Obtain Queue(element data type="Log Message.gtype" {all zero or empty}, error in=w2, name=w3) -> (error out=w10, queue out=w8)
    }
  }
  Flush Queue(error in=w10, queue=w8) -> (error out=w11, remaining elements=w12)
  # sort the elements by time stamp
  for (iteration -> i1) {
    w13 = each element of w12
    Property Node(instance in=w13) -> ("Time Stamp"=w15)
    Build Cluster(w15, i1) -> w16
    append w16 to w14
  }
  s1 = w11  # shift register
  for {
    w17 = each element of w14
    Property Node(instance in=w17) -> ("Element 2"=w19)
    Array Index(array=w12) -> (out0[w19]=w20)
    Property Node(instance in=w20) -> ("Time Stamp"=w21, "log level"=w22, "module"=w23, "message"=w24)
    case (w22) {
      frame "Trace" {
        w25 = "TRC"
      }
      frame "Debug" {
        w25 = "DBG"
      }
      frame "Info" {
        w25 = "INF"
      }
      frame "Warn" {
        w25 = "WRN"
      }
      frame "Error" {
        w25 = "ERR"
      }
      frame "Fatal" {
        w25 = "FAT"
      }
    }
    Quotient And Remainder(x=w21, y=10000) -> (floor(x/y)=w26, x-y*floor(x/y)=w27)
    Quotient And Remainder(x=w26, y=1000) -> (floor(x/y)=w28, x-y*floor(x/y)=w29)
    Quotient And Remainder(x=w28, y=60) -> (floor(x/y)=w30, x-y*floor(x/y)=w31)
    Format Into String(formatString="%01d:%02d,%03d.%04d [%s] %10s-%s\\r\\n", errIn=s1, w30, w31, w29, w27, w25, w23, w24) -> (outString=w32, errOut=w33)
    append w32 to w18
    next s1 = w33
  }
  $"log entries" <- w18
  $"error out" <- s1
