vi "Host DL.gvi"   [LabVIEW NXG 4.0.0]
# Enqueue an element into the stop notifier if error in indicates an error. Call after each loop on host top level to synchronize host shut down in case of any error.
panel controls:
  "RIO Device": string = "RIO0"  # The RIO address of the RF hardware device
  "UE RX Frequency": f64 = 2000000000  # DL RX center frequency, allowed range depends on used RF device.
  "UE Manual Gain": f64  # Controls the analog RX gain in case UE AGC is switched off
  "eNB TX Frequency": f64 = 2000000000  # DL TX center frequency, allowed range depends on used RF device.
  "eNB Max RF TX Power": f64 = 10  # Maximum RF transmit power (upper bound - achievable for a full scale complex sine wave (CW) signal) Note: The actual time-domain RF transmit power depends on the configured resource allocation and is typically at least 15 dB lower to allow for the OFDM PAPR backoff.
  "UDP Receive Port": u16 = 50000  # The UDP port the host monitors for incoming packets to be transferred to the FPGA PDSCH chain.
  "Transmit IP Address": string = "127.0.0.1"  # The IP address the UDP packets received from PDSCH shall be sent to.
  "UDP Transmit Port": u16 = 60000  # The UDP port the UDP packets received from PDSCH shall be sent to.
  "UE AGC": bool = TRUE  # Enables or disables the automated gain control on the receiver side. If enabled the analog RX gain of the RF device will be automatically configured within its valid range to meet a target range for the baseband input signal power.
  "Reference Clock Source": string = "Internal"  # Configures the Reference Clock source used for the transceiver chain. Internal: Device internal clock REF IN / ClkIn: Clock input at the RF device (i.e. rear connector pane at USRP RIO, front connector pane for NI 579x) PXI_CLK: Backplane clock from the PXI Chassis (NI 579x only) GPS: GPS module (NI USRP RIO 295x only)
  "UE Receiver": bool  # Enables or disables the receiver using the current configuration.
  "eNB TX RF Port (USRP)": enum{"TX1/RF0", "TX1/RF1"} = "TX1/RF0"  # Selects the HW RF port the DL TX is transmitted on (USRP RIO only).
  "UE RX RF Port (USRP)": "USRP RX RF Port.gtype" = "RX2/RF1"  # Selects the HW RF port the DL RX will be received from (USRP RIO only).
  "symbol number for PDSCH constellation": u8 = 4  # The OFDM symbol number (counting from 0 with symbol 0 being occupied by the PDCCH) used for displaying constellation data for PDSCH I/Q samples.
  "eNB Transmitter": bool  # Enables or disables the transmitter using the current configuration.
  "Rate Adaption": bool  # If enabled, eNB TX MCS is automatically adapted to reported/measured Wideband SINR [dB] to handle with channel quality fluctuations. The adaptation is calibrated so that the applied MCS produces approximately 5% to 10% BLER under current MCS conditions. If that is not desired, modify SINR Offset [dB].
  "SINR Offset": f64 = 3  # This value is effectively subtracted from the reported SINR before looking up the MCS in the adaptation table (i.e. if a positive offset is configured, a higher reported SINR is required to adapt to a certain MCS to avoid block errors).
  "eNB TX UE Context": T2 = {"RNTI"=10, "Use UERS"=FALSE, "Antenna Port"=7, "CCE Offset"=0}
    # UE specific parameters for DL transmission
    # Use UERS: If enabled, the DL transmitter feeds UE-specific reference signals into the PDSCH data stream. The usage of UERS is closely related to Transmission Mode 9 defined in the LTE standard 3GPP TS 36.213 §7.1.
    # RNTI: The radio network temporary identifier used for PDSCH scrambling and PDCCH CRC mask generation.
    # Antenna Port: The antenna port used for generating UERS, Range: 7…14 according to 3GPP TS 36.213 §7.1.
    # CCE Offset: First control channel element to be used for PDCCH transmission. According to 3GPP TS 36.211 §6.8.1/.2.
  "eNB TX Frame Structure": enum{"FDD", "TDD 5 5"} = "FDD"  # Select between frequency division duplex (FDD) and time division duplex (TDD) using subframe configuration 5 and special subframe configuration 5 (3GPP TS 36.211 §4).
  "UE RX Frame Structure": enum{"FDD", "TDD 5 5"} = "FDD"  # Select between FDD (frequency division duplex) and TDD (time division duplex) using subframe configuration 5 and special subframe configuration 5 (3GPP TS 36.211 §4).
  "eNB TX Cell ID": u16  # Physical cell ID used for PSS, CRS, UERS sequence generation and PDCCH/PDSCH scrambling. [0…511]
  "UE RX Cell ID": u16  # Physical cell ID used for PSS, CRS, UERS sequence generation and PDCCH/PDSCH scrambling. [0…511].
  "eNB Timing Offset": i32  # Changes the eNodeB timing (start of radio frame). Given in 30.72MS/s.
  "stop": bool
  "session": "Host Session.gtype"
  "UE RX UE Context": T2 = {"RNTI"=10, "Use UERS"=FALSE, "Antenna Port"=7, "CCE Offset"=0}
    # UE specific parameters for DL reception.
    # Use UERS: If enabled the DL receiver will use UE specific reference signals for equalizing PDSCH assigned I/Q samples. The usage of UERS is closely related to Transmission Mode 9 defined in the LTE standard 3GPP TS 36.213 §7.1.
    # RNTI: The radio network temporary identifier used for PDSCH scrambling and PDCCH CRC mask check.
    # Antenna Port: The antenna port used for generating UERS for channel estimation, Range: 7…14 according to 3GPP TS 36.213 §7.1.
    # CCE Offset: First control channel element to be used for PDCCH reception. According to 3GPP TS 36.211 §6.8.1/.2.
  "Command": string = "MACsimpleDL"  # Command to execute for external MAC
  "External MAC": bool  # When enabled a program is executed on the RT described by command line and arguments. This switch applies for RT only. When disabled an internal basic MAX will be executed.
  "throughput select": T12 = "PDSCH (CRC ok)"  # Selects the used values for throughput calculation: PDSCH (overall): The total throughput scheduled by the eNodeB Tx regardless of CRC result. PDSCH (CRC ok): The actual achieved physical layer throughput, which could be decoded successfully. User data (to UDP): The higher layer throughput (from/to UDP stream) after removing the padding.
  "Arguments": string = "10000 4 FF"  # Arguments to pass to the external MAC
  "Tab": i32
  "Stop on API Confirmation Errors": bool
  "eNB TX DCI": "DCI Message.gtype" = {"Active"=TRUE, "MCS"="MCS 17 (64-QAM, rate ~0.43)", "Resource Block Allocation (4 PRB/bit)"=8388607}
  "Transport Instance ID": u8
panel indicators:
  "FPGA Ready": bool  # Signals that the FPGA bitfile has been downloaded and that the device has been initialized and is ready for configuration. Initialization can take up to 20 seconds.
  "UE RX Active": bool  # Signals that all UE RX control configurations have been applied and the receiver is running.
  "UE Coerced Gain": f64  # The actual used analog RX RF gain either set by AGC, if enabled, or by UE Manual Gain Value [dB].
  "eNB TX Active": bool  # Signals that all eNB TX control configurations have been applied and the transmitter is running.
  "eNB Coerced Max RF TX Power": f64  # Indicates the coerced value actually used as maximum RF transmit output power after applying the device capabilities (range and resolution limitations) to the configured eNB Maximum RF TX Power [dBm].
  "UE ADC Values Clipped": bool  # Indicates a numeric overflow at the ADC output. An overflow can occur when the analog RX RF gain is too high or the receiver power level is too high.
  "UE Baseband RX Power": f64  # The measured baseband input power level in dB full scale.
  "Data Transfer In": bool  # Indicates that the configured UDP stream is receiving data on the configured Receive Port.
  "Packet Loss In": bool  # Indicates that the system loses UDP data because of overload, which can occur when data inflow from UDP port is higher than configured PDSCH throughput.
  "UE RX Power Spectrum": T1  # Shows the power spectrum of the DL RX baseband signal received from RF. If synchronization is successful, frequency offset compensation is applied.
  "PDSCH Constellation": c128[]  # Constellation of RX I/Q samples allocated for PDSCH transmission after equalization. Only samples for the configured OFDM Symbol-Nr (PDSCH) are displayed.
  "PDCCH Constellation": c128[]  # Constellation of RX I/Q samples allocated for PDCCH transmission after equalization.
  "DL throughput": f64[][]
  "UE Failure / Block Error Rate (BLER)": f64[][]  # Numerical and graphical display of error rates for synchronization detection and PDCCH and PDSCH decoding.
  "eNB TX Power Spectrum": T1  # Shows the power spectrum of the DL TX baseband signal transferred to the RF.
  "UE Frequency Offset": f64  # The estimated and compensated frequency offset detected in the RX signal.
  "Sync Found": bool  # Indicates that the synchronization module has successfully detected and synchronized to a DL RX signal.
  "UE DDC Values Clipped": bool  # Indicates a numeric overflow at the output of the digital downconversion block (i.e. analog RX RF gain too high or receive power level too high).
  "Packet Loss Out": bool  # Indicates that the system loses UDP data caused by overload, which can occur when data inflow from the PDSCH is higher than UDP throughput.
  "channel estimation": f64[][]  # Graphical representation of the normalized channel amplitude and phase estimated on the cell specific reference signals.
  "Data Transfer Out": bool  # Indicates that the configured UDP stream is sending data to the configured Transmit IP Address using Transmit Port.
  "DL throughput (current)": f64  # Numerical and graphical indication of scheduled, successfully decodable and actually used channel capacity. PDSCH (overall): The total throughput scheduled by the eNodeB TX regardless of CRC result. PDSCH (CRC ok): The actual achieved physical layer throughput, which could be decoded successfully. User data (to UDP): The higher layer throughput (from/to UDP stream) after removing the padding.
  "Subband SINR [dB]": f64[]  # The estimated SINR for each subband occupying 8 PRBs. Comparable to Reporting Mode 3-0 in 3GPP TS 36.213 §7.2.1. Usage of CRS or UERS for estimation depends on setting of Use UERS switch in UE RX System Parameters.
  "TX starting": bool
  "eNB TX IFFT Output Clipped": bool  # Indicates a numeric overflow after IFFT.
  "Wideband SINR": f64  # The estimated SINR over the full 20 MHz band using cell-specific reference signals.
  "UE RF RX Power": f64  # The measured time domain input power at the RX RF port.
  "power calibration offset [dB]": f64
  "PDCCH Received DCI Message": "DCI Message.gtype"[]
  "eNB RF TX Power": f64  # Actual eNB RF transmit power in dBm.
  "eNB Baseband TX Power": f64  # Actual eNB baseband transmit power level [baseband output power level] in dB full scale.
  "UE Applied Gain": f64
  "L1-L2 Interface active": bool
  "PHY Timing Indication Received": u32
  "Max MAC TX Delay": u32
  "DL RX Indication CRC OK": bool
  "TTI": u8
  "SFN": u16
  "Error Report": string
  "BLER cluster": cluster{"PDSCH": f64, "PDCCH": f64, "sync": f64}
  "Evaluation Errors": u32
  "External MAC Output": string
  "device bandwidth": u16
  "IP Packets Size Exeeded Count": u32
  "Received Confirmations": T13
  "Negatives": u32
  "MPDU Disassembly Failed": bool  # specific error cleared? indicates whether the error referenced by specific error code to clear has been cleared.
types:
  T1 = cluster{"f0": f64, "df": f64, "magnitude": f64[]}
  "USRP RX RF Port.gtype" = enum{"RX1/RF0", "RX2/RF0", "RX1/RF1", "RX2/RF1"}
  T2 = cluster{"RNTI": u16, "Use UERS": bool, "Antenna Port": UFXP(4.0), "CCE Offset": u8}
  T3 = enum{"MCS 0 (QPSK, rate ~0.12)", "MCS 1 (QPSK, rate ~0.15)", "MCS 2 (QPSK, rate ~0.19)", "MCS 3 (QPSK, rate ~0.25)", "MCS 4 (QPSK, rate ~0.30)", "MCS 5 (QPSK, rate ~0.37)", "MCS 6 (QPSK, rate ~0.44)", "MCS 7 (QPSK, rate ~0.51)", "MCS 8 (QPSK, rate ~0.59)", "MCS 9 (QPSK, rate ~0.66)", "MCS 10 (16-QAM, rate ~0.33)", "MCS 11 (16-QAM, rate ~0.37)", "MCS 12 (16-QAM, rate ~0.42)", "MCS 13 (16-QAM, rate ~0.48)", "MCS 14 (16-QAM, rate ~0.54)", "MCS 15 (16-QAM, rate ~0.60)", "MCS 16 (16-QAM, rate ~0.64)", "MCS 17 (64-QAM, rate ~0.43)", "MCS 18 (64-QAM, rate ~0.46)", "MCS 19 (64-QAM, rate ~0.50)", "MCS 20 (64-QAM, rate ~0.55)", "MCS 21 (64-QAM, rate ~0.60)", "MCS 22 (64-QAM, rate ~0.65)", "MCS 23 (64-QAM, rate ~0.70)", "MCS 24 (64-QAM, rate ~0.75)", "MCS 25 (64-QAM, rate ~0.80)", "MCS 26 (64-QAM, rate ~0.85)", "MCS 27 (64-QAM, rate ~0.89)", "MCS 28 (64-QAM, rate ~0.93)"}
  "DCI Message.gtype" = cluster{"Active": bool, "MCS": T3, "Resource Block Allocation (4 PRB/bit)": UFXP(25.0)}
  "Transport Session.gtype" = cluster{"FIFO pathname": string, "pipe reader": "Pipe Reader.gtype", "pipe writer": "Pipe Writer.gtype", "transport in RT FIFO": RTFifoRefnum<u8[]>, "transport out RT FIFO": RTFifoRefnum<u8[]>, "transport in timing source name": string, "transport in timing trigger ID": u8, "transport out timing source name": string, "transport out timing trigger ID": u8, "maximum API message size": u32}
  "Register Bus Session.gtype" = Queue<"Session Data.gtype">
  "Semaphore.gtype" = i32
  "DB Queue Reference.gtype" = Queue<"Daughterboard Data.gtype">
  "niUsrpRio Session.gtype" = cluster{"FPGA Interface": any, "RIO Interface Number": u32, "Data Clock Rate": u32, "FPGA Data Clock Rate": u32, "Global Settings Register Bus": "Register Bus Session.gtype", "Radio 0 Settings Register Bus": "Register Bus Session.gtype", "Radio 1 Settings Register Bus": "Register Bus Session.gtype", "Radio Settings Bus Semaphore": "Semaphore.gtype", "DB Queues": "DB Queue Reference.gtype"[], "Characterization Data Valid?": bool, "EEPROM Header": "EEPROM Header.gtype", "Device Data Header": "EEPROM Device Data Header.gtype", "EEPROM Characterization Header": "EEPROM Characterization Header.gtype", "Characterization Data": "Characterization Data.gtype"[], "FPGA Current Version": u32, "FPGA Oldest Compatible Version": u32, "Fixed Logic Current Version": u32, "Fixed Logic Oldest Compatible Version": u32, "FPGA Radio Settings Bus Current Version": u32, "FPGA Radio Settings Bus Oldest Compatible Version": u32, "FPGA Board Config Current Version": u32, "FPGA Board Config Oldest Compatible Version": u32, "Daughterboard Clock Rate": u32}
  T4 = cluster{"FPGA ref": any, "bus instance": u32, "instruction FIFO depth": u32, "executing on FPGA target": bool, "show error call chain": bool}
  T5 = cluster{"Actual Gain [dB]": f64, "Attenuation Table Index": i32}
  T6 = cluster{"Attenuation Table [dB]": f64[][], "Frequencies [Hz]": f64[], "IQ Imbalance Table": "IQ Imbalance.gtype"[], "Gain Table": T5[][]}
  T7 = cluster{"FlexRIO Register Bus": Queue<T4>, "RX Characterization Data": T6, "TX Characterization Data": T6, "FPGA Interface": any}
  T8 = cluster{"transport block size": u32, "CRC ok": bool, "user data": u32}
  "Link Direction.gtype" = enum{"DL", "UL"}
  T9 = cluster{"MAC Stub RX Payload Information FIFO": RTFifoRefnum<"MAC Stub RX Payload Information.gtype">, "MAC Stub RX Confirmation Information FIFO": RTFifoRefnum<u64[16]>, "MAC Stub RX UL Payload Information FIFO": RTFifoRefnum<f64[23]>}
  T10 = cluster{"MAC Stub TX Input Terminals FIFO": RTFifoRefnum<"MAC Stub TX Input Terminals.gtype">, "MAC Stub TX Output Terminals FIFO": RTFifoRefnum<"MAC Stub TX Output Terminals.gtype">}
  T11 = cluster{"MAC Stub RX Interface": T9, "MAC Stub TX Interface": T10}
  "Host Session.gtype" = cluster{"target": enum{"USRP", "FlexRIO"}, "real time mode": bool, "MAC Stub enabled": bool, "DMA FIFO read timeout": i32, "timed loop period": i64, "LTE Transport Sessions": "Transport Session.gtype"[], "USRP session": "niUsrpRio Session.gtype", "FlexRIO session": T7, "UDP RX session": UdpNetworkConnectionRefnum, "UDP TX session": UdpNetworkConnectionRefnum, "sync found FIFO": RTFifoRefnum<bool>, "PDCCH CRC OK FIFO": RTFifoRefnum<bool>, "DL PDCCH status FIFO": RTFifoRefnum<cluster{"CRC ok": bool, "subframe number": u32}>, "DL PDSCH status FIFO": RTFifoRefnum<cluster{"CRC ok": bool, "subframe number": u32}>, "DL SINR FIFO": RTFifoRefnum<f64[]>, "PDSCH user data FIFO": RTFifoRefnum<u32>, "PDSCH user data UDP FIFO": RTFifoRefnum<T8>, "PDSCH user data throughput FIFO": RTFifoRefnum<T8>, "PUSCH user data FIFO": RTFifoRefnum<u32>, "PUSCH user data UDP FIFO": RTFifoRefnum<T8>, "PUSCH user data throughput FIFO": RTFifoRefnum<T8>, "UE feedback info FIFO": RTFifoRefnum<u8[]>, "Request information FIFO": RTFifoRefnum<"Request Information.gtype">, "UDP TX outbound FIFO": RTFifoRefnum<u8[]>, "UDP RX inbound FIFO": RTFifoRefnum<u8[]>, "stop notifier": Notifier<string>, "DL RX scope": string, "UL RX scope": string, "external MAC log file": string, "external MAC process ID": u32, "TX link direction": "Link Direction.gtype", "RX link direction": "Link Direction.gtype", "Sychronization FIFO": RTFifoRefnum<i32>, "RT Loop Interfaces": T11}
  T12 = enum{"PDSCH (overall)", "PDSCH (CRC ok)", "User data (to UDP)"}
  "Confirmation States.gtype" = enum{"Success", "Unknown Message", "Message not Supported", "Unknown Parameter (Set)", "Missing Parameter (Set)", "Parameter (Set) Repetition", "Range Violation", "State Violation", "Timeout", "Config Payload Mismatch", "Length Mismatch", "Input Buffer Full", "Internal Error", "Instance ID Mismatch"}
  T13 = cluster{"Element 1": "Confirmation States.gtype"[], "Value": u64[]}
  "MAC Stub RX Payload Information.gtype" = cluster{"RX Indication CRC OK": bool, "MPDU Disassembly Failed": bool, "Radio Frame Number": u16, "Reported WB SINR": f64, "DL error rate": f64}
  "MAC Stub TX Input Terminals.gtype" = cluster{"TX Frame Structure": enum{"FDD", "TDD 5 5"}, "eNB TX UE Context": T2, "eNB TX DCI": "DCI Message.gtype", "Wideband SINR": f64, "Rate Adaption": bool, "SINR Offset": f64}
  "MAC Stub TX Output Terminals.gtype" = cluster{"eNB TX DCI": "DCI Message.gtype", "IP Packets Size Exeeded Count": u32}
  "DTP Send Status.gtype" = cluster{"send packet counter": u32, "network too slow counter": u32}
  "DTP Pending Data.gtype" = cluster{"expected size": u32, "payload": u8[]}
uses:
  AFW::LTE::RF Control::DL Host Initialization.gvi
  AFW::LTE::MAC::Read External MAC Output.gvi
  NI::G Core::Error::Display Error.gvi
  AFW::LTE::L1L2 API::Transport::Transport.gvi
  AFW::LTE::Utilities::Write Configuration to RT.gvi
  AFW::LTE::Utilities::Read Status from RT.gvi
  AFW::Common::Check Stop.gvi
  AFW::Common::Stop On Error.gvi
  AFW::LTE::L1L2 API::Transport::Get Transport Session.gvi
  AFW::LTE::Utilities::Check Loop Stop Condition.gvi
  AFW::LTE::L1L2 API::Transport::Transport Read From Transport.gvi
  AFW::LTE::L1L2 API::Decode General Message Header.gvi
  NI::G Core::Error::Build Error Cluster.gvi
  AFW::LTE::L1L2 API::Handle DL TX Confirm.gvi
  AFW::LTE::L1L2 API::PHY Receive RX Indication.gvi
  AFW::LTE::MAC::MAC PDU Disassembly.gvi
  NI::G Core::Error::Filter Error Code.gvi
  AFW::LTE::Conversion::Remove Timed Loop Abort Error.gvi
  AFW::LTE::PHY SAP::Receive Timing Indication RT.gvi
  AFW::Common::Timing Measurement::Get Time.gvi
  AFW::LTE::MAC::TTI Counter to SFN and TTI.gvi
  AFW::Common::Counters::Counter U16 Dominant Increment.gvi
  AFW::LTE::L1L2 API::Encode PHY SAP Timing Indication.gvi
  AFW::LTE::L1L2 API::Transport::Transport Send To Transport.gvi
  AFW::LTE::Configuration::Send Dynamic DL RX Configuration.gvi
  AFW::LTE::L1L2 API::PHY TX Request Confirm Handler.gvi
  AFW::LTE::Configuration::Send Dynamic DL TX Configuration.gvi
  AFW::LTE::PHY SAP::Send Dynamic DL Tx Payload.gvi
  AFW::Common::Timing Measurement::Get and Hold Maximum.gvi
  AFW::LTE::PHY SAP::Receice PDSCH Decoding Status.gvi
  AFW::LTE::Conversion::PDSCH Channel Decoder Status from U32.gvi
  AFW::LTE::PHY SAP::Receive PDSCH MAC PDU.gvi
  AFW::LTE::L1L2 API::Encode PHY SAP DL RX Indication.gvi
  NI::G Core::Error::Filter Error Codes.gvi
  NI::G Core::Error::Is Error.gvi
  AFW::LTE::L1L2 API::PHY Receive Timing Indication.gvi
  AFW::LTE::Conversion::Check Subframe for Transmit.gvi
  AFW::LTE::Conversion::MCS Regulation.gvi
  AFW::LTE::MAC::MAC Prepare Tx Config.gvi
  AFW::LTE::MAC::MAC PDU Assembly.gvi
  AFW::LTE::L1L2 API::PHY TX Request Confirm Abstraction.gvi
  AFW::LTE::MAC::MAC Enque Requests.gvi
  AFW::LTE::Configuration::Receive Timing Indication.gvi
  AFW::LTE::UDP Interface::Receive UDP Data.gvi
  AFW::LTE::UDP Interface::Send UDP Data.gvi
  AFW::LTE::Conversion::Determine Configuration Trigger.gvi
  AFW::LTE::Configuration::Disable DL RX.gvi
  AFW::LTE::Configuration::Setup DL RX Baseband.gvi
  AFW::LTE::Configuration::Setup DL Loopback.gvi
  AFW::LTE::RF Control::Setup RX.gvi
  AFW::LTE::Configuration::Disable DL TX.gvi
  AFW::LTE::Configuration::Setup DL TX Baseband.gvi
  AFW::LTE::RF Control::Setup TX.gvi
  AFW::LTE::Configuration::Setup DL TX Set Active.gvi
  AFW::LTE::UDP Interface::Check UDP Port In Use.gvi
  AFW::Common::Create Stop.gvi
  AFW::LTE::Utilities::Trigger Stop Timed Loops.gvi
  AFW::LTE::Conversion::Read PDSCH Decoder Status.gvi
  AFW::LTE::Conversion::Get ADC and IFFT Status.gvi
  AFW::LTE::Conversion::Read DL BB Power and sync status.gvi
  AFW::LTE::Conversion::Read TX BB Power.gvi
  AFW::LTE::RF Control::Calculate Power Calibration Offset.gvi
  AFW::LTE::RF Control::Control Power Gain.gvi
  AFW::LTE::RF Control::Apply AGC Output.gvi
  AFW::LTE::Conversion::Read TX Data.gvi
  AFW::LTE::Conversion::Calculate TX Power Spectrum.gvi
  AFW::LTE::Conversion::Read RX Data.gvi
  AFW::LTE::Conversion::Calculate RX Power Spectrum.gvi
  AFW::LTE::Conversion::Read PDCCH Data.gvi
  AFW::LTE::Conversion::Read Constellation Data.gvi
  AFW::LTE::Conversion::Read Channel Estimates.gvi
  AFW::LTE::Conversion::Calculate DL Throughput and BLER.gvi
  AFW::LTE::Conversion::Collect DL Status Info.gvi
  AFW::LTE::RF Control::DL Host Cleanup.gvi
  AFW::LTE::Conversion::LTE Generate Error Report.gvi
diagram:
  sequence {
    frame 0 {
      # Set Controls to default values
      $"L1-L2 Interface active" <- FALSE
      $"eNB Transmitter" <- FALSE
      $"UE Receiver" <- FALSE
      $"FPGA Ready" <- FALSE
      $"UE RX Active" <- FALSE
      $"eNB TX Active" <- FALSE
      $"TX starting" <- FALSE
      $"Sync Found" <- FALSE
      $"PDSCH Constellation" <- c128[] []
      $"PDCCH Constellation" <- c128[] []
      Build Array(f64[] [], f64[] [], f64[] []) -> w1
      $"DL throughput" <- w1
      $"UE Failure / Block Error Rate (BLER)" <- w1
      $"channel estimation" <- w1
      $"UE RX Power Spectrum" <- T1 {all zero or empty}
      $"eNB TX Power Spectrum" <- T1 {all zero or empty}
      $"eNB Coerced Max RF TX Power" <- 0
      $"UE Coerced Gain" <- 0
      $"Wideband SINR" <- 0
      $"DL throughput (current)" <- 0
      $"Subband SINR [dB]" <- f64[] []
      $"PDCCH Received DCI Message" <- "DCI Message.gtype"[] []
      $"Error Report" <- ""
    }
  }
  sequence {
    frame 0 {
      w2 = $Arguments
      w3 = $Command
      w4 = $"External MAC"
      w5 = $session
      w6 = $"RIO Device"
      w7 = $"Reference Clock Source"
      w8 = $"Transport Instance ID"
    }
  }
  call "DL Host Initialization.gvi"(reference clock source=w7, transport instance id=w8, session in=w5, USRP device=w6, error in=no error, external MAC=w4, command=w3, arguments=w2) -> (session out=w9, device bandwidth=w10, error out=w11)
  call "Read External MAC Output.gvi"(session=w9, error in=w11, full log=TRUE) -> (session dup=w12, external MAC log output=w13, error out=w14)
  sequence {
    frame 0 {
      $session <- w12
      call "Display Error.gvi"(type of dialog="continue or stop message", error in=w14)
      $"L1-L2 Interface active" <- TRUE
    }
  }
  disable {
    frame TARGET_TYPE == "RT", Default {
      call "Transport.gvi"(session=w12, error in=w14) -> (error out=w16)
      s1 = w14  # shift register
      while {
        Wait Until Next Multiple(multiple to wait=100)
        call "Write Configuration to RT.gvi"(session in=w12, eNB TX DCI in=$"eNB TX DCI", eNB TX UE context=$"eNB TX UE Context", eNB TX frame structure=$"eNB TX Frame Structure", error in=s1, rate adaption=$"Rate Adaption", SINR offset=$"SINR Offset", wideband SINR=$"Wideband SINR") -> (session dup=w17, eNB TX DCI out=w18, IP packets size exeeded count=w19, error out=w20)
        case ($"Rate Adaption") {
          frame False, Default { }
          frame True {
            $"eNB TX DCI" <- w18
          }
        }
        call "Read Status from RT.gvi"(session in=w17, error in=w20) -> (negatives=w21, evaluation errors=w22, received confirmations=w23, error out=w24, DL RX indication CRC OK=w25, MPDU disassembly failed=w26)
        $"DL RX Indication CRC OK" <- w25
        $"MPDU Disassembly Failed" <- w26
        $Negatives <- w21
        call "Check Stop.gvi"(error in=w24) -> (error out=w27, stop=w28)
        $"Evaluation Errors" <- w22
        $"Received Confirmations" <- w23
        $"IP Packets Size Exeeded Count" <- w19
        next s1 = w27
        stop if w28
      }
      call "Stop On Error.gvi"(error in=s1) -> (error out=w29)
      call "Get Transport Session.gvi"(Session=w12, Transport Session Select="Transport PHY to MAC") -> (Session dup=w30, LTE Transport Session=w31)
      Property Node(instance in=w31) -> ("transport out timing source name"=w32)
      w33 = 98  # priority in
      # Transport layer moves packets from L1 to MAC Stub implementation or external MAC
      timed loop {
        # MAC Stub: handle RX messages
        Left Execution System Border Node(priority_in=w33)
        Left Timing Source Border Node[AlarmName=L, DefaultTimingSourceName="1 MHz", DefaultTimingSourceType=2](mode_in="Process missed periods, ignore original phase", period_in=1, source_in=w32, structure_in="MAC Stub Rx")
        call "Get Transport Session.gvi"(Session=w30, Transport Session Select="Transport PHY to MAC") -> (Session dup=w34, LTE Transport Session=w35)
        Left Timing Error Border Node(error_in=w14) -> (error_out=w36)
        call "Check Loop Stop Condition.gvi"(session in=w30, error in=w36) -> (stop execution=w37, error out=w38)
        Not(x=w37) -> w39
        call "Transport Read From Transport.gvi"(API transport session=w35, allow read fail=w39, error in=w38) -> (transport out=w40, transport read success=w41, error out=w42)
        case (w41) {
          frame False {
            w43 = w42
          }
          frame True {
            Property Node(instance in=w34) -> ("RT Loop Interfaces:MAC Stub RX Interface"=w44, instance out=w45)
            call "Decode General Message Header.gvi"(message data in=w40, error in=w42) -> (decoded general message header=w46, error out=w47)
            Property Node(instance in=w46) -> ("message type ID"=w48)
            case (w48) {
              frame 0, Default {
                call "Build Error Cluster.gvi"(code=-1, description="MAC Stub Rx: unexpected API message", error in=w47) -> (error out=w43)
              }
              frame 16898 {
                Property Node(instance in=w44) -> ("MAC Stub RX Confirmation Information FIFO"=w49)
                # PHY_CNF
                Property Node(instance in=w45) -> ("Request information FIFO"=w50)
                call "Handle DL TX Confirm.gvi"(RT FIFO reference=w50, api transport in=w40, clear confirmation errors=TRUE, error in=w47) -> (confirm received counts=w51, negative confirm received count=w52, confirmation evaluation error count=w53, error out=w54)
                Property Node(instance in=w51) -> ("Value"=w55)
                To Unsigned 64 Bit Integer(number=w52) -> w56
                To Unsigned 64 Bit Integer(number=w53) -> w57
                Build Array(w55, w56, w57) -> w58
                Type Cast(type=u64[16] [0, 0, 0, 0, 0, 0, 0, 0, 0, 0, 0, 0, 0, 0, 0, 0], x=w58) -> w59
                RTFIFO Write(element=w59, error in=w54, overwrite on timeout=TRUE, rt fifo=w49, timeout in ms=0) -> (error out=w43)
              }
              frame 18433 {
                call "PHY Receive RX Indication.gvi"(api transport in=w40, expected device location="UE", error in=w47) -> (MAC RX Config=w60, MAC PDU=w61, error out=w62)
                # PHY_DLSCH_RX_IND
                Property Node(instance in=w60) -> ("CRC Result"=w63)
                Is Greater Than 0(x=w63) -> w64
                case (w64) {
                  frame False, Default {
                    w65 = w62
                    w66 = FALSE
                  }
                  frame True {
                    Property Node(instance in=w45) -> ("UDP RX inbound FIFO"=w67, instance out=w68)
                    call "MAC PDU Disassembly.gvi"(MAC PDU=w61, error in=w62, FIFO in=w67) -> (bytes=w69, error out=w70)
                    call "Filter Error Code.gvi"(code to clear=-1, error in=w70) -> (error cleared?=w66, error out=w71)
                    case (w66) {
                      frame True {
                        w65 = w71
                      }
                      frame False {
                        Property Node(instance in=w68) -> ("PDSCH user data FIFO"=w72)
                        To Unsigned 32 Bit Integer(number=w69) -> w73
                        # bytes to bits
                        Scale By Power Of 2(n=3, x=w73) -> w74
                        RTFIFO Write(element=w74, error in=w71, rt fifo=w72) -> (error out=w65)
                      }
                    }
                  }
                }
                Property Node(instance in=w44) -> ("MAC Stub RX Payload Information FIFO"=w75)
                Property Node(instance in="MAC Stub RX Payload Information.gtype" {all zero or empty}, "MPDU Disassembly Failed"=w66, "RX Indication CRC OK"=w64) -> (instance out=w76)
                RTFIFO Write(element=w76, error in=w62, overwrite on timeout=TRUE, rt fifo=w75, timeout in ms=0) -> (error out=w77)
                Merge Errors(w65, w77) -> (error out=w43)
              }
            }
          }
        }
        Right Timing Error Border Node(error_in=w43) -> (error_out=w78)
        Left Timing Statistics Border Node() -> (wakeupreason_out=w79)
        stop if w37
      }
      call "Remove Timed Loop Abort Error.gvi"(error in=w78, wake up reason=w79) -> (error out=w80)
      call "Stop On Error.gvi"(error source prefix="MAC Stub Rx", error in=w80) -> (error out=w81)
      w82 = 100  # priority in
      Property Node(instance in=w12) -> ("timed loop period"=w83)
      timed loop {
        # receive PHY TTI timing indication (one per ms)
        Left Execution System Border Node(priority_in=w82)
        Left Timing Statistics Border Node()
        Left Timing Error Border Node(error_in=w14) -> (error_out=w84)
        call "Check Loop Stop Condition.gvi"(session in=w12, error in=w84) -> (stop execution=w85, session dup=w86, error out=w87)
        call "Receive Timing Indication RT.gvi"(session=w86, eNB TX Active=$"eNB TX Active", error in=w87) -> (subframe index=w88, subframe index valid=w89, error out=w90)
        case (w89) {
          frame False {
            w91 = w90
            w92 = w12
            w93 = w89
          }
          frame True, Default {
            call "Get Transport Session.gvi"(Session=w12, Transport Session Select="Transport PHY Timing to MAC") -> (Session dup=w92, LTE Transport Session=w94)
            call "Get Time.gvi"(error in_2=w90) -> (tick count (us)=w95, error out_2=w96)
            call "TTI Counter to SFN and TTI.gvi"(TTI counter=w88, error in=w96) -> (SFN=w97, TTI=w98, error out=w99)
            call "Counter U16 Dominant Increment.gvi"() -> (count out=w100)
            call "Encode PHY SAP Timing Indication.gvi"(reference ID=w100, SFN=w97, TTI index=w98, error in=w99) -> (encoded PHY SAP Timing Indication=w101, error out=w102)
            call "Transport Send To Transport.gvi"(API transport session=w94, transport in=w101, error in=w102) -> (error out=w91)
            $SFN <- w97
            $TTI <- w98
            $"PHY Timing Indication Received" <- w95
            w93 = w89
          }
        }
        Logical And(w93, $"UE RX Active") -> w103
        case (w103) {
          frame False, Default {
            w104 = w91
          }
          frame True {
            call "Send Dynamic DL RX Configuration.gvi"(session=w92, UE context=$"UE RX UE Context", error in=w91) -> (error out=w104)
          }
        }
        Right Timing Error Border Node(error_in=w104) -> (error_out=w105)
        Left Timing Source Border Node[AlarmName=L, DefaultTimingSourceName="1 MHz", DefaultTimingSourceType=2](mode_in="Discard missed periods, ignore original phase", period_in=w83, structure_in="PHY SAP Tim")
        stop if w85
      }
      call "Stop On Error.gvi"(error source prefix="PHY SAP Tim", error in=w105) -> (error out=w106)
      call "Get Transport Session.gvi"(Session=w12, Transport Session Select="Transport MAC to PHY") -> (Session dup=w107, LTE Transport Session=w108)
      Property Node(instance in=w108) -> ("transport out timing source name"=w109)
      w110 = 99  # priority in
      timed loop {
        Left Execution System Border Node(priority_in=w110)
        # handover TX request to PHY FPGA
        Left Timing Statistics Border Node()
        call "Get Transport Session.gvi"(Session=w107, Transport Session Select="Transport MAC to PHY") -> (Session dup=w111, LTE Transport Session=w112)
        Left Timing Error Border Node(error_in=w14) -> (error_out=w113)
        call "Check Loop Stop Condition.gvi"(session in=w107, error in=w113) -> (stop execution=w114, error out=w115)
        Not(x=w114) -> w116
        call "Transport Read From Transport.gvi"(API transport session=w112, allow read fail=w116, error in=w115) -> (transport out=w117, transport read success=w118, error out=w119)
        call "Get Time.gvi"(error in=w119) -> (error out=w120, tick count (us)=w121)
        Subtract(x=w121, y=$"PHY Timing Indication Received") -> w122
        w123 = 700  # maximal allowed TX processing time [us]
        # reserve time buffer to transmit TX data to FPGA
        Is Greater(x=w122, y=w123) -> w124
        case (w118) {
          frame True {
            Property Node(instance in=$"eNB TX UE Context") -> ("Use UERS"=w127)
            call "PHY TX Request Confirm Handler.gvi"(TX request too late=w124, api transport in=w117, Expected SFN=$SFN, Expected TTI index=$TTI, Expected Device Location="eNB", error in=w120, frame structure=$"eNB TX Frame Structure", use UERS=w127) -> (output valid=w128, api transport out=w129, TX UE Context=w130, TX DCI=w131, TX Data=w132, error out=w133)
            Logical And(w128, $"eNB TX Active") -> w126
            case (w126) {
              frame False, Default {
                w134 = w133
                w135 = w111
              }
              frame True {
                call "Send Dynamic DL TX Configuration.gvi"(session=w111, UE context=w130, DCI in=w131, error in=w133) -> (session dup=w136, error out=w137)
                call "Send Dynamic DL Tx Payload.gvi"(session in=w136, TX data=w132, error in=w137) -> (session out=w135, error out=w134)
              }
            }
            Array Size(array=w129) -> (size(s)=w138)
            Is Greater Than 0(x=w138) -> w139
            case (w139) {
              frame False, Default {
                call "Build Error Cluster.gvi"(code=-1, description="Confirmation message response is empty.", error in=w134) -> (error out=w125)
              }
              frame True {
                call "Get Transport Session.gvi"(Session=w135, Transport Session Select="Transport PHY to MAC") -> (LTE Transport Session=w140)
                call "Transport Send To Transport.gvi"(API transport session=w140, transport in=w129, error in=w134) -> (error out=w125)
              }
            }
          }
          frame False {
            w125 = w120
            w126 = w118
          }
        }
        call "Get Time.gvi"(error in=w125) -> (error out=w141, tick count (us)=w142)
        Right Timing Error Border Node(error_in=w141) -> (error_out=w143)
        Left Timing Source Border Node[AlarmName=L, DefaultTimingSourceName="1 MHz", DefaultTimingSourceType=2](mode_in="Process missed periods, ignore original phase", period_in=1, source_in=w109, structure_in="PHY SAP Tx")
        case (w126) {
          frame True {
            Subtract(x=w142, y=$"PHY Timing Indication Received") -> w144
            call "Get and Hold Maximum.gvi"(value=w144) -> (max value=w145)
            $"Max MAC TX Delay" <- w145
          }
          frame False { }
        }
        stop if w114
      }
      call "Stop On Error.gvi"(error source prefix="PHY SAP Tx", error in=w143) -> (error out=w146)
      w147 = 98  # priority in
      Property Node(instance in=w12) -> ("timed loop period"=w148)
      timed loop {
        Left Execution System Border Node(priority_in=w147)
        Left Timing Statistics Border Node()
        Left Timing Error Border Node(error_in=w14) -> (error_out=w149)
        call "Check Loop Stop Condition.gvi"(session in=w12, error in=w149) -> (stop execution=w150, session dup=w151, error out=w152)
        call "Receice PDSCH Decoding Status.gvi"(session=w151, error in=w152) -> (PDSCH Decoding Status=w153, PDSCH Decoding Status valid=w154, error out=w155)
        case (w154) {
          frame False, Default {
            w156 = w155
          }
          frame True {
            Property Node(instance in=w12) -> ("PDSCH user data throughput FIFO"=w157, instance out=w158)
            call "PDSCH Channel Decoder Status from U32.gvi"(bit vector in=w153) -> (PDSCH decoder status=w159)
            Property Node(instance in=w159) -> ("user data"=w160, "transport block size"=w161, "CRC ok"=w162, instance out=w163)
            RTFIFO Write(element=w163, error in=w155, rt fifo=w157) -> (error out=w164)
            call "Receive PDSCH MAC PDU.gvi"(session=w158, transport block size=w161, error in=w164) -> (MAC PDU=w165, error out=w166)
            call "Get Transport Session.gvi"(Session=w158, Transport Session Select="Transport PHY to MAC") -> (LTE Transport Session=w167)
            call "Counter U16 Dominant Increment.gvi"() -> (count out=w168)
            To Unsigned 8 Bit Integer(number=w160) -> w169
            Property Node(instance in=$"UE RX UE Context") -> ("RNTI"=w170)
            Boolean To 0 Or 1(Boolean=w162) -> (0, 1=w171)
            To Unsigned 8 Bit Integer(number=w171) -> w172
            Array Size(array=w165) -> (size(s)=w173)
            To Unsigned 32 Bit Integer(number=w173) -> w174
            call "Encode PHY SAP DL RX Indication.gvi"(reference ID=w168, SFN=0, TTI index=w169, MAC PDU=w165, MAC PDU Size=w174, RNTI=w170, CRC Result=w172) -> (encoded UL RX Indication=w175)
            call "Transport Send To Transport.gvi"(API transport session=w167, transport in=w175, error in=w166) -> (error out=w156)
          }
        }
        Right Timing Error Border Node(error_in=w156) -> (error_out=w176)
        Left Timing Source Border Node[AlarmName=L, DefaultTimingSourceName="1 MHz", DefaultTimingSourceType=2](mode_in="Discard missed periods, ignore original phase", period_in=w148, structure_in="PHY SAP Rx")
        stop if w150
      }
      call "Stop On Error.gvi"(error source prefix="PHY SAP Rx", error in=w176) -> (error out=w177)
      s2 = w14  # shift register
      while {
        Wait(time to wait=1)
        Property Node(instance in=$session) -> ("UDP TX outbound FIFO"=w178, "UDP TX session"=w179, "UDP RX session"=w180, "UDP RX inbound FIFO"=w181)
        s3 = s2  # shift register
        while {
          Udp Read I Pv 6 Binary(connection ID=w179, error in=s3, max size=10240, timeout ms=0) -> (data out=w184, error out=w185)
          call "Filter Error Codes.gvi"(codes to clear=[1, 113, 66, 56], error in=w185) -> (codes cleared=w186, error cleared?=w187, error out=w188)
          Search 1D Array(1D array=w186, element=113) -> (index of element=w189)
          Is Greater Or Equal To 0(x=w189) -> w190
          Search 1D Array(1D array=w186, element=56) -> (index of element=w191)
          Is Greater Or Equal To 0(x=w191) -> w192
          Not(x=w192) -> w193
          Is Empty Array(array=w184) -> w194
          Not(x=w194) -> w195
          Logical And(w193, w195) -> w196
          case (w187) {
            frame True {
              w197 = w188
            }
            frame False {
              RTFIFO Write(element=w184, error in=w188, overwrite on timeout=TRUE, rt fifo=w178, timeout in ms=0) -> (error out=w197)
            }
          }
          call "Is Error.gvi"(error in=w197) -> (error?=w198)
          Logical Or(w198, w187, w194) -> w199
          append w190 to w182
          append w196 to w183
          next s3 = w197
          stop if w199
        }
        Or Array Elements(Boolean array=w182) -> (logical OR=w200)
        $"Packet Loss In" <- w200
        Or Array Elements(Boolean array=w183) -> (logical OR=w201)
        $"Data Transfer In" <- w201
        s4 = s2  # shift register
        while {
          RTFIFO Read(error in=s4, rt fifo=w181, timeout in ms=0) -> (element out=w204, empty?=w205, error out=w206)
          Array Size(array=w204) -> (size(s)=w207)
          case (w205) {
            frame True {
              w208 = w206
              w209 = FALSE
            }
            frame False {
              Udp Write Binary(address=$"Transmit IP Address", connection ID=w180, data in=w204, error in=w206, port or service name=$"UDP Transmit Port", timeout ms=0) -> (error out=w210)
              w211 = 55  # UDP timeout
              call "Filter Error Code.gvi"(error in=w210, code to clear=w211) -> (error out=w208, error cleared?=w209)
            }
          }
          call "Is Error.gvi"(error in=w208) -> (error?=w212)
          Logical Or(w209, w212) -> w213
          Logical Or(w213, w205) -> w214
          append w209 to w202
          append w207 to w203
          next s4 = w208
          stop if w214
        }
        Merge Errors(s3, s4) -> (error out=w215)
        call "Check Stop.gvi"(error in=w215) -> (error out=w216, stop=w217)
        Add Array Elements(numeric array=w203) -> (sum=w218)
        Scale By Power Of 2(n=3, x=w218) -> w219
        Is Greater Than 0(x=w219) -> w220
        $"Data Transfer Out" <- w220
        Or Array Elements(Boolean array=w202) -> (logical OR=w221)
        $"Packet Loss Out" <- w221
        next s2 = w216
        stop if w217
      }
      call "Stop On Error.gvi"(error in=s2) -> (error out=w222)
      call "Get Transport Session.gvi"(Session=w12, Transport Session Select="Transport PHY Timing to MAC") -> (Session dup=w223, LTE Transport Session=w224)
      Property Node(instance in=w224) -> ("transport out timing source name"=w225)
      w226 = 100  # priority in
      s5 = "MAC Stub TX Input Terminals.gtype" {all zero or empty}  # shift register
      timed loop {
        # MAC Stub: handle TX messages
        Left Execution System Border Node(priority_in=w226)
        Left Timing Source Border Node[AlarmName=L, DefaultTimingSourceName="1 MHz", DefaultTimingSourceType=2](mode_in="Process missed periods, ignore original phase", period_in=1, source_in=w225, structure_in="MAC Stub Tx")
        call "Get Transport Session.gvi"(Session=w223, Transport Session Select="Transport PHY Timing to MAC") -> (Session dup=w227, LTE Transport Session=w228)
        Left Timing Error Border Node(error_in=w14) -> (error_out=w229)
        call "Check Loop Stop Condition.gvi"(session in=w223, error in=w229) -> (stop execution=w230, session dup=w231, error out=w232)
        Property Node(instance in=w231) -> ("RT Loop Interfaces:MAC Stub TX Interface:MAC Stub TX Input Terminals FIFO"=w233)
        RTFIFO Read(element=s5, error in=w232, rt fifo=w233) -> (element out=w234, error out=w235)
        Not(x=w230) -> w236
        call "Transport Read From Transport.gvi"(API transport session=w228, allow read fail=w236, error in=w235) -> (transport out=w237, transport read success=w238, error out=w239)
        Property Node(instance in=w234) -> ("TX Frame Structure"=w240, instance out=w241)
        call "Is Error.gvi"(error in=w239) -> (error?=w242)
        Logical And(w238, not w242) -> w243
        case (w243) {
          frame False {
            w244 = w239
            w245 = w241
          }
          frame True {
            call "PHY Receive Timing Indication.gvi"(api transport in=w237, error in=w239) -> (SFN=w246, TTI index=w247, error out=w248)
            call "Check Subframe for Transmit.gvi"(frame structure=w240, subframe index=w247, UL TX=FALSE, error in=w248) -> (allow DL transmit=w249, error out=w250)
            case (w249) {
              frame False, Default {
                w244 = w250
                w245 = w241
              }
              frame True {
                Property Node(instance in=w241) -> ("eNB TX UE Context"=w251, "eNB TX DCI"=w252, "Wideband SINR"=w253, "SINR Offset"=w254, "Rate Adaption"=w255, instance out=w256)
                case (w255) {
                  frame False, Default {
                    w257 = w252
                    w258 = w250
                    w259 = w251
                    w260 = w247
                    w261 = w246
                    w262 = w240
                  }
                  frame True {
                    call "MCS Regulation.gvi"(DCI in=w252, wideband SNR=w253, SNR offset [dB]=w254, UE context=w251) -> (DCI out=w257)
                    w258 = w250
                    w259 = w251
                    w260 = w247
                    w261 = w246
                    w262 = w240
                  }
                }
                Property Node(instance in=w256, "eNB TX DCI"=w257) -> (instance out=w245)
                Property Node(instance in=w227) -> ("RT Loop Interfaces:MAC Stub TX Interface:MAC Stub TX Output Terminals FIFO"=w263, "Request information FIFO"=w264, "UDP TX outbound FIFO"=w265, instance out=w266)
                w267 = 200  # maximal execution time MPU assembly
                call "MAC Prepare Tx Config.gvi"(frame structure=w262, SFN=w261, TTI index=w260, error in=w258, eNB TX UE Context=w259, eNB TX DCI=w257) -> (MAC TX Config=w268, error out=w269)
                call "MAC PDU Assembly.gvi"(data FIFO in=w265, MAC TX config in=w268, error in=w269, maximal execution time=w267) -> (MAC TX config out=w270, MAC PDU=w271, MAC PDU Size=w272, error out=w273, IP Packets size exceeded=w274)
                call "PHY TX Request Confirm Abstraction.gvi"(MAC TX Config=w270, MAC PDU=w271, MAC PDU Size=w272, error in=w273, Device Location="eNB") -> (api transport out=w275, requests=w276, error out=w277)
                call "Get Transport Session.gvi"(Session=w266, Transport Session Select="Transport MAC to PHY") -> (LTE Transport Session=w278)
                call "MAC Enque Requests.gvi"(RT FIFO reference=w264, requests=w276, error in=w277) -> (error out=w279)
                call "Transport Send To Transport.gvi"(API transport session=w278, transport in=w275, error in=w279) -> (error out=w280)
                Feedback Node(input=w281) -> w282
                Add(w274, w282) -> w281
                Property Node(instance in="MAC Stub TX Output Terminals.gtype" {all zero or empty}, "IP Packets Size Exeeded Count"=w281, "eNB TX DCI"=w257) -> (instance out=w283)
                RTFIFO Write(element=w283, error in=w280, overwrite on timeout=TRUE, rt fifo=w263, timeout in ms=0) -> (error out=w244)
              }
            }
          }
        }
        Right Timing Error Border Node(error_in=w244) -> (error_out=w284)
        Left Timing Statistics Border Node() -> (wakeupreason_out=w285)
        next s5 = w245
        stop if w230
      }
      call "Remove Timed Loop Abort Error.gvi"(error in=w284, wake up reason=w285) -> (error out=w286)
      call "Stop On Error.gvi"(error source prefix="MAC Stub Tx", error in=w286) -> (error out=w287)
      Build Array(w287, w81, w16, w106, w146, w177, w222, w29) -> w15
    }
    frame TARGET_TYPE != "RT" {
      s6 = w14  # shift register
      while {
        # Update dynamic UE contexts
        case ($"eNB TX Active") {
          frame False, Default {
            Wait(time to wait=10)
            w288 = s6
            w289 = TRUE
          }
          frame True {
            call "Receive Timing Indication.gvi"(session=$session, error in=s6) -> (session dup=w290, new timing indication=w289, error out=w291)
            case (w289) {
              frame False, Default {
                w288 = w291
              }
              frame True {
                case ($"Rate Adaption") {
                  frame False, Default {
                    w292 = $"eNB TX DCI"
                    w293 = w291
                  }
                  frame True {
                    call "MCS Regulation.gvi"(DCI in=$"eNB TX DCI", wideband SNR=$"Wideband SINR", SNR offset [dB]=$"SINR Offset", UE context=$"eNB TX UE Context") -> (DCI out=w292)
                    w293 = w291
                  }
                }
                call "Send Dynamic DL TX Configuration.gvi"(session=w290, UE context=$"eNB TX UE Context", DCI in=w292, error in=w293) -> (DCI modified=w294, coerced DCI=w295, error out=w288)
                case (w294) {
                  frame False, Default { }
                  frame True {
                    $"eNB TX DCI" <- w295
                  }
                }
              }
            }
          }
        }
        Logical And($"UE RX Active", w289) -> w296
        # 5
        case (w296) {
          frame False, Default {
            w297 = w288
          }
          frame True {
            call "Send Dynamic DL RX Configuration.gvi"(session=$session, UE context=$"UE RX UE Context", error in=w288) -> (error out=w297)
          }
        }
        call "Check Stop.gvi"(error in=w297) -> (error out=w298, stop=w299)
        next s6 = w298
        stop if w299
      }
      call "Stop On Error.gvi"(error in=s6) -> (error out=w300)
      s7 = w14  # shift register
      s8 = 0  # shift register
      while {
        Wait Until Next Multiple[Units=Microseconds](multiple to wait=1)
        # receive UDP data from network and send it to the FPGA as PDSCH payload data of the transmitter
        call "Receive UDP Data.gvi"(eNB TX active=$"eNB TX Active", session=$session, UDP packet counter in=s8, error in=s7) -> (UDP packet counter out=w301, error out=w302, FIFO full=w303, data transfer=w304)
        $"Packet Loss In" <- w303
        $"Data Transfer In" <- w304
        # 6
        call "Check Stop.gvi"(error in=w302) -> (error out=w305, stop=w306)
        next s7 = w305
        next s8 = w301
        stop if w306
      }
      call "Stop On Error.gvi"(error in=s7) -> (error out=w307)
      s9 = w14  # shift register
      s10 = "DTP Pending Data.gtype" {all zero or empty}  # shift register
      s11 = "DTP Send Status.gtype" {all zero or empty}  # shift register
      while {
        call "Send UDP Data.gvi"(pending data in=s10, session=$session, enable MAC RX=TRUE, UDP send status in=s11, error in=s9, transmit IP address=$"Transmit IP Address", transmit port=$"UDP Transmit Port") -> (pending data out=w308, transferring data=w309, network too slow=w310, UDP send status out=w311, error out=w312)
        # read received PDSCH payload data from FPGA and send it to the specified UDP port
        $"Data Transfer Out" <- w309
        $"Packet Loss Out" <- w310
        Wait Until Next Multiple(multiple to wait=1)
        call "Check Stop.gvi"(error in=w312) -> (error out=w313, stop=w314)
        next s9 = w313
        next s10 = w308
        next s11 = w311
        stop if w314
      }
      call "Stop On Error.gvi"(error in=s9) -> (error out=w315)
      Build Array(w300, w307, w315) -> w15
    }
  }
  s12 = w14  # shift register
  while {
    Wait Until Next Multiple(multiple to wait=100)
    call "Determine Configuration Trigger.gvi"(RX enabled=$"UE Receiver", TX enabled=$"eNB Transmitter") -> (trigger RX configuration=w316, trigger TX configuration=w317)
    # configure eNB RX/TX baseband and RF when enabled
    # 1
    case (w316) {
      frame False, Default {
        w318 = s12
      }
      frame True {
        case ($"UE Receiver") {
          frame False, Default {
            call "Disable DL RX.gvi"(session=$session, error in=s12) -> (error out=w318)
            sequence {
              frame 0 {
                $"UE RX Active" <- FALSE
              }
            }
          }
          frame True {
            Property Node(instance in=$session) -> ("real time mode"=w319)
            call "Setup DL RX Baseband.gvi"(UE context=$"UE RX UE Context", session in=$session, frame structure=$"UE RX Frame Structure", cell ID=$"UE RX Cell ID", error in=s12, real time mode=w319) -> (session dup=w320, error out=w321)
            call "Setup DL Loopback.gvi"(internal DL loopback=FALSE, session in=w320, error in=w321) -> (session dup=w322, error out=w323)
            call "Setup RX.gvi"(session in=w322, RX frequency [Hz]=$"UE RX Frequency", gain value [dB]=$"UE Coerced Gain", error in=w323, RX port=$"UE RX RF Port (USRP)") -> (session out=w324, coerced gain [dB]=w325, coerced frequency [Hz]=w326, error out=w327)
            $session <- w324
            $"UE Coerced Gain" <- w325
            $"UE RX Frequency" <- w326
            case (w327) {
              frame Error {
                $"UE Receiver" <- FALSE
                w318 = w327
              }
              frame No Error {
                $"UE RX Active" <- TRUE
                w318 = w327
              }
            }
          }
        }
      }
    }
    case (w317) {
      frame False, Default {
        w328 = s12
      }
      frame True {
        case ($"eNB Transmitter") {
          frame False, Default {
            sequence {
              frame 0 {
                $"eNB TX Active" <- FALSE
              }
              frame 1 {
                Wait(time to wait=10)
              }
            }
            call "Disable DL TX.gvi"(session=$session, error in=s12) -> (error out=w328)
          }
          frame True {
            Property Node(instance in=$session) -> ("real time mode"=w329)
            case (s12) {
              frame Error {
                w330 = s12
              }
              frame No Error {
                $"TX starting" <- TRUE
                w330 = s12
              }
            }
            call "Setup DL TX Baseband.gvi"(UE context=$"eNB TX UE Context", DCI=$"eNB TX DCI", session in=$session, frame structure=$"eNB TX Frame Structure", cell ID=$"eNB TX Cell ID", error in=w330, UDP receive port=$"UDP Receive Port", real time mode=w329) -> (session out=w331, error out=w332)
            call "Setup TX.gvi"(timing advance=0, session in=w331, TX frequency [Hz]=$"eNB TX Frequency", TX power level [dB]=$"eNB Max RF TX Power", error in=w332, TX port=$"eNB TX RF Port (USRP)", RF timing offset=$"eNB Timing Offset") -> (coerced power level setting [dB]=w333, session dup=w334, coerced output power [dB]=w335, coerced frequency [Hz]=w336, error out=w337)
            $"eNB Coerced Max RF TX Power" <- w335
            $session <- w334
            case (w337) {
              frame No Error, Default {
                $"eNB TX Active" <- TRUE
                $"TX starting" <- FALSE
                call "Setup DL TX Set Active.gvi"(session in=w334, error in=w337) -> (error out=w328)
              }
              frame Error {
                $"eNB Transmitter" <- FALSE
                $"TX starting" <- FALSE
                call "Check UDP Port In Use.gvi"(error in=w337) -> (error out=w328)
              }
            }
            $"eNB TX Frequency" <- w336
            $"eNB Max RF TX Power" <- w333
          }
        }
      }
    }
    Merge Errors(w318, w328) -> (error out=w338)
    call "Create Stop.gvi"(stop in=$stop, error in=w338) -> (error out=w339)
    # synchronize the exit condition across all loops of the host application
    call "Check Stop.gvi"(error in=w339) -> (error out=w340, stop=w341)
    case (w341) {
      frame False, Default {
        w342 = w340
      }
      frame True {
        call "Trigger Stop Timed Loops.gvi"(Session=$session, error in=w340) -> (error out=w342)
        # Disable TX and RX to
        # ensure proper shutdown
        $"UE Receiver" <- FALSE
        $"eNB Transmitter" <- FALSE
      }
    }
    case (s12) {
      frame Error { }
      frame No Error {
        $"FPGA Ready" <- TRUE
      }
    }
    Feedback Node[DelayCount=3](input=w341) -> w343
    next s12 = w342
    stop if w343
  }
  call "Stop On Error.gvi"(error in=s12) -> (error out=w344)
  s13 = w14  # shift register
  while (iteration -> i1) {
    Wait Until Next Multiple(multiple to wait=50)
    disable {
      frame TARGET_TYPE == "RT", Default {
        w345 = $session
        w346 = s13
      }
      frame TARGET_TYPE != "RT" {
        call "Read PDSCH Decoder Status.gvi"(session in=$session, error in=s13) -> (session dup=w345, error out=w346)
      }
    }
    call "Get ADC and IFFT Status.gvi"(session in=w345, error in=w346) -> (RX DDC values clipped=w347, TX IFFT output clipped=w348, session dup=w349, ADC values clipped=w350, error out=w351)
    call "Read DL BB Power and sync status.gvi"(session in=w349, error in=w351) -> (signal detected?=w352, DL frequency offset [Hz]=w353, session dup=w354, RX baseband input power=w355, error out=w356)
    call "Read TX BB Power.gvi"(session in=w354, TX reference level [dBm]=$"eNB Coerced Max RF TX Power", error in=w356) -> (session dup=w357, TX power [dBm]=w358, TX baseband power [dBFS]=w359, error out=w360)
    call "Calculate Power Calibration Offset.gvi"(session in=w357, error in=w360, frequency [Hz]=$"UE RX Frequency") -> (session dup=w361, power calibration offset [dB]=w362, error out=w363)
    $"power calibration offset [dB]" <- w362
    Not(x=$"UE AGC") -> w364
    call "Control Power Gain.gvi"(expected signal range lower bound=-17, use manual gain=w364, BB input power=w355, gain in=$"UE Coerced Gain", manual gain value [dB]=$"UE Manual Gain", expected signal range upper bound=-15, power calibration offset [dB]=w362) -> (RF input power [dBm]=w365, power [dBFS]=w366, gain out=w367)
    # read sync status and baseband power levels from FPGA and feed them into automatic gain control (AGC)
    # use manual gain value if AGC is disabled
    # configure frequency offset on FPGA
    # read PDSCH decoder status
    Logical And($"UE Receiver", $"UE RX Active", not $"TX starting") -> w368
    # 2
    case (w368) {
      frame False, Default {
        w369 = w363
      }
      frame True {
        call "Apply AGC Output.gvi"(session=w361, apply values=w368, AGC output=w367, error in=w363) -> (coerced gain [dB]=w370, error out=w369)
        $"UE Coerced Gain" <- w370
      }
    }
    call "Check Stop.gvi"(error in=w369) -> (error out=w371, stop=w372)
    $"eNB RF TX Power" <- w358
    $"eNB Baseband TX Power" <- w359
    $"UE Baseband RX Power" <- w366
    $"UE RF RX Power" <- w365
    $"UE Applied Gain" <- $"UE Coerced Gain"
    $"UE Frequency Offset" <- w353
    $"Sync Found" <- w352
    $"UE ADC Values Clipped" <- w350
    $"eNB TX IFFT Output Clipped" <- w348
    To Unsigned 32 Bit Integer(number=i1) -> w373
    Quotient And Remainder(x=w373, y=10) -> (x-y*floor(x/y)=w374)
    Is Equal To 0(x=w374) -> w375
    Logical Or(w347, w375) -> w376
    Feedback Node(enable?=w376, input=w347) -> w377
    Feedback Node(enable?=w375, input=w377) -> w378
    $"UE DDC Values Clipped" <- w378
    next s13 = w371
    stop if w372
  }
  call "Stop On Error.gvi"(error in=s13) -> (error out=w379)
  s14 = w14  # shift register
  while (iteration -> i2) {
    Wait Until Next Multiple(multiple to wait=20)
    Quotient And Remainder(x=i2, y=5) -> (x-y*floor(x/y)=w380)
    # read RX/TX baseband data values and PDCCH/PDSCH constellation data from FPGA and draw corresponding diagrams
    case (w380) {
      frame 0, Default {
        call "Read TX Data.gvi"(session=$session, error in=s14) -> (TX baseband data=w382, error out=w383)
        call "Calculate TX Power Spectrum.gvi"(TX data=w382, error in=w383, coerced gain [dB]=$"eNB Coerced Max RF TX Power") -> (TX power spectrum=w384, error out=w381)
        $"eNB TX Power Spectrum" <- w384
      }
      frame 1 {
        call "Read RX Data.gvi"(session=$session, error in=s14) -> (RX data=w385, error out=w386)
        call "Calculate RX Power Spectrum.gvi"(RX data=w385, coerced gain [dB]=$"UE Coerced Gain", error in=w386, power calibration offset [dB]=$"power calibration offset [dB]") -> (RX power spectrum=w387, error out=w381)
        $"UE RX Power Spectrum" <- w387
      }
      frame 2 {
        call "Read PDCCH Data.gvi"(session in=$session, error in=s14) -> (DCI messages=w388, error out=w389)
        $"PDCCH Received DCI Message" <- w388
        case ($"External MAC") {
          frame False, Default {
            w390 = s14
          }
          frame True {
            call "Read External MAC Output.gvi"(error in=s14, full log=FALSE) -> (external MAC log output=w391, error out=w390)
            $"External MAC Output" <- w391
          }
        }
        Merge Errors(w389, w390) -> (error out=w381)
      }
      frame 3 {
        call "Read Constellation Data.gvi"(session=$session, symbol number for display=$"symbol number for PDSCH constellation", error in=s14, RX tab=$Tab) -> (display data out=w392, constellation data=w393, displayed constellation=w394, error out=w381)
        case (w392) {
          frame False, Default { }
          frame True {
            case (w394) {
              frame "DL EQ Output", Default {
                $"PDCCH Constellation" <- w393
              }
              frame "PDSCH Dec Input" {
                $"PDSCH Constellation" <- w393
              }
            }
          }
        }
      }
      frame 4 {
        call "Read Channel Estimates.gvi"(session=$session, UE Context=$"UE RX UE Context", error in=s14) -> (channel estimation=w395, subband SNR [dB]=w396, wideband SNR [dB]=w397, error out=w381)
        $"channel estimation" <- w395
        $"Subband SINR [dB]" <- w396
        $"Wideband SINR" <- w397
      }
    }
    # 3
    call "Check Stop.gvi"(error in=w381) -> (error out=w398, stop=w399)
    next s14 = w398
    stop if w399
  }
  sequence {
    frame 0 {
      call "Read External MAC Output.gvi"(session=$session, error in=s14, full log=TRUE) -> (external MAC log output=w400, error out=w401)
      $"External MAC Output" <- w400
    }
  }
  call "Stop On Error.gvi"(error in=w401) -> (error out=w402)
  s15 = 0  # shift register
  s16 = f64[] []  # shift register
  while {
    Wait Until Next Multiple(multiple to wait=1000)
    # compute throughput and block error rate and draw corresponding diagrams
    Tick Count() -> (timer value=w403)
    Subtract(x=w403, y=s15) -> w404
    call "Calculate DL Throughput and BLER.gvi"(session=$session, time difference=w404, throughput select=$"throughput select", DL throughput previous=s16, error in=w14) -> (BLER cluster=w405, DL throughput (current)=w406, DL throughput averaged=w407, DL BLER=w408, DL throughput current=w409, error out=w410)
    # 4
    case ($"UE RX Active") {
      frame False, Default { }
      frame True {
        $"DL throughput (current)" <- w406
        $"DL throughput" <- w407
        $"UE Failure / Block Error Rate (BLER)" <- w408
      }
    }
    call "Check Stop.gvi"(error in=w410) -> (error out=w411, stop=w412)
    $"BLER cluster" <- w405
    next s15 = w403
    next s16 = w409
    stop if w412
  }
  call "Stop On Error.gvi"(error in=w411) -> (error out=w413)
  s17 = w14  # shift register
  while {
    Wait Until Next Multiple(multiple to wait=0)
    # emply DL status information queues
    call "Collect DL Status Info.gvi"(session=$session, error in=s17) -> (error out=w414)
    call "Check Stop.gvi"(error in=w414) -> (error out=w415, stop=w416)
    next s17 = w415
    stop if w416
  }
  call "Stop On Error.gvi"(error in=s17) -> (error out=w417)
  Build Array(w344, w379, w402, w413, w417, w15) -> w418
  sequence {
    frame 0 {
      call "DL Host Cleanup.gvi"(session=$session, error in=no error) -> (error out=w419)
      Build Array(w418, w419) -> w420
      $"FPGA Ready" <- FALSE
    }
  }
  call "LTE Generate Error Report.gvi"(error in=w420) -> (error report=w421, error occured=w422)
  $"Error Report" <- w421
  $"External MAC Output" <- w13
  case (w422) {
    frame False, Default { }
    frame True {
      # Switch to status tab
      # in case of error
      $Tab <- 2
    }
  }
  $"device bandwidth" <- w10
