vi "Host DL MIMO.gvi"   [LabVIEW NXG 4.0.0]
panel controls:
  "RIO Device": string = "RIO0"
  "eNB TX Frequency [Hz]": f64 = 2000000000
  "eNB Max RF TX Power [dBm]": f64 = 10
  "UDP Receive Port": u16 = 50000
  "eNB TX RF Port (USRP)": enum{"TX1/RF0", "TX1/RF1"} = "TX1/RF0"
  "eNB Transmitter": bool
  "eNB TX Frame Structure": enum{"FDD", "TDD 5 5"} = "FDD"
  "eNB TX Cell ID": u16
  "eNB TX DCI": T2 = {"Active"=TRUE, "MCS"="MCS 17 (64-QAM, rate ~0.43)", "Resource Block Allocation (4 PRB/bit)"=8388607, "MIMO flag"=TRUE}
  "eNB TX UE Context": T3 = {"RNTI"=10, "Use UERS"=FALSE, "Antenna Port"=7, "CCE Offset"=0}
  "Host Session": "Host Session.gtype" = {"target"="USRP", "MAC Stub enabled"=TRUE, "TX link direction"="DL", "RX link direction"="DL"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}
  "UE Receiver": bool
  "UE RX RF Port (USRP)": enum{"RX2/RF0", "RX2/RF1"} = "RX2/RF0"
  "UE RX Frequency [Hz]": f64 = 2000000000
  "UE RX Frame Structure": enum{"FDD", "TDD 5 5"} = "FDD"
  "UE RX Cell ID": u16
  "UE RX UE Context": T3 = {"RNTI"=10, "Use UERS"=FALSE, "Antenna Port"=7, "CCE Offset"=0}
  "stop": bool
  "Equalizer Type": enum{"Simple", "ZF", "MMSE"} = "ZF"
  "Sigma": UFXP(1.14) = 0.0010986328125
  "MIMO Selector AP0": enum{"SISO", "MIMO"} = "SISO"
  "UE RX tab": i32
  "symbol number for PDSCH constellation": u8 = 4
  "eNB Timing Offset": i32
  "UE Manual Gain [dB]": f64
  "UE AGC": bool = TRUE
  "throughput select": T14 = "PDSCH (CRC ok)"
  "Rate Adaption": bool
  "SINR Offset [dB]": f64 = 3
  "Reference Clock Source": string = "Internal"
  "UDP Transmit Port": u16 = 60000
  "Transmit IP Address": string = "127.0.0.1"
  "USRP Bandwidth": "USRP bandwidth.gtype" = "40 MHz"
  "eNB TX tab": i32
  "Logging": bool
  "TDMSDataSavePath": path
  "DL channel equalizer bypass": bool
panel indicators:
  "eNB TX Active": bool
  "eNB Coerced Max RF TX Power [dBm]": f64
  "FPGA Ready": bool
  "UE RX Active": bool
  "PDSCH Constellation": c128[]
  "UE Coerced Gain [dB]": f64
  "Packet Loss In": bool
  "Data Transfer In": bool
  "eNB TX Power Spectrum AP0": T12
  "PDCCH Constellation": c128[]
  "UE RX Power Spectrum AP0": T12
  "DL throughput": f64[][]
  "UE Failure / Block Error Rate (BLER)": f64[][]
  "Sync Found": bool
  "channel estimation": f64[][]
  "Wideband SINR [dB]": f64
  "DL throughput (current)": f64
  "Subband SINR [dB]": f64[]
  "PDCCH Received DCI Message": T13[]
  "PDSCH Constellation AP1": c128[]
  "Channel Estimation RX1TX1": f64[][]
  "eNB TX Power Spectrum AP1": T12
  "UE RX Power Spectrum AP1": T12
  "power calibration offset [dB]": f64
  "UE ADC Values Clipped": bool
  "UE Frequency Offset [Hz]": f64
  "UE Baseband RX Power [dBFS]": f64
  "eNB TX IFFT Ouput Clipped": bool
  "UE DDC Values Clipped": bool
  "UE RF RX Power [dBm]": f64
  "eNB RF TX Power [dBm]": f64
  "eNB Baseband TX Power [dBFS]": f64
  "UE Applied Gain [dB]": f64
  "BLER cluster": cluster{"PDSCH": f64, "PDCCH": f64, "sync": f64}
  "Packet Loss Out": bool
  "Data Transfer Out": bool
  "DL trigger received count": u32
  "Num DL TX RF Triggers": u32
  "rx.samples processed": u32
  "rx.state": enum{"Idle", "Active"}
  "sync frame start count": u32
  "DL TX trigger generated count": u32
  "rx.number of overflows": u32
  "rx 0.stream enable": bool
  "rx 1.stream enable": bool
types:
  T1 = enum{"MCS 0 (QPSK, rate ~0.12)", "MCS 1 (QPSK, rate ~0.15)", "MCS 2 (QPSK, rate ~0.19)", "MCS 3 (QPSK, rate ~0.25)", "MCS 4 (QPSK, rate ~0.30)", "MCS 5 (QPSK, rate ~0.37)", "MCS 6 (QPSK, rate ~0.44)", "MCS 7 (QPSK, rate ~0.51)", "MCS 8 (QPSK, rate ~0.59)", "MCS 9 (QPSK, rate ~0.66)", "MCS 10 (16-QAM, rate ~0.33)", "MCS 11 (16-QAM, rate ~0.37)", "MCS 12 (16-QAM, rate ~0.42)", "MCS 13 (16-QAM, rate ~0.48)", "MCS 14 (16-QAM, rate ~0.54)", "MCS 15 (16-QAM, rate ~0.60)", "MCS 16 (16-QAM, rate ~0.64)", "MCS 17 (64-QAM, rate ~0.43)", "MCS 18 (64-QAM, rate ~0.46)", "MCS 19 (64-QAM, rate ~0.50)", "MCS 20 (64-QAM, rate ~0.55)", "MCS 21 (64-QAM, rate ~0.60)", "MCS 22 (64-QAM, rate ~0.65)", "MCS 23 (64-QAM, rate ~0.70)", "MCS 24 (64-QAM, rate ~0.75)", "MCS 25 (64-QAM, rate ~0.80)", "MCS 26 (64-QAM, rate ~0.85)", "MCS 27 (64-QAM, rate ~0.89)", "MCS 28 (64-QAM, rate ~0.93)"}
  T2 = cluster{"Active": bool, "MCS": T1, "Resource Block Allocation (4 PRB/bit)": UFXP(25.0), "MIMO flag": bool}
  T3 = cluster{"RNTI": u16, "Use UERS": bool, "Antenna Port": UFXP(4.0), "CCE Offset": u8}
  "Transport Session.gtype" = cluster{"FIFO pathname": string, "pipe reader": "Pipe Reader.gtype", "pipe writer": "Pipe Writer.gtype", "transport in RT FIFO": RTFifoRefnum<u8[]>, "transport out RT FIFO": RTFifoRefnum<u8[]>, "transport in timing source name": string, "transport in timing trigger ID": u8, "transport out timing source name": string, "transport out timing trigger ID": u8, "maximum API message size": u32}
  "Register Bus Session.gtype" = Queue<"Session Data.gtype">
  "Semaphore.gtype" = i32
  "DB Queue Reference.gtype" = Queue<"Daughterboard Data.gtype">
  "niUsrpRio Session.gtype" = cluster{"FPGA Interface": any, "RIO Interface Number": u32, "Data Clock Rate": u32, "FPGA Data Clock Rate": u32, "Global Settings Register Bus": "Register Bus Session.gtype", "Radio 0 Settings Register Bus": "Register Bus Session.gtype", "Radio 1 Settings Register Bus": "Register Bus Session.gtype", "Radio Settings Bus Semaphore": "Semaphore.gtype", "DB Queues": "DB Queue Reference.gtype"[], "Characterization Data Valid?": bool, "EEPROM Header": "EEPROM Header.gtype", "Device Data Header": "EEPROM Device Data Header.gtype", "EEPROM Characterization Header": "EEPROM Characterization Header.gtype", "Characterization Data": "Characterization Data.gtype"[], "FPGA Current Version": u32, "FPGA Oldest Compatible Version": u32, "Fixed Logic Current Version": u32, "Fixed Logic Oldest Compatible Version": u32, "FPGA Radio Settings Bus Current Version": u32, "FPGA Radio Settings Bus Oldest Compatible Version": u32, "FPGA Board Config Current Version": u32, "FPGA Board Config Oldest Compatible Version": u32, "Daughterboard Clock Rate": u32}
  T4 = cluster{"FPGA ref": any, "bus instance": u32, "instruction FIFO depth": u32, "executing on FPGA target": bool, "show error call chain": bool}
  T5 = cluster{"Actual Gain [dB]": f64, "Attenuation Table Index": i32}
  T6 = cluster{"Attenuation Table [dB]": f64[][], "Frequencies [Hz]": f64[], "IQ Imbalance Table": "IQ Imbalance.gtype"[], "Gain Table": T5[][]}
  T7 = cluster{"FlexRIO Register Bus": Queue<T4>, "RX Characterization Data": T6, "TX Characterization Data": T6, "FPGA Interface": any}
  T8 = cluster{"transport block size": u32, "CRC ok": bool, "user data": u32}
  "Link Direction.gtype" = enum{"DL", "UL"}
  T9 = cluster{"MAC Stub RX Payload Information FIFO": RTFifoRefnum<"MAC Stub RX Payload Information.gtype">, "MAC Stub RX Confirmation Information FIFO": RTFifoRefnum<u64[16]>, "MAC Stub RX UL Payload Information FIFO": RTFifoRefnum<f64[23]>}
  T10 = cluster{"MAC Stub TX Input Terminals FIFO": RTFifoRefnum<"MAC Stub TX Input Terminals.gtype">, "MAC Stub TX Output Terminals FIFO": RTFifoRefnum<"MAC Stub TX Output Terminals.gtype">}
  T11 = cluster{"MAC Stub RX Interface": T9, "MAC Stub TX Interface": T10}
  "Host Session.gtype" = cluster{"target": enum{"USRP", "FlexRIO"}, "real time mode": bool, "MAC Stub enabled": bool, "DMA FIFO read timeout": i32, "timed loop period": i64, "LTE Transport Sessions": "Transport Session.gtype"[], "USRP session": "niUsrpRio Session.gtype", "FlexRIO session": T7, "UDP RX session": UdpNetworkConnectionRefnum, "UDP TX session": UdpNetworkConnectionRefnum, "sync found FIFO": RTFifoRefnum<bool>, "PDCCH CRC OK FIFO": RTFifoRefnum<bool>, "DL PDCCH status FIFO": RTFifoRefnum<cluster{"CRC ok": bool, "subframe number": u32}>, "DL PDSCH status FIFO": RTFifoRefnum<cluster{"CRC ok": bool, "subframe number": u32}>, "DL SINR FIFO": RTFifoRefnum<f64[]>, "PDSCH user data FIFO": RTFifoRefnum<u32>, "PDSCH user data UDP FIFO": RTFifoRefnum<T8>, "PDSCH user data throughput FIFO": RTFifoRefnum<T8>, "PUSCH user data FIFO": RTFifoRefnum<u32>, "PUSCH user data UDP FIFO": RTFifoRefnum<T8>, "PUSCH user data throughput FIFO": RTFifoRefnum<T8>, "UE feedback info FIFO": RTFifoRefnum<u8[]>, "Request information FIFO": RTFifoRefnum<"Request Information.gtype">, "UDP TX outbound FIFO": RTFifoRefnum<u8[]>, "UDP RX inbound FIFO": RTFifoRefnum<u8[]>, "stop notifier": Notifier<string>, "DL RX scope": string, "UL RX scope": string, "external MAC log file": string, "external MAC process ID": u32, "TX link direction": "Link Direction.gtype", "RX link direction": "Link Direction.gtype", "Sychronization FIFO": RTFifoRefnum<i32>, "RT Loop Interfaces": T11}
  T12 = cluster{"f0": f64, "df": f64, "magnitude": f64[]}
  T13 = cluster{"Valid": bool, "MCS": T1, "Resource Block Allocation (4 PRB/bit)": UFXP(25.0)}
  T14 = enum{"PDSCH (overall)", "PDSCH (CRC ok)", "User data (to UDP)"}
  "USRP bandwidth.gtype" = enum{"40 MHz", "120 MHz", "160 MHz"}
  "DTP Send Status.gtype" = cluster{"send packet counter": u32, "network too slow counter": u32}
  "DTP Pending Data.gtype" = cluster{"expected size": u32, "payload": u8[]}
uses:
  Host subvis MIMO::DL Host Initialization MIMO.gvi
  NI::G Core::Error::Legacy::Simple Error Handler.gvi
  AFW::LTE::RF Control::Unbundle Session.gvi
  AFW::LTE::Conversion::Determine Configuration Trigger.gvi
  AFW::LTE::Configuration::Disable DL RX.gvi
  AFW::LTE::Configuration::Setup DL RX Baseband.gvi
  AFW::LTE::Configuration::Setup DL Loopback.gvi
  Host subvis MIMO::Setup RX MIMO.gvi
  AFW::LTE::Configuration::Disable DL TX.gvi
  Host subvis MIMO::LTE Setup DL TX Baseband MIMO.gvi
  Host subvis MIMO::Setup TX MIMO.gvi
  AFW::LTE::Configuration::Setup DL TX Set Active.gvi
  AFW::LTE::UDP Interface::Check UDP Port In Use.gvi
  AFW::Common::Create Stop.gvi
  AFW::Common::Check Stop.gvi
  AFW::Common::Stop On Error.gvi
  AFW::LTE::Conversion::Read PDSCH Decoder Status.gvi
  AFW::LTE::Conversion::Get ADC and IFFT Status.gvi
  AFW::LTE::Conversion::Read DL BB Power and sync status.gvi
  AFW::LTE::Conversion::Read TX BB Power.gvi
  AFW::LTE::RF Control::Calculate Power Calibration Offset.gvi
  AFW::LTE::RF Control::Control Power Gain.gvi
  Host subvis MIMO::Apply AGC Output MIMO.gvi
  Host subvis MIMO::LTE Read RX and TX Spectrum MIMO.gvi
  AFW::LTE::Conversion::Read PDCCH Data.gvi
  Host subvis MIMO::LTE Read Constellation Data MIMO.gvi
  AFW::LTE::Conversion::Read Channel Estimates.gvi
  Host subvis MIMO::Configure RF Timing Offset.gvi
  Host subvis MIMO::LTE Read Channel Estimates MIMO.gvi
  AFW::LTE::Conversion::Calculate DL Throughput and BLER.gvi
  AFW::LTE::Configuration::Receive Timing Indication.gvi
  Host subvis MIMO::LTE MCS Regulation MIMO.gvi
  Host subvis MIMO::LTE Send Dynamic DL TX Configuration MIMO.gvi
  Host subvis MIMO::LTE Send Dynamic DL RX Configuration MIMO.gvi
  AFW::LTE::UDP Interface::Receive UDP Data.gvi
  AFW::LTE::UDP Interface::Send UDP Data.gvi
  AFW::LTE::RF Control::DL Host Cleanup.gvi
diagram:
  sequence {
    frame 0 {
      # Set Controls to default values
      $"eNB Transmitter" <- FALSE
      $"UE Receiver" <- FALSE
      $"FPGA Ready" <- FALSE
      $"UE RX Active" <- FALSE
      $"eNB TX Active" <- FALSE
      $"Sync Found" <- FALSE
      $"PDSCH Constellation AP1" <- c128[] []
      $"PDSCH Constellation" <- c128[] []
      $"PDCCH Constellation" <- c128[] []
      Build Array(f64[] [], f64[] [], f64[] []) -> w1
      $"DL throughput" <- w1
      $"UE Failure / Block Error Rate (BLER)" <- w1
      $"channel estimation" <- w1
      $"Channel Estimation RX1TX1" <- w1
      $"UE RX Power Spectrum AP0" <- T12 {all zero or empty}
      $"eNB TX Power Spectrum AP0" <- T12 {all zero or empty}
      $"eNB TX Power Spectrum AP1" <- T12 {all zero or empty}
      $"UE RX Power Spectrum AP1" <- T12 {all zero or empty}
      $"eNB Coerced Max RF TX Power [dBm]" <- 0
      $"UE Coerced Gain [dB]" <- 0
      $"Wideband SINR [dB]" <- 0
      $"DL throughput (current)" <- 0
      $"Subband SINR [dB]" <- f64[] []
      $"PDCCH Received DCI Message" <- T13[] []
    }
  }
  call "DL Host Initialization MIMO.gvi"(reference clock source=$"Reference Clock Source", Host Session=$"Host Session", USRP bandwidth=$"USRP Bandwidth", error in=no error, USRP device=$"RIO Device") -> (session out=w2, error out=w3)
  $"Host Session" <- w2
  call "Simple Error Handler.gvi"(type of dialog="continue or stop message", error in=w3) -> (error out=w4)
  s1 = w4  # shift register
  while {
    Wait Until Next Multiple(multiple to wait=100)
    call "Unbundle Session.gvi"(session=$"Host Session") -> (DL FPGA Interface=w5)
    Type Cast(type=any constant, x=w5) -> w6
    Is Equal(x=$"UE RX tab", y=1) -> w7
    Select(s=w7, t="SISO", f=$"MIMO Selector AP0") -> w8
    # configure eNB RX/TX baseband and RF when enabled
    Property Node(instance in=w6, "Equalizer Type"=$"Equalizer Type", "Sigma"=$Sigma, "MIMO Selector AP0"=w8)
    # Disable TX and RX to
    # ensure proper shutdown
    Feedback Node[DelayCount=2](input=w9) -> w10
    case (s1) {
      frame Error { }
      frame No Error {
        $"FPGA Ready" <- TRUE
      }
    }
    call "Determine Configuration Trigger.gvi"(RX enabled=$"UE Receiver", TX enabled=$"eNB Transmitter") -> (trigger RX configuration=w11, trigger TX configuration=w12)
    # 1
    case (w11) {
      frame False, Default {
        w13 = s1
      }
      frame True {
        case ($"UE Receiver") {
          frame False, Default {
            call "Disable DL RX.gvi"(session=$"Host Session", error in=s1) -> (error out=w13)
            sequence {
              frame 0 {
                $"UE RX Active" <- FALSE
              }
            }
          }
          frame True {
            Property Node(instance in=$"Host Session") -> ("real time mode"=w14)
            call "Setup DL RX Baseband.gvi"(UE context=$"UE RX UE Context", session in=$"Host Session", frame structure=$"UE RX Frame Structure", cell ID=$"UE RX Cell ID", error in=s1, real time mode=w14) -> (session dup=w15, error out=w16)
            call "Setup DL Loopback.gvi"(internal DL loopback=FALSE, session in=w15, error in=w16) -> (session dup=w17, error out=w18)
            call "Setup RX MIMO.gvi"(LTE scope="DL", Host Session=w17, RX frequency [Hz]=$"UE RX Frequency [Hz]", gain value [dB]=$"UE Coerced Gain [dB]", error in=w18, RX port=$"UE RX RF Port (USRP)") -> (Session Out=w19, coerced gain [dB]=w20, coerced frequency [Hz]=w21, error out=w22)
            $"Host Session" <- w19
            $"UE Coerced Gain [dB]" <- w20
            $"UE RX Frequency [Hz]" <- w21
            case (w22) {
              frame Error {
                $"UE Receiver" <- FALSE
                w13 = w22
              }
              frame No Error {
                $"UE RX Active" <- TRUE
                w13 = w22
              }
            }
          }
        }
      }
    }
    case (w12) {
      frame False, Default {
        w23 = s1
      }
      frame True {
        case ($"eNB Transmitter") {
          frame False, Default {
            sequence {
              frame 0 {
                $"eNB TX Active" <- FALSE
              }
              frame 1 {
                Wait(time to wait=10)
              }
            }
            call "Disable DL TX.gvi"(session=$"Host Session", error in=s1) -> (error out=w23)
          }
          frame True {
            call "LTE Setup DL TX Baseband MIMO.gvi"(UE context=$"eNB TX UE Context", DCI=$"eNB TX DCI", Host Session=$"Host Session", frame structure=$"eNB TX Frame Structure", cell ID=$"eNB TX Cell ID", error in=s1, UDP receive port=$"UDP Receive Port") -> (session out=w24, error out=w25)
            call "Setup TX MIMO.gvi"(LTE scope="DL", timing advance=0, Host Session=w24, TX frequency [Hz]=$"eNB TX Frequency [Hz]", TX power level [dB]=$"eNB Max RF TX Power [dBm]", error in=w25, TX port=$"eNB TX RF Port (USRP)") -> (coerced power level setting [dB]=w26, Host Session out=w27, coerced output power [dB]=w28, coerced frequency [Hz]=w29, error out=w30)
            $"eNB Coerced Max RF TX Power [dBm]" <- w28
            $"Host Session" <- w27
            case (w30) {
              frame No Error, Default {
                $"eNB TX Active" <- TRUE
                call "Setup DL TX Set Active.gvi"(session in=w27, error in=w30) -> (error out=w23)
              }
              frame Error {
                $"eNB Transmitter" <- FALSE
                call "Check UDP Port In Use.gvi"(error in=w30) -> (error out=w23)
              }
            }
            $"eNB TX Frequency [Hz]" <- w29
            $"eNB Max RF TX Power [dBm]" <- w26
          }
        }
      }
    }
    Merge Errors(w13, w23) -> (error out=w31)
    # synchronize the exit condition across all loops of the host application
    call "Create Stop.gvi"(stop in=$stop, error in=w31) -> (error out=w32)
    call "Check Stop.gvi"(error in=w32) -> (stop=w9, error out=w33)
    case (w9) {
      frame False, Default { }
      frame True {
        $"UE Receiver" <- FALSE
        $"eNB Transmitter" <- FALSE
      }
    }
    next s1 = w33
    stop if w10
  }
  call "Stop On Error.gvi"(error in=s1) -> (error out=w34)
  s2 = w4  # shift register
  while (iteration -> i1) {
    Wait Until Next Multiple(multiple to wait=50)
    call "Read PDSCH Decoder Status.gvi"(session in=$"Host Session", error in=s2) -> (session dup=w35, error out=w36)
    call "Get ADC and IFFT Status.gvi"(session in=w35, error in=w36) -> (RX DDC values clipped=w37, TX IFFT output clipped=w38, session dup=w39, ADC values clipped=w40, error out=w41)
    call "Read DL BB Power and sync status.gvi"(session in=w39, error in=w41) -> (signal detected?=w42, DL frequency offset [Hz]=w43, session dup=w44, RX baseband input power=w45, error out=w46)
    call "Read TX BB Power.gvi"(session in=w44, TX reference level [dBm]=$"eNB Coerced Max RF TX Power [dBm]", error in=w46) -> (session dup=w47, TX power [dBm]=w48, TX baseband power [dBFS]=w49, error out=w50)
    call "Calculate Power Calibration Offset.gvi"(session in=w47, error in=w50, frequency [Hz]=$"UE RX Frequency [Hz]") -> (session dup=w51, power calibration offset [dB]=w52, error out=w53)
    $"power calibration offset [dB]" <- w52
    Not(x=$"UE AGC") -> w54
    call "Control Power Gain.gvi"(expected signal range lower bound=-17, expected signal range upper bound=-15, BB input power=w45, gain in=$"UE Coerced Gain [dB]", use manual gain=w54, manual gain value [dB]=$"UE Manual Gain [dB]", power calibration offset [dB]=w52) -> (power [dBFS]=w55, gain out=w56, RF input power [dBm]=w57)
    # read sync status and baseband power levels from FPGA and feed them into automatic gain control (AGC)
    # use manual gain value if AGC is disabled
    # configure frequency offset on FPGA
    # read PDSCH decoder status
    Logical And($"UE Receiver", $"UE RX Active") -> w58
    # 2
    case (w58) {
      frame False, Default {
        w59 = w53
      }
      frame True {
        call "Apply AGC Output MIMO.gvi"(Host Session=w51, apply values=w58, AGC output=w56, error in=w53, LTE scope="DL") -> (coerced gain [dB]=w60, error out=w59)
        $"UE Coerced Gain [dB]" <- w60
      }
    }
    call "Check Stop.gvi"(error in=w59) -> (stop=w61, error out=w62)
    $"eNB RF TX Power [dBm]" <- w48
    $"eNB Baseband TX Power [dBFS]" <- w49
    $"UE Baseband RX Power [dBFS]" <- w55
    $"UE RF RX Power [dBm]" <- w57
    $"UE Applied Gain [dB]" <- $"UE Coerced Gain [dB]"
    $"UE Frequency Offset [Hz]" <- w43
    $"Sync Found" <- w42
    $"UE ADC Values Clipped" <- w40
    $"eNB TX IFFT Ouput Clipped" <- w38
    To Unsigned 32 Bit Integer(number=i1) -> w63
    Quotient And Remainder(x=w63, y=10) -> (x-y*floor(x/y)=w64)
    Is Equal To 0(x=w64) -> w65
    Logical Or(w37, w65) -> w66
    Feedback Node(enable?=w66, input=w37) -> w67
    Feedback Node(enable?=w65, input=w67) -> w68
    $"UE DDC Values Clipped" <- w68
    next s2 = w62
    stop if w61
  }
  call "Stop On Error.gvi"(error in=s2) -> (error out=w69)
  TDMS Open(byte order="little-endian", create index file=TRUE, file format version="2.0", file path=$TDMSDataSavePath, operation="create or replace") -> (error out=w70, tdms file out=w71)
  s3 = w4  # shift register
  while (iteration -> i2) {
    Wait Until Next Multiple(multiple to wait=10)
    call "LTE Read RX and TX Spectrum MIMO.gvi"(RX power calibration offset [dB]=$"power calibration offset [dB]", Host Session=$"Host Session", TX coerced gain [dB]=$"eNB Coerced Max RF TX Power [dBm]", counter=i2, error in=s3, RX coerced gain [dB]=$"UE Coerced Gain [dB]", RX active=$"UE RX Active") -> (error out=w72, TX power spectrum=w73, TX power spectrum AP1=w74, update RX spectrum=w75, RX power spectrum=w76, RX power spectrum AP1=w77, update TX spectrum=w78)
    # read RX/TX baseband data values and PDCCH/PDSCH constellation data from FPGA and draw corresponding diagrams
    case (w78) {
      frame False, Default { }
      frame True {
        $"eNB TX Power Spectrum AP0" <- w73
        $"eNB TX Power Spectrum AP1" <- w74
      }
    }
    case (w75) {
      frame False, Default { }
      frame True {
        $"UE RX Power Spectrum AP0" <- w76
        $"UE RX Power Spectrum AP1" <- w77
      }
    }
    call "Read PDCCH Data.gvi"(session in=$"Host Session", error in=s3) -> (DCI messages=w79, error out=w80)
    call "LTE Read Constellation Data MIMO.gvi"(DL channel equalizer bypass=$"DL channel equalizer bypass", Host Session=$"Host Session", symbol number for display=$"symbol number for PDSCH constellation", counter=i2, error in=s3, RX tab=$"UE RX tab") -> (constellation data=w81, constellation data AP1=w82, displayed constellation=w83, error out=w84, display data=w85)
    call "Read Channel Estimates.gvi"(session=$"Host Session", UE Context=$"UE RX UE Context", error in=s3) -> (CRSRaw=w86, SubframeIndex=w87, channel estimation=w88, subband SNR [dB]=w89, wideband SNR [dB]=w90, error out=w91)
    call "Configure RF Timing Offset.gvi"(session in=$"Host Session", RF timing offset=$"eNB Timing Offset", error in=s3) -> (error out=w92)
    call "LTE Read Channel Estimates MIMO.gvi"(Host Session=$"Host Session", counter=i2, error in=s3) -> (display data=w93, channel estimation RX1TX1=w94, subframe Index=w95, CRSRaw=w96, error out=w97)
    Merge Errors(w72, w80, w84, w91, w92, w97) -> (error out=w98)
    # 3
    call "Check Stop.gvi"(error in=w98) -> (stop=w99, error out=w100)
    case (TRUE) {
      frame False, Default { }
      frame True {
        $"PDCCH Received DCI Message" <- w79
      }
    }
    Property Node(instance in=$"Host Session") -> ("USRP session:FPGA Interface"=w101)
    Dynamic Fpga Interface Cast(reference in=w101, type=any constant) -> (reference out=w102)
    Property Node(instance in=w102) -> ("DL trigger received count"=w103, "Num DL TX RF Triggers"=w104, "rx.samples processed"=w105, "rx.state"=w106, "sync frame start count"=w107, "DL TX trigger generated count"=w108, "rx.number of overflows"=w109, "rx 0.stream enable"=w110, "rx 1.stream enable"=w111)
    $"DL trigger received count" <- w103
    $"Num DL TX RF Triggers" <- w104
    case (w85) {
      frame False, Default { }
      frame True {
        case (w83) {
          frame "DL EQ Output", Default {
            $"PDCCH Constellation" <- w81
          }
          frame "PDSCH Dec Input" {
            $"PDSCH Constellation" <- w81
            $"PDSCH Constellation AP1" <- w82
          }
        }
      }
    }
    $"rx.samples processed" <- w105
    $"rx.state" <- w106
    $"sync frame start count" <- w107
    $"DL TX trigger generated count" <- w108
    $"rx.number of overflows" <- w109
    $"rx 0.stream enable" <- w110
    $"rx 1.stream enable" <- w111
    case (TRUE) {
      frame False, Default { }
      frame True {
        $"channel estimation" <- w88
        $"Subband SINR [dB]" <- w89
        $"Wideband SINR [dB]" <- w90
      }
    }
    Complex To Real And Imaginary(x + iy=w86) -> (x=w112, y=w113)
    Build Array(w112, w113) -> w114
    Build Array(w114, w87) -> w115
    Complex To Real And Imaginary(x + iy=w96) -> (x=w116, y=w117)
    Build Array(w116, w117) -> w118
    Build Array(w118, w95) -> w119
    Insert Into Array(inArray=w115, index0=3, new=w119) -> w120
    case ($Logging) {
      frame False, Default {
        w121 = w71
        w122 = w70
      }
      frame True {
        w123 = ["H11 Real", "H11 Imag", "Subframe Index 0", "H22 Real", "H22 Imag", "Subframe Index 1"]
        TDMS Write(channel name(s) in=w123, data=w120, error in=w70, group name in="RxCRSData", tdms file=w71) -> (error out=w122, tdms file out=w121)
      }
    }
    case (w93) {
      frame False, Default { }
      frame True {
        $"Channel Estimation RX1TX1" <- w94
      }
    }
    next s3 = w100
    stop if w99
  }
  call "Stop On Error.gvi"(error in=s3) -> (error out=w124)
  s4 = 0  # shift register
  s5 = f64[] []  # shift register
  while {
    Wait Until Next Multiple(multiple to wait=1000)
    # compute throughput and block error rate and draw corresponding diagrams
    Tick Count() -> (timer value=w125)
    Subtract(x=w125, y=s4) -> w126
    call "Calculate DL Throughput and BLER.gvi"(session=$"Host Session", time difference=w126, throughput select=$"throughput select", DL throughput previous=s5, error in=w4) -> (BLER cluster=w127, DL throughput (current)=w128, DL throughput averaged=w129, DL BLER=w130, DL throughput current=w131, error out=w132)
    # 4
    case ($"UE RX Active") {
      frame False, Default { }
      frame True {
        $"DL throughput (current)" <- w128
        $"DL throughput" <- w129
        $"UE Failure / Block Error Rate (BLER)" <- w130
      }
    }
    call "Check Stop.gvi"(error in=w132) -> (stop=w133, error out=w134)
    $"BLER cluster" <- w127
    next s4 = w125
    next s5 = w131
    stop if w133
  }
  call "Stop On Error.gvi"(error in=w134) -> (error out=w135)
  s6 = w4  # shift register
  while {
    # Update dynamic UE contexts
    case ($"eNB TX Active") {
      frame False, Default {
        Wait(time to wait=10)
        w136 = s6
        w137 = TRUE
      }
      frame True {
        call "Receive Timing Indication.gvi"(session=$"Host Session", error in=s6) -> (session dup=w138, new timing indication=w137, error out=w139)
        case (w137) {
          frame False, Default {
            w136 = w139
          }
          frame True {
            case ($"Rate Adaption") {
              frame False, Default {
                w140 = $"eNB TX DCI"
                w141 = w139
              }
              frame True {
                call "LTE MCS Regulation MIMO.gvi"(DCI in=$"eNB TX DCI", wideband SNR=$"Wideband SINR [dB]", SNR offset [dB]=$"SINR Offset [dB]", UE context=$"eNB TX UE Context") -> (DCI out=w140)
                w141 = w139
              }
            }
            call "LTE Send Dynamic DL TX Configuration MIMO.gvi"(Host Session=w138, UE context=$"eNB TX UE Context", DCI in=w140, error in=w141) -> (MCS adapted=w142, coerced DCI=w143, error out=w136)
            case (w142) {
              frame False, Default { }
              frame True {
                $"eNB TX DCI" <- w143
              }
            }
          }
        }
      }
    }
    Logical And($"UE RX Active", w137) -> w144
    # 5
    case (w144) {
      frame False, Default {
        w145 = w136
      }
      frame True {
        call "LTE Send Dynamic DL RX Configuration MIMO.gvi"(Host Session=$"Host Session", UE context=$"UE RX UE Context", error in=w136) -> (error out=w145)
      }
    }
    call "Check Stop.gvi"(error in=w145) -> (stop=w146, error out=w147)
    next s6 = w147
    stop if w146
  }
  call "Stop On Error.gvi"(error in=s6) -> (error out=w148)
  s7 = w4  # shift register
  s8 = 0  # shift register
  while {
    Wait Until Next Multiple[Units=Microseconds](multiple to wait=1)
    # receive UDP data from network and send it to the FPGA as PDSCH payload data of the transmitter
    call "Receive UDP Data.gvi"(eNB TX active=$"eNB TX Active", session=$"Host Session", UDP packet counter in=s8, error in=s7) -> (UDP packet counter out=w149, error out=w150, FIFO full=w151, data transfer=w152)
    $"Packet Loss In" <- w151
    $"Data Transfer In" <- w152
    # 6
    call "Check Stop.gvi"(error in=w150) -> (stop=w153, error out=w154)
    next s7 = w154
    next s8 = w149
    stop if w153
  }
  call "Stop On Error.gvi"(error in=s7) -> (error out=w155)
  s9 = w4  # shift register
  s10 = "DTP Pending Data.gtype" {all zero or empty}  # shift register
  s11 = "DTP Send Status.gtype" {all zero or empty}  # shift register
  while {
    # read received PDSCH payload data from FPGA and send it to the specified UDP port
    call "Send UDP Data.gvi"(pending data in=s10, session=$"Host Session", enable MAC RX=TRUE, UDP send status in=s11, error in=s9, transmit IP address=$"Transmit IP Address", transmit port=$"UDP Transmit Port") -> (pending data out=w156, transferring data=w157, network too slow=w158, UDP send status out=w159, error out=w160)
    $"Data Transfer Out" <- w157
    $"Packet Loss Out" <- w158
    Wait Until Next Multiple(multiple to wait=1)
    call "Check Stop.gvi"(error in=w160) -> (stop=w161, error out=w162)
    next s9 = w162
    next s10 = w156
    next s11 = w159
    stop if w161
  }
  call "Stop On Error.gvi"(error in=s9) -> (error out=w163)
  Merge Errors(w34, w69, w124, w135, w148, w155, w163) -> (error out=w164)
  sequence {
    frame 0 {
      call "DL Host Cleanup.gvi"(session=$"Host Session", error in=w164) -> (error out=w165)
      $"FPGA Ready" <- FALSE
    }
  }
  call "Simple Error Handler.gvi"(type of dialog="OK message", error in=w165)
  TDMS Close(error in=w122, tdms file=w121)
