vi "LTE Create FPGA Resources.gvi"   [LabVIEW NXG 4.0.0]
outputs:
  "AFW FPGA Resources": "LTE AFW FPGA Resources.gtype"
types:
  T1 = cluster{"data valid": bool, "normalized CFO": FXP(0.48), "frame timing estimation": UFXP(19.0)}
  "LTE AFW FPGA Resources.gtype" = cluster{"Baseband clock": ClockDataType, "sync trigger": RegisterDataType<bool>, "TX trigger": RegisterDataType<bool>, "time and freq offset": RegisterDataType<T1>, "loopback trigger": RegisterDataType<bool>, "RX RF to BB FIFO": any, "TX BB to RF FIFO": any, "loopback FIFO": any}
diagram:
  Register Create(initial value=FALSE) -> (reference out=w1)
  Register Create(initial value=FALSE) -> (reference out=w2)
  Register Create(initial value=T1 {all zero or empty}) -> (reference out=w3)
  Register Create(initial value=FALSE) -> (reference out=w4)
  FIFO Create(data type=u32 0, minimum depth=4097) -> (reference out=w5)
  FIFO Create(data type=CFXP(1.15) 0+0i, minimum depth=4097) -> (reference out=w6)
  FIFO Create(data type=CFXP(1.15) 0+0i, minimum depth=4097) -> (reference out=w7)
  Property Node(instance in="LTE AFW FPGA Resources.gtype" {all zero or empty}, "Baseband clock"="AFW::LTE::Resources::LTE AFW Resources.grsc::192MHz", "sync trigger"=w1, "TX trigger"=w2, "time and freq offset"=w3, "loopback trigger"=w4, "RX RF to BB FIFO"=w5, "TX BB to RF FIFO"=w6, "loopback FIFO"=w7) -> (instance out=w8)
  $"AFW FPGA Resources" <- w8
