vi "DL RX FIFO Initialization.gvi"   [LabVIEW NXG 4.0.0]
# Configures the depth of the host-side FIFO for all target-to-host and host-to-target FIFOs used for the DL receiver, and starts the DMA data transfer between the FPGA and the host.
inputs:
  "session": "Host Session.gtype"
  "error in": error
outputs:
  "error out": error
types:
  "Transport Session.gtype" = cluster{"FIFO pathname": string, "pipe reader": "Pipe Reader.gtype", "pipe writer": "Pipe Writer.gtype", "transport in RT FIFO": RTFifoRefnum<u8[]>, "transport out RT FIFO": RTFifoRefnum<u8[]>, "transport in timing source name": string, "transport in timing trigger ID": u8, "transport out timing source name": string, "transport out timing trigger ID": u8, "maximum API message size": u32}
  "Register Bus Session.gtype" = Queue<"Session Data.gtype">
  "Semaphore.gtype" = i32
  "DB Queue Reference.gtype" = Queue<"Daughterboard Data.gtype">
  "niUsrpRio Session.gtype" = cluster{"FPGA Interface": any, "RIO Interface Number": u32, "Data Clock Rate": u32, "FPGA Data Clock Rate": u32, "Global Settings Register Bus": "Register Bus Session.gtype", "Radio 0 Settings Register Bus": "Register Bus Session.gtype", "Radio 1 Settings Register Bus": "Register Bus Session.gtype", "Radio Settings Bus Semaphore": "Semaphore.gtype", "DB Queues": "DB Queue Reference.gtype"[], "Characterization Data Valid?": bool, "EEPROM Header": "EEPROM Header.gtype", "Device Data Header": "EEPROM Device Data Header.gtype", "EEPROM Characterization Header": "EEPROM Characterization Header.gtype", "Characterization Data": "Characterization Data.gtype"[], "FPGA Current Version": u32, "FPGA Oldest Compatible Version": u32, "Fixed Logic Current Version": u32, "Fixed Logic Oldest Compatible Version": u32, "FPGA Radio Settings Bus Current Version": u32, "FPGA Radio Settings Bus Oldest Compatible Version": u32, "FPGA Board Config Current Version": u32, "FPGA Board Config Oldest Compatible Version": u32, "Daughterboard Clock Rate": u32}
  T1 = cluster{"FPGA ref": any, "bus instance": u32, "instruction FIFO depth": u32, "executing on FPGA target": bool, "show error call chain": bool}
  T2 = cluster{"Actual Gain [dB]": f64, "Attenuation Table Index": i32}
  T3 = cluster{"Attenuation Table [dB]": f64[][], "Frequencies [Hz]": f64[], "IQ Imbalance Table": "IQ Imbalance.gtype"[], "Gain Table": T2[][]}
  T4 = cluster{"FlexRIO Register Bus": Queue<T1>, "RX Characterization Data": T3, "TX Characterization Data": T3, "FPGA Interface": any}
  T5 = cluster{"transport block size": u32, "CRC ok": bool, "user data": u32}
  "Link Direction.gtype" = enum{"DL", "UL"}
  T6 = cluster{"MAC Stub RX Payload Information FIFO": RTFifoRefnum<"MAC Stub RX Payload Information.gtype">, "MAC Stub RX Confirmation Information FIFO": RTFifoRefnum<u64[16]>, "MAC Stub RX UL Payload Information FIFO": RTFifoRefnum<f64[23]>}
  T7 = cluster{"MAC Stub TX Input Terminals FIFO": RTFifoRefnum<"MAC Stub TX Input Terminals.gtype">, "MAC Stub TX Output Terminals FIFO": RTFifoRefnum<"MAC Stub TX Output Terminals.gtype">}
  T8 = cluster{"MAC Stub RX Interface": T6, "MAC Stub TX Interface": T7}
  "Host Session.gtype" = cluster{"target": enum{"USRP", "FlexRIO"}, "real time mode": bool, "MAC Stub enabled": bool, "DMA FIFO read timeout": i32, "timed loop period": i64, "LTE Transport Sessions": "Transport Session.gtype"[], "USRP session": "niUsrpRio Session.gtype", "FlexRIO session": T4, "UDP RX session": UdpNetworkConnectionRefnum, "UDP TX session": UdpNetworkConnectionRefnum, "sync found FIFO": RTFifoRefnum<bool>, "PDCCH CRC OK FIFO": RTFifoRefnum<bool>, "DL PDCCH status FIFO": RTFifoRefnum<cluster{"CRC ok": bool, "subframe number": u32}>, "DL PDSCH status FIFO": RTFifoRefnum<cluster{"CRC ok": bool, "subframe number": u32}>, "DL SINR FIFO": RTFifoRefnum<f64[]>, "PDSCH user data FIFO": RTFifoRefnum<u32>, "PDSCH user data UDP FIFO": RTFifoRefnum<T5>, "PDSCH user data throughput FIFO": RTFifoRefnum<T5>, "PUSCH user data FIFO": RTFifoRefnum<u32>, "PUSCH user data UDP FIFO": RTFifoRefnum<T5>, "PUSCH user data throughput FIFO": RTFifoRefnum<T5>, "UE feedback info FIFO": RTFifoRefnum<u8[]>, "Request information FIFO": RTFifoRefnum<"Request Information.gtype">, "UDP TX outbound FIFO": RTFifoRefnum<u8[]>, "UDP RX inbound FIFO": RTFifoRefnum<u8[]>, "stop notifier": Notifier<string>, "DL RX scope": string, "UL RX scope": string, "external MAC log file": string, "external MAC process ID": u32, "TX link direction": "Link Direction.gtype", "RX link direction": "Link Direction.gtype", "Sychronization FIFO": RTFifoRefnum<i32>, "RT Loop Interfaces": T8}
uses:
  AFW::LTE::RF Control::Unbundle Session.gvi
diagram:
  call "Unbundle Session.gvi"(session=$session) -> (DL FPGA Interface=w1)
  Host Fifo Configure Node[FifoName="AFW::LTE::Resources::LTE AFW Resources.grsc::T2H RX Constellation"](depth=4000, error in=$"error in", reference in=w1) -> (error out=w2, reference out=w3)
  Host Fifo Start Node[FifoName="AFW::LTE::Resources::LTE AFW Resources.grsc::T2H RX Constellation"](error in=w2, reference in=w3) -> (error out=w4)
  Host Fifo Configure Node[FifoName="AFW::LTE::Resources::LTE AFW Resources.grsc::T2H PDCCH Message"](depth=3000, error in=$"error in", reference in=w1) -> (error out=w5, reference out=w6)
  Host Fifo Start Node[FifoName="AFW::LTE::Resources::LTE AFW Resources.grsc::T2H PDCCH Message"](error in=w5, reference in=w6) -> (error out=w7)
  Host Fifo Configure Node[FifoName="AFW::LTE::Resources::LTE AFW Resources.grsc::T2H PDSCH Decoded Data"](depth=100000000, error in=$"error in", reference in=w1) -> (error out=w8, reference out=w9)
  Host Fifo Start Node[FifoName="AFW::LTE::Resources::LTE AFW Resources.grsc::T2H PDSCH Decoded Data"](error in=w8, reference in=w9) -> (error out=w10)
  Host Fifo Configure Node[FifoName="AFW::LTE::Resources::LTE AFW Resources.grsc::T2H PDSCH Decoding Status"](depth=1000, error in=$"error in", reference in=w1) -> (error out=w11, reference out=w12)
  Host Fifo Start Node[FifoName="AFW::LTE::Resources::LTE AFW Resources.grsc::T2H PDSCH Decoding Status"](error in=w11, reference in=w12) -> (error out=w13)
  Host Fifo Configure Node[FifoName="AFW::LTE::Resources::LTE AFW Resources.grsc::T2H RX Baseband Stream"](depth=30720, error in=$"error in", reference in=w1) -> (error out=w14, reference out=w15)
  Host Fifo Start Node[FifoName="AFW::LTE::Resources::LTE AFW Resources.grsc::T2H RX Baseband Stream"](error in=w14, reference in=w15) -> (error out=w16)
  Host Fifo Configure Node[FifoName="AFW::LTE::Resources::LTE AFW Resources.grsc::T2H RX Channel Estimates"](depth=40000, error in=$"error in", reference in=w1) -> (error out=w17, reference out=w18)
  Host Fifo Start Node[FifoName="AFW::LTE::Resources::LTE AFW Resources.grsc::T2H RX Channel Estimates"](error in=w17, reference in=w18) -> (error out=w19)
  Host Fifo Configure Node[FifoName="AFW::LTE::Resources::LTE AFW Resources.grsc::H2T DL RX Dynamic Configuration"](depth=1000, error in=$"error in", reference in=w1) -> (error out=w20, reference out=w21)
  Host Fifo Start Node[FifoName="AFW::LTE::Resources::LTE AFW Resources.grsc::H2T DL RX Dynamic Configuration"](error in=w20, reference in=w21) -> (error out=w22)
  Merge Errors(w4, w7, w10, w13, w16, w19, w22) -> (error out=w23)
  $"error out" <- w23
