vi "Flush U32 FIFO.gvi"   [LabVIEW NXG 4.0.0]
inputs:
  "U32 FIFO in": RTFifoRefnum<u32>
  "error in": error
outputs:
  "U32": u32[]
  "error out": error
  "U32 FIFO out": RTFifoRefnum<u32>
diagram:
  RTFIFO Read(error in=$"error in", rt fifo=$"U32 FIFO in", timeout in ms=0) -> (element out=w1, empty?=w2, error out=w3, number of elements=w4, rt fifo out=w5)
  Not(x=w2) -> w6
  Boolean To 0 Or 1(Boolean=w6) -> (0, 1=w7)
  To Signed 32 Bit Integer(number=w7) -> w8
  To Signed 32 Bit Integer(number=w4) -> w9
  Add(w8, w9) -> w10
  s1 = w3  # shift register
  s2 = w5  # shift register
  for (N = w10) (iteration -> i1) {
    Is Equal To 0(x=i1) -> w12
    Logical And(w6, w12) -> w13
    case (w13) {
      frame True {
        w14 = w1
        w15 = s1
        w16 = s2
      }
      frame False {
        RTFIFO Read(error in=s1, rt fifo=s2, timeout in ms=0) -> (element out=w14, error out=w15, rt fifo out=w16)
      }
    }
    append w14 to w11
    next s1 = w15
    next s2 = w16
  }
  $"U32 FIFO out" <- s2
  $U32 <- w11
  $"error out" <- s1
