vi "RT Interface Cleanup.gvi"   [LabVIEW NXG 4.0.0]
inputs:
  "RT Loop Interfaces": T3
  "error in": error
outputs:
  "error out": error
types:
  T1 = cluster{"MAC Stub RX Payload Information FIFO": RTFifoRefnum<"MAC Stub RX Payload Information.gtype">, "MAC Stub RX Confirmation Information FIFO": RTFifoRefnum<u64[16]>, "MAC Stub RX UL Payload Information FIFO": RTFifoRefnum<f64[23]>}
  T2 = cluster{"MAC Stub TX Input Terminals FIFO": RTFifoRefnum<"MAC Stub TX Input Terminals.gtype">, "MAC Stub TX Output Terminals FIFO": RTFifoRefnum<"MAC Stub TX Output Terminals.gtype">}
  T3 = cluster{"MAC Stub RX Interface": T1, "MAC Stub TX Interface": T2}
diagram:
  Property Node(instance in=$"RT Loop Interfaces") -> ("MAC Stub RX Interface:MAC Stub RX Payload Information FIFO"=w1, "MAC Stub RX Interface:MAC Stub RX Confirmation Information FIFO"=w2, "MAC Stub RX Interface:MAC Stub RX UL Payload Information FIFO"=w3, "MAC Stub TX Interface:MAC Stub TX Input Terminals FIFO"=w4, "MAC Stub TX Interface:MAC Stub TX Output Terminals FIFO"=w5)
  RTFIFO Delete(error in=$"error in", rt fifo=w5) -> (error out=w6)
  RTFIFO Delete(error in=w6, rt fifo=w4) -> (error out=w7)
  RTFIFO Delete(error in=w7, rt fifo=w3) -> (error out=w8)
  RTFIFO Delete(error in=w8, rt fifo=w2) -> (error out=w9)
  RTFIFO Delete(error in=w9, rt fifo=w1) -> (error out=w10)
  $"error out" <- w10
