vi "Read with Preview PDCCH Status FIFO.gvi"   [LabVIEW NXG 4.0.0]
inputs:
  "rt fifo reference in": RTFifoRefnum<cluster{"CRC ok": bool, "subframe number": u32}>
  "error in": error
  "preview": bool
  "timeout in ms": i32
outputs:
  "rt fifo reference out": RTFifoRefnum<cluster{"CRC ok": bool, "subframe number": u32}>
  "error out": error
  "element out": cluster{"CRC ok": bool, "subframe number": u32}
  "empty": bool
diagram:
  Feedback Node(initial value="READ", input=w1) -> w2
  Feedback Node(input=w3) -> w4
  case (w2) {
    frame "HOLD" {
      Select(s=$preview, t="HOLD", f="READ") -> w1
      w5 = $"rt fifo reference in"
      w3 = w4
      w6 = FALSE
      w7 = $"error in"
    }
    frame "READ" {
      RTFIFO Read(error in=$"error in", rt fifo=$"rt fifo reference in", timeout in ms=$"timeout in ms") -> (element out=w8, empty?=w6, error out=w7, rt fifo out=w5)
      Not(x=w6) -> w9
      Select(s=w9, t=w8, f=w4) -> w3
      Logical And(w9, $preview) -> w10
      Select(s=w10, t="HOLD", f=w2) -> w1
    }
  }
  $"rt fifo reference out" <- w5
  $empty <- w6
  $"error out" <- w7
  $"element out" <- w3
