vi "Send Dynamic DL TX Configuration.gvi"   [LabVIEW NXG 4.0.0]
# Prepares the TTI configuration for the downlink transmitter (DL TX) consiting of the UE context (dynamic DL configuration) and the DCI message.
inputs:
  "DCI in": "DCI Message.gtype" = {"Active"=TRUE, "MCS"="MCS 17 (64-QAM, rate ~0.43)", "Resource Block Allocation (4 PRB/bit)"=8388607}
  "UE context": T1 = {"RNTI"=10, "Use UERS"=FALSE, "Antenna Port"=7, "CCE Offset"=0}  # Per-subframe changeable UE specific parameter set (RNTI, CCE offset, UERS configuration).
  "session": "Host Session.gtype"
  "error in": error
outputs:
  "error out": error
  "coerced DCI": "DCI Message.gtype"
  "DCI modified": bool  # Flag that indicates when the DCI message was coerced.
  "session dup": "Host Session.gtype"  # Contains session information such as used target, FlexRIO and USRP sessions, FPGA reference, and queue references.
types:
  T1 = cluster{"RNTI": u16, "Use UERS": bool, "Antenna Port": UFXP(4.0), "CCE Offset": u8}
  "Transport Session.gtype" = cluster{"FIFO pathname": string, "pipe reader": "Pipe Reader.gtype", "pipe writer": "Pipe Writer.gtype", "transport in RT FIFO": RTFifoRefnum<u8[]>, "transport out RT FIFO": RTFifoRefnum<u8[]>, "transport in timing source name": string, "transport in timing trigger ID": u8, "transport out timing source name": string, "transport out timing trigger ID": u8, "maximum API message size": u32}
  "Register Bus Session.gtype" = Queue<"Session Data.gtype">
  "Semaphore.gtype" = i32
  "DB Queue Reference.gtype" = Queue<"Daughterboard Data.gtype">
  "niUsrpRio Session.gtype" = cluster{"FPGA Interface": any, "RIO Interface Number": u32, "Data Clock Rate": u32, "FPGA Data Clock Rate": u32, "Global Settings Register Bus": "Register Bus Session.gtype", "Radio 0 Settings Register Bus": "Register Bus Session.gtype", "Radio 1 Settings Register Bus": "Register Bus Session.gtype", "Radio Settings Bus Semaphore": "Semaphore.gtype", "DB Queues": "DB Queue Reference.gtype"[], "Characterization Data Valid?": bool, "EEPROM Header": "EEPROM Header.gtype", "Device Data Header": "EEPROM Device Data Header.gtype", "EEPROM Characterization Header": "EEPROM Characterization Header.gtype", "Characterization Data": "Characterization Data.gtype"[], "FPGA Current Version": u32, "FPGA Oldest Compatible Version": u32, "Fixed Logic Current Version": u32, "Fixed Logic Oldest Compatible Version": u32, "FPGA Radio Settings Bus Current Version": u32, "FPGA Radio Settings Bus Oldest Compatible Version": u32, "FPGA Board Config Current Version": u32, "FPGA Board Config Oldest Compatible Version": u32, "Daughterboard Clock Rate": u32}
  T2 = cluster{"FPGA ref": any, "bus instance": u32, "instruction FIFO depth": u32, "executing on FPGA target": bool, "show error call chain": bool}
  T3 = cluster{"Actual Gain [dB]": f64, "Attenuation Table Index": i32}
  T4 = cluster{"Attenuation Table [dB]": f64[][], "Frequencies [Hz]": f64[], "IQ Imbalance Table": "IQ Imbalance.gtype"[], "Gain Table": T3[][]}
  T5 = cluster{"FlexRIO Register Bus": Queue<T2>, "RX Characterization Data": T4, "TX Characterization Data": T4, "FPGA Interface": any}
  T6 = cluster{"transport block size": u32, "CRC ok": bool, "user data": u32}
  "Link Direction.gtype" = enum{"DL", "UL"}
  T7 = cluster{"MAC Stub RX Payload Information FIFO": RTFifoRefnum<"MAC Stub RX Payload Information.gtype">, "MAC Stub RX Confirmation Information FIFO": RTFifoRefnum<u64[16]>, "MAC Stub RX UL Payload Information FIFO": RTFifoRefnum<f64[23]>}
  T8 = cluster{"MAC Stub TX Input Terminals FIFO": RTFifoRefnum<"MAC Stub TX Input Terminals.gtype">, "MAC Stub TX Output Terminals FIFO": RTFifoRefnum<"MAC Stub TX Output Terminals.gtype">}
  T9 = cluster{"MAC Stub RX Interface": T7, "MAC Stub TX Interface": T8}
  "Host Session.gtype" = cluster{"target": enum{"USRP", "FlexRIO"}, "real time mode": bool, "MAC Stub enabled": bool, "DMA FIFO read timeout": i32, "timed loop period": i64, "LTE Transport Sessions": "Transport Session.gtype"[], "USRP session": "niUsrpRio Session.gtype", "FlexRIO session": T5, "UDP RX session": UdpNetworkConnectionRefnum, "UDP TX session": UdpNetworkConnectionRefnum, "sync found FIFO": RTFifoRefnum<bool>, "PDCCH CRC OK FIFO": RTFifoRefnum<bool>, "DL PDCCH status FIFO": RTFifoRefnum<cluster{"CRC ok": bool, "subframe number": u32}>, "DL PDSCH status FIFO": RTFifoRefnum<cluster{"CRC ok": bool, "subframe number": u32}>, "DL SINR FIFO": RTFifoRefnum<f64[]>, "PDSCH user data FIFO": RTFifoRefnum<u32>, "PDSCH user data UDP FIFO": RTFifoRefnum<T6>, "PDSCH user data throughput FIFO": RTFifoRefnum<T6>, "PUSCH user data FIFO": RTFifoRefnum<u32>, "PUSCH user data UDP FIFO": RTFifoRefnum<T6>, "PUSCH user data throughput FIFO": RTFifoRefnum<T6>, "UE feedback info FIFO": RTFifoRefnum<u8[]>, "Request information FIFO": RTFifoRefnum<"Request Information.gtype">, "UDP TX outbound FIFO": RTFifoRefnum<u8[]>, "UDP RX inbound FIFO": RTFifoRefnum<u8[]>, "stop notifier": Notifier<string>, "DL RX scope": string, "UL RX scope": string, "external MAC log file": string, "external MAC process ID": u32, "TX link direction": "Link Direction.gtype", "RX link direction": "Link Direction.gtype", "Sychronization FIFO": RTFifoRefnum<i32>, "RT Loop Interfaces": T9}
  T10 = enum{"MCS 0 (QPSK, rate ~0.12)", "MCS 1 (QPSK, rate ~0.15)", "MCS 2 (QPSK, rate ~0.19)", "MCS 3 (QPSK, rate ~0.25)", "MCS 4 (QPSK, rate ~0.30)", "MCS 5 (QPSK, rate ~0.37)", "MCS 6 (QPSK, rate ~0.44)", "MCS 7 (QPSK, rate ~0.51)", "MCS 8 (QPSK, rate ~0.59)", "MCS 9 (QPSK, rate ~0.66)", "MCS 10 (16-QAM, rate ~0.33)", "MCS 11 (16-QAM, rate ~0.37)", "MCS 12 (16-QAM, rate ~0.42)", "MCS 13 (16-QAM, rate ~0.48)", "MCS 14 (16-QAM, rate ~0.54)", "MCS 15 (16-QAM, rate ~0.60)", "MCS 16 (16-QAM, rate ~0.64)", "MCS 17 (64-QAM, rate ~0.43)", "MCS 18 (64-QAM, rate ~0.46)", "MCS 19 (64-QAM, rate ~0.50)", "MCS 20 (64-QAM, rate ~0.55)", "MCS 21 (64-QAM, rate ~0.60)", "MCS 22 (64-QAM, rate ~0.65)", "MCS 23 (64-QAM, rate ~0.70)", "MCS 24 (64-QAM, rate ~0.75)", "MCS 25 (64-QAM, rate ~0.80)", "MCS 26 (64-QAM, rate ~0.85)", "MCS 27 (64-QAM, rate ~0.89)", "MCS 28 (64-QAM, rate ~0.93)"}
  "DCI Message.gtype" = cluster{"Active": bool, "MCS": T10, "Resource Block Allocation (4 PRB/bit)": UFXP(25.0)}
uses:
  AFW::LTE::RF Control::Unbundle Session.gvi
  AFW::LTE::Conversion::Create Dynamic DL TX Configuration.gvi
  AFW::LTE::Conversion::DL TTI Configuration To U64.gvi
diagram:
  $"session dup" <- $session
  call "Unbundle Session.gvi"(session=$session) -> (DL FPGA Interface=w1)
  call "Create Dynamic DL TX Configuration.gvi"(UE context=$"UE context", DCI in=$"DCI in") -> (dynamic configuration=w2, MCS adapted=w3, coerced DCI=w4)
  call "DL TTI Configuration To U64.gvi"(TTI configuration cluster=w2) -> (TTI configuration out=w5)
  Build Array(w5) -> w6
  Host Fifo Write Node[FifoName="AFW::LTE::Resources::LTE AFW Resources.grsc::H2T DL TX Dynamic Configuration"](data=w6, error in=$"error in", reference in=w1, timeout (ms)=0) -> (error out=w7)
  $"error out" <- w7
  $"coerced DCI" <- w4
  Feedback Node(input=w4) -> w8
  Is Not Equal[ComparisonMode=CompareAggregates](x=w4, y=w8) -> w9
  Is Not Equal[ComparisonMode=CompareAggregates](x=w4, y=$"DCI in") -> w10
  Logical Or(w3, w9, w10) -> w11
  $"DCI modified" <- w11
