vi "Setup DL TX Baseband.gvi"   [LabVIEW NXG 4.0.0]
# Maps DL TX configuration controls on the host top level panel to the corresponding types used on the FPGA and writes the resulting configuration to the FPGA target.
# Opens a UDP socket on the provided port and stores the connection ID into the session cluster. Other nodes use this socket to read the data used as PDSCH payload.
inputs:
  "session in": "Host Session.gtype"  # Contains session information such as used target, FlexRIO and USRP sessions, FPGA reference, and queue references.
  "UDP receive port": u16 = 50000  # Local port where you want to create a UDP socket.
  "frame structure": enum{"FDD", "TDD 5 5"} = "TDD 5 5"  # Defines whether the frame structure is based on TDD LTE or FDD LTE. Refer to the LTE Specification 3GPP TS 36.211 to read about the LTE frame structure.
  "cell ID": u16  # The physical layer cell identity as defined in TS 36.211.
  "UE context": T9 = {"RNTI"=10, "Use UERS"=FALSE, "Antenna Port"=7, "CCE Offset"=0}  # Per-subframe changeable UE specific parameter set (RNTI, CCE offset, UERS configuration).
  "error in": error
  "DCI": "DCI Message.gtype" = {"Active"=TRUE, "MCS"="MCS 17 (64-QAM, rate ~0.43)", "Resource Block Allocation (4 PRB/bit)"=8388607}
  "real time mode": bool, required  # Defines
outputs:
  "session out": "Host Session.gtype"  # Contains session information such as used target, FlexRIO and USRP sessions, FPGA reference, and queue references.
  "error out": error
types:
  "Transport Session.gtype" = cluster{"FIFO pathname": string, "pipe reader": "Pipe Reader.gtype", "pipe writer": "Pipe Writer.gtype", "transport in RT FIFO": RTFifoRefnum<u8[]>, "transport out RT FIFO": RTFifoRefnum<u8[]>, "transport in timing source name": string, "transport in timing trigger ID": u8, "transport out timing source name": string, "transport out timing trigger ID": u8, "maximum API message size": u32}
  "Register Bus Session.gtype" = Queue<"Session Data.gtype">
  "Semaphore.gtype" = i32
  "DB Queue Reference.gtype" = Queue<"Daughterboard Data.gtype">
  "niUsrpRio Session.gtype" = cluster{"FPGA Interface": any, "RIO Interface Number": u32, "Data Clock Rate": u32, "FPGA Data Clock Rate": u32, "Global Settings Register Bus": "Register Bus Session.gtype", "Radio 0 Settings Register Bus": "Register Bus Session.gtype", "Radio 1 Settings Register Bus": "Register Bus Session.gtype", "Radio Settings Bus Semaphore": "Semaphore.gtype", "DB Queues": "DB Queue Reference.gtype"[], "Characterization Data Valid?": bool, "EEPROM Header": "EEPROM Header.gtype", "Device Data Header": "EEPROM Device Data Header.gtype", "EEPROM Characterization Header": "EEPROM Characterization Header.gtype", "Characterization Data": "Characterization Data.gtype"[], "FPGA Current Version": u32, "FPGA Oldest Compatible Version": u32, "Fixed Logic Current Version": u32, "Fixed Logic Oldest Compatible Version": u32, "FPGA Radio Settings Bus Current Version": u32, "FPGA Radio Settings Bus Oldest Compatible Version": u32, "FPGA Board Config Current Version": u32, "FPGA Board Config Oldest Compatible Version": u32, "Daughterboard Clock Rate": u32}
  T1 = cluster{"FPGA ref": any, "bus instance": u32, "instruction FIFO depth": u32, "executing on FPGA target": bool, "show error call chain": bool}
  T2 = cluster{"Actual Gain [dB]": f64, "Attenuation Table Index": i32}
  T3 = cluster{"Attenuation Table [dB]": f64[][], "Frequencies [Hz]": f64[], "IQ Imbalance Table": "IQ Imbalance.gtype"[], "Gain Table": T2[][]}
  T4 = cluster{"FlexRIO Register Bus": Queue<T1>, "RX Characterization Data": T3, "TX Characterization Data": T3, "FPGA Interface": any}
  T5 = cluster{"transport block size": u32, "CRC ok": bool, "user data": u32}
  "Link Direction.gtype" = enum{"DL", "UL"}
  T6 = cluster{"MAC Stub RX Payload Information FIFO": RTFifoRefnum<"MAC Stub RX Payload Information.gtype">, "MAC Stub RX Confirmation Information FIFO": RTFifoRefnum<u64[16]>, "MAC Stub RX UL Payload Information FIFO": RTFifoRefnum<f64[23]>}
  T7 = cluster{"MAC Stub TX Input Terminals FIFO": RTFifoRefnum<"MAC Stub TX Input Terminals.gtype">, "MAC Stub TX Output Terminals FIFO": RTFifoRefnum<"MAC Stub TX Output Terminals.gtype">}
  T8 = cluster{"MAC Stub RX Interface": T6, "MAC Stub TX Interface": T7}
  "Host Session.gtype" = cluster{"target": enum{"USRP", "FlexRIO"}, "real time mode": bool, "MAC Stub enabled": bool, "DMA FIFO read timeout": i32, "timed loop period": i64, "LTE Transport Sessions": "Transport Session.gtype"[], "USRP session": "niUsrpRio Session.gtype", "FlexRIO session": T4, "UDP RX session": UdpNetworkConnectionRefnum, "UDP TX session": UdpNetworkConnectionRefnum, "sync found FIFO": RTFifoRefnum<bool>, "PDCCH CRC OK FIFO": RTFifoRefnum<bool>, "DL PDCCH status FIFO": RTFifoRefnum<cluster{"CRC ok": bool, "subframe number": u32}>, "DL PDSCH status FIFO": RTFifoRefnum<cluster{"CRC ok": bool, "subframe number": u32}>, "DL SINR FIFO": RTFifoRefnum<f64[]>, "PDSCH user data FIFO": RTFifoRefnum<u32>, "PDSCH user data UDP FIFO": RTFifoRefnum<T5>, "PDSCH user data throughput FIFO": RTFifoRefnum<T5>, "PUSCH user data FIFO": RTFifoRefnum<u32>, "PUSCH user data UDP FIFO": RTFifoRefnum<T5>, "PUSCH user data throughput FIFO": RTFifoRefnum<T5>, "UE feedback info FIFO": RTFifoRefnum<u8[]>, "Request information FIFO": RTFifoRefnum<"Request Information.gtype">, "UDP TX outbound FIFO": RTFifoRefnum<u8[]>, "UDP RX inbound FIFO": RTFifoRefnum<u8[]>, "stop notifier": Notifier<string>, "DL RX scope": string, "UL RX scope": string, "external MAC log file": string, "external MAC process ID": u32, "TX link direction": "Link Direction.gtype", "RX link direction": "Link Direction.gtype", "Sychronization FIFO": RTFifoRefnum<i32>, "RT Loop Interfaces": T8}
  T9 = cluster{"RNTI": u16, "Use UERS": bool, "Antenna Port": UFXP(4.0), "CCE Offset": u8}
  T10 = enum{"MCS 0 (QPSK, rate ~0.12)", "MCS 1 (QPSK, rate ~0.15)", "MCS 2 (QPSK, rate ~0.19)", "MCS 3 (QPSK, rate ~0.25)", "MCS 4 (QPSK, rate ~0.30)", "MCS 5 (QPSK, rate ~0.37)", "MCS 6 (QPSK, rate ~0.44)", "MCS 7 (QPSK, rate ~0.51)", "MCS 8 (QPSK, rate ~0.59)", "MCS 9 (QPSK, rate ~0.66)", "MCS 10 (16-QAM, rate ~0.33)", "MCS 11 (16-QAM, rate ~0.37)", "MCS 12 (16-QAM, rate ~0.42)", "MCS 13 (16-QAM, rate ~0.48)", "MCS 14 (16-QAM, rate ~0.54)", "MCS 15 (16-QAM, rate ~0.60)", "MCS 16 (16-QAM, rate ~0.64)", "MCS 17 (64-QAM, rate ~0.43)", "MCS 18 (64-QAM, rate ~0.46)", "MCS 19 (64-QAM, rate ~0.50)", "MCS 20 (64-QAM, rate ~0.55)", "MCS 21 (64-QAM, rate ~0.60)", "MCS 22 (64-QAM, rate ~0.65)", "MCS 23 (64-QAM, rate ~0.70)", "MCS 24 (64-QAM, rate ~0.75)", "MCS 25 (64-QAM, rate ~0.80)", "MCS 26 (64-QAM, rate ~0.85)", "MCS 27 (64-QAM, rate ~0.89)", "MCS 28 (64-QAM, rate ~0.93)"}
  "DCI Message.gtype" = cluster{"Active": bool, "MCS": T10, "Resource Block Allocation (4 PRB/bit)": UFXP(25.0)}
  T11 = cluster{"total number of REGs": u16, "aggregation level": u16, "DCI message length": u8}
  T12 = cluster{"cell ID": u16, "number of antenna ports": u8, "frame structure": enum{"FDD", "TDD 5 5"}, "enable T2H transfer": bool, "PDCCH": T11}
  T13 = cluster{"disable mini MAC": bool, "transmit counter value": bool}
uses:
  AFW::LTE::RF Control::Unbundle Session.gvi
  AFW::Common::Set Socket Option.gvi
  AFW::LTE::Configuration::Send Dynamic DL TX Configuration.gvi
diagram:
  w1 = 0x1002  # optname SO_RCVBUF
  w2 = 0xFFFF  # level SOL_SOCKET
  w3 = 1024000  # buffer size in bytes
  Property Node(instance in=T12 {0, 2, 0, TRUE, 200, 2, 32}, "frame structure"=$"frame structure", "cell ID"=$"cell ID") -> (instance out=w4)
  call "Unbundle Session.gvi"(session=$"session in") -> (DL FPGA Interface=w5)
  w6 = T13 {"disable mini MAC"=TRUE, "transmit counter value"=FALSE}
  Property Node(instance in=w6, "disable mini MAC"=$"real time mode") -> (instance out=w7)
  Property Node(instance in=w5, "DL TX static parameters"=w4, "transfer full DL TX frame"=FALSE, "number of DL TX IFFT output bits shifted"=7, "use DL TX RF start trigger"=TRUE, "DL TX RT mode"=$"real time mode", "DL debug MAC settings"=w7, error in=$"error in") -> (error out=w8)
  Udp Open(error in=w8, net address=0, port=$"UDP receive port", service name="", timeout ms=25000) -> (connection ID=w9, error out=w10)
  call "Set Socket Option.gvi"(connection in=w9, level=w2, option name=w1, value=w3, error in=w10) -> (error out=w11, connection out=w12)
  Property Node(instance in=$"session in", "UDP TX session"=w12) -> (instance out=w13)
  $"session out" <- w13
  case ($"real time mode") {
    frame False, Default {
      call "Send Dynamic DL TX Configuration.gvi"(session=$"session in", UE context=$"UE context", DCI in=$DCI, error in=w11) -> (error out=w14)
    }
    frame True {
      w14 = w11
    }
  }
  $"error out" <- w14
