vi "Setup RT Interface.gvi"   [LabVIEW NXG 4.0.0]
inputs:
  "error in": error
outputs:
  "RT Loop Interfaces": T3
  "error out": error
types:
  T1 = cluster{"MAC Stub RX Payload Information FIFO": RTFifoRefnum<"MAC Stub RX Payload Information.gtype">, "MAC Stub RX Confirmation Information FIFO": RTFifoRefnum<u64[16]>, "MAC Stub RX UL Payload Information FIFO": RTFifoRefnum<f64[23]>}
  T2 = cluster{"MAC Stub TX Input Terminals FIFO": RTFifoRefnum<"MAC Stub TX Input Terminals.gtype">, "MAC Stub TX Output Terminals FIFO": RTFifoRefnum<"MAC Stub TX Output Terminals.gtype">}
  T3 = cluster{"MAC Stub RX Interface": T1, "MAC Stub TX Interface": T2}
  T4 = cluster{"read mode": enum{"polling", "blocking"}, "write mode": enum{"polling", "blocking"}}
  "MAC Stub RX Payload Information.gtype" = cluster{"RX Indication CRC OK": bool, "MPDU Disassembly Failed": bool, "Radio Frame Number": u16, "Reported WB SINR": f64, "DL error rate": f64}
  T5 = cluster{"RNTI": u16, "Use UERS": bool, "Antenna Port": UFXP(4.0), "CCE Offset": u8}
  T6 = enum{"MCS 0 (QPSK, rate ~0.12)", "MCS 1 (QPSK, rate ~0.15)", "MCS 2 (QPSK, rate ~0.19)", "MCS 3 (QPSK, rate ~0.25)", "MCS 4 (QPSK, rate ~0.30)", "MCS 5 (QPSK, rate ~0.37)", "MCS 6 (QPSK, rate ~0.44)", "MCS 7 (QPSK, rate ~0.51)", "MCS 8 (QPSK, rate ~0.59)", "MCS 9 (QPSK, rate ~0.66)", "MCS 10 (16-QAM, rate ~0.33)", "MCS 11 (16-QAM, rate ~0.37)", "MCS 12 (16-QAM, rate ~0.42)", "MCS 13 (16-QAM, rate ~0.48)", "MCS 14 (16-QAM, rate ~0.54)", "MCS 15 (16-QAM, rate ~0.60)", "MCS 16 (16-QAM, rate ~0.64)", "MCS 17 (64-QAM, rate ~0.43)", "MCS 18 (64-QAM, rate ~0.46)", "MCS 19 (64-QAM, rate ~0.50)", "MCS 20 (64-QAM, rate ~0.55)", "MCS 21 (64-QAM, rate ~0.60)", "MCS 22 (64-QAM, rate ~0.65)", "MCS 23 (64-QAM, rate ~0.70)", "MCS 24 (64-QAM, rate ~0.75)", "MCS 25 (64-QAM, rate ~0.80)", "MCS 26 (64-QAM, rate ~0.85)", "MCS 27 (64-QAM, rate ~0.89)", "MCS 28 (64-QAM, rate ~0.93)"}
  "DCI Message.gtype" = cluster{"Active": bool, "MCS": T6, "Resource Block Allocation (4 PRB/bit)": UFXP(25.0)}
  "MAC Stub TX Input Terminals.gtype" = cluster{"TX Frame Structure": enum{"FDD", "TDD 5 5"}, "eNB TX UE Context": T5, "eNB TX DCI": "DCI Message.gtype", "Wideband SINR": f64, "Rate Adaption": bool, "SINR Offset": f64}
  "MAC Stub TX Output Terminals.gtype" = cluster{"eNB TX DCI": "DCI Message.gtype", "IP Packets Size Exeeded Count": u32}
diagram:
  RTFIFO Create(elements in array=16, error in=$"error in", r/w modes=T4 {"read mode"="blocking", "write mode"="blocking"}, size=1, type=u64[16] [0, 0, 0, 0, 0, 0, 0, 0, 0, 0, 0, 0, 0, 0, 0, 0]) -> (error out=w1, rt fifo=w2)
  RTFIFO Create(error in=w1, r/w modes=T4 {"read mode"="blocking", "write mode"="blocking"}, size=1, type="MAC Stub RX Payload Information.gtype" {all zero or empty}) -> (error out=w3, rt fifo=w4)
  w5 = f64[23] [0, 0, 0, 0, 0, 0, 0, 0, 0, 0, 0, 0, 0, 0, 0, 0, 0, 0, 0, 0, 0, 0, 0]
  RTFIFO Create(elements in array=23, error in=w3, r/w modes=T4 {"read mode"="blocking", "write mode"="blocking"}, size=1, type=w5) -> (error out=w6, rt fifo=w7)
  w8 = "MAC Stub TX Input Terminals.gtype" {0, 10, FALSE, "0x7", 0, FALSE, 0, 0, 0, FALSE, 3}
  RTFIFO Create(error in=w6, r/w modes=T4 {"read mode"="blocking", "write mode"="blocking"}, size=1, type=w8) -> (error out=w9, rt fifo=w10)
  RTFIFO Create(error in=w9, r/w modes=T4 {"read mode"="blocking", "write mode"="blocking"}, size=1, type="MAC Stub TX Output Terminals.gtype" {all zero or empty}) -> (error out=w11, rt fifo=w12)
  Property Node(instance in=T3 {all zero or empty}, "MAC Stub RX Interface:MAC Stub RX Confirmation Information FIFO"=w2, "MAC Stub RX Interface:MAC Stub RX Payload Information FIFO"=w4, "MAC Stub RX Interface:MAC Stub RX UL Payload Information FIFO"=w7, "MAC Stub TX Interface:MAC Stub TX Input Terminals FIFO"=w10, "MAC Stub TX Interface:MAC Stub TX Output Terminals FIFO"=w12) -> (instance out=w13)
  $"RT Loop Interfaces" <- w13
  $"error out" <- w11
