vi "Setup RT Parameters.gvi"   [LabVIEW NXG 4.0.0]
inputs:
  "error in": error
  "MAC Stub enabled?": bool
  "command line": string
  "arguments": string
  "transport instance id": u8
outputs:
  "error out": error
  "DMA FIFO read timeout (ms)": i32
  "real time mode": bool
  "timed loop period": i64
  "LTE Transport Sessions": "Transport Session.gtype"[]
  "process ID": u32
  "log file": string
types:
  "Pipe Reader.gtype" = cluster{"file name": string, "pipe file descriptor": i32, "timer file descriptor": i32, "epoll file descriptor": i32}
  "Pipe Writer.gtype" = cluster{"file name": string, "pipe file descriptor": i32}
  "Transport Session.gtype" = cluster{"FIFO pathname": string, "pipe reader": "Pipe Reader.gtype", "pipe writer": "Pipe Writer.gtype", "transport in RT FIFO": RTFifoRefnum<u8[]>, "transport out RT FIFO": RTFifoRefnum<u8[]>, "transport in timing source name": string, "transport in timing trigger ID": u8, "transport out timing source name": string, "transport out timing trigger ID": u8, "maximum API message size": u32}
uses:
  AFW::Common::Get System Model Name.gvi
  NI::RT::SMP CPU::RT Get Number of CPUs.gvi
  NI::RT::SMP CPU::RT Set CPU Pool Assignments.gvi
  AFW::LTE::L1L2 API::Transport::Transport Init.gvi
diagram:
  call "Get System Model Name.gvi"(error in=$"error in") -> (model name=w1, error out=w2)
  disable {
    frame TARGET_TYPE != "RT", Default {
      w3 = w2
      w4 = FALSE
      w5 = 5000
      w6 = -1
      w7 = default
      w8 = default
      w9 = 0
    }
    frame TARGET_TYPE == "RT" {
      case (w1) {
        frame Default {
          # poll DMA FIFO
          w5 = 0
          w6 = 75
        }
        frame "NI USRP-2974" {
          # read blocking from DMA FIFO
          w5 = 2
          w6 = 1
        }
      }
      call "RT Get Number of CPUs.gvi"(error in=w2) -> (# of CPUs=w10, error out=w11)
      w12 = "Timed Structures"  # RT CPU Pool Assignments
      To Signed 32 Bit Integer(number=w10) -> w13
      Initialize Array(element=w12, size=w13) -> w14
      w15 = "System"  # RT CPU Pool Assignments
      Replace Array Subset(inArray=w14, index=0, new=w15) -> w16
      call "RT Set CPU Pool Assignments.gvi"(CPU pools=w16, error in=w11) -> (error out=w17)
      call "Transport Init.gvi"(instance id=$"transport instance id", MAC Stub enabled?=$"MAC Stub enabled?", command=$"command line", arguments=$arguments, error in=w17) -> (LTE Transport Sessions=w7, process ID=w9, log file=w8, Error out=w3)
      w4 = TRUE
    }
  }
  $"DMA FIFO read timeout (ms)" <- w5
  $"timed loop period" <- w6
  $"real time mode" <- w4
  $"LTE Transport Sessions" <- w7
  $"process ID" <- w9
  $"log file" <- w8
  $"error out" <- w3
