vi "Align Feedback Data.gvi"   [LabVIEW NXG 4.0.0]
# Aligns the incoming byte stream to find the proprietary Feedback-Header and extract the corresponding feedback message.
inputs:
  "data in": u8[]  # Collected incoming byte stream from PUSCH receiver.
outputs:
  "remaining portion": u8[]  # Remaining bytes after extracting one Feedback packet from stream.
  "feedback payload": u8[]  # The actual feedback message, if available.
diagram:
  w1 = 0x7F7F  # feedback header
  w2 = 4  # feedback header length
  Array Size(array=$"data in") -> (size(s)=w3)
  Is Greater Or Equal(x=w3, y=w2) -> w4
  # Align header
  case (w4) {
    frame False {
      w5 = $"data in"
    }
    frame True {
      Array Index(array=$"data in") -> (out2[_]=w6, out3[_]=w7)
      Join Numbers(high(x)=w7, low(x)=w6) -> w8
      Is Equal(x=w8, y=w1) -> w9
      case (w9) {
        frame False, Default {
          s1 = $"data in"  # shift register
          while {
            Delete From Array(inArray=s1, index0=0) -> w10
            Array Index(array=w10) -> (out2[_]=w11, out3[_]=w12)
            Join Numbers(high(x)=w12, low(x)=w11) -> w13
            Is Equal(x=w13, y=w1) -> w14
            Array Size(array=w10) -> (size(s)=w15)
            Is Less(x=w15, y=w2) -> w16
            Logical Or(w14, w16) -> w17
            next s1 = w10
            stop if w17
          }
          w5 = s1
        }
        frame True {
          w5 = $"data in"
        }
      }
    }
  }
  Array Size(array=w5) -> (size(s)=w18)
  Is Greater Or Equal(x=w18, y=24) -> w19
  # Extract PUSCH message
  case (w19) {
    frame False, Default {
      w20 = w5
      w21 = u8[] []
    }
    frame True {
      Array Size(array=w5) -> (size(s)=w22)
      Quotient And Remainder(x=w22, y=24) -> (floor(x/y)=w23)
      Decrement(x=w23) -> w24
      Multiply(24, w24) -> w25
      Array Subset(array=w5, index0=w25) -> w26
      Delete From Array(inArray=w26, length (1)=24, index0=0) -> (outArray=w20, deleted=w21)
    }
  }
  $"remaining portion" <- w20
  $"feedback payload" <- w21
