vi "Calculate Average Error Rate.gvi"   [LabVIEW NXG 4.0.0]
# Collects DL ACK/NACK feedback information received within the last two seconds.
# Calculates average DL error rate based on this feedback.
inputs:
  "ACK/NACK": enum{"NACK", "ACK", "DTX"}[]  # Array of received DL ACK/NACK feedback information.
outputs:
  "error rate": f64  # Calculated DL error rate, averaged over the last 2 seconds of feedback information.
diagram:
  Initialize Array(element="DTX", size=200) -> w1
  Feedback Node(initial value=w1, input=w2) -> w3
  Replace Array Subset(inArray=w3, index=0, new=$"ACK/NACK") -> w4
  # 2s  moving average
  Array Size(array=$"ACK/NACK") -> (size(s)=w5)
  Rotate 1D Array(array=w4, n=w5) -> (array (last n elements first)=w2)
  s1 = 0  # shift register
  s2 = 0  # shift register
  for {
    w6 = each element of w2
    case (w6) {
      frame "NACK" {
        Increment(x=s1) -> w7
        w8 = s2
      }
      frame "ACK" {
        Increment(x=s2) -> w8
        w7 = s1
      }
      frame "DTX", Default {
        w7 = s1
        w8 = s2
      }
    }
    next s1 = w7
    next s2 = w8
  }
  Add(s1, s2) -> w9
  Divide(x=s1, y=w9) -> w10
  $"error rate" <- w10
