vi "Calculate Channel Estimates.gvi"   [LabVIEW NXG 4.0.0]
# Extracts channel coefficients based on cell-specific reference symbols in OFDM symbol 0 from an array of estimated channel coefficients.
inputs:
  "estimated channel coefficients": c128[]  # Estimated channel coefficients estimated with cell-specific and UE-specific reference symbols.
  "timing indices": T1[]  # Timing information for estimated channel coefficients.
outputs:
  "CRS phase": f64[]  # Phase of extracted channel coefficients (based on CRS in OFDM symbol 0).
  "CRS amplitude": f64[]  # Amplitude of extracted channel coefficients. based on CRS in OFDM symbol 0.
  "subframe Index": u8[]
  "CRSRaw": c128[]
types:
  T1 = cluster{"symbol index (0-13)": u8, "RB index (0-99)": u8, "subframe index (0-9)": u8, "subcarrier index (0-11)": u8, "UERS": bool}
diagram:
  # select one subframe
  # of CRS and UERS
  # (200+300)*4
  Array Index(array=$"timing indices") -> (out0[_]=w1)
  # skip first 200 symbols
  # in case symbol 0 is the
  # first symbol
  Property Node(instance in=w1) -> ("symbol index (0-13)"=w2)
  Is Equal To 0(x=w2) -> w3
  Select(s=w3, t=200, f=0) -> w4
  Array Subset(array=$"timing indices", index0=w4, length0=2000) -> w5
  Array Subset(array=$"estimated channel coefficients", index0=w4, length0=2000) -> w6
  s1 = c128[] []  # shift register
  for {
    w7 = each element of w5
    w8 = each element of w6
    # Filter CRS for symbol 0
    Property Node(instance in=w7) -> ("UERS"=w10, "symbol index (0-13)"=w11, "subframe index (0-9)"=w12)
    Is Equal To 0(x=w11) -> w13
    Logical And(not w10, w13) -> w14
    case (w14) {
      frame True {
        Build Array(s1, w8) -> w15
      }
      frame False {
        w15 = s1
      }
    }
    append w12 to w9
    next s1 = w15
  }
  Array Subset(array=s1, length0=200) -> w16
  Complex To Polar(r * e^(i*theta)=w16) -> (r=w17, theta=w18)
  Logarithm Base 10(x=w17) -> w19
  Multiply(10, w19) -> w20
  Add Array Elements(numeric array=w20) -> (sum=w21)
  Array Size(array=w20) -> (size(s)=w22)
  To Double Precision Float(number=w22) -> w23
  Divide(x=w21, y=w23) -> w24
  Subtract(x=w20, y=w24) -> w25
  $"CRS amplitude" <- w25
  $"CRS phase" <- w18
  $CRSRaw <- w16
  Array Subset(array=w9, length0=200) -> w26
  $"subframe Index" <- w26
