vi "Calculate DL Throughput and BLER.gvi"   [LabVIEW NXG 4.0.0]
# Reads PDCCH and PDSCH decoding status information from queues and calculates Block Error Rate (BLER) and throughput values.
inputs:
  "time difference": u32  # The time difference since the last time this node ran. Subsequent nodes can use this value for exact throughput calculation.
  "session": "Host Session.gtype"
  "error in": error
  "DL throughput previous": f64[]  # Array of calculated throughput values of the previous call of this node.
  "throughput select": T1 = "PDSCH (CRC ok)"  # Selects which value is provided at the DL throughput (current) output. Valid values: overall PDSCH throughput decoded PDSCH throughput (PDSCH CRC was ok) - user data throughput to selected UDP port
outputs:
  "DL throughput (current)": f64  # Single throughput value selected using throughput select.
  "DL throughput averaged": f64[][]  # Array of calculated throughput values used for overlay display of overall PDSCH throughput, decoded PDSCH throughput, and user data throughput using UDP.
  "DL BLER": f64[][]  # Calculated DL Block Error Rates for sync, PDCCH, and PDSCH used for top-level diagram display.
  "BLER cluster": cluster{"PDSCH": f64, "PDCCH": f64, "sync": f64}  # Calculated DL Block Error Rates for sync, PDCCH, and PDSCH used for top-level numeric display.
  "error out": error
  "DL throughput current": f64[]  # Array of calculated throughput values of the current call of this node.
types:
  T1 = enum{"PDSCH (overall)", "PDSCH (CRC ok)", "User data (to UDP)"}
  "Transport Session.gtype" = cluster{"FIFO pathname": string, "pipe reader": "Pipe Reader.gtype", "pipe writer": "Pipe Writer.gtype", "transport in RT FIFO": RTFifoRefnum<u8[]>, "transport out RT FIFO": RTFifoRefnum<u8[]>, "transport in timing source name": string, "transport in timing trigger ID": u8, "transport out timing source name": string, "transport out timing trigger ID": u8, "maximum API message size": u32}
  "Register Bus Session.gtype" = Queue<"Session Data.gtype">
  "Semaphore.gtype" = i32
  "DB Queue Reference.gtype" = Queue<"Daughterboard Data.gtype">
  "niUsrpRio Session.gtype" = cluster{"FPGA Interface": any, "RIO Interface Number": u32, "Data Clock Rate": u32, "FPGA Data Clock Rate": u32, "Global Settings Register Bus": "Register Bus Session.gtype", "Radio 0 Settings Register Bus": "Register Bus Session.gtype", "Radio 1 Settings Register Bus": "Register Bus Session.gtype", "Radio Settings Bus Semaphore": "Semaphore.gtype", "DB Queues": "DB Queue Reference.gtype"[], "Characterization Data Valid?": bool, "EEPROM Header": "EEPROM Header.gtype", "Device Data Header": "EEPROM Device Data Header.gtype", "EEPROM Characterization Header": "EEPROM Characterization Header.gtype", "Characterization Data": "Characterization Data.gtype"[], "FPGA Current Version": u32, "FPGA Oldest Compatible Version": u32, "Fixed Logic Current Version": u32, "Fixed Logic Oldest Compatible Version": u32, "FPGA Radio Settings Bus Current Version": u32, "FPGA Radio Settings Bus Oldest Compatible Version": u32, "FPGA Board Config Current Version": u32, "FPGA Board Config Oldest Compatible Version": u32, "Daughterboard Clock Rate": u32}
  T2 = cluster{"FPGA ref": any, "bus instance": u32, "instruction FIFO depth": u32, "executing on FPGA target": bool, "show error call chain": bool}
  T3 = cluster{"Actual Gain [dB]": f64, "Attenuation Table Index": i32}
  T4 = cluster{"Attenuation Table [dB]": f64[][], "Frequencies [Hz]": f64[], "IQ Imbalance Table": "IQ Imbalance.gtype"[], "Gain Table": T3[][]}
  T5 = cluster{"FlexRIO Register Bus": Queue<T2>, "RX Characterization Data": T4, "TX Characterization Data": T4, "FPGA Interface": any}
  T6 = cluster{"transport block size": u32, "CRC ok": bool, "user data": u32}
  "Link Direction.gtype" = enum{"DL", "UL"}
  T7 = cluster{"MAC Stub RX Payload Information FIFO": RTFifoRefnum<"MAC Stub RX Payload Information.gtype">, "MAC Stub RX Confirmation Information FIFO": RTFifoRefnum<u64[16]>, "MAC Stub RX UL Payload Information FIFO": RTFifoRefnum<f64[23]>}
  T8 = cluster{"MAC Stub TX Input Terminals FIFO": RTFifoRefnum<"MAC Stub TX Input Terminals.gtype">, "MAC Stub TX Output Terminals FIFO": RTFifoRefnum<"MAC Stub TX Output Terminals.gtype">}
  T9 = cluster{"MAC Stub RX Interface": T7, "MAC Stub TX Interface": T8}
  "Host Session.gtype" = cluster{"target": enum{"USRP", "FlexRIO"}, "real time mode": bool, "MAC Stub enabled": bool, "DMA FIFO read timeout": i32, "timed loop period": i64, "LTE Transport Sessions": "Transport Session.gtype"[], "USRP session": "niUsrpRio Session.gtype", "FlexRIO session": T5, "UDP RX session": UdpNetworkConnectionRefnum, "UDP TX session": UdpNetworkConnectionRefnum, "sync found FIFO": RTFifoRefnum<bool>, "PDCCH CRC OK FIFO": RTFifoRefnum<bool>, "DL PDCCH status FIFO": RTFifoRefnum<cluster{"CRC ok": bool, "subframe number": u32}>, "DL PDSCH status FIFO": RTFifoRefnum<cluster{"CRC ok": bool, "subframe number": u32}>, "DL SINR FIFO": RTFifoRefnum<f64[]>, "PDSCH user data FIFO": RTFifoRefnum<u32>, "PDSCH user data UDP FIFO": RTFifoRefnum<T6>, "PDSCH user data throughput FIFO": RTFifoRefnum<T6>, "PUSCH user data FIFO": RTFifoRefnum<u32>, "PUSCH user data UDP FIFO": RTFifoRefnum<T6>, "PUSCH user data throughput FIFO": RTFifoRefnum<T6>, "UE feedback info FIFO": RTFifoRefnum<u8[]>, "Request information FIFO": RTFifoRefnum<"Request Information.gtype">, "UDP TX outbound FIFO": RTFifoRefnum<u8[]>, "UDP RX inbound FIFO": RTFifoRefnum<u8[]>, "stop notifier": Notifier<string>, "DL RX scope": string, "UL RX scope": string, "external MAC log file": string, "external MAC process ID": u32, "TX link direction": "Link Direction.gtype", "RX link direction": "Link Direction.gtype", "Sychronization FIFO": RTFifoRefnum<i32>, "RT Loop Interfaces": T9}
uses:
  NI::G Core::Error::Filter Error Code.gvi
  AFW::LTE::Configuration::Flush User Data FIFO.gvi
  AFW::LTE::Configuration::Flush U32 FIFO.gvi
  AFW::LTE::Configuration::Flush Boolean FIFO.gvi
diagram:
  case ($"throughput select") {
    frame "PDSCH (overall)", Default {
      w1 = 0
    }
    frame "PDSCH (CRC ok)" {
      w1 = 1
    }
    frame "User data (to UDP)" {
      w1 = 2
    }
  }
  # Average last 2 results
  To Double Precision Float(number=$"time difference") -> w2
  Divide(x=w2, y=1000) -> w3
  Multiply(1000000, w3) -> w4
  Property Node(instance in=$session) -> ("sync found FIFO"=w5, "PDCCH CRC OK FIFO"=w6, "PDSCH user data FIFO"=w7, "PDSCH user data throughput FIFO"=w8)
  call "Filter Error Code.gvi"(error in=$"error in", code to clear=-63195) -> (error out=w9)
  call "Flush User Data FIFO.gvi"(user data FIFO in=w8, error in=w9) -> (user data=w10, error out=w11)
  call "Flush U32 FIFO.gvi"(U32 FIFO in=w7, error in=w11) -> (U32=w12, error out=w13)
  Add Array Elements(numeric array=w12) -> (sum=w14)
  To Double Precision Float(number=w14) -> w15
  Divide(x=w15, y=w4) -> w16
  for {
    w17 = each element of w10
    Property Node(instance in=w17) -> ("transport block size"=w21, "CRC ok"=w22)
    Select(s=w22, t=w21, f=0) -> w23
    Boolean To 0 Or 1(Boolean=w22) -> (0, 1=w24)
    append w23 to w18
    append w21 to w19
    append w24 to w20
  }
  Add Array Elements(numeric array=w18) -> (sum=w25)
  To Double Precision Float(number=w25) -> w26
  Divide(x=w26, y=w4) -> w27
  Add Array Elements(numeric array=w19) -> (sum=w28)
  To Double Precision Float(number=w28) -> w29
  Divide(x=w29, y=w4) -> w30
  Build Array(w16, w27, w30) -> w31
  Reverse 1D Array(array=w31) -> (reversed array=w32)
  Add(w32, $"DL throughput previous") -> w33
  Divide(x=w33, y=2) -> w34
  Array Index(array=w34) -> (out0[w1]=w35)
  $"DL throughput (current)" <- w35
  Build Array(w34) -> w36
  $"DL throughput averaged" <- w36
  $"DL throughput current" <- w32
  call "Flush Boolean FIFO.gvi"(boolean FIFO in=w6, error in=w13) -> (booleans=w37, error out=w38)
  call "Flush Boolean FIFO.gvi"(boolean FIFO in=w5, error in=w38) -> (booleans=w39, error out=w40)
  Boolean To 0 Or 1(Boolean=w39) -> (0, 1=w41)
  Add Array Elements(numeric array=w41) -> (sum=w42)
  To Double Precision Float(number=w42) -> w43
  Array Size(array=w41) -> (size(s)=w44)
  To Double Precision Float(number=w44) -> w45
  Divide(x=w43, y=w45) -> w46
  Subtract(x=1, y=w46) -> w47
  Boolean To 0 Or 1(Boolean=w37) -> (0, 1=w48)
  Add Array Elements(numeric array=w48) -> (sum=w49)
  To Double Precision Float(number=w49) -> w50
  Array Size(array=w48) -> (size(s)=w51)
  To Double Precision Float(number=w51) -> w52
  Divide(x=w50, y=w52) -> w53
  Is Greater Than 0(x=w52) -> w54
  Select(s=w54, t=w53, f=0) -> w55
  Multiply(w46, w55) -> w56
  Subtract(x=1, y=w56) -> w57
  Add Array Elements(numeric array=w20) -> (sum=w58)
  To Double Precision Float(number=w58) -> w59
  Array Size(array=w20) -> (size(s)=w60)
  To Double Precision Float(number=w60) -> w61
  Divide(x=w59, y=w61) -> w62
  Is Greater Than 0(x=w61) -> w63
  Select(s=w63, t=w62, f=0) -> w64
  Multiply(w56, w64) -> w65
  Subtract(x=1, y=w65) -> w66
  Build Array(w47, w57, w66) -> w67
  Reverse 1D Array(array=w67) -> (reversed array=w68)
  Build Array(w68) -> w69
  $"DL BLER" <- w69
  w70 = cluster{"PDSCH": f64, "PDCCH": f64, "sync": f64} {all zero or empty}
  Property Node(instance in=w70, "PDSCH"=w66, "PDCCH"=w57, "sync"=w47) -> (instance out=w71)
  $"BLER cluster" <- w71
  $"error out" <- w40
