vi "Calculate TX Power Spectrum.gvi"   [LabVIEW NXG 4.0.0]
# Reinterprets TX data values read from the FPGA and calculates the TX power spectrum.
inputs:
  "TX data": u32[]  # Array of transmitter data values read from the FPGA. Only the first 30,720 values are used for spectrum calculation.
  "error in": error
  "coerced gain [dB]": f64 = 10  # Coerced TX gain used for TX spectrum magnitude correction.
outputs:
  "TX power spectrum": T1  # Calculated TX power spectrum for 1 subframe (30,720 samples).
  "error out": error
types:
  T1 = cluster{"f0": f64, "df": f64, "magnitude": f64[]}
  T2 = enum{"No averaging", "Vector averaging", "RMS averaging", "Peak hold"}
  "Averaging Parameters.gtype" = cluster{"averaging mode": T2, "weighting mode": enum{"Linear", "Exponential"}, "number of averages": u32}
uses:
  NI::Analysis::Measurement::Power Spectrum for 1 Chan (CDB).gvi
diagram:
  Array Subset(array=$"TX data", length0=30720) -> w1
  Split Number(x=w1) -> (high(x)=w2, low(x)=w3)
  for {
    w4 = each element of w2
    w5 = each element of w3
    Reinterpret Number[RestrictToSameWordLength=True](data in=w5, type=UFXP(1.15) 0) -> (data out=w7)
    To Fixed Point(fixed-point type=FXP(1.15) 0, number=w7) -> w8: FXP(1.15) Wrap:Truncate
    To Double Precision Float(number=w8) -> w9
    Reinterpret Number[RestrictToSameWordLength=True](data in=w4, type=UFXP(1.15) 0) -> (data out=w10)
    To Fixed Point(fixed-point type=FXP(1.15) 0, number=w10) -> w11: FXP(1.15) Wrap:Truncate
    To Double Precision Float(number=w11) -> w12
    Real And Imaginary To Complex(x=w9, y=w12) -> w13
    append w13 to w6
  }
  Reciprocal(x=30720000) -> w14
  Property Node(instance in=waveform<c128> {dt=1, Y=[]}, "Y"=w6, "dt"=w14) -> (instance out=w15)
  call "Power Spectrum for 1 Chan (CDB).gvi"(signal=w15, window type="Rectangle"(0), averaging parameters="Averaging Parameters.gtype" {all zero or empty}, dB on=TRUE, error in=$"error in", restart averaging=FALSE) -> (power spectrum=w16, error out=w17)
  Property Node(instance in=w16) -> ("magnitude"=w18, instance out=w19)
  Add(w18, $"coerced gain [dB]") -> w20
  Property Node(instance in=w19, "magnitude"=w20) -> (instance out=w21)
  $"TX power spectrum" <- w21
  $"error out" <- w17
