vi "Check Subframe for Transmit.gvi"   [LabVIEW NXG 4.0.0]
inputs:
  "frame structure": enum{"FDD", "TDD 5 5"} = "FDD"
  "subframe index": u8
  "UL TX": bool
  "error in": error
outputs:
  "allow DL transmit": bool
  "allow UL transmit": bool
  "error out": error
diagram:
  case ($"frame structure") {
    frame "TDD 5 5" {
      To Signed 32 Bit Integer(number=$"subframe index") -> w3
      w4 = ["DL", "SSF", "UL", "DL", "DL", "DL", "DL", "DL", "DL", "DL"]
      Array Index(array=w4) -> (out0[w3]=w5)
      Is Equal(x="DL", y=w5) -> w6
      Logical And(not $"UL TX", w6) -> w1
      Is Equal(x="UL", y=w5) -> w7
      Logical And($"UL TX", w7) -> w2
    }
    frame "FDD" {
      w1 = TRUE
      w2 = TRUE
    }
  }
  $"allow DL transmit" <- w1
  $"allow UL transmit" <- w2
  $"error out" <- $"error in"
