vi "Collect DL Status Info.gvi"   [LabVIEW NXG 4.0.0]
# Reads DL status information for the current radioframe from different queues and provides wideband SNR, sub-band SNR and DL ACK/NACK feedback information in the correct UL feedback channel payload format.
inputs:
  "error in": error
  "session": "Host Session.gtype"
outputs:
  "SNR0": u32  # Sub-band SNR for sub-band 0-3 as 8 bit fixed point (FXP6.2) values (sub-band 0 @ MSBs, sub-band 3 @ LSBs).
  "DL ACK/NACK feedback": u32  # Array of DL ACK/NACK feedback information for one radio frame as 2-bit values for 10 subframes (starting with LSBs for subframe 0).
  "SNR1": u32  # Sub-band SNR for sub-band 4-7 as 8 bit fixed point (FXP6.2) values (sub-band 4 @ MSBs, sub-band 7 @ LSBs).
  "SNR2": u32  # Sub-band SNR for sub-band 8-11 as 8 bit fixed point (FXP6.2) values (sub-band 8 @ MSBs, sub-band 11 @ LSBs).
  "SNR3": u32  # Sub-band SNR for sub-band 12 and wideband SNR as 8 bit fixed point (FXP6.2) values (sub-band 12 @ bits 8-15, wideband SNR @ LSBs).
  "error out": error
types:
  "Transport Session.gtype" = cluster{"FIFO pathname": string, "pipe reader": "Pipe Reader.gtype", "pipe writer": "Pipe Writer.gtype", "transport in RT FIFO": RTFifoRefnum<u8[]>, "transport out RT FIFO": RTFifoRefnum<u8[]>, "transport in timing source name": string, "transport in timing trigger ID": u8, "transport out timing source name": string, "transport out timing trigger ID": u8, "maximum API message size": u32}
  "Register Bus Session.gtype" = Queue<"Session Data.gtype">
  "Semaphore.gtype" = i32
  "DB Queue Reference.gtype" = Queue<"Daughterboard Data.gtype">
  "niUsrpRio Session.gtype" = cluster{"FPGA Interface": any, "RIO Interface Number": u32, "Data Clock Rate": u32, "FPGA Data Clock Rate": u32, "Global Settings Register Bus": "Register Bus Session.gtype", "Radio 0 Settings Register Bus": "Register Bus Session.gtype", "Radio 1 Settings Register Bus": "Register Bus Session.gtype", "Radio Settings Bus Semaphore": "Semaphore.gtype", "DB Queues": "DB Queue Reference.gtype"[], "Characterization Data Valid?": bool, "EEPROM Header": "EEPROM Header.gtype", "Device Data Header": "EEPROM Device Data Header.gtype", "EEPROM Characterization Header": "EEPROM Characterization Header.gtype", "Characterization Data": "Characterization Data.gtype"[], "FPGA Current Version": u32, "FPGA Oldest Compatible Version": u32, "Fixed Logic Current Version": u32, "Fixed Logic Oldest Compatible Version": u32, "FPGA Radio Settings Bus Current Version": u32, "FPGA Radio Settings Bus Oldest Compatible Version": u32, "FPGA Board Config Current Version": u32, "FPGA Board Config Oldest Compatible Version": u32, "Daughterboard Clock Rate": u32}
  T1 = cluster{"FPGA ref": any, "bus instance": u32, "instruction FIFO depth": u32, "executing on FPGA target": bool, "show error call chain": bool}
  T2 = cluster{"Actual Gain [dB]": f64, "Attenuation Table Index": i32}
  T3 = cluster{"Attenuation Table [dB]": f64[][], "Frequencies [Hz]": f64[], "IQ Imbalance Table": "IQ Imbalance.gtype"[], "Gain Table": T2[][]}
  T4 = cluster{"FlexRIO Register Bus": Queue<T1>, "RX Characterization Data": T3, "TX Characterization Data": T3, "FPGA Interface": any}
  T5 = cluster{"transport block size": u32, "CRC ok": bool, "user data": u32}
  "Link Direction.gtype" = enum{"DL", "UL"}
  T6 = cluster{"MAC Stub RX Payload Information FIFO": RTFifoRefnum<"MAC Stub RX Payload Information.gtype">, "MAC Stub RX Confirmation Information FIFO": RTFifoRefnum<u64[16]>, "MAC Stub RX UL Payload Information FIFO": RTFifoRefnum<f64[23]>}
  T7 = cluster{"MAC Stub TX Input Terminals FIFO": RTFifoRefnum<"MAC Stub TX Input Terminals.gtype">, "MAC Stub TX Output Terminals FIFO": RTFifoRefnum<"MAC Stub TX Output Terminals.gtype">}
  T8 = cluster{"MAC Stub RX Interface": T6, "MAC Stub TX Interface": T7}
  "Host Session.gtype" = cluster{"target": enum{"USRP", "FlexRIO"}, "real time mode": bool, "MAC Stub enabled": bool, "DMA FIFO read timeout": i32, "timed loop period": i64, "LTE Transport Sessions": "Transport Session.gtype"[], "USRP session": "niUsrpRio Session.gtype", "FlexRIO session": T4, "UDP RX session": UdpNetworkConnectionRefnum, "UDP TX session": UdpNetworkConnectionRefnum, "sync found FIFO": RTFifoRefnum<bool>, "PDCCH CRC OK FIFO": RTFifoRefnum<bool>, "DL PDCCH status FIFO": RTFifoRefnum<cluster{"CRC ok": bool, "subframe number": u32}>, "DL PDSCH status FIFO": RTFifoRefnum<cluster{"CRC ok": bool, "subframe number": u32}>, "DL SINR FIFO": RTFifoRefnum<f64[]>, "PDSCH user data FIFO": RTFifoRefnum<u32>, "PDSCH user data UDP FIFO": RTFifoRefnum<T5>, "PDSCH user data throughput FIFO": RTFifoRefnum<T5>, "PUSCH user data FIFO": RTFifoRefnum<u32>, "PUSCH user data UDP FIFO": RTFifoRefnum<T5>, "PUSCH user data throughput FIFO": RTFifoRefnum<T5>, "UE feedback info FIFO": RTFifoRefnum<u8[]>, "Request information FIFO": RTFifoRefnum<"Request Information.gtype">, "UDP TX outbound FIFO": RTFifoRefnum<u8[]>, "UDP RX inbound FIFO": RTFifoRefnum<u8[]>, "stop notifier": Notifier<string>, "DL RX scope": string, "UL RX scope": string, "external MAC log file": string, "external MAC process ID": u32, "TX link direction": "Link Direction.gtype", "RX link direction": "Link Direction.gtype", "Sychronization FIFO": RTFifoRefnum<i32>, "RT Loop Interfaces": T8}
uses:
  AFW::LTE::Configuration::Read with Preview PDCCH Status FIFO.gvi
  AFW::LTE::Configuration::Read with Preview PDSCH Status FIFO.gvi
  AFW::Common::Check Stop.gvi
diagram:
  Property Node(instance in=$session) -> ("DL SINR FIFO"=w1, "DL PDCCH status FIFO"=w2, "DL PDSCH status FIFO"=w3)
  Initialize Array(element="DTX", size=10) -> w4
  s1 = 0  # shift register
  s2 = w4  # shift register
  s3 = $"error in"  # shift register
  s4 = uninitialised  # shift register
  while {
    RTFIFO Read(error in=s3, rt fifo=w1) -> (element out=w5, empty?=w6, error out=w7)
    Select(s=w6, t=s4, f=w5) -> w8
    call "Read with Preview PDCCH Status FIFO.gvi"(rt fifo reference in=w2, error in=s3, preview=TRUE) -> (rt fifo reference out=w9, error out=w10, empty=w11)
    Not(x=w11) -> w12
    Not(x=w6) -> w13
    Logical Or(w13, w12) -> w14
    case (w14) {
      frame True { }
      frame False {
        # prevent busy waiting
        Wait[Units=Microseconds](time to wait=100)
      }
    }
    call "Read with Preview PDSCH Status FIFO.gvi"(rt fifo reference in=w3, error in=s3, preview=TRUE) -> (rt fifo reference out=w15, error out=w16, empty=w17)
    Not(x=w17) -> w18
    Merge Errors(w10, w16) -> (error out=w19)
    case (w12) {
      frame False, Default {
        w20 = s1
        w21 = s2
        w22 = w19
      }
      frame True {
        call "Read with Preview PDCCH Status FIFO.gvi"(rt fifo reference in=w9, error in=w19, preview=TRUE) -> (rt fifo reference out=w23, error out=w24, element out=w25)
        case (w18) {
          frame False, Default {
            w29 = cluster{"CRC ok": bool, "subframe number": u32} {"CRC ok"=FALSE, "subframe number"=10}
            w26 = w29
            w27 = w15
            w28 = w19
          }
          frame True {
            call "Read with Preview PDSCH Status FIFO.gvi"(rt fifo reference in=w15, error in=w19, preview=TRUE) -> (rt fifo reference out=w27, error out=w28, element out=w26)
          }
        }
        Merge Errors(w24, w28) -> (error out=w30)
        Property Node(instance in=w25) -> ("CRC ok"=w31, "subframe number"=w32)
        Is Equal(x=w32, y=s1) -> w33
        case (w33) {
          frame False, Default {
            w34 = w30
          }
          frame True {
            call "Read with Preview PDCCH Status FIFO.gvi"(rt fifo reference in=w23, error in=w30, preview=FALSE) -> (error out=w34)
          }
        }
        Property Node(instance in=w26) -> ("CRC ok"=w35, "subframe number"=w36)
        Is Equal(x=s1, y=w36) -> w37
        case (w37) {
          frame False, Default {
            w38 = w30
          }
          frame True {
            call "Read with Preview PDSCH Status FIFO.gvi"(rt fifo reference in=w27, error in=w30, preview=FALSE) -> (error out=w38)
          }
        }
        Merge Errors(w34, w38) -> (error out=w22)
        Logical And(w31, w33) -> w39
        Logical And(w37, w35) -> w40
        Select(s=w40, t="ACK", f="NACK") -> w41
        Select(s=w39, t=w41, f="DTX") -> w42
        To Signed 32 Bit Integer(number=s1) -> w43
        Replace Array Subset(inArray=s2, index=w43, new=w42) -> w21
        Increment(x=s1) -> w20
      }
    }
    Is Greater(x=w20, y=9) -> w44
    Merge Errors(w7, w22) -> (error out=w45)
    call "Check Stop.gvi"(error in=w45) -> (error out=w46, stop=w47)
    Logical Or(w44, w47) -> w48
    next s1 = w20
    next s2 = w21
    next s3 = w46
    next s4 = w8
    stop if w48
  }
  To Fixed Point(number=s4) -> w49: FXP(6.2)[] Saturate:ConvergentRounding
  Reinterpret Number[RestrictToSameWordLength=True](data in=w49, type=u8 0) -> (data out=w50)
  To Unsigned 8 Bit Integer(number=w50) -> w51
  Array Index(array=w51) -> (out0[_]=w52, out1[_]=w53, out2[_]=w54, out3[_]=w55, out4[_]=w56, out5[_]=w57, out6[_]=w58, out7[_]=w59, out8[_]=w60, out9[_]=w61, out10[_]=w62, out11[_]=w63, out12[_]=w64, out13[_]=w65)
  Join Numbers(high(x)=w52, low(x)=w53) -> w66
  Join Numbers(high(x)=w54, low(x)=w55) -> w67
  Join Numbers(high(x)=w66, low(x)=w67) -> w68
  $SNR0 <- w68
  Join Numbers(high(x)=w56, low(x)=w57) -> w69
  Join Numbers(high(x)=w58, low(x)=w59) -> w70
  Join Numbers(high(x)=w69, low(x)=w70) -> w71
  $SNR1 <- w71
  Join Numbers(high(x)=w60, low(x)=w61) -> w72
  Join Numbers(high(x)=w62, low(x)=w63) -> w73
  Join Numbers(high(x)=w72, low(x)=w73) -> w74
  $SNR2 <- w74
  Join Numbers(high(x)=w64, low(x)=w65) -> w75
  To Unsigned 32 Bit Integer(number=w75) -> w76
  $SNR3 <- w76
  s5 = bool[] []  # shift register
  for {
    w77 = each element of s2
    Type Cast(type=u16 0, x=w77) -> w78
    Number To Boolean Array(number=w78) -> (Boolean array=w79)
    Array Subset(array=w79, index0=0, length0=2) -> w80
    Build Array(s5, w80) -> w81
    next s5 = w81
  }
  Boolean Array To Number(Boolean array=s5) -> (number=w82)
  $"DL ACK/NACK feedback" <- w82
  $"error out" <- s3
