vi "Compute TX Trigger Offset.gvi"   [LabVIEW NXG 4.0.0]
# Adds processing delay and configured timing advances, and converts the result to an offset in clock cycles of the corresponding FPGA loop.
inputs:
  "processing delay [samples]": u32 = 17229  # Processing delay in number of baseband samples, defined as the delay from DL baseband TX start signal to UL baseband RX start trigger (TX + RX processing delay assuming no propagation delay).
  "timing advance [samples]": u32  # Configured timing advance in number of baseband samples used to compensate propagation delay between TX and RX antenna).
  "clock cycles per radio frame": u32 = 17229  # Number of clock cycles per radio frame in the data processing clock domain.
outputs:
  "TX trigger offset": u32  # Calculated trigger offset in number of 120 MHz clock cycles used to compensate processing delay on the FPGA and propagation delay at the RF link.
diagram:
  To Unsigned 64 Bit Integer(number=$"clock cycles per radio frame") -> w1
  Add($"processing delay [samples]", $"timing advance [samples]") -> w2
  To Unsigned 64 Bit Integer(number=w2) -> w3
  # convert offset in samples to
  # offset in clock cycles (120, 130 or 200MHz)
  Multiply(w1, w3) -> w4
  Quotient And Remainder(x=w4, y=307200) -> (floor(x/y)=w5)
  To Unsigned 32 Bit Integer(number=w5) -> w6
  $"TX trigger offset" <- w6
