vi "Create Dynamic DL TX Configuration.gvi"   [LabVIEW NXG 4.0.0]
# Converts the host parameters DCI message and UE context (dynamic DL configuration) to the TTI configuration cluster.
# Coerces the DCI message when UERS is enabled and MCS = 28.
inputs:
  "DCI in": "DCI Message.gtype" = {"Active"=TRUE, "MCS"="MCS 17 (64-QAM, rate ~0.43)", "Resource Block Allocation (4 PRB/bit)"=8388607}
  "UE context": T1 = {"RNTI"=10, "Use UERS"=FALSE, "Antenna Port"=7, "CCE Offset"=0}  # Per-subframe changeable UE specific parameter set (use UERS, RNTI, antenna port, CCE offset). Corresponds to dynamic DL configuration on the FPGA.
outputs:
  "coerced DCI": "DCI Message.gtype"
  "dynamic configuration": cluster{"UE config": T1, "DCI message": T2}  # The resulting TTI configuration consisting of the UE context (dynamic DL configuration) and the full DCI message.
  "MCS adapted": bool  # Indicates if the DCI message was coerced.
types:
  T1 = cluster{"RNTI": u16, "Use UERS": bool, "Antenna Port": UFXP(4.0), "CCE Offset": u8}
  T2 = cluster{"valid": bool, "resource allocation header": UFXP(1.0), "resource block allocation": UFXP(25.0), "MCS": UFXP(5.0), "HARQ process number": UFXP(4.0), "new data indicator": bool, "redundancy version": UFXP(2.0), "TPC command for pucch": UFXP(2.0), "DL assignment index": UFXP(2.0)}
  T3 = enum{"MCS 0 (QPSK, rate ~0.12)", "MCS 1 (QPSK, rate ~0.15)", "MCS 2 (QPSK, rate ~0.19)", "MCS 3 (QPSK, rate ~0.25)", "MCS 4 (QPSK, rate ~0.30)", "MCS 5 (QPSK, rate ~0.37)", "MCS 6 (QPSK, rate ~0.44)", "MCS 7 (QPSK, rate ~0.51)", "MCS 8 (QPSK, rate ~0.59)", "MCS 9 (QPSK, rate ~0.66)", "MCS 10 (16-QAM, rate ~0.33)", "MCS 11 (16-QAM, rate ~0.37)", "MCS 12 (16-QAM, rate ~0.42)", "MCS 13 (16-QAM, rate ~0.48)", "MCS 14 (16-QAM, rate ~0.54)", "MCS 15 (16-QAM, rate ~0.60)", "MCS 16 (16-QAM, rate ~0.64)", "MCS 17 (64-QAM, rate ~0.43)", "MCS 18 (64-QAM, rate ~0.46)", "MCS 19 (64-QAM, rate ~0.50)", "MCS 20 (64-QAM, rate ~0.55)", "MCS 21 (64-QAM, rate ~0.60)", "MCS 22 (64-QAM, rate ~0.65)", "MCS 23 (64-QAM, rate ~0.70)", "MCS 24 (64-QAM, rate ~0.75)", "MCS 25 (64-QAM, rate ~0.80)", "MCS 26 (64-QAM, rate ~0.85)", "MCS 27 (64-QAM, rate ~0.89)", "MCS 28 (64-QAM, rate ~0.93)"}
  "DCI Message.gtype" = cluster{"Active": bool, "MCS": T3, "Resource Block Allocation (4 PRB/bit)": UFXP(25.0)}
diagram:
  Property Node(instance in=$"UE context") -> ("Use UERS"=w1, instance out=w2)
  Property Node(instance in=$"DCI in") -> ("Active"=w3, "MCS"=w4, "Resource Block Allocation (4 PRB/bit)"=w5, instance out=w6)
  Is Equal(x=w4, y="MCS 28 (64-QAM, rate ~0.93)") -> w7
  Logical And(w1, w7) -> w8
  $"MCS adapted" <- w8
  case (w8) {
    frame False, Default {
      w9 = w4
    }
    frame True {
      w10 = "MCS clipped to 27 as RX reception on the UE side will fail with MCS set to 28 and UERS enabled due to a code rate greater than 1!"
      One Button Dialog(message=w10)
      w9 = "MCS 27 (64-QAM, rate ~0.89)"
    }
  }
  Property Node(instance in=w6, "MCS"=w9) -> (instance out=w11)
  $"coerced DCI" <- w11
  Type Cast(type=u16 0, x=w9) -> w12
  To Fixed Point(fixed-point type=UFXP(5.0) 0, number=w12) -> w13
  Number To Boolean Array(number=w5) -> (Boolean array=w14)
  Reverse 1D Array(array=w14) -> (reversed array=w15)
  Boolean Array To Number(Boolean array=w15) -> (number=w16: UFXP(25.0))
  w17 = cluster{"UE config": T1, "DCI message": T2} {all zero or empty}
  Property Node(instance in=w17, "DCI message:MCS"=w13, "DCI message:resource block allocation"=w16, "DCI message:valid"=w3, "UE config"=w2) -> (instance out=w18)
  $"dynamic configuration" <- w18
