vi "DCI Interpreter DCI1x.gvi"   [LabVIEW NXG 4.0.0]
# Interprets a 70-bit message received from the PDCCH decoder as downlink control information format 1 message, and maps it into a cluster.
inputs:
  "DCI message": bool[]  # 70-bit Boolean array of decoded PDCCH data bits.
  "DCI message valid": bool  # Valid signal for DCI message.
outputs:
  "DCI message out": "DCI Message.gtype"
types:
  T1 = enum{"MCS 0 (QPSK, rate ~0.12)", "MCS 1 (QPSK, rate ~0.15)", "MCS 2 (QPSK, rate ~0.19)", "MCS 3 (QPSK, rate ~0.25)", "MCS 4 (QPSK, rate ~0.30)", "MCS 5 (QPSK, rate ~0.37)", "MCS 6 (QPSK, rate ~0.44)", "MCS 7 (QPSK, rate ~0.51)", "MCS 8 (QPSK, rate ~0.59)", "MCS 9 (QPSK, rate ~0.66)", "MCS 10 (16-QAM, rate ~0.33)", "MCS 11 (16-QAM, rate ~0.37)", "MCS 12 (16-QAM, rate ~0.42)", "MCS 13 (16-QAM, rate ~0.48)", "MCS 14 (16-QAM, rate ~0.54)", "MCS 15 (16-QAM, rate ~0.60)", "MCS 16 (16-QAM, rate ~0.64)", "MCS 17 (64-QAM, rate ~0.43)", "MCS 18 (64-QAM, rate ~0.46)", "MCS 19 (64-QAM, rate ~0.50)", "MCS 20 (64-QAM, rate ~0.55)", "MCS 21 (64-QAM, rate ~0.60)", "MCS 22 (64-QAM, rate ~0.65)", "MCS 23 (64-QAM, rate ~0.70)", "MCS 24 (64-QAM, rate ~0.75)", "MCS 25 (64-QAM, rate ~0.80)", "MCS 26 (64-QAM, rate ~0.85)", "MCS 27 (64-QAM, rate ~0.89)", "MCS 28 (64-QAM, rate ~0.93)"}
  "DCI Message.gtype" = cluster{"Active": bool, "MCS": T1, "Resource Block Allocation (4 PRB/bit)": UFXP(25.0)}
diagram:
  Array Subset(array=$"DCI message", index0=0, length0=25) -> w1
  Reverse 1D Array(array=w1) -> (reversed array=w2)
  Boolean Array To Number[SignExtensionMode=1](Boolean array=w2) -> (number=w3: u32 Wrap:Truncate)
  Reinterpret Number[RestrictToSameWordLength=True](data in=w3, type=UFXP(32.0) 0) -> (data out=w4)
  To Fixed Point(number=w4) -> w5: UFXP(25.0) Saturate:Truncate
  Array Subset(array=$"DCI message", index0=25, length0=5) -> w6
  Reverse 1D Array(array=w6) -> (reversed array=w7)
  Boolean Array To Number[SignExtensionMode=1](Boolean array=w7) -> (number=w8: u32 Wrap:Truncate)
  Reinterpret Number[RestrictToSameWordLength=True](data in=w8, type=UFXP(32.0) 0) -> (data out=w9)
  To Fixed Point(number=w9) -> w10: UFXP(5.0) Saturate:Truncate
  To Unsigned 16 Bit Integer(number=w10) -> w11
  Type Cast(type=T1 "MCS 0 (QPSK, rate ~0.12)", x=w11) -> w12
  Property Node(instance in="DCI Message.gtype" {all zero or empty}, "Active"=$"DCI message valid", "Resource Block Allocation (4 PRB/bit)"=w5, "MCS"=w12) -> (instance out=w13)
  $"DCI message out" <- w13
  Array Subset(array=$"DCI message", index0=30, length0=2) -> w14
  Reverse 1D Array(array=w14) -> (reversed array=w15)
  Boolean Array To Number[SignExtensionMode=1](Boolean array=w15) -> (number=w16: u32 Wrap:Truncate)
  Reinterpret Number[RestrictToSameWordLength=True](data in=w16, type=UFXP(32.0) 0) -> (data out=w17)
  # TPC Command for PUCCH
  To Fixed Point(number=w17)
