vi "DL TTI Configuration To U64.gvi"   [LabVIEW NXG 4.0.0]
# Converts the TTI configuration from the cluster input to a binary packed U64 format.
inputs:
  "TTI configuration cluster": cluster{"UE config": T1, "DCI message": T2}  # A cluster containing a Per-subframe changeable UE specific parameter set (RNTI, CCE offset, UERS configuration) and the full DCI message.
outputs:
  "TTI configuration out": u64  # The TTI configuration converted to a binary packed U64 value.
types:
  T1 = cluster{"RNTI": u16, "Use UERS": bool, "Antenna Port": UFXP(4.0), "CCE Offset": u8}
  T2 = cluster{"valid": bool, "resource allocation header": UFXP(1.0), "resource block allocation": UFXP(25.0), "MCS": UFXP(5.0), "HARQ process number": UFXP(4.0), "new data indicator": bool, "redundancy version": UFXP(2.0), "TPC command for pucch": UFXP(2.0), "DL assignment index": UFXP(2.0)}
diagram:
  Property Node(instance in=$"TTI configuration cluster") -> ("UE config:RNTI"=w1, "UE config:Use UERS"=w2, "UE config:Antenna Port"=w3, "UE config:CCE Offset"=w4, "DCI message:valid"=w5, "DCI message:resource block allocation"=w6, "DCI message:MCS"=w7, "DCI message:TPC command for pucch"=w8)
  Number To Boolean Array(number=w6) -> (Boolean array=w9)
  Number To Boolean Array(number=w7) -> (Boolean array=w10)
  Number To Boolean Array(number=w8) -> (Boolean array=w11)
  Build Array(w9, w10, w11) -> w12
  Boolean Array To Number(Boolean array=w12) -> (number=w13: u32)
  Number To Boolean Array(number=w3) -> (Boolean array=w14)
  Build Array(w2, w14, w5) -> w15
  Boolean Array To Number(Boolean array=w15) -> (number=w16: u8)
  Join Numbers(high(x)=w4, low(x)=w16) -> w17
  Join Numbers(high(x)=w1, low(x)=w17) -> w18
  Join Numbers(high(x)=w18, low(x)=w13) -> w19
  $"TTI configuration out" <- w19
