vi "Decode ACK NACK.gvi"   [LabVIEW NXG 4.0.0]
# Interprets the 32-bit data word received as part of the UL feedback channel payload as DL ACK/NACK information.
inputs:
  "data in": u32  # DL ACK/NACK information for one radioframe as 2-bit values for 10 subframes (starting with LSBs for subframe 0).
outputs:
  "ACK/NACK": enum{"NACK", "ACK", "DTX"}[]  # Array of DL ACK/NACK information, with each array element representing one subframe.
diagram:
  Number To Boolean Array(number=$"data in") -> (Boolean array=w1)
  Array Subset(array=w1, index0=0, length0=20) -> w2
  s1 = 0  # shift register
  s2 = enum{"NACK", "ACK", "DTX"}[] []  # shift register
  for (iteration -> i1) {
    w3 = each element of w2
    To Unsigned 8 Bit Integer(number=i1) -> w4
    Quotient And Remainder(x=w4, y=2) -> (x-y*floor(x/y)=w5)
    Is Equal(x=w5, y=1) -> w6
    Increment(x=w5) -> w7
    case (w3) {
      frame False, Default {
        w8 = s1
      }
      frame True {
        Add(s1, w7) -> w8
      }
    }
    case (w6) {
      frame False, Default {
        w9 = w8
        w10 = s2
      }
      frame True {
        case (w8) {
          frame 0, Default {
            w11 = "NACK"
          }
          frame 1 {
            w11 = "ACK"
          }
          frame 2 {
            w11 = "DTX"
          }
        }
        Build Array(s2, w11) -> w10
        w9 = 0
      }
    }
    next s1 = w9
    next s2 = w10
  }
  $"ACK/NACK" <- s2
