vi "Determine Configuration Trigger.gvi"   [LabVIEW NXG 4.0.0]
# Triggers RX or TX configuration when corresponding buttons on the host top level panel are pushed. If RX and TX are enabled simultaneously, the RX is enabled first.
inputs:
  "RX enabled": bool  # Must be connected to the enable RX button on the host top level.
  "TX enabled": bool  # Must be connected to the enable TX button on the host top level.
outputs:
  "trigger RX configuration": bool  # Triggers RX configuration. A trigger is always generated when the value of RX enable changes.
  "trigger TX configuration": bool  # Triggers TX configuration. A trigger is always generated when the value of TX enable changes.
diagram:
  Feedback Node(input=$"RX enabled") -> w1
  Feedback Node(input=w1) -> w2
  Is Not Equal(x=w1, y=w2) -> w3
  $"trigger RX configuration" <- w3
  Feedback Node(input=$"TX enabled") -> w4
  Feedback Node(input=w4) -> w5
  Is Not Equal(x=w4, y=w5) -> w6
  Feedback Node(initial value=FALSE, input=w7) -> w8
  Logical Or(w6, w8) -> w9
  Logical And(not w3, w9) -> w10
  $"trigger TX configuration" <- w10
  Logical And(w3, w9) -> w7
