vi "Extract Payload.gvi"   [LabVIEW NXG 4.0.0]
# Extracts the actual MAC payload from a received PHY packet, i.e. reads MAC header and removes padding.
inputs:
  "transport block": u8[]  # The received PHY data packet.
outputs:
  "payload length": u32  # The length of the payload in bytes.
  "payload": u8[]  # The actually filled portion of the transport block.
diagram:
  w1 = 4  # header length
  Split 1D Array(array=$"transport block", index=w1) -> (first subarray=w2, second subarray=w3)
  Reverse 1D Array(array=w2) -> (reversed array=w4)
  # build U32 from 4xU8
  # (payload length)
  Array Index(array=w4) -> (out0[_]=w5, out1[_]=w6, out2[_]=w7, out3[_]=w8)
  Join Numbers(high(x)=w5, low(x)=w6) -> w9
  Join Numbers(high(x)=w7, low(x)=w8) -> w10
  Join Numbers(high(x)=w9, low(x)=w10) -> w11
  $"payload length" <- w11
  To Signed 32 Bit Integer(number=w11) -> w12
  Array Subset(array=w3, length0=w12) -> w13
  $payload <- w13
