vi "Extract Received DCI.gvi"   [LabVIEW NXG 4.0.0]
# Extracts the 70-bit PDCCH payload message from the FPGA data, interprets it as downlink control information format 1 message, and maps it into a cluster.
# This node also extracts the additional PDCCH decoding status information from FPGA data and writes it into PDCCH status queues.
inputs:
  "PDCCH data": u32[][]  # Array of received PDCCH information from the FPGA. This input includes PDCCH payload data and status information.
  "error in": error
  "session in": "Host Session.gtype"
outputs:
  "DCI messages": "DCI Message.gtype"[]  # Downlink Control Information messages (DCI format 1).
  "error out": error
  "session out": "Host Session.gtype"  # Contains session information such as used target, FlexRIO and USRP sessions, FPGA reference, and queue references.
  "CCE offsets": u8[]  # The control channel element offsets the corresponding DCI messages have been received on.
  "DCI formats": u8[]  # The used DCI formats for the corresponding DCI messages.
types:
  T1 = enum{"MCS 0 (QPSK, rate ~0.12)", "MCS 1 (QPSK, rate ~0.15)", "MCS 2 (QPSK, rate ~0.19)", "MCS 3 (QPSK, rate ~0.25)", "MCS 4 (QPSK, rate ~0.30)", "MCS 5 (QPSK, rate ~0.37)", "MCS 6 (QPSK, rate ~0.44)", "MCS 7 (QPSK, rate ~0.51)", "MCS 8 (QPSK, rate ~0.59)", "MCS 9 (QPSK, rate ~0.66)", "MCS 10 (16-QAM, rate ~0.33)", "MCS 11 (16-QAM, rate ~0.37)", "MCS 12 (16-QAM, rate ~0.42)", "MCS 13 (16-QAM, rate ~0.48)", "MCS 14 (16-QAM, rate ~0.54)", "MCS 15 (16-QAM, rate ~0.60)", "MCS 16 (16-QAM, rate ~0.64)", "MCS 17 (64-QAM, rate ~0.43)", "MCS 18 (64-QAM, rate ~0.46)", "MCS 19 (64-QAM, rate ~0.50)", "MCS 20 (64-QAM, rate ~0.55)", "MCS 21 (64-QAM, rate ~0.60)", "MCS 22 (64-QAM, rate ~0.65)", "MCS 23 (64-QAM, rate ~0.70)", "MCS 24 (64-QAM, rate ~0.75)", "MCS 25 (64-QAM, rate ~0.80)", "MCS 26 (64-QAM, rate ~0.85)", "MCS 27 (64-QAM, rate ~0.89)", "MCS 28 (64-QAM, rate ~0.93)"}
  "DCI Message.gtype" = cluster{"Active": bool, "MCS": T1, "Resource Block Allocation (4 PRB/bit)": UFXP(25.0)}
  "Transport Session.gtype" = cluster{"FIFO pathname": string, "pipe reader": "Pipe Reader.gtype", "pipe writer": "Pipe Writer.gtype", "transport in RT FIFO": RTFifoRefnum<u8[]>, "transport out RT FIFO": RTFifoRefnum<u8[]>, "transport in timing source name": string, "transport in timing trigger ID": u8, "transport out timing source name": string, "transport out timing trigger ID": u8, "maximum API message size": u32}
  "Register Bus Session.gtype" = Queue<"Session Data.gtype">
  "Semaphore.gtype" = i32
  "DB Queue Reference.gtype" = Queue<"Daughterboard Data.gtype">
  "niUsrpRio Session.gtype" = cluster{"FPGA Interface": any, "RIO Interface Number": u32, "Data Clock Rate": u32, "FPGA Data Clock Rate": u32, "Global Settings Register Bus": "Register Bus Session.gtype", "Radio 0 Settings Register Bus": "Register Bus Session.gtype", "Radio 1 Settings Register Bus": "Register Bus Session.gtype", "Radio Settings Bus Semaphore": "Semaphore.gtype", "DB Queues": "DB Queue Reference.gtype"[], "Characterization Data Valid?": bool, "EEPROM Header": "EEPROM Header.gtype", "Device Data Header": "EEPROM Device Data Header.gtype", "EEPROM Characterization Header": "EEPROM Characterization Header.gtype", "Characterization Data": "Characterization Data.gtype"[], "FPGA Current Version": u32, "FPGA Oldest Compatible Version": u32, "Fixed Logic Current Version": u32, "Fixed Logic Oldest Compatible Version": u32, "FPGA Radio Settings Bus Current Version": u32, "FPGA Radio Settings Bus Oldest Compatible Version": u32, "FPGA Board Config Current Version": u32, "FPGA Board Config Oldest Compatible Version": u32, "Daughterboard Clock Rate": u32}
  T2 = cluster{"FPGA ref": any, "bus instance": u32, "instruction FIFO depth": u32, "executing on FPGA target": bool, "show error call chain": bool}
  T3 = cluster{"Actual Gain [dB]": f64, "Attenuation Table Index": i32}
  T4 = cluster{"Attenuation Table [dB]": f64[][], "Frequencies [Hz]": f64[], "IQ Imbalance Table": "IQ Imbalance.gtype"[], "Gain Table": T3[][]}
  T5 = cluster{"FlexRIO Register Bus": Queue<T2>, "RX Characterization Data": T4, "TX Characterization Data": T4, "FPGA Interface": any}
  T6 = cluster{"transport block size": u32, "CRC ok": bool, "user data": u32}
  "Link Direction.gtype" = enum{"DL", "UL"}
  T7 = cluster{"MAC Stub RX Payload Information FIFO": RTFifoRefnum<"MAC Stub RX Payload Information.gtype">, "MAC Stub RX Confirmation Information FIFO": RTFifoRefnum<u64[16]>, "MAC Stub RX UL Payload Information FIFO": RTFifoRefnum<f64[23]>}
  T8 = cluster{"MAC Stub TX Input Terminals FIFO": RTFifoRefnum<"MAC Stub TX Input Terminals.gtype">, "MAC Stub TX Output Terminals FIFO": RTFifoRefnum<"MAC Stub TX Output Terminals.gtype">}
  T9 = cluster{"MAC Stub RX Interface": T7, "MAC Stub TX Interface": T8}
  "Host Session.gtype" = cluster{"target": enum{"USRP", "FlexRIO"}, "real time mode": bool, "MAC Stub enabled": bool, "DMA FIFO read timeout": i32, "timed loop period": i64, "LTE Transport Sessions": "Transport Session.gtype"[], "USRP session": "niUsrpRio Session.gtype", "FlexRIO session": T5, "UDP RX session": UdpNetworkConnectionRefnum, "UDP TX session": UdpNetworkConnectionRefnum, "sync found FIFO": RTFifoRefnum<bool>, "PDCCH CRC OK FIFO": RTFifoRefnum<bool>, "DL PDCCH status FIFO": RTFifoRefnum<cluster{"CRC ok": bool, "subframe number": u32}>, "DL PDSCH status FIFO": RTFifoRefnum<cluster{"CRC ok": bool, "subframe number": u32}>, "DL SINR FIFO": RTFifoRefnum<f64[]>, "PDSCH user data FIFO": RTFifoRefnum<u32>, "PDSCH user data UDP FIFO": RTFifoRefnum<T6>, "PDSCH user data throughput FIFO": RTFifoRefnum<T6>, "PUSCH user data FIFO": RTFifoRefnum<u32>, "PUSCH user data UDP FIFO": RTFifoRefnum<T6>, "PUSCH user data throughput FIFO": RTFifoRefnum<T6>, "UE feedback info FIFO": RTFifoRefnum<u8[]>, "Request information FIFO": RTFifoRefnum<"Request Information.gtype">, "UDP TX outbound FIFO": RTFifoRefnum<u8[]>, "UDP RX inbound FIFO": RTFifoRefnum<u8[]>, "stop notifier": Notifier<string>, "DL RX scope": string, "UL RX scope": string, "external MAC log file": string, "external MAC process ID": u32, "TX link direction": "Link Direction.gtype", "RX link direction": "Link Direction.gtype", "Sychronization FIFO": RTFifoRefnum<i32>, "RT Loop Interfaces": T9}
uses:
  AFW::LTE::Conversion::DCI Interpreter DCI1x.gvi
diagram:
  $"session out" <- $"session in"
  s1 = $"error in"  # shift register
  for {
    w1 = each element of $"PDCCH data"
    Array Index(array=w1) -> (out0[0]=w5, out1[1]=w6, out2[2]=w7)
    Split Number(x=w7) -> (high(x)=w8, low(x)=w9)
    Split Number(x=w9) -> (high(x)=w10, low(x)=w11)
    Number To Boolean Array(number=w11) -> (Boolean array=w12)
    Array Index(array=w12) -> (out0[0]=w13)
    Number To Boolean Array(number=w5) -> (Boolean array=w14)
    Number To Boolean Array(number=w6) -> (Boolean array=w15)
    Split Number(x=w8) -> (high(x)=w16, low(x)=w17)
    Number To Boolean Array(number=w16) -> (Boolean array=w18)
    Array Subset(array=w18, index0=0, length0=6) -> w19
    # w20: DCI message bits
    Build Array(w19, w15, w14) -> w20
    call "DCI Interpreter DCI1x.gvi"(DCI message=w20, DCI message valid=w13) -> (DCI message out=w21)
    Property Node(instance in=$"session in") -> ("PDCCH CRC OK FIFO"=w22, "DL PDCCH status FIFO"=w23)
    # w13: DCI message valid
    Array Subset(array=w12, index0=4, length0=4) -> w24
    Boolean Array To Number(Boolean array=w24) -> (number=w25: u32)
    w26 = cluster{"CRC ok": bool, "subframe number": u32} {all zero or empty}
    Property Node(instance in=w26, "CRC ok"=w13, "subframe number"=w25) -> (instance out=w27)
    RTFIFO Write(element=w27, error in=s1, rt fifo=w23) -> (error out=w28)
    RTFIFO Write(element=w13, error in=s1, rt fifo=w22) -> (error out=w29)
    Merge Errors(w28, w29) -> (error out=w30)
    append w21 to w2
    append w17 to w3
    append w10 to w4
    next s1 = w30
  }
  $"DCI messages" <- w2
  $"DCI formats" <- w3
  $"CCE offsets" <- w4
  $"error out" <- s1
