vi "Get ADC and IFFT Status.gvi"   [LabVIEW NXG 4.0.0]
# Reads analog-to-digital converter (ADC) information and inverse fast Fourier transform (IFFT) status information from the FPGA.
inputs:
  "session in": "Host Session.gtype"
  "error in": error
outputs:
  "ADC values clipped": bool  # A Boolean that indicates whether the RX samples were clipped in the ADC The FPGA signalizes clipping for one second after the clipping occurs.
  "error out": error
  "TX IFFT output clipped": bool  # A Boolean that indicates whether the IFFT output in the TX baseband samples were clipped. The FPGA signalizes clipping for one second after the clipping occurrs.
  "RX DDC values clipped": bool  # A Boolean that indicates whether the RX samples were clipped in the DDC module. Clipping is signalized when the overflow counter on the FPGA has changed since the last readout.
  "session dup": "Host Session.gtype"  # Contains session information such as used target, FlexRIO and USRP sessions, FPGA reference, and queue references.
types:
  "Transport Session.gtype" = cluster{"FIFO pathname": string, "pipe reader": "Pipe Reader.gtype", "pipe writer": "Pipe Writer.gtype", "transport in RT FIFO": RTFifoRefnum<u8[]>, "transport out RT FIFO": RTFifoRefnum<u8[]>, "transport in timing source name": string, "transport in timing trigger ID": u8, "transport out timing source name": string, "transport out timing trigger ID": u8, "maximum API message size": u32}
  "Register Bus Session.gtype" = Queue<"Session Data.gtype">
  "Semaphore.gtype" = i32
  "DB Queue Reference.gtype" = Queue<"Daughterboard Data.gtype">
  "niUsrpRio Session.gtype" = cluster{"FPGA Interface": any, "RIO Interface Number": u32, "Data Clock Rate": u32, "FPGA Data Clock Rate": u32, "Global Settings Register Bus": "Register Bus Session.gtype", "Radio 0 Settings Register Bus": "Register Bus Session.gtype", "Radio 1 Settings Register Bus": "Register Bus Session.gtype", "Radio Settings Bus Semaphore": "Semaphore.gtype", "DB Queues": "DB Queue Reference.gtype"[], "Characterization Data Valid?": bool, "EEPROM Header": "EEPROM Header.gtype", "Device Data Header": "EEPROM Device Data Header.gtype", "EEPROM Characterization Header": "EEPROM Characterization Header.gtype", "Characterization Data": "Characterization Data.gtype"[], "FPGA Current Version": u32, "FPGA Oldest Compatible Version": u32, "Fixed Logic Current Version": u32, "Fixed Logic Oldest Compatible Version": u32, "FPGA Radio Settings Bus Current Version": u32, "FPGA Radio Settings Bus Oldest Compatible Version": u32, "FPGA Board Config Current Version": u32, "FPGA Board Config Oldest Compatible Version": u32, "Daughterboard Clock Rate": u32}
  T1 = cluster{"FPGA ref": any, "bus instance": u32, "instruction FIFO depth": u32, "executing on FPGA target": bool, "show error call chain": bool}
  T2 = cluster{"Actual Gain [dB]": f64, "Attenuation Table Index": i32}
  T3 = cluster{"Attenuation Table [dB]": f64[][], "Frequencies [Hz]": f64[], "IQ Imbalance Table": "IQ Imbalance.gtype"[], "Gain Table": T2[][]}
  T4 = cluster{"FlexRIO Register Bus": Queue<T1>, "RX Characterization Data": T3, "TX Characterization Data": T3, "FPGA Interface": any}
  T5 = cluster{"transport block size": u32, "CRC ok": bool, "user data": u32}
  "Link Direction.gtype" = enum{"DL", "UL"}
  T6 = cluster{"MAC Stub RX Payload Information FIFO": RTFifoRefnum<"MAC Stub RX Payload Information.gtype">, "MAC Stub RX Confirmation Information FIFO": RTFifoRefnum<u64[16]>, "MAC Stub RX UL Payload Information FIFO": RTFifoRefnum<f64[23]>}
  T7 = cluster{"MAC Stub TX Input Terminals FIFO": RTFifoRefnum<"MAC Stub TX Input Terminals.gtype">, "MAC Stub TX Output Terminals FIFO": RTFifoRefnum<"MAC Stub TX Output Terminals.gtype">}
  T8 = cluster{"MAC Stub RX Interface": T6, "MAC Stub TX Interface": T7}
  "Host Session.gtype" = cluster{"target": enum{"USRP", "FlexRIO"}, "real time mode": bool, "MAC Stub enabled": bool, "DMA FIFO read timeout": i32, "timed loop period": i64, "LTE Transport Sessions": "Transport Session.gtype"[], "USRP session": "niUsrpRio Session.gtype", "FlexRIO session": T4, "UDP RX session": UdpNetworkConnectionRefnum, "UDP TX session": UdpNetworkConnectionRefnum, "sync found FIFO": RTFifoRefnum<bool>, "PDCCH CRC OK FIFO": RTFifoRefnum<bool>, "DL PDCCH status FIFO": RTFifoRefnum<cluster{"CRC ok": bool, "subframe number": u32}>, "DL PDSCH status FIFO": RTFifoRefnum<cluster{"CRC ok": bool, "subframe number": u32}>, "DL SINR FIFO": RTFifoRefnum<f64[]>, "PDSCH user data FIFO": RTFifoRefnum<u32>, "PDSCH user data UDP FIFO": RTFifoRefnum<T5>, "PDSCH user data throughput FIFO": RTFifoRefnum<T5>, "PUSCH user data FIFO": RTFifoRefnum<u32>, "PUSCH user data UDP FIFO": RTFifoRefnum<T5>, "PUSCH user data throughput FIFO": RTFifoRefnum<T5>, "UE feedback info FIFO": RTFifoRefnum<u8[]>, "Request information FIFO": RTFifoRefnum<"Request Information.gtype">, "UDP TX outbound FIFO": RTFifoRefnum<u8[]>, "UDP RX inbound FIFO": RTFifoRefnum<u8[]>, "stop notifier": Notifier<string>, "DL RX scope": string, "UL RX scope": string, "external MAC log file": string, "external MAC process ID": u32, "TX link direction": "Link Direction.gtype", "RX link direction": "Link Direction.gtype", "Sychronization FIFO": RTFifoRefnum<i32>, "RT Loop Interfaces": T8}
uses:
  AFW::LTE::RF Control::Unbundle Session.gvi
diagram:
  $"session dup" <- $"session in"
  call "Unbundle Session.gvi"(session=$"session in") -> (TX link direction=w1, DL FPGA Interface=w2, UE FPGA Interface=w3)
  Property Node(instance in=w2, error in=$"error in") -> ("ADC values clipped"=w4, "rx.number of clipped IQ data samples"=w5, error out=w6)
  $"ADC values clipped" <- w4
  Feedback Node(input=w5) -> w7
  Is Not Equal(x=w5, y=w7) -> w8
  $"RX DDC values clipped" <- w8
  Dynamic Fpga Interface Cast(reference in=w2, type=any constant) -> (reference out=w9)
  case (w1) {
    frame "DL", Default {
      Property Node(instance in=w9, error in=$"error in") -> ("TX IFFT output clipped"=w10, error out=w11)
    }
    frame "UL" {
      Property Node(instance in=w3, error in=$"error in") -> ("UL TX IFFT output clipped"=w10, error out=w11)
    }
  }
  Merge Errors(w6, w11) -> (error out=w12)
  $"error out" <- w12
  $"TX IFFT output clipped" <- w10
