vi "Interpret PUSCH Payload.gvi"   [LabVIEW NXG 4.0.0]
# Interprets the decoded PUSCH payload and extracts contained downlink feedback information.
inputs:
  "PUSCH payload": u8[]  # PUSCH payload values. Contains downlink feedback information for one radio frame.
outputs:
  "radioframe number": u16  # Number of reported downlink radio frames. Valid range: 0-1023.
  "ACK/NACK": enum{"NACK", "ACK", "DTX"}[]  # Array of DL ACK/NACK information for the reported radio frame, with each array element representing one subframe.
  "subband SNR": FXP(6.2)[]  # Array of signal-to-noise ratio (SNR) values for the reported radio frame, in dB, for all 13 sub-bands of 8 physical resource blocks. The last sub-band contains only 4 resource blocks.
  "wideband SNR": FXP(6.2)  # Scalar wideband SNR for the reported radio frame, in dB.
uses:
  AFW::LTE::Conversion::Decode ACK NACK.gvi
diagram:
  Type Cast(type=u32[] [], x=$"PUSCH payload") -> w1
  Swap Bytes(data=w1) -> (byte swapped=w2)
  Swap Words(data=w2) -> (word swapped=w3)
  Array Index(array=w3) -> (out0[_]=w4, out1[_]=w5, out2[_]=w6, out3[_]=w7, out4[_]=w8, out5[_]=w9)
  Split Number(x=w4) -> w10
  $"radioframe number" <- w10
  call "Decode ACK NACK.gvi"(data in=w5) -> (ACK/NACK=w11)
  $"ACK/NACK" <- w11
  Type Cast(type=u8[] [], x=w6) -> w12
  Type Cast(type=u8[] [], x=w7) -> w13
  To Unsigned 16 Bit Integer(number=w9) -> w14
  Split Number(x=w14) -> (high(x)=w15, low(x)=w16)
  Type Cast(type=u8[] [], x=w8) -> w17
  Build Array(w12, w13, w17, w15) -> w18
  Reinterpret Number[RestrictToSameWordLength=True](data in=w18, type=FXP(6.2) 0) -> (data out=w19)
  $"subband SNR" <- w19
  Reinterpret Number[RestrictToSameWordLength=True](data in=w16, type=FXP(6.2) 0) -> (data out=w20)
  $"wideband SNR" <- w20
