vi "LTE Generate Error Report.gvi"   [LabVIEW NXG 4.0.0]
# Generates an error report for the system. The VI can handle multiplexed errors as well as errors with timestamp in it. If a time stamp is detected the errors are ordered by occurrence. Errors without timestamp are placed at the end of the list. Each error is printed with timestamp, location and error message.
inputs:
  "error in": error[]
outputs:
  "error report": string
  "error occured": bool
uses:
  NI::G Core::Error::Read Location.gvi
  NI::G Core::Error::Read Description.gvi
  NI::G Core::Error::Read Call Chain.gvi
  NI::G Core::Error::Is Error.gvi
diagram:
  for {
    w1 = each element of $"error in"
    call "Read Location.gvi"(error in=w1) -> (location=w3)
    call "Read Description.gvi"(error in=w1) -> (description=w4)
    call "Read Call Chain.gvi"(error in=w1) -> (call chain=w5)
    Array Index(array=w5) -> (out0[_]=w6)
    Match Pattern(regular expression="\\(", string=w6) -> (after substring=w7, before substring=w8)
    # Read stacktrace. If possible,
    # extract timestamp and detailed location
    # from first entry in stacktrace.
    # Bundle timestamp, occurance and
    # error message for further processing.
    Decimal String To Number(default (0 I32)=0, string=w7) -> (number=w9)
    # Sort elements without timestamp
    # to the end of the list.
    Is Equal To 0(x=w9) -> w10
    Select(s=w10, t=0xFFFFFFFF, f=w9) -> w11
    Build Cluster(w11, w3, w8, w4) -> w12
    call "Is Error.gvi"(error in=w1) -> (error?=w13)
    append w12 to w2 if w13
  }
  Sort 1D Array(array=w2) -> (sorted array=w14)
  s1 = ""  # shift register
  for {
    w15 = each element of w14
    Property Node(instance in=w15) -> ("Element 1"=w16, "Element 2"=w17, "Element 3"=w18, "Element 4"=w19)
    Is Equal(x=0xFFFFFFFF, y=w16) -> w20
    Is Empty String Or Path(string/path=w18) -> w21
    Select(s=w21, t="unknown location", f=w18) -> w22
    case (w20) {
      frame True {
        Format Into String(formatString="%s at %s\\n\\t%s\\n\\n", w17, w22, w19) -> w23
      }
      frame False {
        Format Into String(formatString="After %dµs: %s in %s\\n\\t%s\\n\\n", w16, w17, w22, w19) -> w23
      }
    }
    # Format each error into two line with first line for timestamp
    # (if available) and occurance and second for error message.
    Concatenate Strings(s1, w23) -> w24
    next s1 = w24
  }
  Is Empty String Or Path(string/path=s1) -> w25
  Select(s=w25, t="No error", f=s1) -> w26
  $"error report" <- w26
  Not(x=w25) -> w27
  $"error occured" <- w27
