vi "PDSCH Channel Decoder Status from U32.gvi"   [LabVIEW NXG 4.0.0]
# Maps the reported PDSCH channel decoder status bit vector to the decoder status channel cluster.
inputs:
  "bit vector in": u32  # A 64 bit vector containing PDSCH channel decoder status information.
outputs:
  "PDSCH decoder status": T1  # PDSCH channel decoder status cluster, including transport block size, CRC ok and user data (used for subframe number) information.
types:
  T1 = cluster{"transport block size": u32, "CRC ok": bool, "user data": u32}
diagram:
  Logical And($"bit vector in", 0x80000000) -> w1
  Is Not Equal To 0(x=w1) -> w2
  Logical And($"bit vector in", 0x3C000) -> w3
  Scale By Power Of 2(n=-14, x=w3) -> w4
  Logical And($"bit vector in", 0x3FFF) -> w5
  Scale By Power Of 2(n=3, x=w5) -> w6
  # 31	TB CRC ok
  # 30:18	CB CRC ok
  # 17:14	subframe number
  # 13:0	TB Size [byte]
  Property Node(instance in=T1 {all zero or empty}, "user data"=w4, "CRC ok"=w2, "transport block size"=w6) -> (instance out=w7)
  $"PDSCH decoder status" <- w7
