vi "Read Channel Estimates.gvi"   [LabVIEW NXG 4.0.0]
# Reads data from the target to host channel estimates FIFO, reinterprets the received values to get the contained estimated channel coefficients and the corresponding timing information, and calculates SNR values based on those values.
# Provides a trigger signal for displaying the calculated data on the host top level panel.
inputs:
  "session": "Host Session.gtype"
  "error in": error
  "UE Context": T1 = {"RNTI"=10, "Use UERS"=FALSE, "Antenna Port"=7, "CCE Offset"=0}  # Context of the receiving UE, required for “use UERS” flag
outputs:
  "channel estimation": f64[][]  # Amplitude and phase of extracted channel coefficients (based on CRS in OFDM symbol 0).
  "SubframeIndex": u8[]
  "error out": error
  "subband SNR [dB]": f64[]  # Array of signal-to-noise ratio (SNR) values, in dB, for all 13 sub-bands of 8 physical resource blocks (the last sub-band contains only 4 resource blocks).
  "wideband SNR [dB]": f64  # Scalar wideband signal-to-noise ratio (SNR), in dB.
  "CRSRaw": c128[]
types:
  T1 = cluster{"RNTI": u16, "Use UERS": bool, "Antenna Port": UFXP(4.0), "CCE Offset": u8}
  "Transport Session.gtype" = cluster{"FIFO pathname": string, "pipe reader": "Pipe Reader.gtype", "pipe writer": "Pipe Writer.gtype", "transport in RT FIFO": RTFifoRefnum<u8[]>, "transport out RT FIFO": RTFifoRefnum<u8[]>, "transport in timing source name": string, "transport in timing trigger ID": u8, "transport out timing source name": string, "transport out timing trigger ID": u8, "maximum API message size": u32}
  "Register Bus Session.gtype" = Queue<"Session Data.gtype">
  "Semaphore.gtype" = i32
  "DB Queue Reference.gtype" = Queue<"Daughterboard Data.gtype">
  "niUsrpRio Session.gtype" = cluster{"FPGA Interface": any, "RIO Interface Number": u32, "Data Clock Rate": u32, "FPGA Data Clock Rate": u32, "Global Settings Register Bus": "Register Bus Session.gtype", "Radio 0 Settings Register Bus": "Register Bus Session.gtype", "Radio 1 Settings Register Bus": "Register Bus Session.gtype", "Radio Settings Bus Semaphore": "Semaphore.gtype", "DB Queues": "DB Queue Reference.gtype"[], "Characterization Data Valid?": bool, "EEPROM Header": "EEPROM Header.gtype", "Device Data Header": "EEPROM Device Data Header.gtype", "EEPROM Characterization Header": "EEPROM Characterization Header.gtype", "Characterization Data": "Characterization Data.gtype"[], "FPGA Current Version": u32, "FPGA Oldest Compatible Version": u32, "Fixed Logic Current Version": u32, "Fixed Logic Oldest Compatible Version": u32, "FPGA Radio Settings Bus Current Version": u32, "FPGA Radio Settings Bus Oldest Compatible Version": u32, "FPGA Board Config Current Version": u32, "FPGA Board Config Oldest Compatible Version": u32, "Daughterboard Clock Rate": u32}
  T2 = cluster{"FPGA ref": any, "bus instance": u32, "instruction FIFO depth": u32, "executing on FPGA target": bool, "show error call chain": bool}
  T3 = cluster{"Actual Gain [dB]": f64, "Attenuation Table Index": i32}
  T4 = cluster{"Attenuation Table [dB]": f64[][], "Frequencies [Hz]": f64[], "IQ Imbalance Table": "IQ Imbalance.gtype"[], "Gain Table": T3[][]}
  T5 = cluster{"FlexRIO Register Bus": Queue<T2>, "RX Characterization Data": T4, "TX Characterization Data": T4, "FPGA Interface": any}
  T6 = cluster{"transport block size": u32, "CRC ok": bool, "user data": u32}
  "Link Direction.gtype" = enum{"DL", "UL"}
  T7 = cluster{"MAC Stub RX Payload Information FIFO": RTFifoRefnum<"MAC Stub RX Payload Information.gtype">, "MAC Stub RX Confirmation Information FIFO": RTFifoRefnum<u64[16]>, "MAC Stub RX UL Payload Information FIFO": RTFifoRefnum<f64[23]>}
  T8 = cluster{"MAC Stub TX Input Terminals FIFO": RTFifoRefnum<"MAC Stub TX Input Terminals.gtype">, "MAC Stub TX Output Terminals FIFO": RTFifoRefnum<"MAC Stub TX Output Terminals.gtype">}
  T9 = cluster{"MAC Stub RX Interface": T7, "MAC Stub TX Interface": T8}
  "Host Session.gtype" = cluster{"target": enum{"USRP", "FlexRIO"}, "real time mode": bool, "MAC Stub enabled": bool, "DMA FIFO read timeout": i32, "timed loop period": i64, "LTE Transport Sessions": "Transport Session.gtype"[], "USRP session": "niUsrpRio Session.gtype", "FlexRIO session": T5, "UDP RX session": UdpNetworkConnectionRefnum, "UDP TX session": UdpNetworkConnectionRefnum, "sync found FIFO": RTFifoRefnum<bool>, "PDCCH CRC OK FIFO": RTFifoRefnum<bool>, "DL PDCCH status FIFO": RTFifoRefnum<cluster{"CRC ok": bool, "subframe number": u32}>, "DL PDSCH status FIFO": RTFifoRefnum<cluster{"CRC ok": bool, "subframe number": u32}>, "DL SINR FIFO": RTFifoRefnum<f64[]>, "PDSCH user data FIFO": RTFifoRefnum<u32>, "PDSCH user data UDP FIFO": RTFifoRefnum<T6>, "PDSCH user data throughput FIFO": RTFifoRefnum<T6>, "PUSCH user data FIFO": RTFifoRefnum<u32>, "PUSCH user data UDP FIFO": RTFifoRefnum<T6>, "PUSCH user data throughput FIFO": RTFifoRefnum<T6>, "UE feedback info FIFO": RTFifoRefnum<u8[]>, "Request information FIFO": RTFifoRefnum<"Request Information.gtype">, "UDP TX outbound FIFO": RTFifoRefnum<u8[]>, "UDP RX inbound FIFO": RTFifoRefnum<u8[]>, "stop notifier": Notifier<string>, "DL RX scope": string, "UL RX scope": string, "external MAC log file": string, "external MAC process ID": u32, "TX link direction": "Link Direction.gtype", "RX link direction": "Link Direction.gtype", "Sychronization FIFO": RTFifoRefnum<i32>, "RT Loop Interfaces": T9}
uses:
  AFW::LTE::RF Control::Unbundle Session.gvi
  AFW::LTE::Conversion::U64 to Channel Estimates.gvi
  AFW::LTE::SNR::Calculate SNR.gvi
  AFW::LTE::Conversion::Calculate Channel Estimates.gvi
diagram:
  Property Node(instance in=$"UE Context") -> ("Use UERS"=w1)
  call "Unbundle Session.gvi"(session=$session) -> (DL FPGA Interface=w2)
  Dynamic Fpga Interface Cast(reference in=w2, type=any constant) -> (reference out=w3)
  Host Fifo Read Node[FifoName="LTE AFW Resources.grsc::T2H RX Channel Estimates"](error in=$"error in", number of elements=0, reference in=w3, timeout (ms)=0) -> (elements remaining=w4, error out=w5, reference out=w6)
  Host Fifo Read Node[FifoName="LTE AFW Resources.grsc::T2H RX Channel Estimates"](error in=w5, number of elements=w4, reference in=w6, timeout (ms)=0) -> (data=w7, error out=w8, reference out=w9)
  Array Size(array=w7) -> (size(s)=w10)
  Is Not Equal To 0(x=w10) -> w11
  case (w11) {
    frame False, Default {
      w12 = f64[][] []
      w13 = 0
      w14 = f64[] []
      w15 = default
      w16 = default
    }
    frame True {
      call "U64 to Channel Estimates.gvi"(signal in=w7) -> (timing indices=w17, estimated channel coefficients=w18, subframe index array=w19)
      call "Calculate SNR.gvi"(session=$session, CE samples in=w18, timing indices=w17, subframe index array=w19, use UERS=w1) -> (subband SNR=w14, wideband SNR=w13)
      call "Calculate Channel Estimates.gvi"(estimated channel coefficients=w18, timing indices=w17) -> (CRS amplitude=w20, CRS phase=w21, subframe Index=w15, CRSRaw=w16)
      Build Array(w20, w21) -> w12
    }
  }
  $"subband SNR [dB]" <- w14
  $"wideband SNR [dB]" <- w13
  $"channel estimation" <- w12
  $SubframeIndex <- w15
  $CRSRaw <- w16
  disable {
    frame Enabled {
      w22 = w8
    }
    frame Disabled {
      Property Node(instance in=w9, "number of channel estimate samples"=40000, "reset channel estimates"=TRUE, "reset channel estimates"=FALSE, error in=w8) -> (error out=w22)
    }
  }
  $"error out" <- w22
