vi "Read Constellation Data.gvi"   [LabVIEW NXG 4.0.0]
# Reads data from the target-to-host constellation data FIFO, reinterprets the received values to the correct data type, and provides a trigger signal for displaying that data on the host top level panel.
inputs:
  "session": "Host Session.gtype"
  "error in": error
  "symbol number for display": u8  # Only the constellation data samples of the specified OFDM symbol that is read from the FPGA.
  "RX tab": i32 = -1  # Selector for displayed constellation. 0 is DL RX basic, 1 is DL RX advanced. Anything else for UL RX
outputs:
  "constellation data": c128[]  # Constellation data values from the FPGA reinterpreted as complex double values. Only the first 4,000 received values are provided each time the node is called, in order to reduce CPU load.
  "display data out": bool  # Trigger for displaying the constellation data on the host top level panel.
  "error out": error
  "displayed constellation": enum{"DL EQ Output", "PDSCH Dec Input"}  # Determines the selected display of data
types:
  "Transport Session.gtype" = cluster{"FIFO pathname": string, "pipe reader": "Pipe Reader.gtype", "pipe writer": "Pipe Writer.gtype", "transport in RT FIFO": RTFifoRefnum<u8[]>, "transport out RT FIFO": RTFifoRefnum<u8[]>, "transport in timing source name": string, "transport in timing trigger ID": u8, "transport out timing source name": string, "transport out timing trigger ID": u8, "maximum API message size": u32}
  "Register Bus Session.gtype" = Queue<"Session Data.gtype">
  "Semaphore.gtype" = i32
  "DB Queue Reference.gtype" = Queue<"Daughterboard Data.gtype">
  "niUsrpRio Session.gtype" = cluster{"FPGA Interface": any, "RIO Interface Number": u32, "Data Clock Rate": u32, "FPGA Data Clock Rate": u32, "Global Settings Register Bus": "Register Bus Session.gtype", "Radio 0 Settings Register Bus": "Register Bus Session.gtype", "Radio 1 Settings Register Bus": "Register Bus Session.gtype", "Radio Settings Bus Semaphore": "Semaphore.gtype", "DB Queues": "DB Queue Reference.gtype"[], "Characterization Data Valid?": bool, "EEPROM Header": "EEPROM Header.gtype", "Device Data Header": "EEPROM Device Data Header.gtype", "EEPROM Characterization Header": "EEPROM Characterization Header.gtype", "Characterization Data": "Characterization Data.gtype"[], "FPGA Current Version": u32, "FPGA Oldest Compatible Version": u32, "Fixed Logic Current Version": u32, "Fixed Logic Oldest Compatible Version": u32, "FPGA Radio Settings Bus Current Version": u32, "FPGA Radio Settings Bus Oldest Compatible Version": u32, "FPGA Board Config Current Version": u32, "FPGA Board Config Oldest Compatible Version": u32, "Daughterboard Clock Rate": u32}
  T1 = cluster{"FPGA ref": any, "bus instance": u32, "instruction FIFO depth": u32, "executing on FPGA target": bool, "show error call chain": bool}
  T2 = cluster{"Actual Gain [dB]": f64, "Attenuation Table Index": i32}
  T3 = cluster{"Attenuation Table [dB]": f64[][], "Frequencies [Hz]": f64[], "IQ Imbalance Table": "IQ Imbalance.gtype"[], "Gain Table": T2[][]}
  T4 = cluster{"FlexRIO Register Bus": Queue<T1>, "RX Characterization Data": T3, "TX Characterization Data": T3, "FPGA Interface": any}
  T5 = cluster{"transport block size": u32, "CRC ok": bool, "user data": u32}
  "Link Direction.gtype" = enum{"DL", "UL"}
  T6 = cluster{"MAC Stub RX Payload Information FIFO": RTFifoRefnum<"MAC Stub RX Payload Information.gtype">, "MAC Stub RX Confirmation Information FIFO": RTFifoRefnum<u64[16]>, "MAC Stub RX UL Payload Information FIFO": RTFifoRefnum<f64[23]>}
  T7 = cluster{"MAC Stub TX Input Terminals FIFO": RTFifoRefnum<"MAC Stub TX Input Terminals.gtype">, "MAC Stub TX Output Terminals FIFO": RTFifoRefnum<"MAC Stub TX Output Terminals.gtype">}
  T8 = cluster{"MAC Stub RX Interface": T6, "MAC Stub TX Interface": T7}
  "Host Session.gtype" = cluster{"target": enum{"USRP", "FlexRIO"}, "real time mode": bool, "MAC Stub enabled": bool, "DMA FIFO read timeout": i32, "timed loop period": i64, "LTE Transport Sessions": "Transport Session.gtype"[], "USRP session": "niUsrpRio Session.gtype", "FlexRIO session": T4, "UDP RX session": UdpNetworkConnectionRefnum, "UDP TX session": UdpNetworkConnectionRefnum, "sync found FIFO": RTFifoRefnum<bool>, "PDCCH CRC OK FIFO": RTFifoRefnum<bool>, "DL PDCCH status FIFO": RTFifoRefnum<cluster{"CRC ok": bool, "subframe number": u32}>, "DL PDSCH status FIFO": RTFifoRefnum<cluster{"CRC ok": bool, "subframe number": u32}>, "DL SINR FIFO": RTFifoRefnum<f64[]>, "PDSCH user data FIFO": RTFifoRefnum<u32>, "PDSCH user data UDP FIFO": RTFifoRefnum<T5>, "PDSCH user data throughput FIFO": RTFifoRefnum<T5>, "PUSCH user data FIFO": RTFifoRefnum<u32>, "PUSCH user data UDP FIFO": RTFifoRefnum<T5>, "PUSCH user data throughput FIFO": RTFifoRefnum<T5>, "UE feedback info FIFO": RTFifoRefnum<u8[]>, "Request information FIFO": RTFifoRefnum<"Request Information.gtype">, "UDP TX outbound FIFO": RTFifoRefnum<u8[]>, "UDP RX inbound FIFO": RTFifoRefnum<u8[]>, "stop notifier": Notifier<string>, "DL RX scope": string, "UL RX scope": string, "external MAC log file": string, "external MAC process ID": u32, "TX link direction": "Link Direction.gtype", "RX link direction": "Link Direction.gtype", "Sychronization FIFO": RTFifoRefnum<i32>, "RT Loop Interfaces": T8}
uses:
  AFW::LTE::RF Control::Unbundle Session.gvi
  AFW::LTE::Conversion::U32 to CDB.gvi
diagram:
  call "Unbundle Session.gvi"(session=$session) -> (RX link direction=w1, DL FPGA Interface=w2, eNB FPGA Interface=w3)
  case (w1) {
    frame "DL", Default {
      Property Node(instance in=w2, "DL constellation subset"=TRUE, "DL constellation symbol number (0-13)"=$"symbol number for display", error in=$"error in") -> (error out=w4)
    }
    frame "UL" {
      Property Node(instance in=w3, "UL constellation subset"=TRUE, "UL constellation symbol number (0-13)"=$"symbol number for display", error in=$"error in") -> (error out=w4)
    }
  }
  Host Fifo Read Node[FifoName="AFW::LTE::Resources::LTE AFW Resources.grsc::T2H RX Constellation"](error in=w4, number of elements=0, reference in=w2, timeout (ms)=0) -> (elements remaining=w5, error out=w6, reference out=w7)
  Host Fifo Read Node[FifoName="AFW::LTE::Resources::LTE AFW Resources.grsc::T2H RX Constellation"](error in=w6, number of elements=w5, reference in=w7, timeout (ms)=0) -> (data=w8, error out=w9)
  Array Size(array=w8) -> (size(s)=w10)
  Is Not Equal To 0(x=w10) -> w11
  case ($"RX tab") {
    frame 0 {
      # UE RX Basic
      Property Node(instance in=w2, "constellation select"="PDSCH Dec Input", error in=$"error in") -> (error out=w13)
      w12 = "PDSCH Dec Input"
    }
    frame 1 {
      # UE RX Advanced
      Property Node(instance in=w2, "constellation select"="DL EQ Output", error in=$"error in") -> (error out=w13)
      w12 = "DL EQ Output"
    }
    frame Default {
      w12 = default
      w13 = $"error in"
    }
  }
  Feedback Node(input=w12) -> w14
  # Only display values if source
  # hasn't changed
  Is Equal(x=w14, y=w12) -> w15
  Logical And(w11, w15) -> w16
  $"display data out" <- w16
  call "U32 to CDB.gvi"(signal in=w8) -> (signal out=w17)
  $"constellation data" <- w17
  Merge Errors(w9, w13) -> (error out=w18)
  $"error out" <- w18
  $"displayed constellation" <- w12
