vi "Read UL Data.gvi"   [LabVIEW NXG 4.0.0]
# Reads PUSCH decoding status from the queue and reads the decoded data from the FPGA for each successfully decoded transport block.
# Extracts the PUSCH payload header containing the length of the payload data, interprets the payload data, and extracts contained DL feedback information.
inputs:
  "session": "Host Session.gtype"  # Contains session information such as used target, FlexRIO and USRP sessions, FPGA reference, and queue references.
  "error in": error
outputs:
  "error out": error
  "radioframe number": u16  # Number of the reported DL radioframe. Value range: 0-1023
  "output valid": bool  # Valid signal for calculated DL feedback information.
  "DL ACK/NACK": enum{"NACK", "ACK", "DTX"}[]  # Array of DL ACK/NACK information for the reported radio frame with each array element representing one subframe.
  "subband SNR": FXP(6.2)[]  # Array of signal-to-noise ratio (SNR) values for the reported radioframe, in dB, for all 13 sub-bands of 8 physical resource blocks. The last sub-band contains only four resource blocks.
  "wideband SNR": FXP(6.2)  # Scalar wideband SNR for the reported radioframe, in dB.
types:
  "Transport Session.gtype" = cluster{"FIFO pathname": string, "pipe reader": "Pipe Reader.gtype", "pipe writer": "Pipe Writer.gtype", "transport in RT FIFO": RTFifoRefnum<u8[]>, "transport out RT FIFO": RTFifoRefnum<u8[]>, "transport in timing source name": string, "transport in timing trigger ID": u8, "transport out timing source name": string, "transport out timing trigger ID": u8, "maximum API message size": u32}
  "Register Bus Session.gtype" = Queue<"Session Data.gtype">
  "Semaphore.gtype" = i32
  "DB Queue Reference.gtype" = Queue<"Daughterboard Data.gtype">
  "niUsrpRio Session.gtype" = cluster{"FPGA Interface": any, "RIO Interface Number": u32, "Data Clock Rate": u32, "FPGA Data Clock Rate": u32, "Global Settings Register Bus": "Register Bus Session.gtype", "Radio 0 Settings Register Bus": "Register Bus Session.gtype", "Radio 1 Settings Register Bus": "Register Bus Session.gtype", "Radio Settings Bus Semaphore": "Semaphore.gtype", "DB Queues": "DB Queue Reference.gtype"[], "Characterization Data Valid?": bool, "EEPROM Header": "EEPROM Header.gtype", "Device Data Header": "EEPROM Device Data Header.gtype", "EEPROM Characterization Header": "EEPROM Characterization Header.gtype", "Characterization Data": "Characterization Data.gtype"[], "FPGA Current Version": u32, "FPGA Oldest Compatible Version": u32, "Fixed Logic Current Version": u32, "Fixed Logic Oldest Compatible Version": u32, "FPGA Radio Settings Bus Current Version": u32, "FPGA Radio Settings Bus Oldest Compatible Version": u32, "FPGA Board Config Current Version": u32, "FPGA Board Config Oldest Compatible Version": u32, "Daughterboard Clock Rate": u32}
  T1 = cluster{"FPGA ref": any, "bus instance": u32, "instruction FIFO depth": u32, "executing on FPGA target": bool, "show error call chain": bool}
  T2 = cluster{"Actual Gain [dB]": f64, "Attenuation Table Index": i32}
  T3 = cluster{"Attenuation Table [dB]": f64[][], "Frequencies [Hz]": f64[], "IQ Imbalance Table": "IQ Imbalance.gtype"[], "Gain Table": T2[][]}
  T4 = cluster{"FlexRIO Register Bus": Queue<T1>, "RX Characterization Data": T3, "TX Characterization Data": T3, "FPGA Interface": any}
  T5 = cluster{"transport block size": u32, "CRC ok": bool, "user data": u32}
  "Link Direction.gtype" = enum{"DL", "UL"}
  T6 = cluster{"MAC Stub RX Payload Information FIFO": RTFifoRefnum<"MAC Stub RX Payload Information.gtype">, "MAC Stub RX Confirmation Information FIFO": RTFifoRefnum<u64[16]>, "MAC Stub RX UL Payload Information FIFO": RTFifoRefnum<f64[23]>}
  T7 = cluster{"MAC Stub TX Input Terminals FIFO": RTFifoRefnum<"MAC Stub TX Input Terminals.gtype">, "MAC Stub TX Output Terminals FIFO": RTFifoRefnum<"MAC Stub TX Output Terminals.gtype">}
  T8 = cluster{"MAC Stub RX Interface": T6, "MAC Stub TX Interface": T7}
  "Host Session.gtype" = cluster{"target": enum{"USRP", "FlexRIO"}, "real time mode": bool, "MAC Stub enabled": bool, "DMA FIFO read timeout": i32, "timed loop period": i64, "LTE Transport Sessions": "Transport Session.gtype"[], "USRP session": "niUsrpRio Session.gtype", "FlexRIO session": T4, "UDP RX session": UdpNetworkConnectionRefnum, "UDP TX session": UdpNetworkConnectionRefnum, "sync found FIFO": RTFifoRefnum<bool>, "PDCCH CRC OK FIFO": RTFifoRefnum<bool>, "DL PDCCH status FIFO": RTFifoRefnum<cluster{"CRC ok": bool, "subframe number": u32}>, "DL PDSCH status FIFO": RTFifoRefnum<cluster{"CRC ok": bool, "subframe number": u32}>, "DL SINR FIFO": RTFifoRefnum<f64[]>, "PDSCH user data FIFO": RTFifoRefnum<u32>, "PDSCH user data UDP FIFO": RTFifoRefnum<T5>, "PDSCH user data throughput FIFO": RTFifoRefnum<T5>, "PUSCH user data FIFO": RTFifoRefnum<u32>, "PUSCH user data UDP FIFO": RTFifoRefnum<T5>, "PUSCH user data throughput FIFO": RTFifoRefnum<T5>, "UE feedback info FIFO": RTFifoRefnum<u8[]>, "Request information FIFO": RTFifoRefnum<"Request Information.gtype">, "UDP TX outbound FIFO": RTFifoRefnum<u8[]>, "UDP RX inbound FIFO": RTFifoRefnum<u8[]>, "stop notifier": Notifier<string>, "DL RX scope": string, "UL RX scope": string, "external MAC log file": string, "external MAC process ID": u32, "TX link direction": "Link Direction.gtype", "RX link direction": "Link Direction.gtype", "Sychronization FIFO": RTFifoRefnum<i32>, "RT Loop Interfaces": T8}
uses:
  AFW::LTE::Configuration::Flush User Data FIFO.gvi
  AFW::LTE::RF Control::Unbundle Session.gvi
  AFW::LTE::Conversion::Extract Payload.gvi
  AFW::LTE::Conversion::Align Feedback Data.gvi
  AFW::LTE::Conversion::Interpret PUSCH Payload.gvi
diagram:
  Property Node(instance in=$session) -> ("PUSCH user data UDP FIFO"=w1, instance out=w2)
  call "Flush User Data FIFO.gvi"(user data FIFO in=w1, error in=$"error in") -> (user data=w3, error out=w4)
  Feedback Node(initial value=u8[] [], input=w5) -> w6
  s1 = w4  # shift register
  s2 = 0  # shift register
  s3 = enum{"NACK", "ACK", "DTX"}[] []  # shift register
  s4 = FXP(6.2)[] []  # shift register
  s5 = w6  # shift register
  s6 = 0  # shift register
  for {
    w7 = each element of w3
    Property Node(instance in=w7) -> ("transport block size"=w9, "CRC ok"=w10)
    Quotient And Remainder(x=w9, y=8) -> (floor(x/y)=w11)
    call "Unbundle Session.gvi"(session=w2) -> (eNB FPGA Interface=w12)
    Host Fifo Read Node[FifoName="AFW::LTE::Resources::LTE AFW Resources.grsc::T2H PUSCH Decoded Data"](error in=s1, number of elements=w11, reference in=w12, timeout (ms)=1) -> (data=w13, error out=w14)
    case (w10) {
      frame False, Default {
        w15 = w14
        w16 = s3
        w17 = s4
        w18 = s2
        w19 = s5
        w20 = FALSE
        w21 = s6
      }
      frame True {
        call "Extract Payload.gvi"(transport block=w13) -> (payload=w22)
        Build Array(s5, w22) -> w23
        call "Align Feedback Data.gvi"(data in=w23) -> (remaining portion=w19, feedback payload=w24)
        Is Empty Array(array=w24) -> w25
        Not(x=w25) -> w20
        case (w20) {
          frame False, Default {
            w17 = s4
            w18 = s2
            w16 = s3
            w21 = s6
          }
          frame True {
            call "Interpret PUSCH Payload.gvi"(PUSCH payload=w24) -> (radioframe number=w18, ACK/NACK=w16, subband SNR=w17, wideband SNR=w21)
          }
        }
        w15 = w14
      }
    }
    append w20 to w8
    next s1 = w15
    next s2 = w18
    next s3 = w16
    next s4 = w17
    next s5 = w19
    next s6 = w21
  }
  w5 = s5
  Or Array Elements(Boolean array=w8) -> (logical OR=w26)
  $"output valid" <- w26
  $"radioframe number" <- s2
  $"DL ACK/NACK" <- s3
  $"subband SNR" <- s4
  $"wideband SNR" <- s6
  $"error out" <- s1
