vi "U32 to CDB.gvi"   [LabVIEW NXG 4.0.0]
# Converts an array of U32 data containers read from the FPGA to an array of complex double values representing one I/Q sample.
inputs:
  "signal in": u32[]  # Array of U32 data containers containing I/Q samples in a specific format.
outputs:
  "signal out": c128[]  # Array of complex double I/Q samples after conversion.
diagram:
  Split Number(x=$"signal in") -> (high(x)=w1, low(x)=w2)
  Reinterpret Number[RestrictToSameWordLength=True](data in=w2, type=FXP(2.14) 0) -> (data out=w3)
  To Double Precision Float(number=w3) -> w4
  Reinterpret Number[RestrictToSameWordLength=True](data in=w1, type=FXP(2.14) 0) -> (data out=w5)
  To Double Precision Float(number=w5) -> w6
  Real And Imaginary To Complex(x=w4, y=w6) -> w7
  $"signal out" <- w7
