vi "U64 to Channel Estimates.gvi"   [LabVIEW NXG 4.0.0]
# Extracts channel estimates and corresponding timing information from an array of U64 data containers used for target to host transfer.
inputs:
  "signal in": u64[]  # Array of U64 data containers containing channel estimates and corresponding timing information.
outputs:
  "timing indices": T1[]  # Timing information for estimated channel coefficients.
  "estimated channel coefficients": c128[]  # Estimated channel coefficients estimated with cell specific or UE specific reference symbols.
  "subframe index array": u8[]  # Array containing the subframes numbers of the received channel coefficients.
types:
  T1 = cluster{"symbol index (0-13)": u8, "RB index (0-99)": u8, "subframe index (0-9)": u8, "subcarrier index (0-11)": u8, "UERS": bool}
diagram:
  for {
    w1 = each element of $"signal in"
    Split Number(x=w1) -> (high(x)=w5, low(x)=w6)
    Split Number(x=w5) -> (high(x)=w7, low(x)=w8)
    Split Number(x=w7) -> (high(x)=w9, low(x)=w10)
    Split Number(x=w8) -> (high(x)=w11, low(x)=w12)
    Logical And(0x7F, w9) -> w13
    Logical And(0x80, w9) -> w14
    Is Greater Than 0(x=w14) -> w15
    Property Node(instance in=T1 {all zero or empty}, "UERS"=w15, "subframe index (0-9)"=w13, "symbol index (0-13)"=w10, "RB index (0-99)"=w11, "subcarrier index (0-11)"=w12) -> (instance out=w16)
    Split Number(x=w6) -> (high(x)=w17, low(x)=w18)
    Reinterpret Number[RestrictToSameWordLength=True](data in=w17, type=FXP(6.10) 0) -> (data out=w19)
    To Double Precision Float(number=w19) -> w20
    Reinterpret Number[RestrictToSameWordLength=True](data in=w18, type=FXP(6.10) 0) -> (data out=w21)
    To Double Precision Float(number=w21) -> w22
    Real And Imaginary To Complex(x=w20, y=w22) -> w23
    append w23 to w2
    append w16 to w3
    append w13 to w4
  }
  $"timing indices" <- w3
  $"subframe index array" <- w4
  $"estimated channel coefficients" <- w2
