vi "UL TTI Configuration To U64.gvi"   [LabVIEW NXG 4.0.0]
# Converts the TTI configuration from the cluster input to a binary packed U64 format.
inputs:
  "TTI configuration cluster": T3 = {"UE configuration"={"RNTI"=0, "SRS configuration"={"SRS enabled"=FALSE, "SRS subframe allocation"=[FALSE, FALSE, FALSE, FALSE, FALSE, FALSE, FALSE, FALSE, FALSE, FALSE], "transmission comb"=FALSE}}, "DCI message"={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}}  # A cluster containing a Per-subframe changeable UE specific parameter set (SRS enabled, SRS subframe allocation, transmission comb) and the full DCI message.
outputs:
  "TTI configuration out": u64  # The TTI configuration converted to a binary packed U64 value.
types:
  T1 = cluster{"SRS enabled": bool, "SRS subframe allocation": bool[], "transmission comb": bool}
  T2 = cluster{"valid": bool, "resource allocation header": UFXP(1.0), "resource block allocation": UFXP(25.0), "MCS": UFXP(5.0), "HARQ process number": UFXP(4.0), "new data indicator": bool, "redundancy version": UFXP(2.0), "TPC command for pucch": UFXP(2.0), "DL assignment index": UFXP(2.0)}
  T3 = cluster{"UE configuration": cluster{"RNTI": u16, "SRS configuration": T1}, "DCI message": T2}
diagram:
  Property Node(instance in=$"TTI configuration cluster") -> ("UE configuration:RNTI"=w1, "UE configuration:SRS configuration:SRS subframe allocation"=w2, "UE configuration:SRS configuration:transmission comb"=w3, "UE configuration:SRS configuration:SRS enabled"=w4, "DCI message:valid"=w5, "DCI message:resource block allocation"=w6, "DCI message:MCS"=w7, "DCI message:TPC command for pucch"=w8)
  Build Array(w4, w2, w3, w5) -> w9
  Boolean Array To Number(Boolean array=w9) -> (number=w10: u16)
  Join Numbers(high(x)=w1, low(x)=w10) -> w11
  Number To Boolean Array(number=w6) -> (Boolean array=w12)
  Number To Boolean Array(number=w7) -> (Boolean array=w13)
  Number To Boolean Array(number=w8) -> (Boolean array=w14)
  Build Array(w12, w13, w14) -> w15
  Boolean Array To Number(Boolean array=w15) -> (number=w16: u32)
  Join Numbers(high(x)=w11, low(x)=w16) -> w17
  $"TTI configuration out" <- w17
