vi "Calculate Transport Block Size from PRB Allocation.gvi"   [LabVIEW NXG 4.0.0]
inputs:
  "PRB Allocation": u32
  "MCS": u8
outputs:
  "TB Size": u32
uses:
  AFW::LTE::MAC::Calculate Transport Block Size.gvi
diagram:
  Number To Boolean Array(number=$"PRB Allocation") -> (Boolean array=w1)
  Boolean To 0 Or 1(Boolean=w1) -> (0, 1=w2)
  Add Array Elements(numeric array=w2) -> (sum=w3)
  Multiply(4, w3) -> w4
  To Unsigned 8 Bit Integer(number=w4) -> w5
  call "Calculate Transport Block Size.gvi"(number of PRBs=w5, MCS=$MCS) -> (bytes to transmit=w6)
  $"TB Size" <- w6
