vi "Check Confirm Mode.gvi"   [LabVIEW NXG 4.0.0]
inputs:
  "error in": error
  "expected confirm mode": u8  # Expected number of submessages (U8) to be initialized by upper level node.
  "received message header type": "Message Header Type.gtype" = "Indication"
outputs:
  "error out": error
  "pass": bool
types:
  "Message Header Type.gtype" = enum{"Indication", "Request", "Confirm", "Reserved"}
uses:
  NI::G Core::Error::Build Error Cluster.gvi
diagram:
  # Only for REQ messages the CNF mode is allowed
  case ($"received message header type") {
    frame "Indication", Default {
      w1 = default
    }
    frame "Request" {
      w1 = 1
    }
    frame "Confirm" {
      w1 = default
    }
    frame "Reserved" {
      w1 = default
    }
  }
  Is Less Or Equal(x=$"expected confirm mode", y=w1) -> w2
  $pass <- w2
  case (w2) {
    frame True {
      w3 = $"error in"
    }
    frame False {
      Format Into String(formatString="Confirmation mode mismatch - \nreceived: %d, expected %d", $"expected confirm mode", w1) -> w4
      w5 = "Range Violation"  # LTE Confirmation States
      Type Cast(type=u8 0, x=w5) -> w6
      To Signed 32 Bit Integer(number=w6) -> w7
      call "Build Error Cluster.gvi"(code=w7, description=w4, error in=$"error in") -> (error out=w3)
    }
  }
  $"error out" <- w3
