vi "Check DL MAC PDU Size.gvi"   [LabVIEW NXG 4.0.0]
inputs:
  "Expected MAC PDU Size": i32
  "Received MAC PDU Size": i32
  "error in": error
  "DLSCH parameter": "Message DLSCH Config Parameter.gtype"
  "UERS check parameter": "UERS Check Pararmeter.gtype" = {"use UERS"=FALSE, "subframe index"=0, "frame structure"="TDD 5 5"}
outputs:
  "error out": error
  "pass": bool
types:
  "Message DLSCH Config Parameter.gtype" = cluster{"Config Active": bool, "MAC PDU Index": u8, "RNTI": u16, "PRB Allocation": u32, "MCS": u8}
  "UERS Check Pararmeter.gtype" = cluster{"use UERS": bool, "subframe index": u8, "frame structure": enum{"FDD", "TDD 5 5"}}
uses:
  AFW::LTE::L1L2 API::Check UERS MAC PDU Size.gvi
  AFW::LTE::L1L2 API::Calculate Transport Block Size from PRB Allocation.gvi
  NI::G Core::Error::Build Error Cluster.gvi
diagram:
  Is Greater Than 0(x=$"Expected MAC PDU Size") -> w1
  Is Less Or Equal(x=$"Expected MAC PDU Size", y=$"Received MAC PDU Size") -> w2
  Logical And(w1, w2) -> w3
  Property Node(instance in=$"DLSCH parameter") -> ("PRB Allocation"=w4, "MCS"=w5)
  Property Node(instance in=$"UERS check parameter") -> ("use UERS"=w6, "subframe index"=w7, "frame structure"=w8)
  call "Check UERS MAC PDU Size.gvi"(use UERS=w6, subframe index=w7, frame structure=w8, PRB Allocation In=w4) -> (PRB Allocation Out=w9)
  call "Calculate Transport Block Size from PRB Allocation.gvi"(PRB Allocation=w9, MCS=w5) -> (TB Size=w10)
  # Bypass if not data connected
  Is Equal To 0(x=w10) -> w11
  To Unsigned 32 Bit Integer(number=$"Expected MAC PDU Size") -> w12
  Is Equal(x=w10, y=w12) -> w13
  Logical Or(w11, w13) -> w14
  Logical And(w14, w3) -> w15
  $pass <- w15
  case (w3) {
    frame True {
      w16 = $"error in"
    }
    frame False {
      w17 = "Received DL MAC PDU size (%d bytes) less than expected (%d bytes)"
      Format Into String(formatString=w17, $"Received MAC PDU Size", $"Expected MAC PDU Size") -> w18
      w19 = "Length Mismatch"  # LTE Confirmation States
      Type Cast(type=u8 0, x=w19) -> w20
      To Signed 32 Bit Integer(number=w20) -> w21
      call "Build Error Cluster.gvi"(code=w21, description=w18, error in=$"error in") -> (error out=w16)
    }
  }
  case (w14) {
    frame True {
      w22 = w16
    }
    frame False {
      w23 = "Expected DL MAC PDU size (%d bytes) does not match allowed transport block size (%d bytes)"
      Format Into String(formatString=w23, w12, w10) -> w24
      w25 = "Length Mismatch"  # LTE Confirmation States
      Type Cast(type=u8 0, x=w25) -> w26
      To Signed 32 Bit Integer(number=w26) -> w27
      call "Build Error Cluster.gvi"(code=w27, description=w24, error in=w16) -> (error out=w22)
    }
  }
  $"error out" <- w22
