vi "Check DL TX Confirm Count.gvi"   [LabVIEW NXG 4.0.0]
inputs:
  "error in": error
  "message select": "Message Type ID Defined.gtype" = "PHY_DL_TX_PAYLOAD_REQ"(17666)
  "SAP sub header": "SAP Sub Header.gtype"
  "message header": "General Message Header.gtype"
  "Confirm Status": "Message Confirm Check Parameter.gtype"[]
outputs:
  "error out": error
  "received confirm count": u16
  "expected confirm count": u16
types:
  "SAP Sub Header.gtype" = cluster{"SFN": u16, "TTI index": u8, "number of submessages": u8, "confirmation mode": u8, "Reserved": u32}
  "Message Type ID Defined.gtype" = u16
  "General Message Header.gtype" = cluster{"message type ID": "Message Type ID Defined.gtype", "reference ID": u16, "instance ID": u8}
  "Message Confirm Check Parameter.gtype" = cluster{"Config Active": bool, "reference ID": u16, "Source Message Type ID": u16, "Confirmation Mode": u8, "Confirmation Status": u8}
uses:
  NI::G Core::Error::Build Error Cluster.gvi
diagram:
  Array Size(array=$"Confirm Status") -> (size(s)=w1)
  s1 = 0  # shift register
  s2 = 0  # shift register
  for (N = w1) {
    w2 = each element of $"Confirm Status"
    Property Node(instance in=w2) -> ("Config Active"=w3, "reference ID"=w4, "Source Message Type ID"=w5)
    Type Cast(type="Message Type ID Defined.gtype" "UNDEFINED_MESSAGE"(0), x=w5) -> w6
    Is Equal(x=w6, y=$"message select") -> w7
    Logical And(w3, w7) -> w8
    case (w8) {
      frame False, Default {
        w9 = s1
        w10 = s2
      }
      frame True {
        Increment(x=s1) -> w9: u16
        w10 = w4
      }
    }
    next s1 = w9
    next s2 = w10
  }
  Feedback Node(initial value=0, input=w11) -> w12
  Add(w12, s1) -> w11
  $"received confirm count" <- w11
  Property Node(instance in=$"SAP sub header") -> ("confirmation mode"=w13)
  Is Equal(x=1, y=w13) -> w14
  Property Node(instance in=$"message header") -> ("reference ID"=w15, "message type ID"=w16)
  Is Equal(x=w16, y=$"message select") -> w17
  Logical And(w14, w17) -> w18
  Feedback Node(initial value=0, input=w19) -> w20
  case (w18) {
    frame False, Default {
      w19 = w20
    }
    frame True {
      Increment(x=w20) -> w19
    }
  }
  $"expected confirm count" <- w19
  Is Not Equal(x=w11, y=w19) -> w21
  case (w21) {
    frame True {
      w23 = "Missing Confirm Message for ID %d  -\nExpected: %d, Received: %d"
      Format Into String(formatString=w23, $"message select", w11, w19) -> w24
      w25 = "Internal Error"  # LTE Confirmation States
      Type Cast(type=u8 0, x=w25) -> w26
      To Signed 32 Bit Integer(number=w26) -> w27
      call "Build Error Cluster.gvi"(code=w27, description=w24, error in=$"error in") -> (error out=w22)
    }
    frame False {
      w22 = $"error in"
    }
  }
  Is Not Equal(x=s2, y=w15) -> w28
  Logical And(w28, w14) -> w29
  case (w29) {
    frame True {
      w31 = "Confirm Reference ID Mismatch -\nreceived: %d, expected: %d,\nMessage ID: %d"
      Format Into String(formatString=w31, s2, w15, $"message select") -> w32
      w33 = "Internal Error"  # LTE Confirmation States
      Type Cast(type=u8 0, x=w33) -> w34
      To Signed 32 Bit Integer(number=w34) -> w35
      call "Build Error Cluster.gvi"(code=w35, description=w32, error in=w22) -> (error out=w30)
    }
    frame False {
      w30 = w22
    }
  }
  $"error out" <- w30
