vi "Check DL TX Confirm Messages.gvi"   [LabVIEW NXG 4.0.0]
inputs:
  "error in": error
  "Confirm Status": "Message Confirm Check Parameter.gtype"
outputs:
  "error out": error
types:
  "Message Confirm Check Parameter.gtype" = cluster{"Config Active": bool, "reference ID": u16, "Source Message Type ID": u16, "Confirmation Mode": u8, "Confirmation Status": u8}
  "Confirmation States.gtype" = enum{"Success", "Unknown Message", "Message not Supported", "Unknown Parameter (Set)", "Missing Parameter (Set)", "Parameter (Set) Repetition", "Range Violation", "State Violation", "Timeout", "Config Payload Mismatch", "Length Mismatch", "Input Buffer Full", "Internal Error", "Instance ID Mismatch"}
uses:
  NI::G Core::Error::Build Error Cluster.gvi
diagram:
  Property Node(instance in=$"Confirm Status") -> ("Config Active"=w1, "Source Message Type ID"=w2, "Confirmation Status"=w3)
  case (w1) {
    frame False, Default {
      w4 = $"error in"
    }
    frame True {
      w5 = "Confirmation States.gtype" "Success"  # LTE Confirmation States
      Type Cast(type=w5, x=w3) -> w6
      Is Equal(x="Success", y=w6) -> w7
      case (w7) {
        frame False, Default {
          Format Into String(formatString="Negative Confirmation Status - code: %d,\nMessage ID: %d", w3, w2) -> w8
          Type Cast(type=u8 0, x=w3) -> w9
          To Signed 32 Bit Integer(number=w9) -> w10
          call "Build Error Cluster.gvi"(code=w10, description=w8, error in=$"error in") -> (error out=w4)
        }
        frame True {
          w4 = $"error in"
        }
      }
    }
  }
  $"error out" <- w4
