vi "Check General Message Header.gvi"   [LabVIEW NXG 4.0.0]
# Reads the received SAP Sub Header and checks if the received number of submessages, confirmation mode and reserved field match the expected ones.
inputs:
  "received general message header": "General Message Header.gtype"
  "expected message ID": "Message Type ID Defined.gtype" = "UNDEFINED_MESSAGE"(0)
  "check minimal size": bool  # If this input is True, this node checks if the received message body length is greater than the minimal one (for PAYLOAD messages). Otherwise it checks if the received message body length is equal to the received one.
  "error in": error
  "received message body length": u32  # Expected message body length (U24) to be initialized by Decode General Message Header.
  "expected message body length": u32  # Expected message body length (U24) to be initialized by the upper level VI.
outputs:
  "error out": error
  "valid message type ID": bool  # Valid signal if message type ID is valid.
  "valid message body length": bool  # Valid signal if message body length is valid.
types:
  "Message Type ID Defined.gtype" = u16
  "General Message Header.gtype" = cluster{"message type ID": "Message Type ID Defined.gtype", "reference ID": u16, "instance ID": u8}
uses:
  AFW::LTE::L1L2 API::Check Message Type ID.gvi
  AFW::LTE::L1L2 API::Check Message Body Length.gvi
diagram:
  Property Node(instance in=$"received general message header") -> ("message type ID"=w1)
  call "Check Message Type ID.gvi"(expected message ID=$"expected message ID", received message ID=w1, error in=$"error in") -> (pass=w2, error out=w3)
  $"valid message type ID" <- w2
  To Signed 32 Bit Integer(number=$"expected message body length") -> w4
  To Signed 32 Bit Integer(number=$"received message body length") -> w5
  call "Check Message Body Length.gvi"(expected message body length=w4, received message body length=w5, error in=w3, check minimal size=$"check minimal size") -> (error out=w6, pass=w7)
  $"valid message body length" <- w7
  $"error out" <- w6
