vi "Check MAC PDU Size.gvi"   [LabVIEW NXG 4.0.0]
inputs:
  "Expected MAC PDU Size": i32
  "Received MAC PDU Size": i32
  "error in": error
  "ulsch parameter": "Message ULSCH Config Parameter.gtype"
  "ulsch parameter check": bool
outputs:
  "error out": error
  "pass": bool
types:
  "Message ULSCH Config Parameter.gtype" = cluster{"Config Active": bool, "MAC PDU Index": u8, "RNTI": u16, "PRB Allocation": u32, "MCS": u8}
uses:
  AFW::LTE::L1L2 API::Calculate Transport Block Size from PRB Allocation.gvi
  NI::G Core::Error::Build Error Cluster.gvi
diagram:
  Is Greater Than 0(x=$"Expected MAC PDU Size") -> w1
  Is Equal(x=$"Expected MAC PDU Size", y=$"Received MAC PDU Size") -> w2
  Logical And(w1, w2) -> w3
  case ($"ulsch parameter check") {
    frame False, Default {
      w4 = 0
    }
    frame True {
      Property Node(instance in=$"ulsch parameter") -> ("PRB Allocation"=w5, "MCS"=w6)
      call "Calculate Transport Block Size from PRB Allocation.gvi"(PRB Allocation=w5, MCS=w6) -> (TB Size=w7)
      w8 = 4  # Mini MAC header length
      # subtract MAC Mini Header size which will be added on FPGA
      Subtract(x=w7, y=w8) -> w9
      Is Greater Or Equal(x=w7, y=w8) -> w10
      Select(s=w10, t=w9, f=0) -> w4
    }
  }
  Is Equal To 0(x=w4) -> w11
  To Unsigned 32 Bit Integer(number=$"Received MAC PDU Size") -> w12
  Is Greater Or Equal(x=w4, y=w12) -> w13
  Logical Or(w11, w13) -> w14
  Logical And(w14, w3) -> w15
  $pass <- w15
  case (w3) {
    frame True {
      w16 = $"error in"
    }
    frame False {
      w17 = "Received MAC PDU size (%d bytes) does not mach expected MAC PDU Size (%d bytes)"
      Format Into String(formatString=w17, $"Received MAC PDU Size", $"Expected MAC PDU Size") -> w18
      w19 = "Length Mismatch"  # LTE Confirmation States
      Type Cast(type=u8 0, x=w19) -> w20
      To Signed 32 Bit Integer(number=w20) -> w21
      call "Build Error Cluster.gvi"(code=w21, description=w18, error in=$"error in") -> (error out=w16)
    }
  }
  case (w14) {
    frame True {
      w22 = w16
    }
    frame False {
      w23 = "Received MAC PDU size (%d bytes) does not match allowed transport block size (%d bytes)"
      Format Into String(formatString=w23, w12, w4) -> w24
      w25 = "Length Mismatch"  # LTE Confirmation States
      Type Cast(type=u8 0, x=w25) -> w26
      To Signed 32 Bit Integer(number=w26) -> w27
      call "Build Error Cluster.gvi"(code=w27, description=w24, error in=w16) -> (error out=w22)
    }
  }
  $"error out" <- w22
