vi "Check MCS.gvi"   [LabVIEW NXG 4.0.0]
inputs:
  "Received MCS": u8
  "error in": error
outputs:
  "error out": error
  "pass": bool
uses:
  NI::G Core::Error::Build Error Cluster.gvi
diagram:
  Is Less Or Equal(x=$"Received MCS", y=29) -> w1
  $pass <- w1
  case (w1) {
    frame True {
      w2 = $"error in"
    }
    frame False {
      Format Into String(formatString="MCS mismatch (> 29) -  \nreceived: %d", $"Received MCS") -> w3
      w4 = "Range Violation"  # LTE Confirmation States
      Type Cast(type=u8 0, x=w4) -> w5
      To Signed 32 Bit Integer(number=w5) -> w6
      call "Build Error Cluster.gvi"(code=w6, description=w3, error in=$"error in") -> (error out=w2)
    }
  }
  $"error out" <- w2
