vi "Check Message Body Length.gvi"   [LabVIEW NXG 4.0.0]
inputs:
  "expected message body length": i32  # Expected message body length (U24) to be initialized by upper level VI.
  "received message body length": i32  # Expected message body length (U24) to be initialized by Decode General Message Header.
  "error in": error
  "check minimal size": bool  # If this input is TRUE, this node checks if the received message body length is greater than the minimal one (for PAYLOAD messages). Otherwise it checks if the received message body length is equal to the received one.
outputs:
  "error out": error
  "pass": bool
uses:
  NI::G Core::Error::Build Error Cluster.gvi
diagram:
  case ($"check minimal size") {
    frame True {
      Is Greater Than 0(x=$"expected message body length") -> w2
      Is Greater Or Equal(x=$"received message body length", y=$"expected message body length") -> w3
      Logical And(w2, w3) -> w1
    }
    frame False {
      Is Equal(x=$"received message body length", y=$"expected message body length") -> w1
    }
  }
  $pass <- w1
  case (w1) {
    frame True {
      w4 = $"error in"
    }
    frame False {
      w5 = "Received message body length (%d bytes) less than expected (%d bytes)"
      Format Into String(formatString=w5, errIn=$"error in", $"received message body length", $"expected message body length") -> (outString=w6, errOut=w7)
      w8 = "Length Mismatch"  # LTE Confirmation States
      Type Cast(type=u8 0, x=w8) -> w9
      To Signed 32 Bit Integer(number=w9) -> w10
      call "Build Error Cluster.gvi"(code=w10, description=w6, error in=w7) -> (error out=w4)
    }
  }
  $"error out" <- w4
