vi "Check Message ID Location Field.gvi"   [LabVIEW NXG 4.0.0]
inputs:
  "Expected Location Field": "Message Header Location.gtype" = "Common"
  "Received Location Field": "Message Header Location.gtype" = "Common"
  "error in": error
outputs:
  "error out": error
  "pass": bool
types:
  "Message Header Location.gtype" = enum{"Common", "eNB", "UE", "Reserved"}
uses:
  NI::G Core::Error::Build Error Cluster.gvi
diagram:
  Is Equal(x=$"Received Location Field", y=$"Expected Location Field") -> w1
  $pass <- w1
  case (w1) {
    frame True {
      w2 = $"error in"
    }
    frame False {
      w3 = "Message not Supported"  # LTE Confirmation States
      Type Cast(type=u8 0, x=w3) -> w4
      To Signed 32 Bit Integer(number=w4) -> w5
      Format Into String(formatString="Location Field Mismatch: expected %d, received: %d", $"Expected Location Field", $"Received Location Field") -> w6
      call "Build Error Cluster.gvi"(code=w5, description=w6, error in=$"error in") -> (error out=w2)
    }
  }
  $"error out" <- w2
