vi "Check Message Type ID.gvi"   [LabVIEW NXG 4.0.0]
inputs:
  "expected message ID": "Message Type ID Defined.gtype" = "UNDEFINED_MESSAGE"(0)
  "received message ID": "Message Type ID Defined.gtype" = "UNDEFINED_MESSAGE"(0)
  "error in": error
outputs:
  "error out": error
  "pass": bool
types:
  "Message Type ID Defined.gtype" = u16
uses:
  NI::G Core::Error::Build Error Cluster.gvi
diagram:
  Is Equal(x=$"received message ID", y=$"expected message ID") -> w1
  $pass <- w1
  case (w1) {
    frame True {
      w2 = $"error in"
    }
    frame False {
      Format Into String(formatString="mismatch: message type ID\nreceived: %d, expected %d", $"received message ID", $"received message ID") -> w3
      w4 = "State Violation"  # LTE Confirmation States
      Type Cast(type=u8 0, x=w4) -> w5
      To Signed 32 Bit Integer(number=w5) -> w6
      call "Build Error Cluster.gvi"(code=w6, description=w3, error in=$"error in") -> (error out=w2)
    }
  }
  $"error out" <- w2
