vi "Check Number Sub Messages.gvi"   [LabVIEW NXG 4.0.0]
inputs:
  "error in": error
  "received number of submessages": u8
  "expected number of submessages": u8
outputs:
  "error out": error
  "pass": bool
uses:
  NI::G Core::Error::Build Error Cluster.gvi
diagram:
  Is Less Or Equal(x=$"received number of submessages", y=$"expected number of submessages") -> w1
  $pass <- w1
  case (w1) {
    frame True {
      w2 = $"error in"
    }
    frame False {
      w3 = "Number of submessages mismatch -\nreceived: %d, expected %d"
      Format Into String(formatString=w3, $"received number of submessages", $"expected number of submessages") -> w4
      w5 = "Range Violation"  # LTE Confirmation States
      Type Cast(type=u8 0, x=w5) -> w6
      To Signed 32 Bit Integer(number=w6) -> w7
      call "Build Error Cluster.gvi"(code=w7, description=w4, error in=$"error in") -> (error out=w2)
    }
  }
  $"error out" <- w2
