vi "Check PHY SAP DCI Config UL Grant.gvi"   [LabVIEW NXG 4.0.0]
inputs:
  "uplink grant parameter": "Message DCI Config UL Grant Parameter.gtype"
  "error in": error
outputs:
  "error out": error
types:
  "Message DCI Config UL Grant Parameter.gtype" = cluster{"Config Active": bool, "RNTI": u16, "CCE Offset": u8, "PRB Allocation": u32, "MCS": u8, "TPC": u8}
uses:
  AFW::LTE::L1L2 API::Check MCS.gvi
  AFW::LTE::L1L2 API::Check CCE Offset.gvi
diagram:
  Property Node(instance in=$"uplink grant parameter") -> ("CCE Offset"=w1, "MCS"=w2)
  call "Check MCS.gvi"(Received MCS=w2, error in=$"error in") -> (error out=w3)
  call "Check CCE Offset.gvi"(Received CCE Offset=w1, error in=w3) -> (error out=w4)
  $"error out" <- w4
