vi "Check PHY SAP DLSCH Config.gvi"   [LabVIEW NXG 4.0.0]
inputs:
  "DLSCH parameter": "Message DLSCH Config Parameter.gtype"
  "error in": error
  "check parameter": "UERS Check Pararmeter.gtype" = {"use UERS"=FALSE, "subframe index"=0, "frame structure"="TDD 5 5"}
outputs:
  "error out": error
types:
  "Message DLSCH Config Parameter.gtype" = cluster{"Config Active": bool, "MAC PDU Index": u8, "RNTI": u16, "PRB Allocation": u32, "MCS": u8}
  "UERS Check Pararmeter.gtype" = cluster{"use UERS": bool, "subframe index": u8, "frame structure": enum{"FDD", "TDD 5 5"}}
uses:
  AFW::LTE::L1L2 API::Check MCS.gvi
  AFW::LTE::Conversion::Check Subframe for Transmit.gvi
  NI::G Core::Error::Build Error Cluster.gvi
diagram:
  Property Node(instance in=$"check parameter") -> ("frame structure"=w1, "subframe index"=w2)
  Property Node(instance in=$"DLSCH parameter") -> ("MCS"=w3)
  call "Check MCS.gvi"(Received MCS=w3, error in=$"error in") -> (error out=w4)
  call "Check Subframe for Transmit.gvi"(frame structure=w1, subframe index=w2, UL TX=FALSE, error in=w4) -> (allow DL transmit=w5, error out=w6)
  case (w5) {
    frame True {
      w7 = w6
    }
    frame False {
      Format Into String(formatString="No DL transmit allowed in subframe (%d).", errIn=w6, w2) -> (outString=w8, errOut=w9)
      w10 = "State Violation"  # LTE Confirmation States
      Type Cast(type=u8 0, x=w10) -> w11
      To Signed 32 Bit Integer(number=w11) -> w12
      call "Build Error Cluster.gvi"(code=w12, description=w8, error in=w9) -> (error out=w7)
    }
  }
  $"error out" <- w7
