vi "Check SAP Sub Header.gvi"   [LabVIEW NXG 4.0.0]
# Reads the received SAP Sub Header and checks if the received number of submessages, confirmation mode and reserved field match the expected ones.
inputs:
  "received SAP sub header": "SAP Sub Header.gtype"
  "expected number of submessages": u8  # Expected number of submessages (U8) to be initialized by upper level node.
  "received message header type": "Message Header Type.gtype" = "Indication"
  "error in": error
outputs:
  "error out": error
  "valid number of submessages": bool  # Valid signal if number of sub-messages is correct.
  "valid confirm mode": bool  # Valid signal if number of confirm mode is correct.
  "Valid SFN TTI Index": bool
types:
  "SAP Sub Header.gtype" = cluster{"SFN": u16, "TTI index": u8, "number of submessages": u8, "confirmation mode": u8, "Reserved": u32}
  "Message Header Type.gtype" = enum{"Indication", "Request", "Confirm", "Reserved"}
uses:
  AFW::LTE::L1L2 API::Check Number Sub Messages.gvi
  AFW::LTE::L1L2 API::Check Confirm Mode.gvi
  AFW::LTE::L1L2 API::Check SFN TTI Index Range.gvi
diagram:
  Property Node(instance in=$"received SAP sub header") -> ("number of submessages"=w1, "confirmation mode"=w2, "SFN"=w3, "TTI index"=w4)
  call "Check Number Sub Messages.gvi"(error in=$"error in", received number of submessages=w1, expected number of submessages=$"expected number of submessages") -> (error out=w5, pass=w6)
  $"valid number of submessages" <- w6
  call "Check Confirm Mode.gvi"(expected confirm mode=w2, received message header type=$"received message header type", error in=w5) -> (pass=w7, error out=w8)
  $"valid confirm mode" <- w7
  call "Check SFN TTI Index Range.gvi"(error in=w8, Received SFN=w3, Received TTI index=w4) -> (error out=w9, pass=w10)
  $"Valid SFN TTI Index" <- w10
  $"error out" <- w9
