vi "Check SFN TTI Index Range.gvi"   [LabVIEW NXG 4.0.0]
inputs:
  "error in": error
  "Received SFN": u16
  "Received TTI index": u8
outputs:
  "error out": error
  "pass": bool
uses:
  NI::G Core::Error::Build Error Cluster.gvi
diagram:
  Is Less(x=$"Received SFN", y=1024) -> w1
  Is Less(x=$"Received TTI index", y=10) -> w2
  Logical And(w1, w2) -> w3
  $pass <- w3
  case (w2) {
    frame True {
      w4 = $"error in"
    }
    frame False {
      Format Into String(formatString="TTI index range violated - expected <10, received: %d", $"Received TTI index") -> w5
      w6 = "Range Violation"  # LTE Confirmation States
      Type Cast(type=u8 0, x=w6) -> w7
      To Signed 32 Bit Integer(number=w7) -> w8
      call "Build Error Cluster.gvi"(code=w8, description=w5, error in=$"error in") -> (error out=w4)
    }
  }
  case (w1) {
    frame True {
      w9 = w4
    }
    frame False {
      Format Into String(formatString="SFN range violated - expected <1024, received: %d", $"Received SFN") -> w10
      w11 = "Range Violation"  # LTE Confirmation States
      Type Cast(type=u8 0, x=w11) -> w12
      To Signed 32 Bit Integer(number=w12) -> w13
      call "Build Error Cluster.gvi"(code=w13, description=w10, error in=w4) -> (error out=w9)
    }
  }
  $"error out" <- w9
