vi "Check SFN TTI Index.gvi"   [LabVIEW NXG 4.0.0]
inputs:
  "Expected SFN": u16
  "Received SFN": u16
  "Expected TTI index": u8
  "Received TTI index": u8
  "error in": error
outputs:
  "error out": error
  "pass": bool
uses:
  NI::G Core::Error::Build Error Cluster.gvi
diagram:
  Is Not Equal(x=$"Expected SFN", y=$"Received SFN") -> w1
  Is Not Equal(x=$"Expected TTI index", y=$"Received TTI index") -> w2
  Logical And(w1, w2) -> w3
  $pass <- w3
  case (w2) {
    frame False {
      w4 = $"error in"
    }
    frame True {
      Format Into String(formatString="TTI index mismatch - expected: %d, received %d", $"Expected TTI index", $"Received TTI index") -> w5
      w6 = "Timeout"  # LTE Confirmation States
      Type Cast(type=u8 0, x=w6) -> w7
      To Signed 32 Bit Integer(number=w7) -> w8
      call "Build Error Cluster.gvi"(code=w8, description=w5, error in=$"error in") -> (error out=w4)
    }
  }
  case (w1) {
    frame False {
      w9 = w4
    }
    frame True {
      Format Into String(formatString="SFN mismatch - expected: %d, received%d", $"Expected SFN", $"Received SFN") -> w10
      w11 = "Timeout"  # LTE Confirmation States
      Type Cast(type=u8 0, x=w11) -> w12
      To Signed 32 Bit Integer(number=w12) -> w13
      call "Build Error Cluster.gvi"(code=w13, description=w10, error in=w4) -> (error out=w9)
    }
  }
  $"error out" <- w9
