vi "Check UERS MAC PDU Size.gvi"   [LabVIEW NXG 4.0.0]
inputs:
  "use UERS": bool = TRUE
  "subframe index": u8
  "frame structure": enum{"FDD", "TDD 5 5"} = "FDD"
  "PRB Allocation In": u32 = 33554431
outputs:
  "PRB Allocation Out": u32
diagram:
  # in FDD case mask PSS PRBs
  # from resource allocation when
  # UERS are enabled
  Number To Boolean Array(number=$"PRB Allocation In") -> (Boolean array=w1)
  case ($"frame structure") {
    frame "FDD" {
      Is Not Equal To 0(x=$"subframe index") -> w3
      Logical Or(not $"use UERS", w3) -> w2
    }
    frame "TDD 5 5" {
      w2 = TRUE
    }
  }
  Array Subset(array=w1, index0=11, length0=3) -> w4
  Logical And(w2, w4) -> w5
  Replace Array Subset(inArray=w1, index=11, new=w5) -> w6
  Boolean Array To Number(Boolean array=w6) -> (number=w7: u32)
  $"PRB Allocation Out" <- w7
