vi "Decode General Message Header.gvi"   [LabVIEW NXG 4.0.0]
# Decodes the general message header from the given 1D array of U8 (byte).
inputs:
  "message data in": u8[]  # General message header in 1D array of U8.
  "error in": error
outputs:
  "decoded message body length": u32  # Decoded message body length.
  "decoded general message header": "General Message Header.gtype"
  "error out": error
  "message body out": u8[]
  "remaining data out": u8[]
types:
  "Message Type ID Defined.gtype" = u16
  "General Message Header.gtype" = cluster{"message type ID": "Message Type ID Defined.gtype", "reference ID": u16, "instance ID": u8}
uses:
  AFW::LTE::L1L2 API::Check Message Body Length.gvi
diagram:
  w1 = 8  # consumed bytes
  Split 1D Array(array=$"message data in", index=w1) -> (first subarray=w2, second subarray=w3)
  Array Index(array=w2) -> (out0[_]=w4, out1[_]=w5, out2[_]=w6, out3[_]=w7, out4[_]=w8, out5[_]=w9, out6[_]=w10, out7[_]=w11)
  Join Numbers(high(x)=w6, low(x)=w7) -> w12
  Join Numbers(high(x)=w4, low(x)=w5) -> w13
  Type Cast(type="Message Type ID Defined.gtype" "UNDEFINED_MESSAGE"(0), x=w13) -> w14
  Property Node(instance in="General Message Header.gtype" {all zero or empty}, "message type ID"=w14, "reference ID"=w12, "instance ID"=w8) -> (instance out=w15)
  $"decoded general message header" <- w15
  Join Numbers(high(x)=0, low(x)=w9) -> w16
  Join Numbers(high(x)=w10, low(x)=w11) -> w17
  Join Numbers(high(x)=w16, low(x)=w17) -> w18
  $"decoded message body length" <- w18
  To Signed 32 Bit Integer(number=w18) -> w19
  Split 1D Array(array=w3, index=w19) -> (first subarray=w20, second subarray=w21)
  $"message body out" <- w20
  $"remaining data out" <- w21
  Array Size(array=w3) -> (size(s)=w22)
  call "Check Message Body Length.gvi"(expected message body length=w19, received message body length=w22, error in=$"error in", check minimal size=TRUE) -> (error out=w23)
  $"error out" <- w23
