vi "Decode Message Header.gvi"   [LabVIEW NXG 4.0.0]
inputs:
  "data in": u8[]
  "expected number of submessages": u8 = 1
  "expected message header type": "Message Header Type.gtype" = "Indication"
  "error in": error
outputs:
  "remaining data": u8[]
  "general message header": "General Message Header.gtype"
  "SAP sub header": "SAP Sub Header.gtype"
  "message body length": u32
  "sub message data": u8[]
  "error out": error
types:
  "Message Header Type.gtype" = enum{"Indication", "Request", "Confirm", "Reserved"}
  "SAP Sub Header.gtype" = cluster{"SFN": u16, "TTI index": u8, "number of submessages": u8, "confirmation mode": u8, "Reserved": u32}
  "Message Type ID Defined.gtype" = u16
  "General Message Header.gtype" = cluster{"message type ID": "Message Type ID Defined.gtype", "reference ID": u16, "instance ID": u8}
uses:
  AFW::LTE::L1L2 API::Decode General Message Header.gvi
  AFW::LTE::L1L2 API::Decode SAP Sub Header.gvi
diagram:
  call "Decode General Message Header.gvi"(message data in=$"data in", error in=$"error in") -> (remaining data out=w1, message body out=w2, decoded message body length=w3, decoded general message header=w4, error out=w5)
  $"message body length" <- w3
  $"general message header" <- w4
  call "Decode SAP Sub Header.gvi"(received SAP sub header=w2, expected number of submessages=$"expected number of submessages", received message header type=$"expected message header type", error in=w5) -> (sub message data out=w6, decoded SAP sub header=w7, error out=w8)
  $"SAP sub header" <- w7
  $"remaining data" <- w1
  $"sub message data" <- w6
  $"error out" <- w8
