vi "Decode Message ID.gvi"   [LabVIEW NXG 4.0.0]
inputs:
  "received message type ID": "General Message Header.gtype"
outputs:
  "LTE message type ID out": "Message Type ID.gtype"
types:
  "Message Header Location.gtype" = enum{"Common", "eNB", "UE", "Reserved"}
  "Message Header Type.gtype" = enum{"Indication", "Request", "Confirm", "Reserved"}
  "Message Type ID.gtype" = cluster{"SAP Interface Type": u8, "Service Layer ID": u8, "Location Field": "Message Header Location.gtype", "Message Type": "Message Header Type.gtype", "Message ID": u8}
  "Message Type ID Defined.gtype" = u16
  "General Message Header.gtype" = cluster{"message type ID": "Message Type ID Defined.gtype", "reference ID": u16, "instance ID": u8}
diagram:
  Property Node(instance in=$"received message type ID") -> ("message type ID"=w1)
  To Unsigned 16 Bit Integer(number=w1) -> w2
  Split Number(x=w2) -> (high(x)=w3, low(x)=w4)
  Number To Boolean Array(number=w3) -> (Boolean array=w5)
  Array Subset(array=w5, index0=6, length0=2) -> w6
  Boolean Array To Number(Boolean array=w6) -> (number=w7: u8)
  Array Subset(array=w5, index0=4, length0=2) -> w8
  Boolean Array To Number(Boolean array=w8) -> (number=w9: u8)
  Array Subset(array=w5, index0=2, length0=2) -> w10
  Boolean Array To Number(Boolean array=w10) -> (number=w11: u8)
  Type Cast(type="Message Header Location.gtype" "Common", x=w11) -> w12
  Array Subset(array=w5, index0=0, length0=2) -> w13
  Boolean Array To Number(Boolean array=w13) -> (number=w14: u8)
  w15 = "Message Header Type.gtype" "Indication"  # LTE Message Header Type
  Type Cast(type=w15, x=w14) -> w16
  Property Node(instance in="Message Type ID.gtype" {all zero or empty}, "SAP Interface Type"=w7, "Service Layer ID"=w9, "Location Field"=w12, "Message Type"=w16, "Message ID"=w4) -> (instance out=w17)
  $"LTE message type ID out" <- w17
