vi "Decode PHY SAP DCI Config DL Grant.gvi"   [LabVIEW NXG 4.0.0]
inputs:
  "sub message": u8[]
outputs:
  "downlink grant parameter": "Message DCI Config DL Grant Parameter.gtype"
types:
  "Message DCI Config DL Grant Parameter.gtype" = cluster{"Config Active": bool, "RNTI": u16, "CCE Offset": u8, "PRB Allocation": u32, "MCS": u8, "TPC": u8}
diagram:
  Array Index(array=$"sub message") -> (out0[_]=w1, out1[_]=w2, out2[_]=w3, out3[_]=w4, out4[_]=w5, out5[_]=w6, out6[_]=w7, out7[_]=w8, out8[_]=w9)
  Join Numbers(high(x)=w1, low(x)=w2) -> w10
  Join Numbers(high(x)=w4, low(x)=w5) -> w11
  Join Numbers(high(x)=w6, low(x)=w7) -> w12
  Join Numbers(high(x)=w11, low(x)=w12) -> w13
  w14 = "Message DCI Config DL Grant Parameter.gtype" {all zero or empty}
  Property Node(instance in=w14, "RNTI"=w10, "CCE Offset"=w3, "PRB Allocation"=w13, "MCS"=w8, "TPC"=w9) -> (instance out=w15)
  $"downlink grant parameter" <- w15
