vi "Decode PHY SAP DL RX Indication.gvi"   [LabVIEW NXG 4.0.0]
inputs:
  "sub message": u8[]
  "number of submessages": u8
  "error in": error
outputs:
  "CRC Result": u8
  "MAC PDU": u8[]
  "error out": error
  "RNTI": u16
uses:
  AFW::LTE::L1L2 API::Decode Sub Message Header.gvi
  NI::G Core::Error::Build Error Cluster.gvi
  AFW::LTE::L1L2 API::Decode PHY SAP DLSCH MAC PDU RX.gvi
  AFW::LTE::L1L2 API::Check MAC PDU Size.gvi
diagram:
  To Signed 32 Bit Integer(number=$"number of submessages") -> w1
  # Decode DL RX Indication Sub-Messages
  s1 = $"sub message"  # shift register
  for (N = w1) {
    call "Decode Sub Message Header.gvi"(submessage data in=s1, error in=$"error in") -> (remaining data out=w2, submessage body out=w3, decoded sub message type=w4, error out=w5)
    case (w4) {
      frame 1, Default {
        # TODO: ^^Change Error Msg to DL RX Infication
        w10 = "Unknown Parameter (Set)"  # LTE Confirmation States
        Type Cast(type=u8 0, x=w10) -> w11
        To Signed 32 Bit Integer(number=w11) -> w12
        call "Build Error Cluster.gvi"(code=w12, description="Unkown sub-message for Tx Payload Request", error in=w5) -> (error out=w6)
        w7 = default
        w8 = default
        w9 = default
      }
      frame 0 {
        call "Decode PHY SAP DLSCH MAC PDU RX.gvi"(sub message=w3) -> (CRC result=w7, MAC PDU=w8, MAC PDU Size=w13, RNTI=w9)
        Array Size(array=w8) -> (size(s)=w14)
        To Signed 32 Bit Integer(number=w13) -> w15
        call "Check MAC PDU Size.gvi"(Expected MAC PDU Size=w15, Received MAC PDU Size=w14, error in=w5) -> (error out=w6)
      }
    }
    next s1 = w2
  }
  $"CRC Result" <- w7
  $RNTI <- w9
  $"MAC PDU" <- w8
  $"error out" <- w6
