vi "Decode PHY SAP DL TX Config Request.gvi"   [LabVIEW NXG 4.0.0]
inputs:
  "sub message": u8[]
  "number of submessages": u8
  "error in": error
  "check parameter": "UERS Check Pararmeter.gtype" = {"use UERS"=FALSE, "subframe index"=0, "frame structure"="TDD 5 5"}
outputs:
  "downlink grant parameter": "Message DCI Config DL Grant Parameter.gtype"
  "dlsch parameter": "Message DLSCH Config Parameter.gtype"
  "error out": error
  "uplink grant parameter": "Message DCI Config UL Grant Parameter.gtype"
types:
  "Message DCI Config DL Grant Parameter.gtype" = cluster{"Config Active": bool, "RNTI": u16, "CCE Offset": u8, "PRB Allocation": u32, "MCS": u8, "TPC": u8}
  "Message DCI Config UL Grant Parameter.gtype" = cluster{"Config Active": bool, "RNTI": u16, "CCE Offset": u8, "PRB Allocation": u32, "MCS": u8, "TPC": u8}
  "Message DLSCH Config Parameter.gtype" = cluster{"Config Active": bool, "MAC PDU Index": u8, "RNTI": u16, "PRB Allocation": u32, "MCS": u8}
  "UERS Check Pararmeter.gtype" = cluster{"use UERS": bool, "subframe index": u8, "frame structure": enum{"FDD", "TDD 5 5"}}
  "Message DL TX Config Type ID.gtype" = enum{"COMMON", "DLSCH_TX_CONFIG", "DCI_TX_CONFIG_DL_GRANT", "DCI_TX_CONFIG_UL_GRANT"}
uses:
  AFW::LTE::L1L2 API::Decode Sub Message Header.gvi
  NI::G Core::Error::Build Error Cluster.gvi
  AFW::LTE::L1L2 API::Decode PHY SAP DLSCH Config.gvi
  AFW::LTE::L1L2 API::Check PHY SAP DLSCH Config.gvi
  AFW::LTE::L1L2 API::Decode PHY SAP DCI Config UL Grant.gvi
  AFW::LTE::L1L2 API::Check PHY SAP DCI Config UL Grant.gvi
  AFW::LTE::L1L2 API::Decode PHY SAP DCI Config DL Grant.gvi
  AFW::LTE::L1L2 API::Check PHY SAP DCI Config DL Grant.gvi
diagram:
  To Signed 32 Bit Integer(number=$"number of submessages") -> w1
  # Decode DL TX Config Request Sub-Messages
  s1 = $"sub message"  # shift register
  s2 = $"error in"  # shift register
  for (N = w1) {
    call "Decode Sub Message Header.gvi"(submessage data in=s1, error in=s2) -> (remaining data out=w5, submessage body out=w6, decoded sub message type=w7, error out=w8)
    w9 = "Message DL TX Config Type ID.gtype" "COMMON"  # LTE Message DL TX Config Type ID
    Type Cast(type=w9, x=w7) -> w10
    case (w10) {
      frame "COMMON", Default {
        w18 = "Unknown Parameter (Set)"  # LTE Confirmation States
        Type Cast(type=u8 0, x=w18) -> w19
        To Signed 32 Bit Integer(number=w19) -> w20
        call "Build Error Cluster.gvi"(code=w20, description="Unkown sub-message for DL Tx Config Request", error in=w8) -> (error out=w14)
        w11 = default
        w12 = default
        w13 = default
        w15 = default
        w16 = default
        w17 = default
      }
      frame "DLSCH_TX_CONFIG" {
        call "Decode PHY SAP DLSCH Config.gvi"(sub message=w6) -> (dlsch parameter=w21)
        Property Node(instance in=w21, "Config Active"=TRUE) -> (instance out=w13)
        call "Check PHY SAP DLSCH Config.gvi"(check parameter=$"check parameter", DLSCH parameter=w21, error in=w8) -> (error out=w14)
        w11 = default
        w12 = default
        w15 = default
        w16 = default
        w17 = TRUE
      }
      frame "DCI_TX_CONFIG_UL_GRANT" {
        call "Decode PHY SAP DCI Config UL Grant.gvi"(sub message=w6) -> (uplink grant parameter=w22)
        Property Node(instance in=w22, "Config Active"=TRUE) -> (instance out=w12)
        call "Check PHY SAP DCI Config UL Grant.gvi"(uplink grant parameter=w22, error in=w8) -> (error out=w14)
        w11 = default
        w13 = default
        w15 = TRUE
        w16 = default
        w17 = default
      }
      frame "DCI_TX_CONFIG_DL_GRANT" {
        call "Decode PHY SAP DCI Config DL Grant.gvi"(sub message=w6) -> (downlink grant parameter=w23)
        Property Node(instance in=w23, "Config Active"=TRUE) -> (instance out=w11)
        call "Check PHY SAP DCI Config DL Grant.gvi"(downlink grant parameter=w23, error in=w8) -> (error out=w14)
        w12 = default
        w13 = default
        w15 = default
        w16 = TRUE
        w17 = default
      }
    }
    w2 = w11 if w16
    w3 = w12 if w15
    w4 = w13 if w17
    next s1 = w5
    next s2 = w14
  }
  $"downlink grant parameter" <- w2
  $"dlsch parameter" <- w4
  $"uplink grant parameter" <- w3
  $"error out" <- s2
