vi "Decode PHY SAP DL TX Payload Request.gvi"   [LabVIEW NXG 4.0.0]
inputs:
  "sub message": u8[]
  "error in": error
  "number of submessages": u8
  "dlsch parameter": "Message DLSCH Config Parameter.gtype"
  "uers check parameter": "UERS Check Pararmeter.gtype" = {"use UERS"=FALSE, "subframe index"=0, "frame structure"="TDD 5 5"}
outputs:
  "MAC PDU Index": u8
  "MAC PDU": u8[]
  "error out": error
types:
  "Message DLSCH Config Parameter.gtype" = cluster{"Config Active": bool, "MAC PDU Index": u8, "RNTI": u16, "PRB Allocation": u32, "MCS": u8}
  "UERS Check Pararmeter.gtype" = cluster{"use UERS": bool, "subframe index": u8, "frame structure": enum{"FDD", "TDD 5 5"}}
uses:
  AFW::LTE::L1L2 API::Decode Sub Message Header.gvi
  NI::G Core::Error::Build Error Cluster.gvi
  AFW::LTE::L1L2 API::Decode PHY SAP DLSCH MAC PDU TX.gvi
  AFW::LTE::L1L2 API::Check DL MAC PDU Size.gvi
diagram:
  To Signed 32 Bit Integer(number=$"number of submessages") -> w1
  # Decode DL TX Payload Request Sub-Messages
  s1 = $"sub message"  # shift register
  for (N = w1) {
    call "Decode Sub Message Header.gvi"(submessage data in=s1, error in=$"error in") -> (remaining data out=w2, submessage body out=w3, decoded sub message type=w4, error out=w5)
    case (w4) {
      frame 1, Default {
        w9 = "Unknown Parameter (Set)"  # LTE Confirmation States
        Type Cast(type=u8 0, x=w9) -> w10
        To Signed 32 Bit Integer(number=w10) -> w11
        call "Build Error Cluster.gvi"(code=w11, description="Unkown sub-message for Tx Payload Request", error in=w5) -> (error out=w6)
        w7 = default
        w8 = default
      }
      frame 0 {
        call "Decode PHY SAP DLSCH MAC PDU TX.gvi"(sub message=w3) -> (MAC PDU Index=w7, MAC PDU=w8, MAC PDU Size=w12)
        Array Size(array=w8) -> (size(s)=w13)
        To Signed 32 Bit Integer(number=w12) -> w14
        call "Check DL MAC PDU Size.gvi"(DLSCH parameter=$"dlsch parameter", UERS check parameter=$"uers check parameter", Expected MAC PDU Size=w14, Received MAC PDU Size=w13, error in=w5) -> (error out=w6)
      }
    }
    next s1 = w2
  }
  $"MAC PDU Index" <- w7
  $"MAC PDU" <- w8
  $"error out" <- w6
