vi "Decode PHY SAP DLSCH Config.gvi"   [LabVIEW NXG 4.0.0]
inputs:
  "sub message": u8[]
outputs:
  "dlsch parameter": "Message DLSCH Config Parameter.gtype"
types:
  "Message DLSCH Config Parameter.gtype" = cluster{"Config Active": bool, "MAC PDU Index": u8, "RNTI": u16, "PRB Allocation": u32, "MCS": u8}
diagram:
  Array Index(array=$"sub message") -> (out0[_]=w1, out1[_]=w2, out2[_]=w3, out3[_]=w4, out4[_]=w5, out5[_]=w6, out6[_]=w7, out7[_]=w8)
  Join Numbers(high(x)=w2, low(x)=w3) -> w9
  Join Numbers(high(x)=w4, low(x)=w5) -> w10
  Join Numbers(high(x)=w6, low(x)=w7) -> w11
  Join Numbers(high(x)=w10, low(x)=w11) -> w12
  Property Node(instance in="Message DLSCH Config Parameter.gtype" {all zero or empty}, "MAC PDU Index"=w1, "RNTI"=w9, "PRB Allocation"=w12, "MCS"=w8) -> (instance out=w13)
  $"dlsch parameter" <- w13
