vi "Decode PHY SAP Map Config.gvi"   [LabVIEW NXG 4.0.0]
inputs:
  "downlink grant parameter": "Message DCI Config DL Grant Parameter.gtype"
  "dlsch parameter": "Message DLSCH Config Parameter.gtype"
  "uplink grant parameter": "Message DCI Config UL Grant Parameter.gtype"
  "Use UERS": bool
outputs:
  "eNB TX UE Context": T1
  "eNB TX DCI": "DCI Message.gtype"
types:
  "Message DCI Config DL Grant Parameter.gtype" = cluster{"Config Active": bool, "RNTI": u16, "CCE Offset": u8, "PRB Allocation": u32, "MCS": u8, "TPC": u8}
  "Message DCI Config UL Grant Parameter.gtype" = cluster{"Config Active": bool, "RNTI": u16, "CCE Offset": u8, "PRB Allocation": u32, "MCS": u8, "TPC": u8}
  "Message DLSCH Config Parameter.gtype" = cluster{"Config Active": bool, "MAC PDU Index": u8, "RNTI": u16, "PRB Allocation": u32, "MCS": u8}
  T1 = cluster{"RNTI": u16, "Use UERS": bool, "Antenna Port": UFXP(4.0), "CCE Offset": u8}
  T2 = enum{"MCS 0 (QPSK, rate ~0.12)", "MCS 1 (QPSK, rate ~0.15)", "MCS 2 (QPSK, rate ~0.19)", "MCS 3 (QPSK, rate ~0.25)", "MCS 4 (QPSK, rate ~0.30)", "MCS 5 (QPSK, rate ~0.37)", "MCS 6 (QPSK, rate ~0.44)", "MCS 7 (QPSK, rate ~0.51)", "MCS 8 (QPSK, rate ~0.59)", "MCS 9 (QPSK, rate ~0.66)", "MCS 10 (16-QAM, rate ~0.33)", "MCS 11 (16-QAM, rate ~0.37)", "MCS 12 (16-QAM, rate ~0.42)", "MCS 13 (16-QAM, rate ~0.48)", "MCS 14 (16-QAM, rate ~0.54)", "MCS 15 (16-QAM, rate ~0.60)", "MCS 16 (16-QAM, rate ~0.64)", "MCS 17 (64-QAM, rate ~0.43)", "MCS 18 (64-QAM, rate ~0.46)", "MCS 19 (64-QAM, rate ~0.50)", "MCS 20 (64-QAM, rate ~0.55)", "MCS 21 (64-QAM, rate ~0.60)", "MCS 22 (64-QAM, rate ~0.65)", "MCS 23 (64-QAM, rate ~0.70)", "MCS 24 (64-QAM, rate ~0.75)", "MCS 25 (64-QAM, rate ~0.80)", "MCS 26 (64-QAM, rate ~0.85)", "MCS 27 (64-QAM, rate ~0.89)", "MCS 28 (64-QAM, rate ~0.93)"}
  "DCI Message.gtype" = cluster{"Active": bool, "MCS": T2, "Resource Block Allocation (4 PRB/bit)": UFXP(25.0)}
diagram:
  Property Node(instance in=$"dlsch parameter")
  Property Node(instance in=$"downlink grant parameter") -> ("Config Active"=w1, "RNTI"=w2, "CCE Offset"=w3, "MCS"=w4, "PRB Allocation"=w5)
  w6 = T1 {"RNTI"=10, "Use UERS"=FALSE, "Antenna Port"=7, "CCE Offset"=0}
  Property Node(instance in=w6, "RNTI"=w2, "CCE Offset"=w3, "Use UERS"=$"Use UERS", "Antenna Port"=7) -> (instance out=w7)
  $"eNB TX UE Context" <- w7
  To Unsigned 16 Bit Integer(number=w4) -> w8
  Type Cast(type=T2 "MCS 0 (QPSK, rate ~0.12)", x=w8) -> w9
  To Fixed Point(fixed-point type=UFXP(25.0) 0, number=w5) -> w10
  w11 = "DCI Message.gtype" {"Active"=TRUE, "MCS"="MCS 17 (64-QAM, rate ~0.43)", "Resource Block Allocation (4 PRB/bit)"=8388610}
  Property Node(instance in=w11, "Active"=w1, "MCS"=w9, "Resource Block Allocation (4 PRB/bit)"=w10) -> (instance out=w12)
  $"eNB TX DCI" <- w12
  Property Node(instance in=$"uplink grant parameter")
