vi "Decode PHY SAP UL TX Config Request.gvi"   [LabVIEW NXG 4.0.0]
inputs:
  "sub message": u8[]
  "number of submessages": u8
  "error in": error
outputs:
  "ulsch parameter": "Message DLSCH Config Parameter.gtype"
  "error out": error
types:
  "Message DLSCH Config Parameter.gtype" = cluster{"Config Active": bool, "MAC PDU Index": u8, "RNTI": u16, "PRB Allocation": u32, "MCS": u8}
  "Message UL TX Config Type ID.gtype" = enum{"COMMON", "ULSCH_TX_CONFIG", "TA_UPDATE"}
uses:
  AFW::LTE::L1L2 API::Decode Sub Message Header.gvi
  NI::G Core::Error::Build Error Cluster.gvi
  AFW::LTE::L1L2 API::Decode PHY SAP DLSCH Config.gvi
  AFW::LTE::L1L2 API::Check PHY SAP DLSCH Config.gvi
diagram:
  To Signed 32 Bit Integer(number=$"number of submessages") -> w1
  # Decode UL TX Config Request Sub-Messages
  s1 = $"sub message"  # shift register
  s2 = $"error in"  # shift register
  for (N = w1) {
    call "Decode Sub Message Header.gvi"(submessage data in=s1, error in=s2) -> (remaining data out=w3, submessage body out=w4, decoded sub message type=w5, error out=w6)
    w7 = "Message UL TX Config Type ID.gtype" "COMMON"  # LTE Message UL TX Config Type ID
    Type Cast(type=w7, x=w5) -> w8
    case (w8) {
      frame "COMMON", Default {
        w12 = "Unknown Parameter (Set)"  # LTE Confirmation States
        Type Cast(type=u8 0, x=w12) -> w13
        To Signed 32 Bit Integer(number=w13) -> w14
        call "Build Error Cluster.gvi"(code=w14, description="Unkown sub-message for DL Tx Config Request", error in=w6) -> (error out=w10)
        w9 = default
        w11 = default
      }
      frame "ULSCH_TX_CONFIG" {
        call "Decode PHY SAP DLSCH Config.gvi"(sub message=w4) -> (dlsch parameter=w15)
        Property Node(instance in=w15, "Config Active"=TRUE) -> (instance out=w9)
        call "Check PHY SAP DLSCH Config.gvi"(DLSCH parameter=w15, error in=w6) -> (error out=w10)
        w11 = TRUE
      }
    }
    w2 = w9 if w11
    next s1 = w3
    next s2 = w10
  }
  $"ulsch parameter" <- w2
  $"error out" <- s2
