vi "Decode PHY SAP UL TX Payload Request.gvi"   [LabVIEW NXG 4.0.0]
inputs:
  "sub message": u8[]
  "error in": error
  "number of submessages": u8
  "ulsch parameter": "Message ULSCH Config Parameter.gtype"
outputs:
  "MAC PDU Index": u8
  "MAC PDU": u8[]
  "error out": error
types:
  "Message ULSCH Config Parameter.gtype" = cluster{"Config Active": bool, "MAC PDU Index": u8, "RNTI": u16, "PRB Allocation": u32, "MCS": u8}
uses:
  AFW::LTE::L1L2 API::Decode Sub Message Header.gvi
  NI::G Core::Error::Build Error Cluster.gvi
  AFW::LTE::L1L2 API::Decode PHY SAP ULSCH MAC PDU TX.gvi
  AFW::LTE::L1L2 API::Check MAC PDU Size.gvi
diagram:
  To Signed 32 Bit Integer(number=$"number of submessages") -> w1
  # Decode UL TX Payload Request Sub-Messages
  s1 = $"sub message"  # shift register
  for (N = w1) {
    call "Decode Sub Message Header.gvi"(submessage data in=s1, error in=$"error in") -> (remaining data out=w2, submessage body out=w3, decoded sub message type=w4, error out=w5)
    case (w4) {
      frame 1, Default {
        w9 = "Unknown Parameter (Set)"  # LTE Confirmation States
        Type Cast(type=u8 0, x=w9) -> w10
        To Signed 32 Bit Integer(number=w10) -> w11
        call "Build Error Cluster.gvi"(code=w11, description="Unkown sub-message for Tx Payload Request") -> (error out=w6)
        w7 = default
        w8 = default
      }
      frame 0 {
        call "Decode PHY SAP ULSCH MAC PDU TX.gvi"(sub message=w3) -> (MAC PDU Index=w7, MAC PDU=w8, MAC PDU Size=w12)
        Array Size(array=w8) -> (size(s)=w13)
        To Signed 32 Bit Integer(number=w12) -> w14
        w15 = TRUE  # ulsch valid
        call "Check MAC PDU Size.gvi"(ulsch parameter=$"ulsch parameter", ulsch parameter check=w15, Expected MAC PDU Size=w14, Received MAC PDU Size=w13, error in=w5) -> (error out=w6)
      }
    }
    next s1 = w2
  }
  $"MAC PDU Index" <- w7
  $"MAC PDU" <- w8
  $"error out" <- w6
