vi "Decode PHY SAP ULSCH MAC PDU RX.gvi"   [LabVIEW NXG 4.0.0]
inputs:
  "sub message": u8[]
outputs:
  "CRC result": u8
  "MAC PDU": u8[]
  "MAC PDU Size": u32
  "RNTI": u16
diagram:
  Split 1D Array(array=$"sub message", index=6) -> (first subarray=w1, second subarray=w2)
  Array Index(array=w1) -> (out0[_]=w3, out1[_]=w4, out2[_]=w5, out3[_]=w6, out4[_]=w7, out5[_]=w8)
  Join Numbers(high(x)=w3, low(x)=w4) -> w9
  $RNTI <- w9
  $"CRC result" <- w5
  Join Numbers(high(x)=0, low(x)=w6) -> w10
  Join Numbers(high(x)=w7, low(x)=w8) -> w11
  Join Numbers(high(x)=w10, low(x)=w11) -> w12
  $"MAC PDU Size" <- w12
  $"MAC PDU" <- w2
