vi "Decode PHY SAP ULSCH MAC PDU TX.gvi"   [LabVIEW NXG 4.0.0]
inputs:
  "sub message": u8[]
outputs:
  "MAC PDU Index": u8
  "MAC PDU": u8[]
  "MAC PDU Size": u32
diagram:
  Split 1D Array(array=$"sub message", index=4) -> (first subarray=w1, second subarray=w2)
  Array Index(array=w1) -> (out0[_]=w3, out1[_]=w4, out2[_]=w5, out3[_]=w6)
  $"MAC PDU Index" <- w3
  Join Numbers(high(x)=0, low(x)=w4) -> w7
  Join Numbers(high(x)=w5, low(x)=w6) -> w8
  Join Numbers(high(x)=w7, low(x)=w8) -> w9
  $"MAC PDU Size" <- w9
  $"MAC PDU" <- w2
