vi "Decode SAP Sub Header.gvi"   [LabVIEW NXG 4.0.0]
# Decodes the SAP Sub Header from the given 1D array of U8 (byte).
inputs:
  "expected number of submessages": u8
  "error in": error
  "received SAP sub header": u8[]
  "received message header type": "Message Header Type.gtype" = "Indication"
outputs:
  "decoded SAP sub header": "SAP Sub Header.gtype"
  "reserved": u32
  "sub message data out": u8[]
  "error out": error
types:
  "SAP Sub Header.gtype" = cluster{"SFN": u16, "TTI index": u8, "number of submessages": u8, "confirmation mode": u8, "Reserved": u32}
  "Message Header Type.gtype" = enum{"Indication", "Request", "Confirm", "Reserved"}
uses:
  AFW::LTE::L1L2 API::Check SAP Sub Header.gvi
diagram:
  w1 = 8  # consumed bytes
  Split 1D Array(array=$"received SAP sub header", index=w1) -> (first subarray=w2, second subarray=w3)
  Array Index(array=w2) -> (out0[_]=w4, out1[_]=w5, out2[_]=w6, out3[_]=w7, out4[_]=w8, out5[_]=w9, out6[_]=w10, out7[_]=w11)
  Join Numbers(high(x)=w4, low(x)=w5) -> w12
  Property Node(instance in="SAP Sub Header.gtype" {all zero or empty}, "SFN"=w12, "TTI index"=w6, "number of submessages"=w7, "confirmation mode"=w8) -> (instance out=w13)
  $"decoded SAP sub header" <- w13
  Join Numbers(high(x)=0, low(x)=w9) -> w14
  Join Numbers(high(x)=w10, low(x)=w11) -> w15
  Join Numbers(high(x)=w14, low(x)=w15) -> w16
  $reserved <- w16
  $"sub message data out" <- w3
  call "Check SAP Sub Header.gvi"(received SAP sub header=w13, expected number of submessages=$"expected number of submessages", received message header type=$"received message header type", error in=$"error in") -> (error out=w17)
  $"error out" <- w17
