vi "Decode Sub Message Header.gvi"   [LabVIEW NXG 4.0.0]
# Decodes the general message header from the given 1D array of U8 (byte).
inputs:
  "submessage data in": u8[]  # General message header in 1D array of U8.
  "error in": error
outputs:
  "remaining data out": u8[]
  "decoded parameter set id": u8  # Decoded message body length.
  "submessage body out": u8[]
  "decoded sub message type": u8  # Decoded message body length.
  "error out": error
  "decoded parameter body length": u32
uses:
  AFW::LTE::L1L2 API::Check Message Body Length.gvi
diagram:
  w1 = 5  # consumed bytes
  Split 1D Array(array=$"submessage data in", index=w1) -> (first subarray=w2, second subarray=w3)
  Array Index(array=w2) -> (out0[_]=w4, out1[_]=w5, out2[_]=w6, out3[_]=w7, out4[_]=w8)
  $"decoded sub message type" <- w4
  $"decoded parameter set id" <- w5
  Join Numbers(high(x)=0, low(x)=w6) -> w9
  Join Numbers(high(x)=w7, low(x)=w8) -> w10
  Join Numbers(high(x)=w9, low(x)=w10) -> w11
  $"decoded parameter body length" <- w11
  To Signed 32 Bit Integer(number=w11) -> w12
  Split 1D Array(array=w3, index=w12) -> (first subarray=w13, second subarray=w14)
  $"submessage body out" <- w13
  $"remaining data out" <- w14
  Array Size(array=w3) -> (size(s)=w15)
  call "Check Message Body Length.gvi"(expected message body length=w12, received message body length=w15, error in=$"error in", check minimal size=TRUE) -> (error out=w16)
  $"error out" <- w16
