vi "Encode PHY SAP Confirm Message.gvi"   [LabVIEW NXG 4.0.0]
inputs:
  "general message header": "General Message Header.gtype"
  "SAP sub header": "SAP Sub Header.gtype"
  "error in": error
outputs:
  "Confirm Message": u8[]
  "message body length": u32
  "error out": error
types:
  "Message Type ID Defined.gtype" = u16
  "General Message Header.gtype" = cluster{"message type ID": "Message Type ID Defined.gtype", "reference ID": u16, "instance ID": u8}
  "SAP Sub Header.gtype" = cluster{"SFN": u16, "TTI index": u8, "number of submessages": u8, "confirmation mode": u8, "Reserved": u32}
uses:
  AFW::LTE::L1L2 API::Encode SAP Sub Header.gvi
  AFW::LTE::L1L2 API::Encode Sub Message Header.gvi
  AFW::LTE::L1L2 API::Encode General Message Header.gvi
  NI::G Core::Error::Filter Error Code.gvi
diagram:
  Property Node(instance in=$"SAP sub header") -> ("SFN"=w1, "TTI index"=w2, "confirmation mode"=w3)
  case (w3) {
    frame 0, Default {
      w4 = u8[] []
      w5 = default
      w6 = $"error in"
    }
    frame 1 {
      w7 = 0  # confirmation mode
      w8 = 0  # Reserved
      Property Node(instance in="SAP Sub Header.gtype" {all zero or empty}, "SFN"=w1, "TTI index"=w2, "confirmation mode"=w7, "number of submessages"=0, "Reserved"=w8) -> (instance out=w9)
      call "Encode SAP Sub Header.gvi"(SAP sub header=w9) -> (encoded SAP sub header=w10)
      call "Encode Sub Message Header.gvi"(sub message type=0, sub message body length=3) -> (encoded sub message header=w11)
      Property Node(instance in=$"error in") -> ("code"=w12, instance out=w13)
      To Unsigned 8 Bit Integer(number=w12) -> w14
      Property Node(instance in=$"general message header") -> ("reference ID"=w15, "message type ID"=w16)
      Split Number(x=w16) -> (high(x)=w17, low(x)=w18)
      Build Array(w11, w14, w17, w18) -> w19
      Build Array(w10, w19) -> w20
      w21 = 0  # instance ID
      Property Node(instance in="General Message Header.gtype" {all zero or empty}, "message type ID"="PHY_CNF"(16898), "instance ID"=w21, "reference ID"=w15) -> (instance out=w22)
      Array Size(array=w20) -> (size(s)=w23)
      To Unsigned 32 Bit Integer(number=w23) -> w5
      call "Encode General Message Header.gvi"(general message header=w22, message body length=w5) -> (encoded general message header=w24)
      Build Array(w24, w20) -> w4
      call "Filter Error Code.gvi"(code to clear=w12, error in=w13) -> (error out=w6)
    }
  }
  $"Confirm Message" <- w4
  $"message body length" <- w5
  $"error out" <- w6
