vi "Encode PHY SAP DCI Config DL Grant.gvi"   [LabVIEW NXG 4.0.0]
inputs:
  "downlink grant parameter": "Message DCI Config DL Grant Parameter.gtype"
outputs:
  "encoded sub message": u8[]
  "sub message body length": u32
types:
  "Message DCI Config DL Grant Parameter.gtype" = cluster{"Config Active": bool, "RNTI": u16, "CCE Offset": u8, "PRB Allocation": u32, "MCS": u8, "TPC": u8}
uses:
  AFW::LTE::L1L2 API::Encode Sub Message Header.gvi
diagram:
  w1 = 9  # sub message body length
  $"sub message body length" <- w1
  w2 = "DCI_TX_CONFIG_DL_GRANT"  # LTE Message DL TX Config Type ID
  Type Cast(type=u8 0, x=w2) -> w3
  call "Encode Sub Message Header.gvi"(sub message type=w3, sub message body length=w1) -> (encoded sub message header=w4)
  Property Node(instance in=$"downlink grant parameter") -> ("RNTI"=w5, "CCE Offset"=w6, "PRB Allocation"=w7, "MCS"=w8, "TPC"=w9)
  Split Number(x=w5) -> (high(x)=w10, low(x)=w11)
  Split Number(x=w7) -> (high(x)=w12, low(x)=w13)
  Split Number(x=w12) -> (high(x)=w14, low(x)=w15)
  Split Number(x=w13) -> (high(x)=w16, low(x)=w17)
  Build Array(w10, w11, w6, w14, w15, w16, w17, w8, w9) -> w18
  Build Array(w4, w18) -> w19
  $"encoded sub message" <- w19
