vi "Encode PHY SAP DL RX Indication.gvi"   [LabVIEW NXG 4.0.0]
# Creates a DX RX indication message.
inputs:
  "reference ID": u16
  "SFN": u16
  "TTI index": u8
  "MAC PDU": u8[]
  "MAC PDU Size": u32 = 8
  "RNTI": u16 = 8
  "CRC Result": u8 = 8
outputs:
  "encoded UL RX Indication": u8[]
  "message body length": u32
types:
  "SAP Sub Header.gtype" = cluster{"SFN": u16, "TTI index": u8, "number of submessages": u8, "confirmation mode": u8, "Reserved": u32}
  "Message Type ID Defined.gtype" = u16
  "General Message Header.gtype" = cluster{"message type ID": "Message Type ID Defined.gtype", "reference ID": u16, "instance ID": u8}
uses:
  AFW::LTE::L1L2 API::Encode SAP Sub Header.gvi
  AFW::LTE::L1L2 API::Encode Sub Message Header.gvi
  AFW::LTE::L1L2 API::Encode General Message Header.gvi
diagram:
  w1 = 0  # confirmation mode
  w2 = 0  # Reserved
  Property Node(instance in="SAP Sub Header.gtype" {all zero or empty}, "SFN"=$SFN, "TTI index"=$"TTI index", "confirmation mode"=w1, "number of submessages"=1, "Reserved"=w2) -> (instance out=w3)
  call "Encode SAP Sub Header.gvi"(SAP sub header=w3) -> (encoded SAP sub header=w4)
  w5 = 6  # sub message body length
  Add(w5, $"MAC PDU Size") -> w6
  call "Encode Sub Message Header.gvi"(sub message type=0, sub message body length=w6) -> (encoded sub message header=w7)
  Split Number(x=$RNTI) -> (high(x)=w8, low(x)=w9)
  Split Number(x=$"MAC PDU Size") -> (high(x)=w10, low(x)=w11)
  Split Number(x=w10) -> w12
  Split Number(x=w11) -> (high(x)=w13, low(x)=w14)
  Build Array(w7, w8, w9, $"CRC Result", w12, w13, w14, $"MAC PDU") -> w15
  Build Array(w4, w15) -> w16
  w17 = 0  # instance ID
  Property Node(instance in="General Message Header.gtype" {all zero or empty}, "message type ID"="PHY_DLSCH_RX_IND"(18433), "instance ID"=w17, "reference ID"=$"reference ID") -> (instance out=w18)
  Array Size(array=w16) -> (size(s)=w19)
  To Unsigned 32 Bit Integer(number=w19) -> w20
  call "Encode General Message Header.gvi"(general message header=w18, message body length=w20) -> (encoded general message header=w21)
  Build Array(w21, w16) -> w22
  $"encoded UL RX Indication" <- w22
  $"message body length" <- w20
