vi "Encode PHY SAP DL TX Config Request.gvi"   [LabVIEW NXG 4.0.0]
inputs:
  "reference ID": u16
  "SFN": u16
  "TTI index": u8
  "downlink config parameter": "Message DCI Config DL Grant Parameter.gtype"
  "uplink config parameter": "Message DCI Config UL Grant Parameter.gtype"
  "MAC PDU index": u8 = 8
outputs:
  "encoded message": u8[]
  "message body length": u32
  "message header": "General Message Header.gtype"
  "SAP sub header": "SAP Sub Header.gtype"
types:
  "Message DCI Config DL Grant Parameter.gtype" = cluster{"Config Active": bool, "RNTI": u16, "CCE Offset": u8, "PRB Allocation": u32, "MCS": u8, "TPC": u8}
  "Message DCI Config UL Grant Parameter.gtype" = cluster{"Config Active": bool, "RNTI": u16, "CCE Offset": u8, "PRB Allocation": u32, "MCS": u8, "TPC": u8}
  "Message Type ID Defined.gtype" = u16
  "General Message Header.gtype" = cluster{"message type ID": "Message Type ID Defined.gtype", "reference ID": u16, "instance ID": u8}
  "SAP Sub Header.gtype" = cluster{"SFN": u16, "TTI index": u8, "number of submessages": u8, "confirmation mode": u8, "Reserved": u32}
uses:
  AFW::LTE::L1L2 API::Encode PHY SAP DCI Config DL Grant.gvi
  AFW::LTE::L1L2 API::Encode PHY SAP DLSCH Config.gvi
  AFW::LTE::L1L2 API::Encode PHY SAP DCI Config UL Grant.gvi
  AFW::LTE::L1L2 API::Encode SAP Sub Header.gvi
  AFW::LTE::L1L2 API::Encode General Message Header.gvi
diagram:
  w1 = 1  # confirmation mode
  w2 = 0  # Reserved
  Property Node(instance in=$"downlink config parameter") -> ("Config Active"=w3, instance out=w4)
  case (w3) {
    frame False, Default {
      w5 = u8[] []
      w6 = 0
    }
    frame True {
      call "Encode PHY SAP DCI Config DL Grant.gvi"(downlink grant parameter=w4) -> (encoded sub message=w7)
      call "Encode PHY SAP DLSCH Config.gvi"(downlink grant parameter=w4, PDU index=$"MAC PDU index") -> (encoded sub message=w8)
      Build Array(w7, w8) -> w5
      w9 = 2  # number sub messages
      w6 = w9
    }
  }
  Property Node(instance in=$"uplink config parameter") -> ("Config Active"=w10, instance out=w11)
  case (w10) {
    frame False, Default {
      w12 = u8[] []
      w13 = 0
    }
    frame True {
      call "Encode PHY SAP DCI Config UL Grant.gvi"(uplink grant parameter=w11) -> (encoded sub message=w12)
      w14 = 1  # number sub messages
      w13 = w14
    }
  }
  Add(w6, w13) -> w15
  Property Node(instance in="SAP Sub Header.gtype" {all zero or empty}, "SFN"=$SFN, "TTI index"=$"TTI index", "confirmation mode"=w1, "number of submessages"=w15, "Reserved"=w2) -> (instance out=w16)
  $"SAP sub header" <- w16
  w17 = 0  # instance ID
  Property Node(instance in="General Message Header.gtype" {all zero or empty}, "message type ID"="PHY_DL_TX_CONFIG_REQ"(17665), "instance ID"=w17, "reference ID"=$"reference ID") -> (instance out=w18)
  $"message header" <- w18
  call "Encode SAP Sub Header.gvi"(SAP sub header=w16) -> (encoded SAP sub header=w19)
  Build Array(w19, w5, w12) -> w20
  Array Size(array=w20) -> (size(s)=w21)
  To Unsigned 32 Bit Integer(number=w21) -> w22
  call "Encode General Message Header.gvi"(general message header=w18, message body length=w22) -> (encoded general message header=w23)
  Build Array(w23, w20) -> w24
  $"encoded message" <- w24
  $"message body length" <- w22
