vi "Encode PHY SAP DL TX Payload Request.gvi"   [LabVIEW NXG 4.0.0]
inputs:
  "reference ID": u16
  "SFN": u16
  "TTI index": u8
  "MAC PDU": u8[]
  "MAC PDU Size": u32 = 8
  "MAC PDU index": u8 = 8
outputs:
  "encoded message": u8[]
  "message body length": u32
  "message header": "General Message Header.gtype"
  "SAP sub header": "SAP Sub Header.gtype"
types:
  "Message Type ID Defined.gtype" = u16
  "General Message Header.gtype" = cluster{"message type ID": "Message Type ID Defined.gtype", "reference ID": u16, "instance ID": u8}
  "SAP Sub Header.gtype" = cluster{"SFN": u16, "TTI index": u8, "number of submessages": u8, "confirmation mode": u8, "Reserved": u32}
uses:
  AFW::LTE::L1L2 API::Encode SAP Sub Header.gvi
  AFW::LTE::L1L2 API::Encode Sub Message Header.gvi
  AFW::LTE::L1L2 API::Encode General Message Header.gvi
diagram:
  w1 = 1  # confirmation mode
  w2 = 1  # number of submessages
  w3 = 0  # Reserved
  Property Node(instance in="SAP Sub Header.gtype" {all zero or empty}, "SFN"=$SFN, "TTI index"=$"TTI index", "confirmation mode"=w1, "number of submessages"=w2, "Reserved"=w3) -> (instance out=w4)
  $"SAP sub header" <- w4
  w5 = 0  # instance ID
  Property Node(instance in="General Message Header.gtype" {all zero or empty}, "message type ID"="PHY_DL_TX_PAYLOAD_REQ"(17666), "instance ID"=w5, "reference ID"=$"reference ID") -> (instance out=w6)
  $"message header" <- w6
  call "Encode SAP Sub Header.gvi"(SAP sub header=w4) -> (encoded SAP sub header=w7)
  w8 = 4  # sub message body length
  Add(w8, $"MAC PDU Size") -> w9
  call "Encode Sub Message Header.gvi"(sub message type=0, sub message body length=w9) -> (encoded sub message header=w10)
  Split Number(x=$"MAC PDU Size") -> (high(x)=w11, low(x)=w12)
  Split Number(x=w11) -> w13
  Split Number(x=w12) -> (high(x)=w14, low(x)=w15)
  Build Array(w10, $"MAC PDU index", w13, w14, w15, $"MAC PDU") -> w16
  Build Array(w7, w16) -> w17
  Array Size(array=w17) -> (size(s)=w18)
  To Unsigned 32 Bit Integer(number=w18) -> w19
  call "Encode General Message Header.gvi"(general message header=w6, message body length=w19) -> (encoded general message header=w20)
  Build Array(w20, w17) -> w21
  $"encoded message" <- w21
  $"message body length" <- w19
