vi "Encode PHY SAP DLSCH Config.gvi"   [LabVIEW NXG 4.0.0]
inputs:
  "downlink grant parameter": "Message DCI Config DL Grant Parameter.gtype"
  "PDU index": u8 = 8
outputs:
  "encoded sub message": u8[]
  "sub message body length": u32
types:
  "Message DCI Config DL Grant Parameter.gtype" = cluster{"Config Active": bool, "RNTI": u16, "CCE Offset": u8, "PRB Allocation": u32, "MCS": u8, "TPC": u8}
uses:
  AFW::LTE::L1L2 API::Encode Sub Message Header.gvi
diagram:
  w1 = 8  # sub message body length
  $"sub message body length" <- w1
  w2 = "DLSCH_TX_CONFIG"  # LTE Message DL TX Config Type ID
  Type Cast(type=u8 0, x=w2) -> w3
  call "Encode Sub Message Header.gvi"(sub message type=w3, sub message body length=w1) -> (encoded sub message header=w4)
  Property Node(instance in=$"downlink grant parameter") -> ("RNTI"=w5, "PRB Allocation"=w6, "MCS"=w7)
  Split Number(x=w5) -> (high(x)=w8, low(x)=w9)
  Split Number(x=w6) -> (high(x)=w10, low(x)=w11)
  Split Number(x=w10) -> (high(x)=w12, low(x)=w13)
  Split Number(x=w11) -> (high(x)=w14, low(x)=w15)
  Build Array($"PDU index", w8, w9, w12, w13, w14, w15, w7) -> w16
  Build Array(w4, w16) -> w17
  $"encoded sub message" <- w17
