vi "Encode PHY SAP Timing Indication.gvi"   [LabVIEW NXG 4.0.0]
# Creates a PHY TIMING IND API message.
inputs:
  "reference ID": u16
  "SFN": u16
  "TTI index": u8
  "error in": error
outputs:
  "encoded PHY SAP Timing Indication": u8[]
  "error out": error
types:
  "SAP Sub Header.gtype" = cluster{"SFN": u16, "TTI index": u8, "number of submessages": u8, "confirmation mode": u8, "Reserved": u32}
  "Message Type ID Defined.gtype" = u16
  "General Message Header.gtype" = cluster{"message type ID": "Message Type ID Defined.gtype", "reference ID": u16, "instance ID": u8}
uses:
  AFW::LTE::L1L2 API::Encode SAP Sub Header.gvi
  AFW::LTE::L1L2 API::Encode General Message Header.gvi
diagram:
  w1 = 0  # confirmation mode
  w2 = 0  # number of submessages
  w3 = 0  # Reserved
  Property Node(instance in="SAP Sub Header.gtype" {all zero or empty}, "SFN"=$SFN, "TTI index"=$"TTI index", "confirmation mode"=w1, "number of submessages"=w2, "Reserved"=w3) -> (instance out=w4)
  call "Encode SAP Sub Header.gvi"(SAP sub header=w4) -> (encoded SAP sub header=w5)
  w6 = 0  # instance ID
  Property Node(instance in="General Message Header.gtype" {all zero or empty}, "message type ID"="PHY_TIMING_IND"(16385), "instance ID"=w6, "reference ID"=$"reference ID") -> (instance out=w7)
  Array Size(array=w5) -> (size(s)=w8)
  To Unsigned 32 Bit Integer(number=w8) -> w9
  call "Encode General Message Header.gvi"(general message header=w7, message body length=w9) -> (encoded general message header=w10)
  Build Array(w10, w5) -> w11
  $"encoded PHY SAP Timing Indication" <- w11
  $"error out" <- $"error in"
