vi "Encode PHY SAP UL TX Payload Request.gvi"   [LabVIEW NXG 4.0.0]
inputs:
  "reference ID": u16
  "SFN": u16
  "TTI index": u8
  "MAC PDU": u8[]
  "MAC PDU Size": u32 = 8
  "MAC PDU index": u8 = 8
outputs:
  "encoded DL TX Config Request": u8[]
  "message body length": u32
  "message header": "General Message Header.gtype"
  "SAP sub header": "SAP Sub Header.gtype"
types:
  "Message Type ID Defined.gtype" = u16
  "General Message Header.gtype" = cluster{"message type ID": "Message Type ID Defined.gtype", "reference ID": u16, "instance ID": u8}
  "SAP Sub Header.gtype" = cluster{"SFN": u16, "TTI index": u8, "number of submessages": u8, "confirmation mode": u8, "Reserved": u32}
uses:
  AFW::LTE::L1L2 API::Encode SAP Sub Header.gvi
  AFW::LTE::L1L2 API::Encode Sub Message Header.gvi
  AFW::LTE::L1L2 API::Encode General Message Header.gvi
diagram:
  w1 = 1  # confirmation mode
  w2 = 0  # Reserved
  Property Node(instance in="SAP Sub Header.gtype" {all zero or empty}, "SFN"=$SFN, "TTI index"=$"TTI index", "confirmation mode"=w1, "number of submessages"=1, "Reserved"=w2) -> (instance out=w3)
  $"SAP sub header" <- w3
  w4 = 0  # instance ID
  Property Node(instance in="General Message Header.gtype" {all zero or empty}, "message type ID"="PHY_UL_TX_PAYLOAD_REQ"(18690), "instance ID"=w4, "reference ID"=$"reference ID") -> (instance out=w5)
  $"message header" <- w5
  call "Encode SAP Sub Header.gvi"(SAP sub header=w3) -> (encoded SAP sub header=w6)
  w7 = 4  # sub message body length
  Add(w7, $"MAC PDU Size") -> w8
  call "Encode Sub Message Header.gvi"(sub message type=0, sub message body length=w8) -> (encoded sub message header=w9)
  Split Number(x=$"MAC PDU Size") -> (high(x)=w10, low(x)=w11)
  Split Number(x=w10) -> w12
  Split Number(x=w11) -> (high(x)=w13, low(x)=w14)
  Build Array(w9, $"MAC PDU index", w12, w13, w14, $"MAC PDU") -> w15
  Build Array(w6, w15) -> w16
  Array Size(array=w16) -> (size(s)=w17)
  To Unsigned 32 Bit Integer(number=w17) -> w18
  call "Encode General Message Header.gvi"(general message header=w5, message body length=w18) -> (encoded general message header=w19)
  Build Array(w19, w16) -> w20
  $"encoded DL TX Config Request" <- w20
  $"message body length" <- w18
