vi "Encode SAP Sub Header.gvi"   [LabVIEW NXG 4.0.0]
# Builds an 1D array of U8 (byte) with the SAP Sub Header cluster and a reserved field.
inputs:
  "SAP sub header": "SAP Sub Header.gtype"
outputs:
  "encoded SAP sub header": u8[]  # SAP Sub Header in 1D array of U8.
types:
  "SAP Sub Header.gtype" = cluster{"SFN": u16, "TTI index": u8, "number of submessages": u8, "confirmation mode": u8, "Reserved": u32}
diagram:
  Property Node(instance in=$"SAP sub header") -> ("SFN"=w1, "TTI index"=w2, "number of submessages"=w3, "confirmation mode"=w4, "Reserved"=w5)
  Split Number(x=w1) -> (high(x)=w6, low(x)=w7)
  Split Number(x=w5) -> (high(x)=w8, low(x)=w9)
  Split Number(x=w8) -> w10
  Split Number(x=w9) -> (high(x)=w11, low(x)=w12)
  Build Array(w6, w7, w2, w3, w4, w10, w11, w12) -> w13
  $"encoded SAP sub header" <- w13
