vi "Encode Sub Message Header.gvi"   [LabVIEW NXG 4.0.0]
# Builds an 1D array of U8 (byte) with the General Message Header cluster and the message body length.
inputs:
  "sub message type": u8
  "sub message body length": u32  # Message body length in U32 (only U24 is effective).
outputs:
  "encoded sub message header": u8[]  # General message header and sub-message header parameters in 1D array of U8.
diagram:
  # parameter set id (version id)
  Split Number(x=$"sub message body length") -> (high(x)=w1, low(x)=w2)
  Split Number(x=w1) -> w3
  Split Number(x=w2) -> (high(x)=w4, low(x)=w5)
  Build Array(w3, w4, w5) -> w6
  Build Array($"sub message type", 100, w6) -> w7
  $"encoded sub message header" <- w7
