vi "Handle DL TX Confirm.gvi"   [LabVIEW NXG 4.0.0]
inputs:
  "RT FIFO reference": RTFifoRefnum<"Request Information.gtype">
  "api transport in": u8[]
  "error in": error
  "clear confirmation errors": bool
outputs:
  "error out": error
  "confirm received counts": T1
  "confirmation evaluation error count": u32
  "negative confirm received count": u64
types:
  "Request Information.gtype" = cluster{"message header": "General Message Header.gtype", "SAP sub header": "SAP Sub Header.gtype"}
  "Confirmation States.gtype" = enum{"Success", "Unknown Message", "Message not Supported", "Unknown Parameter (Set)", "Missing Parameter (Set)", "Parameter (Set) Repetition", "Range Violation", "State Violation", "Timeout", "Config Payload Mismatch", "Length Mismatch", "Input Buffer Full", "Internal Error", "Instance ID Mismatch"}
  T1 = cluster{"Element 1": "Confirmation States.gtype"[], "Value": u64[]}
  "Message Type ID Defined.gtype" = u16
uses:
  AFW::LTE::L1L2 API::PHY Receive PHY Confirm.gvi
  NI::G Core::Error::Clear Error Cluster.gvi
  AFW::LTE::MAC::MAC Dequeue Requests.gvi
  AFW::LTE::L1L2 API::Check DL TX Confirm Count.gvi
  NI::G Core::Error::Read Error Code.gvi
diagram:
  # one confirm expected
  call "PHY Receive PHY Confirm.gvi"(api transport in=$"api transport in", error in=$"error in") -> (Confirm Status=w1, error out=w2)
  case ($"clear confirmation errors") {
    frame False, Default {
      w3 = w2
    }
    frame True {
      call "Clear Error Cluster.gvi"(error in=w2) -> (error out=w3)
    }
  }
  s1 = w3  # shift register
  for {
    w4 = each element of w1
    call "MAC Dequeue Requests.gvi"(RT FIFO reference in=$"RT FIFO reference", error in=s1) -> (requests=w6, error out=w7)
    Property Node(instance in=w6) -> ("message header"=w8, "SAP sub header"=w9)
    Build Array(w4) -> w10
    Property Node(instance in=w4) -> ("Source Message Type ID"=w11)
    w12 = "Message Type ID Defined.gtype" "PHY_DL_TX_PAYLOAD_REQ"(17666)
    Type Cast(type=w12, x=w11) -> w13
    call "Check DL TX Confirm Count.gvi"(Confirm Status=w10, message header=w8, SAP sub header=w9, error in=w7, message select=w13) -> (error out=w14)
    case ($"clear confirmation errors") {
      frame False, Default {
        w15 = w14
      }
      frame True {
        call "Clear Error Cluster.gvi"(error in=w14) -> (error out=w15)
      }
    }
    call "Read Error Code.gvi"(error in=w14) -> (code=w16)
    Is Not Equal To 0(x=w16) -> w17
    Boolean To 0 Or 1(Boolean=w17) -> (0, 1=w18)
    append w18 to w5 if w17
    next s1 = w15
  }
  $"error out" <- s1
  Add Array Elements(numeric array=w5) -> (sum=w19)
  To Unsigned 32 Bit Integer(number=w19) -> w20
  Feedback Node(initial value=0, input=w21) -> w22
  Add(w20, w22) -> w21
  $"confirmation evaluation error count" <- w21
  call "Read Error Code.gvi"(error in=w2) -> (code=w23)
  w24 = ["Success", "Unknown Message", "Message not Supported", "Unknown Parameter (Set)", "Missing Parameter (Set)", "Parameter (Set) Repetition", "Range Violation", "State Violation", "Timeout", "Config Payload Mismatch", "Length Mismatch", "Input Buffer Full", "Internal Error", "Instance ID Mismatch"]
  Array Size(array=w24) -> (size(s)=w25)
  Initialize Array(element=0, size=w25) -> w26
  Feedback Node(initial value=w26, input=w27) -> w28
  case (TRUE) {
    frame False, Default {
      w27 = w28
    }
    frame True {
      Array Index(array=w28) -> (out0[w23]=w29)
      Increment(x=w29) -> w30
      To Signed 32 Bit Integer(number=w23) -> w31
      Replace Array Subset(inArray=w28, index=w31, new=w30) -> w27
    }
  }
  Split 1D Array(array=w27, index=1) -> (second subarray=w32)
  Add Array Elements(numeric array=w32) -> (sum=w33)
  $"negative confirm received count" <- w33
  Property Node(instance in=T1 {all zero or empty}, "Element 1"=w24, "Value"=w27) -> (instance out=w34)
  $"confirm received counts" <- w34
