vi "Map Message Location Field.gvi"   [LabVIEW NXG 4.0.0]
inputs:
  "Device Location": "Device Location.gtype" = "UE"
outputs:
  "Message Location Field": "Message Header Location.gtype"
types:
  "Message Header Location.gtype" = enum{"Common", "eNB", "UE", "Reserved"}
  "Device Location.gtype" = enum{"eNB", "UE"}
diagram:
  Type Cast(type=u8 1, x=$"Device Location") -> w1
  Increment(x=w1) -> w2
  Type Cast(type="Message Header Location.gtype" "Common", x=w2) -> w3
  $"Message Location Field" <- w3
