vi "PHY Generate RX Indication.gvi"   [LabVIEW NXG 4.0.0]
inputs:
  "MAC RX Indication Config": "MAC RX Config.gtype"
  "MAC PDU Size": u32 = 8
  "MAC PDU": u8[]
  "Device Location": "Device Location.gtype" = "eNB"
outputs:
  "api transport out": u8[]
types:
  "MAC RX Config.gtype" = cluster{"SFN": u16, "TTI Index": u8, "RNTI": u16, "CRC Result": u8}
  "Device Location.gtype" = enum{"eNB", "UE"}
uses:
  AFW::LTE::L1L2 API::Encode PHY SAP DL RX Indication.gvi
  AFW::LTE::L1L2 API::Encode PHY SAP UL RX Indication.gvi
diagram:
  Property Node(instance in=$"MAC RX Indication Config") -> ("SFN"=w1, "TTI Index"=w2, "RNTI"=w3, "CRC Result"=w4)
  # reference ID generator
  Feedback Node(initial value=0, input=w5) -> w6
  Increment(x=w6) -> w5
  case ($"Device Location") {
    frame "UE", Default {
      call "Encode PHY SAP DL RX Indication.gvi"(reference ID=w5, SFN=w1, TTI index=w2, MAC PDU=$"MAC PDU", MAC PDU Size=$"MAC PDU Size", RNTI=w3, CRC Result=w4) -> (encoded UL RX Indication=w7)
    }
    frame "eNB" {
      call "Encode PHY SAP UL RX Indication.gvi"(reference ID=w5, SFN=w1, TTI index=w2, MAC PDU=$"MAC PDU", MAC PDU Size=$"MAC PDU Size", RNTI=w3, CRC Result=w4) -> (encoded UL RX Indication=w7)
    }
  }
  $"api transport out" <- w7
