vi "PHY Receive PHY Confirm.gvi"   [LabVIEW NXG 4.0.0]
inputs:
  "api transport in": u8[]
  "error in": error
outputs:
  "Confirm Status": "Message Confirm Check Parameter.gtype"[]
  "error out": error
panel indicators:
  "loop iteration": i32
types:
  "Message Confirm Check Parameter.gtype" = cluster{"Config Active": bool, "reference ID": u16, "Source Message Type ID": u16, "Confirmation Mode": u8, "Confirmation Status": u8}
uses:
  AFW::LTE::L1L2 API::Decode Message Header.gvi
  NI::G Core::Error::Build Error Cluster.gvi
  AFW::LTE::L1L2 API::Decode Sub Message Header.gvi
  AFW::LTE::L1L2 API::Check DL TX Confirm Messages.gvi
diagram:
  s1 = $"api transport in"  # shift register
  s2 = $"error in"  # shift register
  while (iteration -> i1) {
    Array Size(array=s1) -> (size(s)=w2)
    Is Equal To 0(x=w2) -> w3
    case (w3) {
      frame True {
        w4 = s1
        w5 = "Message Confirm Check Parameter.gtype" {all zero or empty}
        w6 = s2
      }
      frame False {
        w7 = 0  # expected max number of submessages
        call "Decode Message Header.gvi"(data in=s1, expected number of submessages=w7, expected message header type="Confirm", error in=s2) -> (remaining data=w4, general message header=w8, SAP sub header=w9, sub message data=w10, error out=w11)
        Property Node(instance in=w8) -> ("message type ID"=w12, "reference ID"=w13)
        Is Equal(x="PHY_CNF"(16898), y=w12) -> w14
        case (w14) {
          frame False, Default {
            w15 = "Message not Supported"  # LTE Confirmation States
            Type Cast(type=u8 0, x=w15) -> w16
            To Signed 32 Bit Integer(number=w16) -> w17
            call "Build Error Cluster.gvi"(code=w17, description="Unsupported eNB message ID", error in=w11) -> (error out=w6)
            w5 = default
          }
          frame True {
            Property Node(instance in=w9) -> ("confirmation mode"=w18)
            call "Decode Sub Message Header.gvi"(submessage data in=w10) -> (submessage body out=w19)
            Array Index(array=w19) -> (out0[_]=w20, out1[_]=w21, out2[_]=w22)
            Join Numbers(high(x)=w21, low(x)=w22) -> w23
            Property Node(instance in="Message Confirm Check Parameter.gtype" {all zero or empty}, "Config Active"=TRUE, "reference ID"=w13, "Source Message Type ID"=w23, "Confirmation Mode"=w18, "Confirmation Status"=w20) -> (instance out=w5)
            w6 = w11
          }
        }
      }
    }
    Array Size(array=w4) -> (size(s)=w24)
    Is Equal To 0(x=w24) -> w25
    call "Check DL TX Confirm Messages.gvi"(Confirm Status=w5, error in=w6) -> (error out=w26)
    $"loop iteration" <- i1
    append w5 to w1
    next s1 = w4
    next s2 = w26
    stop if w25
  }
  $"Confirm Status" <- w1
  $"error out" <- s2
