vi "PHY Receive RX Indication.gvi"   [LabVIEW NXG 4.0.0]
# Decodes data from API transport in as PHY RX Indication.
# On success the indicators contains the received MAC PDU as well as the MAC RX Config for this MAC PDU.
inputs:
  "api transport in": u8[]
  "expected device location": "Device Location.gtype" = "eNB"  # Decode API transport in as UL RX Indication for eNB and DL RX Indication for UE.
  "error in": error
outputs:
  "MAC RX Config": "MAC RX Config.gtype"
  "MAC PDU": u8[]  # Decoded MAC PDU.
  "error out": error
types:
  "MAC RX Config.gtype" = cluster{"SFN": u16, "TTI Index": u8, "RNTI": u16, "CRC Result": u8}
  "Device Location.gtype" = enum{"eNB", "UE"}
uses:
  AFW::LTE::L1L2 API::Decode Message Header.gvi
  AFW::LTE::L1L2 API::Decode Message ID.gvi
  AFW::LTE::L1L2 API::Map Message Location Field.gvi
  AFW::LTE::L1L2 API::Check Message ID Location Field.gvi
  NI::G Core::Error::Build Error Cluster.gvi
  AFW::LTE::L1L2 API::Decode PHY SAP UL RX Indication.gvi
  AFW::LTE::L1L2 API::Decode PHY SAP DL RX Indication.gvi
diagram:
  # Rx Indication Handler for eNB and UE
  s1 = $"api transport in"  # shift register
  while {
    w1 = 1  # expected max number of submessages
    call "Decode Message Header.gvi"(data in=s1, expected number of submessages=w1, expected message header type="Indication", error in=$"error in") -> (remaining data=w2, general message header=w3, SAP sub header=w4, sub message data=w5, error out=w6)
    Property Node(instance in=w4) -> ("number of submessages"=w7, "SFN"=w8, "TTI index"=w9)
    call "Decode Message ID.gvi"(received message type ID=w3) -> (LTE message type ID out=w10)
    Property Node(instance in=w10) -> ("Location Field"=w11, "Message ID"=w12)
    call "Map Message Location Field.gvi"(Device Location=$"expected device location") -> (Message Location Field=w13)
    call "Check Message ID Location Field.gvi"(Received Location Field=w11, Expected Location Field=w13, error in=w6) -> (error out=w14)
    case (w11) {
      frame "eNB" {
        case (w12) {
          frame 0, Default {
            w19 = "Message not Supported"  # LTE Confirmation States
            Type Cast(type=u8 0, x=w19) -> w20
            To Signed 32 Bit Integer(number=w20) -> w21
            call "Build Error Cluster.gvi"(code=w21, description="Unsupported eNB message ID", error in=w14) -> (error out=w15)
            w17 = default
            w18 = default
            w16 = default
          }
          frame 1 {
            call "Decode PHY SAP UL RX Indication.gvi"(sub message=w5, number of submessages=w7, error in=w14) -> (CRC Result=w17, MAC PDU=w16, error out=w15, RNTI=w18)
          }
          frame 2 {
            w22 = "Unknown Message"  # LTE Confirmation States
            Type Cast(type=u8 0, x=w22) -> w23
            To Signed 32 Bit Integer(number=w23) -> w24
            call "Build Error Cluster.gvi"(code=w24, description="Unknown eNB message ID", error in=w14) -> (error out=w15)
            w17 = default
            w18 = default
            w16 = default
          }
        }
      }
      frame "UE" {
        case (w12) {
          frame 0, Default {
            w25 = "Message not Supported"  # LTE Confirmation States
            Type Cast(type=u8 0, x=w25) -> w26
            To Signed 32 Bit Integer(number=w26) -> w27
            call "Build Error Cluster.gvi"(code=w27, description="Unsupported UE message ID", error in=w14) -> (error out=w15)
            w16 = default
            w17 = default
            w18 = default
          }
          frame 1 {
            call "Decode PHY SAP DL RX Indication.gvi"(sub message=w5, number of submessages=w7, error in=w14) -> (CRC Result=w17, MAC PDU=w16, error out=w15, RNTI=w18)
          }
          frame 2 {
            w28 = "Unknown Message"  # LTE Confirmation States
            Type Cast(type=u8 0, x=w28) -> w29
            To Signed 32 Bit Integer(number=w29) -> w30
            call "Build Error Cluster.gvi"(code=w30, description="Unknown UE message ID", error in=w14) -> (error out=w15)
            w16 = default
            w17 = default
            w18 = default
          }
        }
      }
      frame "Common", Default {
        w15 = w14
        w16 = default
        w17 = default
        w18 = default
      }
    }
    Array Size(array=w2) -> (size(s)=w31)
    Is Equal To 0(x=w31) -> w32
    next s1 = w2
    stop if w32
  }
  Property Node(instance in="MAC RX Config.gtype" {all zero or empty}, "CRC Result"=w17, "RNTI"=w18, "SFN"=w8, "TTI Index"=w9) -> (instance out=w33)
  $"MAC RX Config" <- w33
  $"MAC PDU" <- w16
  $"error out" <- w15
