vi "PHY Receive Timing Indication.gvi"   [LabVIEW NXG 4.0.0]
# Try to decode message given by API transport in as PHY Timing Indication. On success, the indicators contain all information from the PHY Timing Indication. The error out carries a descriptive error otherwise.
inputs:
  "api transport in": u8[]  # Encoded message.
  "error in": error
outputs:
  "SFN": u16  # SFN encoded in PHY Timing Indication.
  "TTI index": u8  # TTI encoded in PHY Timing Indication.
  "Timing Update": bool  # If true, Timing Indication carries a timing update.
  "error out": error
  "message body length": u32  # Length of message without header information.
  "general message header": "General Message Header.gtype"  # Contains base information about the decoded message.
types:
  "Message Type ID Defined.gtype" = u16
  "General Message Header.gtype" = cluster{"message type ID": "Message Type ID Defined.gtype", "reference ID": u16, "instance ID": u8}
uses:
  AFW::LTE::L1L2 API::Decode Message Header.gvi
  AFW::LTE::L1L2 API::Decode Message ID.gvi
  AFW::LTE::L1L2 API::Check Message ID Location Field.gvi
  NI::G Core::Error::Build Error Cluster.gvi
diagram:
  # TODO: add total lenght check for timing indication
  w1 = 0  # expected max number of submessages
  call "Decode Message Header.gvi"(data in=$"api transport in", expected number of submessages=w1, expected message header type="Indication", error in=$"error in") -> (general message header=w2, SAP sub header=w3, error out=w4, message body length=w5)
  $"message body length" <- w5
  $"general message header" <- w2
  call "Decode Message ID.gvi"(received message type ID=w2) -> (LTE message type ID out=w6)
  Property Node(instance in=w6) -> ("Location Field"=w7, "Message ID"=w8)
  call "Check Message ID Location Field.gvi"(Received Location Field=w7, Expected Location Field="Common", error in=w4) -> (pass=w9, error out=w10)
  Is Equal(x=1, y=w8) -> w11
  Logical And(w11, w9) -> w12
  $"Timing Update" <- w12
  case (w12) {
    frame False, Default {
      w16 = "Message not Supported"  # LTE Confirmation States
      Type Cast(type=u8 0, x=w16) -> w17
      To Signed 32 Bit Integer(number=w17) -> w18
      call "Build Error Cluster.gvi"(code=w18, description="Unsupported eNB message ID", error in=w10) -> (error out=w15)
      w13 = default
      w14 = default
    }
    frame True {
      Property Node(instance in=w3) -> ("SFN"=w13, "TTI index"=w14)
      w15 = w10
    }
  }
  $SFN <- w13
  $"TTI index" <- w14
  $"error out" <- w15
