vi "PHY TX Request Confirm Abstraction.gvi"   [LabVIEW NXG 4.0.0]
# Use MAC TX Config as well as MAC PDU to create TX Config and Payload requests for eNodeB or UE operation. The output are ready to send API messages as U8 array as well as request messages that can be kept for comparison against confirmation received for the request encoded in the API messages.
inputs:
  "MAC TX Config": "MAC TX Config.gtype"
  "MAC PDU Size": u32 = 8  # MAC TX config to be encoding in TX config request.
  "MAC PDU": u8[]  # MAC PDU to be encoded in PHY payload request.
  "Device Location": "Device Location.gtype" = "eNB"  # Defines whether the TX request should be generated for DL TX (eNodeB) or UL TX (UE).
  "error in": error
outputs:
  "api transport out": u8[]  # Encoded TX requests (configuration and payload) concatenated in a U8 array.
  "error out": error
  "requests": "Request Information.gtype"[]  # Requests to be used for comparisons against confirmation messages received for the encoded requests.
types:
  "MAC TX Config.gtype" = cluster{"SFN": u16, "TTI Index": u8, "RNTI": u16, "CCE Offset": u8, "PRB Allocation": u32, "MCS": u8}
  "Device Location.gtype" = enum{"eNB", "UE"}
  "Message Type ID Defined.gtype" = u16
  "General Message Header.gtype" = cluster{"message type ID": "Message Type ID Defined.gtype", "reference ID": u16, "instance ID": u8}
  "SAP Sub Header.gtype" = cluster{"SFN": u16, "TTI index": u8, "number of submessages": u8, "confirmation mode": u8, "Reserved": u32}
  "Request Information.gtype" = cluster{"message header": "General Message Header.gtype", "SAP sub header": "SAP Sub Header.gtype"}
  "Message DCI Config DL Grant Parameter.gtype" = cluster{"Config Active": bool, "RNTI": u16, "CCE Offset": u8, "PRB Allocation": u32, "MCS": u8, "TPC": u8}
  "Message DCI Config UL Grant Parameter.gtype" = cluster{"Config Active": bool, "RNTI": u16, "CCE Offset": u8, "PRB Allocation": u32, "MCS": u8, "TPC": u8}
uses:
  AFW::LTE::L1L2 API::Encode PHY SAP UL TX Payload Request.gvi
  AFW::LTE::L1L2 API::Encode PHY SAP DL TX Config Request.gvi
  AFW::LTE::L1L2 API::Encode PHY SAP DL TX Payload Request.gvi
diagram:
  Property Node(instance in=$"MAC TX Config") -> ("SFN"=w1, "TTI Index"=w2, "RNTI"=w3, "CCE Offset"=w4, "PRB Allocation"=w5, "MCS"=w6)
  # reference ID generator
  Feedback Node(initial value=0, input=w7) -> w8
  Increment(x=w8) -> w7
  w9 = "Message DCI Config DL Grant Parameter.gtype" {all zero or empty}
  Property Node(instance in=w9, "Config Active"=TRUE, "RNTI"=w3, "CCE Offset"=w4, "PRB Allocation"=w5, "MCS"=w6, "TPC"=0) -> (instance out=w10)
  w11 = "Message DCI Config UL Grant Parameter.gtype" {all zero or empty}
  Property Node(instance in=w11, "Config Active"=FALSE) -> (instance out=w12)
  # MAC PDU index generator
  Feedback Node(initial value=0, input=w13) -> w14
  Increment(x=w14) -> w13: u8
  case ($"Device Location") {
    frame "UE", Default {
      call "Encode PHY SAP UL TX Payload Request.gvi"(reference ID=w7, MAC PDU index=w13, MAC PDU Size=$"MAC PDU Size", MAC PDU=$"MAC PDU", SFN=w1, TTI index=w2) -> (encoded DL TX Config Request=w15, message header=w18, SAP sub header=w19)
      Property Node(instance in="Request Information.gtype" {all zero or empty}, "message header"=w18, "SAP sub header"=w19) -> (instance out=w20)
      Build Array(w20) -> w17
      w16 = $"error in"
    }
    frame "eNB" {
      call "Encode PHY SAP DL TX Config Request.gvi"(reference ID=w7, MAC PDU index=w13, downlink config parameter=w10, uplink config parameter=w12, SFN=w1, TTI index=w2) -> (encoded message=w21, message header=w22, SAP sub header=w23)
      call "Encode PHY SAP DL TX Payload Request.gvi"(reference ID=w7, MAC PDU index=w13, MAC PDU Size=$"MAC PDU Size", MAC PDU=$"MAC PDU", SFN=w1, TTI index=w2) -> (encoded message=w24, message header=w25, SAP sub header=w26)
      Build Array(w21, w24) -> w15
      Property Node(instance in="Request Information.gtype" {all zero or empty}, "message header"=w22, "SAP sub header"=w23) -> (instance out=w27)
      Property Node(instance in="Request Information.gtype" {all zero or empty}, "message header"=w25, "SAP sub header"=w26) -> (instance out=w28)
      Build Array(w27, w28) -> w17
      w16 = $"error in"
    }
  }
  $"api transport out" <- w15
  $requests <- w17
  $"error out" <- w16
