vi "PHY TX Request Confirm Handler.gvi"   [LabVIEW NXG 4.0.0]
# Processes PHY TX request messages.
# This routine decodes messages from API transport in and checks whether they are valid and matches the current SFN/TTI counter.
# On success output valid turn to True to signal that the indicators carry valid data.
inputs:
  "api transport in": u8[]  # TTI that should be decoded from TX config request.
  "Expected SFN": u16
  "Expected TTI index": u8
  "Expected Device Location": "Device Location.gtype" = "eNB"  # Context this VI is called in.
  "error in": error
  "frame structure": enum{"FDD", "TDD 5 5"} = "FDD"  # Current frame structure.
  "use UERS": bool  # Current UERS configuration.
  "UE TX DCI": "DCI Message.gtype" = {"Active"=TRUE, "MCS"="MCS 0 (QPSK, rate ~0.12)", "Resource Block Allocation (4 PRB/bit)"=29360128}
  "TX request too late": bool  # System detected late TX request. Send timeout message as respond.
outputs:
  "TX UE Context": T1  # UE context decoded from TX config request.
  "TX DCI": "DCI Message.gtype"
  "TX Data": u8[]  # Payload decoded from TX payload request.
  "error out": error
  "api transport out": u8[]  # Confirmations messages encoded as response to received TX requests.
  "output valid": bool  # Indicators carry valid data.
types:
  T1 = cluster{"RNTI": u16, "Use UERS": bool, "Antenna Port": UFXP(4.0), "CCE Offset": u8}
  "Device Location.gtype" = enum{"eNB", "UE"}
  T2 = enum{"MCS 0 (QPSK, rate ~0.12)", "MCS 1 (QPSK, rate ~0.15)", "MCS 2 (QPSK, rate ~0.19)", "MCS 3 (QPSK, rate ~0.25)", "MCS 4 (QPSK, rate ~0.30)", "MCS 5 (QPSK, rate ~0.37)", "MCS 6 (QPSK, rate ~0.44)", "MCS 7 (QPSK, rate ~0.51)", "MCS 8 (QPSK, rate ~0.59)", "MCS 9 (QPSK, rate ~0.66)", "MCS 10 (16-QAM, rate ~0.33)", "MCS 11 (16-QAM, rate ~0.37)", "MCS 12 (16-QAM, rate ~0.42)", "MCS 13 (16-QAM, rate ~0.48)", "MCS 14 (16-QAM, rate ~0.54)", "MCS 15 (16-QAM, rate ~0.60)", "MCS 16 (16-QAM, rate ~0.64)", "MCS 17 (64-QAM, rate ~0.43)", "MCS 18 (64-QAM, rate ~0.46)", "MCS 19 (64-QAM, rate ~0.50)", "MCS 20 (64-QAM, rate ~0.55)", "MCS 21 (64-QAM, rate ~0.60)", "MCS 22 (64-QAM, rate ~0.65)", "MCS 23 (64-QAM, rate ~0.70)", "MCS 24 (64-QAM, rate ~0.75)", "MCS 25 (64-QAM, rate ~0.80)", "MCS 26 (64-QAM, rate ~0.85)", "MCS 27 (64-QAM, rate ~0.89)", "MCS 28 (64-QAM, rate ~0.93)"}
  "DCI Message.gtype" = cluster{"Active": bool, "MCS": T2, "Resource Block Allocation (4 PRB/bit)": UFXP(25.0)}
  "UERS Check Pararmeter.gtype" = cluster{"use UERS": bool, "subframe index": u8, "frame structure": enum{"FDD", "TDD 5 5"}}
  "Message ULSCH Config Parameter.gtype" = cluster{"Config Active": bool, "MAC PDU Index": u8, "RNTI": u16, "PRB Allocation": u32, "MCS": u8}
  "Message DL TX Type ID.gtype" = enum{"COMMON", "DL_TX_CONFIG_REQ", "DL_TX_PAYLOAD_REQ", "UNKNOWN"}
  "Message DLSCH Config Parameter.gtype" = cluster{"Config Active": bool, "MAC PDU Index": u8, "RNTI": u16, "PRB Allocation": u32, "MCS": u8}
  "Message DCI Config DL Grant Parameter.gtype" = cluster{"Config Active": bool, "RNTI": u16, "CCE Offset": u8, "PRB Allocation": u32, "MCS": u8, "TPC": u8}
  "Message UL TX Type ID.gtype" = enum{"COMMON", "UL_TX_CONFIG_REQ", "UL_TX_PAYLOAD_REQ", "UNKNOWN"}
uses:
  AFW::LTE::L1L2 API::Decode Message Header.gvi
  AFW::LTE::L1L2 API::Decode Message ID.gvi
  AFW::LTE::L1L2 API::Map Message Location Field.gvi
  AFW::LTE::L1L2 API::Check SFN TTI Index.gvi
  AFW::LTE::L1L2 API::Check Message ID Location Field.gvi
  NI::G Core::Error::Build Error Cluster.gvi
  AFW::LTE::L1L2 API::Decode PHY SAP DL TX Config Request.gvi
  AFW::LTE::L1L2 API::Decode PHY SAP DL TX Payload Request.gvi
  AFW::LTE::L1L2 API::Decode PHY SAP UL TX Payload Request.gvi
  AFW::LTE::Conversion::Check Subframe for Transmit.gvi
  NI::G Core::Error::Is Error.gvi
  AFW::LTE::L1L2 API::Encode PHY SAP Confirm Message.gvi
  AFW::LTE::L1L2 API::Decode PHY SAP Map Config.gvi
diagram:
  case ($"error in") {
    frame Error {
      w1 = $"error in"
      w2 = default
      w3 = default
      w4 = default
      w5 = default
      w6 = default
    }
    frame No Error {
      # Tx Request Handler for eNB and UE
      s1 = uninitialised  # shift register
      s2 = uninitialised  # shift register
      s3 = $"api transport in"  # shift register
      s4 = $"error in"  # shift register
      while {
        w9 = 3  # expected max number of submessages
        call "Decode Message Header.gvi"(data in=s3, expected number of submessages=w9, expected message header type="Request", error in=s4) -> (remaining data=w10, general message header=w11, SAP sub header=w12, sub message data=w13, error out=w14)
        Array Size(array=w10) -> (size(s)=w15)
        Is Equal To 0(x=w15) -> w16
        Property Node(instance in=w12) -> ("number of submessages"=w17, "SFN"=w18, "TTI index"=w19)
        call "Decode Message ID.gvi"(received message type ID=w11) -> (LTE message type ID out=w20)
        Property Node(instance in=w20) -> ("Location Field"=w21, "Message ID"=w22)
        w23 = "UERS Check Pararmeter.gtype" {"use UERS"=FALSE, "subframe index"=0, "frame structure"="TDD 5 5"}
        Property Node(instance in=w23, "subframe index"=w19, "frame structure"=$"frame structure", "use UERS"=$"use UERS") -> (instance out=w24)
        call "Map Message Location Field.gvi"(Device Location=$"Expected Device Location") -> (Message Location Field=w25)
        call "Check SFN TTI Index.gvi"(Expected SFN=$"Expected SFN", Received SFN=w18, Expected TTI index=$"Expected TTI index", Received TTI index=w19, error in=w14) -> (error out=w26)
        call "Check Message ID Location Field.gvi"(Received Location Field=w21, Expected Location Field=w25, error in=w26) -> (error out=w27)
        Property Node(instance in=$"UE TX DCI") -> ("Resource Block Allocation (4 PRB/bit)"=w28, "MCS"=w29)
        To Unsigned 32 Bit Integer(number=w28) -> w30
        Type Cast(type=u16 0, x=w29) -> w31
        To Unsigned 8 Bit Integer(number=w31) -> w32
        Property Node(instance in="Message ULSCH Config Parameter.gtype" {all zero or empty}, "PRB Allocation"=w30, "MCS"=w32) -> (instance out=w33)
        case (w21) {
          frame "eNB" {
            w40 = "Message DL TX Type ID.gtype" "COMMON"  # LTE Message DL TX Type ID
            Type Cast(type=w40, x=w22) -> w41
            case (w41) {
              frame "COMMON" {
                w42 = "Message not Supported"  # LTE Confirmation States
                Type Cast(type=u8 0, x=w42) -> w43
                To Signed 32 Bit Integer(number=w43) -> w44
                call "Build Error Cluster.gvi"(code=w44, description="Unsupported eNB message ID", error in=w27) -> (error out=w34)
                w35 = s2
                w4 = default
                w36 = default
                w37 = default
                w38 = default
                w39 = s1
              }
              frame "DL_TX_CONFIG_REQ" {
                Property Node(instance in=s2) -> ("Config Active"=w45)
                # To start the Tx PHY first a downlink request message is expected
                case (w45) {
                  frame True {
                    w46 = "No DL TX Payload Request message received before Config Request"
                    w47 = "State Violation"  # LTE Confirmation States
                    Type Cast(type=u8 0, x=w47) -> w48
                    To Signed 32 Bit Integer(number=w48) -> w49
                    call "Build Error Cluster.gvi"(code=w49, description=w46, error in=w27) -> (error out=w34)
                    w35 = default
                    w39 = default
                  }
                  frame False {
                    call "Decode PHY SAP DL TX Config Request.gvi"(check parameter=w24, number of submessages=w17, sub message=w13, error in=w27) -> (downlink grant parameter=w39, dlsch parameter=w35, error out=w34)
                  }
                }
                w4 = u8[] []
                w36 = FALSE
                w37 = default
                w38 = default
              }
              frame "DL_TX_PAYLOAD_REQ" {
                Property Node(instance in=s2) -> ("Config Active"=w50)
                # After a downlink request message is received a payload request message is expected linked through MAC PDU index
                case (w50) {
                  frame False, Default {
                    w51 = "State Violation"  # LTE Confirmation States
                    Type Cast(type=u8 0, x=w51) -> w52
                    To Signed 32 Bit Integer(number=w52) -> w53
                    call "Build Error Cluster.gvi"(code=w53, description="No TX DL Config Request message received", error in=w27) -> (error out=w34)
                    w4 = u8[] []
                    w36 = FALSE
                    w38 = default
                    w37 = default
                  }
                  frame True {
                    call "Decode PHY SAP DL TX Payload Request.gvi"(dlsch parameter=s2, uers check parameter=w24, number of submessages=w17, sub message=w13, error in=w27) -> (MAC PDU Index=w54, MAC PDU=w55, error out=w56)
                    Property Node(instance in=s2) -> ("MAC PDU Index"=w57)
                    Is Equal(x=w54, y=w57) -> w58
                    case (w58) {
                      frame True {
                        w34 = w56
                        w36 = TRUE
                        w4 = w55
                        w38 = s2
                        w37 = s1
                      }
                      frame False {
                        w59 = "Config Payload Mismatch"  # LTE Confirmation States
                        Type Cast(type=u8 0, x=w59) -> w60
                        To Signed 32 Bit Integer(number=w60) -> w61
                        call "Build Error Cluster.gvi"(code=w61, description="DL TX MAC PDU Index mismatch ", error in=w56) -> (error out=w34)
                        w36 = FALSE
                        w4 = u8[] []
                        w38 = default
                        w37 = default
                      }
                    }
                  }
                }
                w62 = "Message DLSCH Config Parameter.gtype" {all zero or empty}  # LTE Message DLSCH Config Parameter
                w63 = "Message DCI Config DL Grant Parameter.gtype" {all zero or empty}  # LTE Message DCI Config DL Grant Parameter
                w35 = w62
                w39 = w63
              }
              frame "UNKNOWN", Default {
                w64 = "Unknown Message"  # LTE Confirmation States
                Type Cast(type=u8 0, x=w64) -> w65
                To Signed 32 Bit Integer(number=w65) -> w66
                call "Build Error Cluster.gvi"(code=w66, description="Unknown eNB message ID", error in=w27) -> (error out=w34)
                w35 = default
                w4 = default
                w36 = default
                w37 = default
                w38 = default
                w39 = default
              }
            }
          }
          frame "UE" {
            w67 = "Message UL TX Type ID.gtype" "COMMON"  # LTE Message UL TX Type ID
            Type Cast(type=w67, x=w22) -> w68
            case (w68) {
              frame "COMMON", "UL_TX_CONFIG_REQ" {
                w69 = "Message not Supported"  # LTE Confirmation States
                Type Cast(type=u8 0, x=w69) -> w70
                To Signed 32 Bit Integer(number=w70) -> w71
                call "Build Error Cluster.gvi"(code=w71, description="Unsupported UE message ID", error in=w27) -> (error out=w34)
                w4 = default
                w36 = default
              }
              frame "UL_TX_PAYLOAD_REQ" {
                Property Node(instance in=w24) -> ("frame structure"=w72, "subframe index"=w73)
                call "Decode PHY SAP UL TX Payload Request.gvi"(ulsch parameter=w33, number of submessages=w17, sub message=w13, error in=w27) -> (MAC PDU=w4, error out=w74)
                call "Check Subframe for Transmit.gvi"(frame structure=w72, subframe index=w73, UL TX=TRUE, error in=w74) -> (allow UL transmit=w36, error out=w75)
                case (w36) {
                  frame True {
                    w34 = w75
                  }
                  frame False {
                    Format Into String(formatString="No UL transmit allowed in subframe (%d).", errIn=w75, w73) -> (outString=w76, errOut=w77)
                    w78 = "State Violation"  # LTE Confirmation States
                    Type Cast(type=u8 0, x=w78) -> w79
                    To Signed 32 Bit Integer(number=w79) -> w80
                    call "Build Error Cluster.gvi"(code=w80, description=w76, error in=w77) -> (error out=w34)
                  }
                }
              }
              frame "UNKNOWN", Default {
                w81 = "Unknown Message"  # LTE Confirmation States
                Type Cast(type=u8 0, x=w81) -> w82
                To Signed 32 Bit Integer(number=w82) -> w83
                call "Build Error Cluster.gvi"(code=w83, description="Unknown UE message ID", error in=w27) -> (error out=w34)
                w4 = default
                w36 = default
              }
            }
            w35 = default
            w37 = default
            w38 = default
            w39 = default
          }
          frame "Common", Default {
            w34 = w27
            w35 = default
            w4 = default
            w36 = default
            w37 = default
            w38 = default
            w39 = default
          }
        }
        case ($"TX request too late") {
          frame False, Default {
            w84 = w34
          }
          frame True {
            w85 = "Timeout"  # LTE Confirmation States
            Type Cast(type=u8 0, x=w85) -> w86
            To Signed 32 Bit Integer(number=w86) -> w87
            call "Build Error Cluster.gvi"(code=w87, description="DL TX request received too late.", error in=w34) -> (error out=w84)
          }
        }
        call "Is Error.gvi"(error in=w84) -> (error?=w88)
        Logical And(w36, not w88) -> w6
        call "Encode PHY SAP Confirm Message.gvi"(general message header=w11, SAP sub header=w12, error in=w84) -> (Confirm Message=w89, error out=w90)
        w7 = w38 if w6
        w8 = w37 if w6
        concatenate w89 onto w5
        next s1 = w39
        next s2 = w35
        next s3 = w10
        next s4 = w90
        stop if w16
      }
      call "Decode PHY SAP Map Config.gvi"(Use UERS=$"use UERS", dlsch parameter=w7, downlink grant parameter=w8) -> (eNB TX UE Context=w2, eNB TX DCI=w3)
      w1 = s4
    }
  }
  $"output valid" <- w6
  $"TX UE Context" <- w2
  $"TX DCI" <- w3
  $"TX Data" <- w4
  $"api transport out" <- w5
  $"error out" <- w1
