vi "Transport Add Header.gvi"   [LabVIEW NXG 4.0.0]
inputs:
  "api transport in": u8[]
outputs:
  "api transport out": u8[]
diagram:
  Array Size(array=$"api transport in") -> (size(s)=w1)
  Split Number(x=w1) -> (high(x)=w2, low(x)=w3)
  Split Number(x=w2) -> (high(x)=w4, low(x)=w5)
  Split Number(x=w3) -> (high(x)=w6, low(x)=w7)
  Build Array(w4, w5, w6, w7, $"api transport in") -> w8
  $"api transport out" <- w8
