vi "Transport Clean Up.gvi"   [LabVIEW NXG 4.0.0]
inputs:
  "LTE Transport Sessions": "Transport Session.gtype"[]
  "error in": error
  "MAC process ID": u32
  "MAC log file": string
outputs:
  "error out": error
types:
  "Pipe Reader.gtype" = cluster{"file name": string, "pipe file descriptor": i32, "timer file descriptor": i32, "epoll file descriptor": i32}
  "Pipe Writer.gtype" = cluster{"file name": string, "pipe file descriptor": i32}
  "Transport Session.gtype" = cluster{"FIFO pathname": string, "pipe reader": "Pipe Reader.gtype", "pipe writer": "Pipe Writer.gtype", "transport in RT FIFO": RTFifoRefnum<u8[]>, "transport out RT FIFO": RTFifoRefnum<u8[]>, "transport in timing source name": string, "transport in timing trigger ID": u8, "transport out timing source name": string, "transport out timing trigger ID": u8, "maximum API message size": u32}
uses:
  AFW::LTE::L1L2 API::Transport::Transport Delete.gvi
  NI::G Core::Libraries and Executables::System Exec.gvi
diagram:
  s1 = $"error in"  # shift register
  for {
    w1 = each element of $"LTE Transport Sessions"
    call "Transport Delete.gvi"(LTE transport session=w1, error in=s1) -> (error out=w2)
    next s1 = w2
  }
  disable {
    frame OS != "Linux", Default {
      w3 = no error
    }
    frame OS == "Linux" {
      Is Greater Than 0(x=$"MAC process ID") -> w4
      case (w4) {
        frame False, Default {
          w5 = no error
        }
        frame True {
          # Stop external MAC proces
          Format Into String(formatString="kill -9 %d", errIn=no error, $"MAC process ID") -> (outString=w6, errOut=w7)
          call "System Exec.gvi"(command line=w6, error in=w7) -> (error out=w5)
        }
      }
      # Remove log file
      Format Into String(formatString="rm %s", errIn=w5, $"MAC log file") -> (outString=w8, errOut=w9)
      call "System Exec.gvi"(command line=w8, error in=w9) -> (error out=w3)
    }
  }
  Merge Errors(w3, s1) -> (error out=w10)
  $"error out" <- w10
