vi "Transport Create Sessions.gvi"   [LabVIEW NXG 4.0.0]
inputs:
  "num pipes": i32
  "Error in": error
  "instance id": u8
outputs:
  "LTE Transport sessions": "Transport Session.gtype"[]
  "Error out": error
types:
  "Pipe Reader.gtype" = cluster{"file name": string, "pipe file descriptor": i32, "timer file descriptor": i32, "epoll file descriptor": i32}
  "Pipe Writer.gtype" = cluster{"file name": string, "pipe file descriptor": i32}
  "Transport Session.gtype" = cluster{"FIFO pathname": string, "pipe reader": "Pipe Reader.gtype", "pipe writer": "Pipe Writer.gtype", "transport in RT FIFO": RTFifoRefnum<u8[]>, "transport out RT FIFO": RTFifoRefnum<u8[]>, "transport in timing source name": string, "transport in timing trigger ID": u8, "transport out timing source name": string, "transport out timing trigger ID": u8, "maximum API message size": u32}
  T1 = cluster{"read mode": enum{"polling", "blocking"}, "write mode": enum{"polling", "blocking"}}
uses:
  AFW::LTE::L1L2 API::Transport::Transport Constants.gvi
  AFW::Common::Linux Pipes::Create FIFO.gvi
  NI::G Core::Timed Loop::Create Software-Triggered Timing Source.gvi
diagram:
  w1 = "Transport Session.gtype" {all zero or empty}  # LTE Transport Session
  # Create new (empty)
  # LTE Transport session
  s1 = $"Error in"  # shift register
  for (N = $"num pipes") (iteration -> i1) {
    # use running index to
    # enumerate the resources
    Format Into String(formatString="api_transport_%d-%d", errIn=s1, $"instance id", i1) -> (outString=w3, errOut=w4)
    # assemble path
    # for named pipe
    Concatenate Strings("/tmp/", w3, "_pipe") -> w5
    Property Node(instance in=w1, "FIFO pathname"=w5) -> (instance out=w6)
    call "Transport Constants.gvi"() -> (constants=w7)
    Property Node(instance in=w7) -> ("MAX_NIAPI_MSG_SIZE"=w8, "MAX_NUM_NIAPI_MSG_IN_BUFFER"=w9)
    # unlink()
    # mkfifo()
    call "Create FIFO.gvi"(pathname=w5, mode=436, error in=w4) -> (error out=w10)
    # assemble names for
    # "RT FIFO in/out"
    # and open the FIFOs
    Concatenate Strings(w3, "_rt_fifo_in") -> w11
    # open RT FIFOs in blocking
    # mode for both read and
    # write operations
    RTFIFO Create(elements in array=w8, error in=w10, name=w11, r/w modes=T1 {"read mode"="blocking", "write mode"="blocking"}, size=w9, type=u8[] []) -> (error out=w12, rt fifo=w13)
    Concatenate Strings(w3, "_rt_fifo_out") -> w14
    RTFIFO Create(elements in array=w8, error in=w12, name=w14, r/w modes=T1 {"read mode"="blocking", "write mode"="blocking"}, size=w9, type=u8[] []) -> (error out=w15, rt fifo=w16)
    Property Node(instance in=w6, "transport in RT FIFO"=w13, "maximum API message size"=w8, "transport out RT FIFO"=w16) -> (instance out=w17)
    Multiply(i1, 2) -> w18: u8
    # create unique timer IDs
    Increment(x=w18) -> w19
    # create timing
    # sources
    call "Create Software-Triggered Timing Source.gvi"(trigger ID=w19, error in=w15) -> (timing source name=w20, error out=w21)
    Increment(x=w19) -> w22
    call "Create Software-Triggered Timing Source.gvi"(trigger ID=w22, error in=w21) -> (timing source name=w23, error out=w24)
    Property Node(instance in=w17, "transport in timing trigger ID"=w19, "transport in timing source name"=w20, "transport out timing trigger ID"=w22, "transport out timing source name"=w23) -> (instance out=w25)
    append w25 to w2
    next s1 = w24
  }
  $"LTE Transport sessions" <- w2
  $"Error out" <- s1
