vi "Transport Create.gvi"   [LabVIEW NXG 4.0.0]
inputs:
  "transport instance ID": u8
  "error in": error
  "maximum API message size": u32 = 10240
  "open reader": bool = TRUE
  "open writer": bool = TRUE
outputs:
  "LTE transport session": "Transport Session.gtype"
  "error out": error
types:
  "Pipe Reader.gtype" = cluster{"file name": string, "pipe file descriptor": i32, "timer file descriptor": i32, "epoll file descriptor": i32}
  "Pipe Writer.gtype" = cluster{"file name": string, "pipe file descriptor": i32}
  "Transport Session.gtype" = cluster{"FIFO pathname": string, "pipe reader": "Pipe Reader.gtype", "pipe writer": "Pipe Writer.gtype", "transport in RT FIFO": RTFifoRefnum<u8[]>, "transport out RT FIFO": RTFifoRefnum<u8[]>, "transport in timing source name": string, "transport in timing trigger ID": u8, "transport out timing source name": string, "transport out timing trigger ID": u8, "maximum API message size": u32}
  T1 = cluster{"read mode": enum{"polling", "blocking"}, "write mode": enum{"polling", "blocking"}}
uses:
  AFW::Common::Linux Pipes::Create FIFO.gvi
  AFW::Common::Linux Pipes::Open Pipe Reader.gvi
  NI::G Core::Error::Filter Error Code.gvi
  AFW::Common::Check Stop.gvi
  NI::G Core::Error::Build Error Cluster.gvi
  AFW::Common::Linux Pipes::Open Pipe Writer.gvi
  NI::G Core::Timed Loop::Create Software-Triggered Timing Source.gvi
diagram:
  Format Into String(formatString="api_transport_%d", errIn=$"error in", $"transport instance ID") -> (outString=w1, errOut=w2)
  Concatenate Strings("/tmp/", w1, "_pipe") -> w3
  call "Create FIFO.gvi"(pathname=w3, mode=436, error in=w2) -> (error out=w4)
  w5 = 10  # number of API message elements
  # TODO: check values and put to constant VI
  Multiply($"maximum API message size", w5) -> w6
  To Signed 32 Bit Integer(number=w6) -> w7
  case ($"open reader") {
    frame False, Default {
      w10 = "Pipe Reader.gtype" {"file name"="NULL", "pipe file descriptor"=-1, "timer file descriptor"=-1, "epoll file descriptor"=-1}  # Pipe Reader
      w8 = w4
      w9 = w10
    }
    frame True {
      s1 = w4  # shift register
      while {
        Wait(time to wait=100)
        call "Open Pipe Reader.gvi"(file name=w3, pipe size=w7, error in=s1) -> (pipe reader=w11, new pipe size=w12, error out=w13)
        Is Less(x=w12, y=w7) -> w14
        Property Node(instance in=w11) -> ("pipe file descriptor"=w15, instance out=w9)
        Is Greater Or Equal To 0(x=w15) -> w16
        # No such device or address
        w17 = 6  # ENXIO
        call "Filter Error Code.gvi"(code to clear=w17, error in=w13) -> (error out=w18)
        call "Check Stop.gvi"(error in=w18) -> (error out=w19, stop=w20)
        Logical Or(w20, w16) -> w21
        next s1 = w19
        stop if w21
      }
      case (w14) {
        frame False, Default {
          w8 = s1
        }
        frame True {
          call "Build Error Cluster.gvi"(code=-1, description="PIPE too small", error in=s1) -> (error out=w8)
        }
      }
    }
  }
  case ($"open writer") {
    frame False, Default {
      w24 = "Pipe Writer.gtype" {"file name"="NULL", "pipe file descriptor"=-1}  # Pipe Writer
      w22 = w8
      w23 = w24
    }
    frame True {
      s2 = w8  # shift register
      while {
        Wait(time to wait=100)
        w25 = FALSE  # writer blocking
        call "Open Pipe Writer.gvi"(file name=w3, blocking=w25, error in=s2) -> (pipe writer=w26, error out=w27)
        Property Node(instance in=w26) -> ("pipe file descriptor"=w28, instance out=w23)
        Is Greater Or Equal To 0(x=w28) -> w29
        # No such device or address
        w30 = 6  # ENXIO
        call "Filter Error Code.gvi"(code to clear=w30, error in=w27) -> (error out=w31)
        call "Check Stop.gvi"(error in=w31) -> (error out=w32, stop=w33)
        Logical Or(w33, w29) -> w34
        next s2 = w32
        stop if w34
      }
      w22 = s2
    }
  }
  Concatenate Strings(w1, "_rt_fifo_in") -> w35
  w36 = u8[] []  # U8 array
  RTFIFO Create(elements in array=$"maximum API message size", error in=w22, name=w35, r/w modes=T1 {"read mode"="blocking", "write mode"="blocking"}, size=w5, type=w36) -> (error out=w37, rt fifo=w38)
  Concatenate Strings(w1, "_rt_fifo_out") -> w39
  RTFIFO Create(elements in array=$"maximum API message size", error in=w37, name=w39, r/w modes=T1 {"read mode"="blocking", "write mode"="blocking"}, size=w5, type=w36) -> (error out=w40, rt fifo=w41)
  Multiply($"transport instance ID", 10) -> w42
  Add(1, w42) -> w43
  Add(2, w42) -> w44
  call "Create Software-Triggered Timing Source.gvi"(trigger ID=w43, error in=w40) -> (timing source name=w45, error out=w46)
  call "Create Software-Triggered Timing Source.gvi"(trigger ID=w44, error in=w46) -> (timing source name=w47, error out=w48)
  Property Node(instance in="Transport Session.gtype" {all zero or empty}, "FIFO pathname"=w3, "pipe reader"=w9, "pipe writer"=w23, "transport in RT FIFO"=w38, "transport out RT FIFO"=w41, "transport in timing trigger ID"=w43, "transport in timing source name"=w45, "transport out timing trigger ID"=w44, "transport out timing source name"=w47, "maximum API message size"=$"maximum API message size") -> (instance out=w49)
  $"LTE transport session" <- w49
  $"error out" <- w48
