vi "Transport Delete.gvi"   [LabVIEW NXG 4.0.0]
inputs:
  "LTE transport session": "Transport Session.gtype"
  "error in": error
outputs:
  "error out": error
types:
  "Pipe Reader.gtype" = cluster{"file name": string, "pipe file descriptor": i32, "timer file descriptor": i32, "epoll file descriptor": i32}
  "Pipe Writer.gtype" = cluster{"file name": string, "pipe file descriptor": i32}
  "Transport Session.gtype" = cluster{"FIFO pathname": string, "pipe reader": "Pipe Reader.gtype", "pipe writer": "Pipe Writer.gtype", "transport in RT FIFO": RTFifoRefnum<u8[]>, "transport out RT FIFO": RTFifoRefnum<u8[]>, "transport in timing source name": string, "transport in timing trigger ID": u8, "transport out timing source name": string, "transport out timing trigger ID": u8, "maximum API message size": u32}
uses:
  NI::G Core::Timed Loop::Clear Timing Source.gvi
  AFW::Common::Linux Pipes::Close Pipe Writer.gvi
  AFW::Common::Linux Pipes::Close Pipe Reader.gvi
  AFW::Common::Linux Pipes::Delete FIFO.gvi
diagram:
  Property Node(instance in=$"LTE transport session") -> ("FIFO pathname"=w1, "pipe reader"=w2, "pipe writer"=w3, "transport out RT FIFO"=w4, "transport in RT FIFO"=w5, "transport in timing source name"=w6, "transport out timing source name"=w7)
  call "Clear Timing Source.gvi"(name=w7, error in=$"error in") -> (error out=w8)
  call "Clear Timing Source.gvi"(name=w6, error in=w8) -> (error out=w9)
  Merge Errors($"error in", w9) -> (error out=w10)
  RTFIFO Delete(error in=w10, rt fifo=w5) -> (error out=w11)
  RTFIFO Delete(error in=w11, rt fifo=w4) -> (error out=w12)
  Property Node(instance in=w3) -> ("file name"=w13, instance out=w14)
  case (w13) {
    frame "NULL" {
      w15 = w12
    }
    frame Default {
      call "Close Pipe Writer.gvi"(pipe writer=w14, error in=w12) -> (error out=w15)
    }
  }
  Property Node(instance in=w2) -> ("file name"=w16, instance out=w17)
  case (w16) {
    frame "NULL" {
      w18 = w15
    }
    frame Default {
      call "Close Pipe Reader.gvi"(pipe reader=w17, error in=w15) -> (error out=w18)
    }
  }
  call "Delete FIFO.gvi"(pathname=w1, error in=w18) -> (error out=w19)
  $"error out" <- w19
