vi "Transport Init.gvi"   [LabVIEW NXG 4.0.0]
inputs:
  "error in": error
  "MAC Stub enabled?": bool
  "command": string
  "arguments": string
  "instance id": u8
outputs:
  "Error out": error
  "LTE Transport Sessions": "Transport Session.gtype"[]
  "process ID": u32
  "log file": string
panel indicators:
  "done": bool
types:
  "Pipe Reader.gtype" = cluster{"file name": string, "pipe file descriptor": i32, "timer file descriptor": i32, "epoll file descriptor": i32}
  "Pipe Writer.gtype" = cluster{"file name": string, "pipe file descriptor": i32}
  "Transport Session.gtype" = cluster{"FIFO pathname": string, "pipe reader": "Pipe Reader.gtype", "pipe writer": "Pipe Writer.gtype", "transport in RT FIFO": RTFifoRefnum<u8[]>, "transport out RT FIFO": RTFifoRefnum<u8[]>, "transport in timing source name": string, "transport in timing trigger ID": u8, "transport out timing source name": string, "transport out timing trigger ID": u8, "maximum API message size": u32}
uses:
  AFW::LTE::L1L2 API::Transport::Transport Create Sessions.gvi
  AFW::LTE::L1L2 API::Transport::Transport Open Readers.gvi
  NI::G Core::Libraries and Executables::System Exec.gvi
  NI::G Core::Error::Build Error Cluster.gvi
  NI::G Core::Strings::Trim Whitespace.gvi
  AFW::LTE::L1L2 API::Transport::Transport Open Writers.gvi
  NI::G Core::Timed Loop::Stop Timed Structure.gvi
diagram:
  w1 = "Transport Number of Sessions"  # LTE Transport Session Index
  Type Cast(type=i32 0, x=w1) -> w2
  Initialize Array(element=FALSE, size=w2) -> w3
  case ($"MAC Stub enabled?") {
    frame True {
      w6 = [TRUE, TRUE, TRUE]  # enabled
      Replace Array Subset(inArray=w3, index=0, new=w6) -> w4
      w5 = w4
    }
    frame False {
      # Counterparts are opened
      # by external application.
      w7 = [FALSE, TRUE, FALSE]  # enabled
      Replace Array Subset(inArray=w3, index=0, new=w7) -> w4
      Not(x=w4) -> w5
    }
  }
  call "Transport Create Sessions.gvi"(num pipes=w2, instance id=$"instance id", Error in=$"error in") -> (LTE Transport sessions=w8, Error out=w9)
  call "Transport Open Readers.gvi"(LTE Transport sessions in=w8, readers enabled=w4, Error in=w9) -> (LTE Transport sessions out=w10, Error out=w11)
  # $"MAC Stub enabled?": If the native MAC Stub is disabled,
  # run the external MAC application.
  case ($"MAC Stub enabled?") {
    frame True {
      w12 = w11
      w13 = default
      w14 = default
    }
    frame False {
      w15 = -2  # CPU core assignment
      w16 = 150  # process priority
      # priority for MAC must be higher than 100, PHY SAP used priorities below 100
      # We use a timed loop to specify process priority and CPU core for the external MAC application
      # 0..N-1	manual -2	automatic
      timed loop {
        Left Execution System Border Node(priority_in=w16, processor_in=w15)
        Left Timing Statistics Border Node()
        Left Timing Source Border Node[AlarmName=L, DefaultTimingSourceName="1 kHz", DefaultTimingSourceType=1](structure_in="MAC External")
        Concatenate Strings("PATH=/usr/local/bin:/usr/bin:/bin:/usr/local/natinst/bin", " ", $command, " ", $arguments) -> w17
        Left Timing Error Border Node(error_in=w11) -> (error_out=w18)
        Format Into String(formatString="pidof %s", errIn=w18, $command) -> (outString=w19, errOut=w20)
        call "System Exec.gvi"(command line=w19, error in=w20) -> (standard output=w21, error out=w22)
        Is Empty String Or Path(string/path=w21) -> w23
        # We cannot check return code of command for successful program start as we do not wait for completion. Instead we check whether we can find the command in the process list. It is therefore important that the executable is not running on target yet to prevent ambiguity.
        case (w23) {
          frame False, Default {
            w25 = "External MAC already running on RT target. Cannot start before running process is stopped"
            call "Build Error Cluster.gvi"(code=-1, description=w25, error in=w22) -> (error out=w24)
            w14 = default
            w13 = default
          }
          frame True {
            # create log file
            call "System Exec.gvi"(command line="mktemp", error in=w22) -> (standard output=w26, error out=w27)
            call "Trim Whitespace.gvi"(string=w26) -> (trimmed string=w14)
            # Start external MAC
            Format Into String(formatString="%s 2>&1 | tee %s", errIn=w27, w17, w14) -> (outString=w28, errOut=w29)
            call "System Exec.gvi"(command line=w28, error in=w29, wait until completion?=FALSE) -> (error out=w30)
            # check pid
            call "System Exec.gvi"(command line=w19, error in=w30) -> (standard output=w31, error out=w32)
            Decimal String To Number(string=w31) -> (number=w33)
            To Unsigned 32 Bit Integer(number=w33) -> w13
            Is Empty String Or Path(string/path=w31) -> w34
            case (w34) {
              frame False, Default {
                w24 = w32
              }
              frame True {
                Format Into String(formatString="Failed to start: \"%s\".", errIn=w32, w17) -> (outString=w35, errOut=w36)
                call "Build Error Cluster.gvi"(code=-1, description=w35, error in=w36) -> (error out=w24)
              }
            }
          }
        }
        Right Timing Error Border Node(error_in=w24) -> (error_out=w12)
        stop if TRUE
      }
    }
  }
  sequence {
    frame 0 {
      $done <- FALSE
    }
  }
  timed loop {
    Left Execution System Border Node()
    Left Timing Statistics Border Node()
    Left Timing Error Border Node(error_in=w12) -> (error_out=w37)
    call "Transport Open Writers.gvi"(LTE Transport sessions in=w10, writers enabled=w5, Error in=w37) -> (LTE Transport sessions out=w38, Error out=w39)
    Right Timing Error Border Node(error_in=w39) -> (error_out=w40)
    Left Timing Source Border Node[AlarmName=L, DefaultTimingSourceName="1 kHz", DefaultTimingSourceType=1](structure_in="TP Open Writers")
    stop if TRUE
  }
  $"LTE Transport Sessions" <- w38
  sequence {
    frame 0 {
      $done <- TRUE
    }
  }
  sequence {
    frame 0 {
      # wait for writers to open
      Wait(time to wait=1000)
    }
    frame 1 {
      w41 = $done
    }
  }
  case (w41) {
    frame True {
      w42 = w12
    }
    frame False {
      w43 = "Could not open pipe writers. (Please check if pipe readers are opened properly!)"
      # kill opening of blocking writers after timeout
      call "Stop Timed Structure.gvi"(name="TP Open Writers", error in=w12) -> (error out=w44)
      call "Build Error Cluster.gvi"(code=-1, description=w43, error in=w44) -> (error out=w42)
    }
  }
  Merge Errors(w42, w40) -> (error out=w45)
  $"Error out" <- w45
  $"process ID" <- w13
  $"log file" <- w14
