vi "Transport Open Readers.gvi"   [LabVIEW NXG 4.0.0]
inputs:
  "LTE Transport sessions in": "Transport Session.gtype"[]
  "Error in": error
  "readers enabled": bool[]
outputs:
  "LTE Transport sessions out": "Transport Session.gtype"[]
  "Error out": error
types:
  "Pipe Reader.gtype" = cluster{"file name": string, "pipe file descriptor": i32, "timer file descriptor": i32, "epoll file descriptor": i32}
  "Pipe Writer.gtype" = cluster{"file name": string, "pipe file descriptor": i32}
  "Transport Session.gtype" = cluster{"FIFO pathname": string, "pipe reader": "Pipe Reader.gtype", "pipe writer": "Pipe Writer.gtype", "transport in RT FIFO": RTFifoRefnum<u8[]>, "transport out RT FIFO": RTFifoRefnum<u8[]>, "transport in timing source name": string, "transport in timing trigger ID": u8, "transport out timing source name": string, "transport out timing trigger ID": u8, "maximum API message size": u32}
uses:
  AFW::LTE::L1L2 API::Transport::Transport Constants.gvi
  AFW::Common::Linux Pipes::Open Pipe Reader.gvi
  NI::G Core::Error::Build Error Cluster.gvi
diagram:
  # First pipe is used only for the PHY_TIMING_IND, which is tiny. The other two pipes can be  rather large.
  # $"readers enabled": This bit mask defines which
  # readers are opened by LV.
  call "Transport Constants.gvi"() -> (constants=w1)
  Property Node(instance in=w1) -> ("MAX_BUFFER_SIZE_TIMING_IND"=w2, "MAX_BUFFER_SIZE"=w3)
  Array Size(array=$"LTE Transport sessions in") -> (size(s)=w4)
  Initialize Array(element=w3, size=w4) -> w5
  Replace Array Subset(inArray=w5, index=0, new=w2) -> w6
  s1 = $"Error in"  # shift register
  for {
    w7 = each element of $"LTE Transport sessions in"
    w8 = each element of w6
    w9 = each element of $"readers enabled"
    Property Node(instance in=w7) -> ("FIFO pathname"=w11, instance out=w12)
    case (w9) {
      frame False, Default {
        w15 = "Pipe Reader.gtype" {"file name"="NULL", "pipe file descriptor"=-1, "timer file descriptor"=-1, "epoll file descriptor"=-1}  # Pipe Reader
        w13 = s1
        w14 = w15
      }
      frame True {
        To Signed 32 Bit Integer(number=w8) -> w16
        call "Open Pipe Reader.gvi"(file name=w11, pipe size=w16, error in=s1) -> (pipe reader=w14, new pipe size=w17, error out=w18)
        Is Less(x=w17, y=w16) -> w19
        case (w19) {
          frame False, Default {
            w13 = w18
          }
          frame True {
            call "Build Error Cluster.gvi"(code=-1, description="PIPE too small", error in=w18) -> (error out=w13)
          }
        }
      }
    }
    Property Node(instance in=w12, "pipe reader"=w14) -> (instance out=w20)
    append w20 to w10
    next s1 = w13
  }
  $"LTE Transport sessions out" <- w10
  $"Error out" <- s1
