vi "Transport Open Writers.gvi"   [LabVIEW NXG 4.0.0]
inputs:
  "LTE Transport sessions in": "Transport Session.gtype"[]
  "Error in": error
  "writers enabled": bool[]
outputs:
  "LTE Transport sessions out": "Transport Session.gtype"[]
  "Error out": error
types:
  "Pipe Reader.gtype" = cluster{"file name": string, "pipe file descriptor": i32, "timer file descriptor": i32, "epoll file descriptor": i32}
  "Pipe Writer.gtype" = cluster{"file name": string, "pipe file descriptor": i32}
  "Transport Session.gtype" = cluster{"FIFO pathname": string, "pipe reader": "Pipe Reader.gtype", "pipe writer": "Pipe Writer.gtype", "transport in RT FIFO": RTFifoRefnum<u8[]>, "transport out RT FIFO": RTFifoRefnum<u8[]>, "transport in timing source name": string, "transport in timing trigger ID": u8, "transport out timing source name": string, "transport out timing trigger ID": u8, "maximum API message size": u32}
uses:
  AFW::Common::Linux Pipes::Open Pipe Writer.gvi
diagram:
  # $"writers enabled": This bit mask defines which
  # writers are opened by LV.
  s1 = $"Error in"  # shift register
  for {
    w1 = each element of $"LTE Transport sessions in"
    w2 = each element of $"writers enabled"
    Property Node(instance in=w1) -> ("FIFO pathname"=w4, instance out=w5)
    case (w2) {
      frame False, Default {
        w8 = "Pipe Writer.gtype" {"file name"="NULL", "pipe file descriptor"=-1}  # Pipe Writer
        w6 = s1
        w7 = w8
      }
      frame True {
        call "Open Pipe Writer.gvi"(file name=w4, blocking=TRUE, error in=s1) -> (pipe writer=w7, error out=w6)
      }
    }
    Property Node(instance in=w5, "pipe writer"=w7) -> (instance out=w9)
    append w9 to w3
    next s1 = w6
  }
  $"LTE Transport sessions out" <- w3
  $"Error out" <- s1
