vi "Transport Read From Transport.gvi"   [LabVIEW NXG 4.0.0]
# Reads data from a transport path.
# When the read operation is successful, transport read success is True and transport out contains the read data.
# Refer to API transport session for details about transport paths.
inputs:
  "API transport session": "Transport Session.gtype"  # Transport session to read data from. Refer to LTE Transport Session for more details.
  "error in": error
  "allow read fail": bool  # Boolean that identifies whether an empty transport out RT FIFO inside the session should throw an error (False) or be ignored (True).
outputs:
  "transport out": u8[]  # Data read from transport out RT FIFO in case of transport read success is True, empty otherwise.
  "transport read success": bool  # Boolean that is True if valid data was read from transport out RT FIFO.
  "error out": error
  "API transport session dup": "Transport Session.gtype"  # Transport session duplicate. Refer to LTE Transport Session for further details.
types:
  "Pipe Reader.gtype" = cluster{"file name": string, "pipe file descriptor": i32, "timer file descriptor": i32, "epoll file descriptor": i32}
  "Pipe Writer.gtype" = cluster{"file name": string, "pipe file descriptor": i32}
  "Transport Session.gtype" = cluster{"FIFO pathname": string, "pipe reader": "Pipe Reader.gtype", "pipe writer": "Pipe Writer.gtype", "transport in RT FIFO": RTFifoRefnum<u8[]>, "transport out RT FIFO": RTFifoRefnum<u8[]>, "transport in timing source name": string, "transport in timing trigger ID": u8, "transport out timing source name": string, "transport out timing trigger ID": u8, "maximum API message size": u32}
uses:
  NI::G Core::Error::Build Error Cluster.gvi
diagram:
  case ($"error in") {
    frame Error {
      w1 = u8[] []
      w2 = $"error in"
      w3 = $"API transport session"
      w4 = FALSE
    }
    frame No Error {
      Property Node(instance in=$"API transport session") -> ("transport out RT FIFO"=w5, instance out=w3)
      RTFIFO Read(error in=$"error in", rt fifo=w5, timeout in ms=0) -> (element out=w1, empty?=w6, error out=w7)
      case ($"allow read fail") {
        frame False {
          w2 = w7
          w4 = FALSE
        }
        frame True {
          case (w6) {
            frame False {
              w2 = w7
              w4 = TRUE
            }
            frame True {
              call "Build Error Cluster.gvi"(code=-1, description="RT FIFO read from Transport Layer fail", error in=w7) -> (error out=w2)
              w4 = FALSE
            }
          }
        }
      }
    }
  }
  $"API transport session dup" <- w3
  $"transport out" <- w1
  $"transport read success" <- w4
  $"error out" <- w2
