vi "Transport Read.gvi"   [LabVIEW NXG 4.0.0]
inputs:
  "transport session in": "Transport Session.gtype"
  "error in": error
  "transport buffer": u8[]
outputs:
  "error out": error
  "transport session out": "Transport Session.gtype"
  "transport success": bool
types:
  "Pipe Reader.gtype" = cluster{"file name": string, "pipe file descriptor": i32, "timer file descriptor": i32, "epoll file descriptor": i32}
  "Pipe Writer.gtype" = cluster{"file name": string, "pipe file descriptor": i32}
  "Transport Session.gtype" = cluster{"FIFO pathname": string, "pipe reader": "Pipe Reader.gtype", "pipe writer": "Pipe Writer.gtype", "transport in RT FIFO": RTFifoRefnum<u8[]>, "transport out RT FIFO": RTFifoRefnum<u8[]>, "transport in timing source name": string, "transport in timing trigger ID": u8, "transport out timing source name": string, "transport out timing trigger ID": u8, "maximum API message size": u32}
uses:
  AFW::Common::Linux Pipes::Read Pipe.gvi
  NI::G Core::Error::Build Error Cluster.gvi
diagram:
  Property Node(instance in=$"transport session in") -> ("transport out RT FIFO"=w1, "pipe reader"=w2, instance out=w3)
  $"transport session out" <- w3
  # read transport header
  w4 = 2000  # timeout (us)
  w5 = 0  # uint8
  w6 = 8  # api transport header size
  Initialize Array(element=w5, size=w6) -> w7
  Array Size(array=w7) -> (size(s)=w8)
  call "Read Pipe.gvi"(pipe reader in=w2, buffer in=w7, bytes to read=w8, error in=$"error in", timeout=w4) -> (timed out=w9, pipe reader out=w10, buffer out=w11, bytes read=w12, Error=w13)
  Is Equal(x=w12, y=w8) -> w14
  case (w14) {
    frame False, Default {
      case (w9) {
        frame True {
          # timed out -> OK
          w15 = w13
        }
        frame False {
          call "Build Error Cluster.gvi"(code=-1, description="Pipe read fail! (too less bytes)", error in=w13) -> (error out=w15)
        }
      }
      w16 = FALSE
    }
    frame True {
      Array Index(array=w11) -> (out0[5]=w17, out1[_]=w18, out2[_]=w19)
      Join Numbers(high(x)=0, low(x)=w17) -> w20
      Join Numbers(high(x)=w18, low(x)=w19) -> w21
      Join Numbers(high(x)=w20, low(x)=w21) -> w22
      To Signed 32 Bit Integer(number=w22) -> w23
      call "Read Pipe.gvi"(pipe reader in=w10, buffer in=$"transport buffer", bytes to read=w23, error in=w13, timeout=w4) -> (timed out=w24, buffer out=w25, bytes read=w26, Error=w27)
      Split 1D Array(array=w25, index=w26) -> (first subarray=w28)
      # read transport payload
      Build Array(w11, w28) -> w29
      Is Not Equal(x=w26, y=w23) -> w30
      Logical Or(w30, w24) -> w31
      case (w31) {
        frame True {
          call "Build Error Cluster.gvi"(code=-1, description="Pipe read fail! (too less bytes or timed out)", error in=w27) -> (error out=w15)
          w16 = FALSE
        }
        frame False {
          RTFIFO Write(element=w29, error in=w27, rt fifo=w1, timeout in ms=0) -> (error out=w32, timed out?=w33)
          case (w33) {
            frame True {
              call "Build Error Cluster.gvi"(code=-1, description="FIFO write fail! (timed out)", error in=w32) -> (error out=w15)
              w16 = FALSE
            }
            frame False {
              # success
              w15 = w32
              w16 = TRUE
            }
          }
        }
      }
    }
  }
  $"transport success" <- w16
  $"error out" <- w15
