vi "Transport Remove Header.gvi"   [LabVIEW NXG 4.0.0]
inputs:
  "api transport in": u8[]
outputs:
  "api transport out": u8[]
  "api transport header": u32
diagram:
  w1 = 4  # api transport header size
  Split 1D Array(array=$"api transport in", index=w1) -> (first subarray=w2, second subarray=w3)
  Array Index(array=w2) -> (out0[_]=w4, out1[_]=w5, out2[_]=w6, out3[_]=w7)
  Join Numbers(high(x)=w4, low(x)=w5) -> w8
  Join Numbers(high(x)=w6, low(x)=w7) -> w9
  Join Numbers(high(x)=w8, low(x)=w9) -> w10
  $"api transport header" <- w10
  $"api transport out" <- w3
