vi "Transport Send To Transport.gvi"   [LabVIEW NXG 4.0.0]
# Writes data into a transport path.
# When the write operation to the RT FIFO is successful the trigger for timing in is raised which typically starts further processing of the data.
# See also API transport session for details about transport paths.
inputs:
  "API transport session": "Transport Session.gtype"  # Transport session to write data to. Refer to LTE Transport Session for further details.
  "transport in": u8[]  # U8 array that should be handed over to transport.
  "error in": error
  "bypass": bool  # Boolean that determines if the pipes of the path are bypassed. If the other transport path is read inside the same LabVIEW process, the pipes of the path can be bypassed. In this case data is written directly to transport out RT FIFO, which saves execution time.
outputs:
  "error out": error
  "API transport session dup": "Transport Session.gtype"  # Copy of API transport session.
types:
  "Pipe Reader.gtype" = cluster{"file name": string, "pipe file descriptor": i32, "timer file descriptor": i32, "epoll file descriptor": i32}
  "Pipe Writer.gtype" = cluster{"file name": string, "pipe file descriptor": i32}
  "Transport Session.gtype" = cluster{"FIFO pathname": string, "pipe reader": "Pipe Reader.gtype", "pipe writer": "Pipe Writer.gtype", "transport in RT FIFO": RTFifoRefnum<u8[]>, "transport out RT FIFO": RTFifoRefnum<u8[]>, "transport in timing source name": string, "transport in timing trigger ID": u8, "transport out timing source name": string, "transport out timing trigger ID": u8, "maximum API message size": u32}
uses:
  NI::G Core::Error::Build Error Cluster.gvi
  NI::G Core::Timed Loop::Fire Software-Triggered Timing Source.gvi
diagram:
  case ($"error in") {
    frame Error {
      w1 = $"error in"
      w2 = $"API transport session"
    }
    frame No Error {
      case ($bypass) {
        frame False, Default {
          Property Node(instance in=$"API transport session") -> ("transport in timing trigger ID"=w4, "transport in RT FIFO"=w3, instance out=w2)
        }
        frame True {
          Property Node(instance in=$"API transport session") -> ("transport out timing trigger ID"=w4, "transport out RT FIFO"=w3, instance out=w2)
        }
      }
      RTFIFO Write(element=$"transport in", error in=$"error in", rt fifo=w3, timeout in ms=0) -> (error out=w5, timed out?=w6)
      case (w6) {
        frame True {
          call "Build Error Cluster.gvi"(code=-1, description="FIFO write to Transport Layer fail", error in=w5) -> (error out=w1)
        }
        frame False {
          call "Fire Software-Triggered Timing Source.gvi"(trigger ID in=w4, error in=w5) -> (error out=w1)
        }
      }
    }
  }
  $"API transport session dup" <- w2
  $"error out" <- w1
