vi "Transport Write.gvi"   [LabVIEW NXG 4.0.0]
inputs:
  "transport in": "Transport Session.gtype"
  "error in": error
outputs:
  "error out": error
panel indicators:
  "transport out": "Transport Session.gtype"
types:
  "Pipe Reader.gtype" = cluster{"file name": string, "pipe file descriptor": i32, "timer file descriptor": i32, "epoll file descriptor": i32}
  "Pipe Writer.gtype" = cluster{"file name": string, "pipe file descriptor": i32}
  "Transport Session.gtype" = cluster{"FIFO pathname": string, "pipe reader": "Pipe Reader.gtype", "pipe writer": "Pipe Writer.gtype", "transport in RT FIFO": RTFifoRefnum<u8[]>, "transport out RT FIFO": RTFifoRefnum<u8[]>, "transport in timing source name": string, "transport in timing trigger ID": u8, "transport out timing source name": string, "transport out timing trigger ID": u8, "maximum API message size": u32}
uses:
  AFW::Common::Linux Pipes::Write Pipe.gvi
  NI::G Core::Error::Build Error Cluster.gvi
diagram:
  Property Node(instance in=$"transport in") -> ("pipe writer"=w1, "transport in RT FIFO"=w2, instance out=w3)
  $"transport out" <- w3
  RTFIFO Read(error in=$"error in", rt fifo=w2, timeout in ms=0) -> (element out=w4, empty?=w5, error out=w6)
  case (w5) {
    frame False, Default {
      call "Write Pipe.gvi"(pipe writer in=w1, buffer in=w4, error in=w6) -> (bytes written=w8, error out=w9)
      Array Size(array=w4) -> (size(s)=w10)
      Is Not Equal(x=w8, y=w10) -> w11
      case (w11) {
        frame False, Default {
          w7 = w9
        }
        frame True {
          call "Build Error Cluster.gvi"(code=-1, description="Pipe write fail", error in=w9) -> (error out=w7)
        }
      }
    }
    frame True {
      call "Build Error Cluster.gvi"(code=-1, description="FIFO read fail", error in=w6) -> (error out=w7)
    }
  }
  $"error out" <- w7
