vi "Transport.gvi"   [LabVIEW NXG 4.0.0]
# Handles transport of messages between L1 and L2 layer.
# The transport is implemented using Linux Pipes. This way it is easy to connect an external MAC application.
# To enable bypass of Linux Pipes data from and to the pipes are written into RT FIFOs.
# Furthermore each transport path executes a trigger when data is available in an outbound RT FIFO.
# The transport offers three paths with decreasing priority, from most important to least important: TTI trigger transport (for PHY TTI Indication), TX messages transport (for TX config and payload requests), and RX messages transport (for PHY confirmations messages and RX indication messages). The priorities are carefully chosen but can be changed by the caller to match the overall system.
inputs:
  "session": "Host Session.gtype"
  "error in": error
  "bypass": bool  # Bypass Linux pipe messages. Messages are written to directly to RT out FIFOs, and this VI only fires the trigger for the transport paths.
outputs:
  "error out": error[]  # Contains error information. This output provides standard error out functionality.
panel controls:
  "transport priority TTI": i32 = 100
  "transport priority Tx": i32 = 99
  "transport priority Rx": i32 = 98
panel indicators:
  "stop": bool
types:
  "Transport Session.gtype" = cluster{"FIFO pathname": string, "pipe reader": "Pipe Reader.gtype", "pipe writer": "Pipe Writer.gtype", "transport in RT FIFO": RTFifoRefnum<u8[]>, "transport out RT FIFO": RTFifoRefnum<u8[]>, "transport in timing source name": string, "transport in timing trigger ID": u8, "transport out timing source name": string, "transport out timing trigger ID": u8, "maximum API message size": u32}
  "Register Bus Session.gtype" = Queue<"Session Data.gtype">
  "Semaphore.gtype" = i32
  "DB Queue Reference.gtype" = Queue<"Daughterboard Data.gtype">
  "niUsrpRio Session.gtype" = cluster{"FPGA Interface": any, "RIO Interface Number": u32, "Data Clock Rate": u32, "FPGA Data Clock Rate": u32, "Global Settings Register Bus": "Register Bus Session.gtype", "Radio 0 Settings Register Bus": "Register Bus Session.gtype", "Radio 1 Settings Register Bus": "Register Bus Session.gtype", "Radio Settings Bus Semaphore": "Semaphore.gtype", "DB Queues": "DB Queue Reference.gtype"[], "Characterization Data Valid?": bool, "EEPROM Header": "EEPROM Header.gtype", "Device Data Header": "EEPROM Device Data Header.gtype", "EEPROM Characterization Header": "EEPROM Characterization Header.gtype", "Characterization Data": "Characterization Data.gtype"[], "FPGA Current Version": u32, "FPGA Oldest Compatible Version": u32, "Fixed Logic Current Version": u32, "Fixed Logic Oldest Compatible Version": u32, "FPGA Radio Settings Bus Current Version": u32, "FPGA Radio Settings Bus Oldest Compatible Version": u32, "FPGA Board Config Current Version": u32, "FPGA Board Config Oldest Compatible Version": u32, "Daughterboard Clock Rate": u32}
  T1 = cluster{"FPGA ref": any, "bus instance": u32, "instruction FIFO depth": u32, "executing on FPGA target": bool, "show error call chain": bool}
  T2 = cluster{"Actual Gain [dB]": f64, "Attenuation Table Index": i32}
  T3 = cluster{"Attenuation Table [dB]": f64[][], "Frequencies [Hz]": f64[], "IQ Imbalance Table": "IQ Imbalance.gtype"[], "Gain Table": T2[][]}
  T4 = cluster{"FlexRIO Register Bus": Queue<T1>, "RX Characterization Data": T3, "TX Characterization Data": T3, "FPGA Interface": any}
  T5 = cluster{"transport block size": u32, "CRC ok": bool, "user data": u32}
  "Link Direction.gtype" = enum{"DL", "UL"}
  T6 = cluster{"MAC Stub RX Payload Information FIFO": RTFifoRefnum<"MAC Stub RX Payload Information.gtype">, "MAC Stub RX Confirmation Information FIFO": RTFifoRefnum<u64[16]>, "MAC Stub RX UL Payload Information FIFO": RTFifoRefnum<f64[23]>}
  T7 = cluster{"MAC Stub TX Input Terminals FIFO": RTFifoRefnum<"MAC Stub TX Input Terminals.gtype">, "MAC Stub TX Output Terminals FIFO": RTFifoRefnum<"MAC Stub TX Output Terminals.gtype">}
  T8 = cluster{"MAC Stub RX Interface": T6, "MAC Stub TX Interface": T7}
  "Host Session.gtype" = cluster{"target": enum{"USRP", "FlexRIO"}, "real time mode": bool, "MAC Stub enabled": bool, "DMA FIFO read timeout": i32, "timed loop period": i64, "LTE Transport Sessions": "Transport Session.gtype"[], "USRP session": "niUsrpRio Session.gtype", "FlexRIO session": T4, "UDP RX session": UdpNetworkConnectionRefnum, "UDP TX session": UdpNetworkConnectionRefnum, "sync found FIFO": RTFifoRefnum<bool>, "PDCCH CRC OK FIFO": RTFifoRefnum<bool>, "DL PDCCH status FIFO": RTFifoRefnum<cluster{"CRC ok": bool, "subframe number": u32}>, "DL PDSCH status FIFO": RTFifoRefnum<cluster{"CRC ok": bool, "subframe number": u32}>, "DL SINR FIFO": RTFifoRefnum<f64[]>, "PDSCH user data FIFO": RTFifoRefnum<u32>, "PDSCH user data UDP FIFO": RTFifoRefnum<T5>, "PDSCH user data throughput FIFO": RTFifoRefnum<T5>, "PUSCH user data FIFO": RTFifoRefnum<u32>, "PUSCH user data UDP FIFO": RTFifoRefnum<T5>, "PUSCH user data throughput FIFO": RTFifoRefnum<T5>, "UE feedback info FIFO": RTFifoRefnum<u8[]>, "Request information FIFO": RTFifoRefnum<"Request Information.gtype">, "UDP TX outbound FIFO": RTFifoRefnum<u8[]>, "UDP RX inbound FIFO": RTFifoRefnum<u8[]>, "stop notifier": Notifier<string>, "DL RX scope": string, "UL RX scope": string, "external MAC log file": string, "external MAC process ID": u32, "TX link direction": "Link Direction.gtype", "RX link direction": "Link Direction.gtype", "Sychronization FIFO": RTFifoRefnum<i32>, "RT Loop Interfaces": T8}
uses:
  AFW::Common::Check Stop.gvi
  AFW::LTE::L1L2 API::Transport::Get Transport Session.gvi
  NI::G Core::Timed Loop::Fire Software-Triggered Timing Source.gvi
  NI::G Core::Timed Loop::Stop Timed Structure.gvi
  NI::G Core::Error::Filter Error Code.gvi
  AFW::LTE::L1L2 API::Transport::Transport Read.gvi
  AFW::Common::Stop On Error.gvi
  AFW::LTE::L1L2 API::Transport::Transport Write.gvi
diagram:
  case ($bypass) {
    frame True {
      while {
        Wait Until Next Multiple(multiple to wait=100)
        call "Check Stop.gvi"(error in=$"error in") -> (error out=w2, stop=w3)
        stop if w3
      }
      call "Get Transport Session.gvi"(Session=$session, Transport Session Select="Transport PHY Timing to MAC") -> (Session dup=w4, LTE Transport Session=w5)
      call "Get Transport Session.gvi"(Session=w4, Transport Session Select="Transport MAC to PHY") -> (Session dup=w6, LTE Transport Session=w7)
      call "Get Transport Session.gvi"(Session=w6, Transport Session Select="Transport PHY to MAC") -> (LTE Transport Session=w8)
      Build Array(w5, w7, w8) -> w9
      # trigger loops outside in order to force stop
      s1 = w2  # shift register
      for {
        w10 = each element of w9
        Property Node(instance in=w10) -> ("transport out timing trigger ID"=w11)
        call "Fire Software-Triggered Timing Source.gvi"(trigger ID in=w11, number of ticks=1000, error in=s1) -> (error out=w12)
        next s1 = w12
      }
      Build Array(s1) -> w1
    }
    frame False {
      sequence {
        frame 0 {
          $stop <- FALSE
        }
      }
      # stop free running loops
      while {
        Wait Until Next Multiple(multiple to wait=100)
        call "Check Stop.gvi"(error in=$"error in") -> (error out=w13, stop=w14)
        $stop <- w14
        stop if w14
      }
      w15 = ["TP PHY Tim Out", "TP PHY Tim In", "TP PHY Tx In", "TP PHY Tx Out", "TP PHY Rx Out", "TP PHY Rx In"]
      call "Get Transport Session.gvi"(Session=$session, Transport Session Select="Transport PHY Timing to MAC") -> (Session dup=w16, LTE Transport Session=w17)
      call "Get Transport Session.gvi"(Session=w16, Transport Session Select="Transport MAC to PHY") -> (Session dup=w18, LTE Transport Session=w19)
      call "Get Transport Session.gvi"(Session=w18, Transport Session Select="Transport PHY to MAC") -> (Session dup=w20, LTE Transport Session=w21)
      Property Node(instance in=w20) -> ("MAC Stub enabled"=w22)
      case (w22) {
        frame True {
          # MAC Stub
          Array Index(array=w15) -> (out0[1]=w24, out1[2]=w25, out2[5]=w26)
          Build Array(w24, w25, w26) -> w23
        }
        frame False {
          # external MAC
          Array Index(array=w15) -> (out0[1]=w27, out1[5]=w28)
          Build Array(w27, w28) -> w23
        }
      }
      for {
        w29 = each element of w23
        # stop triggered
        # TP loops
        call "Stop Timed Structure.gvi"(name=w29) -> (error out=w31)
        call "Filter Error Code.gvi"(code to clear=-804, error in=w31) -> (error out=w32)
        append w32 to w30
      }
      Build Array(w17, w19, w21) -> w33
      for {
        w34 = each element of w33
        w36 = -804  # timed structure does not exist
        # trigger loops outside in order to force stop
        Property Node(instance in=w34) -> ("transport out timing trigger ID"=w37)
        call "Fire Software-Triggered Timing Source.gvi"(trigger ID in=w37, number of ticks=1000) -> (error out=w38)
        call "Filter Error Code.gvi"(code to clear=w36, error in=w38) -> (error out=w39)
        append w39 to w35
      }
      Array Index(array=w15) -> (out0[_]=w40, out1[_]=w41, out2[_]=w42, out3[_]=w43, out4[_]=w44, out5[_]=w45)
      # w17: PHY Timing Indication
      # w19: PHY Tx Request
      # w21: PHY Rx Indication / Tx Confirmation
      case (w22) {
        frame False, Default {
          w46 = $"error in"
        }
        frame True {
          Property Node(instance in=w17) -> ("maximum API message size"=w47, instance out=w48)
          w49 = 10  # period in
          w50 = 0  # uint8
          To Signed 32 Bit Integer(number=w47) -> w51
          Initialize Array(element=w50, size=w51) -> w52
          timed loop {
            # Transport PHY Timing Indication out
            Left Execution System Border Node(priority_in=$"transport priority TTI")
            Left Timing Source Border Node[AlarmName=L, DefaultTimingSourceName="1 MHz", DefaultTimingSourceType=2](mode_in="Discard missed periods, ignore original phase", period_in=w49, structure_in=w40)
            Left Timing Error Border Node(error_in=$"error in") -> (error_out=w53)
            call "Transport Read.gvi"(transport session in=w48, transport buffer=w52, error in=w53) -> (transport session out=w54, transport success=w55, error out=w56)
            case (w55) {
              frame False {
                w57 = w56
              }
              frame True {
                Property Node(instance in=w54) -> ("transport out timing trigger ID"=w58)
                # trigger outer loop
                call "Fire Software-Triggered Timing Source.gvi"(trigger ID in=w58, error in=w56) -> (error out=w57)
              }
            }
            Right Timing Error Border Node(error_in=w57) -> (error_out=w46)
            Left Timing Statistics Border Node()
            stop if $stop
          }
        }
      }
      call "Stop On Error.gvi"(error in=w46, error source prefix=w40) -> (error out=w59)
      call "Stop On Error.gvi"(error in=w13, error source prefix="TP stop") -> (error out=w60)
      Property Node(instance in=w17) -> ("transport in timing source name"=w61)
      # MAC
      # ^^^^^^^
      # PHY SAP
      timed loop forever {
        # Transport PHY Timing Indication in
        Left Execution System Border Node(priority_in=$"transport priority TTI")
        Left Timing Source Border Node[AlarmName=L, DefaultTimingSourceName="1 MHz", DefaultTimingSourceType=2](mode_in="Process missed periods, ignore original phase", period_in=1, source_in=w61, structure_in=w41)
        Left Timing Error Border Node(error_in=$"error in") -> (error_out=w62)
        call "Transport Write.gvi"(transport in=w17, error in=w62) -> (error out=w63)
        Right Timing Error Border Node(error_in=w63) -> (error_out=w64)
        Left Timing Statistics Border Node() -> (wakeupreason_out=w65)
      }
      case (w65) {
        frame "Normal", Default {
          w66 = w64
        }
        frame "Aborted" {
          w67 = -816  # Timed structure aborted
          call "Filter Error Code.gvi"(code to clear=w67, error in=w64) -> (error out=w66)
        }
      }
      call "Stop On Error.gvi"(error in=w66, error source prefix=w41) -> (error out=w68)
      case (w22) {
        frame False, Default {
          w69 = $"error in"
        }
        frame True {
          Property Node(instance in=w19) -> ("transport in timing source name"=w70)
          timed loop forever {
            # Transport PHY Tx Request in
            Left Execution System Border Node(priority_in=$"transport priority Tx")
            Left Timing Source Border Node[AlarmName=L, DefaultTimingSourceName="1 MHz", DefaultTimingSourceType=2](mode_in="Process missed periods, ignore original phase", period_in=1, source_in=w70, structure_in=w42)
            Left Timing Error Border Node(error_in=$"error in") -> (error_out=w71)
            call "Transport Write.gvi"(transport in=w19, error in=w71) -> (error out=w72)
            Right Timing Error Border Node(error_in=w72) -> (error_out=w73)
            Left Timing Statistics Border Node() -> (wakeupreason_out=w74)
          }
          case (w74) {
            frame "Normal", Default {
              w69 = w73
            }
            frame "Aborted" {
              w75 = -816  # Timed structure aborted
              call "Filter Error Code.gvi"(code to clear=w75, error in=w73) -> (error out=w69)
            }
          }
        }
      }
      call "Stop On Error.gvi"(error in=w69, error source prefix=w42) -> (error out=w76)
      Property Node(instance in=w19) -> ("maximum API message size"=w77, instance out=w78)
      w79 = 10  # period in
      w80 = 0  # uint8
      To Signed 32 Bit Integer(number=w77) -> w81
      Initialize Array(element=w80, size=w81) -> w82
      # MAC
      # vvvvvvvvv
      # PHY SAP
      timed loop {
        Left Execution System Border Node(priority_in=$"transport priority Tx")
        # Transport PHY Tx Request out
        Left Timing Source Border Node[AlarmName=L, DefaultTimingSourceName="1 MHz", DefaultTimingSourceType=2](mode_in="Discard missed periods, ignore original phase", period_in=w79, structure_in=w43)
        Left Timing Error Border Node(error_in=$"error in") -> (error_out=w83)
        call "Transport Read.gvi"(transport session in=w78, transport buffer=w82, error in=w83) -> (transport session out=w84, transport success=w85, error out=w86)
        case (w85) {
          frame False {
            w87 = w86
          }
          frame True {
            Property Node(instance in=w84) -> ("transport out timing trigger ID"=w88)
            # trigger outer loop
            call "Fire Software-Triggered Timing Source.gvi"(trigger ID in=w88, error in=w86) -> (error out=w87)
          }
        }
        Right Timing Error Border Node(error_in=w87) -> (error_out=w89)
        Left Timing Statistics Border Node()
        stop if $stop
      }
      call "Stop On Error.gvi"(error in=w89, error source prefix=w43) -> (error out=w90)
      case (w22) {
        frame False, Default {
          w91 = $"error in"
        }
        frame True {
          Property Node(instance in=w21) -> ("maximum API message size"=w92, instance out=w93)
          w94 = 10  # period in
          w95 = 0  # uint8
          To Signed 32 Bit Integer(number=w92) -> w96
          Initialize Array(element=w95, size=w96) -> w97
          timed loop {
            # Transport PHY Rx Indication out
            Left Execution System Border Node(priority_in=$"transport priority Rx")
            Left Timing Source Border Node[AlarmName=L, DefaultTimingSourceName="1 MHz", DefaultTimingSourceType=2](mode_in="Discard missed periods, ignore original phase", period_in=w94, structure_in=w44)
            Left Timing Error Border Node(error_in=$"error in") -> (error_out=w98)
            call "Transport Read.gvi"(transport session in=w93, transport buffer=w97, error in=w98) -> (transport session out=w99, transport success=w100, error out=w101)
            case (w100) {
              frame False {
                w102 = w101
              }
              frame True {
                Property Node(instance in=w99) -> ("transport out timing trigger ID"=w103)
                # trigger outer loop
                call "Fire Software-Triggered Timing Source.gvi"(trigger ID in=w103, error in=w101) -> (error out=w102)
              }
            }
            Right Timing Error Border Node(error_in=w102) -> (error_out=w91)
            Left Timing Statistics Border Node()
            stop if $stop
          }
        }
      }
      call "Stop On Error.gvi"(error in=w91, error source prefix=w44) -> (error out=w104)
      Property Node(instance in=w21) -> ("transport in timing source name"=w105)
      # MAC
      # ^^^^^^^
      # PHY SAP
      timed loop forever {
        # Transport PHY Rx Indication in
        Left Execution System Border Node(priority_in=$"transport priority Rx")
        Left Timing Source Border Node[AlarmName=L, DefaultTimingSourceName="1 MHz", DefaultTimingSourceType=2](mode_in="Process missed periods, ignore original phase", period_in=1, source_in=w105, structure_in=w45)
        Left Timing Error Border Node(error_in=$"error in") -> (error_out=w106)
        call "Transport Write.gvi"(transport in=w21, error in=w106) -> (error out=w107)
        Right Timing Error Border Node(error_in=w107) -> (error_out=w108)
        Left Timing Statistics Border Node() -> (wakeupreason_out=w109)
      }
      case (w109) {
        frame "Normal", Default {
          w110 = w108
        }
        frame "Aborted" {
          w111 = -816  # Timed structure aborted
          call "Filter Error Code.gvi"(code to clear=w111, error in=w108) -> (error out=w110)
        }
      }
      call "Stop On Error.gvi"(error in=w110, error source prefix=w45) -> (error out=w112)
      Build Array(w30, w35, w60, w59, w68, w76, w90, w104, w112) -> w1
    }
  }
  $"error out" <- w1
