vi "Calculate Transport Block Size.gvi"   [LabVIEW NXG 4.0.0]
# Calculates the transport block size as specified in TS 36.213, table 7.1.7.2.1-1.
# 				Latency: 4 cycles
inputs:
  "number of PRBs": u8  # Number of resource blocks.
  "MCS": u8  # Modulation and coding scheme.
outputs:
  "transport block size": u32  # Calculated transport block size.
  "bytes to transmit": u32
diagram:
  # 36.213 rel10 table 7.1.7.2.1-1
  # w1: I_TBS
  w2 = [[16, 32, 56, 88, 120, 152, 176, 208, 224, 256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], [24, 56, 88, 144, 176, 208, 224, 256, 328, 344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], [32, 72, 144, 176, 208, 256, 296, 328, 376, 424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], [40, 104, 176, 208, 256, 328, 392, 440, 504, 568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], [56, 120, 208, 256, 328, 408, 488, 552, 632, 696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], [72, 144, 224, 328, 424, 504, 600, 680, 776, 872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], [328, 176, 256, 392, 504, 600, 712, 808, 936, 1032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], [104, 224, 328, 472, 584, 712, 840, 968, 1096, 1224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], [120, 256, 392, 536, 680, 808, 968, 1096, 1256, 1384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], [136, 296, 456, 616, 776, 936, 1096, 1256, 1416, 1544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], [144, 328, 504, 680, 872, 1032, 1224, 1384, 1544, 1736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], [176, 376, 584, 776, 1000, 1192, 1384, 1608, 1800, 2024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], [208, 440, 680, 904, 1128, 1352, 1608, 1800, 2024, 2280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], [224, 488, 744, 1000, 1256, 1544, 1800, 2024, 2280, 2536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], [256, 552, 840, 1128, 1416, 1736, 1992, 2280, 2600, 2856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], [280, 600, 904, 1224, 1544, 1800, 2152, 2472, 2728, 3112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], [328, 632, 968, 1288, 1608, 1928, 2280, 2600, 2984, 3240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], [336, 696, 1064, 1416, 1800, 2152, 2536, 2856, 3240, 3624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], [376, 776, 1160, 1544, 1992, 2344, 2792, 3112, 3624, 4008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], [408, 840, 1288, 1736, 2152, 2600, 2984, 3496, 3880, 4264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], [440, 904, 1384, 1864, 2344, 2792, 3240, 3752, 4136, 4584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], [488, 1000, 1480, 1992, 2472, 2984, 3496, 4008, 4584, 4968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], [520, 1064, 1608, 2152, 2664, 3240, 3752, 4264, 4776, 5352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], [552, 1128, 1736, 2280, 2856, 3496, 4008, 4584, 5160, 5736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], [584, 1192, 1800, 2408, 2984, 3624, 4264, 4968, 5544, 5992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], [616, 1256, 1864, 2536, 3112, 3752, 4392, 5160, 5736, 6200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], [712, 1480, 2216, 2984, 3752, 4392, 5160, 5992, 6712, 7480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]]
  To Signed 32 Bit Integer(number=$MCS) -> w3
  case (w3) {
    frame 0..9, Default {
      # QPSK
      w1 = $MCS
    }
    frame 10..16 {
      # 16QAM
      Decrement(x=$MCS) -> w1
    }
    frame 17..28 {
      # 64QAM
      Decrement(x=$MCS) -> w4
      Decrement(x=w4) -> w1
    }
    frame 29..31 {
      w1 = 0
    }
  }
  To Signed 32 Bit Integer(number=w1) -> w5
  Decrement(x=$"number of PRBs") -> w6
  To Signed 32 Bit Integer(number=w6) -> w7
  Array Index(array=w2) -> (out0[w5, w7]=w8)
  $"transport block size" <- w8
  Quotient And Remainder(x=w8, y=8) -> (floor(x/y)=w9)
  $"bytes to transmit" <- w9
