vi "MAC Enque Requests.gvi"   [LabVIEW NXG 4.0.0]
# Writes requests into RT FIFO reference. Another loop will receive confirmation messages for this request and use the content of the FIFO to compare the confirmations against the requests to detect loss or mismatches in the messages.
inputs:
  "RT FIFO reference": RTFifoRefnum<"Request Information.gtype">  # RT FIFO to write requests into.
  "requests": "Request Information.gtype"[]  # Requests to enque in RT FIFO reference.
  "error in": error
outputs:
  "error out": error
types:
  "Request Information.gtype" = cluster{"message header": "General Message Header.gtype", "SAP sub header": "SAP Sub Header.gtype"}
uses:
  NI::G Core::Error::Build Error Cluster.gvi
diagram:
  s1 = $"error in"  # shift register
  for {
    w1 = each element of $requests
    RTFIFO Write(element=w1, error in=s1, rt fifo=$"RT FIFO reference") -> (error out=w2, timed out?=w3)
    case (w3) {
      frame True {
        call "Build Error Cluster.gvi"(code=-1, description="Enque Tx Request Information failed!", error in=w2) -> (error out=w4)
      }
      frame False {
        w4 = w2
      }
    }
    next s1 = w4
  }
  $"error out" <- s1
