vi "MAC PDU Assembly.gvi"   [LabVIEW NXG 4.0.0]
# Implements a simple MAC PDU assembly.
# IP packed are read from data FIFO in and placed into the MPDU. To be able to disassemble the packets each one is prepended with its size as a unsigned 16-bit value. A packet read from data FIFO is never split. If it does not fit the remaining size of the MPDU it is kept for the next call. The assembly stops at this point and leaves the remaining bytes zero. If a packet does not fit the MPDU as the first packet  it is discarded and IP packets size exceeded turns to True. The assembly also stops if maximum execution time is exceeded. This way the TX chain can ensure that an MPDU is created in time at the cost of an MPDU which is only partially filled with data.
inputs:
  "MAC TX config in": "MAC TX Config.gtype"
  "error in": error
  "data FIFO in": RTFifoRefnum<u8[]>  # Contains array of U8 to be encoded in the MPDU.
  "IP packet count in": u32  # Incoming packet count for statistic purpose of the calling VI.
  "maximal execution time": u32  # Maximum amount of time that the routine is allowed to take. This ensures the assembly finishes in time even if data FIFO in contains many small packets.
outputs:
  "MAC PDU Size": u32
  "MAC PDU": u8[]  # Assembled MPDU.
  "error out": error
  "MAC PDU ready": bool  # Defines whether MAC PDU contains a valid MPDU. In error cases, this indicator turns to False and content of MAC PDU should not be used for further processing.
  "IP Packets size exceeded": u32  # Packet from data FIFO in could not be processed because it is bigger than the size of the MPDU.
  "MAC PDU Size filled": i32  # Fill state of the MPDU in bytes. This could be smaller than the MPDU in case of maximum execution size was exceeded and/or the packet sizes plus the length information do not sum up to the MPDU size.
  "data FIFO out": RTFifoRefnum<u8[]>  # Copy reference of data FIFO in.
  "MAC TX config out": "MAC TX Config.gtype"  # Copy reference of MAC TX config in.
  "IP packet count out": u32  # Outgoing packet counter for statistic purpose. This number is IP packet count in added to the number of packets encoded in the MPDU.
types:
  "MAC TX Config.gtype" = cluster{"SFN": u16, "TTI Index": u8, "RNTI": u16, "CCE Offset": u8, "PRB Allocation": u32, "MCS": u8}
uses:
  AFW::LTE::L1L2 API::Calculate Transport Block Size from PRB Allocation.gvi
  NI::G Core::Error::Is Error.gvi
diagram:
  Property Node(instance in=$"MAC TX config in") -> ("PRB Allocation"=w1, "MCS"=w2, instance out=w3)
  call "Calculate Transport Block Size from PRB Allocation.gvi"(PRB Allocation=w1, MCS=w2) -> (TB Size=w4)
  Feedback Node(input=w5) -> w6
  Array Size(array=w6) -> (size(s)=w7)
  Initialize Array(element=0, size=10240) -> w8
  To Signed 32 Bit Integer(number=w4) -> w9
  Split 1D Array(array=w8, index=w9) -> (first subarray=w10)
  Is Greater Or Equal(x=w9, y=w7) -> w11
  Is Greater Than 0(x=w7) -> w12
  Logical And(w11, w12) -> w13
  case (w13) {
    frame False {
      w14 = w10
      w15 = 0
    }
    frame True {
      Replace Array Subset(inArray=w10, index=0, new=w6) -> w14
      w15 = w7
    }
  }
  sequence {
    frame 0 {
      Tick Count[Units=Microseconds]() -> (timer value=w16)
    }
  }
  s1 = $"data FIFO in"  # shift register
  s2 = $"error in"  # shift register
  s3 = w14  # shift register
  s4 = w15  # shift register
  s5 = $"IP packet count in"  # shift register
  s6 = 0  # shift register
  while {
    RTFIFO Read(element=u8[] [], error in=s2, rt fifo=s1, timeout in ms=0) -> (element out=w17, empty?=w18, error out=w19, rt fifo out=w20)
    Is Empty Array(array=w17) -> w21
    Logical Or(w21, w18) -> w22
    case (w22) {
      frame True {
        # output zero stuffed MAC PDU
        w23 = s3
        w24 = s4
        w25 = TRUE
        w5 = u8[] []
        w26 = s5
        w27 = s6
      }
      frame False {
        Increment(x=s5) -> w26: u32
        To Signed 32 Bit Integer(number=w4) -> w28
        Array Size(array=w17) -> (size(s)=w29)
        Add(2, w29) -> w30
        To Unsigned 16 Bit Integer(number=w29) -> w31
        Split Number(x=w31) -> (high(x)=w32, low(x)=w33)
        Build Array(w32, w33, w17) -> w34
        Is Greater Or Equal(x=w28, y=w30) -> w35
        case (w35) {
          frame False, Default {
            Increment(x=s6) -> w27: u32
            w23 = s3
            w24 = s4
            w25 = FALSE
            w5 = u8[] []
          }
          frame True {
            Add(w30, s4) -> w36
            Is Greater Or Equal(x=w28, y=w36) -> w37
            case (w37) {
              frame False, Default {
                w23 = s3
                w24 = s4
                w5 = w34
                w25 = TRUE
              }
              frame True {
                Replace Array Subset(inArray=s3, index=s4, new=w34) -> w23
                w24 = w36
                w5 = u8[] []
                w25 = FALSE
              }
            }
            w27 = s6
          }
        }
      }
    }
    Is Greater Than 0(x=$"maximal execution time") -> w38
    case (w38) {
      frame False, Default {
        w39 = FALSE
      }
      frame True {
        Tick Count[Units=Microseconds]() -> (timer value=w40)
        Subtract(x=w40, y=w16) -> w41
        Is Greater(x=w41, y=$"maximal execution time") -> w39
      }
    }
    call "Is Error.gvi"(error in=w19) -> (error?=w42)
    Logical Or(w25, w42, w39) -> w43
    next s1 = w20
    next s2 = w19
    next s3 = w23
    next s4 = w24
    next s5 = w26
    next s6 = w27
    stop if w43
  }
  $"data FIFO out" <- s1
  $"MAC TX config out" <- w3
  $"MAC PDU Size" <- w4
  $"IP packet count out" <- s5
  $"MAC PDU" <- s3
  $"MAC PDU Size filled" <- s4
  $"IP Packets size exceeded" <- s6
  $"MAC PDU ready" <- w25
  $"error out" <- s2
