vi "MAC PDU Disassembly.gvi"   [LabVIEW NXG 4.0.0]
# Disassembles MAC PDU and forwards result into FIFO in. It is assumed that MAC PDU contains packets where each packet is prepended with a length information of 16 bytes. Packets do not cross MAC PDU boundaries to ease assembly and disassembly. Disassembly stops if either the end of the packets occurs, the read size is zero, or an error occurs.
inputs:
  "MAC PDU": u8[]  # MAC PDU with arbitrary number of packets in it. Each packet is prepended by a U16 which holds the size of the packet.
  "error in": error
  "FIFO in": RTFifoRefnum<u8[]>  # FIFO reference to receive packets decoded from MAC PDU.
outputs:
  "packets": u16  # Number of packets decoded.
  "bytes": u16  # Number of bytes decoded.
  "error out": error
  "FIFO out": RTFifoRefnum<u8[]>  # Reference copy of FIFO in.
uses:
  NI::G Core::Error::Build Error Cluster.gvi
diagram:
  Array Size(array=$"MAC PDU") -> (size(s)=w1)
  s1 = 0  # shift register
  s2 = 0  # shift register
  s3 = 0  # shift register
  s4 = $"error in"  # shift register
  s5 = $"FIFO in"  # shift register
  while {
    Array Index(array=$"MAC PDU") -> (out0[s1]=w2, out1[_]=w3)
    Join Numbers(high(x)=w2, low(x)=w3) -> w4
    # w4: packet size
    Is Equal To 0(x=w4) -> w5
    # Decodes transport block from MAC PDU and writes result into a RT FIFO.
    # The block contains up to n packets of arbritrary size.
    # Each packet has 2 bytes of length information prepended.
    # Two counters return the number of packets decoded and the overall size of decoded packets.
    # s2: packet counter
    # s3: byte counter
    # s1: decoding offset
    case (w5) {
      frame False, Default {
        Add(2, s1) -> w12
        To Signed 32 Bit Integer(number=w4) -> w13
        Add(w12, w13) -> w14
        Is Less Or Equal(x=w14, y=w1) -> w6
        case (w6) {
          frame False, Default {
            Subtract(x=w1, y=w14) -> w15
            Format Into String(formatString="decoded length (%d) exceeds remaining array size (%d).", errIn=s4, w13, w15) -> (outString=w16, errOut=w17)
            call "Build Error Cluster.gvi"(code=-1, description=w16, error in=w17) -> (error out=w8)
            w7 = w14
            w9 = s3
            w10 = s2
            w11 = s5
          }
          frame True {
            Increment(x=s2) -> w10
            To Unsigned 16 Bit Integer(number=w13) -> w18
            Add(s3, w18) -> w9
            Array Subset(array=$"MAC PDU", index0=w12, length0=w13) -> w19
            RTFIFO Write(element=w19, error in=s4, rt fifo=s5, timeout in ms=0) -> (error out=w8, rt fifo out=w11)
            w7 = w14
          }
        }
      }
      frame True {
        w6 = FALSE
        w7 = s1
        w8 = s4
        w9 = s3
        w10 = s2
        w11 = s5
      }
    }
    Logical Or(not w6, w5) -> w20
    next s1 = w7
    next s2 = w10
    next s3 = w9
    next s4 = w8
    next s5 = w11
    stop if w20
  }
  $packets <- s2
  $bytes <- s3
  $"FIFO out" <- s5
  $"error out" <- s4
