vi "MAC Prepare Tx Config.gvi"   [LabVIEW NXG 4.0.0]
# Creates a MAC TX configuration cluster based on static and dynamic input parameters.
inputs:
  "SFN": u16  # Current subframe number.
  "TTI index": u8  # Current transmission time interval.
  "eNB TX UE Context": T1 = {"RNTI"=10, "Use UERS"=FALSE, "Antenna Port"=7, "CCE Offset"=0}
    # UE-specific parameters for UL transmission.
    # RNTI: The radio network temporary identifier used for PUSCH scrambling.
    # SRS Configuration: The configuration used for transmitting sounding reference signal.
    # SRS Enabled: If True, SRS location is reserved as last symbol in each UL subframe (FDD, TDD) and last 2 symbols in each special subframe (TDD) (according to 3GPP TS 36.211 §5.5.3.3: FDD: srs-SubframeConfig = 0, TDD: srs-SubframeConfig = 7).
    # SRS Subframe Allocation: Bitmap determining the subframes actually used for SRS transmission. Periodicity of 10, leftmost bit represents subframe 0.
    # Transmission Comb: Parameter transmissionComb k_TC determining if even (0) or odd (1) subcarriers are used for SRS transmission/reception. See also 3GPP TS 36.211 §5.5.3.2.
  "eNB TX DCI": "DCI Message.gtype" = {"Active"=TRUE, "MCS"="MCS 17 (64-QAM, rate ~0.43)", "Resource Block Allocation (4 PRB/bit)"=8388607}
  "frame structure": enum{"FDD", "TDD 5 5"} = "FDD"  # Current frame structure.
  "error in": error
outputs:
  "MAC TX Config": "MAC TX Config.gtype"
  "error out": error
types:
  T1 = cluster{"RNTI": u16, "Use UERS": bool, "Antenna Port": UFXP(4.0), "CCE Offset": u8}
  "MAC TX Config.gtype" = cluster{"SFN": u16, "TTI Index": u8, "RNTI": u16, "CCE Offset": u8, "PRB Allocation": u32, "MCS": u8}
  T2 = enum{"MCS 0 (QPSK, rate ~0.12)", "MCS 1 (QPSK, rate ~0.15)", "MCS 2 (QPSK, rate ~0.19)", "MCS 3 (QPSK, rate ~0.25)", "MCS 4 (QPSK, rate ~0.30)", "MCS 5 (QPSK, rate ~0.37)", "MCS 6 (QPSK, rate ~0.44)", "MCS 7 (QPSK, rate ~0.51)", "MCS 8 (QPSK, rate ~0.59)", "MCS 9 (QPSK, rate ~0.66)", "MCS 10 (16-QAM, rate ~0.33)", "MCS 11 (16-QAM, rate ~0.37)", "MCS 12 (16-QAM, rate ~0.42)", "MCS 13 (16-QAM, rate ~0.48)", "MCS 14 (16-QAM, rate ~0.54)", "MCS 15 (16-QAM, rate ~0.60)", "MCS 16 (16-QAM, rate ~0.64)", "MCS 17 (64-QAM, rate ~0.43)", "MCS 18 (64-QAM, rate ~0.46)", "MCS 19 (64-QAM, rate ~0.50)", "MCS 20 (64-QAM, rate ~0.55)", "MCS 21 (64-QAM, rate ~0.60)", "MCS 22 (64-QAM, rate ~0.65)", "MCS 23 (64-QAM, rate ~0.70)", "MCS 24 (64-QAM, rate ~0.75)", "MCS 25 (64-QAM, rate ~0.80)", "MCS 26 (64-QAM, rate ~0.85)", "MCS 27 (64-QAM, rate ~0.89)", "MCS 28 (64-QAM, rate ~0.93)"}
  "DCI Message.gtype" = cluster{"Active": bool, "MCS": T2, "Resource Block Allocation (4 PRB/bit)": UFXP(25.0)}
uses:
  AFW::LTE::L1L2 API::Check UERS MAC PDU Size.gvi
diagram:
  Property Node(instance in=$"eNB TX UE Context") -> ("RNTI"=w1, "CCE Offset"=w2, "Use UERS"=w3)
  Property Node(instance in=$"eNB TX DCI") -> ("MCS"=w4, "Resource Block Allocation (4 PRB/bit)"=w5)
  Type Cast(type=u16 0, x=w4) -> w6
  To Unsigned 8 Bit Integer(number=w6) -> w7
  To Unsigned 32 Bit Integer(number=w5) -> w8
  call "Check UERS MAC PDU Size.gvi"(use UERS=w3, subframe index=$"TTI index", frame structure=$"frame structure", PRB Allocation In=w8) -> (PRB Allocation Out=w9)
  Property Node(instance in="MAC TX Config.gtype" {all zero or empty}, "SFN"=$SFN, "TTI Index"=$"TTI index", "RNTI"=w1, "CCE Offset"=w2, "MCS"=w7, "PRB Allocation"=w9) -> (instance out=w10)
  $"MAC TX Config" <- w10
  $"error out" <- $"error in"
