vi "TTI Counter to SFN and TTI.gvi"   [LabVIEW NXG 4.0.0]
# Adds a subframe number to TTI counter.
inputs:
  "TTI counter": u32  # Current TTI.
  "reset": bool  # Reset SFN counter.
  "error in": error
outputs:
  "SFN": u16  # Generated SFN.
  "TTI": u8  # TTI converted to U8.
  "error out": error
diagram:
  w1 = 1024  # max num SFN
  Is Equal To 0(x=$"TTI counter") -> w2
  Boolean To 0 Or 1(Boolean=w2) -> (0, 1=w3)
  To Unsigned 16 Bit Integer(number=w3) -> w4
  Feedback Node(initial value=0, input=w5) -> w6
  Add(w6, w4) -> w7
  Quotient And Remainder(x=w7, y=w1) -> (x-y*floor(x/y)=w8)
  Select(s=$reset, t=0, f=w8) -> w5
  $SFN <- w8
  To Unsigned 8 Bit Integer(number=$"TTI counter") -> w9
  $TTI <- w9
  $"error out" <- $"error in"
