vi "Receice PDSCH Decoding Status.gvi"   [LabVIEW NXG 4.0.0]
inputs:
  "session": "Host Session.gtype"
  "error in": error
outputs:
  "PDSCH Decoding Status valid": bool
  "PDSCH Decoding Status": u32
  "Max PDSCH Decoding Status remaining": u32
  "error out": error
types:
  "Transport Session.gtype" = cluster{"FIFO pathname": string, "pipe reader": "Pipe Reader.gtype", "pipe writer": "Pipe Writer.gtype", "transport in RT FIFO": RTFifoRefnum<u8[]>, "transport out RT FIFO": RTFifoRefnum<u8[]>, "transport in timing source name": string, "transport in timing trigger ID": u8, "transport out timing source name": string, "transport out timing trigger ID": u8, "maximum API message size": u32}
  "Register Bus Session.gtype" = Queue<"Session Data.gtype">
  "Semaphore.gtype" = i32
  "DB Queue Reference.gtype" = Queue<"Daughterboard Data.gtype">
  "niUsrpRio Session.gtype" = cluster{"FPGA Interface": any, "RIO Interface Number": u32, "Data Clock Rate": u32, "FPGA Data Clock Rate": u32, "Global Settings Register Bus": "Register Bus Session.gtype", "Radio 0 Settings Register Bus": "Register Bus Session.gtype", "Radio 1 Settings Register Bus": "Register Bus Session.gtype", "Radio Settings Bus Semaphore": "Semaphore.gtype", "DB Queues": "DB Queue Reference.gtype"[], "Characterization Data Valid?": bool, "EEPROM Header": "EEPROM Header.gtype", "Device Data Header": "EEPROM Device Data Header.gtype", "EEPROM Characterization Header": "EEPROM Characterization Header.gtype", "Characterization Data": "Characterization Data.gtype"[], "FPGA Current Version": u32, "FPGA Oldest Compatible Version": u32, "Fixed Logic Current Version": u32, "Fixed Logic Oldest Compatible Version": u32, "FPGA Radio Settings Bus Current Version": u32, "FPGA Radio Settings Bus Oldest Compatible Version": u32, "FPGA Board Config Current Version": u32, "FPGA Board Config Oldest Compatible Version": u32, "Daughterboard Clock Rate": u32}
  T1 = cluster{"FPGA ref": any, "bus instance": u32, "instruction FIFO depth": u32, "executing on FPGA target": bool, "show error call chain": bool}
  T2 = cluster{"Actual Gain [dB]": f64, "Attenuation Table Index": i32}
  T3 = cluster{"Attenuation Table [dB]": f64[][], "Frequencies [Hz]": f64[], "IQ Imbalance Table": "IQ Imbalance.gtype"[], "Gain Table": T2[][]}
  T4 = cluster{"FlexRIO Register Bus": Queue<T1>, "RX Characterization Data": T3, "TX Characterization Data": T3, "FPGA Interface": any}
  T5 = cluster{"transport block size": u32, "CRC ok": bool, "user data": u32}
  "Link Direction.gtype" = enum{"DL", "UL"}
  T6 = cluster{"MAC Stub RX Payload Information FIFO": RTFifoRefnum<"MAC Stub RX Payload Information.gtype">, "MAC Stub RX Confirmation Information FIFO": RTFifoRefnum<u64[16]>, "MAC Stub RX UL Payload Information FIFO": RTFifoRefnum<f64[23]>}
  T7 = cluster{"MAC Stub TX Input Terminals FIFO": RTFifoRefnum<"MAC Stub TX Input Terminals.gtype">, "MAC Stub TX Output Terminals FIFO": RTFifoRefnum<"MAC Stub TX Output Terminals.gtype">}
  T8 = cluster{"MAC Stub RX Interface": T6, "MAC Stub TX Interface": T7}
  "Host Session.gtype" = cluster{"target": enum{"USRP", "FlexRIO"}, "real time mode": bool, "MAC Stub enabled": bool, "DMA FIFO read timeout": i32, "timed loop period": i64, "LTE Transport Sessions": "Transport Session.gtype"[], "USRP session": "niUsrpRio Session.gtype", "FlexRIO session": T4, "UDP RX session": UdpNetworkConnectionRefnum, "UDP TX session": UdpNetworkConnectionRefnum, "sync found FIFO": RTFifoRefnum<bool>, "PDCCH CRC OK FIFO": RTFifoRefnum<bool>, "DL PDCCH status FIFO": RTFifoRefnum<cluster{"CRC ok": bool, "subframe number": u32}>, "DL PDSCH status FIFO": RTFifoRefnum<cluster{"CRC ok": bool, "subframe number": u32}>, "DL SINR FIFO": RTFifoRefnum<f64[]>, "PDSCH user data FIFO": RTFifoRefnum<u32>, "PDSCH user data UDP FIFO": RTFifoRefnum<T5>, "PDSCH user data throughput FIFO": RTFifoRefnum<T5>, "PUSCH user data FIFO": RTFifoRefnum<u32>, "PUSCH user data UDP FIFO": RTFifoRefnum<T5>, "PUSCH user data throughput FIFO": RTFifoRefnum<T5>, "UE feedback info FIFO": RTFifoRefnum<u8[]>, "Request information FIFO": RTFifoRefnum<"Request Information.gtype">, "UDP TX outbound FIFO": RTFifoRefnum<u8[]>, "UDP RX inbound FIFO": RTFifoRefnum<u8[]>, "stop notifier": Notifier<string>, "DL RX scope": string, "UL RX scope": string, "external MAC log file": string, "external MAC process ID": u32, "TX link direction": "Link Direction.gtype", "RX link direction": "Link Direction.gtype", "Sychronization FIFO": RTFifoRefnum<i32>, "RT Loop Interfaces": T8}
uses:
  AFW::LTE::RF Control::Unbundle Session.gvi
  NI::G Core::Error::Filter Error Code.gvi
diagram:
  Property Node(instance in=$session) -> ("DMA FIFO read timeout"=w1)
  call "Unbundle Session.gvi"(session=$session) -> (DL FPGA Interface=w2)
  Host Fifo Read Node[FifoName="AFW::LTE::Resources::LTE AFW Resources.grsc::T2H PDSCH Decoding Status"](error in=$"error in", number of elements=1, reference in=w2, timeout (ms)=w1) -> (data=w3, elements remaining=w4, error out=w5)
  Array Index(array=w3) -> (out0[_]=w6)
  $"PDSCH Decoding Status" <- w6
  Array Size(array=w3) -> (size(s)=w7)
  Is Greater Than 0(x=w7) -> w8
  case (w8) {
    frame False {
      w12 = -50400  # timeout error
      call "Filter Error Code.gvi"(code to clear=w12, error in=w5) -> (error out=w9)
      w10 = FALSE
      w11 = 0
    }
    frame True {
      w9 = w5
      w10 = TRUE
      w11 = w4
    }
  }
  $"PDSCH Decoding Status valid" <- w10
  $"error out" <- w9
  To Unsigned 32 Bit Integer(number=w11) -> w13
  Feedback Node(initial value=0, input=w14) -> w15
  Max And Min(x=w13, y=w15) -> (max(x,y)=w14: u32)
  $"Max PDSCH Decoding Status remaining" <- w14
