vi "Receive Timing Indication RT.gvi"   [LabVIEW NXG 4.0.0]
# Reads timing indication from DMA FIFO. This routine supports blocking as well as polling read. The read method is configured via session.
# The VI assumes it is invoked such that it reads no more than one indication. If there are more indications in the DMA an error is raised which assuming the VI was called too late to receive all indications in time.
inputs:
  "session": "Host Session.gtype"
  "error in": error
  "eNB TX Active": bool = TRUE
outputs:
  "error out": error
  "subframe index": u32  # Subframe index read from timing indication.
  "subframe index valid": bool  # Timing indication was read successful and subframe index is valid.
types:
  "Transport Session.gtype" = cluster{"FIFO pathname": string, "pipe reader": "Pipe Reader.gtype", "pipe writer": "Pipe Writer.gtype", "transport in RT FIFO": RTFifoRefnum<u8[]>, "transport out RT FIFO": RTFifoRefnum<u8[]>, "transport in timing source name": string, "transport in timing trigger ID": u8, "transport out timing source name": string, "transport out timing trigger ID": u8, "maximum API message size": u32}
  "Register Bus Session.gtype" = Queue<"Session Data.gtype">
  "Semaphore.gtype" = i32
  "DB Queue Reference.gtype" = Queue<"Daughterboard Data.gtype">
  "niUsrpRio Session.gtype" = cluster{"FPGA Interface": any, "RIO Interface Number": u32, "Data Clock Rate": u32, "FPGA Data Clock Rate": u32, "Global Settings Register Bus": "Register Bus Session.gtype", "Radio 0 Settings Register Bus": "Register Bus Session.gtype", "Radio 1 Settings Register Bus": "Register Bus Session.gtype", "Radio Settings Bus Semaphore": "Semaphore.gtype", "DB Queues": "DB Queue Reference.gtype"[], "Characterization Data Valid?": bool, "EEPROM Header": "EEPROM Header.gtype", "Device Data Header": "EEPROM Device Data Header.gtype", "EEPROM Characterization Header": "EEPROM Characterization Header.gtype", "Characterization Data": "Characterization Data.gtype"[], "FPGA Current Version": u32, "FPGA Oldest Compatible Version": u32, "Fixed Logic Current Version": u32, "Fixed Logic Oldest Compatible Version": u32, "FPGA Radio Settings Bus Current Version": u32, "FPGA Radio Settings Bus Oldest Compatible Version": u32, "FPGA Board Config Current Version": u32, "FPGA Board Config Oldest Compatible Version": u32, "Daughterboard Clock Rate": u32}
  T1 = cluster{"FPGA ref": any, "bus instance": u32, "instruction FIFO depth": u32, "executing on FPGA target": bool, "show error call chain": bool}
  T2 = cluster{"Actual Gain [dB]": f64, "Attenuation Table Index": i32}
  T3 = cluster{"Attenuation Table [dB]": f64[][], "Frequencies [Hz]": f64[], "IQ Imbalance Table": "IQ Imbalance.gtype"[], "Gain Table": T2[][]}
  T4 = cluster{"FlexRIO Register Bus": Queue<T1>, "RX Characterization Data": T3, "TX Characterization Data": T3, "FPGA Interface": any}
  T5 = cluster{"transport block size": u32, "CRC ok": bool, "user data": u32}
  "Link Direction.gtype" = enum{"DL", "UL"}
  T6 = cluster{"MAC Stub RX Payload Information FIFO": RTFifoRefnum<"MAC Stub RX Payload Information.gtype">, "MAC Stub RX Confirmation Information FIFO": RTFifoRefnum<u64[16]>, "MAC Stub RX UL Payload Information FIFO": RTFifoRefnum<f64[23]>}
  T7 = cluster{"MAC Stub TX Input Terminals FIFO": RTFifoRefnum<"MAC Stub TX Input Terminals.gtype">, "MAC Stub TX Output Terminals FIFO": RTFifoRefnum<"MAC Stub TX Output Terminals.gtype">}
  T8 = cluster{"MAC Stub RX Interface": T6, "MAC Stub TX Interface": T7}
  "Host Session.gtype" = cluster{"target": enum{"USRP", "FlexRIO"}, "real time mode": bool, "MAC Stub enabled": bool, "DMA FIFO read timeout": i32, "timed loop period": i64, "LTE Transport Sessions": "Transport Session.gtype"[], "USRP session": "niUsrpRio Session.gtype", "FlexRIO session": T4, "UDP RX session": UdpNetworkConnectionRefnum, "UDP TX session": UdpNetworkConnectionRefnum, "sync found FIFO": RTFifoRefnum<bool>, "PDCCH CRC OK FIFO": RTFifoRefnum<bool>, "DL PDCCH status FIFO": RTFifoRefnum<cluster{"CRC ok": bool, "subframe number": u32}>, "DL PDSCH status FIFO": RTFifoRefnum<cluster{"CRC ok": bool, "subframe number": u32}>, "DL SINR FIFO": RTFifoRefnum<f64[]>, "PDSCH user data FIFO": RTFifoRefnum<u32>, "PDSCH user data UDP FIFO": RTFifoRefnum<T5>, "PDSCH user data throughput FIFO": RTFifoRefnum<T5>, "PUSCH user data FIFO": RTFifoRefnum<u32>, "PUSCH user data UDP FIFO": RTFifoRefnum<T5>, "PUSCH user data throughput FIFO": RTFifoRefnum<T5>, "UE feedback info FIFO": RTFifoRefnum<u8[]>, "Request information FIFO": RTFifoRefnum<"Request Information.gtype">, "UDP TX outbound FIFO": RTFifoRefnum<u8[]>, "UDP RX inbound FIFO": RTFifoRefnum<u8[]>, "stop notifier": Notifier<string>, "DL RX scope": string, "UL RX scope": string, "external MAC log file": string, "external MAC process ID": u32, "TX link direction": "Link Direction.gtype", "RX link direction": "Link Direction.gtype", "Sychronization FIFO": RTFifoRefnum<i32>, "RT Loop Interfaces": T8}
uses:
  AFW::LTE::RF Control::Unbundle Session.gvi
  NI::G Core::Error::Filter Error Code.gvi
  NI::G Core::Error::Build Error Cluster.gvi
diagram:
  Feedback Node(input=$"eNB TX Active") -> w1
  Logical And($"eNB TX Active", not w1) -> w2
  Property Node(instance in=$session) -> ("DMA FIFO read timeout"=w3)
  call "Unbundle Session.gvi"(session=$session) -> (DL FPGA Interface=w4)
  case (w2) {
    frame True {
      # empty Timing Indication FIFO on initial read
      Host Fifo Read Node[FifoName="AFW::LTE::Resources::LTE AFW Resources.grsc::T2H Timing Indication"](error in=$"error in", number of elements=0, reference in=w4, timeout (ms)=w3) -> (elements remaining=w8, error out=w9, reference out=w10)
      Host Fifo Read Node[FifoName="AFW::LTE::Resources::LTE AFW Resources.grsc::T2H Timing Indication"](error in=w9, number of elements=w8, reference in=w10, timeout (ms)=0) -> (data=w5, elements remaining=w7, error out=w6)
    }
    frame False {
      # read Timing Indication every TTI from FPGA
      Host Fifo Read Node[FifoName="AFW::LTE::Resources::LTE AFW Resources.grsc::T2H Timing Indication"](error in=$"error in", number of elements=1, reference in=w4, timeout (ms)=w3) -> (data=w5, elements remaining=w7, error out=w6)
    }
  }
  Array Size(array=w5) -> (size(s)=w11)
  Is Greater Than 0(x=w11) -> w12
  case (w12) {
    frame False {
      w16 = -50400  # timeout error
      call "Filter Error Code.gvi"(code to clear=w16, error in=w6) -> (error out=w13)
      w14 = FALSE
      w15 = 255
    }
    frame True {
      Decrement(x=w11) -> w17
      Array Index(array=w5) -> (out0[w17]=w15)
      Is Equal To 0(x=w7) -> w18
      case (w18) {
        frame False, Default {
          call "Build Error Cluster.gvi"(code=-1, description="Timing Indication missed", error in=w6) -> (error out=w13)
          w14 = FALSE
        }
        frame True {
          w13 = w6
          w14 = TRUE
        }
      }
    }
  }
  $"subframe index" <- w15
  $"subframe index valid" <- w14
  $"error out" <- w13
