vi "Calculate SNR.gvi"   [LabVIEW NXG 4.0.0]
# Calculates wideband and sub-band signal-to-noise ratio (SNR) for one subframe, based on estimated channel coefficients.
# The remaining channel estimate (CE) samples are stored for the SNR calculation of the next subframe.
# SNR values are written in a queue.
inputs:
  "CE samples in": c128[]  # Estimated channel coefficients. These coefficients are estimated with cell-specific or user equipment (UE)-specific reference symbols.
  "timing indices": T1[]  # Timing information for CE samples in.
  "session": "Host Session.gtype"
  "use UERS": bool  # If TRUE, UERS based channel estimates are used, else CRS based channel estimates
  "subframe index array": u8[]  # Array containing the subframes numbers of the received channel coefficients.
outputs:
  "subband SNR": f64[]  # Array of SNR values, in dB, for all 13 sub-bands of eight physical resource blocks. The last sub-band contains only four resource blocks.
  "wideband SNR": f64  # Scalar wideband SNR, in dB.
types:
  T1 = cluster{"symbol index (0-13)": u8, "RB index (0-99)": u8, "subframe index (0-9)": u8, "subcarrier index (0-11)": u8, "UERS": bool}
  "Transport Session.gtype" = cluster{"FIFO pathname": string, "pipe reader": "Pipe Reader.gtype", "pipe writer": "Pipe Writer.gtype", "transport in RT FIFO": RTFifoRefnum<u8[]>, "transport out RT FIFO": RTFifoRefnum<u8[]>, "transport in timing source name": string, "transport in timing trigger ID": u8, "transport out timing source name": string, "transport out timing trigger ID": u8, "maximum API message size": u32}
  "Register Bus Session.gtype" = Queue<"Session Data.gtype">
  "Semaphore.gtype" = i32
  "DB Queue Reference.gtype" = Queue<"Daughterboard Data.gtype">
  "niUsrpRio Session.gtype" = cluster{"FPGA Interface": any, "RIO Interface Number": u32, "Data Clock Rate": u32, "FPGA Data Clock Rate": u32, "Global Settings Register Bus": "Register Bus Session.gtype", "Radio 0 Settings Register Bus": "Register Bus Session.gtype", "Radio 1 Settings Register Bus": "Register Bus Session.gtype", "Radio Settings Bus Semaphore": "Semaphore.gtype", "DB Queues": "DB Queue Reference.gtype"[], "Characterization Data Valid?": bool, "EEPROM Header": "EEPROM Header.gtype", "Device Data Header": "EEPROM Device Data Header.gtype", "EEPROM Characterization Header": "EEPROM Characterization Header.gtype", "Characterization Data": "Characterization Data.gtype"[], "FPGA Current Version": u32, "FPGA Oldest Compatible Version": u32, "Fixed Logic Current Version": u32, "Fixed Logic Oldest Compatible Version": u32, "FPGA Radio Settings Bus Current Version": u32, "FPGA Radio Settings Bus Oldest Compatible Version": u32, "FPGA Board Config Current Version": u32, "FPGA Board Config Oldest Compatible Version": u32, "Daughterboard Clock Rate": u32}
  T2 = cluster{"FPGA ref": any, "bus instance": u32, "instruction FIFO depth": u32, "executing on FPGA target": bool, "show error call chain": bool}
  T3 = cluster{"Actual Gain [dB]": f64, "Attenuation Table Index": i32}
  T4 = cluster{"Attenuation Table [dB]": f64[][], "Frequencies [Hz]": f64[], "IQ Imbalance Table": "IQ Imbalance.gtype"[], "Gain Table": T3[][]}
  T5 = cluster{"FlexRIO Register Bus": Queue<T2>, "RX Characterization Data": T4, "TX Characterization Data": T4, "FPGA Interface": any}
  T6 = cluster{"transport block size": u32, "CRC ok": bool, "user data": u32}
  "Link Direction.gtype" = enum{"DL", "UL"}
  T7 = cluster{"MAC Stub RX Payload Information FIFO": RTFifoRefnum<"MAC Stub RX Payload Information.gtype">, "MAC Stub RX Confirmation Information FIFO": RTFifoRefnum<u64[16]>, "MAC Stub RX UL Payload Information FIFO": RTFifoRefnum<f64[23]>}
  T8 = cluster{"MAC Stub TX Input Terminals FIFO": RTFifoRefnum<"MAC Stub TX Input Terminals.gtype">, "MAC Stub TX Output Terminals FIFO": RTFifoRefnum<"MAC Stub TX Output Terminals.gtype">}
  T9 = cluster{"MAC Stub RX Interface": T7, "MAC Stub TX Interface": T8}
  "Host Session.gtype" = cluster{"target": enum{"USRP", "FlexRIO"}, "real time mode": bool, "MAC Stub enabled": bool, "DMA FIFO read timeout": i32, "timed loop period": i64, "LTE Transport Sessions": "Transport Session.gtype"[], "USRP session": "niUsrpRio Session.gtype", "FlexRIO session": T5, "UDP RX session": UdpNetworkConnectionRefnum, "UDP TX session": UdpNetworkConnectionRefnum, "sync found FIFO": RTFifoRefnum<bool>, "PDCCH CRC OK FIFO": RTFifoRefnum<bool>, "DL PDCCH status FIFO": RTFifoRefnum<cluster{"CRC ok": bool, "subframe number": u32}>, "DL PDSCH status FIFO": RTFifoRefnum<cluster{"CRC ok": bool, "subframe number": u32}>, "DL SINR FIFO": RTFifoRefnum<f64[]>, "PDSCH user data FIFO": RTFifoRefnum<u32>, "PDSCH user data UDP FIFO": RTFifoRefnum<T6>, "PDSCH user data throughput FIFO": RTFifoRefnum<T6>, "PUSCH user data FIFO": RTFifoRefnum<u32>, "PUSCH user data UDP FIFO": RTFifoRefnum<T6>, "PUSCH user data throughput FIFO": RTFifoRefnum<T6>, "UE feedback info FIFO": RTFifoRefnum<u8[]>, "Request information FIFO": RTFifoRefnum<"Request Information.gtype">, "UDP TX outbound FIFO": RTFifoRefnum<u8[]>, "UDP RX inbound FIFO": RTFifoRefnum<u8[]>, "stop notifier": Notifier<string>, "DL RX scope": string, "UL RX scope": string, "external MAC log file": string, "external MAC process ID": u32, "TX link direction": "Link Direction.gtype", "RX link direction": "Link Direction.gtype", "Sychronization FIFO": RTFifoRefnum<i32>, "RT Loop Interfaces": T9}
uses:
  AFW::LTE::SNR::Calculate Subframe SNR.gvi
diagram:
  # collect at least 40k data samples
  # before calling subVI to calculate SNR
  Property Node(instance in=$session) -> ("DL SINR FIFO"=w1)
  Feedback Node(initial value=T1[] [], input=w2) -> w3
  Build Array(w3, $"timing indices") -> w4
  Feedback Node(initial value=u8[] [], input=w5) -> w6
  Build Array(w6, $"subframe index array") -> w7
  Feedback Node(initial value=c128[] [], input=w8) -> w9
  Build Array(w9, $"CE samples in") -> w10
  Array Size(array=w7) -> (size(s)=w11)
  Is Greater Or Equal(x=w11, y=40000) -> w12
  case (w12) {
    frame False, Default {
      w13 = default
      w14 = default
      w15 = default
      w16 = default
      w17 = default
      w18 = default
      w2 = w4
      w5 = w7
      w8 = w10
    }
    frame True {
      Subtract(x=w11, y=40000) -> w19
      # use the latest 40k data
      # samples to calculate SNR
      Array Subset(array=w4, index0=w19, length0=40000) -> w20
      # search for tti=5
      # after tti=4, to make
      # sure tti=5 is complete
      Array Subset(array=w10, index0=w19, length0=40000) -> w21
      # cut out data of 5 TTIs
      Array Subset(array=w7, index0=w19, length0=40000) -> w22
      Search 1D Array(1D array=w22, element=4, start index (0)=0) -> (index of element=w23)
      Search 1D Array(1D array=w22, element=5, start index (0)=w23) -> (index of element=w24)
      # check given data for continuity (switch
      # from TTI 9 to TTI 0 at right index)
      Add(w24, 10000) -> w25
      Decrement(x=w25) -> w26
      Array Index(array=w22) -> (out0[w26]=w27, out1[_]=w28)
      Is Equal(x=9, y=w27) -> w29
      Is Equal(x=w28, y=0) -> w30
      Logical And(w29, w30) -> w31
      case (w31) {
        frame False, Default {
          w13 = default
          w14 = default
          w15 = default
          w16 = default
          w17 = default
          w18 = default
        }
        frame True {
          Array Subset(array=w20, index0=w24, length0=10000) -> w32
          Array Subset(array=w21, index0=w24, length0=10000) -> w33
          s1 = [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]  # shift register
          s2 = [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]  # shift register
          s3 = 0  # shift register
          s4 = 0  # shift register
          for {
            w34 = each element of w32
            w35 = each element of w33
            Property Node(instance in=w34) -> ("UERS"=w36)
            case (w36) {
              frame False, Default {
                Replace Array Subset(inArray=s1, index=s3, new=w35) -> w38
                Increment(x=s3) -> w39
                w37 = s2
                w40 = s4
              }
              frame True {
                Replace Array Subset(inArray=s2, index=s4, new=w35) -> w37
                Increment(x=s4) -> w40
                w38 = s1
                w39 = s3
              }
            }
            next s1 = w38
            next s2 = w37
            next s3 = w39
            next s4 = w40
          }
          call "Calculate Subframe SNR.gvi"(CE samples in=s2, RS per PRB=3) -> (subband SNR out [dB]=w13, SNR valid=w18, wideband SNR out [dB]=w16)
          call "Calculate Subframe SNR.gvi"(CE samples in=s1, RS per PRB=2) -> (subband SNR out [dB]=w14, SNR valid=w15, wideband SNR out [dB]=w17)
        }
      }
      w2 = T1[] []
      w5 = u8[] []
      w8 = c128[] []
    }
  }
  Select(s=$"use UERS", t=w18, f=w15) -> w41
  Feedback Node(enable?=w18, initial value=f64[] [], input=w13) -> w42
  Feedback Node(enable?=w15, initial value=f64[] [], input=w14) -> w43
  Select(s=$"use UERS", t=w42, f=w43) -> w44
  Feedback Node(enable?=w18, initial value=0, input=w16) -> w45
  Feedback Node(enable?=w15, initial value=0, input=w17) -> w46
  Select(s=$"use UERS", t=w45, f=w46) -> w47
  Build Array(w44, w47) -> w48
  case (w41) {
    frame False, Default { }
    frame True {
      RTFIFO Write(element=w48, rt fifo=w1)
    }
  }
  $"subband SNR" <- w44
  $"wideband SNR" <- w47
