vi "Calculate Signal and Noise Power.gvi"   [LabVIEW NXG 4.0.0]
# Calculates signal power and noise power from the the noisy least squares channel-estimate values for one sub-band.
# The signal portion of the channel estimates is extracted by low-pass filtering. The noise portion of the signal is calculated by subtracting the extracted signal from the original estimates.
# Signal and noise power are accumulated for the given sub-band.
inputs:
  "subband channel estimates": c128[]  # Noisy least squares channel estimate values for one sub-band.
outputs:
  "signal power": f64  # Accumulated signal power for the given sub-band.
  "noise power": f64  # Accumulated noise power for the given sub-band.
types:
  "Filter Structure.gtype" = u32
  "Filter.gtype" = cluster{"filter structure": "Filter Structure.gtype", "forward coefficients": f64[], "reverse coefficients": f64[], "sampling frequency": f64}
uses:
  NI::Analysis::Filtering::Filtering (CDB).gvi
diagram:
  w1 = [0, -0.061235467, 0, 0.306177333, 0.510116268, 0.306177333, 0, -0.061235467, 0]
  w2 = "Filter.gtype" {"filter structure"=3, "forward coefficients"=[], "reverse coefficients"=[], "sampling frequency"=0}
  Property Node(instance in=w2, "filter structure"="FIR"(3), "forward coefficients"=w1, "sampling frequency"=1) -> (instance out=w3)
  Array Index(array=$"subband channel estimates") -> (out0[0]=w4)
  Build Array(w4, w4, w4, w4) -> w5
  Array Size(array=$"subband channel estimates") -> (size(s)=w6)
  Decrement(x=w6) -> w7
  Array Index(array=$"subband channel estimates") -> (out0[w7]=w8)
  Build Array(w8, w8, w8, w8) -> w9
  Build Array(w5, $"subband channel estimates", w9) -> w10
  call "Filtering (CDB).gvi"(signal=w10, filter=w3) -> (filtered signal=w11)
  Array Subset(array=w11, index0=8) -> w12
  Subtract(x=$"subband channel estimates", y=w12) -> w13
  Absolute Value(x=w13) -> w14
  Square(x=w14) -> w15
  Add Array Elements(numeric array=w15) -> (sum=w16)
  $"noise power" <- w16
  Absolute Value(x=w12) -> w17
  Square(x=w17) -> w18
  Add Array Elements(numeric array=w18) -> (sum=w19)
  $"signal power" <- w19
