vi "Calculate Subframe SNR.gvi"   [LabVIEW NXG 4.0.0]
# Calculates the wideband and sub-band signal-to-noise ratio (SNR) for one subframe, based on estimated channel coefficients.
inputs:
  "CE samples in": c128[]  # Estimated channel coefficients. The esimates are calculated using cell-specific or UE-specific reference symbols.
  "RS per PRB": i32 = 2  # Number of reference symbols per physical resource block.
outputs:
  "CE samples out": c128[]  # Remaining estimated channel coefficients that were not part of the calculated subframe.
  "subband SNR out [dB]": f64[]  # Array of signal-to-noise ratio (SNR) values, in dB, for all 13 sub-bands of eight physical resource blocks. The last sub-band contains only 4 resource blocks.
  "SNR valid": bool  # Valid signal for wideband and sub-band signal-to-noise ratio (SNR) output values.
  "wideband SNR out [dB]": f64  # Scalar wideband signal-to-noise ratio (SNR), in dB.
uses:
  AFW::LTE::SNR::Calculate Signal and Noise Power.gvi
  AFW::LTE::SNR::Map Raw SNR to Unbiased Estimates.gvi
diagram:
  Array Size(array=$"CE samples in") -> (size(s)=w1)
  w2 = 5  # DL subframes for averaging
  w3 = 4  # RS symbols per SF
  w4 = 100  # num PRBs
  Multiply(w4, $"RS per PRB") -> w5
  Multiply(w3, w5) -> w6
  Multiply(w2, w6) -> w7
  Is Greater Or Equal(x=w1, y=w7) -> w8
  $"SNR valid" <- w8
  Multiply(w4, $"RS per PRB") -> w9
  w10 = 8  # subband size
  Multiply(w10, $"RS per PRB") -> w11
  # w9: RE per symbol
  # w11: RE per subband
  case (w8) {
    frame False, Default {
      w12 = $"CE samples in"
      w13 = default
      w14 = default
    }
    frame True {
      Array Size(array=$"CE samples in") -> (size(s)=w15)
      Quotient And Remainder(x=w15, y=w7) -> (floor(x/y)=w16)
      Decrement(x=w16) -> w17
      Multiply(w17, w7) -> w18
      # delete older data, only work on last full subframe
      Delete From Array(inArray=$"CE samples in", length (1)=w18, index0=0) -> w19
      Delete From Array(inArray=w19, length (1)=w7, index0=0) -> (outArray=w12, deleted=w20)
      s1 = w20  # shift register
      while {
        # SNR per symbol
        Delete From Array(inArray=s1, length (1)=w9, index0=0) -> (outArray=w23, deleted=w24)
        Is Empty Array(array=w23) -> w25
        s2 = w24  # shift register
        while (after $"RS per PRB") {
          # SINR per subband
          Delete From Array(inArray=s2, length (1)=w11, index0=0) -> (outArray=w28, deleted=w29)
          Is Empty Array(array=w28) -> w30
          call "Calculate Signal and Noise Power.gvi"(subband channel estimates=w29) -> (signal power=w31, noise power=w32)
          append w31 to w26
          append w32 to w27
          next s2 = w28
          stop if w30
        }
        append w26 to w21
        append w27 to w22
        next s1 = w23
        stop if w25
      }
      Transpose 2D Array(2D array=w21) -> (transposed array=w33)
      Transpose 2D Array(2D array=w22) -> (transposed array=w34)
      s3 = 0  # shift register
      s4 = 0  # shift register
      for {
        w35 = each element of w33
        w36 = each element of w34
        Add Array Elements(numeric array=w35) -> (sum=w37)
        # average over 1 SF
        Add(s3, w37) -> w38
        Add Array Elements(numeric array=w36) -> (sum=w39)
        Add(s4, w39) -> w40
        Divide(x=w38, y=w40) -> w41
        Logarithm Base 10(x=w41) -> w42
        Multiply(w42, 10) -> w43
        call "Map Raw SNR to Unbiased Estimates.gvi"(raw SNR=w43) -> (unbiased estimate=w14)
        Divide(x=w37, y=w39) -> w44
        Logarithm Base 10(x=w44) -> w45
        Multiply(w45, 10) -> w46
        call "Map Raw SNR to Unbiased Estimates.gvi"(raw SNR=w46) -> (unbiased estimate=w47)
        append w47 to w13
        next s3 = w38
        next s4 = w40
      }
    }
  }
  $"CE samples out" <- w12
  $"wideband SNR out [dB]" <- w14
  $"subband SNR out [dB]" <- w13
