vi "Map Raw SNR to Unbiased Estimates.gvi"   [LabVIEW NXG 4.0.0]
# Applies linear approximated calibration values on raw biased SNR estimates.
inputs:
  "raw SNR": f64  # Raw biased signal-to-noise ratio (SNR) estimates, in dB.
outputs:
  "unbiased estimate": f64  # Unbiased signal-to-noise ratio (SNR) estimates after applying calibration values, in dB.
diagram:
  Is Less(x=$"raw SNR", y=6) -> w1
  case (w1) {
    frame True {
      Multiply(1.8, $"raw SNR") -> w3
      Subtract(x=w3, y=10.2) -> w2
    }
    frame False {
      Multiply(1.1, $"raw SNR") -> w4
      Subtract(x=w4, y=6) -> w2
    }
  }
  # apply calibration values
  Multiply(0.93, w2) -> w5
  Subtract(x=w5, y=1.65) -> w6
  Add(w6, 2.8) -> w7
  In Range And Coerce[IncludeHighLimit=True](lower limit=-6, upper limit=30, x=w7) -> (coerced(x)=w8)
  $"unbiased estimate" <- w8
