vi "Check UDP Port In Use.gvi"   [LabVIEW NXG 4.0.0]
# Checks the error wire for “UDP port already in use” (error code 60) displays a message and clears the error.
inputs:
  "error in": error
outputs:
  "error out": error
uses:
  NI::G Core::Error::Filter Error Code.gvi
diagram:
  call "Filter Error Code.gvi"(code to clear=60, error in=$"error in") -> (error cleared?=w1, error out=w2)
  $"error out" <- w2
  case (w1) {
    frame False, Default { }
    frame True {
      w3 = "The specified \"UDP Receive Port\" is already in use. Select an available port."
      One Button Dialog(message=w3)
    }
  }
