vi "Receive UDP Data.gvi"   [LabVIEW NXG 4.0.0]
# Reads an array of bytes from a UDP socket and writes that data onto the FPGA as PDSCH payload data.
# Only multiples of 4 bytes are written to the FPGA, because all the 32 bit written to the FPGA are intepreted as payload information. The remaining data is provided as an output and is stored in a shift register of the calling loop.
inputs:
  "session": "Host Session.gtype"
  "eNB TX active": bool  # A Boolean that indicates whether the eNodeB transmitter is active. Data is read from the UDP socket only if the transmitter is enabled.
  "UDP packet counter in": u32  # Counter value of the number of packets received, from the previous execution of this node.
  "error in": error
outputs:
  "FIFO full": bool  # A Boolean that indicates whether an overflow occurred of the host-to-target FIFO used for the data transfer to the FPGA.
  "data transfer": bool  # A Boolean that indicates whether data is received from the UDP socket. If this output is False, no data is provided to the FPGA, which fills the PUSCH payload with zeros instead.
  "UDP packet counter out": u32  # Counter value of the number of packets received, from the current execution of this node.
  "error out": error
  "num packets dropped": u32  # Counter value of the number of packets dropped.
panel indicators:
  "Rxy": f64[]
  "output array": u8[]
types:
  "Transport Session.gtype" = cluster{"FIFO pathname": string, "pipe reader": "Pipe Reader.gtype", "pipe writer": "Pipe Writer.gtype", "transport in RT FIFO": RTFifoRefnum<u8[]>, "transport out RT FIFO": RTFifoRefnum<u8[]>, "transport in timing source name": string, "transport in timing trigger ID": u8, "transport out timing source name": string, "transport out timing trigger ID": u8, "maximum API message size": u32}
  "Register Bus Session.gtype" = Queue<"Session Data.gtype">
  "Semaphore.gtype" = i32
  "DB Queue Reference.gtype" = Queue<"Daughterboard Data.gtype">
  "niUsrpRio Session.gtype" = cluster{"FPGA Interface": any, "RIO Interface Number": u32, "Data Clock Rate": u32, "FPGA Data Clock Rate": u32, "Global Settings Register Bus": "Register Bus Session.gtype", "Radio 0 Settings Register Bus": "Register Bus Session.gtype", "Radio 1 Settings Register Bus": "Register Bus Session.gtype", "Radio Settings Bus Semaphore": "Semaphore.gtype", "DB Queues": "DB Queue Reference.gtype"[], "Characterization Data Valid?": bool, "EEPROM Header": "EEPROM Header.gtype", "Device Data Header": "EEPROM Device Data Header.gtype", "EEPROM Characterization Header": "EEPROM Characterization Header.gtype", "Characterization Data": "Characterization Data.gtype"[], "FPGA Current Version": u32, "FPGA Oldest Compatible Version": u32, "Fixed Logic Current Version": u32, "Fixed Logic Oldest Compatible Version": u32, "FPGA Radio Settings Bus Current Version": u32, "FPGA Radio Settings Bus Oldest Compatible Version": u32, "FPGA Board Config Current Version": u32, "FPGA Board Config Oldest Compatible Version": u32, "Daughterboard Clock Rate": u32}
  T1 = cluster{"FPGA ref": any, "bus instance": u32, "instruction FIFO depth": u32, "executing on FPGA target": bool, "show error call chain": bool}
  T2 = cluster{"Actual Gain [dB]": f64, "Attenuation Table Index": i32}
  T3 = cluster{"Attenuation Table [dB]": f64[][], "Frequencies [Hz]": f64[], "IQ Imbalance Table": "IQ Imbalance.gtype"[], "Gain Table": T2[][]}
  T4 = cluster{"FlexRIO Register Bus": Queue<T1>, "RX Characterization Data": T3, "TX Characterization Data": T3, "FPGA Interface": any}
  T5 = cluster{"transport block size": u32, "CRC ok": bool, "user data": u32}
  "Link Direction.gtype" = enum{"DL", "UL"}
  T6 = cluster{"MAC Stub RX Payload Information FIFO": RTFifoRefnum<"MAC Stub RX Payload Information.gtype">, "MAC Stub RX Confirmation Information FIFO": RTFifoRefnum<u64[16]>, "MAC Stub RX UL Payload Information FIFO": RTFifoRefnum<f64[23]>}
  T7 = cluster{"MAC Stub TX Input Terminals FIFO": RTFifoRefnum<"MAC Stub TX Input Terminals.gtype">, "MAC Stub TX Output Terminals FIFO": RTFifoRefnum<"MAC Stub TX Output Terminals.gtype">}
  T8 = cluster{"MAC Stub RX Interface": T6, "MAC Stub TX Interface": T7}
  "Host Session.gtype" = cluster{"target": enum{"USRP", "FlexRIO"}, "real time mode": bool, "MAC Stub enabled": bool, "DMA FIFO read timeout": i32, "timed loop period": i64, "LTE Transport Sessions": "Transport Session.gtype"[], "USRP session": "niUsrpRio Session.gtype", "FlexRIO session": T4, "UDP RX session": UdpNetworkConnectionRefnum, "UDP TX session": UdpNetworkConnectionRefnum, "sync found FIFO": RTFifoRefnum<bool>, "PDCCH CRC OK FIFO": RTFifoRefnum<bool>, "DL PDCCH status FIFO": RTFifoRefnum<cluster{"CRC ok": bool, "subframe number": u32}>, "DL PDSCH status FIFO": RTFifoRefnum<cluster{"CRC ok": bool, "subframe number": u32}>, "DL SINR FIFO": RTFifoRefnum<f64[]>, "PDSCH user data FIFO": RTFifoRefnum<u32>, "PDSCH user data UDP FIFO": RTFifoRefnum<T5>, "PDSCH user data throughput FIFO": RTFifoRefnum<T5>, "PUSCH user data FIFO": RTFifoRefnum<u32>, "PUSCH user data UDP FIFO": RTFifoRefnum<T5>, "PUSCH user data throughput FIFO": RTFifoRefnum<T5>, "UE feedback info FIFO": RTFifoRefnum<u8[]>, "Request information FIFO": RTFifoRefnum<"Request Information.gtype">, "UDP TX outbound FIFO": RTFifoRefnum<u8[]>, "UDP RX inbound FIFO": RTFifoRefnum<u8[]>, "stop notifier": Notifier<string>, "DL RX scope": string, "UL RX scope": string, "external MAC log file": string, "external MAC process ID": u32, "TX link direction": "Link Direction.gtype", "RX link direction": "Link Direction.gtype", "Sychronization FIFO": RTFifoRefnum<i32>, "RT Loop Interfaces": T8}
uses:
  AFW::Common::PN9 Sequence Generator.gvi
  NI::G Core::File IO (General)::Write Delimited Spreadsheet (1D I64).gvi
  NI::Analysis::Operations::1D Cross Correlation (DBL).gvi
  NI::G Core::File IO (General)::Read Delimited Spreadsheet (DBL).gvi
  AFW::Common::Data Transfer Protocol::DTP Header.gvi
  AFW::LTE::RF Control::Unbundle Session.gvi
  AFW::Common::Data Transfer Protocol::DTP Add Header and CRC.gvi
  NI::G Core::Error::Filter Error Code.gvi
diagram:
  call "PN9 Sequence Generator.gvi"(samples=1000, seed=51) -> (sequence=w1)
  call "Write Delimited Spreadsheet (1D I64).gvi"(delimiter="\t,", file=path "C:\\Users\\ge69mog\\Desktop\\test.txt", 1D data=w1, append to file=FALSE, format="%d")
  call "1D Cross Correlation (DBL).gvi"(x=w1, y=w1, algorithm="direct", normalization="none") -> (Rxy=w2)
  $Rxy <- w2
  call "Read Delimited Spreadsheet (DBL).gvi"(delimiter="\t\\n", file=path "C:\\Users\\ge69mog\\Desktop\\test.txt", format="%d") -> (all rows=w3)
  To Unsigned 8 Bit Integer(number=w3) -> w4
  Reshape Array(inArray=w4, size=1000) -> w5
  $"output array" <- w5
  w6 = 65535  # maximum UDP packet size
  case ($"eNB TX active") {
    frame False, Default {
      w7 = $"error in"
      w8 = FALSE
      w9 = FALSE
      w10 = $"UDP packet counter in"
      w11 = default
    }
    frame True {
      call "DTP Header.gvi"() -> (header length=w12)
      To Signed 32 Bit Integer(number=w12) -> w13
      Add(w6, w13) -> w14
      To Unsigned 32 Bit Integer(number=w14) -> w15
      call "Unbundle Session.gvi"(session=$session) -> (DL FPGA Interface=w16)
      Dynamic Fpga Interface Cast(reference in=w16, type=any constant) -> (reference out=w17)
      Host Fifo Write Node[FifoName="LTE AFW Resources.grsc::H2T PDSCH Payload"](data=u8[] [], error in=$"error in", reference in=w17, timeout (ms)=0) -> (empty elements remaining=w18, error out=w19, reference out=w20)
      Is Greater Or Equal(x=w18, y=w15) -> w21
      case (w21) {
        frame False, Default {
          w7 = w19
          w8 = FALSE
          w9 = TRUE
          w10 = $"UDP packet counter in"
          w11 = default
        }
        frame True {
          s1 = w19  # shift register
          s2 = $"UDP packet counter in"  # shift register
          while {
            Property Node(instance in=$session) -> ("UDP TX session"=w24)
            Udp Read Binary(connection ID=w24, error in=s1, max size=w6, timeout ms=10) -> (data out=w25, error out=w26)
            Is Empty Array(array=w25) -> w27
            case (w27) {
              frame False, Default {
                To Unsigned 16 Bit Integer(number=s2) -> w30
                call "DTP Add Header and CRC.gvi"(counter=w30, U8 input data array=w25) -> (U8 data array=w28)
                Increment(x=s2) -> w29
              }
              frame True {
                w28 = w25
                w29 = s2
              }
            }
            Host Fifo Write Node[FifoName="LTE AFW Resources.grsc::H2T PDSCH Payload"](data=w28, error in=w26, reference in=w20, timeout (ms)=0) -> (empty elements remaining=w31, error out=w32)
            call "Filter Error Code.gvi"(error in=w32, code to clear=113) -> (error out=w33, error cleared?=w34)
            Boolean To 0 Or 1(Boolean=w34) -> (0, 1=w35)
            To Unsigned 32 Bit Integer(number=w35) -> w36
            call "Filter Error Code.gvi"(error in=w33, code to clear=56) -> (error out=w37, error cleared?=w38)
            Not(x=w38) -> w8
            call "Filter Error Code.gvi"(error in=w37, code to clear=1) -> (error out=w39)
            call "Filter Error Code.gvi"(error in=w39, code to clear=66) -> (error out=w40)
            Is Less(x=w31, y=w15) -> w41
            Logical Or(w41, w27) -> w42
            append w34 to w22
            append w36 to w23
            next s1 = w40
            next s2 = w29
            stop if w42
          }
          Add Array Elements(numeric array=w23) -> (sum=w11)
          Or Array Elements(Boolean array=w22) -> (logical OR=w9)
          w7 = s1
          w10 = s2
        }
      }
    }
  }
  $"num packets dropped" <- w11
  $"FIFO full" <- w9
  $"data transfer" <- w8
  $"error out" <- w7
  $"UDP packet counter out" <- w10
