vi "Send UDP Data.gvi"   [LabVIEW NXG 4.0.0]
# Reads PDSCH decoding status from the queue and reads the decoded data from the FPGA for each successfully decoded transport block.
# Extracts the PDSCH payload header containing the length of the payload data and writes the extracted PDSCH payload data to a remote UDP socket.
inputs:
  "transmit port": u16 = 60000  # Port at the specified address to write to.
  "transmit IP address": string = "127.0.0.1"  # Address of the computer to which to send the PDSCH payload.
  "session": "Host Session.gtype"
  "enable MAC RX": bool = TRUE  # Enables the Mini MAC on the receiver side, which removes the header from the received PDSCH data.
  "error in": error
  "pending data in": "DTP Pending Data.gtype"  # Cluster containing information about the current DTP packet from the previous execution of this node.
  "UDP send status in": "DTP Send Status.gtype"  # Cluster containing counter values for number of sent packets and network too slow events, from the previous execution of this node.
outputs:
  "error out": error
  "network too slow": bool  # Boolean that indicates whether the transfer to the UDP socket failed and the payload data was lost.
  "transferring data": bool  # Boolean that indicates whether payload data was received from the FPGA and is sent to the specified USP socket.
  "pending data out": "DTP Pending Data.gtype"  # Cluster containing information about the current DTP packet, from the current execution of this node.
  "UDP send status out": "DTP Send Status.gtype"  # Cluster containing counter values for number of sent packets and network too slow events, from the current execution of this node.
types:
  "DTP Send Status.gtype" = cluster{"send packet counter": u32, "network too slow counter": u32}
  "DTP Pending Data.gtype" = cluster{"expected size": u32, "payload": u8[]}
  "Transport Session.gtype" = cluster{"FIFO pathname": string, "pipe reader": "Pipe Reader.gtype", "pipe writer": "Pipe Writer.gtype", "transport in RT FIFO": RTFifoRefnum<u8[]>, "transport out RT FIFO": RTFifoRefnum<u8[]>, "transport in timing source name": string, "transport in timing trigger ID": u8, "transport out timing source name": string, "transport out timing trigger ID": u8, "maximum API message size": u32}
  "Register Bus Session.gtype" = Queue<"Session Data.gtype">
  "Semaphore.gtype" = i32
  "DB Queue Reference.gtype" = Queue<"Daughterboard Data.gtype">
  "niUsrpRio Session.gtype" = cluster{"FPGA Interface": any, "RIO Interface Number": u32, "Data Clock Rate": u32, "FPGA Data Clock Rate": u32, "Global Settings Register Bus": "Register Bus Session.gtype", "Radio 0 Settings Register Bus": "Register Bus Session.gtype", "Radio 1 Settings Register Bus": "Register Bus Session.gtype", "Radio Settings Bus Semaphore": "Semaphore.gtype", "DB Queues": "DB Queue Reference.gtype"[], "Characterization Data Valid?": bool, "EEPROM Header": "EEPROM Header.gtype", "Device Data Header": "EEPROM Device Data Header.gtype", "EEPROM Characterization Header": "EEPROM Characterization Header.gtype", "Characterization Data": "Characterization Data.gtype"[], "FPGA Current Version": u32, "FPGA Oldest Compatible Version": u32, "Fixed Logic Current Version": u32, "Fixed Logic Oldest Compatible Version": u32, "FPGA Radio Settings Bus Current Version": u32, "FPGA Radio Settings Bus Oldest Compatible Version": u32, "FPGA Board Config Current Version": u32, "FPGA Board Config Oldest Compatible Version": u32, "Daughterboard Clock Rate": u32}
  T1 = cluster{"FPGA ref": any, "bus instance": u32, "instruction FIFO depth": u32, "executing on FPGA target": bool, "show error call chain": bool}
  T2 = cluster{"Actual Gain [dB]": f64, "Attenuation Table Index": i32}
  T3 = cluster{"Attenuation Table [dB]": f64[][], "Frequencies [Hz]": f64[], "IQ Imbalance Table": "IQ Imbalance.gtype"[], "Gain Table": T2[][]}
  T4 = cluster{"FlexRIO Register Bus": Queue<T1>, "RX Characterization Data": T3, "TX Characterization Data": T3, "FPGA Interface": any}
  T5 = cluster{"transport block size": u32, "CRC ok": bool, "user data": u32}
  "Link Direction.gtype" = enum{"DL", "UL"}
  T6 = cluster{"MAC Stub RX Payload Information FIFO": RTFifoRefnum<"MAC Stub RX Payload Information.gtype">, "MAC Stub RX Confirmation Information FIFO": RTFifoRefnum<u64[16]>, "MAC Stub RX UL Payload Information FIFO": RTFifoRefnum<f64[23]>}
  T7 = cluster{"MAC Stub TX Input Terminals FIFO": RTFifoRefnum<"MAC Stub TX Input Terminals.gtype">, "MAC Stub TX Output Terminals FIFO": RTFifoRefnum<"MAC Stub TX Output Terminals.gtype">}
  T8 = cluster{"MAC Stub RX Interface": T6, "MAC Stub TX Interface": T7}
  "Host Session.gtype" = cluster{"target": enum{"USRP", "FlexRIO"}, "real time mode": bool, "MAC Stub enabled": bool, "DMA FIFO read timeout": i32, "timed loop period": i64, "LTE Transport Sessions": "Transport Session.gtype"[], "USRP session": "niUsrpRio Session.gtype", "FlexRIO session": T4, "UDP RX session": UdpNetworkConnectionRefnum, "UDP TX session": UdpNetworkConnectionRefnum, "sync found FIFO": RTFifoRefnum<bool>, "PDCCH CRC OK FIFO": RTFifoRefnum<bool>, "DL PDCCH status FIFO": RTFifoRefnum<cluster{"CRC ok": bool, "subframe number": u32}>, "DL PDSCH status FIFO": RTFifoRefnum<cluster{"CRC ok": bool, "subframe number": u32}>, "DL SINR FIFO": RTFifoRefnum<f64[]>, "PDSCH user data FIFO": RTFifoRefnum<u32>, "PDSCH user data UDP FIFO": RTFifoRefnum<T5>, "PDSCH user data throughput FIFO": RTFifoRefnum<T5>, "PUSCH user data FIFO": RTFifoRefnum<u32>, "PUSCH user data UDP FIFO": RTFifoRefnum<T5>, "PUSCH user data throughput FIFO": RTFifoRefnum<T5>, "UE feedback info FIFO": RTFifoRefnum<u8[]>, "Request information FIFO": RTFifoRefnum<"Request Information.gtype">, "UDP TX outbound FIFO": RTFifoRefnum<u8[]>, "UDP RX inbound FIFO": RTFifoRefnum<u8[]>, "stop notifier": Notifier<string>, "DL RX scope": string, "UL RX scope": string, "external MAC log file": string, "external MAC process ID": u32, "TX link direction": "Link Direction.gtype", "RX link direction": "Link Direction.gtype", "Sychronization FIFO": RTFifoRefnum<i32>, "RT Loop Interfaces": T8}
uses:
  AFW::LTE::Configuration::Flush User Data FIFO.gvi
  AFW::LTE::RF Control::Unbundle Session.gvi
  AFW::LTE::Conversion::Extract Payload.gvi
  AFW::Common::Data Transfer Protocol::DTP Extract Packet.gvi
  NI::G Core::Error::Filter Error Code.gvi
diagram:
  Property Node(instance in=$session) -> ("PDSCH user data FIFO"=w1, "PDSCH user data UDP FIFO"=w2, instance out=w3)
  Property Node(instance in=$"UDP send status in") -> ("network too slow counter"=w4, "send packet counter"=w5)
  call "Flush User Data FIFO.gvi"(user data FIFO in=w2, error in=$"error in") -> (user data=w6, error out=w7)
  s1 = w7  # shift register
  s2 = $"pending data in"  # shift register
  s3 = w5  # shift register
  s4 = w4  # shift register
  for {
    w8 = each element of w6
    String To Ip Address(name=$"transmit IP address") -> (net address=w10)
    Property Node(instance in=w8) -> ("transport block size"=w11, "CRC ok"=w12)
    Logical And(w12, $"enable MAC RX") -> w13
    call "Unbundle Session.gvi"(session=w3) -> (DL FPGA Interface=w14)
    Dynamic Fpga Interface Cast(reference in=w14, type=any constant) -> (reference out=w15)
    Quotient And Remainder(x=w11, y=8) -> (floor(x/y)=w16)
    Host Fifo Read Node[FifoName="LTE AFW Resources.grsc::T2H PDSCH Decoded Data"](error in=s1, number of elements=w16, reference in=w15, timeout (ms)=5) -> (data=w17, error out=w18)
    case (w13) {
      frame False, Default {
        w19 = w18
        w20 = 0
        w21 = FALSE
        w22 = s3
        w23 = s2
        w24 = s4
      }
      frame True {
        call "Extract Payload.gvi"(transport block=w17) -> (payload length=w20, payload=w25)
        Is Not Equal To 0(x=w20) -> w26
        case (w26) {
          frame False, Default {
            w27 = w18
            w22 = s3
            w23 = s2
            w28 = default
          }
          frame True {
            Property Node(instance in=s2) -> ("payload"=w29, "expected size"=w30, instance out=w31)
            Build Array(w29, w25) -> w32
            To Signed 32 Bit Integer(number=w30) -> w33
            Array Size(array=w32) -> (size(s)=w34)
            Is Greater Or Equal(x=w34, y=w33) -> w35
            case (w35) {
              frame False, Default {
                w27 = w18
                w22 = s3
                w28 = bool[] []
                w36 = w32
                w37 = w33
              }
              frame True {
                s5 = w32  # shift register
                s6 = s3  # shift register
                while {
                  Property Node(instance in=w3) -> ("UDP RX session"=w38)
                  call "DTP Extract Packet.gvi"(data in=s5) -> (packet=w39, packet valid=w40, data out=w41, expected packet size=w37)
                  # UDP timeout
                  case (w40) {
                    frame False, Default {
                      w42 = w18
                      w43 = s6
                    }
                    frame True {
                      Udp Write Binary(address=w10, connection ID=w38, data in=w39, error in=w18, port or service name=$"transmit port", timeout ms=1) -> (error out=w42)
                      Increment(x=s6) -> w43
                    }
                  }
                  call "Filter Error Code.gvi"(error in=w42, code to clear=55) -> (error out=w27, error cleared?=w44)
                  append w44 to w28
                  next s5 = w41
                  next s6 = w43
                  continue if w40
                }
                w22 = s6
                w36 = s5
              }
            }
            To Unsigned 32 Bit Integer(number=w37) -> w45
            Property Node(instance in=w31, "payload"=w36, "expected size"=w45) -> (instance out=w23)
          }
        }
        Or Array Elements(Boolean array=w28) -> (logical OR=w21)
        call "Filter Error Code.gvi"(error in=w27, code to clear=2) -> (error out=w19)
        Boolean To 0 Or 1(Boolean=w28) -> (0, 1=w46)
        To Unsigned 32 Bit Integer(number=w46) -> w47
        Add Array Elements(numeric array=w47) -> (sum=w48)
        Add(w48, s4) -> w24
      }
    }
    append w20 to w9
    next s1 = w19
    next s2 = w23
    next s3 = w22
    next s4 = w24
  }
  Add Array Elements(numeric array=w9) -> (sum=w49)
  Scale By Power Of 2(n=3, x=w49) -> w50
  Is Greater Than 0(x=w50) -> w51
  $"transferring data" <- w51
  $"network too slow" <- w21
  RTFIFO Write(element=w50, error in=s1, rt fifo=w1) -> (error out=w52)
  $"error out" <- w52
  Property Node(instance in="DTP Send Status.gtype" {all zero or empty}, "network too slow counter"=s4, "send packet counter"=s3) -> (instance out=w53)
  $"UDP send status out" <- w53
  $"pending data out" <- s2
