vi "Read Status from RT.gvi"   [LabVIEW NXG 4.0.0]
# Read status of timed loops for display on front panel.
inputs:
  "session in": "Host Session.gtype" = {"target"="USRP", "MAC Stub enabled"=TRUE, "TX link direction"="DL", "RX link direction"="DL"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}
  "error in": error
outputs:
  "DL RX indication CRC OK": bool
  "MPDU disassembly failed": bool  # specific error cleared? indicates whether the error referenced by specific error code to clear has been cleared.
  "negatives": u32
  "evaluation errors": u32
  "received confirmations": T1
  "DL error rate": f64
  "error out": error
  "Reported DL ACK/NACK": enum{"NACK", "ACK", "DTX"}[]  # Array showing the latest received DL ACK/NACK report from UE side.
  "Reported Subband SINR [dB]": f64[13]  # The reported SINR for each subband occupying 8 PRBs. Comparable to Reporting Mode 3-0 in 3GPP TS 36.213 §7.2.1. Usage of CRS or UERS for estimation depends on setting of Use UERS switch in UE RX System Parameters on the UE side
  "Reported WB SINR": f64
  "Radio Frame Number": u16
panel indicators:
  "session dup": "Host Session.gtype"
types:
  "Confirmation States.gtype" = enum{"Success", "Unknown Message", "Message not Supported", "Unknown Parameter (Set)", "Missing Parameter (Set)", "Parameter (Set) Repetition", "Range Violation", "State Violation", "Timeout", "Config Payload Mismatch", "Length Mismatch", "Input Buffer Full", "Internal Error", "Instance ID Mismatch"}
  T1 = cluster{"Element 1": "Confirmation States.gtype"[], "Value": u64[]}
  "Transport Session.gtype" = cluster{"FIFO pathname": string, "pipe reader": "Pipe Reader.gtype", "pipe writer": "Pipe Writer.gtype", "transport in RT FIFO": RTFifoRefnum<u8[]>, "transport out RT FIFO": RTFifoRefnum<u8[]>, "transport in timing source name": string, "transport in timing trigger ID": u8, "transport out timing source name": string, "transport out timing trigger ID": u8, "maximum API message size": u32}
  "Register Bus Session.gtype" = Queue<"Session Data.gtype">
  "Semaphore.gtype" = i32
  "DB Queue Reference.gtype" = Queue<"Daughterboard Data.gtype">
  "niUsrpRio Session.gtype" = cluster{"FPGA Interface": any, "RIO Interface Number": u32, "Data Clock Rate": u32, "FPGA Data Clock Rate": u32, "Global Settings Register Bus": "Register Bus Session.gtype", "Radio 0 Settings Register Bus": "Register Bus Session.gtype", "Radio 1 Settings Register Bus": "Register Bus Session.gtype", "Radio Settings Bus Semaphore": "Semaphore.gtype", "DB Queues": "DB Queue Reference.gtype"[], "Characterization Data Valid?": bool, "EEPROM Header": "EEPROM Header.gtype", "Device Data Header": "EEPROM Device Data Header.gtype", "EEPROM Characterization Header": "EEPROM Characterization Header.gtype", "Characterization Data": "Characterization Data.gtype"[], "FPGA Current Version": u32, "FPGA Oldest Compatible Version": u32, "Fixed Logic Current Version": u32, "Fixed Logic Oldest Compatible Version": u32, "FPGA Radio Settings Bus Current Version": u32, "FPGA Radio Settings Bus Oldest Compatible Version": u32, "FPGA Board Config Current Version": u32, "FPGA Board Config Oldest Compatible Version": u32, "Daughterboard Clock Rate": u32}
  T2 = cluster{"FPGA ref": any, "bus instance": u32, "instruction FIFO depth": u32, "executing on FPGA target": bool, "show error call chain": bool}
  T3 = cluster{"Actual Gain [dB]": f64, "Attenuation Table Index": i32}
  T4 = cluster{"Attenuation Table [dB]": f64[][], "Frequencies [Hz]": f64[], "IQ Imbalance Table": "IQ Imbalance.gtype"[], "Gain Table": T3[][]}
  T5 = cluster{"FlexRIO Register Bus": Queue<T2>, "RX Characterization Data": T4, "TX Characterization Data": T4, "FPGA Interface": any}
  T6 = cluster{"transport block size": u32, "CRC ok": bool, "user data": u32}
  "Link Direction.gtype" = enum{"DL", "UL"}
  T7 = cluster{"MAC Stub RX Payload Information FIFO": RTFifoRefnum<"MAC Stub RX Payload Information.gtype">, "MAC Stub RX Confirmation Information FIFO": RTFifoRefnum<u64[16]>, "MAC Stub RX UL Payload Information FIFO": RTFifoRefnum<f64[23]>}
  T8 = cluster{"MAC Stub TX Input Terminals FIFO": RTFifoRefnum<"MAC Stub TX Input Terminals.gtype">, "MAC Stub TX Output Terminals FIFO": RTFifoRefnum<"MAC Stub TX Output Terminals.gtype">}
  T9 = cluster{"MAC Stub RX Interface": T7, "MAC Stub TX Interface": T8}
  "Host Session.gtype" = cluster{"target": enum{"USRP", "FlexRIO"}, "real time mode": bool, "MAC Stub enabled": bool, "DMA FIFO read timeout": i32, "timed loop period": i64, "LTE Transport Sessions": "Transport Session.gtype"[], "USRP session": "niUsrpRio Session.gtype", "FlexRIO session": T5, "UDP RX session": UdpNetworkConnectionRefnum, "UDP TX session": UdpNetworkConnectionRefnum, "sync found FIFO": RTFifoRefnum<bool>, "PDCCH CRC OK FIFO": RTFifoRefnum<bool>, "DL PDCCH status FIFO": RTFifoRefnum<cluster{"CRC ok": bool, "subframe number": u32}>, "DL PDSCH status FIFO": RTFifoRefnum<cluster{"CRC ok": bool, "subframe number": u32}>, "DL SINR FIFO": RTFifoRefnum<f64[]>, "PDSCH user data FIFO": RTFifoRefnum<u32>, "PDSCH user data UDP FIFO": RTFifoRefnum<T6>, "PDSCH user data throughput FIFO": RTFifoRefnum<T6>, "PUSCH user data FIFO": RTFifoRefnum<u32>, "PUSCH user data UDP FIFO": RTFifoRefnum<T6>, "PUSCH user data throughput FIFO": RTFifoRefnum<T6>, "UE feedback info FIFO": RTFifoRefnum<u8[]>, "Request information FIFO": RTFifoRefnum<"Request Information.gtype">, "UDP TX outbound FIFO": RTFifoRefnum<u8[]>, "UDP RX inbound FIFO": RTFifoRefnum<u8[]>, "stop notifier": Notifier<string>, "DL RX scope": string, "UL RX scope": string, "external MAC log file": string, "external MAC process ID": u32, "TX link direction": "Link Direction.gtype", "RX link direction": "Link Direction.gtype", "Sychronization FIFO": RTFifoRefnum<i32>, "RT Loop Interfaces": T9}
diagram:
  Property Node(instance in=$"session in") -> ("RT Loop Interfaces"=w1, instance out=w2)
  $"session dup" <- w2
  Property Node(instance in=w1) -> ("MAC Stub RX Interface"=w3)
  Property Node(instance in=w3) -> ("MAC Stub RX Confirmation Information FIFO"=w4, "MAC Stub RX Payload Information FIFO"=w5, "MAC Stub RX UL Payload Information FIFO"=w6)
  RTFIFO Read(error in=$"error in", rt fifo=w6, timeout in ms=0) -> (element out=w7, error out=w8)
  RTFIFO Read(error in=w8, rt fifo=w5, timeout in ms=0) -> (element out=w9, error out=w10)
  RTFIFO Read(error in=w10, rt fifo=w4, timeout in ms=0) -> (element out=w11, error out=w12)
  $"error out" <- w12
  Property Node(instance in=w9) -> ("RX Indication CRC OK"=w13, "MPDU Disassembly Failed"=w14, "Radio Frame Number"=w15, "Reported WB SINR"=w16, "DL error rate"=w17)
  $"DL RX indication CRC OK" <- w13
  $"MPDU disassembly failed" <- w14
  $"Radio Frame Number" <- w15
  $"Reported WB SINR" <- w16
  $"DL error rate" <- w17
  Array Index(array=w11) -> (out0[14]=w18, out1[15]=w19)
  To Unsigned 32 Bit Integer(number=w18) -> w20
  $negatives <- w20
  To Unsigned 32 Bit Integer(number=w19) -> w21
  $"evaluation errors" <- w21
  Array Subset(array=w11, index0=0, length0=14) -> w22
  w23 = T1 {"Element 1"=["Success", "Unknown Message", "Message not Supported", "Unknown Parameter (Set)", "Missing Parameter (Set)", "Parameter (Set) Repetition", "Range Violation", "State Violation", "Timeout", "Config Payload Mismatch", "Length Mismatch", "Input Buffer Full", "Internal Error", "Instance ID Mismatch"], "Value"=[0, 0, 0, 0, 0, 0, 0, 0, 0, 0, 0, 0, 0, 0]}
  Property Node(instance in=w23, "Value"=w22) -> (instance out=w24)
  $"received confirmations" <- w24
  Split 1D Array(array=w7, index=13) -> (first subarray=w25, second subarray=w26)
  $"Reported Subband SINR [dB]" <- w25
  To Unsigned 16 Bit Integer(number=w26) -> w27
  Type Cast(type=enum{"NACK", "ACK", "DTX"}[] [], x=w27) -> w28
  $"Reported DL ACK/NACK" <- w28
