vi "Write Configuration to RT.gvi"   [LabVIEW NXG 4.0.0]
# Write configuration from front panel to timed loops.
inputs:
  "session in": "Host Session.gtype" = {"target"="USRP", "MAC Stub enabled"=TRUE, "TX link direction"="DL", "RX link direction"="DL"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}
  "eNB TX frame structure": enum{"FDD", "TDD 5 5"} = "FDD"  # Select between frequency division duplex (FDD) and time division duplex (TDD) using subframe configuration 5 and special subframe configuration 5 (3GPP TS 36.211 §4).
  "eNB TX UE context": T1 = {"RNTI"=10, "Use UERS"=FALSE, "Antenna Port"=7, "CCE Offset"=0}
    # UE specific parameters for DL transmission
    # Use UERS: If enabled, the DL transmitter feeds UE-specific reference signals into the PDSCH data stream. The usage of UERS is closely related to Transmission Mode 9 defined in the LTE standard 3GPP TS 36.213 §7.1.
    # RNTI: The radio network temporary identifier used for PDSCH scrambling and PDCCH CRC mask generation.
    # Antenna Port: The antenna port used for generating UERS, Range: 7…14 according to 3GPP TS 36.213 §7.1.
    # CCE Offset: First control channel element to be used for PDCCH transmission. According to 3GPP TS 36.211 §6.8.1/.2.
  "eNB TX DCI in": "DCI Message.gtype" = {"Active"=TRUE, "MCS"="MCS 17 (64-QAM, rate ~0.43)", "Resource Block Allocation (4 PRB/bit)"=8388607}
  "wideband SINR": f64  # The estimated SINR over the full 20 MHz band using cell-specific reference signals.
  "SINR offset": f64 = 3  # This value is effectively subtracted from the reported SINR before looking up the MCS in the adaptation table (i.e. if a positive offset is configured, a higher reported SINR is required to adapt to a certain MCS to avoid block errors).
  "rate adaption": bool  # If enabled, eNB TX MCS is automatically adapted to reported/measured Wideband SINR [dB] to handle with channel quality fluctuations. The adaptation is calibrated so that the applied MCS produces approximately 5% to 10% BLER under current MCS conditions. If that is not desired, modify SINR Offset [dB].
  "error in": error
outputs:
  "eNB TX DCI out": "DCI Message.gtype"
  "IP packets size exeeded count": u32
  "error out": error
  "session dup": "Host Session.gtype"
types:
  T1 = cluster{"RNTI": u16, "Use UERS": bool, "Antenna Port": UFXP(4.0), "CCE Offset": u8}
  T2 = enum{"MCS 0 (QPSK, rate ~0.12)", "MCS 1 (QPSK, rate ~0.15)", "MCS 2 (QPSK, rate ~0.19)", "MCS 3 (QPSK, rate ~0.25)", "MCS 4 (QPSK, rate ~0.30)", "MCS 5 (QPSK, rate ~0.37)", "MCS 6 (QPSK, rate ~0.44)", "MCS 7 (QPSK, rate ~0.51)", "MCS 8 (QPSK, rate ~0.59)", "MCS 9 (QPSK, rate ~0.66)", "MCS 10 (16-QAM, rate ~0.33)", "MCS 11 (16-QAM, rate ~0.37)", "MCS 12 (16-QAM, rate ~0.42)", "MCS 13 (16-QAM, rate ~0.48)", "MCS 14 (16-QAM, rate ~0.54)", "MCS 15 (16-QAM, rate ~0.60)", "MCS 16 (16-QAM, rate ~0.64)", "MCS 17 (64-QAM, rate ~0.43)", "MCS 18 (64-QAM, rate ~0.46)", "MCS 19 (64-QAM, rate ~0.50)", "MCS 20 (64-QAM, rate ~0.55)", "MCS 21 (64-QAM, rate ~0.60)", "MCS 22 (64-QAM, rate ~0.65)", "MCS 23 (64-QAM, rate ~0.70)", "MCS 24 (64-QAM, rate ~0.75)", "MCS 25 (64-QAM, rate ~0.80)", "MCS 26 (64-QAM, rate ~0.85)", "MCS 27 (64-QAM, rate ~0.89)", "MCS 28 (64-QAM, rate ~0.93)"}
  "DCI Message.gtype" = cluster{"Active": bool, "MCS": T2, "Resource Block Allocation (4 PRB/bit)": UFXP(25.0)}
  "Transport Session.gtype" = cluster{"FIFO pathname": string, "pipe reader": "Pipe Reader.gtype", "pipe writer": "Pipe Writer.gtype", "transport in RT FIFO": RTFifoRefnum<u8[]>, "transport out RT FIFO": RTFifoRefnum<u8[]>, "transport in timing source name": string, "transport in timing trigger ID": u8, "transport out timing source name": string, "transport out timing trigger ID": u8, "maximum API message size": u32}
  "Register Bus Session.gtype" = Queue<"Session Data.gtype">
  "Semaphore.gtype" = i32
  "DB Queue Reference.gtype" = Queue<"Daughterboard Data.gtype">
  "niUsrpRio Session.gtype" = cluster{"FPGA Interface": any, "RIO Interface Number": u32, "Data Clock Rate": u32, "FPGA Data Clock Rate": u32, "Global Settings Register Bus": "Register Bus Session.gtype", "Radio 0 Settings Register Bus": "Register Bus Session.gtype", "Radio 1 Settings Register Bus": "Register Bus Session.gtype", "Radio Settings Bus Semaphore": "Semaphore.gtype", "DB Queues": "DB Queue Reference.gtype"[], "Characterization Data Valid?": bool, "EEPROM Header": "EEPROM Header.gtype", "Device Data Header": "EEPROM Device Data Header.gtype", "EEPROM Characterization Header": "EEPROM Characterization Header.gtype", "Characterization Data": "Characterization Data.gtype"[], "FPGA Current Version": u32, "FPGA Oldest Compatible Version": u32, "Fixed Logic Current Version": u32, "Fixed Logic Oldest Compatible Version": u32, "FPGA Radio Settings Bus Current Version": u32, "FPGA Radio Settings Bus Oldest Compatible Version": u32, "FPGA Board Config Current Version": u32, "FPGA Board Config Oldest Compatible Version": u32, "Daughterboard Clock Rate": u32}
  T3 = cluster{"FPGA ref": any, "bus instance": u32, "instruction FIFO depth": u32, "executing on FPGA target": bool, "show error call chain": bool}
  T4 = cluster{"Actual Gain [dB]": f64, "Attenuation Table Index": i32}
  T5 = cluster{"Attenuation Table [dB]": f64[][], "Frequencies [Hz]": f64[], "IQ Imbalance Table": "IQ Imbalance.gtype"[], "Gain Table": T4[][]}
  T6 = cluster{"FlexRIO Register Bus": Queue<T3>, "RX Characterization Data": T5, "TX Characterization Data": T5, "FPGA Interface": any}
  T7 = cluster{"transport block size": u32, "CRC ok": bool, "user data": u32}
  "Link Direction.gtype" = enum{"DL", "UL"}
  T8 = cluster{"MAC Stub RX Payload Information FIFO": RTFifoRefnum<"MAC Stub RX Payload Information.gtype">, "MAC Stub RX Confirmation Information FIFO": RTFifoRefnum<u64[16]>, "MAC Stub RX UL Payload Information FIFO": RTFifoRefnum<f64[23]>}
  T9 = cluster{"MAC Stub TX Input Terminals FIFO": RTFifoRefnum<"MAC Stub TX Input Terminals.gtype">, "MAC Stub TX Output Terminals FIFO": RTFifoRefnum<"MAC Stub TX Output Terminals.gtype">}
  T10 = cluster{"MAC Stub RX Interface": T8, "MAC Stub TX Interface": T9}
  "Host Session.gtype" = cluster{"target": enum{"USRP", "FlexRIO"}, "real time mode": bool, "MAC Stub enabled": bool, "DMA FIFO read timeout": i32, "timed loop period": i64, "LTE Transport Sessions": "Transport Session.gtype"[], "USRP session": "niUsrpRio Session.gtype", "FlexRIO session": T6, "UDP RX session": UdpNetworkConnectionRefnum, "UDP TX session": UdpNetworkConnectionRefnum, "sync found FIFO": RTFifoRefnum<bool>, "PDCCH CRC OK FIFO": RTFifoRefnum<bool>, "DL PDCCH status FIFO": RTFifoRefnum<cluster{"CRC ok": bool, "subframe number": u32}>, "DL PDSCH status FIFO": RTFifoRefnum<cluster{"CRC ok": bool, "subframe number": u32}>, "DL SINR FIFO": RTFifoRefnum<f64[]>, "PDSCH user data FIFO": RTFifoRefnum<u32>, "PDSCH user data UDP FIFO": RTFifoRefnum<T7>, "PDSCH user data throughput FIFO": RTFifoRefnum<T7>, "PUSCH user data FIFO": RTFifoRefnum<u32>, "PUSCH user data UDP FIFO": RTFifoRefnum<T7>, "PUSCH user data throughput FIFO": RTFifoRefnum<T7>, "UE feedback info FIFO": RTFifoRefnum<u8[]>, "Request information FIFO": RTFifoRefnum<"Request Information.gtype">, "UDP TX outbound FIFO": RTFifoRefnum<u8[]>, "UDP RX inbound FIFO": RTFifoRefnum<u8[]>, "stop notifier": Notifier<string>, "DL RX scope": string, "UL RX scope": string, "external MAC log file": string, "external MAC process ID": u32, "TX link direction": "Link Direction.gtype", "RX link direction": "Link Direction.gtype", "Sychronization FIFO": RTFifoRefnum<i32>, "RT Loop Interfaces": T10}
  "MAC Stub TX Input Terminals.gtype" = cluster{"TX Frame Structure": enum{"FDD", "TDD 5 5"}, "eNB TX UE Context": T1, "eNB TX DCI": "DCI Message.gtype", "Wideband SINR": f64, "Rate Adaption": bool, "SINR Offset": f64}
diagram:
  Property Node(instance in=$"session in") -> ("RT Loop Interfaces"=w1, instance out=w2)
  $"session dup" <- w2
  Property Node(instance in=w1) -> ("MAC Stub TX Interface"=w3)
  Property Node(instance in=w3) -> ("MAC Stub TX Output Terminals FIFO"=w4, "MAC Stub TX Input Terminals FIFO"=w5)
  w6 = "MAC Stub TX Input Terminals.gtype" {0, 10, FALSE, "0x7", 0, FALSE, 0, 0, 0, FALSE, 3}
  Property Node(instance in=w6, "TX Frame Structure"=$"eNB TX frame structure", "eNB TX UE Context"=$"eNB TX UE context", "eNB TX DCI"=$"eNB TX DCI in", "Wideband SINR"=$"wideband SINR", "SINR Offset"=$"SINR offset", "Rate Adaption"=$"rate adaption") -> (instance out=w7)
  RTFIFO Write(element=w7, error in=$"error in", overwrite on timeout=TRUE, rt fifo=w5, timeout in ms=0) -> (error out=w8)
  RTFIFO Read(error in=w8, rt fifo=w4, timeout in ms=0) -> (element out=w9, error out=w10)
  Property Node(instance in=w9) -> ("eNB TX DCI"=w11, "IP Packets Size Exeeded Count"=w12)
  Property Node(instance in=w11) -> ("MCS"=w13)
  Property Node(instance in=$"eNB TX DCI in", "MCS"=w13) -> (instance out=w14)
  $"eNB TX DCI out" <- w14
  $"IP packets size exeeded count" <- w12
  $"error out" <- w10
