vi "LTE Host DL MIMO.gvi"   [LabVIEW Communications System Design Suite 2.0.1]
panel controls:
  "RIO Device": string = "RIO0"
  "UE RX Frequency [Hz]": f64 = 2000000000
  "UE Manual Gain [dB]": f64
  "eNB TX Frequency [Hz]": f64 = 2000000000
  "eNB Max RF TX Power [dBm]": f64 = 10
  "UDP Receive Port": u16 = 50000
  "Transmit IP Address": string = "127.0.0.1"
  "UDP Transmit Port": u16 = 60000
  "UE AGC": bool = TRUE
  "Reference Clock Source": string = "Internal"
  "UE Receiver": bool
  "eNB TX tab": i32
  "eNB TX RF Port (USRP)": enum{"TX1/RF0", "TX1/RF1"} = "TX1/RF0"
  "UE RX RF Port (USRP)": enum{"RX2/RF0", "RX2/RF1"} = "RX2/RF0"
  "symbol number for PDSCH constellation": u8 = 4
  "throughput select": T2 = "PDSCH (CRC ok)"
  "eNB Transmitter": bool
  "UE RX tab": i32
  "Rate Adaption": bool
  "SINR Offset [dB]": f64 = 3
  "eNB TX UE Context": T3 = {"RNTI"=10, "Use UERS"=FALSE, "Antenna Port"=7, "CCE Offset"=0}
  "eNB TX Frame Structure": enum{"FDD", "TDD 5 5"} = "FDD"
  "UE RX Frame Structure": enum{"FDD", "TDD 5 5"} = "FDD"
  "eNB TX Cell ID": u16
  "UE RX Cell ID": u16
  "eNB TX DCI": T6 = {"Active"=TRUE, "MCS"="MCS 17 (64-QAM, rate ~0.43)", "Resource Block Allocation (4 PRB/bit)"=8388607, "MIMO flag"=TRUE}
  "eNB Timing Offset": i32
  "stop": bool
  "session": "LTE Host Session.gtype"
  "UE RX UE Context": T3 = {"RNTI"=10, "Use UERS"=FALSE, "Antenna Port"=7, "CCE Offset"=0}
  "USRP Bandwidth": "USRP bandwidth.gtype" = "40 MHz"
  "Equalizer Type": enum{"Simple", "ZF", "MMSE"} = "ZF"
  "Sigma": UFXP(1.14) = 0.0010986328125
  "MIMO Selector AP0": enum{"SISO", "MIMO"} = "SISO"
panel indicators:
  "FPGA Ready": bool
  "UE RX Active": bool
  "UE Coerced Gain [dB]": f64
  "eNB TX Active": bool
  "eNB Coerced Max RF TX Power [dBm]": f64
  "UE ADC Values Clipped": bool
  "UE Baseband RX Power [dBFS]": f64
  "Data Transfer In": bool
  "Packet Loss In": bool
  "UE RX Power Spectrum AP0": T1
  "PDSCH Constellation": c128[]
  "PDCCH Constellation": c128[]
  "DL throughput": f64[][]
  "UE Failure / Block Error Rate (BLER)": f64[][]
  "eNB TX Power Spectrum AP0": T1
  "UE Frequency Offset [Hz]": f64
  "Sync Found": bool
  "UE DDC Values Clipped": bool
  "Packet Loss Out": bool
  "channel estimation": f64[][]
  "Data Transfer Out": bool
  "DL throughput (current)": f64
  "Subband SINR [dB]": f64[]
  "eNB TX IFFT Ouput Clipped": bool
  "Wideband SINR [dB]": f64
  "BLER cluster": cluster{"PDSCH": f64, "PDCCH": f64, "sync": f64}
  "UE RF RX Power [dBm]": f64
  "power calibration offset [dB]": f64
  "PDCCH Received DCI Message": T5[]
  "eNB RF TX Power [dBm]": f64
  "eNB Baseband TX Power [dBFS]": f64
  "UE Applied Gain [dB]": f64
  "eNB TX Power Spectrum AP1": T1
  "UE RX Power Spectrum AP1": T1
  "PDSCH Constellation AP1": c128[]
  "Channel Estimation RX1TX1": f64[][]
types:
  T1 = cluster{"f0": f64, "df": f64, "magnitude": f64[]}
  T2 = enum{"PDSCH (overall)", "PDSCH (CRC ok)", "User data (to UDP)"}
  T3 = cluster{"RNTI": u16, "Use UERS": bool, "Antenna Port": UFXP(4.0), "CCE Offset": u8}
  T4 = enum{"MCS 0 (QPSK, rate ~0.12)", "MCS 1 (QPSK, rate ~0.15)", "MCS 2 (QPSK, rate ~0.19)", "MCS 3 (QPSK, rate ~0.25)", "MCS 4 (QPSK, rate ~0.30)", "MCS 5 (QPSK, rate ~0.37)", "MCS 6 (QPSK, rate ~0.44)", "MCS 7 (QPSK, rate ~0.51)", "MCS 8 (QPSK, rate ~0.59)", "MCS 9 (QPSK, rate ~0.66)", "MCS 10 (16-QAM, rate ~0.33)", "MCS 11 (16-QAM, rate ~0.37)", "MCS 12 (16-QAM, rate ~0.42)", "MCS 13 (16-QAM, rate ~0.48)", "MCS 14 (16-QAM, rate ~0.54)", "MCS 15 (16-QAM, rate ~0.60)", "MCS 16 (16-QAM, rate ~0.64)", "MCS 17 (64-QAM, rate ~0.43)", "MCS 18 (64-QAM, rate ~0.46)", "MCS 19 (64-QAM, rate ~0.50)", "MCS 20 (64-QAM, rate ~0.55)", "MCS 21 (64-QAM, rate ~0.60)", "MCS 22 (64-QAM, rate ~0.65)", "MCS 23 (64-QAM, rate ~0.70)", "MCS 24 (64-QAM, rate ~0.75)", "MCS 25 (64-QAM, rate ~0.80)", "MCS 26 (64-QAM, rate ~0.85)", "MCS 27 (64-QAM, rate ~0.89)", "MCS 28 (64-QAM, rate ~0.93)"}
  T5 = cluster{"Valid": bool, "MCS": T4, "Resource Block Allocation (4 PRB/bit)": UFXP(25.0)}
  T6 = cluster{"Active": bool, "MCS": T4, "Resource Block Allocation (4 PRB/bit)": UFXP(25.0), "MIMO flag": bool}
  "niInstr Register Bus v0 Host.lvlib__Register Bus Session.gtype" = Queue<"niInstr Register Bus v0 Host.lvlib__Session Data.gtype">
  "Semaphore RefNum.gtype" = i32
  "niUsrpRio Config v1 Host.lvlib__DB Queue Reference.gtype" = Queue<"niUsrpRio Config v1 Host.lvlib__Daughterboard Data.gtype">
  "niUsrpRio Config v1 Host.lvlib__niUsrpRio Session.gtype" = cluster{"FPGA Interface": any, "RIO Interface Number": u32, "Data Clock Rate": u32, "FPGA Data Clock Rate": u32, "Global Settings Register Bus": "niInstr Register Bus v0 Host.lvlib__Register Bus Session.gtype", "Radio 0 Settings Register Bus": "niInstr Register Bus v0 Host.lvlib__Register Bus Session.gtype", "Radio 1 Settings Register Bus": "niInstr Register Bus v0 Host.lvlib__Register Bus Session.gtype", "Radio Settings Bus Semaphore": "Semaphore RefNum.gtype", "DB Queues": "niUsrpRio Config v1 Host.lvlib__DB Queue Reference.gtype"[], "Characterization Data Valid?": bool, "EEPROM Header": "niUsrpRio Config v1 Host.lvlib__EEPROM Header.gtype", "Device Data Header": "niUsrpRio Config v1 Host.lvlib__EEPROM Device Data Header.gtype", "EEPROM Characterization Header": "niUsrpRio Config v1 Host.lvlib__EEPROM Characterization Header.gtype", "Characterization Data": "niUsrpRio Config v1 Host.lvlib__Characterization Data.gtype"[], "FPGA Current Version": u32, "FPGA Oldest Compatible Version": u32, "Fixed Logic Current Version": u32, "Fixed Logic Oldest Compatible Version": u32, "FPGA Radio Settings Bus Current Version": u32, "FPGA Radio Settings Bus Oldest Compatible Version": u32, "FPGA Board Config Current Version": u32, "FPGA Board Config Oldest Compatible Version": u32, "Daughterboard Clock Rate": u32}
  T7 = cluster{"FPGA ref": any, "bus instance": u32, "instruction FIFO depth": u32, "executing on FPGA target": bool, "show error call chain": bool}
  T8 = cluster{"Actual Gain [dB]": f64, "Attenuation Table Index": i32}
  T9 = cluster{"Attenuation Table [dB]": f64[][], "Frequencies [Hz]": f64[], "IQ Imbalance Table": "niUsrpRio Config v1 Host.lvlib__IQ Imbalance.gtype"[], "Gain Table": T8[][]}
  T10 = cluster{"FlexRIO Register Bus": Queue<T7>, "RX Characterization Data": T9, "TX Characterization Data": T9, "FPGA Interface": any}
  T11 = cluster{"transport block size": u32, "CRC ok": bool, "user data": u32}
  "LTE Host Session.gtype" = cluster{"target": enum{"USRP", "FlexRIO"}, "USRP session": "niUsrpRio Config v1 Host.lvlib__niUsrpRio Session.gtype", "FlexRIO session": T10, "UDP RX session": UdpNetworkConnectionRefnum, "UDP TX session": UdpNetworkConnectionRefnum, "sync found queue": Queue<bool>, "PDCCH CRC ok queue": Queue<bool>, "DL PDCCH status queue": Queue<cluster{"CRC ok": bool, "subframe number": u32}>, "DL PDSCH status queue": Queue<cluster{"CRC ok": bool, "subframe number": u32}>, "DL SINR queue": Queue<f64[]>, "PDSCH user data queue": Queue<u32>, "PDSCH user data UDP queue": Queue<T11>, "PDSCH user data throughput queue": Queue<T11>, "PUSCH user data queue": Queue<u32>, "PUSCH user data UDP queue": Queue<T11>, "PUSCH user data throughput queue": Queue<T11>, "stop notifier": Notifier<string>, "DL RX scope": string, "UL RX scope": string}
  "USRP bandwidth.gtype" = enum{"40 MHz", "120 MHz", "160 MHz"}
  "DTP Send Status.gtype" = cluster{"send packet counter": u32, "network too slow counter": u32}
  "DTP Pending Data.gtype" = cluster{"expected size": u32, "payload": u8[]}
diagram:
  sequence {
    frame 0 {
      # Set Controls to default values
      $"eNB Transmitter" <- FALSE
      $"UE Receiver" <- FALSE
      $"FPGA Ready" <- FALSE
      $"UE RX Active" <- FALSE
      $"eNB TX Active" <- FALSE
      $"Sync Found" <- FALSE
      $"PDSCH Constellation AP1" <- c128[] []
      $"PDSCH Constellation" <- c128[] []
      $"PDCCH Constellation" <- c128[] []
      Build Array(f64[] [], f64[] [], f64[] []) -> w1
      $"DL throughput" <- w1
      $"UE Failure / Block Error Rate (BLER)" <- w1
      $"channel estimation" <- w1
      $"Channel Estimation RX1TX1" <- w1
      $"UE RX Power Spectrum AP0" <- T1 {all zero or empty}
      $"eNB TX Power Spectrum AP0" <- T1 {all zero or empty}
      $"eNB TX Power Spectrum AP1" <- T1 {all zero or empty}
      $"UE RX Power Spectrum AP1" <- T1 {all zero or empty}
      $"eNB Coerced Max RF TX Power [dBm]" <- 0
      $"UE Coerced Gain [dB]" <- 0
      $"Wideband SINR [dB]" <- 0
      $"DL throughput (current)" <- 0
      $"Subband SINR [dB]" <- f64[] []
      $"PDCCH Received DCI Message" <- T5[] []
    }
  }
  call "LTE DL Host Initialization MIMO.gvi"(USRP device=$"RIO Device", session in=$session, error in=no error, USRP bandwidth=$"USRP Bandwidth", reference clock source=$"Reference Clock Source") -> (error out=w2, session out=w3)
  $session <- w3
  call "Simple Error Handler.gvi"(type of dialog="continue or stop message", error in=w2) -> (error out=w4)
  s1 = w4  # shift register
  while {
    call "LTE Unbundle Session.gvi"(session=$session) -> (FPGA Interface=w5)
    Type Cast(type=any constant, x=w5) -> w6
    Is Equal(x=$"UE RX tab", y=1) -> w7
    Select(s=w7, t="SISO", f=$"MIMO Selector AP0") -> w8
    # configure eNB RX/TX baseband and RF when enabled
    Property Node(instance in=w6, "Equalizer Type"=$"Equalizer Type", "Sigma"=$Sigma, "MIMO Selector AP0"=w8)
    Wait Until Next Multiple(multiple to wait=100)
    Feedback Node[DelayCount=2](input=w9) -> w10
    case (s1) {
      frame Error { }
      frame No Error {
        $"FPGA Ready" <- TRUE
      }
    }
    call "LTE Determine Configuration Trigger.gvi"(RX enabled=$"UE Receiver", TX enabled=$"eNB Transmitter") -> (trigger RX configuration=w11, trigger TX configuration=w12)
    # 1
    case (w11) {
      frame False, Default {
        w13 = s1
      }
      frame True {
        case ($"UE Receiver") {
          frame False, Default {
            call "LTE Disable DL RX.gvi"(session=$session, error in=s1) -> (error out=w13)
            sequence {
              frame 0 {
                $"UE RX Active" <- FALSE
              }
            }
          }
          frame True {
            call "LTE Setup DL RX Baseband.gvi"(frame structure=$"UE RX Frame Structure", session in=$session, error in=s1, cell ID=$"UE RX Cell ID", UE context=$"UE RX UE Context") -> (error out=w14, session dup=w15)
            call "LTE Setup DL Loopback.gvi"(internal DL loopback=FALSE, session in=w15, error in=w14) -> (error out=w16, session dup=w17)
            call "LTE Setup RX MIMO.gvi"(session in=w17, RX port=$"UE RX RF Port (USRP)", error in=w16, RX frequency [Hz]=$"UE RX Frequency [Hz]", gain value [dB]=$"UE Coerced Gain [dB]", LTE scope="DL") -> (session out=w18, coerced gain [dB]=w19, error out=w20, coerced frequency [Hz]=w21)
            $session <- w18
            $"UE Coerced Gain [dB]" <- w19
            $"UE RX Frequency [Hz]" <- w21
            case (w20) {
              frame Error {
                $"UE Receiver" <- FALSE
                w13 = w20
              }
              frame No Error {
                $"UE RX Active" <- TRUE
                w13 = w20
              }
            }
          }
        }
      }
    }
    case (w12) {
      frame False, Default {
        w22 = s1
      }
      frame True {
        case ($"eNB Transmitter") {
          frame False, Default {
            sequence {
              frame 0 {
                $"eNB TX Active" <- FALSE
              }
              frame 1 {
                Wait(time to wait=10)
              }
            }
            call "LTE Disable DL TX.gvi"(session=$session, error in=s1) -> (error out=w22)
          }
          frame True {
            call "LTE Setup DL TX Baseband MIMO.gvi"(session in=$session, UDP receive port=$"UDP Receive Port", frame structure=$"eNB TX Frame Structure", cell ID=$"eNB TX Cell ID", UE context=$"eNB TX UE Context", error in=s1, DCI=$"eNB TX DCI") -> (session out=w23, error out=w24)
            call "LTE Setup TX MIMO.gvi"(session in=w23, TX frequency [Hz]=$"eNB TX Frequency [Hz]", TX power level [dB]=$"eNB Max RF TX Power [dBm]", TX port=$"eNB TX RF Port (USRP)", error in=w24, LTE scope="DL", timing advance=0) -> (coerced output power [dB]=w25, error out=w26, session dup=w27, coerced frequency [Hz]=w28, coerced power level setting [dB]=w29)
            $"eNB Coerced Max RF TX Power [dBm]" <- w25
            $session <- w27
            case (w26) {
              frame No Error, Default {
                $"eNB TX Active" <- TRUE
                call "LTE Setup DL TX Set Active.gvi"(session in=w27, error in=w26) -> (error out=w22)
              }
              frame Error {
                $"eNB Transmitter" <- FALSE
                call "LTE Check UDP Port In Use.gvi"(error in=w26) -> (error out=w22)
              }
            }
            $"eNB TX Frequency [Hz]" <- w28
            $"eNB Max RF TX Power [dBm]" <- w29
          }
        }
      }
    }
    Merge Errors(w13, w22) -> (error out=w30)
    # synchronize the exit condition across all loops of the host application
    call "Create Stop.gvi"(error in=w30, stop in=$stop) -> (error out=w31)
    call "Check Stop.gvi"(error in=w31) -> (error out=w32, stop=w9)
    # Disable TX and RX to
    # ensure proper shutdown
    case (w9) {
      frame False, Default { }
      frame True {
        $"UE Receiver" <- FALSE
        $"eNB Transmitter" <- FALSE
      }
    }
    next s1 = w32
    stop if w10
  }
  call "Stop On Error.gvi"(error in=s1) -> (error out=w33)
  s2 = w4  # shift register
  while (iteration -> i1) {
    Wait Until Next Multiple(multiple to wait=50)
    call "LTE Read PDSCH Decoder Status.gvi"(session in=$session, error in=s2) -> (error out=w34, session dup=w35)
    call "LTE Get ADC and IFFT Status.gvi"(session in=w35, error in=w34) -> (ADC values clipped=w36, error out=w37, TX IFFT output clipped=w38, RX DDC values clipped=w39, session dup=w40)
    call "LTE Read DL BB Power and sync status.gvi"(error in=w37, session in=w40) -> (session dup=w41, error out=w42, RX baseband input power=w43, DL frequency offset [Hz]=w44, signal detected?=w45)
    call "LTE Read TX BB Power.gvi"(error in=w42, session in=w41, TX reference level [dBm]=$"eNB Coerced Max RF TX Power [dBm]", LTE scope="DL") -> (session dup=w46, error out=w47, TX power [dBm]=w48, TX baseband power [dBFS]=w49)
    call "LTE Calculate Power Calibration Offset.gvi"(session in=w46, frequency [Hz]=$"UE RX Frequency [Hz]", error in=w47, LTE scope="DL") -> (session dup=w50, power calibration offset [dB]=w51, error out=w52)
    $"power calibration offset [dB]" <- w51
    Not(x=$"UE AGC") -> w53
    call "LTE Control Power Gain.gvi"(expected signal range lower bound=-17, use manual gain=w53, BB input power=w43, gain in=$"UE Coerced Gain [dB]", manual gain value [dB]=$"UE Manual Gain [dB]", expected signal range upper bound=-15, power calibration offset [dB]=w51) -> (RF input power [dBm]=w54, power [dBFS]=w55, gain out=w56)
    # read sync status and baseband power levels from FPGA and feed them into automatic gain control (AGC)
    # use manual gain value if AGC is disabled
    # configure frequency offset on FPGA
    # read PDSCH decoder status
    Logical And($"UE Receiver", $"UE RX Active") -> w57
    # 2
    case (w57) {
      frame False, Default {
        w58 = w52
      }
      frame True {
        call "LTE Apply AGC Output MIMO.gvi"(session=w50, LTE scope="DL", error in=w52, apply values=w57, AGC output=w56) -> (coerced gain [dB]=w59, error out=w58)
        $"UE Coerced Gain [dB]" <- w59
      }
    }
    call "Check Stop.gvi"(error in=w58) -> (error out=w60, stop=w61)
    $"eNB RF TX Power [dBm]" <- w48
    $"eNB Baseband TX Power [dBFS]" <- w49
    $"UE Baseband RX Power [dBFS]" <- w55
    $"UE RF RX Power [dBm]" <- w54
    $"UE Applied Gain [dB]" <- $"UE Coerced Gain [dB]"
    $"UE Frequency Offset [Hz]" <- w44
    $"Sync Found" <- w45
    $"UE ADC Values Clipped" <- w36
    $"eNB TX IFFT Ouput Clipped" <- w38
    To Unsigned Long Integer(number=i1) -> w62
    Quotient And Remainder(x=w62, y=10) -> (x-y*floor(x/y)=w63)
    Is Equal To 0(x=w63) -> w64
    Logical Or(w39, w64) -> w65
    Feedback Node(enable?=w65, input=w39) -> w66
    Feedback Node(enable?=w64, input=w66) -> w67
    $"UE DDC Values Clipped" <- w67
    next s2 = w60
    stop if w61
  }
  call "Stop On Error.gvi"(error in=s2) -> (error out=w68)
  s3 = w4  # shift register
  while (iteration -> i2) {
    Wait Until Next Multiple(multiple to wait=10)
    call "LTE Read RX and TX Spectrum MIMO.gvi"(session=$session, RX power calibration offset [dB]=$"power calibration offset [dB]", error in=s3, RX active=$"UE RX Active", RX coerced gain [dB]=$"UE Coerced Gain [dB]", TX coerced gain [dB]=$"eNB Coerced Max RF TX Power [dBm]", counter=i2) -> (update TX spectrum=w69, TX power spectrum=w70, error out=w71, TX power spectrum AP1=w72, update RX spectrum=w73, RX power spectrum=w74, RX power spectrum AP1=w75)
    # read RX/TX baseband data values and PDCCH/PDSCH constellation data from FPGA and draw corresponding diagrams
    case (w69) {
      frame False, Default { }
      frame True {
        $"eNB TX Power Spectrum AP0" <- w70
        $"eNB TX Power Spectrum AP1" <- w72
      }
    }
    case (w73) {
      frame False, Default { }
      frame True {
        $"UE RX Power Spectrum AP0" <- w74
        $"UE RX Power Spectrum AP1" <- w75
      }
    }
    call "LTE Read PDCCH Data.gvi"(session in=$session, error in=s3, counter=i2) -> (DCI messages=w76, display PDCCH data=w77, error out=w78)
    call "LTE Read Constellation Data MIMO.gvi"(counter=i2, session=$session, error in=s3, symbol number for display=$"symbol number for PDSCH constellation", RX tab=$"UE RX tab") -> (constellation data=w79, display data=w80, error out=w81, displayed constellation=w82, constellation data AP1=w83)
    call "LTE Read Channel Estimates.gvi"(counter=i2, session=$session, error in=s3, UE Context=$"UE RX UE Context") -> (channel estimation=w84, display data=w85, error out=w86, subband SNR [dB]=w87, wideband SNR [dB]=w88)
    call "LTE Configure RF Timing Offset.gvi"(RF timing offset=$"eNB Timing Offset", session=$session, error in=s3) -> (error out=w89)
    call "LTE Read Channel Estimates MIMO.gvi"(session=$session, counter=i2, error in=s3) -> (channel estimation RX1TX1=w90, error out=w91, display data=w92)
    Merge Errors(w71, w78, w81, w86, w89, w91) -> (error out=w93)
    # 3
    call "Check Stop.gvi"(error in=w93) -> (error out=w94, stop=w95)
    case (w77) {
      frame False, Default { }
      frame True {
        $"PDCCH Received DCI Message" <- w76
      }
    }
    case (w80) {
      frame False, Default { }
      frame True {
        case (w82) {
          frame "DL EQ Output", Default {
            $"PDCCH Constellation" <- w79
          }
          frame "PDSCH Dec Input" {
            $"PDSCH Constellation" <- w79
            $"PDSCH Constellation AP1" <- w83
          }
        }
      }
    }
    case (w85) {
      frame False, Default { }
      frame True {
        $"channel estimation" <- w84
        $"Subband SINR [dB]" <- w87
        $"Wideband SINR [dB]" <- w88
      }
    }
    case (w92) {
      frame False, Default { }
      frame True {
        $"Channel Estimation RX1TX1" <- w90
      }
    }
    next s3 = w94
    stop if w95
  }
  call "Stop On Error.gvi"(error in=s3) -> (error out=w96)
  s4 = 0  # shift register
  s5 = f64[] []  # shift register
  while {
    Wait Until Next Multiple(multiple to wait=1000)
    Tick Count() -> (timer value=w97)
    Subtract(x=w97, y=s4) -> w98
    call "LTE Calculate DL Throughput and BLER.gvi"(time difference=w98, session=$session, error in=w4, DL throughput previous=s5, throughput select=$"throughput select") -> (DL throughput (current)=w99, DL throughput averaged=w100, DL BLER=w101, BLER cluster=w102, error out=w103, DL throughput current=w104)
    # compute throughput and block error rate and draw corresponding diagrams
    # 4
    case ($"UE RX Active") {
      frame False, Default { }
      frame True {
        $"DL throughput (current)" <- w99
        $"DL throughput" <- w100
        $"UE Failure / Block Error Rate (BLER)" <- w101
      }
    }
    call "Check Stop.gvi"(error in=w103) -> (error out=w105, stop=w106)
    $"BLER cluster" <- w102
    next s4 = w97
    next s5 = w104
    stop if w106
  }
  call "Stop On Error.gvi"(error in=w105) -> (error out=w107)
  s6 = w4  # shift register
  while {
    # Update dynamic UE contexts
    case ($"eNB TX Active") {
      frame False, Default {
        Wait(time to wait=10)
        w108 = s6
        w109 = TRUE
      }
      frame True {
        call "LTE Receive Timing Indication.gvi"(session=$session, error in=s6) -> (session dup=w110, error out=w111, new timing indication=w109)
        case (w109) {
          frame False, Default {
            w108 = w111
          }
          frame True {
            case ($"Rate Adaption") {
              frame False, Default {
                w112 = $"eNB TX DCI"
                w113 = w111
              }
              frame True {
                call "LTE MCS Regulation MIMO.gvi"(SNR offset [dB]=$"SINR Offset [dB]", wideband SNR=$"Wideband SINR [dB]", DCI in=$"eNB TX DCI", UE context=$"eNB TX UE Context") -> (DCI out=w112)
                w113 = w111
              }
            }
            call "LTE Send Dynamic DL TX Configuration MIMO.gvi"(DCI in=w112, UE context=$"eNB TX UE Context", session=w110, error in=w113) -> (error out=w108, coerced DCI=w114, MCS adapted=w115)
            case (w115) {
              frame False, Default { }
              frame True {
                $"eNB TX DCI" <- w114
              }
            }
          }
        }
      }
    }
    Logical And($"UE RX Active", w109) -> w116
    # 5
    case (w116) {
      frame False, Default {
        w117 = w108
      }
      frame True {
        call "LTE Send Dynamic DL RX Configuration MIMO.gvi"(session=$session, UE context=$"UE RX UE Context", error in=w108) -> (error out=w117)
      }
    }
    call "Check Stop.gvi"(error in=w117) -> (error out=w118, stop=w119)
    next s6 = w118
    stop if w119
  }
  call "Stop On Error.gvi"(error in=s6) -> (error out=w120)
  s7 = w4  # shift register
  s8 = 0  # shift register
  while {
    Wait Until Next Multiple[Units=Microseconds](multiple to wait=1)
    # receive UDP data from network and send it to the FPGA as PDSCH payload data of the transmitter
    call "LTE Receive UDP Data.gvi"(session=$session, eNB TX active=$"eNB TX Active", UDP packet counter in=s8, error in=s7) -> (FIFO full=w121, data transfer=w122, UDP packet counter out=w123, error out=w124)
    $"Packet Loss In" <- w121
    $"Data Transfer In" <- w122
    # 6
    call "Check Stop.gvi"(error in=w124) -> (error out=w125, stop=w126)
    next s7 = w125
    next s8 = w123
    stop if w126
  }
  call "Stop On Error.gvi"(error in=s7) -> (error out=w127)
  s9 = w4  # shift register
  s10 = "DTP Pending Data.gtype" {all zero or empty}  # shift register
  s11 = "DTP Send Status.gtype" {all zero or empty}  # shift register
  while {
    call "LTE Send UDP Data.gvi"(transmit port=$"UDP Transmit Port", transmit IP address=$"Transmit IP Address", session=$session, enable MAC RX=TRUE, error in=s9, pending data in=s10, UDP send status in=s11) -> (error out=w128, network too slow=w129, transferring data=w130, pending data out=w131, UDP send status out=w132)
    # read received PDSCH payload data from FPGA and send it to the specified UDP port
    $"Data Transfer Out" <- w130
    $"Packet Loss Out" <- w129
    Wait Until Next Multiple(multiple to wait=1)
    call "Check Stop.gvi"(error in=w128) -> (error out=w133, stop=w134)
    next s9 = w133
    next s10 = w131
    next s11 = w132
    stop if w134
  }
  call "Stop On Error.gvi"(error in=s9) -> (error out=w135)
  Merge Errors(w33, w68, w96, w107, w120, w127, w135) -> (error out=w136)
  sequence {
    frame 0 {
      call "LTE DL Host Cleanup.gvi"(session=$session, error in=w136) -> (error out=w137)
      $"FPGA Ready" <- FALSE
    }
  }
  call "Simple Error Handler.gvi"(type of dialog="OK message", error in=w137)
