vi "LTE Calculate Channel Estimates MIMO.gvi"   [LabVIEW Communications System Design Suite 2.0.1]
# Extracts channel coefficients based on cell-specific reference symbols in OFDM symbol 0 from an array of estimated channel coefficients.
inputs:
  "estimated channel coefficients": c128[]  # Estimated channel coefficients estimated with cell-specific and UE-specific reference symbols.
  "timing indices": T1[]  # Timing information for estimated channel coefficients.
outputs:
  "CRS phase": f64[]  # Phase of extracted channel coefficients (based on CRS in OFDM symbol 0).
  "CRS amplitude": f64[]  # Amplitude of extracted channel coefficients. based on CRS in OFDM symbol 0.
types:
  T1 = cluster{"symbol index (0-13)": u8, "RB index (0-99)": u8, "subframe index (0-9)": u8, "subcarrier index (0-11)": u8, "UERS": bool}
diagram:
  # select one subframe
  # of CRS and UERS
  # (200+300)*4
  Array Index(array=$"timing indices") -> (out0[_]=w1)
  # skip first 200 symbols
  # in case symbol 0 is the
  # first symbol
  Property Node(instance in=w1) -> ("symbol index (0-13)"=w2)
  Is Equal To 0(x=w2) -> w3
  Select(s=w3, t=200, f=0) -> w4
  Array Subset(array=$"timing indices", index0=w4, length0=2000) -> w5
  Array Subset(array=$"estimated channel coefficients", index0=w4, length0=2000) -> w6
  s1 = c128[] []  # shift register
  for {
    w7 = each element of w5
    w8 = each element of w6
    # Filter CRS for symbol 0
    Property Node(instance in=w7) -> ("UERS"=w9, "symbol index (0-13)"=w10)
    Is Equal To 0(x=w10) -> w11
    Logical And(not w9, w11) -> w12
    case (w12) {
      frame True {
        Build Array[ConcatenateInputs=True](s1, w8) -> w13
      }
      frame False {
        w13 = s1
      }
    }
    next s1 = w13
  }
  Array Subset(array=s1, length0=200) -> w14
  Complex To Polar(r * e^(i*theta)=w14) -> (r=w15, theta=w16)
  Logarithm Base 10(x=w15) -> w17
  Multiply(10, w17) -> w18
  Add Array Elements(numeric array=w18) -> (sum=w19)
  Array Size(array=w18) -> (size(s)=w20)
  To Double Precision Float(number=w20) -> w21
  Divide(x=w19, y=w21) -> w22
  Subtract(x=w18, y=w22) -> w23
  $"CRS amplitude" <- w23
  $"CRS phase" <- w16
