vi "LTE Calculate RX Power Spectrum MIMO.gvi"   [LabVIEW Communications System Design Suite 2.0.1]
# Reinterprets receiver data values read from the FPGA and calculates the RX power spectrum.
inputs:
  "RX data AP1": u32[]  # Array of RX data values read from the FPGA. Only the first 30,720 values are used for spectrum calculation.
  "coerced gain [dB]": f64 = -10  # Coerced RX gain used for RX spectrum magnitude correction. This correction is required because RX values on the FPGA are captured after RX gain is applied.
  "error in": error
  "power calibration offset [dB]": f64 = -10  # Frequency dependent power offset that is applied to the RX baseband sample stream from the FPGA to ensure that the RX power levels in the displayed spectrum are correct.
  "RX data AP0": u32[]  # Array of RX data values read from the FPGA. Only the first 30,720 values are used for spectrum calculation.
outputs:
  "RX power spectrum AP1": T1  # Calculated RX power spectrum for 1 subframe (30,720 samples).
  "error out": error
  "RX power spectrum AP0": T1  # Calculated RX power spectrum for 1 subframe (30,720 samples).
types:
  T1 = cluster{"f0": f64, "df": f64, "magnitude": f64[]}
  T2 = enum{"No averaging", "Vector averaging", "RMS averaging", "Peak hold"}
  "Averaging Parameters.gtype" = cluster{"averaging mode": T2, "weighting mode": enum{"Linear", "Exponential"}, "number of averages": u32}
uses:
  NI::Analysis::Measurement::Power Spectrum for 1 Chan (CDB).gvi
diagram:
  Array Subset(array=$"RX data AP0", length0=30720) -> w1
  Split Number(x=w1) -> (high(x)=w2, low(x)=w3)
  for {
    w4 = each element of w2
    w5 = each element of w3
    Reinterpret Number[RestrictToSameWordLength=True](data in=w5, type=UFXP(1.15) 0) -> (data out=w7)
    To Fixed Point(fixed-point type=FXP(1.15) 0, number=w7) -> w8: FXP(1.15) Wrap:Truncate
    To Double Precision Float(number=w8) -> w9
    Reinterpret Number[RestrictToSameWordLength=True](data in=w4, type=UFXP(1.15) 0) -> (data out=w10)
    To Fixed Point(fixed-point type=FXP(1.15) 0, number=w10) -> w11: FXP(1.15) Wrap:Truncate
    To Double Precision Float(number=w11) -> w12
    Real And Imaginary To Complex(x=w9, y=w12) -> w13
    append w13 to w6
  }
  Reciprocal(x=30720000) -> w14
  Property Node(instance in=waveform<c128> {dt=1, Y=[]}, "Y"=w6, "dt"=w14) -> (instance out=w15)
  call "Power Spectrum for 1 Chan (CDB).gvi"(signal=w15, window type="Rectangle"(0), averaging parameters="Averaging Parameters.gtype" {all zero or empty}, dB on=TRUE, error in=$"error in", restart averaging=FALSE) -> (power spectrum=w16, error out=w17)
  Property Node(instance in=w16) -> ("magnitude"=w18, instance out=w19)
  Add(w18, $"power calibration offset [dB]") -> w20
  Subtract(x=w20, y=$"coerced gain [dB]") -> w21
  Property Node(instance in=w19, "magnitude"=w21) -> (instance out=w22)
  $"RX power spectrum AP0" <- w22
  Array Subset(array=$"RX data AP1", length0=30720) -> w23
  Split Number(x=w23) -> (high(x)=w24, low(x)=w25)
  for {
    w26 = each element of w24
    w27 = each element of w25
    Reinterpret Number[RestrictToSameWordLength=True](data in=w27, type=UFXP(1.15) 0) -> (data out=w29)
    To Fixed Point(fixed-point type=FXP(1.15) 0, number=w29) -> w30: FXP(1.15) Wrap:Truncate
    To Double Precision Float(number=w30) -> w31
    Reinterpret Number[RestrictToSameWordLength=True](data in=w26, type=UFXP(1.15) 0) -> (data out=w32)
    To Fixed Point(fixed-point type=FXP(1.15) 0, number=w32) -> w33: FXP(1.15) Wrap:Truncate
    To Double Precision Float(number=w33) -> w34
    Real And Imaginary To Complex(x=w31, y=w34) -> w35
    append w35 to w28
  }
  Reciprocal(x=30720000) -> w36
  Property Node(instance in=waveform<c128> {dt=1, Y=[]}, "Y"=w28, "dt"=w36) -> (instance out=w37)
  call "Power Spectrum for 1 Chan (CDB).gvi"(signal=w37, window type="Rectangle"(0), averaging parameters="Averaging Parameters.gtype" {all zero or empty}, dB on=TRUE, error in=$"error in", restart averaging=FALSE) -> (power spectrum=w38, error out=w39)
  Property Node(instance in=w38) -> ("magnitude"=w40, instance out=w41)
  Add(w40, $"power calibration offset [dB]") -> w42
  Subtract(x=w42, y=$"coerced gain [dB]") -> w43
  Property Node(instance in=w41, "magnitude"=w43) -> (instance out=w44)
  $"RX power spectrum AP1" <- w44
  Merge Errors(w17, w39) -> (error out=w45)
  $"error out" <- w45
