vi "LTE DL RX FIFO Initialization MIMO.gvi"   [LabVIEW Communications System Design Suite 2.0.1]
# Configures the depth of the host-side FIFO for all target-to-host and host-to-target FIFOs used for the DL receiver, and starts the DMA data transfer between the FPGA and the host.
inputs:
  "session": "LTE Host Session.gtype"  # Contains session information such as used target, FlexRIO and USRP sessions, FPGA reference, and queue references.
  "error in": error
outputs:
  "error out": error
types:
  "niInstr Register Bus v0 Host.lvlib__Register Bus Session.gtype" = Queue<"niInstr Register Bus v0 Host.lvlib__Session Data.gtype">
  "Semaphore RefNum.gtype" = i32
  "niUsrpRio Config v1 Host.lvlib__DB Queue Reference.gtype" = Queue<"niUsrpRio Config v1 Host.lvlib__Daughterboard Data.gtype">
  "niUsrpRio Config v1 Host.lvlib__niUsrpRio Session.gtype" = cluster{"FPGA Interface": any, "RIO Interface Number": u32, "Data Clock Rate": u32, "FPGA Data Clock Rate": u32, "Global Settings Register Bus": "niInstr Register Bus v0 Host.lvlib__Register Bus Session.gtype", "Radio 0 Settings Register Bus": "niInstr Register Bus v0 Host.lvlib__Register Bus Session.gtype", "Radio 1 Settings Register Bus": "niInstr Register Bus v0 Host.lvlib__Register Bus Session.gtype", "Radio Settings Bus Semaphore": "Semaphore RefNum.gtype", "DB Queues": "niUsrpRio Config v1 Host.lvlib__DB Queue Reference.gtype"[], "Characterization Data Valid?": bool, "EEPROM Header": "niUsrpRio Config v1 Host.lvlib__EEPROM Header.gtype", "Device Data Header": "niUsrpRio Config v1 Host.lvlib__EEPROM Device Data Header.gtype", "EEPROM Characterization Header": "niUsrpRio Config v1 Host.lvlib__EEPROM Characterization Header.gtype", "Characterization Data": "niUsrpRio Config v1 Host.lvlib__Characterization Data.gtype"[], "FPGA Current Version": u32, "FPGA Oldest Compatible Version": u32, "Fixed Logic Current Version": u32, "Fixed Logic Oldest Compatible Version": u32, "FPGA Radio Settings Bus Current Version": u32, "FPGA Radio Settings Bus Oldest Compatible Version": u32, "FPGA Board Config Current Version": u32, "FPGA Board Config Oldest Compatible Version": u32, "Daughterboard Clock Rate": u32}
  T1 = cluster{"FPGA ref": any, "bus instance": u32, "instruction FIFO depth": u32, "executing on FPGA target": bool, "show error call chain": bool}
  T2 = cluster{"Actual Gain [dB]": f64, "Attenuation Table Index": i32}
  T3 = cluster{"Attenuation Table [dB]": f64[][], "Frequencies [Hz]": f64[], "IQ Imbalance Table": "niUsrpRio Config v1 Host.lvlib__IQ Imbalance.gtype"[], "Gain Table": T2[][]}
  T4 = cluster{"FlexRIO Register Bus": Queue<T1>, "RX Characterization Data": T3, "TX Characterization Data": T3, "FPGA Interface": any}
  T5 = cluster{"transport block size": u32, "CRC ok": bool, "user data": u32}
  "LTE Host Session.gtype" = cluster{"target": enum{"USRP", "FlexRIO"}, "USRP session": "niUsrpRio Config v1 Host.lvlib__niUsrpRio Session.gtype", "FlexRIO session": T4, "UDP RX session": UdpNetworkConnectionRefnum, "UDP TX session": UdpNetworkConnectionRefnum, "sync found queue": Queue<bool>, "PDCCH CRC ok queue": Queue<bool>, "DL PDCCH status queue": Queue<cluster{"CRC ok": bool, "subframe number": u32}>, "DL PDSCH status queue": Queue<cluster{"CRC ok": bool, "subframe number": u32}>, "DL SINR queue": Queue<f64[]>, "PDSCH user data queue": Queue<u32>, "PDSCH user data UDP queue": Queue<T5>, "PDSCH user data throughput queue": Queue<T5>, "PUSCH user data queue": Queue<u32>, "PUSCH user data UDP queue": Queue<T5>, "PUSCH user data throughput queue": Queue<T5>, "stop notifier": Notifier<string>, "DL RX scope": string, "UL RX scope": string}
diagram:
  call "LTE Unbundle Session.gvi"(session=$session) -> (FPGA Interface=w1)
  Type Cast(type=any constant, x=w1) -> w2
  Host Fifo Configure Node[FifoName="LTE AFW Resources.grsc\\T2H RX Constellation"](depth=1000000, error in=$"error in", reference in=w2) -> (error out=w3, reference out=w4)
  Host Fifo Start Node[FifoName="LTE AFW Resources.grsc\\T2H RX Constellation"](error in=w3, reference in=w4) -> (error out=w5)
  Host Fifo Configure Node[FifoName="LTE AFW Resources MIMO.grsc\\T2H RX Constellation AP1"](depth=1000000, error in=$"error in", reference in=w2) -> (error out=w6, reference out=w7)
  Host Fifo Start Node[FifoName="LTE AFW Resources MIMO.grsc\\T2H RX Constellation AP1"](error in=w6, reference in=w7) -> (error out=w8)
  Host Fifo Configure Node[FifoName="LTE AFW Resources.grsc\\T2H PDCCH Message"](depth=1000000, error in=$"error in", reference in=w2) -> (error out=w9, reference out=w10)
  Host Fifo Start Node[FifoName="LTE AFW Resources.grsc\\T2H PDCCH Message"](error in=w9, reference in=w10) -> (error out=w11)
  Host Fifo Configure Node[FifoName="LTE AFW Resources.grsc\\T2H PDSCH Decoded Data"](depth=100000000, error in=$"error in", reference in=w2) -> (error out=w12, reference out=w13)
  Host Fifo Start Node[FifoName="LTE AFW Resources.grsc\\T2H PDSCH Decoded Data"](error in=w12, reference in=w13) -> (error out=w14)
  Host Fifo Configure Node[FifoName="LTE AFW Resources.grsc\\T2H PDSCH Decoding Status"](depth=1000000, error in=$"error in", reference in=w2) -> (error out=w15, reference out=w16)
  Host Fifo Start Node[FifoName="LTE AFW Resources.grsc\\T2H PDSCH Decoding Status"](error in=w15, reference in=w16) -> (error out=w17)
  Host Fifo Configure Node[FifoName="LTE AFW Resources MIMO.grsc\\T2H RX Baseband Stream MIMO"](depth=1000000, error in=$"error in", reference in=w2) -> (error out=w18, reference out=w19)
  Host Fifo Start Node[FifoName="LTE AFW Resources MIMO.grsc\\T2H RX Baseband Stream MIMO"](error in=w18, reference in=w19) -> (error out=w20)
  Host Fifo Configure Node[FifoName="LTE AFW Resources.grsc\\T2H RX Channel Estimates"](depth=1000000, error in=$"error in", reference in=w2) -> (error out=w21, reference out=w22)
  Host Fifo Start Node[FifoName="LTE AFW Resources.grsc\\T2H RX Channel Estimates"](error in=w21, reference in=w22) -> (error out=w23)
  Host Fifo Configure Node[FifoName="LTE AFW Resources.grsc\\H2T DL RX Dynamic Configuration"](depth=1000, error in=$"error in", reference in=w2) -> (error out=w24, reference out=w25)
  Host Fifo Start Node[FifoName="LTE AFW Resources.grsc\\H2T DL RX Dynamic Configuration"](error in=w24, reference in=w25) -> (error out=w26)
  Host Fifo Configure Node[FifoName="LTE AFW Resources MIMO.grsc\\channel estimate RX1TX1"](depth=1000000, error in=$"error in", reference in=w2) -> (error out=w27, reference out=w28)
  Host Fifo Start Node[FifoName="LTE AFW Resources MIMO.grsc\\channel estimate RX1TX1"](error in=w27, reference in=w28) -> (error out=w29)
  Merge Errors(w5, w8, w11, w14, w17, w20, w23, w26, w29) -> (error out=w30)
  $"error out" <- w30
