vi "LTE DL TTI Configuration To U64 MIMO.gvi"   [LabVIEW Communications System Design Suite 2.0.1]
# Converts the TTI configuration from the cluster input to a binary packed U64 format.
inputs:
  "TTI configuration cluster": cluster{"UE config": T1, "DCI message": T2}  # Cluster containing a per subframe changeable UE specific parameter set (RNTI, CCE offset, UERS configuration) and the full DCI message.
outputs:
  "TTI configuration out": u64  # The TTI configuration converted to a binary packed U64 value.
types:
  T1 = cluster{"RNTI": u16, "use UERS": bool, "antenna port": UFXP(4.0), "CCE offset": u8}
  T2 = cluster{"valid": bool, "resource allocation header": UFXP(1.0), "resource block allocation": UFXP(25.0), "MCS": UFXP(5.0), "HARQ process number": UFXP(4.0), "new data indicator": bool, "redundancy version": UFXP(2.0), "TPC command for pucch": UFXP(2.0), "DL assignment index": UFXP(2.0), "MIMO flag": bool}
diagram:
  Property Node(instance in=$"TTI configuration cluster") -> ("UE config:RNTI"=w1, "UE config:use UERS"=w2, "UE config:antenna port"=w3, "UE config:CCE offset"=w4, "DCI message:valid"=w5, "DCI message:MIMO flag"=w6, "DCI message:resource block allocation"=w7, "DCI message:MCS"=w8, "DCI message:TPC command for pucch"=w9)
  Number To Boolean Array(number=w7) -> (Boolean array=w10)
  Number To Boolean Array(number=w8) -> (Boolean array=w11)
  Number To Boolean Array(number=w9) -> (Boolean array=w12)
  Build Array[ConcatenateInputs=True](w10, w11, w12) -> w13
  Boolean Array To Number(Boolean array=w13) -> (number=w14: u32)
  Number To Boolean Array(number=w3) -> (Boolean array=w15)
  Build Array[ConcatenateInputs=True](w2, w15, w5, w6) -> w16
  Boolean Array To Number(Boolean array=w16) -> (number=w17: u8)
  Join Numbers(high(x)=w4, low(x)=w17) -> w18
  Join Numbers(high(x)=w1, low(x)=w18) -> w19
  Join Numbers(high(x)=w19, low(x)=w14) -> w20
  $"TTI configuration out" <- w20
