vi "LTE MCS Regulation MIMO.gvi"   [LabVIEW Communications System Design Suite 2.0.1]
# Calculates MCS value for downlink (DL) TX PDSCH transmission, based on reported wideband SNR.
# The MCS calculation is calibrated to achieve a block error rate of about 5% at the DL RX receiver. This target BLER can be adapted using the SNR offset [dB] input.
inputs:
  "SNR offset [dB]": f64  # Signal-to-noise ratio (SNR) offset value, in dB, used to adapt the target range for the MCS regulation. If set to 1 dB, the needed minimum SNR value for a specific MCS is 1 dB higher, which results in a lower block error rate at the downlink receiver.
  "wideband SNR": f64 = 22.25  # Reported downlink wideband SNR value received via PUSCH feedback channel.
  "DCI in": T3 = {"Active"=TRUE, "MCS"="MCS 17 (64-QAM, rate ~0.43)", "Resource Block Allocation (4 PRB/bit)"=8388607, "MIMO flag"=FALSE}  # The downlink control information message (DCI message) which is a subset of Format 1 as specified in TS 36.212. It consists of the resource block allocation and the modulation and coding scheme (MCS).
  "UE context": T1 = {"RNTI"=10, "use UERS"=FALSE, "antenna port"=7, "CCE offset"=0}  # Per subframe changeable UE specific parameter set (RNTI, CCE offset, UERS configuration).
outputs:
  "DCI out": T3  # DCI message where the modulation and coding scheme (MCS) has been set accordingly.
types:
  T1 = cluster{"RNTI": u16, "use UERS": bool, "antenna port": UFXP(4.0), "CCE offset": u8}
  T2 = enum{"MCS 0 (QPSK, rate ~0.12)", "MCS 1 (QPSK, rate ~0.15)", "MCS 2 (QPSK, rate ~0.19)", "MCS 3 (QPSK, rate ~0.25)", "MCS 4 (QPSK, rate ~0.30)", "MCS 5 (QPSK, rate ~0.37)", "MCS 6 (QPSK, rate ~0.44)", "MCS 7 (QPSK, rate ~0.51)", "MCS 8 (QPSK, rate ~0.59)", "MCS 9 (QPSK, rate ~0.66)", "MCS 10 (16-QAM, rate ~0.33)", "MCS 11 (16-QAM, rate ~0.37)", "MCS 12 (16-QAM, rate ~0.42)", "MCS 13 (16-QAM, rate ~0.48)", "MCS 14 (16-QAM, rate ~0.54)", "MCS 15 (16-QAM, rate ~0.60)", "MCS 16 (16-QAM, rate ~0.64)", "MCS 17 (64-QAM, rate ~0.43)", "MCS 18 (64-QAM, rate ~0.46)", "MCS 19 (64-QAM, rate ~0.50)", "MCS 20 (64-QAM, rate ~0.55)", "MCS 21 (64-QAM, rate ~0.60)", "MCS 22 (64-QAM, rate ~0.65)", "MCS 23 (64-QAM, rate ~0.70)", "MCS 24 (64-QAM, rate ~0.75)", "MCS 25 (64-QAM, rate ~0.80)", "MCS 26 (64-QAM, rate ~0.85)", "MCS 27 (64-QAM, rate ~0.89)", "MCS 28 (64-QAM, rate ~0.93)"}
  T3 = cluster{"Active": bool, "MCS": T2, "Resource Block Allocation (4 PRB/bit)": UFXP(25.0), "MIMO flag": bool}
diagram:
  Property Node(instance in=$"UE context") -> ("use UERS"=w1)
  w2 = [6.8, 7.3, 7.8, 8.3, 8.8, 9.3, 9.8, 10.2, 10.6, 12.8, 13.2, 13.8, 14.4, 14.7, 15, 15.4, 16.2, 16.6, 17.1, 17.4, 18, 18.5, 19.5, 20.1, 21.2, 22.4, 22.8, 26.6, Inf]
  Add($"SNR offset [dB]", w2) -> w3
  Is Greater Or Equal(x=$"wideband SNR", y=w3) -> w4
  Search 1D Array(1D array=w4, element=FALSE, start index (0)=0) -> (index of element=w5)
  To Unsigned Word Integer(number=w5) -> w6
  case (w1) {
    frame False, Default {
      w7 = w6
    }
    frame True {
      In Range And Coerce(lower limit=0, upper limit=27, x=w6) -> (coerced(x)=w7)
    }
  }
  Type Cast(type=T2 "MCS 0 (QPSK, rate ~0.12)", x=w7) -> w8
  Property Node(instance in=$"DCI in", "MCS"=w8) -> (instance out=w9)
  $"DCI out" <- w9
