vi "LTE Read Channel Estimates MIMO.gvi"   [LabVIEW Communications System Design Suite 2.0.1]
inputs:
  "session": "LTE Host Session.gtype"  # Contains session information such as used target, FlexRIO and USRP sessions, FPGA reference, and queue references.
  "counter": i32  # Loop iteration counter of calling loop used to display only parts of the calculated data to reduce CPU load.
  "error in": error
outputs:
  "channel estimation RX1TX1": f64[][]  # Amplitude and phase of extracted channel coefficients (based on CRS in OFDM symbol 0).
  "error out": error
  "display data": bool  # Trigger for displaying the calculated data on the host top level panel.
types:
  "niInstr Register Bus v0 Host.lvlib__Register Bus Session.gtype" = Queue<"niInstr Register Bus v0 Host.lvlib__Session Data.gtype">
  "Semaphore RefNum.gtype" = i32
  "niUsrpRio Config v1 Host.lvlib__DB Queue Reference.gtype" = Queue<"niUsrpRio Config v1 Host.lvlib__Daughterboard Data.gtype">
  "niUsrpRio Config v1 Host.lvlib__niUsrpRio Session.gtype" = cluster{"FPGA Interface": any, "RIO Interface Number": u32, "Data Clock Rate": u32, "FPGA Data Clock Rate": u32, "Global Settings Register Bus": "niInstr Register Bus v0 Host.lvlib__Register Bus Session.gtype", "Radio 0 Settings Register Bus": "niInstr Register Bus v0 Host.lvlib__Register Bus Session.gtype", "Radio 1 Settings Register Bus": "niInstr Register Bus v0 Host.lvlib__Register Bus Session.gtype", "Radio Settings Bus Semaphore": "Semaphore RefNum.gtype", "DB Queues": "niUsrpRio Config v1 Host.lvlib__DB Queue Reference.gtype"[], "Characterization Data Valid?": bool, "EEPROM Header": "niUsrpRio Config v1 Host.lvlib__EEPROM Header.gtype", "Device Data Header": "niUsrpRio Config v1 Host.lvlib__EEPROM Device Data Header.gtype", "EEPROM Characterization Header": "niUsrpRio Config v1 Host.lvlib__EEPROM Characterization Header.gtype", "Characterization Data": "niUsrpRio Config v1 Host.lvlib__Characterization Data.gtype"[], "FPGA Current Version": u32, "FPGA Oldest Compatible Version": u32, "Fixed Logic Current Version": u32, "Fixed Logic Oldest Compatible Version": u32, "FPGA Radio Settings Bus Current Version": u32, "FPGA Radio Settings Bus Oldest Compatible Version": u32, "FPGA Board Config Current Version": u32, "FPGA Board Config Oldest Compatible Version": u32, "Daughterboard Clock Rate": u32}
  T1 = cluster{"FPGA ref": any, "bus instance": u32, "instruction FIFO depth": u32, "executing on FPGA target": bool, "show error call chain": bool}
  T2 = cluster{"Actual Gain [dB]": f64, "Attenuation Table Index": i32}
  T3 = cluster{"Attenuation Table [dB]": f64[][], "Frequencies [Hz]": f64[], "IQ Imbalance Table": "niUsrpRio Config v1 Host.lvlib__IQ Imbalance.gtype"[], "Gain Table": T2[][]}
  T4 = cluster{"FlexRIO Register Bus": Queue<T1>, "RX Characterization Data": T3, "TX Characterization Data": T3, "FPGA Interface": any}
  T5 = cluster{"transport block size": u32, "CRC ok": bool, "user data": u32}
  "LTE Host Session.gtype" = cluster{"target": enum{"USRP", "FlexRIO"}, "USRP session": "niUsrpRio Config v1 Host.lvlib__niUsrpRio Session.gtype", "FlexRIO session": T4, "UDP RX session": UdpNetworkConnectionRefnum, "UDP TX session": UdpNetworkConnectionRefnum, "sync found queue": Queue<bool>, "PDCCH CRC ok queue": Queue<bool>, "DL PDCCH status queue": Queue<cluster{"CRC ok": bool, "subframe number": u32}>, "DL PDSCH status queue": Queue<cluster{"CRC ok": bool, "subframe number": u32}>, "DL SINR queue": Queue<f64[]>, "PDSCH user data queue": Queue<u32>, "PDSCH user data UDP queue": Queue<T5>, "PDSCH user data throughput queue": Queue<T5>, "PUSCH user data queue": Queue<u32>, "PUSCH user data UDP queue": Queue<T5>, "PUSCH user data throughput queue": Queue<T5>, "stop notifier": Notifier<string>, "DL RX scope": string, "UL RX scope": string}
diagram:
  Quotient And Remainder(x=$counter, y=10) -> (x-y*floor(x/y)=w1)
  Is Equal To 0(x=w1) -> w2
  call "LTE Unbundle Session.gvi"(session=$session) -> (FPGA Interface=w3)
  Type Cast(type=any constant, x=w3) -> w4
  Host Fifo Read Node[FifoName="LTE AFW Resources MIMO.grsc\\channel estimate RX1TX1"](error in=$"error in", number of elements=0, reference in=w4, timeout (ms)=0) -> (elements remaining=w5, error out=w6, reference out=w7)
  Host Fifo Read Node[FifoName="LTE AFW Resources MIMO.grsc\\channel estimate RX1TX1"](error in=w6, number of elements=w5, reference in=w7, timeout (ms)=0) -> (data=w8, error out=w9)
  Array Size(array=w8) -> (size(s)=w10)
  Is Not Equal To 0(x=w10) -> w11
  Logical And(w2, w11) -> w12
  $"display data" <- w12
  call "LTE U64 to Channel Estimates.gvi"(signal in=w8) -> (timing indices=w13, estimated channel coefficients=w14)
  call "LTE Calculate Channel Estimates.gvi"(estimated channel coefficients=w14, timing indices=w13) -> (CRS phase=w15, CRS amplitude=w16)
  Build Array(w16, w15) -> w17
  $"channel estimation RX1TX1" <- w17
  $"error out" <- w9
