vi "LTE Read Constellation Data MIMO.gvi"   [LabVIEW Communications System Design Suite 2.0.1]
# Reads data from the target-to-host constellation data FIFO, reinterprets the received values to the correct data type, and provides a trigger signal for displaying that data on the host top level panel.
inputs:
  "counter": i32  # Loop iteration counter of the calling loop used for displaying only parts of the calculated data to reduce CPU load.
  "session": "LTE Host Session.gtype"  # Contains session information such as used target, FlexRIO and USRP sessions, FPGA reference, and queue references.
  "error in": error
  "symbol number for display": u8  # Only the constellation data samples of the specified OFDM symbol that is read from the FPGA.
  "RX tab": i32 = -1  # Selector for displayed constellation. 0 is DL RX basic, 1 is DL RX advanced. Anything else for UL RX
outputs:
  "constellation data": c128[]  # Constellation data values from the FPGA reinterpreted as complex double values. Only the first 4,000 received values are provided each time the node is called, in order to reduce CPU load.
  "display data": bool  # Trigger for displaying the constellation data on the host top level panel.
  "error out": error
  "displayed constellation": T6  # Determines the selected display of data
  "constellation data AP1": c128[]  # Constellation data values from the FPGA reinterpreted as complex double values. Only the first 4,000 received values are provided each time the node is called, in order to reduce CPU load.
types:
  "niInstr Register Bus v0 Host.lvlib__Register Bus Session.gtype" = Queue<"niInstr Register Bus v0 Host.lvlib__Session Data.gtype">
  "Semaphore RefNum.gtype" = i32
  "niUsrpRio Config v1 Host.lvlib__DB Queue Reference.gtype" = Queue<"niUsrpRio Config v1 Host.lvlib__Daughterboard Data.gtype">
  "niUsrpRio Config v1 Host.lvlib__niUsrpRio Session.gtype" = cluster{"FPGA Interface": any, "RIO Interface Number": u32, "Data Clock Rate": u32, "FPGA Data Clock Rate": u32, "Global Settings Register Bus": "niInstr Register Bus v0 Host.lvlib__Register Bus Session.gtype", "Radio 0 Settings Register Bus": "niInstr Register Bus v0 Host.lvlib__Register Bus Session.gtype", "Radio 1 Settings Register Bus": "niInstr Register Bus v0 Host.lvlib__Register Bus Session.gtype", "Radio Settings Bus Semaphore": "Semaphore RefNum.gtype", "DB Queues": "niUsrpRio Config v1 Host.lvlib__DB Queue Reference.gtype"[], "Characterization Data Valid?": bool, "EEPROM Header": "niUsrpRio Config v1 Host.lvlib__EEPROM Header.gtype", "Device Data Header": "niUsrpRio Config v1 Host.lvlib__EEPROM Device Data Header.gtype", "EEPROM Characterization Header": "niUsrpRio Config v1 Host.lvlib__EEPROM Characterization Header.gtype", "Characterization Data": "niUsrpRio Config v1 Host.lvlib__Characterization Data.gtype"[], "FPGA Current Version": u32, "FPGA Oldest Compatible Version": u32, "Fixed Logic Current Version": u32, "Fixed Logic Oldest Compatible Version": u32, "FPGA Radio Settings Bus Current Version": u32, "FPGA Radio Settings Bus Oldest Compatible Version": u32, "FPGA Board Config Current Version": u32, "FPGA Board Config Oldest Compatible Version": u32}
  T1 = cluster{"FPGA ref": any, "bus instance": u32, "instruction FIFO depth": u32, "executing on FPGA target": bool, "show error call chain": bool}
  T2 = cluster{"Actual Gain [dB]": f64, "Attenuation Table Index": i32}
  T3 = cluster{"Attenuation Table [dB]": f64[][], "Frequencies [Hz]": f64[], "IQ Imbalance Table": "niUsrpRio Config v1 Host.lvlib__IQ Imbalance.gtype"[], "Gain Table": T2[][]}
  T4 = cluster{"FlexRIO Register Bus": Queue<T1>, "RX Characterization Data": T3, "TX Characterization Data": T3, "FPGA Interface": any}
  T5 = cluster{"transport block size": u32, "CRC ok": bool, "user data": u32}
  "LTE Host Session.gtype" = cluster{"target": enum{"USRP", "FlexRIO"}, "USRP session": "niUsrpRio Config v1 Host.lvlib__niUsrpRio Session.gtype", "FlexRIO session": T4, "UDP RX session": UdpNetworkConnectionRefnum, "UDP TX session": UdpNetworkConnectionRefnum, "sync found queue": Queue<bool>, "PDCCH CRC ok queue": Queue<bool>, "DL PDCCH status queue": Queue<cluster{"CRC ok": bool, "subframe number": u32}>, "DL PDSCH status queue": Queue<cluster{"CRC ok": bool, "subframe number": u32}>, "DL SINR queue": Queue<f64[]>, "PDSCH user data queue": Queue<u32>, "PDSCH user data UDP queue": Queue<T5>, "PDSCH user data throughput queue": Queue<T5>, "PUSCH user data queue": Queue<u32>, "PUSCH user data UDP queue": Queue<T5>, "PUSCH user data throughput queue": Queue<T5>, "stop notifier": Notifier<string>, "DL RX scope": string, "UL RX scope": string}
  T6 = enum{"DL EQ Output", "PDSCH Dec Input", "UL EQ Output", "PUSCH Dec Input"}
diagram:
  Quotient And Remainder(x=$counter, y=10) -> (x-y*floor(x/y)=w1)
  Is Equal To 0(x=w1) -> w2
  call "LTE Unbundle Session.gvi"(session=$session) -> (FPGA Interface=w3)
  Type Cast(type=any constant, x=w3) -> w4
  case ($"RX tab") {
    frame 0 {
      # UE RX Basic
      Property Node(instance in=w4, "constellation select"="PDSCH Dec Input", error in=$"error in") -> (error out=w6)
      w5 = "PDSCH Dec Input"
    }
    frame 1 {
      # UE RX Advanced
      Property Node(instance in=w4, "constellation select"="DL EQ Output", error in=$"error in") -> (error out=w6)
      w5 = "DL EQ Output"
    }
    frame Default {
      w5 = default
      w6 = $"error in"
    }
  }
  Feedback Node(input=w5) -> w7
  # Only display values if source
  # hasn't changed
  Is Equal(x=w7, y=w5) -> w8
  Type Cast(type=any constant, x=w3) -> w9
  Property Node(instance in=w9, "constellation subset"=TRUE, "constellation symbol number (0-13)"=$"symbol number for display", error in=$"error in") -> (error out=w10, instance out=w11)
  Host Fifo Read Node[FifoName="LTE AFW Resources MIMO.grsc\\T2H RX Constellation AP1"](error in=w10, number of elements=0, reference in=w11, timeout (ms)=0) -> (elements remaining=w12, error out=w13, reference out=w14)
  Host Fifo Read Node[FifoName="LTE AFW Resources MIMO.grsc\\T2H RX Constellation AP1"](error in=w13, number of elements=w12, reference in=w14, timeout (ms)=0) -> (data=w15, error out=w16)
  Array Size(array=w15) -> (size(s)=w17)
  Is Not Equal To 0(x=w17) -> w18
  Host Fifo Read Node[FifoName="LTE AFW Resources.grsc\\T2H RX Constellation"](error in=w10, number of elements=0, reference in=w11, timeout (ms)=0) -> (elements remaining=w19, error out=w20, reference out=w21)
  Host Fifo Read Node[FifoName="LTE AFW Resources.grsc\\T2H RX Constellation"](error in=w20, number of elements=w19, reference in=w21, timeout (ms)=0) -> (data=w22, error out=w23)
  Array Size(array=w22) -> (size(s)=w24)
  Is Not Equal To 0(x=w24) -> w25
  Logical Or(w25, w18) -> w26
  Logical And(w2, w26, w8) -> w27
  $"display data" <- w27
  Array Subset(array=w22, length0=4000) -> w28
  call "LTE U32 to CDB.gvi"(signal in=w28) -> (signal out=w29)
  $"constellation data" <- w29
  Merge Errors(w23, w16, w6) -> (error out=w30)
  $"error out" <- w30
  Array Subset(array=w15, length0=4000) -> w31
  call "LTE U32 to CDB.gvi"(signal in=w31) -> (signal out=w32)
  $"constellation data AP1" <- w32
  $"displayed constellation" <- w5
