vi "LTE Read RX and TX Spectrum MIMO.gvi"   [LabVIEW Communications System Design Suite 2.0.1]
# Reads RX baseband input data and TX baseband output data from the FPGA and calculates the RX and TX power spectrum.
# Provides trigger signals for displaying the spectrum data on the host top level panel.
inputs:
  "session": "LTE Host Session.gtype"  # Contains session information such as used target, FlexRIO and USRP sessions, FPGA reference, and queue references.
  "RX power calibration offset [dB]": f64  # Frequency dependent power offset that will be applied to the RX baseband sample stream from the FPGA to ensure that the RX power levels in the displayed spectrum are correct.
  "error in": error
  "RX active": bool  # Boolean that indicates that the receiver is active. The RX display trigger is only generated when the receiver is active.
  "RX coerced gain [dB]": f64 = -10  # Coerced RX gain used for RX spectrum magnitude correction because RX values on the FPGA are captured after RX gain was applied.
  "TX coerced gain [dB]": f64 = 10  # Coerced TX gain used for TX spectrum magnitude correction.
  "counter": i32  # Loop iteration counter of calling loop used for displaying only parts of the calculated data. Displaying partial data reduces CPU load.
outputs:
  "update TX spectrum": bool  # Trigger for displaying the TX baseband output data on the host top level panel.
  "TX power spectrum": T1  # Calculated TX power spectrum for 1 subframe (30,720 samples).
  "error out": error
  "TX power spectrum AP1": T1
  "update RX spectrum": bool  # Trigger for displaying the RX baseband input data on the host top level panel.
  "RX power spectrum": T1  # Calculated RX power spectrum for 1 subframe (30720 samples).
  "RX power spectrum AP1": T1
types:
  T1 = cluster{"f0": f64, "df": f64, "magnitude": f64[]}
  "niInstr Register Bus v0 Host.lvlib__Register Bus Session.gtype" = Queue<"niInstr Register Bus v0 Host.lvlib__Session Data.gtype">
  "Semaphore RefNum.gtype" = i32
  "niUsrpRio Config v1 Host.lvlib__DB Queue Reference.gtype" = Queue<"niUsrpRio Config v1 Host.lvlib__Daughterboard Data.gtype">
  "niUsrpRio Config v1 Host.lvlib__niUsrpRio Session.gtype" = cluster{"FPGA Interface": any, "RIO Interface Number": u32, "Data Clock Rate": u32, "FPGA Data Clock Rate": u32, "Global Settings Register Bus": "niInstr Register Bus v0 Host.lvlib__Register Bus Session.gtype", "Radio 0 Settings Register Bus": "niInstr Register Bus v0 Host.lvlib__Register Bus Session.gtype", "Radio 1 Settings Register Bus": "niInstr Register Bus v0 Host.lvlib__Register Bus Session.gtype", "Radio Settings Bus Semaphore": "Semaphore RefNum.gtype", "DB Queues": "niUsrpRio Config v1 Host.lvlib__DB Queue Reference.gtype"[], "Characterization Data Valid?": bool, "EEPROM Header": "niUsrpRio Config v1 Host.lvlib__EEPROM Header.gtype", "Device Data Header": "niUsrpRio Config v1 Host.lvlib__EEPROM Device Data Header.gtype", "EEPROM Characterization Header": "niUsrpRio Config v1 Host.lvlib__EEPROM Characterization Header.gtype", "Characterization Data": "niUsrpRio Config v1 Host.lvlib__Characterization Data.gtype"[], "FPGA Current Version": u32, "FPGA Oldest Compatible Version": u32, "Fixed Logic Current Version": u32, "Fixed Logic Oldest Compatible Version": u32, "FPGA Radio Settings Bus Current Version": u32, "FPGA Radio Settings Bus Oldest Compatible Version": u32, "FPGA Board Config Current Version": u32, "FPGA Board Config Oldest Compatible Version": u32}
  T2 = cluster{"FPGA ref": any, "bus instance": u32, "instruction FIFO depth": u32, "executing on FPGA target": bool, "show error call chain": bool}
  T3 = cluster{"Actual Gain [dB]": f64, "Attenuation Table Index": i32}
  T4 = cluster{"Attenuation Table [dB]": f64[][], "Frequencies [Hz]": f64[], "IQ Imbalance Table": "niUsrpRio Config v1 Host.lvlib__IQ Imbalance.gtype"[], "Gain Table": T3[][]}
  T5 = cluster{"FlexRIO Register Bus": Queue<T2>, "RX Characterization Data": T4, "TX Characterization Data": T4, "FPGA Interface": any}
  T6 = cluster{"transport block size": u32, "CRC ok": bool, "user data": u32}
  "LTE Host Session.gtype" = cluster{"target": enum{"USRP", "FlexRIO"}, "USRP session": "niUsrpRio Config v1 Host.lvlib__niUsrpRio Session.gtype", "FlexRIO session": T5, "UDP RX session": UdpNetworkConnectionRefnum, "UDP TX session": UdpNetworkConnectionRefnum, "sync found queue": Queue<bool>, "PDCCH CRC ok queue": Queue<bool>, "DL PDCCH status queue": Queue<cluster{"CRC ok": bool, "subframe number": u32}>, "DL PDSCH status queue": Queue<cluster{"CRC ok": bool, "subframe number": u32}>, "DL SINR queue": Queue<f64[]>, "PDSCH user data queue": Queue<u32>, "PDSCH user data UDP queue": Queue<T6>, "PDSCH user data throughput queue": Queue<T6>, "PUSCH user data queue": Queue<u32>, "PUSCH user data UDP queue": Queue<T6>, "PUSCH user data throughput queue": Queue<T6>, "stop notifier": Notifier<string>, "DL RX scope": string, "UL RX scope": string}
diagram:
  call "LTE Read TX Data MIMO.gvi"(session=$session, error in=$"error in", counter=$counter) -> (TX baseband data AP1=w1, error out=w2, display TX spectrum=w3, TX baseband data=w4)
  $"update TX spectrum" <- w3
  call "LTE Calculate TX Power Spectrum MIMO.gvi"(TX data=w4, error in=w2, coerced gain [dB]=$"TX coerced gain [dB]", TX data AP1=w1) -> (TX power spectrum=w5, error out=w6, TX power spectrum AP1=w7)
  $"TX power spectrum" <- w5
  $"TX power spectrum AP1" <- w7
  call "LTE Read RX Data MIMO.gvi"(counter=$counter, RX active=$"RX active", session=$session, error in=$"error in") -> (display RX spectrum=w8, RX data AP0=w9, error out=w10, RX data AP1=w11)
  $"update RX spectrum" <- w8
  call "LTE Calculate RX Power Spectrum MIMO.gvi"(RX data AP1=w11, coerced gain [dB]=$"RX coerced gain [dB]", error in=w10, power calibration offset [dB]=$"RX power calibration offset [dB]", RX data AP0=w9) -> (RX power spectrum AP1=w12, error out=w13, RX power spectrum AP0=w14)
  $"RX power spectrum" <- w14
  $"RX power spectrum AP1" <- w12
  Merge Errors(w6, w13) -> (error out=w15)
  $"error out" <- w15
