vi "LTE Read TX Data MIMO.gvi"   [LabVIEW Communications System Design Suite 2.0.1]
# Reads transmitter (TX) baseband (BB) output data from the target-to-host TX BB FIFO and provides a trigger signal for displaying that data on the host top level panel.
inputs:
  "session": "LTE Host Session.gtype" = {"target"="USRP", "USRP session"={"EEPROM Header"={"Number of Reserved Bytes"=9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}, "Device Data Header"={"Number of Reserved Bytes"=27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}, "EEPROM Characterization Header"={"Number of Reserved Bytes"=28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}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}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}  # Contains session information such as used target, FlexRIO and USRP sessions, FPGA reference, and queue references.
  "error in": error
  "counter": i32  # Loop iteration counter of calling loop used for displaying only parts of the calculated data. Displaying partial data reduces CPU load.
outputs:
  "TX baseband data AP1": u32[]
  "error out": error
  "display TX spectrum": bool  # Trigger for displaying the TX baseband output data on the host top level panel.
  "TX baseband data": u32[]  # Array of TX baseband output data values read from the FPGA.
types:
  "niInstr Register Bus v0 Host.lvlib__Register Bus Session.gtype" = Queue<"niInstr Register Bus v0 Host.lvlib__Session Data.gtype">
  "Semaphore RefNum.gtype" = i32
  "niUsrpRio Config v1 Host.lvlib__DB Queue Reference.gtype" = Queue<"niUsrpRio Config v1 Host.lvlib__Daughterboard Data.gtype">
  "niUsrpRio Config v1 Host.lvlib__niUsrpRio Session.gtype" = cluster{"FPGA Interface": any, "RIO Interface Number": u32, "Data Clock Rate": u32, "FPGA Data Clock Rate": u32, "Global Settings Register Bus": "niInstr Register Bus v0 Host.lvlib__Register Bus Session.gtype", "Radio 0 Settings Register Bus": "niInstr Register Bus v0 Host.lvlib__Register Bus Session.gtype", "Radio 1 Settings Register Bus": "niInstr Register Bus v0 Host.lvlib__Register Bus Session.gtype", "Radio Settings Bus Semaphore": "Semaphore RefNum.gtype", "DB Queues": "niUsrpRio Config v1 Host.lvlib__DB Queue Reference.gtype"[], "Characterization Data Valid?": bool, "EEPROM Header": "niUsrpRio Config v1 Host.lvlib__EEPROM Header.gtype", "Device Data Header": "niUsrpRio Config v1 Host.lvlib__EEPROM Device Data Header.gtype", "EEPROM Characterization Header": "niUsrpRio Config v1 Host.lvlib__EEPROM Characterization Header.gtype", "Characterization Data": "niUsrpRio Config v1 Host.lvlib__Characterization Data.gtype"[], "FPGA Current Version": u32, "FPGA Oldest Compatible Version": u32, "Fixed Logic Current Version": u32, "Fixed Logic Oldest Compatible Version": u32, "FPGA Radio Settings Bus Current Version": u32, "FPGA Radio Settings Bus Oldest Compatible Version": u32, "FPGA Board Config Current Version": u32, "FPGA Board Config Oldest Compatible Version": u32}
  T1 = cluster{"FPGA ref": any, "bus instance": u32, "instruction FIFO depth": u32, "executing on FPGA target": bool, "show error call chain": bool}
  T2 = cluster{"Actual Gain [dB]": f64, "Attenuation Table Index": i32}
  T3 = cluster{"Attenuation Table [dB]": f64[][], "Frequencies [Hz]": f64[], "IQ Imbalance Table": "niUsrpRio Config v1 Host.lvlib__IQ Imbalance.gtype"[], "Gain Table": T2[][]}
  T4 = cluster{"FlexRIO Register Bus": Queue<T1>, "RX Characterization Data": T3, "TX Characterization Data": T3, "FPGA Interface": any}
  T5 = cluster{"transport block size": u32, "CRC ok": bool, "user data": u32}
  "LTE Host Session.gtype" = cluster{"target": enum{"USRP", "FlexRIO"}, "USRP session": "niUsrpRio Config v1 Host.lvlib__niUsrpRio Session.gtype", "FlexRIO session": T4, "UDP RX session": UdpNetworkConnectionRefnum, "UDP TX session": UdpNetworkConnectionRefnum, "sync found queue": Queue<bool>, "PDCCH CRC ok queue": Queue<bool>, "DL PDCCH status queue": Queue<cluster{"CRC ok": bool, "subframe number": u32}>, "DL PDSCH status queue": Queue<cluster{"CRC ok": bool, "subframe number": u32}>, "DL SINR queue": Queue<f64[]>, "PDSCH user data queue": Queue<u32>, "PDSCH user data UDP queue": Queue<T5>, "PDSCH user data throughput queue": Queue<T5>, "PUSCH user data queue": Queue<u32>, "PUSCH user data UDP queue": Queue<T5>, "PUSCH user data throughput queue": Queue<T5>, "stop notifier": Notifier<string>, "DL RX scope": string, "UL RX scope": string}
diagram:
  call "LTE Unbundle Session.gvi"(session=$session) -> (FPGA Interface=w1)
  Type Cast(type=any constant, x=w1) -> w2
  Host Fifo Read Node[FifoName="LTE AFW Resources.grsc\\T2H TX Baseband Stream"](error in=$"error in", number of elements=0, reference in=w2) -> (elements remaining=w3, error out=w4, reference out=w5)
  Quotient And Remainder(x=w3, y=30720) -> (floor(x/y)=w6)
  Multiply(w6, 30720) -> w7
  Host Fifo Read Node[FifoName="LTE AFW Resources.grsc\\T2H TX Baseband Stream"](error in=w4, number of elements=w7, reference in=w5, timeout (ms)=0) -> (data=w8, error out=w9)
  $"TX baseband data" <- w8
  Host Fifo Read Node[FifoName="LTE AFW Resources MIMO.grsc\\T2H TX Baseband Stream AP1"](error in=$"error in", number of elements=0, reference in=w2) -> (elements remaining=w10, error out=w11, reference out=w12)
  Quotient And Remainder(x=w10, y=30720) -> (floor(x/y)=w13)
  Multiply(w13, 30720) -> w14
  Host Fifo Read Node[FifoName="LTE AFW Resources MIMO.grsc\\T2H TX Baseband Stream AP1"](error in=w11, number of elements=w14, reference in=w12, timeout (ms)=0) -> (data=w15, error out=w16)
  call "Clear Errors.gvi"(specific error code to clear=-50400, error in=w16) -> (error out=w17)
  call "Clear Errors.gvi"(specific error code to clear=-50400, error in=w9) -> (error out=w18)
  Merge Errors(w18, w17) -> (error out=w19)
  $"error out" <- w19
  $"TX baseband data AP1" <- w15
  Quotient And Remainder(x=$counter, y=10) -> (x-y*floor(x/y)=w20)
  Is Equal To 0(x=w20) -> w21
  Is Empty Array(array=w15) -> w22
  Is Empty Array(array=w8) -> w23
  Logical And(not w23, not w22, w21) -> w24
  $"display TX spectrum" <- w24
