vi "LTE Send Dynamic DL RX Configuration MIMO.gvi"   [LabVIEW Communications System Design Suite 2.0.1]
# Prepares the TTI configuration for the downlink receiver (DL RX), consisting of the UE context (dynamic DL configuration).
inputs:
  "session": "LTE Host Session.gtype"  # Contains session information such as used target, FlexRIO and USRP sessions, FPGA reference, and queue references.
  "UE context": T1 = {"RNTI"=10, "use UERS"=FALSE, "antenna port"=7, "CCE offset"=0}  # Per subframe changeable UE specific parameter set (RNTI, CCE offset, UERS configuration).
  "error in": error
outputs:
  "error out": error
panel controls:
  "FPGA type": any
types:
  T1 = cluster{"RNTI": u16, "use UERS": bool, "antenna port": UFXP(4.0), "CCE offset": u8}
  "niInstr Register Bus v0 Host.lvlib__Register Bus Session.gtype" = Queue<"niInstr Register Bus v0 Host.lvlib__Session Data.gtype">
  "Semaphore RefNum.gtype" = i32
  "niUsrpRio Config v1 Host.lvlib__DB Queue Reference.gtype" = Queue<"niUsrpRio Config v1 Host.lvlib__Daughterboard Data.gtype">
  "niUsrpRio Config v1 Host.lvlib__niUsrpRio Session.gtype" = cluster{"FPGA Interface": any, "RIO Interface Number": u32, "Data Clock Rate": u32, "FPGA Data Clock Rate": u32, "Global Settings Register Bus": "niInstr Register Bus v0 Host.lvlib__Register Bus Session.gtype", "Radio 0 Settings Register Bus": "niInstr Register Bus v0 Host.lvlib__Register Bus Session.gtype", "Radio 1 Settings Register Bus": "niInstr Register Bus v0 Host.lvlib__Register Bus Session.gtype", "Radio Settings Bus Semaphore": "Semaphore RefNum.gtype", "DB Queues": "niUsrpRio Config v1 Host.lvlib__DB Queue Reference.gtype"[], "Characterization Data Valid?": bool, "EEPROM Header": "niUsrpRio Config v1 Host.lvlib__EEPROM Header.gtype", "Device Data Header": "niUsrpRio Config v1 Host.lvlib__EEPROM Device Data Header.gtype", "EEPROM Characterization Header": "niUsrpRio Config v1 Host.lvlib__EEPROM Characterization Header.gtype", "Characterization Data": "niUsrpRio Config v1 Host.lvlib__Characterization Data.gtype"[], "FPGA Current Version": u32, "FPGA Oldest Compatible Version": u32, "Fixed Logic Current Version": u32, "Fixed Logic Oldest Compatible Version": u32, "FPGA Radio Settings Bus Current Version": u32, "FPGA Radio Settings Bus Oldest Compatible Version": u32, "FPGA Board Config Current Version": u32, "FPGA Board Config Oldest Compatible Version": u32}
  T2 = cluster{"FPGA ref": any, "bus instance": u32, "instruction FIFO depth": u32, "executing on FPGA target": bool, "show error call chain": bool}
  T3 = cluster{"Actual Gain [dB]": f64, "Attenuation Table Index": i32}
  T4 = cluster{"Attenuation Table [dB]": f64[][], "Frequencies [Hz]": f64[], "IQ Imbalance Table": "niUsrpRio Config v1 Host.lvlib__IQ Imbalance.gtype"[], "Gain Table": T3[][]}
  T5 = cluster{"FlexRIO Register Bus": Queue<T2>, "RX Characterization Data": T4, "TX Characterization Data": T4, "FPGA Interface": any}
  T6 = cluster{"transport block size": u32, "CRC ok": bool, "user data": u32}
  "LTE Host Session.gtype" = cluster{"target": enum{"USRP", "FlexRIO"}, "USRP session": "niUsrpRio Config v1 Host.lvlib__niUsrpRio Session.gtype", "FlexRIO session": T5, "UDP RX session": UdpNetworkConnectionRefnum, "UDP TX session": UdpNetworkConnectionRefnum, "sync found queue": Queue<bool>, "PDCCH CRC ok queue": Queue<bool>, "DL PDCCH status queue": Queue<cluster{"CRC ok": bool, "subframe number": u32}>, "DL PDSCH status queue": Queue<cluster{"CRC ok": bool, "subframe number": u32}>, "DL SINR queue": Queue<f64[]>, "PDSCH user data queue": Queue<u32>, "PDSCH user data UDP queue": Queue<T6>, "PDSCH user data throughput queue": Queue<T6>, "PUSCH user data queue": Queue<u32>, "PUSCH user data UDP queue": Queue<T6>, "PUSCH user data throughput queue": Queue<T6>, "stop notifier": Notifier<string>, "DL RX scope": string, "UL RX scope": string}
  T7 = cluster{"valid": bool, "resource allocation header": UFXP(1.0), "resource block allocation": UFXP(25.0), "MCS": UFXP(5.0), "HARQ process number": UFXP(4.0), "new data indicator": bool, "redundancy version": UFXP(2.0), "TPC command for pucch": UFXP(2.0), "DL assignment index": UFXP(2.0), "MIMO flag": bool}
diagram:
  call "LTE Unbundle Session.gvi"(session=$session) -> (FPGA Interface=w1)
  Type Cast(type=$"FPGA type", x=w1) -> w2
  Property Node(instance in=$"UE context") -> ("CCE offset"=w3, "antenna port"=w4, "RNTI"=w5, "use UERS"=w6)
  w7 = cluster{"UE config": T1, "DCI message": T7} {all zero or empty}
  Property Node(instance in=w7, "UE config:RNTI"=w5, "UE config:use UERS"=w6, "UE config:antenna port"=w4, "UE config:CCE offset"=w3) -> (instance out=w8)
  call "LTE DL TTI Configuration To U64 MIMO.gvi"(TTI configuration cluster=w8) -> (TTI configuration out=w9)
  Build Array(w9) -> w10
  Host Fifo Write Node[FifoName="LTE AFW Resources.grsc\\H2T DL RX Dynamic Configuration"](data=w10, error in=$"error in", reference in=w2) -> (error out=w11)
  $"error out" <- w11
