vi "LTE DL Host Initialization MIMO.gvi"   [LabVIEW Communications System Design Suite 2.0.1]
# Opens a session to a specific USRP RIO device, downloads the FPGA bitfile, runs the FPGA, and starts all the target to host and host to target DMA transfers
# Necessary UDP connections are opened and all the queues used in the DL host application are obtained. The session cluster is initialized with queue references and the USRP session.
inputs:
  "USRP device": string = "RIO0"  # Specific USRP RIO device to open a session to.
  "session in": "LTE Host Session.gtype"  # Contains session information such as used target, FlexRIO and USRP sessions, FPGA reference, and queue references.
  "error in": error
  "USRP bandwidth": "USRP bandwidth.gtype" = "120 MHz"
  "reference clock source": string = "Internal"  # The used reference clock input. Valid values are Internal, REF IN / ClkIn, PXI_CLK, and GPS.
outputs:
  "error out": error
  "session out": "LTE Host Session.gtype"  # Contains session information such as used target, FlexRIO and USRP sessions, FPGA reference, and queue references.
types:
  "niInstr Register Bus v0 Host.lvlib__Register Bus Session.gtype" = Queue<"niInstr Register Bus v0 Host.lvlib__Session Data.gtype">
  "Semaphore RefNum.gtype" = i32
  "niUsrpRio Config v1 Host.lvlib__DB Queue Reference.gtype" = Queue<"niUsrpRio Config v1 Host.lvlib__Daughterboard Data.gtype">
  "niUsrpRio Config v1 Host.lvlib__niUsrpRio Session.gtype" = cluster{"FPGA Interface": any, "RIO Interface Number": u32, "Data Clock Rate": u32, "FPGA Data Clock Rate": u32, "Global Settings Register Bus": "niInstr Register Bus v0 Host.lvlib__Register Bus Session.gtype", "Radio 0 Settings Register Bus": "niInstr Register Bus v0 Host.lvlib__Register Bus Session.gtype", "Radio 1 Settings Register Bus": "niInstr Register Bus v0 Host.lvlib__Register Bus Session.gtype", "Radio Settings Bus Semaphore": "Semaphore RefNum.gtype", "DB Queues": "niUsrpRio Config v1 Host.lvlib__DB Queue Reference.gtype"[], "Characterization Data Valid?": bool, "EEPROM Header": "niUsrpRio Config v1 Host.lvlib__EEPROM Header.gtype", "Device Data Header": "niUsrpRio Config v1 Host.lvlib__EEPROM Device Data Header.gtype", "EEPROM Characterization Header": "niUsrpRio Config v1 Host.lvlib__EEPROM Characterization Header.gtype", "Characterization Data": "niUsrpRio Config v1 Host.lvlib__Characterization Data.gtype"[], "FPGA Current Version": u32, "FPGA Oldest Compatible Version": u32, "Fixed Logic Current Version": u32, "Fixed Logic Oldest Compatible Version": u32, "FPGA Radio Settings Bus Current Version": u32, "FPGA Radio Settings Bus Oldest Compatible Version": u32, "FPGA Board Config Current Version": u32, "FPGA Board Config Oldest Compatible Version": u32, "Daughterboard Clock Rate": u32}
  T1 = cluster{"FPGA ref": any, "bus instance": u32, "instruction FIFO depth": u32, "executing on FPGA target": bool, "show error call chain": bool}
  T2 = cluster{"Actual Gain [dB]": f64, "Attenuation Table Index": i32}
  T3 = cluster{"Attenuation Table [dB]": f64[][], "Frequencies [Hz]": f64[], "IQ Imbalance Table": "niUsrpRio Config v1 Host.lvlib__IQ Imbalance.gtype"[], "Gain Table": T2[][]}
  T4 = cluster{"FlexRIO Register Bus": Queue<T1>, "RX Characterization Data": T3, "TX Characterization Data": T3, "FPGA Interface": any}
  T5 = cluster{"transport block size": u32, "CRC ok": bool, "user data": u32}
  "LTE Host Session.gtype" = cluster{"target": enum{"USRP", "FlexRIO"}, "USRP session": "niUsrpRio Config v1 Host.lvlib__niUsrpRio Session.gtype", "FlexRIO session": T4, "UDP RX session": UdpNetworkConnectionRefnum, "UDP TX session": UdpNetworkConnectionRefnum, "sync found queue": Queue<bool>, "PDCCH CRC ok queue": Queue<bool>, "DL PDCCH status queue": Queue<cluster{"CRC ok": bool, "subframe number": u32}>, "DL PDSCH status queue": Queue<cluster{"CRC ok": bool, "subframe number": u32}>, "DL SINR queue": Queue<f64[]>, "PDSCH user data queue": Queue<u32>, "PDSCH user data UDP queue": Queue<T5>, "PDSCH user data throughput queue": Queue<T5>, "PUSCH user data queue": Queue<u32>, "PUSCH user data UDP queue": Queue<T5>, "PUSCH user data throughput queue": Queue<T5>, "stop notifier": Notifier<string>, "DL RX scope": string, "UL RX scope": string}
  "USRP bandwidth.gtype" = enum{"40 MHz", "120 MHz", "160 MHz"}
diagram:
  case ($"reference clock source") {
    frame "Internal" {
      w1 = $"reference clock source"
      w2 = default
    }
    frame "REF IN / ClkIn" {
      w1 = "REF IN"
      w2 = default
    }
    frame "GPS" {
      w1 = $"reference clock source"
      w2 = default
    }
    frame "PXI_CLK", Default {
      w3 = error {"status"=TRUE, "code"=1, "source"="PXI_CLK reference clock not supported for USRP target"}
      w1 = "Internal"
      w2 = w3
    }
  }
  case ($"USRP bandwidth") {
    frame "40 MHz" {
      FPGA Open Node[ProjectItem=":NullTarget:LTE\\ FPGA\\ USRP\\ RIO\\ 40\\ MHz\\ BW\\ DL\\ MIMO2x2\\.lvbitx"](RIO address=$"USRP device", error in=$"error in", run?=FALSE) -> (error out=w5, reference out=w4)
    }
    frame "120 MHz" {
      FPGA Open Node[ProjectItem=":NullTarget:LTE\\ FPGA\\ USRP\\ RIO\\ 120\\ MHz\\ BW\\ DL\\ MIMO2x2\\.lvbitx"](RIO address=$"USRP device", error in=$"error in", run?=FALSE) -> (error out=w5, reference out=w4)
    }
    frame "160 MHz" {
      FPGA Open Node[ProjectItem=":NullTarget:LTE\\ FPGA\\ USRP\\ RIO\\ 160\\ MHz\\ BW\\ DL\\ MIMO2x2\\.lvbitx"](RIO address=$"USRP device", error in=$"error in", run?=FALSE) -> (error out=w5, reference out=w4)
    }
  }
  FPGA Download Node(error in=w5, reference in=w4) -> (error out=w6, reference out=w7)
  FPGA Run Node(error in=w6, reference in=w7) -> (error out=w8, reference out=w9)
  Merge Errors(w8, w2) -> (error out=w10)
  call "niUsrpRio Config v1 Host.lvlib__Open 2.gvi"(fpga ref=w9, error in=w10, reference frequency source=w1, gpsdo power enable=TRUE, timeout=1, scope="") -> (niusrprio session out=w11, error out=w12)
  call "niUsrpRio Config v1 Host.lvlib__Enable Front End.gvi"(niusrprio session in=w11, enable=FALSE, error in=w12, scope="rx") -> (niusrprio session out=w13, error out=w14)
  call "niUsrpRio Config v1 Host.lvlib__Enable Front End.gvi"(niusrprio session in=w13, enable=FALSE, error in=w14, scope="tx") -> (niusrprio session out=w15, error out=w16)
  call "Check USRP Data Clock Rate and Bandwidth.gvi"(niusrprio session in=w15, error in=w16) -> (niusrprio session out=w17, error out=w18)
  w19 = 0xFFFF  # level SOL_SOCKET
  w20 = 1024000  # buffer size in bytes
  w21 = 0x1001  # optname SO_SNDBUF
  Udp Open(error in=w18, net address=0, port=0, service name="", timeout ms=25000) -> (connection ID=w22, error out=w23)
  call "Set Socket Option.gvi"(connection in=w22, level=w19, option name=w21, value=w20, error in=w23) -> (error out=w24, connection out=w25)
  Obtain Queue(create if not found?=TRUE, element data type=bool FALSE, error in=w24, max queue size=-1, name="") -> (error out=w26, queue out=w27)
  Obtain Queue(create if not found?=TRUE, element data type=bool FALSE, error in=w26, max queue size=-1, name="") -> (error out=w28, queue out=w29)
  w30 = cluster{"CRC ok": bool, "subframe number": u32} {all zero or empty}
  Obtain Queue(create if not found?=TRUE, element data type=w30, error in=w28, max queue size=-1, name="") -> (error out=w31, queue out=w32)
  Obtain Queue(create if not found?=TRUE, element data type=w30, error in=w31, max queue size=-1, name="") -> (error out=w33, queue out=w34)
  Obtain Queue(create if not found?=TRUE, element data type=f64[] [], error in=w33, max queue size=-1, name="") -> (error out=w35, queue out=w36)
  Obtain Queue(create if not found?=TRUE, element data type=u32 0, error in=w35, max queue size=-1, name="") -> (error out=w37, queue out=w38)
  Obtain Queue(create if not found?=TRUE, element data type=T5 {all zero or empty}, error in=w37, max queue size=-1, name="") -> (error out=w39, queue out=w40)
  Obtain Queue(create if not found?=TRUE, element data type=T5 {all zero or empty}, error in=w39, max queue size=-1, name="") -> (error out=w41, queue out=w42)
  call "Create Stop Notifier.gvi"(error in=w41) -> (error out=w43, stop notifier=w44)
  Property Node(instance in=$"session in", "USRP session"=w17, "UDP RX session"=w25, "sync found queue"=w27, "PDCCH CRC ok queue"=w29, "DL PDCCH status queue"=w32, "DL PDSCH status queue"=w34, "DL SINR queue"=w36, "PDSCH user data queue"=w38, "PDSCH user data UDP queue"=w40, "PDSCH user data throughput queue"=w42, "stop notifier"=w44) -> (instance out=w45)
  $"session out" <- w45
  call "LTE DL RX FIFO Initialization MIMO.gvi"(session=w45, error in=w43) -> (error out=w46)
  call "LTE DL TX FIFO Initialization MIMO.gvi"(session=w45, error in=w43) -> (error out=w47)
  Merge Errors(w46, w47) -> (error out=w48)
  $"error out" <- w48
