vi "LTE Setup RX MIMO.gvi"   [LabVIEW Communications System Design Suite 2.0.1]
# Configures the RF part of the receiver, including the reference clock, center frequency, gain, and used RF port.
# Triggers the reception of data from the RX antenna.
inputs:
  "session in": "LTE Host Session.gtype"  # Contains session information such as used target, FlexRIO and USRP sessions, FPGA reference, and queue references.
  "RX port": enum{"RX2/RF0", "RX2/RF1"} = "RX2/RF0"  # Selects one of the USRP RIO ports that is used for data reception.
  "error in": error
  "RX frequency [Hz]": f64 = 2400000000  # Requested center frequency, in Hz, to acquire the signal from.
  "gain value [dB]": f64  # Requested RX gain, in dB.
  "LTE scope": enum{"DL", "UL"} = "DL"  # Stores the configured RF port either in the UL RX scope or the DL RX scope section of the session cluster.
outputs:
  "session out": "LTE Host Session.gtype"  # Contains session information such as used target, FlexRIO and USRP sessions, FPGA reference, and queue references.
  "coerced gain [dB]": f64  # Actual applied RX gain values, in dB.
  "error out": error
  "coerced frequency [Hz]": f64  # Actual center frequency, in Hz, to acquire the signal from.
types:
  "niInstr Register Bus v0 Host.lvlib__Register Bus Session.gtype" = Queue<"niInstr Register Bus v0 Host.lvlib__Session Data.gtype">
  "Semaphore RefNum.gtype" = i32
  "niUsrpRio Config v1 Host.lvlib__DB Queue Reference.gtype" = Queue<"niUsrpRio Config v1 Host.lvlib__Daughterboard Data.gtype">
  "niUsrpRio Config v1 Host.lvlib__niUsrpRio Session.gtype" = cluster{"FPGA Interface": any, "RIO Interface Number": u32, "Data Clock Rate": u32, "FPGA Data Clock Rate": u32, "Global Settings Register Bus": "niInstr Register Bus v0 Host.lvlib__Register Bus Session.gtype", "Radio 0 Settings Register Bus": "niInstr Register Bus v0 Host.lvlib__Register Bus Session.gtype", "Radio 1 Settings Register Bus": "niInstr Register Bus v0 Host.lvlib__Register Bus Session.gtype", "Radio Settings Bus Semaphore": "Semaphore RefNum.gtype", "DB Queues": "niUsrpRio Config v1 Host.lvlib__DB Queue Reference.gtype"[], "Characterization Data Valid?": bool, "EEPROM Header": "niUsrpRio Config v1 Host.lvlib__EEPROM Header.gtype", "Device Data Header": "niUsrpRio Config v1 Host.lvlib__EEPROM Device Data Header.gtype", "EEPROM Characterization Header": "niUsrpRio Config v1 Host.lvlib__EEPROM Characterization Header.gtype", "Characterization Data": "niUsrpRio Config v1 Host.lvlib__Characterization Data.gtype"[], "FPGA Current Version": u32, "FPGA Oldest Compatible Version": u32, "Fixed Logic Current Version": u32, "Fixed Logic Oldest Compatible Version": u32, "FPGA Radio Settings Bus Current Version": u32, "FPGA Radio Settings Bus Oldest Compatible Version": u32, "FPGA Board Config Current Version": u32, "FPGA Board Config Oldest Compatible Version": u32, "Daughterboard Clock Rate": u32}
  T1 = cluster{"FPGA ref": any, "bus instance": u32, "instruction FIFO depth": u32, "executing on FPGA target": bool, "show error call chain": bool}
  T2 = cluster{"Actual Gain [dB]": f64, "Attenuation Table Index": i32}
  T3 = cluster{"Attenuation Table [dB]": f64[][], "Frequencies [Hz]": f64[], "IQ Imbalance Table": "niUsrpRio Config v1 Host.lvlib__IQ Imbalance.gtype"[], "Gain Table": T2[][]}
  T4 = cluster{"FlexRIO Register Bus": Queue<T1>, "RX Characterization Data": T3, "TX Characterization Data": T3, "FPGA Interface": any}
  T5 = cluster{"transport block size": u32, "CRC ok": bool, "user data": u32}
  "LTE Host Session.gtype" = cluster{"target": enum{"USRP", "FlexRIO"}, "USRP session": "niUsrpRio Config v1 Host.lvlib__niUsrpRio Session.gtype", "FlexRIO session": T4, "UDP RX session": UdpNetworkConnectionRefnum, "UDP TX session": UdpNetworkConnectionRefnum, "sync found queue": Queue<bool>, "PDCCH CRC ok queue": Queue<bool>, "DL PDCCH status queue": Queue<cluster{"CRC ok": bool, "subframe number": u32}>, "DL PDSCH status queue": Queue<cluster{"CRC ok": bool, "subframe number": u32}>, "DL SINR queue": Queue<f64[]>, "PDSCH user data queue": Queue<u32>, "PDSCH user data UDP queue": Queue<T5>, "PDSCH user data throughput queue": Queue<T5>, "PUSCH user data queue": Queue<u32>, "PUSCH user data UDP queue": Queue<T5>, "PUSCH user data throughput queue": Queue<T5>, "stop notifier": Notifier<string>, "DL RX scope": string, "UL RX scope": string}
diagram:
  Format Into String(formatString="rx/RF %d", errIn=$"error in", $"RX port") -> w1
  case ($"LTE scope") {
    frame "DL", Default {
      Property Node(instance in=$"session in", "DL RX scope"=w1) -> (instance out=w2)
    }
    frame "UL" {
      Property Node(instance in=$"session in", "UL RX scope"=w1) -> (instance out=w2)
    }
  }
  $"session out" <- w2
  call "LTE Unbundle Session.gvi"(session=$"session in") -> (FPGA Interface=w3, USRP session=w4)
  s1 = $"error in"  # shift register
  for {
    w5 = each element of ["rx/RF 0\n", "rx/RF 1"]
    call "LTE Setup RF.gvi"(USRP RIO session in=w4, correct impairments=FALSE, error in=s1, scope=w5, frequency [Hz]=$"RX frequency [Hz]", power level/gain [dB]=$"gain value [dB]") -> (coerced frequency [Hz]=w6, coerced gain [dB]=w7, error out=w8)
    next s1 = w8
  }
  Type Cast(type=any constant, x=w3) -> w9
  Type Cast(type=u16 0, x=$"RX port") -> w10
  To Long Integer(number=w10) -> w11
  Property Node(instance in=w9, "RX RF channel"=w11, error in=s1) -> (error out=w12)
  call "Initiate Stream.gvi"(niusrprio session in=w4, error in=w12, scope="rx") -> (error out=w13)
  call "Clear Errors.gvi"(specific error code to clear=5001, error in=w13) -> (specific error cleared?=w14, error out=w15)
  case (w14) {
    frame False, Default { }
    frame True {
      w16 = "The RX frequency was set to a coerced value because the provided value was out of bounds."
      One Button Dialog(message=w16)
    }
  }
  $"error out" <- w15
  $"coerced gain [dB]" <- w7
  $"coerced frequency [Hz]" <- w6
