vi "LTE Setup TX MIMO.gvi"   [LabVIEW Communications System Design Suite 2.0.1]
# Configures the RF part of the transmitter, including the reference clock, center frequency, output power level, and used RF port.
# Triggers the transmission of calculated baseband data to the TX antenna.
inputs:
  "session in": "LTE Host Session.gtype"  # Contains session information such as used target, FlexRIO and USRP sessions, FPGA reference, and queue references.
  "TX frequency [Hz]": f64  # Requested center frequency, in Hz, to generate the signal at.
  "TX power level [dB]": f64  # Requested output power level, in dB.
  "TX port": enum{"TX1/RF0", "TX1/RF1"} = "TX1/RF0"  # Selects one of the USRP RIO ports that is used for data transmission.
  "error in": error
  "LTE scope": enum{"DL", "UL"} = "DL"  # Selects if the node configures the UL or the DL host (necessary because an additional parameter must be configured when used for UL TX setup).
  "timing advance": u32  # Timing advance in baseband samples. Triggers the TX the configured number of samples earlier to ensure that TX and RX are aligned at the antenna.
outputs:
  "coerced output power [dB]": f64  # Actual output power level of the signal, in dB.
  "error out": error
  "session dup": "LTE Host Session.gtype"  # Contains session information such as used target, FlexRIO and USRP sessions, FPGA reference, and queue references.
  "coerced frequency [Hz]": f64  # Actual center frequency, in Hz, to generate the signal at.
  "coerced power level setting [dB]": f64  # Coerced requested output power level of the signal, in dB. This value should be the same as TX power level [dB] as long as you configure a power level within the supported range.
types:
  "niInstr Register Bus v0 Host.lvlib__Register Bus Session.gtype" = Queue<"niInstr Register Bus v0 Host.lvlib__Session Data.gtype">
  "Semaphore RefNum.gtype" = i32
  "niUsrpRio Config v1 Host.lvlib__DB Queue Reference.gtype" = Queue<"niUsrpRio Config v1 Host.lvlib__Daughterboard Data.gtype">
  "niUsrpRio Config v1 Host.lvlib__niUsrpRio Session.gtype" = cluster{"FPGA Interface": any, "RIO Interface Number": u32, "Data Clock Rate": u32, "FPGA Data Clock Rate": u32, "Global Settings Register Bus": "niInstr Register Bus v0 Host.lvlib__Register Bus Session.gtype", "Radio 0 Settings Register Bus": "niInstr Register Bus v0 Host.lvlib__Register Bus Session.gtype", "Radio 1 Settings Register Bus": "niInstr Register Bus v0 Host.lvlib__Register Bus Session.gtype", "Radio Settings Bus Semaphore": "Semaphore RefNum.gtype", "DB Queues": "niUsrpRio Config v1 Host.lvlib__DB Queue Reference.gtype"[], "Characterization Data Valid?": bool, "EEPROM Header": "niUsrpRio Config v1 Host.lvlib__EEPROM Header.gtype", "Device Data Header": "niUsrpRio Config v1 Host.lvlib__EEPROM Device Data Header.gtype", "EEPROM Characterization Header": "niUsrpRio Config v1 Host.lvlib__EEPROM Characterization Header.gtype", "Characterization Data": "niUsrpRio Config v1 Host.lvlib__Characterization Data.gtype"[], "FPGA Current Version": u32, "FPGA Oldest Compatible Version": u32, "Fixed Logic Current Version": u32, "Fixed Logic Oldest Compatible Version": u32, "FPGA Radio Settings Bus Current Version": u32, "FPGA Radio Settings Bus Oldest Compatible Version": u32, "FPGA Board Config Current Version": u32, "FPGA Board Config Oldest Compatible Version": u32, "Daughterboard Clock Rate": u32}
  T1 = cluster{"FPGA ref": any, "bus instance": u32, "instruction FIFO depth": u32, "executing on FPGA target": bool, "show error call chain": bool}
  T2 = cluster{"Actual Gain [dB]": f64, "Attenuation Table Index": i32}
  T3 = cluster{"Attenuation Table [dB]": f64[][], "Frequencies [Hz]": f64[], "IQ Imbalance Table": "niUsrpRio Config v1 Host.lvlib__IQ Imbalance.gtype"[], "Gain Table": T2[][]}
  T4 = cluster{"FlexRIO Register Bus": Queue<T1>, "RX Characterization Data": T3, "TX Characterization Data": T3, "FPGA Interface": any}
  T5 = cluster{"transport block size": u32, "CRC ok": bool, "user data": u32}
  "LTE Host Session.gtype" = cluster{"target": enum{"USRP", "FlexRIO"}, "USRP session": "niUsrpRio Config v1 Host.lvlib__niUsrpRio Session.gtype", "FlexRIO session": T4, "UDP RX session": UdpNetworkConnectionRefnum, "UDP TX session": UdpNetworkConnectionRefnum, "sync found queue": Queue<bool>, "PDCCH CRC ok queue": Queue<bool>, "DL PDCCH status queue": Queue<cluster{"CRC ok": bool, "subframe number": u32}>, "DL PDSCH status queue": Queue<cluster{"CRC ok": bool, "subframe number": u32}>, "DL SINR queue": Queue<f64[]>, "PDSCH user data queue": Queue<u32>, "PDSCH user data UDP queue": Queue<T5>, "PDSCH user data throughput queue": Queue<T5>, "PUSCH user data queue": Queue<u32>, "PUSCH user data UDP queue": Queue<T5>, "PUSCH user data throughput queue": Queue<T5>, "stop notifier": Notifier<string>, "DL RX scope": string, "UL RX scope": string}
diagram:
  $"session dup" <- $"session in"
  call "LTE Unbundle Session.gvi"(session=$"session in") -> (FPGA Interface=w1, USRP session=w2)
  Property Node(instance in=w2) -> ("Data Clock Rate"=w3, instance out=w4)
  Quotient And Remainder(x=w3, y=100) -> (floor(x/y)=w5)
  Type Cast(type=u16 0, x=$"TX port") -> w6
  To Long Integer(number=w6) -> w7
  case ($"LTE scope") {
    frame "UL" {
      call "LTE Compute TX Trigger Offset.gvi"(processing delay [samples]=17230, timing advance [samples]=$"timing advance", clock cycles per radio frame=w5) -> (TX trigger offset=w9)
      Type Cast(type=any constant, x=w1) -> w10
      Property Node(instance in=w10, "TX start trigger count"=w5, "UE processing delay + timing advance"=w9, "TX RF channel"=w7, "transmit without sync"=FALSE, error in=$"error in") -> (error out=w8)
    }
    frame "DL" {
      call "LTE Compute TX Trigger Offset.gvi"(processing delay [samples]=17239, timing advance [samples]=$"timing advance", clock cycles per radio frame=w5) -> (TX trigger offset=w11)
      Type Cast(type=any constant, x=w1) -> w12
      Property Node(instance in=w12, "TX start trigger count"=w5, "eNB processing delay"=w11, "TX RF channel"=w7, error in=$"error in") -> (error out=w8)
    }
  }
  s1 = w8  # shift register
  for {
    w13 = each element of ["tx/RF 0", "tx/RF 1"]
    call "LTE Setup RF.gvi"(USRP RIO session in=w4, correct impairments=FALSE, error in=s1, scope=w13, frequency [Hz]=$"TX frequency [Hz]", power level/gain [dB]=$"TX power level [dB]") -> (coerced frequency [Hz]=w14, coerced gain [dB]=w15, error out=w16)
    next s1 = w16
  }
  $"coerced output power [dB]" <- w15
  $"coerced frequency [Hz]" <- w14
  call "Clear Errors.gvi"(specific error code to clear=5000, error in=s1) -> (specific error cleared?=w17, error out=w18)
  call "Clear Errors.gvi"(specific error code to clear=5001, error in=w18) -> (specific error cleared?=w19, error out=w20)
  call "Initiate Stream.gvi"(niusrprio session in=w4, error in=w20, scope="tx") -> (error out=w21)
  $"error out" <- w21
  case (w19) {
    frame False, Default { }
    frame True {
      w22 = "The UE TX frequency was set to a coerced value because the provided value was out of bounds."
      One Button Dialog(message=w22)
    }
  }
  case (w17) {
    frame False, Default {
      w23 = $"TX power level [dB]"
    }
    frame True {
      w24 = "The UE TX Power Level was set to a default value because the provided value was out of bounds."
      One Button Dialog(message=w24)
      w23 = 10
    }
  }
  $"coerced power level setting [dB]" <- w23
