vi "LTE FPGA USRP RIO DL MIMO.gvi"   [LabVIEW NXG 4.0.0]
panel controls:
  "reg.host read.go rcvd 0": bool
  "reg.notify host.go rcvd 0": bool
  "reg.reset 0": bool
  "RF 0/Rx/Enable": bool
  "RF 0/Tx/Enable": bool
  "RF 1/Rx/Enable": bool
  "RF 1/Tx/Enable": bool
  "rx.reset": bool = TRUE
  "rx.abort": bool
  "tx.abort": bool
  "tx.reset": bool = TRUE
  "rx 0.stream enable": bool
  "rx 1.stream enable": bool
  "tx 0.stream enable": bool
  "tx 1.stream enable": bool
  "TX start trigger count": u32 = 1200000
  "RX RF channel": i32 = 2
  "enable DC offset correction": bool
  "TX RF channel": i32 = 2
  "eNB processing delay": u32
  "TX RF trigger offset": i32
  "rx.output sample rate": UFXP(1.47)
  "rx.delay": FXP(0.16)
  "rx 0.frequency shift": FXP(0.48)
  "rx 0.phase": FXP(0.21)
  "rx 1.frequency shift": FXP(0.48)
  "rx 1.phase": FXP(0.21)
  "rx 0.impairments": "IQ Impairments.gtype"
  "rx 1.impairments": "IQ Impairments.gtype"
  "tx.input sample rate": UFXP(1.47)
  "tx.delay": FXP(0.18)
  "tx 0.frequency shift": FXP(0.48)
  "tx 0.phase": FXP(0.21)
  "tx 1.frequency shift": FXP(0.48)
  "tx 1.phase": FXP(0.21)
  "tx 0.gain": "IQ Gain.gtype"
  "tx 0.impairments": "IQ Impairments.gtype"
  "tx 1.gain": "IQ Gain.gtype"
  "tx 1.impairments": "IQ Impairments.gtype"
  "DL TX active": bool
  "use DL TX RF start trigger": bool = TRUE
  "transfer full DL TX frame": bool
  "DL debug MAC settings": T1
  "number of TX IFFT output bits shifted": u8
  "TX RT mode": bool
  "DL TX static parameters": T3 = {0, 0, 1, FALSE, 200, 2, 32}
  "DL TX RF Trigger delay": u16
  "transfer full RX stream": bool
  "enable DL RX": bool
  "internal DL loopback": bool
  "DL channel equalizer bypass": bool
  "DL FFT debug channel select": T5
  "constellation symbol number (0-13)": u8
  "constellation subset": bool
  "use fix PDSCH configuration": bool
  "sync configuration": T8 = {"FFT window timing advance"=-3, "autocorrelation threshold"=1.04308128357e-07, "static CFO"=0, "use static CFO"=FALSE, "CFO factor"=0.0290069580078, "sync operation mode"="Normal", "trigger delay"=0}
  "FO normalization factor": FXP(5.11) = -1
  "constellation select": enum{"DL EQ Output", "PDSCH Dec Input"} = "DL EQ Output"
  "enable frequency tracking": bool = TRUE
  "RX RT mode": bool
  "DL RX static parameters": T3 = {0, 0, 1, FALSE, 200, 2, 32}
  "fix PDSCH configuration": T10 = {"modulation"="64QAM", "RB allocation"=[FALSE, FALSE, FALSE, FALSE, FALSE, FALSE, FALSE, FALSE, FALSE, FALSE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], "decoder"={"number of REs"=0, "modulation"="QPSK", "redundancy version index"=0, "transport block size"=0, "user data"=0}, "MIMO flag"=FALSE}
  "Equalizer Type": enum{"Simple", "ZF", "MMSE"} = "Simple"
  "Sigma": UFXP(1.14)
  "MIMO Selector AP0": enum{"SISO", "MIMO"} = "SISO"
panel indicators:
  "reg.notify host.go 0": bool
  "rx.samples processed": u32
  "rx.number of clipped IQ data samples": u64
  "rx.number of overflows": u32
  "tx.samples processed": u32
  "tx.underflows": u32
  "tx.number of clipped IQ data samples": u64
  "rx.dsp reset done": bool
  "tx.dsp reset done": bool
  "tx.state": "Stream Control State.gtype"
  "rx.state": "Stream Control State.gtype"
  "ADC values clipped": bool
  "DL TX trigger generated count": u32
  "DC average": CFXP(1.17)
  "reg.host read.data 0": "Read Cmd Data.gtype"
  "TS DL TX FIFO to DACs overflow": u16
  "DL trigger received count": u32
  "TS internal DL loopback FIFO overflow": u16
  "T2H DL TX BB FIFO overflow": u16
  "TX IFFT output clipped": bool
  "DL BB out power": UFXP(1.30)
  "Num DL TX RF Triggers": u32
  "TS DL TX FIFO to DACs overflow AP1": u16
  "TS internal DL loopback FIFO overflow AP1": u16
  "T2H DL TX BB FIFO overflow AP1": u16
  "TX IFFT output clipped AP1": bool
  "DL BB out power AP1": UFXP(1.30)
  "FIFO faults AP1": T4
  "FIFO faults AP0": T4
  "sync frame start count": u32
  "frame aligned data FIFO overflow": u16
  "T2H DL RX stream FIFO overflow": u16
  "DL sync in power": UFXP(1.30)
  "DL BB in power": UFXP(1.30)
  "T2H channel estimation FIFO overflow": u16
  "T2H PDCCH FIFO overflow": u16
  "T2H DL FFT FIFO overflow": u16
  "T2H PDSCH decoder data overflow": u16
  "T2H PDSCH decoder status overflow": u16
  "T2H PDSCH FIFO overflow": u16
  "sync status": T6
  "T2H DL FFT FIFO overflow AP1": u16
  "T2H PDSCH FIFO overflow AP1": u16
  "frame aligned data FIFO overflow AP1": u16
  "PXSCH decoder status latched": T11
  "inverse value of Weight Matrix": T12
  "T2H channel estimation FIFO overflow RX1TX1": u16
types:
  "Stream Control State.gtype" = enum{"Idle", "Active"}
  "IQ Impairments.gtype" = cluster{"inline gain I": FXP(1.17), "inline gain Q": FXP(1.17), "cross gain I": FXP(1.17), "cross gain Q": FXP(1.17), "pre-gain offset I": FXP(1.17), "pre-gain offset Q": FXP(1.17), "post-gain offset I": FXP(1.17), "post-gain offset Q": FXP(1.17)}
  "IQ Gain.gtype" = cluster{"gain I": FXP(3.21), "gain Q": FXP(3.21)}
  "Read Cmd Data.gtype" = cluster{"go": bool, "data": u32}
  T1 = cluster{"disable mini MAC": bool, "transmit counter value": bool}
  T2 = cluster{"total number of REGs": u16, "aggregation level": u16, "DCI message length": u8}
  T3 = cluster{"cell ID": u16, "number of antenna ports": u8, "frame structure": enum{"FDD", "TDD 5 5"}, "enable T2H transfer": bool, "PDCCH": T2}
  T4 = cluster{"PDCCH Sample Overflow": u16, "PDCCH Sample Underflow": u16, "PDSCH Sample Overflow": u16, "PDSCH Sample Underflow": u16}
  T5 = cluster{"ZERO": bool, "PSS": bool, "SSS": bool, "CRS": bool, "PBCH": bool, "PCFICH": bool, "PHICH": bool, "PDCCH": bool, "PDSCH": bool, "UERS AP7": bool, "UERS AP9": bool}
  T6 = cluster{"PSS detected?": bool, "cross correlation timing estimate": UFXP(19.0), "autocorrelation peak index": UFXP(19.0), "FFO estimation": FXP(2.14), "IFO estimation": FXP(3.0), "frame timing estimation": UFXP(19.0), "signal detected?": bool, "normalized CFO": FXP(0.48)}
  T7 = enum{"Normal", "Use internal Trigger", "Use external Trigger", "Manual", "Bypass"}
  T8 = cluster{"FFT window timing advance": i8, "autocorrelation threshold": UFXP(14.26), "static CFO": FXP(4.44), "use static CFO": bool, "CFO factor": UFXP(0.16), "sync operation mode": T7, "trigger delay": UFXP(19.0)}
  T9 = cluster{"number of REs": u16, "modulation": enum{"QPSK", "QAM16", "QAM64"}, "redundancy version index": UFXP(2.0), "transport block size": UFXP(17.0), "user data": u32}
  T10 = cluster{"modulation": enum{"QPSK", "16QAM", "64QAM"}, "RB allocation": bool[100], "decoder": T9, "MIMO flag": bool}
  T11 = cluster{"transport block size": UFXP(17.0), "TB CRC ok": bool, "CB CRC ok": bool[13], "user data": u32}
  T12 = cluster{"1/sqrt() latched": FXP(2.16), "1/sqrt() scaling latched": FXP(8.17), "data valid": bool}
  "DDC Parameters.gtype" = cluster{"output sample rate": UFXP(1.47), "delay": FXP(0.16), "frequency shift": FXP(0.48), "impairments": "IQ Impairments.gtype", "phase": FXP(0.21)}
  "DUC Parameters.gtype" = cluster{"frequency shift": FXP(0.48), "impairments": "IQ Impairments.gtype", "phase": FXP(0.21), "input sample rate": UFXP(1.47), "gain": "IQ Gain.gtype", "delay": FXP(0.18)}
  T13 = cluster{"data valid": bool, "normalized CFO": FXP(0.48), "frame timing estimation": UFXP(19.0)}
  T14 = cluster{"symbol": CFXP(2.14), "symbol valid": bool}
uses:
  NI::SDR::RegisterBusV1FPGA::Process.gcdl
  NI::USRPRIO::ConfigV1FPGA::Process.gvi
diagram:
  call "Create Resources.gvi"() -> (sync.resources=w1, config.resources=w2, time.resources=w3)
  clock-driven loop (clock = "40 MHz Onboard Clock") {
    # Register Bus and Required Controls/Indicators
    Io Write(data=$"RF 1/Rx/Enable", reference in="RF 1/Rx/Enable")
    Io Write(data=$"RF 0/Tx/Enable", reference in="RF 0/Tx/Enable")
    Io Write(data=$"RF 0/Rx/Enable", reference in="RF 0/Rx/Enable")
    Io Write(data=$"RF 1/Tx/Enable", reference in="RF 1/Tx/Enable")
    Feedback Node(input=w4) -> w5
    call "read completion from typedef.gcdl"(read completion (typedef)=w5) -> (read completion=w6)
    Feedback Node(input=w7) -> w8
    call "Process.gcdl"(reg.notify host.go rcvd=$"reg.notify host.go rcvd 0", reg.host read.go rcvd=$"reg.host read.go rcvd 0", read completion=w6, reg.reset=$"reg.reset 0", reg.host instruction fifo="niInstr Register Bus v0.grsc::reg.host instruction fifo 0", ready for output=w8) -> (reg.notify host.go=w9, reg.host read.data=w10, register instruction=w11)
    $"reg.notify host.go 0" <- w9
    call "reg.host read.data to typedef.gcdl"(reg.host read.data=w10) -> (reg.host read.data (typedef)=w12)
    $"reg.host read.data 0" <- w12
    call "register instruction to typedef.gcdl"(register instruction=w11) -> (register instruction (typedef)=w13)
    call "Registers.gcdl"(register instruction=w13, config.resources=w2, sync.resources=w1, time.resources=w3) -> (read completion out=w4, ready for input=w7)
    stop if FALSE
  }
  call "LEDs.gvi"()
  call "Process.gvi"(resources=w2)
  Register Create(initial value=FALSE) -> (reference out=w14)
  Register Create(initial value=FALSE) -> (reference out=w15)
  clock-driven loop (clock = "Data Clock") forever {
    # Data Reception from Antenna, downconversion to baseband sample rate, received data will be written into RX baseband input FIFO
    # Readout of TX baseband output buffer, upconversion and transmission to antenna
    Build Array($"rx 0.stream enable", $"rx 1.stream enable") -> w16
    call "LTE RF TX Trigger Generator.gcdl"(TX trigger register=w14, use independent RX trigger=FALSE, sync frame start=w15, TX start trigger count=$"TX start trigger count", delay + timing advance=$"eNB processing delay", use independent TX trigger=TRUE, TX RF trigger offset=$"TX RF trigger offset", transmit without sync=TRUE) -> (RX frame start trigger=w17, TX trigger generated count=w18)
    w19 = "DDC Parameters.gtype" {"0x800000000000", 0, 0, "0x1FFFF", "0x1FFFF", 0, 0, 0, 0, 0, 0, 0}
    Property Node(instance in=w19, "impairments"=$"rx 0.impairments", "frequency shift"=$"rx 0.frequency shift", "phase"=$"rx 0.phase", "output sample rate"=$"rx.output sample rate", "delay"=$"rx.delay") -> (instance out=w20)
    w21 = "DDC Parameters.gtype" {"0x800000000000", 0, 0, "0x1FFFF", "0x1FFFF", 0, 0, 0, 0, 0, 0, 0}
    Property Node(instance in=w21, "delay"=$"rx.delay", "output sample rate"=$"rx.output sample rate", "impairments"=$"rx 1.impairments", "frequency shift"=$"rx 1.frequency shift", "phase"=$"rx 1.phase") -> (instance out=w22)
    Build Array(w20, w22) -> w23
    call "LTE USRP Stream RX Top MIMO.gcdl"(RX frame start trigger=w17, rx.reset=$"rx.reset", RX RF channel=$"RX RF channel", rx.stream enable=w16, rx.abort=$"rx.abort", DDC parameters=w23, enable DC offset correction=$"enable DC offset correction", RX baseband FIFO reference="LTE AFW Resources.grsc::TS DL RX from RF", RX baseband FIFO reference AP1="LTE AFW Resources MIMO.grsc::TS DL RX from RF AP1") -> (rx.number of overflows=w24, rx.samples processed=w25, ADC values clipped=w26, DC average=w27, rx.number of clipped IQ data samples=w28, rx.dsp reset done=w29, rx.state=w30)
    $"ADC values clipped" <- w26
    $"DC average" <- w27
    $"rx.number of clipped IQ data samples" <- w28
    Build Array($"tx 0.stream enable", $"tx 1.stream enable") -> w31
    w32 = "DUC Parameters.gtype" {0, "0x1FFFF", "0x1FFFF", 0, 0, 0, 0, 0, 0, 0, 0, "0x200000", "0x200000", 0}
    Property Node(instance in=w32, "gain"=$"tx 0.gain", "frequency shift"=$"tx 0.frequency shift", "phase"=$"tx 0.phase", "impairments"=$"tx 0.impairments", "input sample rate"=$"tx.input sample rate", "delay"=$"tx.delay") -> (instance out=w33)
    w34 = "DUC Parameters.gtype" {0, "0x1FFFF", "0x1FFFF", 0, 0, 0, 0, 0, 0, 0, 0, "0x200000", "0x200000", 0}
    Property Node(instance in=w34, "delay"=$"tx.delay", "input sample rate"=$"tx.input sample rate", "gain"=$"tx 1.gain", "frequency shift"=$"tx 1.frequency shift", "phase"=$"tx 1.phase", "impairments"=$"tx 1.impairments") -> (instance out=w35)
    Build Array(w33, w35) -> w36
    call "LTE USRP Stream TX Top MIMO.gcdl"(tx.reset=$"tx.reset", TX RF channel=$"TX RF channel", TX baseband FIFO reference="LTE AFW Resources.grsc::TS DL TX to RF", DUC parameters=w36, tx.enable streams=w31, TX baseband FIFO reference AP1="LTE AFW Resources MIMO.grsc::TS DL TX to RF AP1", tx.abort=$"tx.abort") -> (tx.state=w37, tx.samples processed=w38, tx.underflows=w39, tx.number of clipped IQ data samples=w40, tx.dsp reset done=w41)
    $"tx.state" <- w37
    $"rx.dsp reset done" <- w29
    $"tx.samples processed" <- w38
    $"rx.state" <- w30
    $"tx.underflows" <- w39
    $"rx.samples processed" <- w25
    $"tx.number of clipped IQ data samples" <- w40
    $"rx.number of overflows" <- w24
    $"tx.dsp reset done" <- w41
    $"DL TX trigger generated count" <- w18
  }
  Register Create(initial value=T13 {all zero or empty}) -> (reference out=w42)
  clock-driven loop (clock = "LTE AFW Resources.grsc::192MHz") forever {
    # SOURCE
    Feedback Node(input=w43) -> w44
    call "LTE DL RX Input FIFO Select.gcdl"(internal DL loopback FIFO="LTE AFW Resources.grsc::TS DL internal loopback", internal DL loopback=$"internal DL loopback", received IQ DL from RF="LTE AFW Resources.grsc::TS DL RX from RF", ready for input=w44) -> (IQ sample=w45, IQ sample valid=w46)
    call "LTE DL RX Sync Build Configuration.gcdl"(enable DL RX=$"enable DL RX", transfer full RX stream=$"transfer full RX stream", sync configuration from host=$"sync configuration", static DL RX configuration=$"DL RX static parameters", FO normalization factor=$"FO normalization factor", enable frequency tracking=$"enable frequency tracking", external trigger reference="AUX I/O 0", internal trigger reference="LTE AFW Resources.grsc::TS DL TX RF Trigger") -> (sync configuration=w47, timing overwrite options=w48)
    call "LTE DL RX Input FIFO Select.gcdl"(internal DL loopback FIFO="LTE AFW Resources MIMO.grsc::TS DL internal loopback AP1", internal DL loopback=$"internal DL loopback", received IQ DL from RF="LTE AFW Resources MIMO.grsc::TS DL RX from RF AP1", ready for input=w44) -> (IQ sample=w49, IQ sample valid=w50)
    Feedback Node(input=w51) -> w52
    call "LTE DL RX Sync Top MIMO.gcdl"(IQ sample in=w45, input valid=w46, IQ sample in AP1=w49, sync configuration=w47, frequency tracking in=w52, timing overwrite options=w48, input valid AP1=w50) -> (DL sync in power=w53, frame aligned sample=w54, frame aligned sample valid=w55, sample to spectrum=w56, sample to spectrum valid=w57, sync status=w58, time and frequency offset=w59, frame start pulse=w60, ready for input=w43, frame aligned sample AP1=w61, frame aligned sample valid AP1=w62, sample to spectrum AP1=w63)
    call "LTE DL IQ Sample Buffer MIMO.gcdl"(frame aligned sample AP1=w61, frame aligned sample valid AP1=w62, frame aligned sample AP0=w54, frame aligned sample valid AP0=w55) -> (frame aligned data FIFO overflow AP1=w64, frame aligned data FIFO overflow AP0=w65, DL IQ sample out AP1=w66, output valid AP1=w67, DL IQ sample out AP0=w68, output valid AP0=w69, symbol start (pulse)=w70)
    # DL RX Chain including Sync, RX IQ processing, PDCCH and PDSCH receiver
    $"frame aligned data FIFO overflow AP1" <- w64
    $"frame aligned data FIFO overflow" <- w65
    Property Node(instance in=w58) -> ("signal detected?"=w71)
    call "LTE Get PDSCH Dynamic Configuration.gcdl"(TTI DL configuration H2T="LTE AFW Resources.grsc::H2T DL RX Dynamic Configuration", symbol trigger=w70, RT mode=$"RX RT mode", sync found=w71) -> (dynamic DL configuration=w72)
    # IQ PROCESSING
    call "LTE DL RX IQ Processing MIMO.gcdl"(data in RX AP0=w68, input valid AP0=w69, static DL RX configuration=$"DL RX static parameters", DL channel equalizer bypass=$"DL channel equalizer bypass", symbol start=w70, dynamic DL configuration=w72, data in RXAP1=w66, input valid AP1=w67, Equalizer Type=$"Equalizer Type", Sigma=$Sigma) -> (DL BB in power=w73, equalized sample CRS AP0=w74, equalized sample CRS SISO=w75, time and resource map CRS AP0=w76, equalized sample UERS AP0=w77, time and resource map UERS=w78, channel estimate AP0 (CRS only)=w79, channel estimate AP0 (UERS only)=w80, equalized sample CRS AP1=w81, frequency tracking=w51, channel estimate CRS only RX1TX1=w82, inverse value=w83)
    $"inverse value of Weight Matrix" <- w83
    $"DL BB in power" <- w73
    # SYNC
    $"DL sync in power" <- w53
    # PDCCH status info for UL Feedback
    Property Node(instance in=$"DL RX static parameters") -> ("enable T2H transfer"=w84, instance out=w85)
    # <---------------PDSCH------------->
    # PDCCH
    call "LTE PDCCH RX Top MIMO.gcdl"(equalized sample=w75, timing and channel cluster=w76, static DL RX configuration=$"DL RX static parameters", dynamic DL configuration=w72) -> (PDSCH parameters=w86, PDSCH parameters valid=w87, DCI to host=w88, DCI to host valid=w89)
    call "LTE PDSCH RX Sample Select MIMO.gcdl"(equalized sample (CRS)=w75, resource map and timing (CRS)=w76, equalized sample (UERS)=w77, resource map and timing (UERS)=w78, PDSCH configuration=w86, PDSCH configuration valid=w87, static DL RX configuration=w85, fix PDSCH configuration=$"fix PDSCH configuration", use fix PDSCH configuration=$"use fix PDSCH configuration", dynamic DL configuration=w72, equalized sample (CRS) AP1=w81, equalized sample (CRS) AP0=w74) -> (PDSCH sample for decoder AP0=w90, PDSCH sample for decoder valid AP0=w91, PDSCH sample for constellation AP0=w92, PXSCH receiver configuration=w93, PXSCH configuration valid AP0=w94, PDSCH sample for decoder AP1=w95, PDSCH sample for decoder valid AP1=w96, PXSCH configuration valid AP1=w97, PDSCH sample for constellation AP1=w98)
    call "LTE PXSCH RX Bit Processing.gcdl"(PXSCH RX symbol=w95, PXSCH RX symbol valid=w96, PXSCH receiver trigger=w97, PXSCH receiver configuration=w93) -> (PXSCH RX payload=w99, PXSCH RX payload valid=w100, PXSCH RX status=w101, PXSCH RX status valid=w102)
    call "LTE PXSCH RX Bit Processing.gcdl"(PXSCH RX symbol=w90, PXSCH RX symbol valid=w91, PXSCH receiver trigger=w94, PXSCH receiver configuration=w93) -> (PXSCH RX payload=w103, PXSCH RX payload valid=w104, PXSCH RX status=w105, PXSCH RX status valid=w106)
    call "LTE RX PXSCH Host Interface MIMO.gcdl"(PXSCH decoded data AP0=w103, PXSCH decoded data valid AP0=w104, PXSCH decoder status AP0=w105, PXSCH decoder status valid AP0=w106, enable T2H transfer=w84, PXSCH decoding status T2H="LTE AFW Resources.grsc::T2H PDSCH Decoding Status", PXSCH decoded data T2H="LTE AFW Resources.grsc::T2H PDSCH Decoded Data", PXSCH decoded data AP1=w99, PXSCH decoded data valid AP1=w100, PXSCH decoder status AP1=w101, PXSCH decoder status valid AP1=w102) -> (PXSCH decoder data T2H overflow=w107, PXSCH decoder status T2H overflow=w108, PXSCH decoder status latched=w109)
    $"T2H PDSCH decoder data overflow" <- w107
    $"T2H PDSCH decoder status overflow" <- w108
    $"PXSCH decoder status latched" <- w109
    $"sync status" <- w58
    call "LTE Channel Estimates to U64.gcdl"(CRS data in=w82, UERS data in=w80) -> (data out=w110, data out valid=w111)
    # Write all Channel Estimates
    call "LTE FIFO Write U64 T2H.gcdl"(FIFO reference in="LTE AFW Resources MIMO.grsc::channel estimate RX1TX1", sample in=w110, sample in valid=w111) -> (FIFO overflow counter=w112)
    $"T2H channel estimation FIFO overflow RX1TX1" <- w112
    call "LTE Channel Estimates to U64.gcdl"(CRS data in=w79, UERS data in=w80) -> (data out=w113, data out valid=w114)
    # Channel estimates for SINR
    call "LTE FIFO Write U64 T2H.gcdl"(FIFO reference in="LTE AFW Resources.grsc::T2H RX Channel Estimates", sample in=w113, sample in valid=w114) -> (FIFO overflow counter=w115)
    $"T2H channel estimation FIFO overflow" <- w115
    # Write Sync Trigger and
    # time and frequency offset
    call "LTE RX Sync Write Status Registers.gcdl"(frame start trigger=w60, time and frequency offset=w59, frame start trigger register=w15, time and frequency offset register=w42) -> (sync frame start count=w116)
    # RX Spectrum
    $"sync frame start count" <- w116
    call "LTE FIFO Write U32 T2H.gcdl"(FIFO reference in="LTE AFW Resources.grsc::T2H PDCCH Message", sample in=w88, sample in valid=w89) -> (FIFO overflow counter=w117)
    $"T2H PDCCH FIFO overflow" <- w117
    Is Equal(x=$"MIMO Selector AP0", y="SISO") -> w118
    Select(s=w118, t=w75, f=w74) -> w119
    # Rx Constellation
    call "LTE DL RX Constellation FIFO Write.gcdl"(equalizer output=w119, resource map and timing=w76, PDSCH sample=w92, DL FFT debug channel select=$"DL FFT debug channel select", DL constellation FIFO="LTE AFW Resources.grsc::T2H RX Constellation", constellation symbol number=$"constellation symbol number (0-13)", constellation subset=$"constellation subset", enable T2H transfer=w84, constellation selector=$"constellation select") -> (FIFO overflow counter EQ=w120, FIFO overflow counter PDSCH=w121)
    $"T2H DL FFT FIFO overflow" <- w120
    $"T2H PDSCH FIFO overflow" <- w121
    call "CFX1.15 to U32.gcdl"(data in=w56) -> (data out=w122)
    call "CFX1.15 to U32.gcdl"(data in=w63) -> (data out=w123)
    Join Numbers(high(x)=w122, low(x)=w123) -> w124
    call "LTE FIFO Write U64 T2H.gcdl"(FIFO reference in="LTE AFW Resources MIMO.grsc::T2H RX Baseband Stream MIMO", sample in=w124, sample in valid=w57) -> (FIFO overflow counter=w125)
    $"T2H DL RX stream FIFO overflow" <- w125
    call "LTE DL RX Constellation FIFO Write.gcdl"(equalizer output=w81, resource map and timing=w76, PDSCH sample=w98, DL FFT debug channel select=$"DL FFT debug channel select", DL constellation FIFO="LTE AFW Resources MIMO.grsc::T2H RX Constellation AP1", constellation symbol number=$"constellation symbol number (0-13)", constellation subset=$"constellation subset", enable T2H transfer=w84, constellation selector=$"constellation select") -> (FIFO overflow counter EQ=w126, FIFO overflow counter PDSCH=w127)
    $"T2H DL FFT FIFO overflow AP1" <- w126
    $"T2H PDSCH FIFO overflow AP1" <- w127
  }
  clock-driven loop (clock = "LTE AFW Resources.grsc::192MHz") forever {
    Register Read(reference in=w14) -> (data=w128)
    # w129: symbol trigger
    call "LTE TX Trigger.gcdl"(trigger in=w128, use TX RF start trigger=$"use DL TX RF start trigger", TX active=$"DL TX active", TX single shot=FALSE) -> (trigger received count=w130, symbol start trigger=w129)
    call "LTE DL TTI Handling MIMO.gcdl"(symbol trigger in=w129, TTI FIFO T2H="LTE AFW Resources.grsc::T2H Timing Indication", TTI DL config fifo H2T="LTE AFW Resources.grsc::H2T DL TX Dynamic Configuration", static DL configuration=$"DL TX static parameters", RT target=$"TX RT mode") -> (TX timing cluster=w131, dynamic DL configuration=w132, empty PDCCH trigger=w133, DCI message=w134)
    # w135: PDSCH params
    call "LTE PDSCH TX Configuration Calculation MIMO.gcdl"(dynamic DL configuration in=w132, static DL configuration=$"DL TX static parameters", timing in=w131, DCI message=w134) -> (OFDM symbol trigger=w136, PDSCH RB allocation=w137, PDSCH transmitter configuration=w135, PDSCH transmitter trigger=w138, PDSCH transport block size=w139, dynamic DL configuration out=w140, PDSCH transmitter trigger AP1=w141, PDSCH RB allocation AP1=w142)
    # DL TX
    # Input: PDSCH Data, PDCCH Data, Start of Subframe
    # Output: Data to DAC SCTL
    Feedback Node(input=w143) -> w144
    Feedback Node(input=w145) -> w146
    # w139: TB size
    call "LTE MAC TX MIMO.gcdl"(MAC settings=$"DL debug MAC settings", MAC trigger=w138, TB size=w139, payload FIFO="LTE AFW Resources.grsc::H2T PDSCH Payload", ready for output AP0=w144, ready for output AP1=w146, MIMO active this subframe=w141) -> (data out AP0=w147, data out AP1=w148)
    # PDCCH
    call "LTE PXSCH TX Bit Processing.gcdl"(MAC data=w148, PXSCH transmitter configuration=w135, PXSCH transmitter trigger=w141, OFDM symbol trigger in=w136, RB allocation=w142) -> (OFDM symbol trigger out=w149, PXSCH symbol=w150, PXSCH configuration delay=w151, RB bitmap out=w152, ready for input=w145)
    call "LTE Dynamic DL Configuration Delay.gcdl"(dynamic DL configuration in=w140, trigger=w141, delay=w151) -> (dynamic DL configuration out=w153)
    call "LTE DL TX IQ Processing.gcdl"(start of symbol=w149, static DL configuration=$"DL TX static parameters", dynamic DL configuration=w153, RB bitmap=w152, PDSCH sample=w150, PDCCH sample=T14 {all zero or empty}, number of IFFT output bits shifted=$"number of TX IFFT output bits shifted", antenna port="AP1") -> (sample out=w154, sample out valid=w155, IFFT output clipped=w156, FIFO faults=w157, baseband output power=w158)
    $"DL BB out power AP1" <- w158
    # IQ processing
    # PDSCH latency: 100000 cylces
    # to ensure enough time for sample
    # generation!
    # <---------- PDSCH ------------------->
    call "LTE TX FIFO Write with Loopback.gcdl"(sample in=w154, sample in valid=w155, scope="DL", transfer full TX frame=$"transfer full DL TX frame", TX spectrum T2H="LTE AFW Resources MIMO.grsc::T2H TX Baseband Stream AP1", internal loopback FIFO="LTE AFW Resources MIMO.grsc::TS DL internal loopback AP1", TX FIFO to DACs="LTE AFW Resources MIMO.grsc::TS DL TX to RF AP1") -> (TX FIFO to DACs overflow=w159, internal loopback FIFO overflow=w160, TX spectrum T2H FIFO overflow=w161)
    $"TS DL TX FIFO to DACs overflow AP1" <- w159
    $"TS internal DL loopback FIFO overflow AP1" <- w160
    $"FIFO faults AP1" <- w157
    $"T2H DL TX BB FIFO overflow AP1" <- w161
    call "Pulse to Strobe U32.gcdl"(pulse=w156, N=1920000) -> (strobe=w162)
    $"TX IFFT output clipped AP1" <- w162
    call "LTE PDCCH Transmitter MIMO.gcdl"(timing in=w131, dynamic DL configuration=w132, static DL configuration=$"DL TX static parameters", empty PDCCH trigger=w133, DCI message=w134) -> (PDCCH symbol=w163)
    call "LTE PXSCH TX Bit Processing.gcdl"(MAC data=w147, PXSCH transmitter configuration=w135, PXSCH transmitter trigger=w138, OFDM symbol trigger in=w136, RB allocation=w137) -> (OFDM symbol trigger out=w164, PXSCH symbol=w165, PXSCH configuration delay=w166, RB bitmap out=w167, ready for input=w143)
    call "LTE Dynamic DL Configuration Delay.gcdl"(dynamic DL configuration in=w140, trigger=w138, delay=w166) -> (dynamic DL configuration out=w168)
    call "LTE DL TX IQ Processing.gcdl"(start of symbol=w164, static DL configuration=$"DL TX static parameters", dynamic DL configuration=w168, RB bitmap=w167, PDSCH sample=w165, PDCCH sample=w163, number of IFFT output bits shifted=$"number of TX IFFT output bits shifted", antenna port="AP0") -> (sample out=w169, sample out valid=w170, IFFT output clipped=w171, FIFO faults=w172, baseband output power=w173)
    $"DL BB out power" <- w173
    # IQ processing
    call "LTE TX FIFO Write with Loopback.gcdl"(sample in=w169, sample in valid=w170, scope="DL", transfer full TX frame=$"transfer full DL TX frame", TX spectrum T2H="LTE AFW Resources.grsc::T2H TX Baseband Stream", internal loopback FIFO="LTE AFW Resources.grsc::TS DL internal loopback", TX FIFO to DACs="LTE AFW Resources.grsc::TS DL TX to RF") -> (TX FIFO to DACs overflow=w174, internal loopback FIFO overflow=w175, TX spectrum T2H FIFO overflow=w176)
    $"TS DL TX FIFO to DACs overflow" <- w174
    $"TS internal DL loopback FIFO overflow" <- w175
    $"FIFO faults AP0" <- w172
    $"T2H DL TX BB FIFO overflow" <- w176
    $"DL trigger received count" <- w130
    call "LTE DL TX Trigger Write.gcdl"(input valid=w170, DL TX Trigger Register="LTE AFW Resources.grsc::TS DL TX RF Trigger", DL TX Trigger IO Port="AUX I/O 1", Trigger delay=$"DL TX RF Trigger delay") -> (Num DL TX Start Triggers=w177)
    $"Num DL TX RF Triggers" <- w177
    call "Pulse to Strobe U32.gcdl"(pulse=w171, N=1920000) -> (strobe=w178)
    $"TX IFFT output clipped" <- w178
  }
