vi "Host UE.gvi"   [LabVIEW NXG 4.0.0]
# Enqueue an element into the stop notifier if error in indicates an error. Call after each loop on host top level to synchronize host shut down in case of any error.
panel controls:
  "RIO Device": string = "RIO0"  # The RIO address of the RF hardware device
  "UE Transmitter": bool  # Enables or disables the transmitter using the current configuration.
  "UE RX Frequency": f64 = 2000000000  # DL RX center frequency, allowed range depends on used RF device.
  "UE Manual Gain": f64  # Controls the analog RX gain in case UE AGC is switched off.
  "Transmit IP Address": string = "127.0.0.1"  # The IP address the UDP packets received from PDSCH shall be sent to.
  "UDP Transmit Port": u16 = 60000  # The UDP port the UDP packets received from PDSCH shall be sent to.
  "UE AGC": bool = TRUE  # Enables or disables the automated gain control on the receiver side. If enabled the analog RX gain of the RF device will be automatically configured within its valid range to meet a target range for the baseband receive power.
  "stop": bool
  "Reference Clock Source": string = "Internal"  # Configures the Reference Clock source used for the transceiver chain. Internal: Device internal clock REF IN / ClkIn: Clock input at the RF device (i.e. rear connector pane at USRP RIO, front connector pane for NI 579x) PXI_CLK: Backplane clock from the PXI Chassis (NI 579x only) GPS: GPS module (NI USRP RIO 295x only)
  "UE Receiver": bool  # Enables or disables the receiver using the current configuration.
  "UE RX RF Port (USRP)": "USRP RX RF Port.gtype" = "RX2/RF1"  # Selects the HW RF port the DL RX will be received from (USRP RIO only).
  "symbol number for PDSCH constellation": u8 = 4  # The OFDM symbol number (counting from 0 with symbol 0 being occupied by the PDCCH) used for displaying constellation data for PDSCH IQ samples.
  "throughput select": T2 = "PDSCH (CRC ok)"  # Selects the used values for throughput calculation: PDSCH (overall): the total throughput scheduled by the eNodeB TX regardless of CRC result. PDSCH (CRC ok): the really achieved physical layer throughput, which could be decoded successfully. User data (to UDP): the higher layer throughput (from/to UDP stream) after removing the padding.
  "UE TX Frequency": f64 = 1800000000  # UL TX center frequency, allowed range depends on used RF device.
  "UE Max RF TX Power": f64 = 10  # Maximum RF transmit output power (upper bound - achievable for a full scale complex sine wave (CW) signal) Note: The actual time-domain RF transmit power depends on the configured resource allocation and is typically at least 15dB lower to allow for the OFDM PAPR backoff.
  "UE TX RF Port (USRP)": enum{"TX1/RF0", "TX1/RF1"} = "TX1/RF0"  # Selects the HW RF port the UL TX will be transmitted on (USRP RIO only).
  "UE TX UE Context": cluster{"RNTI": u16, "SRS Configuration": T3} = {10, TRUE, "0x200", TRUE}
    # UE-specific parameters for UL transmission.
    # RNTI: The radio network temporary identifier used for PUSCH scrambling.
    # SRS Configuration: The configuration used for transmitting sounding reference signal.
    # SRS Enabled: If TRUE, SRS location is reserved as last symbol in each UL subframe (FDD, TDD) and last 2 symbols in each special subframe (TDD) (according to 3GPP TS 36.211 §5.5.3.3: FDD: srs-SubframeConfig = 0, TDD: srs-SubframeConfig = 7).
    # SRS Subframe Allocation: Bitmap determining the subframes actually used for SRS transmission. Periodicity of 10, leftmost bit represents subframe 0.
    # Transmission Comb: Parameter transmissionComb k_TC determining if even (0) or odd (1) subcarriers are used for SRS transmission/reception. See also 3GPP TS 36.211 §5.5.3.2.
  "Timing Advance [samples]": u32  # The applied UL timing advance, i.e. the number of samples the UL TX is started earlier than the DL RX. Given in 30.72 MS/s domain.
  "UE TX Frame Structure": enum{"FDD", "TDD 5 5"} = "FDD"  # Select between FDD (frequency division duplex) and TDD (time division duplex) using subframe configuration 5 and special subframe configuration 5 (3GPP TS 36.211 §4).
  "UE RX Frame Structure": enum{"FDD", "TDD 5 5"} = "FDD"  # Select between FDD (frequency division duplex) and TDD (time division duplex) using subframe configuration 5 and special subframe configuration 5 (3GPP TS 36.211 §4).
  "UE TX Cell ID": u16  # Physical cell ID used for PUSCH scrambling.
  "UE RX Cell ID": u16  # Physical cell ID used for PSS, CRS, UERS sequence generation and PDCCH/PDSCH scrambling. [0…511].
  "session": "Host Session.gtype"
  "UE RX UE Context": T13 = {"RNTI"=10, "Use UERS"=FALSE, "Antenna Port"=7, "CCE Offset"=0}
    # UE specific parameters for DL reception.
    # Use UERS: If enabled the DL receiver will use UE specific reference signals for equalizing PDSCH assigned I/Q samples. The usage of UERS is closely related to Transmission Mode 9 defined in the LTE standard 3GPP TS 36.213 §7.1.
    # RNTI: The radio network temporary identifier used for PDSCH scrambling and PDCCH CRC mask check.
    # Antenna Port: The antenna port used for generating UERS for channel estimation, Range: 7…14 according to 3GPP TS 36.213 §7.1.
    # CCE Offset: First control channel element to be used for PDCCH reception. According to 3GPP TS 36.211 §6.8.1/.2.
  "Command": string = "MACsimpleUE"  # Command to execute for external MAC.
  "External MAC": bool  # When enabled a program is executed on the RT described by command line and arguments. This switch applies for RT only. When disabled an internal basic MAX will be executed.
  "Arguments": string  # Arguments to pass to the external MAC.
  "Tab": i32
  "Stop on API Confirmation Errors": bool
  "UE TX DCI": "DCI Message.gtype" = {"Active"=TRUE, "MCS"="MCS 0 (QPSK, rate ~0.12)", "Resource Block Allocation (4 PRB/bit)"=29360128}
  "Transport Instance ID": u8
panel indicators:
  "FPGA Ready": bool  # Signals that the FPGA bitfile has been downloaded and that the device has been initialized and is ready for configuration. (Initialization can take up to 20 seconds).
  "UE RX Active": bool  # Signals that all UE RX control configurations have been applied and the receiver is running.
  "UE Coerced Gain": f64  # The actual used analog RX RF gain either set by AGC, if enabled, or by UE Manual Gain Value [dB].
  "UE ADC Values Clipped": bool  # Indicates a numeric overflow at the ADC output (i.e. analog RX RF gain too high or receive power level too high).
  "UE Baseband RX Power": f64  # The measured baseband receive power level in dB full scale.
  "UE RX Power Spectrum": T1  # Shows the power spectrum of the DL RX baseband signal received from RF. If synchronization is successful frequency offset compensation is applied.
  "PDSCH Constellation": c128[]  # Constellation of RX IQ samples allocated for PDSCH transmission after equalization. Only samples for the configured OFDM Symbol-Nr (PDSCH) are displayed.
  "PDCCH Constellation": c128[]  # Constellation of RX IQ samples allocated for PDCCH transmission after equalization.
  "DL throughput": f64[][]
  "UE Failure / Block Error Rate (BLER)": f64[][]  # Numerical and graphical display of error rates for synchronization detection, PDCCH and PDSCH decoding.
  "UE Frequency Offset": f64  # The estimated and compensated frequency offset detected in the RX signal.
  "Sync Found": bool  # Indicates that the synchronization module has successfully detected and synchronized to a DL RX signal.
  "UE DDC Values Clipped": bool  # Indicates a numeric overflow at the output of the digital downconversion block (i.e. analog RX RF gain too high or input power level too high).
  "Packet Loss Out": bool  # Indicates that the system loses UDP data due to overload (i.e. data inflow from PDSCH is higher than UDP throughput).
  "channel estimation": f64[][]  # Graphical representation of the normalized channel amplitude and phase estimated on the cell specific reference signals.
  "Data Transfer Out": bool  # Indicates that the configured UDP stream is sending data to the configured Transmit IP Address using Transmit Port.
  "DL throughput (current)": f64  # Numerical and graphical indication of scheduled, successfully decodable and actually used channel capacity. PDSCH (overall): the total throughput scheduled by the eNodeB TX regardless of CRC result. PDSCH (CRC ok): the really achieved physical layer throughput, which could be decoded successfully. User data (to UDP): the higher layer throughput (from/to UDP stream) after removing the padding
  "UE Coerced Max RF TX Power": f64  # Indicates the coerced value actually used as maximum RF transmit output power after applying the device’s capabilities (range and resolution limitations) to the configured UE Maximum RF TX Power [dBm].
  "UE TX Power Spectrum": T1  # Shows the power spectrum of the UL TX baseband signal transferred to the RF.
  "UE TX Active": bool  # Signals that all UE TX control configurations have been applied and the transmitter is running.
  "Subband SINR [dB]": f64[]  # The estimated SINR for each subband occupying 8 PRBs. Comparable to Reporting Mode 3-0 in 3GPP TS 36.213 §7.2.1. Usage of CRS or UERS for estimation depends on setting of Use UERS switch in UE RX System Parameters.
  "TX starting": bool
  "UE TX IFFT Output Clipped": bool  # Indicates a numeric overflow after the IFFT.
  "Wideband SINR": f64  # The estimated SINR over the full 20MHz band using cell specific reference signals.
  "BLER cluster": cluster{"PDSCH": f64, "PDCCH": f64, "sync": f64}
  "UE RF RX Power": f64  # The measured time domain receive power at the RX RF port.
  "power calibration offset [dB]": f64
  "PDCCH Received DCI Message": "DCI Message.gtype"[]  # Array of decoded and interpreted downlink control information messages received on PDCCH and applied to PDSCH decoding. Each element corresponds to a DL subframe.
  "Radio Frame Number": u16
  "UE RF TX Power": f64  # Actual UE RF transmit power in dBm.
  "UE Baseband TX Power": f64  # Actual UE baseband transmit power level [baseband output power level] in dB full scale.
  "UE Applied Gain": f64
  "PHY Timing Indication Received": u32
  "TTI": u8
  "SFN": u16
  "MAC TX Total Delay": u32
  "DL RX Indication CRC OK": bool
  "Error Report": string
  "device bandwidth [MHz]": u16
  "External MAC Output": string
  "Received Confirmations": T14
  "Negatives": u32
  "Evaluation Errors": u32
  "MPDU Disassembly Failed": bool  # specific error cleared? indicates whether the error referenced by specific error code to clear has been cleared.
types:
  T1 = cluster{"f0": f64, "df": f64, "magnitude": f64[]}
  "USRP RX RF Port.gtype" = enum{"RX1/RF0", "RX2/RF0", "RX1/RF1", "RX2/RF1"}
  T2 = enum{"PDSCH (overall)", "PDSCH (CRC ok)", "User data (to UDP)"}
  T3 = cluster{"SRS Enabled": bool, "SRS Subframe Allocation": UFXP(10.0), "Transmission Comb": bool}
  T4 = enum{"MCS 0 (QPSK, rate ~0.12)", "MCS 1 (QPSK, rate ~0.15)", "MCS 2 (QPSK, rate ~0.19)", "MCS 3 (QPSK, rate ~0.25)", "MCS 4 (QPSK, rate ~0.30)", "MCS 5 (QPSK, rate ~0.37)", "MCS 6 (QPSK, rate ~0.44)", "MCS 7 (QPSK, rate ~0.51)", "MCS 8 (QPSK, rate ~0.59)", "MCS 9 (QPSK, rate ~0.66)", "MCS 10 (16-QAM, rate ~0.33)", "MCS 11 (16-QAM, rate ~0.37)", "MCS 12 (16-QAM, rate ~0.42)", "MCS 13 (16-QAM, rate ~0.48)", "MCS 14 (16-QAM, rate ~0.54)", "MCS 15 (16-QAM, rate ~0.60)", "MCS 16 (16-QAM, rate ~0.64)", "MCS 17 (64-QAM, rate ~0.43)", "MCS 18 (64-QAM, rate ~0.46)", "MCS 19 (64-QAM, rate ~0.50)", "MCS 20 (64-QAM, rate ~0.55)", "MCS 21 (64-QAM, rate ~0.60)", "MCS 22 (64-QAM, rate ~0.65)", "MCS 23 (64-QAM, rate ~0.70)", "MCS 24 (64-QAM, rate ~0.75)", "MCS 25 (64-QAM, rate ~0.80)", "MCS 26 (64-QAM, rate ~0.85)", "MCS 27 (64-QAM, rate ~0.89)", "MCS 28 (64-QAM, rate ~0.93)"}
  "DCI Message.gtype" = cluster{"Active": bool, "MCS": T4, "Resource Block Allocation (4 PRB/bit)": UFXP(25.0)}
  "Transport Session.gtype" = cluster{"FIFO pathname": string, "pipe reader": "Pipe Reader.gtype", "pipe writer": "Pipe Writer.gtype", "transport in RT FIFO": RTFifoRefnum<u8[]>, "transport out RT FIFO": RTFifoRefnum<u8[]>, "transport in timing source name": string, "transport in timing trigger ID": u8, "transport out timing source name": string, "transport out timing trigger ID": u8, "maximum API message size": u32}
  "Register Bus Session.gtype" = Queue<"Session Data.gtype">
  "Semaphore.gtype" = i32
  "DB Queue Reference.gtype" = Queue<"Daughterboard Data.gtype">
  "niUsrpRio Session.gtype" = cluster{"FPGA Interface": any, "RIO Interface Number": u32, "Data Clock Rate": u32, "FPGA Data Clock Rate": u32, "Global Settings Register Bus": "Register Bus Session.gtype", "Radio 0 Settings Register Bus": "Register Bus Session.gtype", "Radio 1 Settings Register Bus": "Register Bus Session.gtype", "Radio Settings Bus Semaphore": "Semaphore.gtype", "DB Queues": "DB Queue Reference.gtype"[], "Characterization Data Valid?": bool, "EEPROM Header": "EEPROM Header.gtype", "Device Data Header": "EEPROM Device Data Header.gtype", "EEPROM Characterization Header": "EEPROM Characterization Header.gtype", "Characterization Data": "Characterization Data.gtype"[], "FPGA Current Version": u32, "FPGA Oldest Compatible Version": u32, "Fixed Logic Current Version": u32, "Fixed Logic Oldest Compatible Version": u32, "FPGA Radio Settings Bus Current Version": u32, "FPGA Radio Settings Bus Oldest Compatible Version": u32, "FPGA Board Config Current Version": u32, "FPGA Board Config Oldest Compatible Version": u32, "Daughterboard Clock Rate": u32}
  T5 = cluster{"FPGA ref": any, "bus instance": u32, "instruction FIFO depth": u32, "executing on FPGA target": bool, "show error call chain": bool}
  T6 = cluster{"Actual Gain [dB]": f64, "Attenuation Table Index": i32}
  T7 = cluster{"Attenuation Table [dB]": f64[][], "Frequencies [Hz]": f64[], "IQ Imbalance Table": "IQ Imbalance.gtype"[], "Gain Table": T6[][]}
  T8 = cluster{"FlexRIO Register Bus": Queue<T5>, "RX Characterization Data": T7, "TX Characterization Data": T7, "FPGA Interface": any}
  T9 = cluster{"transport block size": u32, "CRC ok": bool, "user data": u32}
  "Link Direction.gtype" = enum{"DL", "UL"}
  T10 = cluster{"MAC Stub RX Payload Information FIFO": RTFifoRefnum<"MAC Stub RX Payload Information.gtype">, "MAC Stub RX Confirmation Information FIFO": RTFifoRefnum<u64[16]>, "MAC Stub RX UL Payload Information FIFO": RTFifoRefnum<f64[23]>}
  T11 = cluster{"MAC Stub TX Input Terminals FIFO": RTFifoRefnum<"MAC Stub TX Input Terminals.gtype">, "MAC Stub TX Output Terminals FIFO": RTFifoRefnum<"MAC Stub TX Output Terminals.gtype">}
  T12 = cluster{"MAC Stub RX Interface": T10, "MAC Stub TX Interface": T11}
  "Host Session.gtype" = cluster{"target": enum{"USRP", "FlexRIO"}, "real time mode": bool, "MAC Stub enabled": bool, "DMA FIFO read timeout": i32, "timed loop period": i64, "LTE Transport Sessions": "Transport Session.gtype"[], "USRP session": "niUsrpRio Session.gtype", "FlexRIO session": T8, "UDP RX session": UdpNetworkConnectionRefnum, "UDP TX session": UdpNetworkConnectionRefnum, "sync found FIFO": RTFifoRefnum<bool>, "PDCCH CRC OK FIFO": RTFifoRefnum<bool>, "DL PDCCH status FIFO": RTFifoRefnum<cluster{"CRC ok": bool, "subframe number": u32}>, "DL PDSCH status FIFO": RTFifoRefnum<cluster{"CRC ok": bool, "subframe number": u32}>, "DL SINR FIFO": RTFifoRefnum<f64[]>, "PDSCH user data FIFO": RTFifoRefnum<u32>, "PDSCH user data UDP FIFO": RTFifoRefnum<T9>, "PDSCH user data throughput FIFO": RTFifoRefnum<T9>, "PUSCH user data FIFO": RTFifoRefnum<u32>, "PUSCH user data UDP FIFO": RTFifoRefnum<T9>, "PUSCH user data throughput FIFO": RTFifoRefnum<T9>, "UE feedback info FIFO": RTFifoRefnum<u8[]>, "Request information FIFO": RTFifoRefnum<"Request Information.gtype">, "UDP TX outbound FIFO": RTFifoRefnum<u8[]>, "UDP RX inbound FIFO": RTFifoRefnum<u8[]>, "stop notifier": Notifier<string>, "DL RX scope": string, "UL RX scope": string, "external MAC log file": string, "external MAC process ID": u32, "TX link direction": "Link Direction.gtype", "RX link direction": "Link Direction.gtype", "Sychronization FIFO": RTFifoRefnum<i32>, "RT Loop Interfaces": T12}
  T13 = cluster{"RNTI": u16, "Use UERS": bool, "Antenna Port": UFXP(4.0), "CCE Offset": u8}
  "Confirmation States.gtype" = enum{"Success", "Unknown Message", "Message not Supported", "Unknown Parameter (Set)", "Missing Parameter (Set)", "Parameter (Set) Repetition", "Range Violation", "State Violation", "Timeout", "Config Payload Mismatch", "Length Mismatch", "Input Buffer Full", "Internal Error", "Instance ID Mismatch"}
  T14 = cluster{"Element 1": "Confirmation States.gtype"[], "Value": u64[]}
  "MAC Stub RX Payload Information.gtype" = cluster{"RX Indication CRC OK": bool, "MPDU Disassembly Failed": bool, "Radio Frame Number": u16, "Reported WB SINR": f64, "DL error rate": f64}
  "DTP Send Status.gtype" = cluster{"send packet counter": u32, "network too slow counter": u32}
  "DTP Pending Data.gtype" = cluster{"expected size": u32, "payload": u8[]}
uses:
  AFW::LTE::RF Control::UE Host Initialization.gvi
  AFW::LTE::MAC::Read External MAC Output.gvi
  NI::G Core::Error::Display Error.gvi
  AFW::LTE::L1L2 API::Transport::Transport.gvi
  AFW::LTE::L1L2 API::Transport::Get Transport Session.gvi
  AFW::LTE::Utilities::Check Loop Stop Condition.gvi
  AFW::LTE::L1L2 API::Transport::Transport Read From Transport.gvi
  AFW::LTE::L1L2 API::PHY Receive Timing Indication.gvi
  AFW::LTE::Conversion::Check Subframe for Transmit.gvi
  AFW::LTE::MAC::MAC Prepare UL Tx Config.gvi
  AFW::LTE::Configuration::Receive Feedback Information.gvi
  AFW::LTE::L1L2 API::PHY TX Request Confirm Abstraction.gvi
  AFW::LTE::MAC::MAC Enque Requests.gvi
  AFW::LTE::L1L2 API::Transport::Transport Send To Transport.gvi
  AFW::LTE::Conversion::Remove Timed Loop Abort Error.gvi
  AFW::Common::Stop On Error.gvi
  AFW::LTE::PHY SAP::Receive Timing Indication RT.gvi
  AFW::Common::Timing Measurement::Get Time.gvi
  AFW::LTE::MAC::TTI Counter to SFN and TTI.gvi
  AFW::Common::Counters::Counter U16 Dominant Increment.gvi
  AFW::LTE::L1L2 API::Encode PHY SAP Timing Indication.gvi
  AFW::LTE::Configuration::Send Dynamic DL RX Configuration.gvi
  AFW::LTE::L1L2 API::PHY TX Request Confirm Handler.gvi
  AFW::LTE::Configuration::Send Dynamic UL Configuration.gvi
  AFW::LTE::PHY SAP::Send Dynamic UL Tx Payload.gvi
  NI::G Core::Error::Build Error Cluster.gvi
  AFW::Common::Timing Measurement::Get and Hold Maximum.gvi
  AFW::LTE::PHY SAP::Receice PDSCH Decoding Status.gvi
  AFW::LTE::Conversion::PDSCH Channel Decoder Status from U32.gvi
  AFW::LTE::PHY SAP::Receive PDSCH MAC PDU.gvi
  AFW::LTE::L1L2 API::Encode PHY SAP DL RX Indication.gvi
  NI::G Core::Error::Filter Error Code.gvi
  NI::G Core::Error::Is Error.gvi
  AFW::Common::Check Stop.gvi
  AFW::LTE::L1L2 API::Decode General Message Header.gvi
  AFW::LTE::L1L2 API::Handle DL TX Confirm.gvi
  AFW::LTE::L1L2 API::PHY Receive RX Indication.gvi
  AFW::LTE::MAC::MAC PDU Disassembly.gvi
  AFW::LTE::Utilities::Write Configuration to RT.gvi
  AFW::LTE::Utilities::Read Status from RT.gvi
  AFW::LTE::UDP Interface::Send UDP Data.gvi
  AFW::LTE::Configuration::Receive Timing Indication.gvi
  AFW::LTE::Conversion::Determine Configuration Trigger.gvi
  AFW::LTE::Configuration::Disable DL RX.gvi
  AFW::LTE::Configuration::Setup DL RX Baseband.gvi
  AFW::LTE::RF Control::Setup RX.gvi
  AFW::LTE::Configuration::Disable UL TX.gvi
  AFW::LTE::Configuration::Setup UL TX Baseband.gvi
  AFW::LTE::RF Control::Setup TX.gvi
  AFW::LTE::Configuration::Setup UL TX Set Active.gvi
  AFW::Common::Create Stop.gvi
  AFW::LTE::Utilities::Trigger Stop Timed Loops.gvi
  AFW::LTE::Conversion::Read PDSCH Decoder Status.gvi
  AFW::LTE::Conversion::Get ADC and IFFT Status.gvi
  AFW::LTE::Conversion::Read DL BB Power and sync status.gvi
  AFW::LTE::Conversion::Read TX BB Power.gvi
  AFW::LTE::RF Control::Calculate Power Calibration Offset.gvi
  AFW::LTE::RF Control::Control Power Gain.gvi
  AFW::LTE::RF Control::Apply AGC Output.gvi
  AFW::LTE::Conversion::Read TX Data.gvi
  AFW::LTE::Conversion::Calculate TX Power Spectrum.gvi
  AFW::LTE::Conversion::Read RX Data.gvi
  AFW::LTE::Conversion::Calculate RX Power Spectrum.gvi
  AFW::LTE::Conversion::Read PDCCH Data.gvi
  AFW::LTE::Conversion::Read Constellation Data.gvi
  AFW::LTE::Conversion::Read Channel Estimates.gvi
  AFW::LTE::Conversion::Calculate DL Throughput and BLER.gvi
  AFW::LTE::Configuration::Compute Feedback Information.gvi
  AFW::LTE::Configuration::Send Feedback Information.gvi
  AFW::LTE::RF Control::UE Host Cleanup.gvi
  AFW::LTE::Conversion::LTE Generate Error Report.gvi
diagram:
  sequence {
    frame 0 {
      # Set Controls to default values
      $"UE Transmitter" <- FALSE
      $"UE Receiver" <- FALSE
      $"FPGA Ready" <- FALSE
      $"UE RX Active" <- FALSE
      $"UE TX Active" <- FALSE
      $"TX starting" <- FALSE
      $"Sync Found" <- FALSE
      $"PDSCH Constellation" <- c128[] []
      $"PDCCH Constellation" <- c128[] []
      Build Array(f64[] [], f64[] [], f64[] []) -> w1
      $"DL throughput" <- w1
      $"UE Failure / Block Error Rate (BLER)" <- w1
      $"channel estimation" <- w1
      $"UE RX Power Spectrum" <- T1 {all zero or empty}
      $"UE TX Power Spectrum" <- T1 {all zero or empty}
      $"UE Coerced Max RF TX Power" <- 0
      $"UE Coerced Gain" <- 0
      $"Wideband SINR" <- 0
      $"DL throughput (current)" <- 0
      $"Subband SINR [dB]" <- f64[] []
      $"PDCCH Received DCI Message" <- "DCI Message.gtype"[] []
      $"Error Report" <- ""
    }
  }
  sequence {
    frame 0 {
      w2 = $Arguments
      w3 = $Command
      w4 = $"External MAC"
      w5 = $session
      w6 = $"RIO Device"
      w7 = $"Reference Clock Source"
      w8 = $"Transport Instance ID"
    }
  }
  call "UE Host Initialization.gvi"(reference clock source=w7, transport instance id=w8, session in=w5, USRP device=w6, error in=no error, external MAC=w4, command=w3, arguments=w2) -> (session out=w9, device bandwidth=w10, error out=w11)
  call "Read External MAC Output.gvi"(session=w9, error in=w11, full log=TRUE) -> (session dup=w12, external MAC log output=w13, error out=w14)
  sequence {
    frame 0 {
      $session <- w12
      call "Display Error.gvi"(type of dialog="continue or stop message", error in=w14)
    }
  }
  disable {
    frame TARGET_TYPE == "RT", Default {
      # Transport layer moves packets from L1 to MAC Stub implementation or external MAC
      call "Transport.gvi"(session=w12, error in=w14) -> (error out=w16)
      call "Get Transport Session.gvi"(Session=w12, Transport Session Select="Transport PHY Timing to MAC") -> (Session dup=w17, LTE Transport Session=w18)
      Property Node(instance in=w18) -> ("transport out timing source name"=w19)
      w20 = 100  # priority in
      timed loop {
        # MAC Stub: handle TX messages
        Left Execution System Border Node(priority_in=w20)
        Left Timing Source Border Node[AlarmName=L, DefaultTimingSourceName="1 MHz", DefaultTimingSourceType=2](mode_in="Process missed periods, ignore original phase", period_in=1, source_in=w19, structure_in="MAC Stub Tx")
        call "Get Transport Session.gvi"(Session=w17, Transport Session Select="Transport PHY Timing to MAC") -> (Session dup=w21, LTE Transport Session=w22)
        Left Timing Error Border Node(error_in=w14) -> (error_out=w23)
        call "Check Loop Stop Condition.gvi"(session in=w17, error in=w23) -> (stop execution=w24, error out=w25)
        Property Node(instance in=w17) -> ("RT Loop Interfaces:MAC Stub TX Interface:MAC Stub TX Input Terminals FIFO"=w26)
        RTFIFO Read(error in=w25, rt fifo=w26, timeout in ms=0) -> (element out=w27, error out=w28)
        Property Node(instance in=w27) -> ("TX Frame Structure"=w29)
        Not(x=w24) -> w30
        call "Transport Read From Transport.gvi"(API transport session=w22, allow read fail=w30, error in=w28) -> (transport out=w31, transport read success=w32, error out=w33)
        case (w32) {
          frame False {
            w34 = w33
          }
          frame True {
            call "PHY Receive Timing Indication.gvi"(api transport in=w31, error in=w33) -> (SFN=w35, TTI index=w36, error out=w37)
            call "Check Subframe for Transmit.gvi"(frame structure=w29, subframe index=w36, UL TX=TRUE, error in=w37) -> (allow UL transmit=w38, error out=w39)
            case (w38) {
              frame False, Default {
                w34 = w39
              }
              frame True {
                call "MAC Prepare UL Tx Config.gvi"(SFN=w35, TTI index=w36) -> (MAC TX Config=w40)
                call "Receive Feedback Information.gvi"(session=w21, error in=w39) -> (feedback info=w41, error out=w42)
                Array Size(array=w41) -> (size(s)=w43)
                Is Greater Than 0(x=w43) -> w44
                case (w44) {
                  frame False, Default {
                    w34 = w42
                  }
                  frame True {
                    To Unsigned 32 Bit Integer(number=w43) -> w45
                    call "PHY TX Request Confirm Abstraction.gvi"(MAC TX Config=w40, MAC PDU=w41, MAC PDU Size=w45, error in=w42, Device Location="UE") -> (api transport out=w46, requests=w47, error out=w48)
                    Property Node(instance in=w21) -> ("Request information FIFO"=w49, instance out=w50)
                    call "MAC Enque Requests.gvi"(RT FIFO reference=w49, requests=w47, error in=w48) -> (error out=w51)
                    call "Get Transport Session.gvi"(Session=w50, Transport Session Select="Transport MAC to PHY") -> (LTE Transport Session=w52)
                    call "Transport Send To Transport.gvi"(API transport session=w52, transport in=w46, error in=w51) -> (error out=w34)
                  }
                }
              }
            }
          }
        }
        Right Timing Error Border Node(error_in=w34) -> (error_out=w53)
        Left Timing Statistics Border Node() -> (wakeupreason_out=w54)
        stop if w24
      }
      call "Remove Timed Loop Abort Error.gvi"(error in=w53, wake up reason=w54) -> (error out=w55)
      call "Stop On Error.gvi"(error in=w55, error source prefix="MAC Stub Tx") -> (error out=w56)
      w57 = 100  # priority in
      Property Node(instance in=w12) -> ("timed loop period"=w58)
      timed loop {
        Left Execution System Border Node(priority_in=w57)
        # handle TTI timing indication every 1ms
        Left Timing Statistics Border Node()
        Left Timing Error Border Node(error_in=w14) -> (error_out=w59)
        call "Check Loop Stop Condition.gvi"(session in=w12, error in=w59) -> (stop execution=w60, error out=w61)
        call "Receive Timing Indication RT.gvi"(session=w12, eNB TX Active=$"UE TX Active", error in=w61) -> (subframe index=w62, subframe index valid=w63, error out=w64)
        case (w63) {
          frame False {
            w65 = w64
            w66 = w63
            w67 = w12
          }
          frame True, Default {
            call "Get Time.gvi"(error in_2=w64) -> (tick count (us)=w68, error out_2=w69)
            call "TTI Counter to SFN and TTI.gvi"(TTI counter=w62, error in=w69) -> (SFN=w70, TTI=w71, error out=w72)
            call "Counter U16 Dominant Increment.gvi"() -> (count out=w73)
            call "Encode PHY SAP Timing Indication.gvi"(reference ID=w73, SFN=w70, TTI index=w71, error in=w72) -> (encoded PHY SAP Timing Indication=w74, error out=w75)
            call "Get Transport Session.gvi"(Session=w12, Transport Session Select="Transport PHY Timing to MAC") -> (Session dup=w67, LTE Transport Session=w76)
            call "Transport Send To Transport.gvi"(API transport session=w76, transport in=w74, error in=w75) -> (error out=w65)
            $SFN <- w70
            $TTI <- w71
            $"PHY Timing Indication Received" <- w68
            w66 = w63
          }
        }
        Logical And(w66, $"UE RX Active") -> w77
        case (w77) {
          frame False, Default {
            w78 = w65
          }
          frame True {
            call "Send Dynamic DL RX Configuration.gvi"(session=w67, UE context=$"UE RX UE Context", error in=w65) -> (error out=w78)
          }
        }
        Right Timing Error Border Node(error_in=w78) -> (error_out=w79)
        Left Timing Source Border Node[AlarmName=L, DefaultTimingSourceName="1 MHz", DefaultTimingSourceType=2](mode_in="Discard missed periods, ignore original phase", period_in=w58, structure_in="PHY SAP Tim")
        stop if w60
      }
      call "Stop On Error.gvi"(error in=w79, error source prefix="PHY SAP Tim") -> (error out=w80)
      call "Get Transport Session.gvi"(Session=w12, Transport Session Select="Transport MAC to PHY") -> (Session dup=w81, LTE Transport Session=w82)
      Property Node(instance in=w82) -> ("transport out timing source name"=w83)
      w84 = 99  # priority in
      timed loop {
        # handover Tx Req to FPGA
        Left Execution System Border Node(priority_in=w84)
        Left Timing Statistics Border Node()
        call "Get Transport Session.gvi"(Session=w81, Transport Session Select="Transport MAC to PHY") -> (Session dup=w85, LTE Transport Session=w86)
        Left Timing Error Border Node(error_in=w14) -> (error_out=w87)
        call "Check Loop Stop Condition.gvi"(session in=w81, error in=w87) -> (stop execution=w88, error out=w89)
        Not(x=w88) -> w90
        call "Transport Read From Transport.gvi"(API transport session=w86, allow read fail=w90, error in=w89) -> (transport out=w91, transport read success=w92, error out=w93)
        call "Get Time.gvi"(error in=w93) -> (error out=w94, tick count (us)=w95)
        Subtract(x=w95, y=$"PHY Timing Indication Received") -> w96
        w97 = 700  # maximal allowed TX processing time [us]
        # reserve time buffer to transmit TX data to FPGA
        Is Greater(x=w96, y=w97) -> w98
        case (w92) {
          frame True {
            call "PHY TX Request Confirm Handler.gvi"(TX request too late=w98, api transport in=w91, Expected SFN=$SFN, Expected TTI index=$TTI, Expected Device Location="UE", error in=w94, frame structure=$"UE TX Frame Structure", use UERS=FALSE, UE TX DCI=$"UE TX DCI") -> (output valid=w101, api transport out=w102, TX Data=w103, error out=w104)
            Logical And(w101, $"UE TX Active") -> w100
            case (w100) {
              frame False, Default {
                w105 = w104
                w106 = w85
              }
              frame True {
                call "Send Dynamic UL Configuration.gvi"(session=w85, UE context=$"UE TX UE Context", DCI=$"UE TX DCI", error in=w104, scope="TX") -> (session dup=w107, error out=w108)
                call "Send Dynamic UL Tx Payload.gvi"(session in=w107, TX data=w103, error in=w108) -> (session out=w106, error out=w105)
              }
            }
            Array Size(array=w102) -> (size(s)=w109)
            Is Greater Than 0(x=w109) -> w110
            case (w110) {
              frame False, Default {
                call "Build Error Cluster.gvi"(code=-1, description="Confirmation message response is empty.", error in=w105) -> (error out=w99)
              }
              frame True {
                call "Get Transport Session.gvi"(Session=w106, Transport Session Select="Transport PHY to MAC") -> (LTE Transport Session=w111)
                call "Transport Send To Transport.gvi"(API transport session=w111, transport in=w102, error in=w105) -> (error out=w99)
              }
            }
          }
          frame False {
            w99 = w94
            w100 = w92
          }
        }
        call "Get Time.gvi"(error in=w99) -> (error out=w112, tick count (us)=w113)
        Right Timing Error Border Node(error_in=w112) -> (error_out=w114)
        case (w100) {
          frame True {
            Subtract(x=w113, y=$"PHY Timing Indication Received") -> w115
            call "Get and Hold Maximum.gvi"(value=w115) -> (max value=w116)
            $"MAC TX Total Delay" <- w116
          }
          frame False { }
        }
        Left Timing Source Border Node[AlarmName=L, DefaultTimingSourceName="1 MHz", DefaultTimingSourceType=2](mode_in="Process missed periods, ignore original phase", period_in=1, source_in=w83, structure_in="PHY SAP Tx")
        stop if w88
      }
      call "Stop On Error.gvi"(error in=w114, error source prefix="PHY SAP Tx") -> (error out=w117)
      Property Node(instance in=w12) -> ("timed loop period"=w118)
      w119 = 98  # priority in
      timed loop {
        Left Execution System Border Node(priority_in=w119)
        Left Timing Statistics Border Node()
        Left Timing Error Border Node(error_in=w14) -> (error_out=w120)
        call "Check Loop Stop Condition.gvi"(session in=w12, error in=w120) -> (stop execution=w121, error out=w122)
        call "Receice PDSCH Decoding Status.gvi"(session=w12, error in=w122) -> (PDSCH Decoding Status=w123, PDSCH Decoding Status valid=w124, error out=w125)
        case (w124) {
          frame False, Default {
            w126 = w125
          }
          frame True {
            Property Node(instance in=w12) -> ("DL PDSCH status FIFO"=w127, "PDSCH user data throughput FIFO"=w128, instance out=w129)
            call "PDSCH Channel Decoder Status from U32.gvi"(bit vector in=w123) -> (PDSCH decoder status=w130)
            Property Node(instance in=w130) -> ("user data"=w131, "transport block size"=w132, "CRC ok"=w133)
            RTFIFO Write(element=w130, error in=w125, rt fifo=w128) -> (error out=w134)
            Property Node(instance in=w130) -> ("CRC ok"=w135, "user data"=w136)
            w137 = cluster{"CRC ok": bool, "subframe number": u32} {all zero or empty}
            Property Node(instance in=w137, "CRC ok"=w135, "subframe number"=w136) -> (instance out=w138)
            RTFIFO Write(element=w138, error in=w134, rt fifo=w127) -> (error out=w139)
            call "Receive PDSCH MAC PDU.gvi"(session=w129, transport block size=w132, error in=w139) -> (MAC PDU=w140, error out=w141)
            call "Get Transport Session.gvi"(Session=w129, Transport Session Select="Transport PHY to MAC") -> (LTE Transport Session=w142)
            Property Node(instance in=$"UE RX UE Context") -> ("RNTI"=w143)
            To Unsigned 8 Bit Integer(number=w131) -> w144
            call "Counter U16 Dominant Increment.gvi"() -> (count out=w145)
            Boolean To 0 Or 1(Boolean=w133) -> (0, 1=w146)
            To Unsigned 8 Bit Integer(number=w146) -> w147
            Array Size(array=w140) -> (size(s)=w148)
            To Unsigned 32 Bit Integer(number=w148) -> w149
            call "Encode PHY SAP DL RX Indication.gvi"(reference ID=w145, SFN=0, TTI index=w144, MAC PDU=w140, MAC PDU Size=w149, RNTI=w143, CRC Result=w147) -> (encoded UL RX Indication=w150)
            call "Transport Send To Transport.gvi"(API transport session=w142, transport in=w150, error in=w141) -> (error out=w126)
          }
        }
        Right Timing Error Border Node(error_in=w126) -> (error_out=w151)
        Left Timing Source Border Node[AlarmName=L, DefaultTimingSourceName="1 MHz", DefaultTimingSourceType=2](mode_in="Discard missed periods, ignore original phase", period_in=w118, structure_in="PHY SAP Rx")
        stop if w121
      }
      call "Stop On Error.gvi"(error in=w151, error source prefix="PHY SAP Rx") -> (error out=w152)
      s1 = w14  # shift register
      while {
        Wait(time to wait=1)
        Property Node(instance in=$session) -> ("UDP RX session"=w153, "UDP RX inbound FIFO"=w154)
        s2 = s1  # shift register
        while {
          RTFIFO Read(error in=s2, rt fifo=w154, timeout in ms=0) -> (element out=w157, empty?=w158, error out=w159)
          Array Size(array=w157) -> (size(s)=w160)
          case (w158) {
            frame True {
              w161 = w159
              w162 = default
            }
            frame False {
              Udp Write Binary(address=$"Transmit IP Address", connection ID=w153, data in=w157, error in=w159, port or service name=$"UDP Transmit Port", timeout ms=0) -> (error out=w163)
              w164 = 55  # UDP timeout
              call "Filter Error Code.gvi"(error in=w163, code to clear=w164) -> (error out=w161, error cleared?=w162)
            }
          }
          call "Is Error.gvi"(error in=w161) -> (error?=w165)
          Logical Or(w165, w158) -> w166
          append w162 to w155
          append w160 to w156
          next s2 = w161
          stop if w166
        }
        Add Array Elements(numeric array=w156) -> (sum=w167)
        Scale By Power Of 2(n=3, x=w167) -> w168
        Is Greater Than 0(x=w168) -> w169
        $"Data Transfer Out" <- w169
        Or Array Elements(Boolean array=w155) -> (logical OR=w170)
        $"Packet Loss Out" <- w170
        call "Check Stop.gvi"(error in=s2) -> (error out=w171, stop=w172)
        next s1 = w171
        stop if w172
      }
      call "Stop On Error.gvi"(error in=s1) -> (error out=w173)
      call "Get Transport Session.gvi"(Session=w12, Transport Session Select="Transport PHY to MAC") -> (Session dup=w174, LTE Transport Session=w175)
      w176 = 98  # priority in
      Property Node(instance in=w175) -> ("transport out timing source name"=w177)
      timed loop {
        Left Execution System Border Node(priority_in=w176)
        Left Timing Source Border Node[AlarmName=L, DefaultTimingSourceName="1 MHz", DefaultTimingSourceType=2](mode_in="Process missed periods, ignore original phase", period_in=1, source_in=w177, structure_in="MAC Stub Rx")
        call "Get Transport Session.gvi"(Session=w174, Transport Session Select="Transport PHY to MAC") -> (Session dup=w178, LTE Transport Session=w179)
        Left Timing Error Border Node(error_in=w14) -> (error_out=w180)
        call "Check Loop Stop Condition.gvi"(session in=w174, error in=w180) -> (stop execution=w181, error out=w182)
        Not(x=w181) -> w183
        call "Transport Read From Transport.gvi"(API transport session=w179, allow read fail=w183, error in=w182) -> (transport out=w184, transport read success=w185, error out=w186)
        # MAC Stub: handle RX messages
        case (w185) {
          frame False {
            w187 = w186
          }
          frame True {
            call "Decode General Message Header.gvi"(message data in=w184, error in=w186) -> (decoded general message header=w188, error out=w189)
            Property Node(instance in=w178) -> ("RT Loop Interfaces:MAC Stub RX Interface"=w190, instance out=w191)
            Property Node(instance in=w188) -> ("message type ID"=w192)
            case (w192) {
              frame 0, Default {
                call "Build Error Cluster.gvi"(code=-1, description="MAC Stub Rx: unexpected API message", error in=w189) -> (error out=w187)
              }
              frame 16898 {
                # PHY_CNF
                Property Node(instance in=w190) -> ("MAC Stub RX Confirmation Information FIFO"=w193)
                Property Node(instance in=w191) -> ("Request information FIFO"=w194)
                call "Handle DL TX Confirm.gvi"(RT FIFO reference=w194, api transport in=w184, clear confirmation errors=TRUE, error in=w189) -> (confirm received counts=w195, negative confirm received count=w196, confirmation evaluation error count=w197, error out=w198)
                Property Node(instance in=w195) -> ("Value"=w199)
                To Unsigned 64 Bit Integer(number=w197) -> w200
                Build Array(w199, w196, w200) -> w201
                Type Cast(type=u64[16] default, x=w201) -> w202
                RTFIFO Write(element=w202, error in=w198, overwrite on timeout=TRUE, rt fifo=w193, timeout in ms=0) -> (error out=w187)
              }
              frame 18433 {
                call "PHY Receive RX Indication.gvi"(api transport in=w184, expected device location="UE", error in=w189) -> (MAC RX Config=w203, MAC PDU=w204, error out=w205)
                # PHY_DLSCH_RX_IND
                Property Node(instance in=w203) -> ("CRC Result"=w206)
                Is Greater Than 0(x=w206) -> w207
                case (w207) {
                  frame False, Default {
                    w208 = w205
                    w209 = FALSE
                  }
                  frame True {
                    Property Node(instance in=w191) -> ("UDP RX inbound FIFO"=w210, instance out=w211)
                    call "MAC PDU Disassembly.gvi"(MAC PDU=w204, error in=w205, FIFO in=w210) -> (bytes=w212, error out=w213)
                    call "Filter Error Code.gvi"(code to clear=-1, error in=w213) -> (error cleared?=w209, error out=w214)
                    case (w209) {
                      frame True {
                        w208 = w214
                      }
                      frame False {
                        Property Node(instance in=w211) -> ("PDSCH user data FIFO"=w215)
                        To Unsigned 32 Bit Integer(number=w212) -> w216
                        Scale By Power Of 2(n=3, x=w216) -> w217
                        RTFIFO Write(element=w217, error in=w214, rt fifo=w215) -> (error out=w208)
                      }
                    }
                  }
                }
                Property Node(instance in=w190) -> ("MAC Stub RX Payload Information FIFO"=w218)
                Property Node(instance in="MAC Stub RX Payload Information.gtype" {all zero or empty}, "RX Indication CRC OK"=w207, "MPDU Disassembly Failed"=w209) -> (instance out=w219)
                RTFIFO Write(element=w219, error in=w189, overwrite on timeout=TRUE, rt fifo=w218, timeout in ms=0) -> (error out=w220)
                Merge Errors(w208, w220) -> (error out=w187)
              }
            }
          }
        }
        Right Timing Error Border Node(error_in=w187) -> (error_out=w221)
        Left Timing Statistics Border Node() -> (wakeupreason_out=w222)
        stop if w181
      }
      call "Remove Timed Loop Abort Error.gvi"(error in=w221, wake up reason=w222) -> (error out=w223)
      call "Stop On Error.gvi"(error in=w223, error source prefix="MAC Stub Rx") -> (error out=w224)
      s3 = w14  # shift register
      while {
        Wait Until Next Multiple(multiple to wait=100)
        call "Write Configuration to RT.gvi"(session in=w12, eNB TX frame structure=$"UE TX Frame Structure", error in=s3) -> (session dup=w225, error out=w226)
        call "Read Status from RT.gvi"(session in=w225, error in=w226) -> (negatives=w227, evaluation errors=w228, received confirmations=w229, error out=w230, DL RX indication CRC OK=w231, MPDU disassembly failed=w232)
        $"DL RX Indication CRC OK" <- w231
        $"MPDU Disassembly Failed" <- w232
        $Negatives <- w227
        $"Evaluation Errors" <- w228
        call "Check Stop.gvi"(error in=w230) -> (stop=w233, error out=w234)
        $"Received Confirmations" <- w229
        next s3 = w234
        stop if w233
      }
      call "Stop On Error.gvi"(error in=s3) -> (error out=w235)
      Build Array(w56, w224, w16, w80, w117, w152, w173, w235) -> w15
    }
    frame TARGET_TYPE != "RT" {
      s4 = w14  # shift register
      s5 = "DTP Send Status.gtype" {all zero or empty}  # shift register
      s6 = "DTP Pending Data.gtype" {all zero or empty}  # shift register
      while {
        # receive UDP data from network and send it to the FPGA as PDSCH payload data of the transmitter
        # read received PDSCH payload data from FPGA and send it to the specified UDP port
        Wait Until Next Multiple(multiple to wait=1)
        call "Send UDP Data.gvi"(pending data in=s6, session=$session, enable MAC RX=TRUE, UDP send status in=s5, error in=s4, transmit IP address=$"Transmit IP Address", transmit port=$"UDP Transmit Port") -> (pending data out=w236, transferring data=w237, network too slow=w238, UDP send status out=w239, error out=w240)
        $"Data Transfer Out" <- w237
        # 5
        call "Check Stop.gvi"(error in=w240) -> (error out=w241, stop=w242)
        $"Packet Loss Out" <- w238
        next s4 = w241
        next s5 = w239
        next s6 = w236
        stop if w242
      }
      call "Stop On Error.gvi"(error in=s4) -> (error out=w243)
      s7 = w14  # shift register
      while {
        # send dynamic parameters to FPGA
        case ($"UE TX Active") {
          frame False, Default {
            Wait(time to wait=10)
            w244 = s7
            w245 = TRUE
          }
          frame True {
            call "Receive Timing Indication.gvi"(session=$session, error in=s7) -> (session dup=w246, new timing indication=w245, error out=w247)
            case (w245) {
              frame False, Default {
                w244 = w247
              }
              frame True {
                call "Send Dynamic UL Configuration.gvi"(session=w246, UE context=$"UE TX UE Context", DCI=$"UE TX DCI", error in=w247, scope="TX") -> (error out=w244)
              }
            }
          }
        }
        Logical And(w245, $"UE RX Active") -> w248
        case (w248) {
          frame False, Default {
            w249 = w244
          }
          frame True {
            call "Send Dynamic DL RX Configuration.gvi"(session=$session, UE context=$"UE RX UE Context", error in=w244) -> (error out=w249)
          }
        }
        # 5
        call "Check Stop.gvi"(error in=w249) -> (error out=w250, stop=w251)
        next s7 = w250
        stop if w251
      }
      call "Stop On Error.gvi"(error in=s7) -> (error out=w252)
      Build Array(w243, w252) -> w15
    }
  }
  s8 = w14  # shift register
  while {
    Wait Until Next Multiple(multiple to wait=100)
    case (s8) {
      frame Error {
        w253 = s8
      }
      frame No Error {
        $"FPGA Ready" <- TRUE
        w253 = s8
      }
    }
    call "Determine Configuration Trigger.gvi"(RX enabled=$"UE Receiver", TX enabled=$"UE Transmitter") -> (trigger RX configuration=w254, trigger TX configuration=w255)
    # configure UE RX/TX baseband and RF when enabled
    # 1
    case (w254) {
      frame False, Default {
        w256 = w253
      }
      frame True {
        case ($"UE Receiver") {
          frame False, Default {
            call "Disable DL RX.gvi"(session=$session, error in=w253) -> (error out=w256)
            sequence {
              frame 0 {
                $"UE RX Active" <- FALSE
              }
            }
          }
          frame True {
            Property Node(instance in=$session) -> ("real time mode"=w257)
            call "Setup DL RX Baseband.gvi"(UE context=$"UE RX UE Context", session in=$session, frame structure=$"UE RX Frame Structure", cell ID=$"UE RX Cell ID", error in=w253, real time mode=w257) -> (session dup=w258, error out=w259)
            call "Setup RX.gvi"(session in=w258, RX frequency [Hz]=$"UE RX Frequency", gain value [dB]=$"UE Coerced Gain", error in=w259, RX port=$"UE RX RF Port (USRP)") -> (session out=w260, coerced gain [dB]=w261, coerced frequency [Hz]=w262, error out=w263)
            $session <- w260
            $"UE Coerced Gain" <- w261
            $"UE RX Frequency" <- w262
            case (w263) {
              frame Error {
                $"UE Receiver" <- FALSE
                w256 = w263
              }
              frame No Error {
                $"UE RX Active" <- TRUE
                disable {
                  frame TARGET_TYPE == "RT", Default {
                    # For RT, TX triggers RX configuration
                    $"UE Transmitter" <- TRUE
                  }
                  frame TARGET_TYPE != "RT" { }
                }
                w256 = w263
              }
            }
          }
        }
      }
    }
    case (w255) {
      frame False, Default {
        w264 = w253
      }
      frame True {
        case ($"UE Transmitter") {
          frame False, Default {
            sequence {
              frame 0 {
                $"UE TX Active" <- FALSE
              }
              frame 1 {
                Wait(time to wait=10)
              }
            }
            call "Disable UL TX.gvi"(session=$session, error in=w253) -> (error out=w265)
            disable {
              frame TARGET_TYPE == "RT", Default {
                # For RT, disable also RX configuration
                $"UE Receiver" <- FALSE
                w264 = w265
              }
              frame TARGET_TYPE != "RT" {
                w264 = w265
              }
            }
          }
          frame True {
            case (w253) {
              frame Error {
                w266 = w253
              }
              frame No Error {
                $"TX starting" <- TRUE
                w266 = w253
              }
            }
            Property Node(instance in=$session) -> ("real time mode"=w267)
            call "Setup UL TX Baseband.gvi"(DL frequency [Hz]=$"UE RX Frequency", UL frequency [Hz]=$"UE TX Frequency", session in=$session, frame structure=$"UE TX Frame Structure", cell ID=$"UE TX Cell ID", error in=w266, DCI=$"UE TX DCI", UE Context=$"UE TX UE Context", real time mode=w267) -> (session dup=w268, error out=w269)
            call "Setup TX.gvi"(timing advance=$"Timing Advance [samples]", session in=w268, TX frequency [Hz]=$"UE TX Frequency", TX power level [dB]=$"UE Max RF TX Power", error in=w269, TX port=$"UE TX RF Port (USRP)") -> (coerced power level setting [dB]=w270, session dup=w271, coerced output power [dB]=w272, coerced frequency [Hz]=w273, error out=w274)
            $"UE Coerced Max RF TX Power" <- w272
            case (w274) {
              frame No Error, Default {
                $"UE TX Active" <- TRUE
                $"TX starting" <- FALSE
                call "Setup UL TX Set Active.gvi"(session in=w271, error in=w274) -> (error out=w264)
              }
              frame Error {
                $"UE Transmitter" <- FALSE
                $"TX starting" <- FALSE
                w264 = w274
              }
            }
            $"UE TX Frequency" <- w273
            $"UE Max RF TX Power" <- w270
          }
        }
      }
    }
    Merge Errors(w256, w264) -> (error out=w275)
    call "Create Stop.gvi"(error in=w275, stop in=$stop) -> (error out=w276)
    # synchronize the exit condition across all loops of the host application
    call "Check Stop.gvi"(error in=w276) -> (error out=w277, stop=w278)
    case (w278) {
      frame False, Default {
        w279 = w277
      }
      frame True {
        call "Trigger Stop Timed Loops.gvi"(Session=$session, error in=w277) -> (error out=w279)
        # Disable TX and RX to
        # ensure proper shutdown
        $"UE Receiver" <- FALSE
        $"UE Transmitter" <- FALSE
      }
    }
    Feedback Node[DelayCount=3](input=w278) -> w280
    next s8 = w279
    stop if w280
  }
  call "Stop On Error.gvi"(error in=s8) -> (error out=w281)
  s9 = w14  # shift register
  while (iteration -> i1) {
    Wait Until Next Multiple(multiple to wait=50)
    disable {
      frame TARGET_TYPE == "RT", Default {
        w282 = $session
        w283 = s9
      }
      frame TARGET_TYPE != "RT" {
        call "Read PDSCH Decoder Status.gvi"(session in=$session, error in=s9) -> (session dup=w282, error out=w283)
      }
    }
    call "Get ADC and IFFT Status.gvi"(session in=w282, error in=w283) -> (RX DDC values clipped=w284, TX IFFT output clipped=w285, session dup=w286, ADC values clipped=w287, error out=w288)
    call "Read DL BB Power and sync status.gvi"(session in=w286, error in=w288) -> (signal detected?=w289, DL frequency offset [Hz]=w290, session dup=w291, RX baseband input power=w292, error out=w293)
    call "Read TX BB Power.gvi"(session in=w291, TX reference level [dBm]=$"UE Coerced Max RF TX Power", error in=w293) -> (session dup=w294, TX power [dBm]=w295, TX baseband power [dBFS]=w296, error out=w297)
    call "Calculate Power Calibration Offset.gvi"(session in=w294, error in=w297, frequency [Hz]=$"UE RX Frequency") -> (session dup=w298, power calibration offset [dB]=w299, error out=w300)
    $"power calibration offset [dB]" <- w299
    Not(x=$"UE AGC") -> w301
    call "Control Power Gain.gvi"(expected signal range lower bound=-17, use manual gain=w301, BB input power=w292, gain in=$"UE Coerced Gain", manual gain value [dB]=$"UE Manual Gain", expected signal range upper bound=-15, power calibration offset [dB]=w299) -> (RF input power [dBm]=w302, power [dBFS]=w303, gain out=w304)
    # read sync status and baseband power levels from FPGA and feed them into automatic gain control (AGC)
    # use manual gain value if AGC is disabled
    # configure frequency offset on FPGA
    # read PDSCH decoder status
    Logical And($"UE Receiver", $"UE RX Active", not $"TX starting") -> w305
    # 2
    case (w305) {
      frame False, Default {
        w306 = w300
      }
      frame True {
        call "Apply AGC Output.gvi"(session=w298, apply values=w305, AGC output=w304, error in=w300) -> (coerced gain [dB]=w307, error out=w306)
        $"UE Coerced Gain" <- w307
      }
    }
    call "Check Stop.gvi"(error in=w306) -> (error out=w308, stop=w309)
    $"UE RF TX Power" <- w295
    $"UE Baseband TX Power" <- w296
    $"UE Baseband RX Power" <- w303
    $"UE RF RX Power" <- w302
    $"UE Frequency Offset" <- w290
    $"Sync Found" <- w289
    $"UE ADC Values Clipped" <- w287
    $"UE TX IFFT Output Clipped" <- w285
    To Unsigned 32 Bit Integer(number=i1) -> w310
    Quotient And Remainder(x=w310, y=10) -> (x-y*floor(x/y)=w311)
    Is Equal To 0(x=w311) -> w312
    Logical Or(w284, w312) -> w313
    Feedback Node(enable?=w313, input=w284) -> w314
    Feedback Node(enable?=w312, input=w314) -> w315
    $"UE DDC Values Clipped" <- w315
    next s9 = w308
    stop if w309
  }
  call "Stop On Error.gvi"(error in=s9) -> (error out=w316)
  s10 = w14  # shift register
  while (iteration -> i2) {
    Wait Until Next Multiple(multiple to wait=20)
    Quotient And Remainder(x=i2, y=5) -> (x-y*floor(x/y)=w317)
    # read RX/TX baseband data values and PDCCH/PDSCH constellation data from FPGA and draw corresponding diagrams
    # 3
    case (w317) {
      frame 0, Default {
        call "Read TX Data.gvi"(session=$session, error in=s10) -> (TX baseband data=w319, error out=w320)
        call "Calculate TX Power Spectrum.gvi"(TX data=w319, error in=w320, coerced gain [dB]=$"UE Coerced Max RF TX Power") -> (TX power spectrum=w321, error out=w318)
        $"UE TX Power Spectrum" <- w321
      }
      frame 1 {
        call "Read RX Data.gvi"(session=$session, error in=s10) -> (RX data=w322, error out=w323)
        call "Calculate RX Power Spectrum.gvi"(RX data=w322, coerced gain [dB]=$"UE Coerced Gain", error in=w323, power calibration offset [dB]=$"power calibration offset [dB]") -> (RX power spectrum=w324, error out=w318)
        $"UE RX Power Spectrum" <- w324
      }
      frame 2 {
        call "Read PDCCH Data.gvi"(session in=$session, error in=s10) -> (DCI messages=w325, error out=w326)
        $"PDCCH Received DCI Message" <- w325
        case ($"External MAC") {
          frame False, Default {
            w327 = s10
          }
          frame True {
            call "Read External MAC Output.gvi"(session=$session, error in=s10, full log=FALSE) -> (external MAC log output=w328, error out=w327)
            $"External MAC Output" <- w328
          }
        }
        Merge Errors(w326, w327) -> (error out=w318)
      }
      frame 3 {
        call "Read Constellation Data.gvi"(session=$session, symbol number for display=$"symbol number for PDSCH constellation", error in=s10, RX tab=$Tab) -> (display data out=w329, constellation data=w330, displayed constellation=w331, error out=w318)
        case (w329) {
          frame False, Default { }
          frame True {
            case (w331) {
              frame "DL EQ Output", Default {
                $"PDCCH Constellation" <- w330
              }
              frame "PDSCH Dec Input" {
                $"PDSCH Constellation" <- w330
              }
            }
          }
        }
      }
      frame 4 {
        call "Read Channel Estimates.gvi"(session=$session, UE Context=$"UE RX UE Context", error in=s10) -> (channel estimation=w332, subband SNR [dB]=w333, wideband SNR [dB]=w334, error out=w318)
        $"channel estimation" <- w332
        $"Subband SINR [dB]" <- w333
        $"Wideband SINR" <- w334
      }
    }
    call "Check Stop.gvi"(error in=w318) -> (error out=w335, stop=w336)
    next s10 = w335
    stop if w336
  }
  sequence {
    frame 0 {
      call "Read External MAC Output.gvi"(session=$session, error in=s10, full log=TRUE) -> (external MAC log output=w337, error out=w338)
      $"External MAC Output" <- w337
    }
  }
  call "Stop On Error.gvi"(error in=w338) -> (error out=w339)
  s11 = 0  # shift register
  s12 = w14  # shift register
  s13 = f64[] []  # shift register
  while {
    Wait Until Next Multiple(multiple to wait=1000)
    # compute throughput and block error rate and draw corresponding diagrams
    Tick Count() -> (timer value=w340)
    Subtract(x=w340, y=s11) -> w341
    call "Calculate DL Throughput and BLER.gvi"(session=$session, time difference=w341, throughput select=$"throughput select", DL throughput previous=s13, error in=s12) -> (BLER cluster=w342, DL throughput (current)=w343, DL throughput averaged=w344, DL BLER=w345, DL throughput current=w346, error out=w347)
    # 4
    case ($"UE RX Active") {
      frame False, Default { }
      frame True {
        $"DL throughput (current)" <- w343
        $"DL throughput" <- w344
        $"UE Failure / Block Error Rate (BLER)" <- w345
      }
    }
    call "Check Stop.gvi"(error in=w347) -> (error out=w348, stop=w349)
    $"BLER cluster" <- w342
    next s11 = w340
    next s12 = w348
    next s13 = w346
    stop if w349
  }
  call "Stop On Error.gvi"(error in=s12) -> (error out=w350)
  s14 = w14  # shift register
  while (iteration -> i3) {
    Quotient And Remainder(x=i3, y=1024) -> (x-y*floor(x/y)=w351)
    To Unsigned 16 Bit Integer(number=w351) -> w352
    $"Radio Frame Number" <- w352
    Wait Until Next Multiple(multiple to wait=0)
    # compute feedback information and send it to the FPGA as PUSCH payload data of the transmitter
    call "Compute Feedback Information.gvi"(session=$session, radioframe number=w352, error in=s14) -> (session dup=w353, feedback info=w354, error out=w355)
    call "Send Feedback Information.gvi"(session=w353, feedback info=w354, UL TX active=$"UE TX Active", error in=w355) -> (error out=w356)
    call "Check Stop.gvi"(error in=w356) -> (error out=w357, stop=w358)
    next s14 = w357
    stop if w358
  }
  call "Stop On Error.gvi"(error in=s14) -> (error out=w359)
  Build Array(w281, w316, w339, w350, w359, w15) -> w360
  sequence {
    frame 0 {
      call "UE Host Cleanup.gvi"(session=$session, error in=no error) -> (error out=w361)
      Build Array(w360, w361) -> w362
      $"FPGA Ready" <- FALSE
    }
  }
  call "LTE Generate Error Report.gvi"(error in=w362) -> (error report=w363, error occured=w364)
  $"Error Report" <- w363
  case (w364) {
    frame False, Default { }
    frame True {
      # Switch to status tab
      # in case of error
      $Tab <- 2
    }
  }
  $"External MAC Output" <- w13
  $"device bandwidth [MHz]" <- w10
