vi "Backup and Self Correct Rx Offset.gvi"   [LabVIEW NXG 4.0.0]
inputs:
  "niusrprio session in": "niUsrpRio Session.gtype"
  "channel to update": i32 = "Rx 0"(0)
  "tuning settle": u32 = 100
  "backup existing data?": bool = TRUE
  "error in": error
  "prompt for backup file path?": bool = TRUE
  "backup folder path": path
outputs:
  "niusrprio session out": "niUsrpRio Session.gtype"
  "updated characterization data": "Characterization Data.gtype"[]
  "error out": error
panel indicators:
  "characterization data valid?": bool
  "eeprom header": "EEPROM Header.gtype"
  "device data header": "EEPROM Device Data Header.gtype"
  "eeprom characterization header": "EEPROM Characterization Header.gtype"
  "original characterization data": "Characterization Data.gtype"[]
types:
  "Register Bus Session.gtype" = Queue<"Session Data.gtype">
  "Semaphore.gtype" = i32
  "DB Queue Reference.gtype" = Queue<"Daughterboard Data.gtype">
  "EEPROM Header.gtype" = cluster{"Checksum": u32, "Product Code": u16, "Hardware Current Version": u16, "Hardware Oldest Compatible Version": u16, "EEPROM Map Current Version": u16, "EEPROM Map Oldest Compatible Version": u16, "User Password": string, "Pointer to Factory Header": u32, "Pointer to User Header": u32, "Recommended Interval": u16, "Number of Reserved Bytes": i32, "Number of Daughterboards": u8, "Daughterboard IDs": u16[], "Daughterboard Serial Numbers": string[]}
  "EEPROM Device Data Header.gtype" = cluster{"Checksum": u32, "Number of Channels": u8, "Number of Gain Settings": u16[], "Pointer to Characterization Data": u32[], "Number of Reserved Bytes": i32, "Number of Frequencies": u16[]}
  "EEPROM Characterization Header.gtype" = cluster{"Checksum": u32, "Date": timestamp, "Temperature": f32, "Misc. Info": string, "Pointer to Device Data Header": u32, "Number of Reserved Bytes": i32}
  "Characterization Data.gtype" = cluster{"Gains[dB]": f64[], "Frequencies [Hz]": f64[], "IQ Imbalance Table": "IQ Imbalance.gtype"[], "Measured Gains[dB]": f64[][]}
  "niUsrpRio Session.gtype" = cluster{"FPGA Interface": any, "RIO Interface Number": u32, "Data Clock Rate": u32, "FPGA Data Clock Rate": u32, "Global Settings Register Bus": "Register Bus Session.gtype", "Radio 0 Settings Register Bus": "Register Bus Session.gtype", "Radio 1 Settings Register Bus": "Register Bus Session.gtype", "Radio Settings Bus Semaphore": "Semaphore.gtype", "DB Queues": "DB Queue Reference.gtype"[], "Characterization Data Valid?": bool, "EEPROM Header": "EEPROM Header.gtype", "Device Data Header": "EEPROM Device Data Header.gtype", "EEPROM Characterization Header": "EEPROM Characterization Header.gtype", "Characterization Data": "Characterization Data.gtype"[], "FPGA Current Version": u32, "FPGA Oldest Compatible Version": u32, "Fixed Logic Current Version": u32, "Fixed Logic Oldest Compatible Version": u32, "FPGA Radio Settings Bus Current Version": u32, "FPGA Radio Settings Bus Oldest Compatible Version": u32, "FPGA Board Config Current Version": u32, "FPGA Board Config Oldest Compatible Version": u32, "Daughterboard Clock Rate": u32}
uses:
  NI::USRPRIO::ConfigV1Host::Decode Daughterboard Names.gvi
  NI::G Core::Strings::Trim Whitespace.gvi
  NI::G Core::File IO (General)::Check if File or Folder Exists.gvi
  NI::G Core::File IO (General)::Get System Directory.gvi
  NI::G Core::Error::Legacy::Error Cluster From Error Code.gvi
  NI::G Core::File IO (General)::Write Delimited Spreadsheet (DBL).gvi
  Host SubVIs::Self Measure Rx IQ Offset.gvi
diagram:
  case ($"error in") {
    frame No Error {
      Property Node(instance in=$"niusrprio session in") -> ("Characterization Data Valid?"=w3, "EEPROM Header"=w4, "Device Data Header"=w5, "EEPROM Characterization Header"=w6, "Characterization Data"=w7)
      $"characterization data valid?" <- w3
      $"eeprom header" <- w4
      $"device data header" <- w5
      $"eeprom characterization header" <- w6
      $"original characterization data" <- w7
      Array Index(array=w7) -> (out0[$"channel to update"]=w8)
      case ($"backup existing data?") {
        frame False, Default {
          w9 = $"niusrprio session in"
          w10 = $"error in"
        }
        frame True {
          Property Node(instance in=$"niusrprio session in") -> ("EEPROM Header:EEPROM Map Current Version"=w11, "EEPROM Header:Daughterboard Serial Numbers"=w12, "EEPROM Header:Number of Daughterboards"=w13, "Characterization Data"=w14)
          Quotient And Remainder(x=$"channel to update", y=w13) -> (floor(x/y)=w15)
          call "Decode Daughterboard Names.gvi"(niusrprio session in=$"niusrprio session in", error in=$"error in") -> (niusrprio session out=w9, daughterboard names=w16, error out=w17)
          Array Index(array=w16) -> (out0[w15]=w18)
          Array Index(array=w12) -> (out0[w15]=w19)
          call "Trim Whitespace.gvi"(string=w19) -> (trimmed string=w20)
          Search And Replace String(input string=w20, replace all (F)=TRUE, search string="") -> (result string=w21)
          Format Into String(formatString="niUsrprio_Rx_Offsets_v%d_%s_%s_ch%d.txt", errIn=w17, w11, w18, w21, w15) -> (outString=w22, errOut=w23)
          # Exists?
          case ($"prompt for backup file path?") {
            frame False, Default {
              Build Path(base path=$"backup folder path", name or relative path=w22) -> (appended path=w25)
              call "Check if File or Folder Exists.gvi"(file or folder=w25, error in=w23) -> (file or folder exists?=w27, error out=w24)
              w26 = FALSE
            }
            frame True {
              Format Into String(formatString="Choose or Enter File Path for Channel %d", errIn=w23, w15) -> (outString=w28, errOut=w29)
              call "Get System Directory.gvi"(type="Default Data Directory") -> (system directory=w30)
              File Dialog[FileDialogSelectionMode=File, NewOrExistingMode=NewOrExisting](default name=w22, error in=w29, prompt=w28, start path=w30) -> (cancelled=w26, error out=w24, exists=w27, selected path=w25)
            }
          }
          Array Index(array=w14) -> (out0[$"channel to update"]=w31)
          Property Node(instance in=w31) -> ("Frequencies [Hz]"=w32, "IQ Imbalance Table"=w33)
          for {
            w34 = each element of w33
            Property Node(instance in=w34) -> ("Offset"=w37)
            Complex To Real And Imaginary(x + iy=w37) -> (x=w38, y=w39)
            append w38 to w35
            append w39 to w36
          }
          Build Array(w32, w35, w36) -> w40
          case (w27) {
            frame False, Default {
              w41 = TRUE
            }
            frame True {
              Two Button Dialog(F button name ("Cancel")="No", T button name ("OK")="Yes", message="Overwrite existing file?") -> (T Button?=w41)
            }
          }
          case (w41) {
            frame False, Default {
              w42 = "-5002: Operation cancelled to avoid overwriting existing file."
              call "Error Cluster From Error Code.gvi"(error code=-5002, error message=w42, error in=w24, show call chain?=TRUE, is warning?=FALSE) -> (error out=w10)
            }
            frame True {
              w10 = w24
            }
          }
          Logical And(not w10, w41, not w26) -> w43
          case (w43) {
            frame False, Default { }
            frame True {
              call "Write Delimited Spreadsheet (DBL).gvi"(file=w25, 2D data=w40)
            }
          }
        }
      }
      Property Node(instance in=w8) -> ("IQ Imbalance Table"=w44)
      Property Node(instance in=w8) -> ("Frequencies [Hz]"=w45)
      case ($"channel to update") {
        frame 0, Default {
          w46 = "rx/RF 0"
        }
        frame 2 {
          w46 = "rx/RF 1"
        }
      }
      s1 = w10  # shift register
      for {
        w47 = each element of w45
        w48 = each element of w44
        call "Self Measure Rx IQ Offset.gvi"(tuning settle=$"tuning settle", niusrprio session in=w9, carrier freq=w47, error in=s1, channel=w46) -> (error out=w50, offset=w51)
        Property Node(instance in=w48, "Offset"=w51) -> (instance out=w52)
        append w52 to w49
        next s1 = w50
        stop if w50
      }
      Property Node(instance in=w8, "IQ Imbalance Table"=w49) -> (instance out=w53)
      Replace Array Subset(inArray=w7, index=$"channel to update", new=w53) -> w54
      $"updated characterization data" <- w54
      case (s1) {
        frame Error, Default {
          w2 = w9
        }
        frame No Error {
          Property Node(instance in=w9, "Characterization Data"=w54) -> (instance out=w2)
        }
      }
      w1 = s1
    }
    frame Error {
      w1 = $"error in"
      w2 = $"niusrprio session in"
    }
  }
  $"niusrprio session out" <- w2
  $"error out" <- w1
