vi "Configure Start Trigger.gvi"   [LabVIEW NXG 4.0.0]
# Configures the Start Trigger of the device by selecting the trigger source. The Start Trigger is used to start the stream circuit on the device.
inputs:
  "niusrprio session in": "niUsrpRio Session.gtype", required
  "start trigger": "Start Trigger.gtype" = "Software", required
  "error in": error
  "scope": string = "rx", required
outputs:
  "niusrprio session out": "niUsrpRio Session.gtype"
  "error out": error
types:
  "Register Bus Session.gtype" = Queue<"Session Data.gtype">
  "Semaphore.gtype" = i32
  "DB Queue Reference.gtype" = Queue<"Daughterboard Data.gtype">
  "EEPROM Header.gtype" = cluster{"Checksum": u32, "Product Code": u16, "Hardware Current Version": u16, "Hardware Oldest Compatible Version": u16, "EEPROM Map Current Version": u16, "EEPROM Map Oldest Compatible Version": u16, "User Password": string, "Pointer to Factory Header": u32, "Pointer to User Header": u32, "Recommended Interval": u16, "Number of Reserved Bytes": i32, "Number of Daughterboards": u8, "Daughterboard IDs": u16[], "Daughterboard Serial Numbers": string[]}
  "EEPROM Device Data Header.gtype" = cluster{"Checksum": u32, "Number of Channels": u8, "Number of Gain Settings": u16[], "Pointer to Characterization Data": u32[], "Number of Reserved Bytes": i32, "Number of Frequencies": u16[]}
  "EEPROM Characterization Header.gtype" = cluster{"Checksum": u32, "Date": timestamp, "Temperature": f32, "Misc. Info": string, "Pointer to Device Data Header": u32, "Number of Reserved Bytes": i32}
  "Characterization Data.gtype" = cluster{"Gains[dB]": f64[], "Frequencies [Hz]": f64[], "IQ Imbalance Table": "IQ Imbalance.gtype"[], "Measured Gains[dB]": f64[][]}
  "niUsrpRio Session.gtype" = cluster{"FPGA Interface": any, "RIO Interface Number": u32, "Data Clock Rate": u32, "FPGA Data Clock Rate": u32, "Global Settings Register Bus": "Register Bus Session.gtype", "Radio 0 Settings Register Bus": "Register Bus Session.gtype", "Radio 1 Settings Register Bus": "Register Bus Session.gtype", "Radio Settings Bus Semaphore": "Semaphore.gtype", "DB Queues": "DB Queue Reference.gtype"[], "Characterization Data Valid?": bool, "EEPROM Header": "EEPROM Header.gtype", "Device Data Header": "EEPROM Device Data Header.gtype", "EEPROM Characterization Header": "EEPROM Characterization Header.gtype", "Characterization Data": "Characterization Data.gtype"[], "FPGA Current Version": u32, "FPGA Oldest Compatible Version": u32, "Fixed Logic Current Version": u32, "Fixed Logic Oldest Compatible Version": u32, "FPGA Radio Settings Bus Current Version": u32, "FPGA Radio Settings Bus Oldest Compatible Version": u32, "FPGA Board Config Current Version": u32, "FPGA Board Config Oldest Compatible Version": u32, "Daughterboard Clock Rate": u32}
  "Start Trigger.gtype" = enum{"Software", "Digital Edge", "Rx Start Trigger", "Tx Start Trigger", "Immediate", "Future Time Event"}
uses:
  NI::USRPRIO::ConfigV1Host::Parse Scope.gvi
  NI::G Core::Error::Legacy::Error Cluster From Error Code.gvi
diagram:
  call "Parse Scope.gvi"(niusrprio session in=$"niusrprio session in", error in=$"error in", scope=$scope) -> (niusrprio session out=w1, device subfunction=w2, error out=w3)
  $"niusrprio session out" <- w1
  Property Node(instance in=w1) -> ("FPGA Interface"=w4)
  Dynamic Fpga Interface Cast(reference in=w4, type="Streaming Xvcr FPGA Ref.gtype" constant) -> (reference out=w5)
  case (w2) {
    frame "rx", Default {
      Property Node(instance in=w5, "rx.trigger select"=$"start trigger", error in=w3) -> (error out=w6)
      w9 = "-1: The Rx Start Trigger cannot be used for the Rx Start Trigger.  Select a different trigger for the Rx Start Trigger."
      call "Error Cluster From Error Code.gvi"(error code=-1, error message=w9, show call chain?=TRUE, is warning?=FALSE) -> (error out=w8)
      Is Equal(x=$"start trigger", y="Rx Start Trigger") -> w7
    }
    frame "tx" {
      Property Node(instance in=w5, "tx.trigger select"=$"start trigger", error in=w3) -> (error out=w6)
      w10 = "-1: The Tx Start Trigger cannot be used for the Tx Start Trigger.  Select a different trigger for the Tx Start Trigger."
      call "Error Cluster From Error Code.gvi"(error code=-1, error message=w10, show call chain?=TRUE, is warning?=FALSE) -> (error out=w8)
      Is Equal(x=$"start trigger", y="Tx Start Trigger") -> w7
    }
  }
  Select(s=w7, t=w8, f=no error) -> w11
  Merge Errors(w6, w11) -> (error out=w12)
  $"error out" <- w12
