vi "Fetch Rx Data (CDB WDT).gvi"   [LabVIEW NXG 4.0.0]
# Fetches Rx data from the device.
# Configure Stream and Initiate Stream before calling this VI.
# Input Parameters
# niUsrpRio Session is the object created by the Open VI and used as the session handle for the USRP RIO design library.
# scope is the channel to fetch the data from. The options are "rx/RF 0", "rx/RF 1", "tx/RF 0", and "tx/RF 1".
# vertical range is the peak-to-peak range, in volts, of the acquired data. This control is used to accurately display the acquired data.
# number of samples to acquire.
# timeout is how long, in seconds, to keep retrying before giving up.
# sample rate the requested rate, in samples per second, the signal will be sampled at. This control is used to accurately display the acquired data.
# leading samples to trim is the number of samples to throw away, starting from the first samples.
# error in describes error conditions that occur before this node runs. This input provides standard 'error in' functionality.
# Output Parameters
# niUsrpRio Session (out) is the niUsrpRio session used in all subsequent USRP RIO design library host VIs.
# waveforms contains the fetched data.
# error out contains error information. This output provides standard 'error out' functionality.
inputs:
  "niusrprio session": "niUsrpRio Session.gtype"
  "number of samples": u32 = 8192
  "sample rate": f64 = 10000000
  "timeout": f64 = 10
  "error in": error
  "scope": string
  "vertical range [vpp]": f64 = 2
  "leading samples to trim": u32
outputs:
  "waveform": waveform<c128>
  "niusrprio session 2": "niUsrpRio Session.gtype"
  "error out": error
types:
  "Register Bus Session.gtype" = Queue<"Session Data.gtype">
  "Semaphore.gtype" = i32
  "DB Queue Reference.gtype" = Queue<"Daughterboard Data.gtype">
  "EEPROM Header.gtype" = cluster{"Checksum": u32, "Product Code": u16, "Hardware Current Version": u16, "Hardware Oldest Compatible Version": u16, "EEPROM Map Current Version": u16, "EEPROM Map Oldest Compatible Version": u16, "User Password": string, "Pointer to Factory Header": u32, "Pointer to User Header": u32, "Recommended Interval": u16, "Number of Reserved Bytes": i32, "Number of Daughterboards": u8, "Daughterboard IDs": u16[], "Daughterboard Serial Numbers": string[]}
  "EEPROM Device Data Header.gtype" = cluster{"Checksum": u32, "Number of Channels": u8, "Number of Gain Settings": u16[], "Pointer to Characterization Data": u32[], "Number of Reserved Bytes": i32, "Number of Frequencies": u16[]}
  "EEPROM Characterization Header.gtype" = cluster{"Checksum": u32, "Date": timestamp, "Temperature": f32, "Misc. Info": string, "Pointer to Device Data Header": u32, "Number of Reserved Bytes": i32}
  "Characterization Data.gtype" = cluster{"Gains[dB]": f64[], "Frequencies [Hz]": f64[], "IQ Imbalance Table": "IQ Imbalance.gtype"[], "Measured Gains[dB]": f64[][]}
  "niUsrpRio Session.gtype" = cluster{"FPGA Interface": any, "RIO Interface Number": u32, "Data Clock Rate": u32, "FPGA Data Clock Rate": u32, "Global Settings Register Bus": "Register Bus Session.gtype", "Radio 0 Settings Register Bus": "Register Bus Session.gtype", "Radio 1 Settings Register Bus": "Register Bus Session.gtype", "Radio Settings Bus Semaphore": "Semaphore.gtype", "DB Queues": "DB Queue Reference.gtype"[], "Characterization Data Valid?": bool, "EEPROM Header": "EEPROM Header.gtype", "Device Data Header": "EEPROM Device Data Header.gtype", "EEPROM Characterization Header": "EEPROM Characterization Header.gtype", "Characterization Data": "Characterization Data.gtype"[], "FPGA Current Version": u32, "FPGA Oldest Compatible Version": u32, "Fixed Logic Current Version": u32, "Fixed Logic Oldest Compatible Version": u32, "FPGA Radio Settings Bus Current Version": u32, "FPGA Radio Settings Bus Oldest Compatible Version": u32, "FPGA Board Config Current Version": u32, "FPGA Board Config Oldest Compatible Version": u32, "Daughterboard Clock Rate": u32}
uses:
  Host SubVIs::Fetch Rx Data (CDB).gvi
diagram:
  call "Fetch Rx Data (CDB).gvi"(leading samples to trim=$"leading samples to trim", niusrprio session=$"niusrprio session", number of samples=$"number of samples", timeout=$timeout, error in=$"error in", scope=$scope, vertical range [vpp]=$"vertical range [vpp]") -> (niusrprio session 2=w1, waveform=w2, error out=w3)
  $"niusrprio session 2" <- w1
  Reciprocal(x=$"sample rate") -> w4
  Build Waveform Node(Y=w2, dt=w4) -> (output waveform=w5)
  $waveform <- w5
  $"error out" <- w3
