vi "Initiate Stream.gvi"   [LabVIEW NXG 4.0.0]
# Initiates the stream. This is required before you acquire/generate data with the Fetch Rx Data or Write Tx Data VIs. Initiation includes resetting the Rx/Tx streams and the DSP. Multi-device usage: Initiate the master device last, after initiating all the slave devices. Input Parameters niUsrpRio Session is the object created by the Open VI and used as the session handle for the USRP RIO design library. scope is the channel on which stream is to be initiated. The options are "rx/RF 0", "rx/RF 1", "tx/RF 0", and "tx/RF 1". error in describes error conditions that occur before this node runs. This input provides standard 'error in' functionality. Output Parameters niUsrpRio Session (out) is the niUsrpRio session used in all subsequent USRP RIO design library host VIs. error out contains error information. This output provides standard 'error out' functionality.
inputs:
  "niusrprio session in": "niUsrpRio Session.gtype", required
  "error in": error
  "scope": string = "rx", required  # is the channel on which stream is to be initiated. The options are "rx/RF 0", "rx/RF 1", "tx/RF 0", and "tx/RF 1".
outputs:
  "niusrprio session out": "niUsrpRio Session.gtype"
  "error out": error
types:
  "Register Bus Session.gtype" = Queue<"Session Data.gtype">
  "Semaphore.gtype" = i32
  "DB Queue Reference.gtype" = Queue<"Daughterboard Data.gtype">
  "EEPROM Header.gtype" = cluster{"Checksum": u32, "Product Code": u16, "Hardware Current Version": u16, "Hardware Oldest Compatible Version": u16, "EEPROM Map Current Version": u16, "EEPROM Map Oldest Compatible Version": u16, "User Password": string, "Pointer to Factory Header": u32, "Pointer to User Header": u32, "Recommended Interval": u16, "Number of Reserved Bytes": i32, "Number of Daughterboards": u8, "Daughterboard IDs": u16[], "Daughterboard Serial Numbers": string[]}
  "EEPROM Device Data Header.gtype" = cluster{"Checksum": u32, "Number of Channels": u8, "Number of Gain Settings": u16[], "Pointer to Characterization Data": u32[], "Number of Reserved Bytes": i32, "Number of Frequencies": u16[]}
  "EEPROM Characterization Header.gtype" = cluster{"Checksum": u32, "Date": timestamp, "Temperature": f32, "Misc. Info": string, "Pointer to Device Data Header": u32, "Number of Reserved Bytes": i32}
  "Characterization Data.gtype" = cluster{"Gains[dB]": f64[], "Frequencies [Hz]": f64[], "IQ Imbalance Table": "IQ Imbalance.gtype"[], "Measured Gains[dB]": f64[][]}
  "niUsrpRio Session.gtype" = cluster{"FPGA Interface": any, "RIO Interface Number": u32, "Data Clock Rate": u32, "FPGA Data Clock Rate": u32, "Global Settings Register Bus": "Register Bus Session.gtype", "Radio 0 Settings Register Bus": "Register Bus Session.gtype", "Radio 1 Settings Register Bus": "Register Bus Session.gtype", "Radio Settings Bus Semaphore": "Semaphore.gtype", "DB Queues": "DB Queue Reference.gtype"[], "Characterization Data Valid?": bool, "EEPROM Header": "EEPROM Header.gtype", "Device Data Header": "EEPROM Device Data Header.gtype", "EEPROM Characterization Header": "EEPROM Characterization Header.gtype", "Characterization Data": "Characterization Data.gtype"[], "FPGA Current Version": u32, "FPGA Oldest Compatible Version": u32, "Fixed Logic Current Version": u32, "Fixed Logic Oldest Compatible Version": u32, "FPGA Radio Settings Bus Current Version": u32, "FPGA Radio Settings Bus Oldest Compatible Version": u32, "FPGA Board Config Current Version": u32, "FPGA Board Config Oldest Compatible Version": u32, "Daughterboard Clock Rate": u32}
uses:
  NI::USRPRIO::ConfigV1Host::Parse Scope.gvi
  NI::G Core::Timing::Elapsed Timer.gvi
  NI::G Core::Error::Legacy::Error Cluster From Error Code.gvi
diagram:
  call "Parse Scope.gvi"(niusrprio session in=$"niusrprio session in", error in=$"error in", scope=$scope) -> (niusrprio session out=w1, device subfunction=w2, device subfunction channel=w3, error out=w4)
  $"niusrprio session out" <- w1
  Property Node(instance in=w1) -> ("FPGA Interface"=w5)
  Dynamic Fpga Interface Cast(reference in=w5, type=any constant) -> (reference out=w6)
  case (w2) {
    frame "tx" {
      disable {
        frame Enabled {
          w8 = w6
          w9 = w4
        }
        frame Disabled {
          Property Node(instance in=w6, "tx.trigger enable"=FALSE, error in=w4) -> (error out=w9, instance out=w8)
        }
      }
      Property Node(instance in=w8, "tx 0.stream enable"=FALSE, "tx 1.stream enable"=FALSE, error in=w9) -> (error out=w10, instance out=w11)
      # an extra read transaction adds delay to ensure the reset propagates to the dsp logic and the reset done indicator
      Property Node(instance in=w11, "tx.abort"=FALSE, error in=w10) -> (error out=w12, instance out=w13)
      Property Node(instance in=w13, "tx.reset"=TRUE, "tx.reset"=FALSE, error in=w12) -> (error out=w14, instance out=w15)
      # wait for DSP to reset
      s1 = FALSE  # shift register
      while (iteration -> i1) {
        Property Node(instance in=w15, error in=w14) -> ("tx.dsp reset done"=w16, error out=w17, instance out=w18)
        Logical Or(w17, w16, s1) -> w19
        # using a shift register ensures the loop runs once more after a timeout in case this thread went to sleep
        Is Equal To 0(x=i1) -> w20
        call "Elapsed Timer.gvi"(target time=1, reset=w20) -> (time has elapsed=w21)
        next s1 = w21
        stop if w19
      }
      call "Error Cluster From Error Code.gvi"(error code=-1, error message="-1: Tx DSP failed to reset within time limit.", show call chain?=TRUE, is warning?=FALSE) -> (error out=w22)
      Select(s=w16, t=no error, f=w22) -> w23
      Merge Errors(w17, w23) -> (error out=w24)
      case (w3) {
        frame "0", Default {
          Property Node(instance in=w18, "tx 0.stream enable"=TRUE, error in=w24) -> (error out=w25, instance out=w26)
        }
        frame "All" {
          Property Node(instance in=w18, "tx 0.stream enable"=TRUE, "tx 1.stream enable"=TRUE, error in=w24) -> (error out=w25, instance out=w26)
        }
        frame "1" {
          Property Node(instance in=w18, "tx 1.stream enable"=TRUE, error in=w24) -> (error out=w25, instance out=w26)
        }
      }
      disable {
        frame Enabled {
          w7 = w25
        }
        frame Disabled {
          Property Node(instance in=w26, "tx.trigger enable"=TRUE, error in=w25) -> (error out=w7)
        }
      }
    }
    frame "rx", Default {
      disable {
        frame Enabled {
          w27 = FALSE
          w28 = w6
          w29 = w4
        }
        frame Disabled {
          Property Node(instance in=w6, "rx.trigger enable"=FALSE, error in=w4) -> (error out=w29, instance out=w28)
          w27 = FALSE
        }
      }
      Property Node(instance in=w28, "rx 0.stream enable"=w27, "rx 1.stream enable"=FALSE, error in=w29) -> (error out=w30, instance out=w31)
      # an extra read transaction adds delay to ensure the reset propagates to the dsp logic and the reset done indicator
      Property Node(instance in=w31, "rx.abort"=FALSE, error in=w30) -> (error out=w32, instance out=w33)
      Property Node(instance in=w33, "rx.reset"=TRUE, "rx.reset"=FALSE, error in=w32) -> (error out=w34, instance out=w35)
      # wait for DSP to reset
      s2 = FALSE  # shift register
      while (iteration -> i2) {
        Property Node(instance in=w35, error in=w34) -> ("rx.dsp reset done"=w36, error out=w37, instance out=w38)
        Logical Or(w37, w36, s2) -> w39
        # using a shift register ensures the loop runs once more after a timeout in case this thread went to sleep
        Is Equal To 0(x=i2) -> w40
        call "Elapsed Timer.gvi"(target time=1, reset=w40) -> (time has elapsed=w41)
        next s2 = w41
        stop if w39
      }
      call "Error Cluster From Error Code.gvi"(error code=-1, error message="-1: Rx DSP failed to reset within time limit.", show call chain?=TRUE, is warning?=FALSE) -> (error out=w42)
      Select(s=w36, t=no error, f=w42) -> w43
      Merge Errors(w37, w43) -> (error out=w44)
      case (w3) {
        frame "0", Default {
          Property Node(instance in=w38, "rx 0.stream enable"=TRUE, error in=w44) -> (error out=w45, instance out=w46)
        }
        frame "All" {
          Property Node(instance in=w38, "rx 0.stream enable"=TRUE, "rx 1.stream enable"=TRUE, error in=w44) -> (error out=w45, instance out=w46)
        }
        frame "1" {
          Property Node(instance in=w38, "rx 1.stream enable"=TRUE, error in=w44) -> (error out=w45, instance out=w46)
        }
      }
      disable {
        frame Enabled {
          w7 = w45
        }
        frame Disabled {
          Property Node(instance in=w46, "rx.trigger enable"=TRUE, error in=w45) -> (error out=w7)
        }
      }
    }
  }
  $"error out" <- w7
