vi "Initiate and Fetch Time (Multi).gvi"   [LabVIEW NXG 4.0.0]
# Initiates acquisition and then fetches data from the device.
# VIs that must execute before this VI:
# Open and Configure
# Configure Time
# Input Parameters
# niUsrpRio Session is the object created by the Open VI and used as the session handle for the USRP RIO design library.
# first iteration is used to determine if the device needs to be triggered. If this VI is in a loop, wire the iteration count to Equals Zero and then to this terminal. If this VI is not in a loop, wire a TRUE constant to this this terminal.
# start trigger time specifies the absolute time to initiate the start trigger. Only applies when the start trigger is set to Future Event.
# error in describes error conditions that occur before this node runs. This input provides standard 'error in' functionality.
# Output Parameters
# niUsrpRio Session (out) is the niUsrpRio session used in all subsequent USRP RIO design library host VIs.
# complex baseband data received by the device.
# error out contains error information. This output provides standard 'error out' functionality.
inputs:
  "niUsrpRio Sessions": "niUsrpRio Session.gtype"[], required
  "first iteration": bool, required  # is used to determine if the device needs to be triggered. If this VI is in a loop, wire the iteration count to Equals Zero and then to this terminal. If this VI is not in a loop, wire a TRUE constant to this this terminal.
  "start trigger time": timestamp, required  # specifies the absolute time to initiate the start trigger. Only applies when the start trigger is set to Future Event.
  "error in": error
  "rx channels": T4[], required
  "leading samples to trim": u32
outputs:
  "niUsrpRio Sessions (out)": "niUsrpRio Session.gtype"[]
  "complex baseband data": waveform<c128>[]  # received by the device.
  "error out": error
types:
  "Register Bus Session.gtype" = Queue<"Session Data.gtype">
  "Semaphore.gtype" = i32
  "DB Queue Reference.gtype" = Queue<"Daughterboard Data.gtype">
  "EEPROM Header.gtype" = cluster{"Checksum": u32, "Product Code": u16, "Hardware Current Version": u16, "Hardware Oldest Compatible Version": u16, "EEPROM Map Current Version": u16, "EEPROM Map Oldest Compatible Version": u16, "User Password": string, "Pointer to Factory Header": u32, "Pointer to User Header": u32, "Recommended Interval": u16, "Number of Reserved Bytes": i32, "Number of Daughterboards": u8, "Daughterboard IDs": u16[], "Daughterboard Serial Numbers": string[]}
  "EEPROM Device Data Header.gtype" = cluster{"Checksum": u32, "Number of Channels": u8, "Number of Gain Settings": u16[], "Pointer to Characterization Data": u32[], "Number of Reserved Bytes": i32, "Number of Frequencies": u16[]}
  "EEPROM Characterization Header.gtype" = cluster{"Checksum": u32, "Date": timestamp, "Temperature": f32, "Misc. Info": string, "Pointer to Device Data Header": u32, "Number of Reserved Bytes": i32}
  "Characterization Data.gtype" = cluster{"Gains[dB]": f64[], "Frequencies [Hz]": f64[], "IQ Imbalance Table": "IQ Imbalance.gtype"[], "Measured Gains[dB]": f64[][]}
  "niUsrpRio Session.gtype" = cluster{"FPGA Interface": any, "RIO Interface Number": u32, "Data Clock Rate": u32, "FPGA Data Clock Rate": u32, "Global Settings Register Bus": "Register Bus Session.gtype", "Radio 0 Settings Register Bus": "Register Bus Session.gtype", "Radio 1 Settings Register Bus": "Register Bus Session.gtype", "Radio Settings Bus Semaphore": "Semaphore.gtype", "DB Queues": "DB Queue Reference.gtype"[], "Characterization Data Valid?": bool, "EEPROM Header": "EEPROM Header.gtype", "Device Data Header": "EEPROM Device Data Header.gtype", "EEPROM Characterization Header": "EEPROM Characterization Header.gtype", "Characterization Data": "Characterization Data.gtype"[], "FPGA Current Version": u32, "FPGA Oldest Compatible Version": u32, "Fixed Logic Current Version": u32, "Fixed Logic Oldest Compatible Version": u32, "FPGA Radio Settings Bus Current Version": u32, "FPGA Radio Settings Bus Oldest Compatible Version": u32, "FPGA Board Config Current Version": u32, "FPGA Board Config Oldest Compatible Version": u32, "Daughterboard Clock Rate": u32}
  T1 = cluster{"antenna": string, "frequency": f64, "lo frequency": f64, "level": f64}
  "Start Trigger.gtype" = enum{"Software", "Digital Edge", "Rx Start Trigger", "Tx Start Trigger", "Immediate", "Future Time Event"}
  T2 = cluster{"rf enable 0": bool, "rf config 0": T1, "rf enable 1": bool, "rf config 1": T1, "transfer mode": enum{"Finite", "Continuous"}, "sample rate": f64, "number of samples": u32, "start trigger": "Start Trigger.gtype"}
  T3 = cluster{"coerced frequencies": f64[], "coerced lo frequencies": f64[], "coerced levels": f64[], "coerced sample rates": f64[]}
  T4 = cluster{"rx config": T2, "reference frequency source": string, "rx.enabled channels": string[], "vertical range": f64[], "rx.coerced configurations": T3}
uses:
  Host SubVIs::Initiate and Trigger.gvi
  Host SubVIs::Fetch Rx Data (CDB WDT).gvi
  Host SubVIs::Check Stream Status.gvi
diagram:
  $"niUsrpRio Sessions (out)" <- $"niUsrpRio Sessions"
  Array Index(array=$"rx channels") -> (out0[_]=w1)
  Property Node(instance in=w1) -> ("rx.enabled channels"=w2, "rx config:start trigger"=w3, "rx config:transfer mode"=w4)
  Is Equal(x=w4, y="Finite") -> w5
  Array Size(array=w2) -> (size(s)=w6)
  case (w6) {
    frame 0 {
      # do nothing if there are zero enabled channels
      w7 = $"error in"
      w8 = default
    }
    frame Default {
      Logical Or(w5, $"first iteration") -> w9
      # For continuous acquisitions, only send the trigger the first time. Sending another trigger would re-initiate an acquisition that has already started/completed.
      case (w9) {
        frame False, Default {
          w10 = $"error in"
          w11 = $"niUsrpRio Sessions"
        }
        frame True {
          call "Initiate and Trigger.gvi"(niUsrpRio Sessions=$"niUsrpRio Sessions", start trigger=w3, start trigger time=$"start trigger time", error in=$"error in", scope="rx") -> (niUsrpRio Sessions (out)=w11, error out=w10)
        }
      }
      # #NOTE: To ameliorate Rx overflows during continuous acquisition, Check Stream Status does not need to run every loop iteration.
      s1 = w10  # shift register
      for {
        w12 = each element of w11
        w13 = each element of $"rx channels"
        Property Node(instance in=w13) -> ("reference frequency source"=w14, "vertical range"=w15, "rx.enabled channels"=w16, "rx config:number of samples"=w17, "rx.coerced configurations:coerced sample rates"=w18)
        s2 = s1  # shift register
        for {
          w19 = each element of w16
          w20 = each element of w15
          w21 = each element of w18
          call "Fetch Rx Data (CDB WDT).gvi"(leading samples to trim=$"leading samples to trim", niusrprio session=w12, number of samples=w17, sample rate=w21, error in=s2, scope=w19, vertical range [vpp]=w20) -> (niusrprio session 2=w23, waveform=w24, error out=w25)
          append w24 to w22
          next s2 = w25
        }
        call "Check Stream Status.gvi"(reference frequency source=w14, niusrprio session in=w23, error in=s2, scope="rx") -> (error out=w26)
        concatenate w22 onto w8
        next s1 = w26
      }
      w7 = s1
    }
  }
  $"error out" <- w7
  $"complex baseband data" <- w8
