vi "LTE Calculate RX Power Spectrum MIMO.gvi"   [LabVIEW NXG 4.0.0]
# Reinterprets receiver data values read from the FPGA and calculates the RX power spectrum.
inputs:
  "RX data AP1": u32[]  # Array of RX data values read from the FPGA. Only the first 30,720 values are used for spectrum calculation.
  "coerced gain [dB]": f64 = -10  # Coerced RX gain used for RX spectrum magnitude correction. This correction is required because RX values on the FPGA are captured after RX gain is applied.
  "error in": error
  "power calibration offset [dB]": f64 = -10  # Frequency dependent power offset that is applied to the RX baseband sample stream from the FPGA to ensure that the RX power levels in the displayed spectrum are correct.
  "RX data AP0": u32[]  # Array of RX data values read from the FPGA. Only the first 30,720 values are used for spectrum calculation.
outputs:
  "RX power spectrum AP1": T1  # Calculated RX power spectrum for 1 subframe (30,720 samples).
  "error out": error
  "RX power spectrum AP0": T1  # Calculated RX power spectrum for 1 subframe (30,720 samples).
  "RXDataCDB_AP0": c128[]
  "RXDataCDB_AP1": c128[]
types:
  T1 = cluster{"f0": f64, "df": f64, "magnitude": f64[]}
  T2 = enum{"No averaging", "Vector averaging", "RMS averaging", "Peak hold"}
  "Averaging Parameters.gtype" = cluster{"averaging mode": T2, "weighting mode": enum{"Linear", "Exponential"}, "number of averages": u32}
uses:
  NI::Analysis::Measurement::Power Spectrum for 1 Chan (CDB).gvi
diagram:
  Array Subset(array=$"RX data AP0", length0=30720) -> w1
  Split Number(x=w1) -> (high(x)=w2, low(x)=w3)
  for {
    w4 = each element of w2
    w5 = each element of w3
    Reinterpret Number[RestrictToSameWordLength=True](data in=w5, type=UFXP(1.15) 0) -> (data out=w7)
    To Fixed Point(fixed-point type=FXP(1.15) 0, number=w7) -> w8: FXP(1.15) Wrap:Truncate
    To Double Precision Float(number=w8) -> w9
    Reinterpret Number[RestrictToSameWordLength=True](data in=w4, type=UFXP(1.15) 0) -> (data out=w10)
    To Fixed Point(fixed-point type=FXP(1.15) 0, number=w10) -> w11: FXP(1.15) Wrap:Truncate
    To Double Precision Float(number=w11) -> w12
    Real And Imaginary To Complex(x=w9, y=w12) -> w13
    append w13 to w6
  }
  $RXDataCDB_AP0 <- w6
  Array Subset(array=$"RX data AP1", length0=30720) -> w14
  Split Number(x=w14) -> (high(x)=w15, low(x)=w16)
  for {
    w17 = each element of w15
    w18 = each element of w16
    Reinterpret Number[RestrictToSameWordLength=True](data in=w18, type=UFXP(1.15) 0) -> (data out=w20)
    To Fixed Point(fixed-point type=FXP(1.15) 0, number=w20) -> w21: FXP(1.15) Wrap:Truncate
    To Double Precision Float(number=w21) -> w22
    Reinterpret Number[RestrictToSameWordLength=True](data in=w17, type=UFXP(1.15) 0) -> (data out=w23)
    To Fixed Point(fixed-point type=FXP(1.15) 0, number=w23) -> w24: FXP(1.15) Wrap:Truncate
    To Double Precision Float(number=w24) -> w25
    Real And Imaginary To Complex(x=w22, y=w25) -> w26
    append w26 to w19
  }
  $RXDataCDB_AP1 <- w19
  Reciprocal(x=30720000) -> w27
  Property Node(instance in=waveform<c128> {dt=1, Y=[]}, "Y"=w6, "dt"=w27) -> (instance out=w28)
  call "Power Spectrum for 1 Chan (CDB).gvi"(signal=w28, window type="Rectangle"(0), averaging parameters="Averaging Parameters.gtype" {all zero or empty}, dB on=TRUE, error in=$"error in", restart averaging=FALSE) -> (power spectrum=w29, error out=w30)
  Property Node(instance in=w29) -> ("magnitude"=w31, instance out=w32)
  Add(w31, $"power calibration offset [dB]") -> w33
  Subtract(x=w33, y=$"coerced gain [dB]") -> w34
  Property Node(instance in=w32, "magnitude"=w34) -> (instance out=w35)
  $"RX power spectrum AP0" <- w35
  Reciprocal(x=30720000) -> w36
  Property Node(instance in=waveform<c128> {dt=1, Y=[]}, "Y"=w19, "dt"=w36) -> (instance out=w37)
  call "Power Spectrum for 1 Chan (CDB).gvi"(signal=w37, window type="Rectangle"(0), averaging parameters="Averaging Parameters.gtype" {all zero or empty}, dB on=TRUE, error in=$"error in", restart averaging=FALSE) -> (power spectrum=w38, error out=w39)
  Property Node(instance in=w38) -> ("magnitude"=w40, instance out=w41)
  Add(w40, $"power calibration offset [dB]") -> w42
  Subtract(x=w42, y=$"coerced gain [dB]") -> w43
  Property Node(instance in=w41, "magnitude"=w43) -> (instance out=w44)
  $"RX power spectrum AP1" <- w44
  Merge Errors(w30, w39) -> (error out=w45)
  $"error out" <- w45
