vi "LTE Create Dynamic DL TX Configuration MIMO.gvi"   [LabVIEW Communications System Design Suite 2.0.1]
# Converts the host parameters DCI message and UE context (dynamic DL configuration) to the TTI configuration cluster.
# Coerces the DCI message when UERS is enabled and MCS = 28.
inputs:
  "DCI in": T4 = {"Active"=TRUE, "MCS"="MCS 17 (64-QAM, rate ~0.43)", "Resource Block Allocation (4 PRB/bit)"=8388607, "MIMO flag"=FALSE}  # The DCI message in the way it is configured on the host, containing only a subset (MCS, Resource Block Allocation, and Active) of the full DCI message which is used on the FPGA.
  "UE context": T1 = {"RNTI"=10, "use UERS"=FALSE, "antenna port"=7, "CCE offset"=0}  # Per subframe changeable UE specific parameter set (use UERS, RNTI, antenna port, CCE offset). Corresponds to dynamic DL configuration on the FPGA.
outputs:
  "coerced DCI": T4  # When UERS is enabled and MCS = 28, the DCI message is changed to MCS=27. In all other cases the value is equal to DCI in.
  "dynamic configuration": cluster{"UE config": T1, "DCI message": T2}  # The resulting TTI configuration consisting of the UE context (dynamic DL configuration) and the full DCI message.
  "MCS adapted": bool  # Indicates if the DCI message was coerced.
types:
  T1 = cluster{"RNTI": u16, "use UERS": bool, "antenna port": UFXP(4.0), "CCE offset": u8}
  T2 = cluster{"valid": bool, "resource allocation header": UFXP(1.0), "resource block allocation": UFXP(25.0), "MCS": UFXP(5.0), "HARQ process number": UFXP(4.0), "new data indicator": bool, "redundancy version": UFXP(2.0), "TPC command for pucch": UFXP(2.0), "DL assignment index": UFXP(2.0), "MIMO flag": bool}
  T3 = enum{"MCS 0 (QPSK, rate ~0.12)", "MCS 1 (QPSK, rate ~0.15)", "MCS 2 (QPSK, rate ~0.19)", "MCS 3 (QPSK, rate ~0.25)", "MCS 4 (QPSK, rate ~0.30)", "MCS 5 (QPSK, rate ~0.37)", "MCS 6 (QPSK, rate ~0.44)", "MCS 7 (QPSK, rate ~0.51)", "MCS 8 (QPSK, rate ~0.59)", "MCS 9 (QPSK, rate ~0.66)", "MCS 10 (16-QAM, rate ~0.33)", "MCS 11 (16-QAM, rate ~0.37)", "MCS 12 (16-QAM, rate ~0.42)", "MCS 13 (16-QAM, rate ~0.48)", "MCS 14 (16-QAM, rate ~0.54)", "MCS 15 (16-QAM, rate ~0.60)", "MCS 16 (16-QAM, rate ~0.64)", "MCS 17 (64-QAM, rate ~0.43)", "MCS 18 (64-QAM, rate ~0.46)", "MCS 19 (64-QAM, rate ~0.50)", "MCS 20 (64-QAM, rate ~0.55)", "MCS 21 (64-QAM, rate ~0.60)", "MCS 22 (64-QAM, rate ~0.65)", "MCS 23 (64-QAM, rate ~0.70)", "MCS 24 (64-QAM, rate ~0.75)", "MCS 25 (64-QAM, rate ~0.80)", "MCS 26 (64-QAM, rate ~0.85)", "MCS 27 (64-QAM, rate ~0.89)", "MCS 28 (64-QAM, rate ~0.93)"}
  T4 = cluster{"Active": bool, "MCS": T3, "Resource Block Allocation (4 PRB/bit)": UFXP(25.0), "MIMO flag": bool}
diagram:
  Property Node(instance in=$"UE context") -> ("use UERS"=w1, instance out=w2)
  Property Node(instance in=$"DCI in") -> ("Active"=w3, "MCS"=w4, "MIMO flag"=w5, "Resource Block Allocation (4 PRB/bit)"=w6, instance out=w7)
  Is Equal(x=w4, y="MCS 28 (64-QAM, rate ~0.93)") -> w8
  Logical And(w1, w8) -> w9
  $"MCS adapted" <- w9
  case (w9) {
    frame False, Default {
      w10 = w4
    }
    frame True {
      w11 = "MCS clipped to 27 as RX reception on the UE side will fail with MCS set to 28 and UERS enabled due to a code rate greater than 1!"
      One Button Dialog(message=w11)
      w10 = "MCS 27 (64-QAM, rate ~0.89)"
    }
  }
  Property Node(instance in=w7, "MCS"=w10) -> (instance out=w12)
  $"coerced DCI" <- w12
  Type Cast(type=u16 0, x=w10) -> w13
  To Fixed Point(fixed-point type=UFXP(5.0) 0, number=w13) -> w14
  Number To Boolean Array(number=w6) -> (Boolean array=w15)
  Reverse 1D Array(array=w15) -> (reversed array=w16)
  Boolean Array To Number(Boolean array=w16) -> (number=w17: UFXP(25.0))
  w18 = cluster{"UE config": T1, "DCI message": T2} {all zero or empty}
  Property Node(instance in=w18, "DCI message:MCS"=w14, "DCI message:resource block allocation"=w17, "DCI message:valid"=w3, "DCI message:MIMO flag"=w5, "UE config"=w2) -> (instance out=w19)
  $"dynamic configuration" <- w19
