vi "LTE DL Host Initialization MIMO.gvi"   [LabVIEW NXG 4.0.0]
# Opens a session to a specific USRP RIO device, downloads the FPGA bitfile, runs the FPGA, and starts all the target to host and host to target DMA transfers
# Necessary UDP connections are opened and all the queues used in the DL host application are obtained. The session cluster is initialized with queue references and the USRP session.
inputs:
  "USRP device": string = "RIO0"  # Specific USRP RIO device to open a session to.
  "Host Session": "Host Session.gtype" = {"target"="USRP", "MAC Stub enabled"=TRUE, "TX link direction"="DL", "RX link direction"="DL"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}
  "error in": error
  "USRP bandwidth": "USRP bandwidth.gtype" = "120 MHz"
  "reference clock source": string = "Internal"  # The used reference clock input. Valid values are Internal, REF IN / ClkIn, PXI_CLK, and GPS.
outputs:
  "error out": error
  "session out": "Host Session.gtype"
panel controls:
  "command": string
  "external MAC": bool
  "arguments": string
  "transport instance id": u8
types:
  "Transport Session.gtype" = cluster{"FIFO pathname": string, "pipe reader": "Pipe Reader.gtype", "pipe writer": "Pipe Writer.gtype", "transport in RT FIFO": RTFifoRefnum<u8[]>, "transport out RT FIFO": RTFifoRefnum<u8[]>, "transport in timing source name": string, "transport in timing trigger ID": u8, "transport out timing source name": string, "transport out timing trigger ID": u8, "maximum API message size": u32}
  "Register Bus Session.gtype" = Queue<"Session Data.gtype">
  "Semaphore.gtype" = i32
  "DB Queue Reference.gtype" = Queue<"Daughterboard Data.gtype">
  "niUsrpRio Session.gtype" = cluster{"FPGA Interface": any, "RIO Interface Number": u32, "Data Clock Rate": u32, "FPGA Data Clock Rate": u32, "Global Settings Register Bus": "Register Bus Session.gtype", "Radio 0 Settings Register Bus": "Register Bus Session.gtype", "Radio 1 Settings Register Bus": "Register Bus Session.gtype", "Radio Settings Bus Semaphore": "Semaphore.gtype", "DB Queues": "DB Queue Reference.gtype"[], "Characterization Data Valid?": bool, "EEPROM Header": "EEPROM Header.gtype", "Device Data Header": "EEPROM Device Data Header.gtype", "EEPROM Characterization Header": "EEPROM Characterization Header.gtype", "Characterization Data": "Characterization Data.gtype"[], "FPGA Current Version": u32, "FPGA Oldest Compatible Version": u32, "Fixed Logic Current Version": u32, "Fixed Logic Oldest Compatible Version": u32, "FPGA Radio Settings Bus Current Version": u32, "FPGA Radio Settings Bus Oldest Compatible Version": u32, "FPGA Board Config Current Version": u32, "FPGA Board Config Oldest Compatible Version": u32, "Daughterboard Clock Rate": u32}
  T1 = cluster{"FPGA ref": any, "bus instance": u32, "instruction FIFO depth": u32, "executing on FPGA target": bool, "show error call chain": bool}
  T2 = cluster{"Actual Gain [dB]": f64, "Attenuation Table Index": i32}
  T3 = cluster{"Attenuation Table [dB]": f64[][], "Frequencies [Hz]": f64[], "IQ Imbalance Table": "IQ Imbalance.gtype"[], "Gain Table": T2[][]}
  T4 = cluster{"FlexRIO Register Bus": Queue<T1>, "RX Characterization Data": T3, "TX Characterization Data": T3, "FPGA Interface": any}
  T5 = cluster{"transport block size": u32, "CRC ok": bool, "user data": u32}
  "Link Direction.gtype" = enum{"DL", "UL"}
  T6 = cluster{"MAC Stub RX Payload Information FIFO": RTFifoRefnum<"MAC Stub RX Payload Information.gtype">, "MAC Stub RX Confirmation Information FIFO": RTFifoRefnum<u64[16]>, "MAC Stub RX UL Payload Information FIFO": RTFifoRefnum<f64[23]>}
  T7 = cluster{"MAC Stub TX Input Terminals FIFO": RTFifoRefnum<"MAC Stub TX Input Terminals.gtype">, "MAC Stub TX Output Terminals FIFO": RTFifoRefnum<"MAC Stub TX Output Terminals.gtype">}
  T8 = cluster{"MAC Stub RX Interface": T6, "MAC Stub TX Interface": T7}
  "Host Session.gtype" = cluster{"target": enum{"USRP", "FlexRIO"}, "real time mode": bool, "MAC Stub enabled": bool, "DMA FIFO read timeout": i32, "timed loop period": i64, "LTE Transport Sessions": "Transport Session.gtype"[], "USRP session": "niUsrpRio Session.gtype", "FlexRIO session": T4, "UDP RX session": UdpNetworkConnectionRefnum, "UDP TX session": UdpNetworkConnectionRefnum, "sync found FIFO": RTFifoRefnum<bool>, "PDCCH CRC OK FIFO": RTFifoRefnum<bool>, "DL PDCCH status FIFO": RTFifoRefnum<cluster{"CRC ok": bool, "subframe number": u32}>, "DL PDSCH status FIFO": RTFifoRefnum<cluster{"CRC ok": bool, "subframe number": u32}>, "DL SINR FIFO": RTFifoRefnum<f64[]>, "PDSCH user data FIFO": RTFifoRefnum<u32>, "PDSCH user data UDP FIFO": RTFifoRefnum<T5>, "PDSCH user data throughput FIFO": RTFifoRefnum<T5>, "PUSCH user data FIFO": RTFifoRefnum<u32>, "PUSCH user data UDP FIFO": RTFifoRefnum<T5>, "PUSCH user data throughput FIFO": RTFifoRefnum<T5>, "UE feedback info FIFO": RTFifoRefnum<u8[]>, "Request information FIFO": RTFifoRefnum<"Request Information.gtype">, "UDP TX outbound FIFO": RTFifoRefnum<u8[]>, "UDP RX inbound FIFO": RTFifoRefnum<u8[]>, "stop notifier": Notifier<string>, "DL RX scope": string, "UL RX scope": string, "external MAC log file": string, "external MAC process ID": u32, "TX link direction": "Link Direction.gtype", "RX link direction": "Link Direction.gtype", "Sychronization FIFO": RTFifoRefnum<i32>, "RT Loop Interfaces": T8}
  "USRP bandwidth.gtype" = enum{"40 MHz", "120 MHz", "160 MHz"}
  T9 = cluster{"read mode": enum{"polling", "blocking"}, "write mode": enum{"polling", "blocking"}}
  "Message Type ID Defined.gtype" = u16
  "General Message Header.gtype" = cluster{"message type ID": "Message Type ID Defined.gtype", "reference ID": u16, "instance ID": u8}
  "SAP Sub Header.gtype" = cluster{"SFN": u16, "TTI index": u8, "number of submessages": u8, "confirmation mode": u8, "Reserved": u32}
  "Request Information.gtype" = cluster{"message header": "General Message Header.gtype", "SAP sub header": "SAP Sub Header.gtype"}
uses:
  NI::USRPRIO::ConfigV1Host::Open 2.gvi
  NI::USRPRIO::ConfigV1Host::Enable Front End.gvi
  AFW::Common::USRP::Check USRP Data Clock Rate and Bandwidth.gvi
  AFW::Common::Set Socket Option.gvi
  AFW::Common::Create Stop Notifier.gvi
  AFW::LTE::Configuration::Setup RT Parameters.gvi
  AFW::LTE::Configuration::Setup RT Interface.gvi
  MIMO::Host::LTE DL RX FIFO Initialization MIMO.gvi
  MIMO::Host::LTE DL TX FIFO Initialization MIMO.gvi
diagram:
  case ($"reference clock source") {
    frame "Internal" {
      w1 = $"reference clock source"
      w2 = default
    }
    frame "REF IN / ClkIn" {
      w1 = "REF IN"
      w2 = default
    }
    frame "GPS" {
      w1 = $"reference clock source"
      w2 = default
    }
    frame "PXI_CLK", Default {
      w3 = error {"status"=TRUE, "code"=1, "source"="PXI_CLK reference clock not supported for USRP target"}
      w1 = "Internal"
      w2 = w3
    }
  }
  case ($"USRP bandwidth") {
    frame "40 MHz" {
      FPGA Open Node(RIO address=$"USRP device", error in=$"error in", run?=FALSE) -> (error out=w5, reference out=w4)
    }
    frame "120 MHz" {
      FPGA Open Node(RIO address=$"USRP device", error in=$"error in", run?=FALSE) -> (error out=w5, reference out=w4)
    }
    frame "160 MHz" {
      FPGA Open Node(RIO address=$"USRP device", error in=$"error in", run?=FALSE) -> (error out=w5, reference out=w4)
    }
  }
  FPGA Download Node(error in=w5, reference in=w4) -> (error out=w6, reference out=w7)
  FPGA Run Node(error in=w6, reference in=w7) -> (error out=w8, reference out=w9)
  Merge Errors(w8, w2) -> (error out=w10)
  call "Open 2.gvi"(fpga ref=w9, reference frequency source=w1, gpsdo power enable=TRUE, timeout=1, error in=w10, scope="") -> (niusrprio session out=w11, error out=w12)
  call "Enable Front End.gvi"(niusrprio session in=w11, enable=FALSE, error in=w12, scope="rx") -> (niusrprio session out=w13, error out=w14)
  call "Enable Front End.gvi"(niusrprio session in=w13, enable=FALSE, error in=w14, scope="tx") -> (niusrprio session out=w15, error out=w16)
  call "Check USRP Data Clock Rate and Bandwidth.gvi"(niusrprio session in=w15, error in=w16) -> (niusrprio session out=w17, error out=w18)
  w19 = 0xFFFF  # level SOL_SOCKET
  w20 = 0x1001  # optname SO_SNDBUF
  w21 = 1024000  # buffer size in bytes
  Udp Open(error in=w18, net address=0, port=0, service name="", timeout ms=25000) -> (connection ID=w22, error out=w23)
  call "Set Socket Option.gvi"(connection in=w22, level=w19, option name=w20, value=w21, error in=w23) -> (connection out=w24, error out=w25)
  RTFIFO Create(create if not found?=TRUE, error in=w25, name="", r/w modes=T9 {"read mode"="blocking", "write mode"="blocking"}, size=10000, type=bool FALSE) -> (error out=w26, rt fifo=w27)
  RTFIFO Create(create if not found?=TRUE, error in=w26, name="", r/w modes=T9 {"read mode"="blocking", "write mode"="blocking"}, size=10000, type=bool FALSE) -> (error out=w28, rt fifo=w29)
  w30 = cluster{"CRC ok": bool, "subframe number": u32} {all zero or empty}
  RTFIFO Create(create if not found?=TRUE, error in=w28, name="", r/w modes=T9 {"read mode"="blocking", "write mode"="blocking"}, size=10000, type=w30) -> (error out=w31, rt fifo=w32)
  RTFIFO Create(create if not found?=TRUE, error in=w31, name="", r/w modes=T9 {"read mode"="blocking", "write mode"="blocking"}, size=10000, type=w30) -> (error out=w33, rt fifo=w34)
  RTFIFO Create(create if not found?=TRUE, elements in array=14, error in=w33, name="", r/w modes=T9 {"read mode"="blocking", "write mode"="blocking"}, size=10000, type=f64[] []) -> (error out=w35, rt fifo=w36)
  RTFIFO Create(create if not found?=TRUE, error in=w35, name="", r/w modes=T9 {"read mode"="blocking", "write mode"="blocking"}, size=10000, type=u32 0) -> (error out=w37, rt fifo=w38)
  RTFIFO Create(create if not found?=TRUE, error in=w37, name="", r/w modes=T9 {"read mode"="blocking", "write mode"="blocking"}, size=10000, type=T5 {all zero or empty}) -> (error out=w39, rt fifo=w40)
  RTFIFO Create(create if not found?=TRUE, error in=w39, name="", r/w modes=T9 {"read mode"="blocking", "write mode"="blocking"}, size=10000, type=T5 {all zero or empty}) -> (error out=w41, rt fifo=w42)
  call "Create Stop Notifier.gvi"(error in=w41) -> (stop notifier=w43, error out=w44)
  Not(x=$"external MAC") -> w45
  call "Setup RT Parameters.gvi"(MAC Stub enabled?=w45, command line=$command, arguments=$arguments, error in=w44, transport instance id=$"transport instance id") -> (log file=w46, process ID=w47, real time mode=w48, DMA FIFO read timeout (ms)=w49, timed loop period=w50, error out=w51, LTE Transport Sessions=w52)
  RTFIFO Create(error in=w51, name="Request information FIFO", r/w modes=T9 {"read mode"="blocking", "write mode"="blocking"}, size=10, type="Request Information.gtype" {all zero or empty}) -> (error out=w53, rt fifo=w54)
  RTFIFO Create(elements in array=65535, error in=w53, name="UDP TX outbound FIFO", r/w modes=T9 {"read mode"="blocking", "write mode"="blocking"}, size=100, type=u8[] []) -> (error out=w55, rt fifo=w56)
  RTFIFO Create(elements in array=65535, error in=w55, name="UDP RX inbound FIFO", r/w modes=T9 {"read mode"="blocking", "write mode"="blocking"}, size=100, type=u8[] []) -> (error out=w57, rt fifo=w58)
  RTFIFO Create(elements in array=1, error in=w57, name="Synchronization FIFO", r/w modes=T9 {"read mode"="blocking", "write mode"="blocking"}, size=1, type=i32 0) -> (error out=w59, rt fifo=w60)
  call "Setup RT Interface.gvi"(error in=w59) -> (RT Loop Interfaces=w61, error out=w62)
  Property Node(instance in=$"Host Session", "USRP session"=w17, "UDP RX session"=w24, "sync found FIFO"=w27, "PDCCH CRC OK FIFO"=w29, "DL PDCCH status FIFO"=w32, "DL PDSCH status FIFO"=w34, "DL SINR FIFO"=w36, "PDSCH user data FIFO"=w38, "PDSCH user data UDP FIFO"=w40, "PDSCH user data throughput FIFO"=w42, "stop notifier"=w43, "real time mode"=w48, "DMA FIFO read timeout"=w49, "timed loop period"=w50, "MAC Stub enabled"=w45, "LTE Transport Sessions"=w52, "Request information FIFO"=w54, "UDP TX outbound FIFO"=w56, "UDP RX inbound FIFO"=w58, "external MAC process ID"=w47, "external MAC log file"=w46, "Sychronization FIFO"=w60, "RT Loop Interfaces"=w61, "TX link direction"="DL", "RX link direction"="DL") -> (instance out=w63)
  $"session out" <- w63
  call "LTE DL RX FIFO Initialization MIMO.gvi"(session=w63, error in=w62) -> (error out=w64)
  call "LTE DL TX FIFO Initialization MIMO.gvi"(session=w63, error in=w62) -> (error out=w65)
  Merge Errors(w64, w65) -> (error out=w66)
  $"error out" <- w66
