vi "LTE Read RX and TX Spectrum MIMO.gvi"   [LabVIEW NXG 4.0.0]
# Reads RX baseband input data and TX baseband output data from the FPGA and calculates the RX and TX power spectrum.
# Provides trigger signals for displaying the spectrum data on the host top level panel.
inputs:
  "Host Session": "Host Session.gtype" = {"target"="USRP", "MAC Stub enabled"=TRUE, "TX link direction"="DL", "RX link direction"="DL"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}
  "RX power calibration offset [dB]": f64  # Frequency dependent power offset that will be applied to the RX baseband sample stream from the FPGA to ensure that the RX power levels in the displayed spectrum are correct.
  "error in": error
  "RX active": bool  # Boolean that indicates that the receiver is active. The RX display trigger is only generated when the receiver is active.
  "RX coerced gain [dB]": f64 = -10  # Coerced RX gain used for RX spectrum magnitude correction because RX values on the FPGA are captured after RX gain was applied.
  "TX coerced gain [dB]": f64 = 10  # Coerced TX gain used for TX spectrum magnitude correction.
  "counter": i32  # Loop iteration counter of calling loop used for displaying only parts of the calculated data. Displaying partial data reduces CPU load.
outputs:
  "update TX spectrum": bool  # Trigger for displaying the TX baseband output data on the host top level panel.
  "TX power spectrum": T1  # Calculated TX power spectrum for 1 subframe (30,720 samples).
  "error out": error
  "TX power spectrum AP1": T1
  "update RX spectrum": bool  # Trigger for displaying the RX baseband input data on the host top level panel.
  "RX power spectrum": T1  # Calculated RX power spectrum for 1 subframe (30720 samples).
  "RX power spectrum AP1": T1
  "TX baseband data": c128[]
  "TX baseband data AP1": c128[]
  "RX data AP0": c128[]
  "RX data AP1": c128[]
types:
  T1 = cluster{"f0": f64, "df": f64, "magnitude": f64[]}
  "Transport Session.gtype" = cluster{"FIFO pathname": string, "pipe reader": "Pipe Reader.gtype", "pipe writer": "Pipe Writer.gtype", "transport in RT FIFO": RTFifoRefnum<u8[]>, "transport out RT FIFO": RTFifoRefnum<u8[]>, "transport in timing source name": string, "transport in timing trigger ID": u8, "transport out timing source name": string, "transport out timing trigger ID": u8, "maximum API message size": u32}
  "Register Bus Session.gtype" = Queue<"Session Data.gtype">
  "Semaphore.gtype" = i32
  "DB Queue Reference.gtype" = Queue<"Daughterboard Data.gtype">
  "niUsrpRio Session.gtype" = cluster{"FPGA Interface": any, "RIO Interface Number": u32, "Data Clock Rate": u32, "FPGA Data Clock Rate": u32, "Global Settings Register Bus": "Register Bus Session.gtype", "Radio 0 Settings Register Bus": "Register Bus Session.gtype", "Radio 1 Settings Register Bus": "Register Bus Session.gtype", "Radio Settings Bus Semaphore": "Semaphore.gtype", "DB Queues": "DB Queue Reference.gtype"[], "Characterization Data Valid?": bool, "EEPROM Header": "EEPROM Header.gtype", "Device Data Header": "EEPROM Device Data Header.gtype", "EEPROM Characterization Header": "EEPROM Characterization Header.gtype", "Characterization Data": "Characterization Data.gtype"[], "FPGA Current Version": u32, "FPGA Oldest Compatible Version": u32, "Fixed Logic Current Version": u32, "Fixed Logic Oldest Compatible Version": u32, "FPGA Radio Settings Bus Current Version": u32, "FPGA Radio Settings Bus Oldest Compatible Version": u32, "FPGA Board Config Current Version": u32, "FPGA Board Config Oldest Compatible Version": u32, "Daughterboard Clock Rate": u32}
  T2 = cluster{"FPGA ref": any, "bus instance": u32, "instruction FIFO depth": u32, "executing on FPGA target": bool, "show error call chain": bool}
  T3 = cluster{"Actual Gain [dB]": f64, "Attenuation Table Index": i32}
  T4 = cluster{"Attenuation Table [dB]": f64[][], "Frequencies [Hz]": f64[], "IQ Imbalance Table": "IQ Imbalance.gtype"[], "Gain Table": T3[][]}
  T5 = cluster{"FlexRIO Register Bus": Queue<T2>, "RX Characterization Data": T4, "TX Characterization Data": T4, "FPGA Interface": any}
  T6 = cluster{"transport block size": u32, "CRC ok": bool, "user data": u32}
  "Link Direction.gtype" = enum{"DL", "UL"}
  T7 = cluster{"MAC Stub RX Payload Information FIFO": RTFifoRefnum<"MAC Stub RX Payload Information.gtype">, "MAC Stub RX Confirmation Information FIFO": RTFifoRefnum<u64[16]>, "MAC Stub RX UL Payload Information FIFO": RTFifoRefnum<f64[23]>}
  T8 = cluster{"MAC Stub TX Input Terminals FIFO": RTFifoRefnum<"MAC Stub TX Input Terminals.gtype">, "MAC Stub TX Output Terminals FIFO": RTFifoRefnum<"MAC Stub TX Output Terminals.gtype">}
  T9 = cluster{"MAC Stub RX Interface": T7, "MAC Stub TX Interface": T8}
  "Host Session.gtype" = cluster{"target": enum{"USRP", "FlexRIO"}, "real time mode": bool, "MAC Stub enabled": bool, "DMA FIFO read timeout": i32, "timed loop period": i64, "LTE Transport Sessions": "Transport Session.gtype"[], "USRP session": "niUsrpRio Session.gtype", "FlexRIO session": T5, "UDP RX session": UdpNetworkConnectionRefnum, "UDP TX session": UdpNetworkConnectionRefnum, "sync found FIFO": RTFifoRefnum<bool>, "PDCCH CRC OK FIFO": RTFifoRefnum<bool>, "DL PDCCH status FIFO": RTFifoRefnum<cluster{"CRC ok": bool, "subframe number": u32}>, "DL PDSCH status FIFO": RTFifoRefnum<cluster{"CRC ok": bool, "subframe number": u32}>, "DL SINR FIFO": RTFifoRefnum<f64[]>, "PDSCH user data FIFO": RTFifoRefnum<u32>, "PDSCH user data UDP FIFO": RTFifoRefnum<T6>, "PDSCH user data throughput FIFO": RTFifoRefnum<T6>, "PUSCH user data FIFO": RTFifoRefnum<u32>, "PUSCH user data UDP FIFO": RTFifoRefnum<T6>, "PUSCH user data throughput FIFO": RTFifoRefnum<T6>, "UE feedback info FIFO": RTFifoRefnum<u8[]>, "Request information FIFO": RTFifoRefnum<"Request Information.gtype">, "UDP TX outbound FIFO": RTFifoRefnum<u8[]>, "UDP RX inbound FIFO": RTFifoRefnum<u8[]>, "stop notifier": Notifier<string>, "DL RX scope": string, "UL RX scope": string, "external MAC log file": string, "external MAC process ID": u32, "TX link direction": "Link Direction.gtype", "RX link direction": "Link Direction.gtype", "Sychronization FIFO": RTFifoRefnum<i32>, "RT Loop Interfaces": T9}
uses:
  Host subvis MIMO::LTE Read TX Data MIMO.gvi
  Host subvis MIMO::LTE Read RX Data MIMO.gvi
diagram:
  call "LTE Read TX Data MIMO.gvi"(Host Session=$"Host Session", counter=$counter, error in=$"error in") -> (TX baseband data=w1, TX baseband data AP1=w2, error out=w3, display TX spectrum=w4)
  call "LTE Calculate TX Power Spectrum MIMO.gvi"(TX data=w1, TX data AP1=w2, coerced gain [dB]=$"TX coerced gain [dB]", error in=w3) -> (TX power spectrum=w5, TX power spectrum AP1=w6, error out=w7, TXDataCDB_AP0=w8, TXDataCDB_AP1=w9)
  $"TX baseband data" <- w8
  $"TX baseband data AP1" <- w9
  $"update TX spectrum" <- w4
  $"TX power spectrum" <- w5
  $"TX power spectrum AP1" <- w6
  call "LTE Read RX Data MIMO.gvi"(Host Session=$"Host Session", RX active=$"RX active", counter=$counter, error in=$"error in") -> (RX data AP0=w10, RX data AP1=w11, error out=w12, display RX spectrum=w13)
  $"update RX spectrum" <- w13
  call "LTE Calculate RX Power Spectrum MIMO.gvi"(power calibration offset [dB]=$"RX power calibration offset [dB]", RX data AP0=w10, RX data AP1=w11, coerced gain [dB]=$"RX coerced gain [dB]", error in=w12) -> (RX power spectrum AP0=w14, RX power spectrum AP1=w15, error out=w16, RXDataCDB_AP0=w17, RXDataCDB_AP1=w18)
  $"RX power spectrum" <- w14
  $"RX power spectrum AP1" <- w15
  Merge Errors(w7, w16) -> (error out=w19)
  $"error out" <- w19
  $"RX data AP0" <- w17
  $"RX data AP1" <- w18
