vi "LTE Send Dynamic DL RX Configuration MIMO.gvi"   [LabVIEW NXG 4.0.0]
# Prepares the TTI configuration for the downlink receiver (DL RX), consisting of the UE context (dynamic DL configuration).
inputs:
  "Host Session": "Host Session.gtype" = {"target"="USRP", "MAC Stub enabled"=TRUE, "TX link direction"="DL", "RX link direction"="DL"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}
  "UE context": T1 = {"RNTI"=10, "use UERS"=FALSE, "antenna port"=7, "CCE offset"=0}  # Per subframe changeable UE specific parameter set (RNTI, CCE offset, UERS configuration).
  "error in": error
outputs:
  "error out": error
panel controls:
  "FPGA type": any
types:
  T1 = cluster{"RNTI": u16, "use UERS": bool, "antenna port": UFXP(4.0), "CCE offset": u8}
  "Transport Session.gtype" = cluster{"FIFO pathname": string, "pipe reader": "Pipe Reader.gtype", "pipe writer": "Pipe Writer.gtype", "transport in RT FIFO": RTFifoRefnum<u8[]>, "transport out RT FIFO": RTFifoRefnum<u8[]>, "transport in timing source name": string, "transport in timing trigger ID": u8, "transport out timing source name": string, "transport out timing trigger ID": u8, "maximum API message size": u32}
  "Register Bus Session.gtype" = Queue<"Session Data.gtype">
  "Semaphore.gtype" = i32
  "DB Queue Reference.gtype" = Queue<"Daughterboard Data.gtype">
  "niUsrpRio Session.gtype" = cluster{"FPGA Interface": any, "RIO Interface Number": u32, "Data Clock Rate": u32, "FPGA Data Clock Rate": u32, "Global Settings Register Bus": "Register Bus Session.gtype", "Radio 0 Settings Register Bus": "Register Bus Session.gtype", "Radio 1 Settings Register Bus": "Register Bus Session.gtype", "Radio Settings Bus Semaphore": "Semaphore.gtype", "DB Queues": "DB Queue Reference.gtype"[], "Characterization Data Valid?": bool, "EEPROM Header": "EEPROM Header.gtype", "Device Data Header": "EEPROM Device Data Header.gtype", "EEPROM Characterization Header": "EEPROM Characterization Header.gtype", "Characterization Data": "Characterization Data.gtype"[], "FPGA Current Version": u32, "FPGA Oldest Compatible Version": u32, "Fixed Logic Current Version": u32, "Fixed Logic Oldest Compatible Version": u32, "FPGA Radio Settings Bus Current Version": u32, "FPGA Radio Settings Bus Oldest Compatible Version": u32, "FPGA Board Config Current Version": u32, "FPGA Board Config Oldest Compatible Version": u32, "Daughterboard Clock Rate": u32}
  T2 = cluster{"FPGA ref": any, "bus instance": u32, "instruction FIFO depth": u32, "executing on FPGA target": bool, "show error call chain": bool}
  T3 = cluster{"Actual Gain [dB]": f64, "Attenuation Table Index": i32}
  T4 = cluster{"Attenuation Table [dB]": f64[][], "Frequencies [Hz]": f64[], "IQ Imbalance Table": "IQ Imbalance.gtype"[], "Gain Table": T3[][]}
  T5 = cluster{"FlexRIO Register Bus": Queue<T2>, "RX Characterization Data": T4, "TX Characterization Data": T4, "FPGA Interface": any}
  T6 = cluster{"transport block size": u32, "CRC ok": bool, "user data": u32}
  "Link Direction.gtype" = enum{"DL", "UL"}
  T7 = cluster{"MAC Stub RX Payload Information FIFO": RTFifoRefnum<"MAC Stub RX Payload Information.gtype">, "MAC Stub RX Confirmation Information FIFO": RTFifoRefnum<u64[16]>, "MAC Stub RX UL Payload Information FIFO": RTFifoRefnum<f64[23]>}
  T8 = cluster{"MAC Stub TX Input Terminals FIFO": RTFifoRefnum<"MAC Stub TX Input Terminals.gtype">, "MAC Stub TX Output Terminals FIFO": RTFifoRefnum<"MAC Stub TX Output Terminals.gtype">}
  T9 = cluster{"MAC Stub RX Interface": T7, "MAC Stub TX Interface": T8}
  "Host Session.gtype" = cluster{"target": enum{"USRP", "FlexRIO"}, "real time mode": bool, "MAC Stub enabled": bool, "DMA FIFO read timeout": i32, "timed loop period": i64, "LTE Transport Sessions": "Transport Session.gtype"[], "USRP session": "niUsrpRio Session.gtype", "FlexRIO session": T5, "UDP RX session": UdpNetworkConnectionRefnum, "UDP TX session": UdpNetworkConnectionRefnum, "sync found FIFO": RTFifoRefnum<bool>, "PDCCH CRC OK FIFO": RTFifoRefnum<bool>, "DL PDCCH status FIFO": RTFifoRefnum<cluster{"CRC ok": bool, "subframe number": u32}>, "DL PDSCH status FIFO": RTFifoRefnum<cluster{"CRC ok": bool, "subframe number": u32}>, "DL SINR FIFO": RTFifoRefnum<f64[]>, "PDSCH user data FIFO": RTFifoRefnum<u32>, "PDSCH user data UDP FIFO": RTFifoRefnum<T6>, "PDSCH user data throughput FIFO": RTFifoRefnum<T6>, "PUSCH user data FIFO": RTFifoRefnum<u32>, "PUSCH user data UDP FIFO": RTFifoRefnum<T6>, "PUSCH user data throughput FIFO": RTFifoRefnum<T6>, "UE feedback info FIFO": RTFifoRefnum<u8[]>, "Request information FIFO": RTFifoRefnum<"Request Information.gtype">, "UDP TX outbound FIFO": RTFifoRefnum<u8[]>, "UDP RX inbound FIFO": RTFifoRefnum<u8[]>, "stop notifier": Notifier<string>, "DL RX scope": string, "UL RX scope": string, "external MAC log file": string, "external MAC process ID": u32, "TX link direction": "Link Direction.gtype", "RX link direction": "Link Direction.gtype", "Sychronization FIFO": RTFifoRefnum<i32>, "RT Loop Interfaces": T9}
  T10 = cluster{"valid": bool, "resource allocation header": UFXP(1.0), "resource block allocation": UFXP(25.0), "MCS": UFXP(5.0), "HARQ process number": UFXP(4.0), "new data indicator": bool, "redundancy version": UFXP(2.0), "TPC command for pucch": UFXP(2.0), "DL assignment index": UFXP(2.0), "MIMO flag": bool}
uses:
  AFW::LTE::RF Control::Unbundle Session.gvi
diagram:
  call "Unbundle Session.gvi"(session=$"Host Session") -> (DL FPGA Interface=w1)
  Type Cast(type=$"FPGA type", x=w1) -> w2
  Property Node(instance in=$"UE context") -> ("CCE offset"=w3, "antenna port"=w4, "RNTI"=w5, "use UERS"=w6)
  w7 = cluster{"UE config": T1, "DCI message": T10} {all zero or empty}
  Property Node(instance in=w7, "UE config:RNTI"=w5, "UE config:use UERS"=w6, "UE config:antenna port"=w4, "UE config:CCE offset"=w3) -> (instance out=w8)
  call "LTE DL TTI Configuration To U64 MIMO.gvi"(TTI configuration cluster=w8) -> (TTI configuration out=w9)
  Build Array(w9) -> w10
  Host Fifo Write Node[FifoName="LTE AFW Resources.grsc::H2T DL RX Dynamic Configuration"](data=w10, error in=$"error in", reference in=w2) -> (error out=w11)
  $"error out" <- w11
