vi "LTE Setup DL TX Baseband MIMO.gvi"   [LabVIEW NXG 4.0.0]
# Maps DL TX configuration controls on the host top level panel to the corresponding types used on the FPGA and writes the resulting configuration to the FPGA target.
# Opens a UDP socket on the provided port and stores the connection ID into the session cluster. Other nodes use this socket to read the data used as PDSCH payload.
inputs:
  "Host Session": "Host Session.gtype" = {"target"="USRP", "MAC Stub enabled"=TRUE, "TX link direction"="DL", "RX link direction"="DL"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}
  "UDP receive port": u16 = 50000  # Local port where you want to create a UDP socket.
  "frame structure": enum{"FDD", "TDD 5 5"} = "TDD 5 5"  # Defines whether the frame structure is based on TDD LTE or FDD LTE. Refer to the LTE Specification 3GPP TS 36.211 to read about the LTE frame structure.
  "cell ID": u16  # The physical layer cell identity as defined in TS 36.211.
  "UE context": T3 = {"RNTI"=10, "Use UERS"=FALSE, "Antenna Port"=7, "CCE Offset"=0}  # Per subframe changeable UE specific parameter set (RNTI, CCE offset, UERS configuration).
  "error in": error
  "DCI": T2 = {"Active"=TRUE, "MCS"="MCS 17 (64-QAM, rate ~0.43)", "Resource Block Allocation (4 PRB/bit)"=8388607, "MIMO flag"=FALSE}  # The DCI message in the way it is configured on the host, containing only a subset (MCS, Resource Block Allocation, and Active) of the full DCI message which is used on the FPGA.
outputs:
  "session out": "Host Session.gtype"
  "error out": error
types:
  T1 = enum{"MCS 0 (QPSK, rate ~0.12)", "MCS 1 (QPSK, rate ~0.15)", "MCS 2 (QPSK, rate ~0.19)", "MCS 3 (QPSK, rate ~0.25)", "MCS 4 (QPSK, rate ~0.30)", "MCS 5 (QPSK, rate ~0.37)", "MCS 6 (QPSK, rate ~0.44)", "MCS 7 (QPSK, rate ~0.51)", "MCS 8 (QPSK, rate ~0.59)", "MCS 9 (QPSK, rate ~0.66)", "MCS 10 (16-QAM, rate ~0.33)", "MCS 11 (16-QAM, rate ~0.37)", "MCS 12 (16-QAM, rate ~0.42)", "MCS 13 (16-QAM, rate ~0.48)", "MCS 14 (16-QAM, rate ~0.54)", "MCS 15 (16-QAM, rate ~0.60)", "MCS 16 (16-QAM, rate ~0.64)", "MCS 17 (64-QAM, rate ~0.43)", "MCS 18 (64-QAM, rate ~0.46)", "MCS 19 (64-QAM, rate ~0.50)", "MCS 20 (64-QAM, rate ~0.55)", "MCS 21 (64-QAM, rate ~0.60)", "MCS 22 (64-QAM, rate ~0.65)", "MCS 23 (64-QAM, rate ~0.70)", "MCS 24 (64-QAM, rate ~0.75)", "MCS 25 (64-QAM, rate ~0.80)", "MCS 26 (64-QAM, rate ~0.85)", "MCS 27 (64-QAM, rate ~0.89)", "MCS 28 (64-QAM, rate ~0.93)"}
  T2 = cluster{"Active": bool, "MCS": T1, "Resource Block Allocation (4 PRB/bit)": UFXP(25.0), "MIMO flag": bool}
  T3 = cluster{"RNTI": u16, "Use UERS": bool, "Antenna Port": UFXP(4.0), "CCE Offset": u8}
  "Transport Session.gtype" = cluster{"FIFO pathname": string, "pipe reader": "Pipe Reader.gtype", "pipe writer": "Pipe Writer.gtype", "transport in RT FIFO": RTFifoRefnum<u8[]>, "transport out RT FIFO": RTFifoRefnum<u8[]>, "transport in timing source name": string, "transport in timing trigger ID": u8, "transport out timing source name": string, "transport out timing trigger ID": u8, "maximum API message size": u32}
  "Register Bus Session.gtype" = Queue<"Session Data.gtype">
  "Semaphore.gtype" = i32
  "DB Queue Reference.gtype" = Queue<"Daughterboard Data.gtype">
  "niUsrpRio Session.gtype" = cluster{"FPGA Interface": any, "RIO Interface Number": u32, "Data Clock Rate": u32, "FPGA Data Clock Rate": u32, "Global Settings Register Bus": "Register Bus Session.gtype", "Radio 0 Settings Register Bus": "Register Bus Session.gtype", "Radio 1 Settings Register Bus": "Register Bus Session.gtype", "Radio Settings Bus Semaphore": "Semaphore.gtype", "DB Queues": "DB Queue Reference.gtype"[], "Characterization Data Valid?": bool, "EEPROM Header": "EEPROM Header.gtype", "Device Data Header": "EEPROM Device Data Header.gtype", "EEPROM Characterization Header": "EEPROM Characterization Header.gtype", "Characterization Data": "Characterization Data.gtype"[], "FPGA Current Version": u32, "FPGA Oldest Compatible Version": u32, "Fixed Logic Current Version": u32, "Fixed Logic Oldest Compatible Version": u32, "FPGA Radio Settings Bus Current Version": u32, "FPGA Radio Settings Bus Oldest Compatible Version": u32, "FPGA Board Config Current Version": u32, "FPGA Board Config Oldest Compatible Version": u32, "Daughterboard Clock Rate": u32}
  T4 = cluster{"FPGA ref": any, "bus instance": u32, "instruction FIFO depth": u32, "executing on FPGA target": bool, "show error call chain": bool}
  T5 = cluster{"Actual Gain [dB]": f64, "Attenuation Table Index": i32}
  T6 = cluster{"Attenuation Table [dB]": f64[][], "Frequencies [Hz]": f64[], "IQ Imbalance Table": "IQ Imbalance.gtype"[], "Gain Table": T5[][]}
  T7 = cluster{"FlexRIO Register Bus": Queue<T4>, "RX Characterization Data": T6, "TX Characterization Data": T6, "FPGA Interface": any}
  T8 = cluster{"transport block size": u32, "CRC ok": bool, "user data": u32}
  "Link Direction.gtype" = enum{"DL", "UL"}
  T9 = cluster{"MAC Stub RX Payload Information FIFO": RTFifoRefnum<"MAC Stub RX Payload Information.gtype">, "MAC Stub RX Confirmation Information FIFO": RTFifoRefnum<u64[16]>, "MAC Stub RX UL Payload Information FIFO": RTFifoRefnum<f64[23]>}
  T10 = cluster{"MAC Stub TX Input Terminals FIFO": RTFifoRefnum<"MAC Stub TX Input Terminals.gtype">, "MAC Stub TX Output Terminals FIFO": RTFifoRefnum<"MAC Stub TX Output Terminals.gtype">}
  T11 = cluster{"MAC Stub RX Interface": T9, "MAC Stub TX Interface": T10}
  "Host Session.gtype" = cluster{"target": enum{"USRP", "FlexRIO"}, "real time mode": bool, "MAC Stub enabled": bool, "DMA FIFO read timeout": i32, "timed loop period": i64, "LTE Transport Sessions": "Transport Session.gtype"[], "USRP session": "niUsrpRio Session.gtype", "FlexRIO session": T7, "UDP RX session": UdpNetworkConnectionRefnum, "UDP TX session": UdpNetworkConnectionRefnum, "sync found FIFO": RTFifoRefnum<bool>, "PDCCH CRC OK FIFO": RTFifoRefnum<bool>, "DL PDCCH status FIFO": RTFifoRefnum<cluster{"CRC ok": bool, "subframe number": u32}>, "DL PDSCH status FIFO": RTFifoRefnum<cluster{"CRC ok": bool, "subframe number": u32}>, "DL SINR FIFO": RTFifoRefnum<f64[]>, "PDSCH user data FIFO": RTFifoRefnum<u32>, "PDSCH user data UDP FIFO": RTFifoRefnum<T8>, "PDSCH user data throughput FIFO": RTFifoRefnum<T8>, "PUSCH user data FIFO": RTFifoRefnum<u32>, "PUSCH user data UDP FIFO": RTFifoRefnum<T8>, "PUSCH user data throughput FIFO": RTFifoRefnum<T8>, "UE feedback info FIFO": RTFifoRefnum<u8[]>, "Request information FIFO": RTFifoRefnum<"Request Information.gtype">, "UDP TX outbound FIFO": RTFifoRefnum<u8[]>, "UDP RX inbound FIFO": RTFifoRefnum<u8[]>, "stop notifier": Notifier<string>, "DL RX scope": string, "UL RX scope": string, "external MAC log file": string, "external MAC process ID": u32, "TX link direction": "Link Direction.gtype", "RX link direction": "Link Direction.gtype", "Sychronization FIFO": RTFifoRefnum<i32>, "RT Loop Interfaces": T11}
  T12 = cluster{"total number of REGs": u16, "aggregation level": u16, "DCI message length": u8}
  T13 = cluster{"cell ID": u16, "number of antenna ports": u8, "frame structure": enum{"FDD", "TDD 5 5"}, "enable T2H transfer": bool, "PDCCH": T12}
uses:
  AFW::LTE::RF Control::Unbundle Session.gvi
  AFW::Common::Set Socket Option.gvi
  Host subvis MIMO::LTE Send Dynamic DL TX Configuration MIMO.gvi
diagram:
  w1 = 0xFFFF  # level SOL_SOCKET
  w2 = 0x1002  # optname SO_RCVBUF
  w3 = 1024000  # buffer size in bytes
  Property Node(instance in=T13 {0, 2, 0, TRUE, 200, 2, 32}, "frame structure"=$"frame structure", "cell ID"=$"cell ID") -> (instance out=w4)
  call "Unbundle Session.gvi"(session=$"Host Session") -> (DL FPGA Interface=w5)
  Type Cast(type=any constant, x=w5) -> w6
  Property Node(instance in=w6, "DL TX static parameters"=w4, "transfer full DL TX frame"=FALSE, "number of TX IFFT output bits shifted"=7, "use DL TX RF start trigger"=TRUE, "TX RT mode"=FALSE, error in=$"error in") -> (error out=w7)
  Udp Open(error in=w7, net address=0, port=$"UDP receive port", service name="", timeout ms=25000) -> (connection ID=w8, error out=w9)
  call "Set Socket Option.gvi"(connection in=w8, level=w1, option name=w2, value=w3, error in=w9) -> (connection out=w10, error out=w11)
  Property Node(instance in=$"Host Session", "UDP TX session"=w10) -> (instance out=w12)
  $"session out" <- w12
  case (FALSE) {
    frame False, Default {
      call "LTE Send Dynamic DL TX Configuration MIMO.gvi"(Host Session=$"Host Session", UE context=$"UE context", DCI in=$DCI, error in=w11) -> (error out=w13)
    }
    frame True {
      w13 = w11
    }
  }
  $"error out" <- w13
