vi "LTE FPGA Top.gvi"   [LabVIEW NXG 4.0.0]
panel controls:
  "reg.host read.go rcvd 0": bool
  "reg.notify host.go rcvd 0": bool
  "reg.reset 0": bool
  "RF 0/Rx/Enable": bool
  "RF 0/Tx/Enable": bool
  "RF 1/Rx/Enable": bool
  "RF 1/Tx/Enable": bool
  "rx.reset": bool = TRUE
  "rx.abort": bool
  "tx.abort": bool
  "tx.reset": bool = TRUE
  "rx 0.stream enable": bool
  "rx 1.stream enable": bool
  "tx 0.stream enable": bool
  "tx 1.stream enable": bool
  "TX start trigger count": u32 = 1200000
  "RX RF channel": i32 = 2
  "enable DC offset correction": bool
  "TX RF channel": i32 = 2
  "BB processing delay": u32
  "TX RF trigger offset": i32
  "DL TX active": bool
  "use DL TX RF start trigger": bool = TRUE
  "transfer full DL TX frame": bool
  "DL debug MAC settings": T1
  "number of DL TX IFFT output bits shifted": u8
  "DL TX RT mode": bool
  "DL TX static parameters": T3 = {0, 0, 1, FALSE, 200, 2, 32}
  "DL TX RF Trigger delay": u16
  "transfer full RX stream": bool
  "enable DL RX": bool
  "internal DL loopback": bool
  "DL channel equalizer bypass": bool
  "DL FFT debug channel select": T4
  "DL constellation symbol number (0-13)": u8
  "DL constellation subset": bool
  "use fix PDSCH configuration": bool
  "sync configuration": T7 = {"FFT window timing advance"=-3, "autocorrelation threshold"=1.04308128357e-07, "static CFO"=0, "use static CFO"=FALSE, "CFO factor"=0.0290069580078, "sync operation mode"="Normal", "trigger delay"=0}
  "FO normalization factor": FXP(5.11) = -1
  "constellation select": enum{"DL EQ Output", "PDSCH Dec Input"} = "DL EQ Output"
  "enable frequency tracking": bool = TRUE
  "fix PDSCH configuration": T9 = {"modulation"="64QAM", "RB allocation"=[FALSE, FALSE, FALSE, FALSE, FALSE, FALSE, FALSE, FALSE, FALSE, FALSE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], "decoder"={"number of REs"=0, "modulation"="QPSK", "redundancy version index"=0, "transport block size"=0, "user data"=0}}
  "DL RX RT mode": bool
  "DL RX static parameters": T3 = {0, 0, 1, FALSE, 200, 2, 32}
  "rx.output sample rate": UFXP(1.47)
  "rx.delay": FXP(0.16)
  "rx 0.frequency shift": FXP(0.48)
  "rx 0.phase": FXP(0.21)
  "rx 1.frequency shift": FXP(0.48)
  "rx 1.phase": FXP(0.21)
  "rx 0.impairments": "IQ Impairments.gtype"
  "rx 1.impairments": "IQ Impairments.gtype"
  "tx.input sample rate": UFXP(1.47)
  "tx.delay": FXP(0.18)
  "tx 0.frequency shift": FXP(0.48)
  "tx 0.phase": FXP(0.21)
  "tx 1.frequency shift": FXP(0.48)
  "tx 1.phase": FXP(0.21)
  "tx 0.gain": "IQ Gain.gtype"
  "tx 0.impairments": "IQ Impairments.gtype"
  "tx 1.gain": "IQ Gain.gtype"
  "tx 1.impairments": "IQ Impairments.gtype"
  "transmit without sync": bool = TRUE
  "use independent RX trigger": bool
  "use independent TX trigger": bool = TRUE
  "UL TX active": bool
  "UL TX use RF start trigger": bool = TRUE
  "UL TX single shot": bool
  "transfer full UL TX frame": bool
  "UL debug MAC settings": T1
  "UL debug fix offset values": T12
  "number of UL TX IFFT output bits shifted": u8
  "UL TX static parameters": T13 = {"cell ID"=0, "frame structure"="TDD 5 5", "enable T2H transfer"=FALSE}
  "UL TX RT mode": bool
  "UL channel equalizer bypass": bool
  "UL constellation subset": bool
  "UL constellation symbol number (0-13)": u8
  "UL FFT debug channel select": T14
  "UL RX static parameters": T13 = {"cell ID"=0, "frame structure"="TDD 5 5", "enable T2H transfer"=FALSE}
  "UL RX RT mode": bool
  "number of channel estimate samples": u16
  "reset channel estimates": bool
panel indicators:
  "reg.notify host.go 0": bool
  "rx.samples processed": u32
  "rx.number of clipped IQ data samples": u64
  "rx.number of overflows": u32
  "tx.samples processed": u32
  "tx.underflows": u32
  "tx.number of clipped IQ data samples": u64
  "rx.dsp reset done": bool
  "tx.dsp reset done": bool
  "ADC values clipped": bool
  "TX trigger generated count": u32
  "TS DL TX FIFO to DACs overflow": u16
  "DL trigger received count": u32
  "TS internal DL loopback FIFO overflow": u16
  "T2H DL TX BB FIFO overflow": u16
  "DL TX IFFT output clipped": bool
  "DL BB out power": UFXP(1.30)
  "Num DL TX RF Triggers": u32
  "sync frame start count": u32
  "frame aligned data FIFO overflow": u16
  "T2H DL RX stream FIFO overflow": u16
  "DL sync in power": UFXP(1.30)
  "DL BB in power": UFXP(1.30)
  "T2H channel estimation FIFO overflow": u16
  "T2H PDCCH FIFO overflow": u16
  "T2H DL FFT FIFO overflow": u16
  "T2H PDSCH decoder data overflow": u16
  "T2H PDSCH decoder status overflow": u16
  "T2H PDSCH FIFO overflow": u16
  "sync status": T5
  "PDSCH decoder status": T10
  "DC average": CFXP(1.17)
  "reg.host read.data 0": "Read Cmd Data.gtype"
  "DL TX FIFO faults": T11
  "tx.state": "Stream Control State.gtype"
  "rx.state": "Stream Control State.gtype"
  "TS UL TX FIFO to DACs overflow": u16
  "UL trigger received count": u32
  "T2H UL TX BB FIFO overflow": u16
  "UL TX IFFT output clipped": bool
  "UL BB out power": UFXP(1.30)
  "UL constellation FIFO overflow": u16
  "T2H UL RX stream FIFO overflow": u16
  "UL BB in power": UFXP(1.30)
  "T2H PUSCH decoder data overflow": u16
  "T2H PUSCH decoder status overflow": u16
  "PUSCH decoder status": T10
  "UL TX FIFO faults": T15
types:
  T1 = cluster{"disable mini MAC": bool, "transmit counter value": bool}
  T2 = cluster{"total number of REGs": u16, "aggregation level": u16, "DCI message length": u8}
  T3 = cluster{"cell ID": u16, "number of antenna ports": u8, "frame structure": enum{"FDD", "TDD 5 5"}, "enable T2H transfer": bool, "PDCCH": T2}
  T4 = cluster{"ZERO": bool, "PSS": bool, "SSS": bool, "CRS": bool, "PBCH": bool, "PCFICH": bool, "PHICH": bool, "PDCCH": bool, "PDSCH": bool, "UERS AP7": bool, "UERS AP9": bool}
  T5 = cluster{"PSS detected?": bool, "cross correlation timing estimate": UFXP(19.0), "autocorrelation peak index": UFXP(19.0), "FFO estimation": FXP(2.14), "IFO estimation": FXP(3.0), "frame timing estimation": UFXP(19.0), "signal detected?": bool, "normalized CFO": FXP(0.48)}
  T6 = enum{"Normal", "Use internal Trigger", "Use external Trigger", "Manual", "Bypass"}
  T7 = cluster{"FFT window timing advance": i8, "autocorrelation threshold": UFXP(14.26), "static CFO": FXP(4.44), "use static CFO": bool, "CFO factor": UFXP(0.16), "sync operation mode": T6, "trigger delay": UFXP(19.0)}
  T8 = cluster{"number of REs": u16, "modulation": enum{"QPSK", "QAM16", "QAM64"}, "redundancy version index": UFXP(2.0), "transport block size": UFXP(17.0), "user data": u32}
  T9 = cluster{"modulation": enum{"QPSK", "16QAM", "64QAM"}, "RB allocation": bool[100], "decoder": T8}
  T10 = cluster{"transport block size": UFXP(17.0), "TB CRC ok": bool, "CB CRC ok": bool[13], "user data": u32}
  "IQ Impairments.gtype" = cluster{"inline gain I": FXP(1.17), "inline gain Q": FXP(1.17), "cross gain I": FXP(1.17), "cross gain Q": FXP(1.17), "pre-gain offset I": FXP(1.17), "pre-gain offset Q": FXP(1.17), "post-gain offset I": FXP(1.17), "post-gain offset Q": FXP(1.17)}
  "IQ Gain.gtype" = cluster{"gain I": FXP(3.21), "gain Q": FXP(3.21)}
  "Read Cmd Data.gtype" = cluster{"go": bool, "data": u32}
  T11 = cluster{"PDCCH Sample Overflow": u16, "PDCCH Sample Underflow": u16, "PDSCH Sample Overflow": u16, "PDSCH Sample Underflow": u16}
  "Stream Control State.gtype" = enum{"Idle", "Active"}
  T12 = cluster{"use fix frequency offset": bool, "use fix time offset": bool, "frequency offset": FXP(0.48), "time offset": FXP(21.0)}
  T13 = cluster{"cell ID": u16, "frame structure": enum{"FDD", "TDD 5 5"}, "enable T2H transfer": bool}
  T14 = cluster{"ZERO": bool, "SRS": bool, "DMRS": bool, "DMRS unused": bool, "PRACH": bool, "PUCCH": bool, "PUSCH": bool}
  T15 = cluster{"PUSCH sample FIFO underflows": u16, "PUSCH sample FIFO overflows": u16}
  "DDC Parameters.gtype" = cluster{"output sample rate": UFXP(1.47), "delay": FXP(0.16), "frequency shift": FXP(0.48), "impairments": "IQ Impairments.gtype", "phase": FXP(0.21)}
  "DUC Parameters.gtype" = cluster{"frequency shift": FXP(0.48), "impairments": "IQ Impairments.gtype", "phase": FXP(0.21), "input sample rate": UFXP(1.47), "gain": "IQ Gain.gtype", "delay": FXP(0.18)}
uses:
  FPGA SubVIs::Create Resources.gvi
  AFW::Common::USRP::Type Conversion::read completion from typedef.gcdl
  NI::SDR::RegisterBusV1FPGA::Process.gcdl
  AFW::Common::USRP::Type Conversion::reg.host read.data to typedef.gcdl
  AFW::Common::USRP::Type Conversion::register instruction to typedef.gcdl
  FPGA SubVIs::Registers.gcdl
  FPGA SubVIs::LEDs.gvi
  NI::USRPRIO::ConfigV1FPGA::Process.gvi
  AFW::LTE::Resources::LTE Create FPGA Resources.gvi
  AFW::LTE::Shared::RF TX Trigger Generator.gcdl
  AFW::LTE::RF Control::USRP Stream RX Top.gcdl
  AFW::LTE::RF Control::USRP Stream TX Top.gcdl
  AFW::LTE::DL RX::DL RX Input FIFO Select.gcdl
  AFW::LTE::DL RX::Synchronization::DL RX Sync Build Configuration.gcdl
  AFW::LTE::DL RX::Synchronization::DL RX Sync Top.gcdl
  AFW::LTE::DL RX::DL IQ Sample Buffer.gcdl
  AFW::LTE::DL RX::Get PDSCH Dynamic Configuration.gcdl
  AFW::LTE::DL RX::DL RX IQ Processing.gcdl
  AFW::LTE::DL RX::PDCCH Decoder::PDCCH RX Top.gcdl
  AFW::LTE::DL RX::PDSCH Decoder::PDSCH RX Sample Select.gcdl
  AFW::LTE::Shared::RX::PXSCH::PXSCH RX Bit Processing.gcdl
  AFW::LTE::Shared::RX::PXSCH::RX PXSCH Host Interface.gcdl
  AFW::LTE::DL RX::Synchronization::RX Sync Write Status Registers.gcdl
  AFW::LTE::Shared::FIFOs::FIFO Write CFX 1.15 T2H.gcdl
  AFW::LTE::DL RX::Channel Estimation::Channel Estimates to U64.gcdl
  AFW::LTE::DL RX::Channel Estimation::Pass Through Samples.gcdl
  AFW::LTE::Shared::FIFOs::FIFO Write U64 T2H.gcdl
  AFW::LTE::Shared::FIFOs::FIFO Write U32 T2H.gcdl
  AFW::LTE::DL RX::DL RX Constellation FIFO Write.gcdl
  AFW::LTE::Shared::TX::TX Trigger.gcdl
  AFW::LTE::DL TX::DL TTI Handling.gcdl
  AFW::LTE::DL TX::PDCCH Transmitter::PDCCH Transmitter.gcdl
  AFW::LTE::DL TX::PDSCH Transmitter::PDSCH TX Configuration Calculation.gcdl
  AFW::LTE::Shared::TX::PXSCH::MAC TX.gcdl
  AFW::LTE::Shared::TX::PXSCH::PXSCH TX Bit Processing.gcdl
  AFW::LTE::DL TX::Dynamic DL Configuration Delay.gcdl
  AFW::LTE::DL TX::DL TX IQ Processing.gcdl
  AFW::LTE::Shared::TX::TX FIFO Write with Loopback.gcdl
  AFW::LTE::DL TX::DL TX Trigger Write.gcdl
  AFW::Common::Counters::Pulse to Strobe U32.gcdl
  AFW::LTE::UL TX::Store Time and Frequency Offset.gcdl
  AFW::LTE::UL TX::UL TTI Handling.gcdl
  AFW::LTE::UL TX::PUSCH Transmitter::PUSCH TX Configuration Calculation.gcdl
  AFW::LTE::UL TX::Dynamic UL Configuration Delay.gcdl
  AFW::LTE::UL TX::UL TX IQ Processing.gcdl
  AFW::LTE::Shared::TX::TX FIFO Write.gcdl
  AFW::LTE::UL RX::UL RX Input FIFO Read.gcdl
  AFW::LTE::UL RX::Calculate PUSCH Configuration.gcdl
  AFW::LTE::UL RX::UL RX IQ Processing.gcdl
  AFW::LTE::UL RX::PUSCH Decoder::PUSCH RX Sample Select.gcdl
  AFW::LTE::UL RX::UL RX Constellation FIFO Write.gcdl
  AFW::LTE::Shared::TX::UL TX TDD5 Select Subframe.gcdl
diagram:
  call "Create Resources.gvi"() -> (sync.resources=w1, config.resources=w2, time.resources=w3)
  clock-driven loop (clock = "40 MHz Onboard Clock") {
    # Register Bus and Required Controls/Indicators
    Io Write(data=$"RF 1/Rx/Enable", reference in="RF 1/Rx/Enable")
    Io Write(data=$"RF 0/Tx/Enable", reference in="RF 0/Tx/Enable")
    Io Write(data=$"RF 0/Rx/Enable", reference in="RF 0/Rx/Enable")
    Io Write(data=$"RF 1/Tx/Enable", reference in="RF 1/Tx/Enable")
    w4 = "NI::SDR::RegisterBusV1FPGA::niInstr Register Bus v0.grsc::reg.host instruction fifo 0"
    Feedback Node(input=w5) -> w6
    call "read completion from typedef.gcdl"(read completion (typedef)=w6) -> (read completion=w7)
    Feedback Node(input=w8) -> w9
    call "Process.gcdl"(reg.notify host.go rcvd=$"reg.notify host.go rcvd 0", reg.host read.go rcvd=$"reg.host read.go rcvd 0", read completion=w7, reg.reset=$"reg.reset 0", reg.host instruction fifo=w4, ready for output=w9) -> (reg.notify host.go=w10, reg.host read.data=w11, register instruction=w12)
    $"reg.notify host.go 0" <- w10
    call "reg.host read.data to typedef.gcdl"(reg.host read.data=w11) -> (reg.host read.data (typedef)=w13)
    $"reg.host read.data 0" <- w13
    call "register instruction to typedef.gcdl"(register instruction=w12) -> (register instruction (typedef)=w14)
    call "Registers.gcdl"(register instruction=w14, config.resources=w2, sync.resources=w1, time.resources=w3) -> (read completion out=w5, ready for input=w8)
    stop if FALSE
  }
  call "LEDs.gvi"()
  call "Process.gvi"(resources=w2)
  call "LTE Create FPGA Resources.gvi"() -> (AFW FPGA Resources=w15)
  clock-driven loop (clock = "Data Clock") forever {
    # Data Reception from Antenna, downconversion to baseband sample rate, received data will be written into RX baseband input FIFO
    # Readout of TX baseband output buffer, upconversion and transmission to antenna
    Property Node(instance in=w15) -> ("TX BB to RF FIFO"=w16, "RX RF to BB FIFO"=w17)
    Build Array($"rx 0.stream enable", $"rx 1.stream enable") -> w18
    Property Node(instance in="DDC Parameters.gtype" {all zero or empty}, "impairments"=$"rx 0.impairments", "frequency shift"=$"rx 0.frequency shift", "phase"=$"rx 0.phase", "output sample rate"=$"rx.output sample rate", "delay"=$"rx.delay") -> (instance out=w19)
    Property Node(instance in="DDC Parameters.gtype" {all zero or empty}, "delay"=$"rx.delay", "output sample rate"=$"rx.output sample rate", "impairments"=$"rx 1.impairments", "frequency shift"=$"rx 1.frequency shift", "phase"=$"rx 1.phase") -> (instance out=w20)
    Build Array(w19, w20) -> w21
    Property Node(instance in=w15) -> ("TX trigger"=w22, "sync trigger"=w23)
    call "RF TX Trigger Generator.gcdl"(TX trigger register=w22, use independent RX trigger=$"use independent RX trigger", sync frame start=w23, TX start trigger count=$"TX start trigger count", delay + timing advance=$"BB processing delay", use independent TX trigger=$"use independent TX trigger", TX RF trigger offset=$"TX RF trigger offset", transmit without sync=$"transmit without sync") -> (RX frame start trigger=w24, TX trigger generated count=w25)
    call "USRP Stream RX Top.gcdl"(RX frame start trigger=w24, rx.reset=$"rx.reset", RX RF channel=$"RX RF channel", rx.stream enable=w18, rx.abort=$"rx.abort", DDC parameters=w21, enable DC offset correction=$"enable DC offset correction", RX baseband FIFO reference=w17) -> (rx.number of overflows=w26, rx.samples processed=w27, ADC values clipped=w28, DC average=w29, rx.number of clipped IQ data samples=w30, rx.dsp reset done=w31, rx.state=w32)
    $"ADC values clipped" <- w28
    $"DC average" <- w29
    $"rx.number of clipped IQ data samples" <- w30
    Build Array($"tx 0.stream enable", $"tx 1.stream enable") -> w33
    Property Node(instance in="DUC Parameters.gtype" {all zero or empty}, "gain"=$"tx 0.gain", "frequency shift"=$"tx 0.frequency shift", "phase"=$"tx 0.phase", "impairments"=$"tx 0.impairments", "input sample rate"=$"tx.input sample rate", "delay"=$"tx.delay") -> (instance out=w34)
    Property Node(instance in="DUC Parameters.gtype" {all zero or empty}, "delay"=$"tx.delay", "input sample rate"=$"tx.input sample rate", "gain"=$"tx 1.gain", "frequency shift"=$"tx 1.frequency shift", "phase"=$"tx 1.phase", "impairments"=$"tx 1.impairments") -> (instance out=w35)
    Build Array(w34, w35) -> w36
    call "USRP Stream TX Top.gcdl"(tx.reset=$"tx.reset", TX RF channel=$"TX RF channel", tx.enable streams=w33, tx.abort=$"tx.abort", DUC parameters=w36, TX baseband FIFO reference=w16) -> (tx.state=w37, tx.samples processed=w38, tx.underflows=w39, tx.number of clipped IQ data samples=w40, tx.dsp reset done=w41)
    $"tx.state" <- w37
    $"rx.dsp reset done" <- w31
    $"tx.samples processed" <- w38
    $"rx.state" <- w32
    $"tx.underflows" <- w39
    $"rx.samples processed" <- w27
    $"tx.number of clipped IQ data samples" <- w40
    $"rx.number of overflows" <- w26
    $"tx.dsp reset done" <- w41
    $"TX trigger generated count" <- w25
  }
  Property Node(instance in=w15) -> ("Baseband clock"=w42)
  clock-driven loop (clock = w42) forever {
    disable {
      frame 0, Default {
        Property Node(instance in=w15) -> ("loopback FIFO"=w43)
        # Avoid compilation errors when
        # Loopback FIFO is written but not read
        FIFO Read(Control Protocol Input=FALSE, reference in=w43)
      }
      frame LTE_MODE == "DL" || LTE_MODE == "UE" {
        Property Node(instance in=w15) -> ("RX RF to BB FIFO"=w44, "loopback FIFO"=w45, "loopback trigger"=w46, "sync trigger"=w47, "time and freq offset"=w48)
        Feedback Node(input=w49) -> w50
        # SOURCE
        call "DL RX Input FIFO Select.gcdl"(internal DL loopback FIFO=w45, internal DL loopback=$"internal DL loopback", received IQ DL from RF=w44, ready for input=w50) -> (IQ sample=w51, IQ sample valid=w52)
        call "DL RX Sync Build Configuration.gcdl"(enable DL RX=$"enable DL RX", transfer full RX stream=$"transfer full RX stream", sync configuration from host=$"sync configuration", static DL RX configuration=$"DL RX static parameters", FO normalization factor=$"FO normalization factor", enable frequency tracking=$"enable frequency tracking", external trigger reference="AUX I/O 0", internal trigger reference=w46) -> (sync configuration=w53, timing overwrite options=w54)
        Feedback Node(input=w55) -> w56
        call "DL RX Sync Top.gcdl"(IQ sample in=w51, input valid=w52, sync configuration=w53, frequency tracking in=w56, timing overwrite options=w54) -> (DL sync in power=w57, frame aligned sample=w58, frame aligned sample valid=w59, sample to spectrum=w60, sample to spectrum valid=w61, sync status=w62, time and frequency offset=w63, frame start pulse=w64, ready for input=w49)
        call "DL IQ Sample Buffer.gcdl"(frame aligned sample=w58, frame aligned sample valid=w59) -> (DL IQ sample out=w65, output valid=w66, symbol start (pulse)=w67, frame aligned data FIFO overflow=w68)
        $"frame aligned data FIFO overflow" <- w68
        # DL RX Chain including Sync, RX IQ processing, PDCCH and PDSCH receiver
        # SYNC
        $"DL sync in power" <- w57
        w69 = "AFW::LTE::Resources::LTE AFW Resources.grsc::H2T DL RX Dynamic Configuration"
        Property Node(instance in=w62) -> ("signal detected?"=w70)
        call "Get PDSCH Dynamic Configuration.gcdl"(TTI DL configuration H2T=w69, symbol trigger=w67, RT mode=$"DL RX RT mode", sync found=w70) -> (dynamic DL configuration=w71)
        # IQ PROCESSING
        call "DL RX IQ Processing.gcdl"(data in=w65, input valid=w66, static DL RX configuration=$"DL RX static parameters", DL channel equalizer bypass=$"DL channel equalizer bypass", symbol start=w67, dynamic DL configuration=w71) -> (DL BB in power=w72, equalized sample CRS=w73, time and resource map CRS=w74, equalized sample UERS=w75, time and resource map UERS=w76, channel estimate (CRS only)=w77, channel estimate (UERS only)=w78, frequency tracking=w55)
        $"DL BB in power" <- w72
        Property Node(instance in=$"DL RX static parameters") -> ("enable T2H transfer"=w79, instance out=w80)
        # PDCCH
        w81 = "AFW::LTE::Resources::LTE AFW Resources.grsc::T2H PDSCH Decoding Status"
        # <---------------PDSCH------------->
        w82 = "AFW::LTE::Resources::LTE AFW Resources.grsc::T2H PDSCH Decoded Data"
        call "PDCCH RX Top.gcdl"(equalized sample=w73, timing and channel cluster=w74, static DL RX configuration=$"DL RX static parameters", dynamic DL configuration=w71) -> (PDSCH parameters=w83, PDSCH parameters valid=w84, DCI to host=w85, DCI to host valid=w86)
        call "PDSCH RX Sample Select.gcdl"(equalized sample (CRS)=w73, resource map and timing (CRS)=w74, equalized sample (UERS)=w75, resource map and timing (UERS)=w76, PDSCH configuration=w83, PDSCH configuration valid=w84, static DL RX configuration=w80, fix PDSCH configuration=$"fix PDSCH configuration", use fix PDSCH configuration=$"use fix PDSCH configuration", dynamic DL configuration=w71) -> (PDSCH sample for decoder=w87, PDSCH sample for decoder valid=w88, PDSCH sample for constellation=w89, PXSCH receiver configuration=w90, PXSCH configuration valid=w91)
        call "PXSCH RX Bit Processing.gcdl"(PXSCH RX symbol=w87, PXSCH RX symbol valid=w88, PXSCH receiver trigger=w91, PXSCH receiver configuration=w90) -> (PXSCH RX payload=w92, PXSCH RX payload valid=w93, PXSCH RX status=w94, PXSCH RX status valid=w95)
        call "RX PXSCH Host Interface.gcdl"(PXSCH decoded data=w92, PXSCH decoded data valid=w93, PXSCH decoder status=w94, PXSCH decoder status valid=w95, enable T2H transfer=w79, PXSCH decoding status T2H=w81, PXSCH decoded data T2H=w82) -> (PXSCH decoder data T2H overflow=w96, PXSCH decoder status T2H overflow=w97, PXSCH decoder status latched=w98)
        $"T2H PDSCH decoder data overflow" <- w96
        $"T2H PDSCH decoder status overflow" <- w97
        $"PDSCH decoder status" <- w98
        $"sync status" <- w62
        # Write Sync Trigger and
        # time and frequency offset
        call "RX Sync Write Status Registers.gcdl"(frame start trigger=w64, time and frequency offset=w63, frame start trigger register=w47, time and frequency offset register=w48) -> (sync frame start count=w99)
        $"sync frame start count" <- w99
        # RX Spectrum
        w100 = "AFW::LTE::Resources::LTE AFW Resources.grsc::T2H RX Baseband Stream"
        call "FIFO Write CFX 1.15 T2H.gcdl"(FIFO reference in=w100, sample in=w60, sample in valid=w61) -> (FIFO overflow counter=w101)
        $"T2H DL RX stream FIFO overflow" <- w101
        # Channel estimates for SINR
        w102 = "AFW::LTE::Resources::LTE AFW Resources.grsc::T2H RX Channel Estimates"
        Feedback Node(input=w103) -> w104
        call "Channel Estimates to U64.gcdl"(CRS data in=w77, UERS data in=w78) -> (data out=w103, data out valid=w105)
        call "Pass Through Samples.gcdl"(valid in=w105, trigger=$"reset channel estimates", number of samples=$"number of channel estimate samples") -> (valid out=w106)
        call "FIFO Write U64 T2H.gcdl"(sample in=w104, sample in valid=w106, FIFO reference in=w102) -> (FIFO overflow counter=w107)
        $"T2H channel estimation FIFO overflow" <- w107
        # PDCCH status info for UL Feedback
        w108 = "AFW::LTE::Resources::LTE AFW Resources.grsc::T2H PDCCH Message"
        call "FIFO Write U32 T2H.gcdl"(FIFO reference in=w108, sample in=w85, sample in valid=w86) -> (FIFO overflow counter=w109)
        $"T2H PDCCH FIFO overflow" <- w109
        w110 = "AFW::LTE::Resources::LTE AFW Resources.grsc::T2H RX Constellation"
        # Rx Constellation
        call "DL RX Constellation FIFO Write.gcdl"(equalizer output=w73, resource map and timing=w74, PDSCH sample=w89, DL FFT debug channel select=$"DL FFT debug channel select", DL constellation FIFO=w110, constellation symbol number=$"DL constellation symbol number (0-13)", constellation subset=$"DL constellation subset", enable T2H transfer=w79, constellation selector=$"constellation select") -> (FIFO overflow counter EQ=w111, FIFO overflow counter PDSCH=w112)
        $"T2H DL FFT FIFO overflow" <- w111
        $"T2H PDSCH FIFO overflow" <- w112
      }
    }
    disable {
      frame 0, Default {
        Property Node(instance in=w15) -> ("loopback FIFO"=w113)
        # Avoid compilation errors when
        # Loopback FIFO is read but not written
        FIFO Write(Control Protocol Input=FALSE, data=0+0i, reference in=w113)
      }
      frame LTE_MODE == "DL" || LTE_MODE == "ENB" {
        w114 = "AFW::LTE::Resources::LTE AFW Resources.grsc::T2H Timing Indication"
        # PDCCH
        w115 = "AFW::LTE::Resources::LTE AFW Resources.grsc::H2T DL TX Dynamic Configuration"
        # DL TX
        # Input: PDSCH Data, PDCCH Data, Start of Subframe
        # Output: Data to DAC SCTL
        Property Node(instance in=w15) -> ("TX trigger"=w116, instance out=w117)
        Register Read(reference in=w116) -> (data=w118)
        # w119: symbol trigger
        call "TX Trigger.gcdl"(trigger in=w118, use TX RF start trigger=$"use DL TX RF start trigger", TX active=$"DL TX active", TX single shot=FALSE) -> (trigger received count=w120, symbol start trigger=w119)
        call "DL TTI Handling.gcdl"(symbol trigger in=w119, TTI FIFO T2H=w114, TTI DL config fifo H2T=w115, static DL configuration=$"DL TX static parameters", RT target=$"DL TX RT mode") -> (TX timing cluster=w121, dynamic DL configuration=w122, empty PDCCH trigger=w123, DCI message=w124)
        call "PDCCH Transmitter.gcdl"(timing in=w121, dynamic DL configuration=w122, static DL configuration=$"DL TX static parameters", empty PDCCH trigger=w123, DCI message=w124) -> (PDCCH symbol=w125)
        # w126: PDSCH params
        call "PDSCH TX Configuration Calculation.gcdl"(dynamic DL configuration in=w122, static DL configuration=$"DL TX static parameters", timing in=w121, DCI message=w124) -> (OFDM symbol trigger=w127, PDSCH RB allocation=w128, PDSCH transmitter configuration=w126, PDSCH transmitter trigger=w129, PDSCH transport block size=w130, dynamic DL configuration out=w131)
        w132 = "AFW::LTE::Resources::LTE AFW Resources.grsc::H2T PDSCH Payload"
        # PDSCH latency: 100000 cylces
        # to ensure enough time for sample generation!
        # <---------- PDSCH ------------------->
        # w130: TB size
        Feedback Node(input=w133) -> w134
        call "MAC TX.gcdl"(MAC settings=$"DL debug MAC settings", MAC trigger=w129, TB size=w130, payload FIFO=w132, ready for output=w134) -> (data out=w135)
        call "PXSCH TX Bit Processing.gcdl"(MAC data=w135, PXSCH transmitter configuration=w126, PXSCH transmitter trigger=w129, OFDM symbol trigger in=w127, RB allocation=w128) -> (OFDM symbol trigger out=w136, PXSCH symbol=w137, PXSCH configuration delay=w138, RB bitmap out=w139, ready for input=w133)
        call "Dynamic DL Configuration Delay.gcdl"(dynamic DL configuration in=w131, trigger=w129, delay=w138) -> (dynamic DL configuration out=w140)
        call "DL TX IQ Processing.gcdl"(start of symbol=w136, static DL configuration=$"DL TX static parameters", dynamic DL configuration=w140, RB bitmap=w139, PDSCH sample=w137, PDCCH sample=w125, number of IFFT output bits shifted=$"number of DL TX IFFT output bits shifted") -> (sample out=w141, sample out valid=w142, IFFT output clipped=w143, FIFO faults=w144, baseband output power=w145)
        # IQ processing
        $"DL BB out power" <- w145
        Property Node(instance in=w117) -> ("TX BB to RF FIFO"=w146, "loopback FIFO"=w147, "loopback trigger"=w148)
        w149 = "AFW::LTE::Resources::LTE AFW Resources.grsc::T2H TX Baseband Stream"
        call "TX FIFO Write with Loopback.gcdl"(sample in=w141, sample in valid=w142, scope="DL", transfer full TX frame=$"transfer full DL TX frame", TX spectrum T2H=w149, internal loopback FIFO=w147, TX FIFO to DACs=w146) -> (TX FIFO to DACs overflow=w150, internal loopback FIFO overflow=w151, TX spectrum T2H FIFO overflow=w152)
        $"TS DL TX FIFO to DACs overflow" <- w150
        $"TS internal DL loopback FIFO overflow" <- w151
        $"T2H DL TX BB FIFO overflow" <- w152
        $"DL trigger received count" <- w120
        call "DL TX Trigger Write.gcdl"(input valid=w142, DL TX Trigger Register=w148, DL TX Trigger IO Port="AUX I/O 1", Trigger delay=$"DL TX RF Trigger delay") -> (Num DL TX Start Triggers=w153)
        $"Num DL TX RF Triggers" <- w153
        $"DL TX FIFO faults" <- w144
        call "Pulse to Strobe U32.gcdl"(pulse=w143, N=1920000) -> (strobe=w154)
        $"DL TX IFFT output clipped" <- w154
      }
    }
    disable {
      frame 0, Default { }
      frame LTE_MODE == "UE" {
        Property Node(instance in=w15) -> ("TX BB to RF FIFO"=w155, "TX trigger"=w156, "time and freq offset"=w157)
        Register Read(reference in=w157) -> (data=w158)
        Register Read(reference in=w156) -> (data=w159)
        # w160: Symbol trigger
        call "TX Trigger.gcdl"(trigger in=w159, use TX RF start trigger=$"UL TX use RF start trigger", TX active=$"UL TX active", TX single shot=$"UL TX single shot") -> (trigger received count=w161, radio frame trigger=w162, TX switched off pulse=w163, symbol start trigger=w160)
        # w164: Frequency offset
        # w165: Time offset
        call "Store Time and Frequency Offset.gcdl"(radioframe start=w162, frame timing and frequency offset=w158, reset values=w163, fix offset values=$"UL debug fix offset values") -> (frequency offset=w164, time offset=w165)
        # w166: Payload data
        w167 = "AFW::LTE::Resources::LTE AFW Resources.grsc::H2T UL TX Dynamic Configuration"
        w168 = "AFW::LTE::Resources::LTE AFW Resources.grsc::T2H Timing Indication"
        call "UL TTI Handling.gcdl"(symbol trigger in=w160, TTI FIFO T2H=w168, TTI DL config fifo H2T=w167, static UL configuration=$"UL TX static parameters", RT target=$"UL TX RT mode") -> (TX timing cluster=w169, dynamic UL configuration=w170, DCI message=w171)
        # w172: PUSCH params
        call "PUSCH TX Configuration Calculation.gcdl"(dynamic UL configuration in=w170, UL TX static parameters=$"UL TX static parameters", DCI message=w171, system timing in=w169) -> (symbol trigger out=w173, PUSCH RB allocation=w174, PUSCH transmitter configuration=w172, PUSCH transmitter trigger=w175, PUSCH transport block size=w176, dynamic UL configuration out=w177)
        # UL TX
        # Input: PUSCH Data, Start of Symbol
        # Output: Data to DAC SCTL
        w166 = "AFW::LTE::Resources::LTE AFW Resources.grsc::H2T PUSCH Payload"
        Feedback Node(input=w178) -> w179
        # w176: TB size
        call "MAC TX.gcdl"(MAC settings=$"UL debug MAC settings", MAC trigger=w175, TB size=w176, payload FIFO=w166, ready for output=w179) -> (data out=w180)
        call "PXSCH TX Bit Processing.gcdl"(MAC data=w180, PXSCH transmitter configuration=w172, PXSCH transmitter trigger=w175, OFDM symbol trigger in=w173, RB allocation=w174) -> (OFDM symbol trigger out=w181, PXSCH symbol=w182, PXSCH configuration delay=w183, RB bitmap out=w184, ready for input=w178)
        call "Dynamic UL Configuration Delay.gcdl"(dynamic UL configuration in=w177, trigger=w175, delay=w183) -> (dynamic UL configuration out=w185)
        call "UL TX IQ Processing.gcdl"(UL TX static parameters=$"UL TX static parameters", frequency offset=w164, time offset=w165, start of symbol=w181, RB bitmap=w184, PUSCH sample=w182, dynamic UL configuration=w185, number of IFFT output bits shifted=$"number of UL TX IFFT output bits shifted") -> (sample out=w186, sample out valid=w187, FIFO faults=w188, IFFT output clipped=w189, baseband output power=w190)
        $"UL BB out power" <- w190
        # PUSCH latency: 100000 cylces
        # to ensure enough time for sample generation!
        # <---------- PUSCH ------------------->
        # IQ processing
        w191 = "AFW::LTE::Resources::LTE AFW Resources.grsc::T2H TX Baseband Stream"
        call "TX FIFO Write.gcdl"(sample in=w186, sample in valid=w187, scope="UL", transfer full TX frame=$"transfer full UL TX frame", TX spectrum T2H=w191, TX FIFO to DACs=w155) -> (TX FIFO to DACs overflow=w192, TX spectrum T2H FIFO overflow=w193)
        $"TS UL TX FIFO to DACs overflow" <- w192
        $"T2H UL TX BB FIFO overflow" <- w193
        $"UL trigger received count" <- w161
        $"UL TX FIFO faults" <- w188
        call "Pulse to Strobe U32.gcdl"(pulse=w189, N=1920000) -> (strobe=w194)
        $"UL TX IFFT output clipped" <- w194
      }
    }
    disable {
      frame 0, Default { }
      frame LTE_MODE == "ENB" {
        Property Node(instance in=$"UL RX static parameters") -> ("enable T2H transfer"=w195, "frame structure"=w196, instance out=w197)
        w198 = "AFW::LTE::Resources::LTE AFW Resources.grsc::T2H PUSCH Decoding Status"
        # <---------------PUSCH -------->
        w199 = "AFW::LTE::Resources::LTE AFW Resources.grsc::T2H PUSCH Decoded Data"
        w200 = "AFW::LTE::Resources::LTE AFW Resources.grsc::H2T UL RX Dynamic Configuration"
        Property Node(instance in=w15) -> ("RX RF to BB FIFO"=w201)
        # Source
        call "UL RX Input FIFO Read.gcdl"(symbol processing ticks -1=9999, received IQ UL from RF=w201) -> (IQ sample=w202, IQ sample valid=w203, symbol start=w204)
        call "Calculate PUSCH Configuration.gcdl"(TTI UL configuration H2T=w200, symbol trigger=w204, RT mode=$"UL RX RT mode") -> (aligned PUSCH configuration=w205, RB allocation=w206, dynamic UL configuration=w207)
        # UL RX
        # Input: Time-domain signal from DAC; 2208/2192 samples per symbol / 30720 samples per subframe
        # Output: Decoded PUSCH data
        # IQ PROCESSING
        call "UL RX IQ Processing.gcdl"(UL channel equalizer bypass=$"UL channel equalizer bypass", frame aligned sample=w202, frame aligned sample valid=w203, symbol start=w204, dynamic UL UE configuration=w207, RB bitmap=w206, frame structure=w196) -> (equalized sample=w208, resource map and timing=w209, UL BB in power=w210)
        call "PUSCH RX Sample Select.gcdl"(equalized sample=w208, static UL configuration=w197, PUSCH configuration=w205, resource map and timing=w209, dynamic UL UE configuration=w207) -> (PUSCH receiver configuration=w211, PUSCH configuration valid=w212, PUSCH sample=w213, PUSCH sample valid=w214)
        call "PXSCH RX Bit Processing.gcdl"(PXSCH RX symbol=w213, PXSCH RX symbol valid=w214, PXSCH receiver trigger=w212, PXSCH receiver configuration=w211) -> (PXSCH RX payload=w215, PXSCH RX payload valid=w216, PXSCH RX status=w217, PXSCH RX status valid=w218)
        call "RX PXSCH Host Interface.gcdl"(PXSCH decoded data=w215, PXSCH decoded data valid=w216, PXSCH decoder status=w217, PXSCH decoder status valid=w218, enable T2H transfer=w195, PXSCH decoding status T2H=w198, PXSCH decoded data T2H=w199) -> (PXSCH decoder data T2H overflow=w219, PXSCH decoder status T2H overflow=w220, PXSCH decoder status latched=w221)
        $"T2H PUSCH decoder data overflow" <- w219
        $"T2H PUSCH decoder status overflow" <- w220
        $"PUSCH decoder status" <- w221
        $"UL BB in power" <- w210
        w222 = "AFW::LTE::Resources::LTE AFW Resources.grsc::T2H RX Constellation"
        call "UL RX Constellation FIFO Write.gcdl"(equalizer output=w208, resource map and timing=w209, enable T2H transfer=w195, UL FFT debug channel select=$"UL FFT debug channel select", constellation subset=$"UL constellation subset", constellation symbol number=$"UL constellation symbol number (0-13)", UL constellation FIFO=w222) -> (FIFO overflow counter=w223)
        # RX constellation
        $"UL constellation FIFO overflow" <- w223
        # RX spectrum
        w224 = "AFW::LTE::Resources::LTE AFW Resources.grsc::T2H RX Baseband Stream"
        call "UL TX TDD5 Select Subframe.gcdl"(valid in=w203, sample in=w202, transfer full UL TX frame=FALSE) -> (valid out=w225, sample out=w226)
        call "FIFO Write CFX 1.15 T2H.gcdl"(FIFO reference in=w224, sample in=w226, sample in valid=w225) -> (FIFO overflow counter=w227)
        $"T2H UL RX stream FIFO overflow" <- w227
      }
    }
  }
