vi "Abort Stream.gvi"   [LabVIEW NXG 4.0.0]
# Aborts the acquisition/generation (based on the scope parameter), waits for the stream to go idle, and then checks the stream status.
inputs:
  "niusrprio session in": "niUsrpRio Session.gtype", required
  "check stream status": bool
  "timeout": f64 = 10
  "error in": error
  "scope": string = "rx", required
outputs:
  "niusrprio session out": "niUsrpRio Session.gtype"
  "error out": error
panel indicators:
  "samples processed": u32
  "state": "Stream Control State.gtype"
types:
  "Register Bus Session.gtype" = Queue<"Session Data.gtype">
  "Semaphore.gtype" = i32
  "DB Queue Reference.gtype" = Queue<"Daughterboard Data.gtype">
  "EEPROM Header.gtype" = cluster{"Checksum": u32, "Product Code": u16, "Hardware Current Version": u16, "Hardware Oldest Compatible Version": u16, "EEPROM Map Current Version": u16, "EEPROM Map Oldest Compatible Version": u16, "User Password": string, "Pointer to Factory Header": u32, "Pointer to User Header": u32, "Recommended Interval": u16, "Number of Reserved Bytes": i32, "Number of Daughterboards": u8, "Daughterboard IDs": u16[], "Daughterboard Serial Numbers": string[]}
  "EEPROM Device Data Header.gtype" = cluster{"Checksum": u32, "Number of Channels": u8, "Number of Gain Settings": u16[], "Pointer to Characterization Data": u32[], "Number of Reserved Bytes": i32, "Number of Frequencies": u16[]}
  "EEPROM Characterization Header.gtype" = cluster{"Checksum": u32, "Date": timestamp, "Temperature": f32, "Misc. Info": string, "Pointer to Device Data Header": u32, "Number of Reserved Bytes": i32}
  "Characterization Data.gtype" = cluster{"Gains[dB]": f64[], "Frequencies [Hz]": f64[], "IQ Imbalance Table": "IQ Imbalance.gtype"[], "Measured Gains[dB]": f64[][]}
  "niUsrpRio Session.gtype" = cluster{"FPGA Interface": any, "RIO Interface Number": u32, "Data Clock Rate": u32, "FPGA Data Clock Rate": u32, "Global Settings Register Bus": "Register Bus Session.gtype", "Radio 0 Settings Register Bus": "Register Bus Session.gtype", "Radio 1 Settings Register Bus": "Register Bus Session.gtype", "Radio Settings Bus Semaphore": "Semaphore.gtype", "DB Queues": "DB Queue Reference.gtype"[], "Characterization Data Valid?": bool, "EEPROM Header": "EEPROM Header.gtype", "Device Data Header": "EEPROM Device Data Header.gtype", "EEPROM Characterization Header": "EEPROM Characterization Header.gtype", "Characterization Data": "Characterization Data.gtype"[], "FPGA Current Version": u32, "FPGA Oldest Compatible Version": u32, "Fixed Logic Current Version": u32, "Fixed Logic Oldest Compatible Version": u32, "FPGA Radio Settings Bus Current Version": u32, "FPGA Radio Settings Bus Oldest Compatible Version": u32, "FPGA Board Config Current Version": u32, "FPGA Board Config Oldest Compatible Version": u32, "Daughterboard Clock Rate": u32}
  "Stream Control State.gtype" = enum{"Idle", "Active"}
uses:
  NI::USRPRIO::ConfigV1Host::Parse Scope.gvi
  NI::G Core::Timing::Elapsed Timer.gvi
  NI::G Core::Error::Legacy::Error Cluster From Error Code.gvi
  AFW::LTE::RF Control::Check Stream Status.gvi
diagram:
  call "Parse Scope.gvi"(niusrprio session in=$"niusrprio session in", error in=$"error in", scope=$scope) -> (niusrprio session out=w1, device subfunction=w2, error out=w3)
  $"niusrprio session out" <- w1
  Property Node(instance in=w1) -> ("FPGA Interface"=w4)
  Dynamic Fpga Interface Cast(reference in=w4, type="Streaming Xvcr FPGA Ref.gtype" constant) -> (reference out=w5)
  case (w2) {
    frame "tx" {
      Property Node(instance in=w5, "tx.abort"=TRUE, error in=w3) -> (error out=w10, instance out=w11)
      s1 = w10  # shift register
      while (iteration -> i1) {
        Is Equal To 0(x=i1) -> w12
        call "Elapsed Timer.gvi"(target time=$timeout, reset=w12) -> (time has elapsed=w13)
        Property Node(instance in=w11, error in=s1) -> ("tx.samples processed"=w9, "tx.state"=w14, error out=w15)
        Type Cast(type="Stream Control State.gtype" "Idle", x=w14) -> w7
        Is Equal(x=w7, y="Stream Control State.gtype" "Idle") -> w8
        Property Node(instance in=w15) -> ("status"=w16)
        Logical Or(w16, w8, w13) -> w17
        next s1 = w15
        stop if w17
      }
      w6 = s1
    }
    frame "rx", Default {
      Property Node(instance in=w5, "rx.abort"=TRUE, error in=w3) -> (error out=w18, instance out=w19)
      s2 = w18  # shift register
      while (iteration -> i2) {
        Is Equal To 0(x=i2) -> w20
        call "Elapsed Timer.gvi"(target time=$timeout, reset=w20) -> (time has elapsed=w21)
        Property Node(instance in=w19, error in=s2) -> ("rx.samples processed"=w9, "rx.state"=w22, error out=w23)
        Type Cast(type="Stream Control State.gtype" "Idle", x=w22) -> w7
        Is Equal(x=w7, y="Stream Control State.gtype" "Idle") -> w8
        Property Node(instance in=w23) -> ("status"=w24)
        Logical Or(w24, w8, w21) -> w25
        next s2 = w23
        stop if w25
      }
      w6 = s2
    }
  }
  case (w8) {
    frame True {
      w26 = w6
    }
    frame False {
      call "Error Cluster From Error Code.gvi"(error code=-1, error message="Abort Timeout", show call chain?=TRUE) -> (error out=w27)
      Merge Errors(w6, w27) -> (error out=w26)
    }
  }
  case ($"check stream status") {
    frame False, Default {
      w28 = w26
    }
    frame True {
      call "Check Stream Status.gvi"(niusrprio session in=w1, error in=w26, scope=$scope) -> (error out=w28)
    }
  }
  $"error out" <- w28
  # Checking the stream status may report erroneous underflows/overflows when aborting continuous transfers. Do not check the stream status by default (to avoid erroneous warnings).
  $"samples processed" <- w9
  $state <- w7
