vi "Check Stream Status.gvi"   [LabVIEW NXG 4.0.0]
# Checks the status of the stream for when it is done, for FIFO overflows, for FIFO underflows, for DSP overflows, and if the clocks ever became unlocked. Checks the stream status after each Fetch Rx Data/Write Tx Data. Input Parameters niUsrpRio Session is the object created by the Open VI and used as the session handle for the USRP RIO design library. Reference Frequency Source is used when the source is GPS to determine whether to check if the GPS became unlocked. scope is the channel to check the stream status. The options are "rx/RF 0", "rx/RF 1", "tx/RF 0", and "tx/RF 1". error in describes error conditions that occur before this node runs. This input provides standard 'error in' functionality. Output Parameters niUsrpRio Session (out) is the niUsrpRio session used in all subsequent USRP RIO design library host VIs. Done indicates when the acquisition/generation has completed. error out contains error information. This output provides standard 'error out' functionality.
inputs:
  "niusrprio session in": "niUsrpRio Session.gtype", required
  "error in": error
  "scope": string = "rx", required  # is the channel to check the stream status. The options are "rx/RF 0", "rx/RF 1", "tx/RF 0", and "tx/RF 1".
  "reference frequency source": string = "Internal"
outputs:
  "niusrprio session out": "niUsrpRio Session.gtype"
  "done": bool
  "error out": error
types:
  "Register Bus Session.gtype" = Queue<"Session Data.gtype">
  "Semaphore.gtype" = i32
  "DB Queue Reference.gtype" = Queue<"Daughterboard Data.gtype">
  "EEPROM Header.gtype" = cluster{"Checksum": u32, "Product Code": u16, "Hardware Current Version": u16, "Hardware Oldest Compatible Version": u16, "EEPROM Map Current Version": u16, "EEPROM Map Oldest Compatible Version": u16, "User Password": string, "Pointer to Factory Header": u32, "Pointer to User Header": u32, "Recommended Interval": u16, "Number of Reserved Bytes": i32, "Number of Daughterboards": u8, "Daughterboard IDs": u16[], "Daughterboard Serial Numbers": string[]}
  "EEPROM Device Data Header.gtype" = cluster{"Checksum": u32, "Number of Channels": u8, "Number of Gain Settings": u16[], "Pointer to Characterization Data": u32[], "Number of Reserved Bytes": i32, "Number of Frequencies": u16[]}
  "EEPROM Characterization Header.gtype" = cluster{"Checksum": u32, "Date": timestamp, "Temperature": f32, "Misc. Info": string, "Pointer to Device Data Header": u32, "Number of Reserved Bytes": i32}
  "Characterization Data.gtype" = cluster{"Gains[dB]": f64[], "Frequencies [Hz]": f64[], "IQ Imbalance Table": "IQ Imbalance.gtype"[], "Measured Gains[dB]": f64[][]}
  "niUsrpRio Session.gtype" = cluster{"FPGA Interface": any, "RIO Interface Number": u32, "Data Clock Rate": u32, "FPGA Data Clock Rate": u32, "Global Settings Register Bus": "Register Bus Session.gtype", "Radio 0 Settings Register Bus": "Register Bus Session.gtype", "Radio 1 Settings Register Bus": "Register Bus Session.gtype", "Radio Settings Bus Semaphore": "Semaphore.gtype", "DB Queues": "DB Queue Reference.gtype"[], "Characterization Data Valid?": bool, "EEPROM Header": "EEPROM Header.gtype", "Device Data Header": "EEPROM Device Data Header.gtype", "EEPROM Characterization Header": "EEPROM Characterization Header.gtype", "Characterization Data": "Characterization Data.gtype"[], "FPGA Current Version": u32, "FPGA Oldest Compatible Version": u32, "Fixed Logic Current Version": u32, "Fixed Logic Oldest Compatible Version": u32, "FPGA Radio Settings Bus Current Version": u32, "FPGA Radio Settings Bus Oldest Compatible Version": u32, "FPGA Board Config Current Version": u32, "FPGA Board Config Oldest Compatible Version": u32, "Daughterboard Clock Rate": u32}
  "Stream Control State.gtype" = enum{"Idle", "Active"}
uses:
  NI::USRPRIO::ConfigV1Host::Query Status.gvi
  NI::G Core::Error::Legacy::Error Cluster From Error Code.gvi
  NI::USRPRIO::ConfigV1Host::Parse Scope.gvi
diagram:
  # #NOTE: If using GPS, make sure to wait for GPS to lock in order to not get false warnings related to the GPS becoming unlocked during execution.
  case ($"reference frequency source") {
    frame Default {
      w1 = $"niusrprio session in"
      w2 = $"error in"
    }
    frame "GPS" {
      call "Query Status.gvi"(niusrprio session in=$"niusrprio session in", what to query for="GPS Ever Unlocked", error in=$"error in", scope=$scope) -> (niusrprio session out=w1, status=w3, error out=w4)
      Select(s=w3, t=1, f=0) -> w5
      call "Error Cluster From Error Code.gvi"(error code=w5, error message="GPS became unlocked", error in=w4, show call chain?=TRUE, is warning?=TRUE) -> (error out=w2)
    }
  }
  call "Query Status.gvi"(niusrprio session in=w1, what to query for="Clock Chip Ever Unlocked", error in=w2, scope=$scope) -> (niusrprio session out=w6, status=w7, error out=w8)
  Select(s=w7, t=1, f=0) -> w9
  call "Error Cluster From Error Code.gvi"(error code=w9, error message="Clock chip became unlocked", error in=w8, show call chain?=TRUE, is warning?=TRUE) -> (error out=w10)
  call "Query Status.gvi"(niusrprio session in=w6, what to query for="Data Clock PLL Ever Unlocked", error in=w10, scope=$scope) -> (niusrprio session out=w11, status=w12, error out=w13)
  Select(s=w12, t=1, f=0) -> w14
  call "Error Cluster From Error Code.gvi"(error code=w14, error message="Data Clock PLL became unlocked", error in=w13, show call chain?=TRUE, is warning?=TRUE) -> (error out=w15)
  call "Query Status.gvi"(niusrprio session in=w11, what to query for="ADC Clock PLL Ever Unlocked", error in=w15, scope=$scope) -> (niusrprio session out=w16, status=w17, error out=w18)
  Select(s=w17, t=1, f=0) -> w19
  call "Error Cluster From Error Code.gvi"(error code=w19, error message="ADC Clock PLL became unlocked", error in=w18, show call chain?=TRUE, is warning?=TRUE) -> (error out=w20)
  call "Query Status.gvi"(niusrprio session in=w16, what to query for="ADC Data Ever Invalid", error in=w20, scope=$scope) -> (niusrprio session out=w21, status=w22, error out=w23)
  Select(s=w22, t=1, f=0) -> w24
  call "Error Cluster From Error Code.gvi"(error code=w24, error message="ADC data became invalid", error in=w23, show call chain?=TRUE, is warning?=TRUE) -> (error out=w25)
  call "Parse Scope.gvi"(niusrprio session in=w21, error in=w25, scope=$scope) -> (niusrprio session out=w26, device subfunction=w27, error out=w28)
  $"niusrprio session out" <- w26
  Property Node(instance in=w26) -> ("FPGA Interface"=w29)
  Dynamic Fpga Interface Cast(reference in=w29, type="DL FPGA Interface.gtype" constant) -> (reference out=w30)
  case (w27) {
    frame "tx" {
      Property Node(instance in=w30, error in=w28) -> ("tx.underflows"=w31, "tx.number of clipped IQ data samples"=w33, "tx.state"=w34, error out=w32)
      w35 = "Tx FIFO Underflows (%d)"
    }
    frame "rx", Default {
      Property Node(instance in=w30, error in=w28) -> ("rx.number of overflows"=w31, "rx.number of clipped IQ data samples"=w33, "rx.state"=w34, error out=w32)
      w35 = "Rx FIFO Overflows (%d)"
    }
  }
  case (w31) {
    frame 0 {
      w36 = w32
    }
    frame Default {
      Format Into String(formatString=w35, w31) -> w37
      call "Error Cluster From Error Code.gvi"(error code=1, error message=w37, show call chain?=TRUE, is warning?=TRUE) -> (error out=w38)
      Merge Errors(w32, w38) -> (error out=w36)
    }
  }
  case (w33) {
    frame 0 {
      w39 = w36
    }
    frame Default {
      call "Error Cluster From Error Code.gvi"(error code=1, error message="DSP Overflow", show call chain?=TRUE, is warning?=TRUE) -> (error out=w40)
      Merge Errors(w36, w40) -> (error out=w39)
    }
  }
  $"error out" <- w39
  Type Cast(type="Stream Control State.gtype" "Idle", x=w34) -> w41
  Is Equal(x="Stream Control State.gtype" "Idle", y=w41) -> w42
  $done <- w42
