vi "DL Host Cleanup.gvi"   [LabVIEW NXG 4.0.0]
# Releases all queues used in the UE host application, closes the UDP socket used for PDSCH payload data, disables RX and TX front end, and closes the FPGA session.
inputs:
  "session": "Host Session.gtype"  # Contains session information such as used target, FlexRIO and USRP sessions, FPGA reference, and queue references.
  "error in": error
outputs:
  "error out": error
types:
  "Transport Session.gtype" = cluster{"FIFO pathname": string, "pipe reader": "Pipe Reader.gtype", "pipe writer": "Pipe Writer.gtype", "transport in RT FIFO": RTFifoRefnum<u8[]>, "transport out RT FIFO": RTFifoRefnum<u8[]>, "transport in timing source name": string, "transport in timing trigger ID": u8, "transport out timing source name": string, "transport out timing trigger ID": u8, "maximum API message size": u32}
  "Register Bus Session.gtype" = Queue<"Session Data.gtype">
  "Semaphore.gtype" = i32
  "DB Queue Reference.gtype" = Queue<"Daughterboard Data.gtype">
  "niUsrpRio Session.gtype" = cluster{"FPGA Interface": any, "RIO Interface Number": u32, "Data Clock Rate": u32, "FPGA Data Clock Rate": u32, "Global Settings Register Bus": "Register Bus Session.gtype", "Radio 0 Settings Register Bus": "Register Bus Session.gtype", "Radio 1 Settings Register Bus": "Register Bus Session.gtype", "Radio Settings Bus Semaphore": "Semaphore.gtype", "DB Queues": "DB Queue Reference.gtype"[], "Characterization Data Valid?": bool, "EEPROM Header": "EEPROM Header.gtype", "Device Data Header": "EEPROM Device Data Header.gtype", "EEPROM Characterization Header": "EEPROM Characterization Header.gtype", "Characterization Data": "Characterization Data.gtype"[], "FPGA Current Version": u32, "FPGA Oldest Compatible Version": u32, "Fixed Logic Current Version": u32, "Fixed Logic Oldest Compatible Version": u32, "FPGA Radio Settings Bus Current Version": u32, "FPGA Radio Settings Bus Oldest Compatible Version": u32, "FPGA Board Config Current Version": u32, "FPGA Board Config Oldest Compatible Version": u32, "Daughterboard Clock Rate": u32}
  T1 = cluster{"FPGA ref": any, "bus instance": u32, "instruction FIFO depth": u32, "executing on FPGA target": bool, "show error call chain": bool}
  T2 = cluster{"Actual Gain [dB]": f64, "Attenuation Table Index": i32}
  T3 = cluster{"Attenuation Table [dB]": f64[][], "Frequencies [Hz]": f64[], "IQ Imbalance Table": "IQ Imbalance.gtype"[], "Gain Table": T2[][]}
  T4 = cluster{"FlexRIO Register Bus": Queue<T1>, "RX Characterization Data": T3, "TX Characterization Data": T3, "FPGA Interface": any}
  T5 = cluster{"transport block size": u32, "CRC ok": bool, "user data": u32}
  "Link Direction.gtype" = enum{"DL", "UL"}
  T6 = cluster{"MAC Stub RX Payload Information FIFO": RTFifoRefnum<"MAC Stub RX Payload Information.gtype">, "MAC Stub RX Confirmation Information FIFO": RTFifoRefnum<u64[16]>, "MAC Stub RX UL Payload Information FIFO": RTFifoRefnum<f64[23]>}
  T7 = cluster{"MAC Stub TX Input Terminals FIFO": RTFifoRefnum<"MAC Stub TX Input Terminals.gtype">, "MAC Stub TX Output Terminals FIFO": RTFifoRefnum<"MAC Stub TX Output Terminals.gtype">}
  T8 = cluster{"MAC Stub RX Interface": T6, "MAC Stub TX Interface": T7}
  "Host Session.gtype" = cluster{"target": enum{"USRP", "FlexRIO"}, "real time mode": bool, "MAC Stub enabled": bool, "DMA FIFO read timeout": i32, "timed loop period": i64, "LTE Transport Sessions": "Transport Session.gtype"[], "USRP session": "niUsrpRio Session.gtype", "FlexRIO session": T4, "UDP RX session": UdpNetworkConnectionRefnum, "UDP TX session": UdpNetworkConnectionRefnum, "sync found FIFO": RTFifoRefnum<bool>, "PDCCH CRC OK FIFO": RTFifoRefnum<bool>, "DL PDCCH status FIFO": RTFifoRefnum<cluster{"CRC ok": bool, "subframe number": u32}>, "DL PDSCH status FIFO": RTFifoRefnum<cluster{"CRC ok": bool, "subframe number": u32}>, "DL SINR FIFO": RTFifoRefnum<f64[]>, "PDSCH user data FIFO": RTFifoRefnum<u32>, "PDSCH user data UDP FIFO": RTFifoRefnum<T5>, "PDSCH user data throughput FIFO": RTFifoRefnum<T5>, "PUSCH user data FIFO": RTFifoRefnum<u32>, "PUSCH user data UDP FIFO": RTFifoRefnum<T5>, "PUSCH user data throughput FIFO": RTFifoRefnum<T5>, "UE feedback info FIFO": RTFifoRefnum<u8[]>, "Request information FIFO": RTFifoRefnum<"Request Information.gtype">, "UDP TX outbound FIFO": RTFifoRefnum<u8[]>, "UDP RX inbound FIFO": RTFifoRefnum<u8[]>, "stop notifier": Notifier<string>, "DL RX scope": string, "UL RX scope": string, "external MAC log file": string, "external MAC process ID": u32, "TX link direction": "Link Direction.gtype", "RX link direction": "Link Direction.gtype", "Sychronization FIFO": RTFifoRefnum<i32>, "RT Loop Interfaces": T8}
uses:
  NI::USRPRIO::ConfigV1Host::Enable Front End.gvi
  NI::USRPRIO::ConfigV1Host::Close.gvi
  AFW::LTE::Configuration::RT Interface Cleanup.gvi
  AFW::LTE::L1L2 API::Transport::Transport Clean Up.gvi
diagram:
  Property Node(instance in=$session) -> ("external MAC log file"=w1, "external MAC process ID"=w2, "UDP TX outbound FIFO"=w3, "UDP RX inbound FIFO"=w4, "Request information FIFO"=w5, "LTE Transport Sessions"=w6, "USRP session"=w7, "UDP RX session"=w8, "sync found FIFO"=w9, "PDCCH CRC OK FIFO"=w10, "DL PDCCH status FIFO"=w11, "DL PDSCH status FIFO"=w12, "DL SINR FIFO"=w13, "PDSCH user data FIFO"=w14, "stop notifier"=w15, "PDSCH user data UDP FIFO"=w16, "PDSCH user data throughput FIFO"=w17, "RT Loop Interfaces"=w18)
  # Dont use incoming error to ensure safe USRP shutdown
  call "Enable Front End.gvi"(niusrprio session in=w7, enable=FALSE, error in=no error, scope="rx") -> (niusrprio session out=w19, error out=w20)
  call "Enable Front End.gvi"(niusrprio session in=w19, enable=FALSE, error in=w20, scope="tx") -> (niusrprio session out=w21, error out=w22)
  call "Close.gvi"(niusrprio session in=w21, error in=w22, scope="") -> (fpga ref=w23, error out=w24)
  FPGA Close Node(abort?=FALSE, error in=w24, reference in=w23) -> (error out=w25)
  call "RT Interface Cleanup.gvi"(RT Loop Interfaces=w18, error in=no error) -> (error out=w26)
  Release Notifier(error in (no error)=w26, notifier=w15) -> (error out=w27)
  RTFIFO Delete(error in=w27, rt fifo=w17) -> (error out=w28)
  RTFIFO Delete(error in=w28, rt fifo=w16) -> (error out=w29)
  RTFIFO Delete(error in=w29, rt fifo=w14) -> (error out=w30)
  RTFIFO Delete(error in=w30, rt fifo=w13) -> (error out=w31)
  RTFIFO Delete(error in=w31, rt fifo=w12) -> (error out=w32)
  RTFIFO Delete(error in=w32, rt fifo=w11) -> (error out=w33)
  RTFIFO Delete(error in=w33, rt fifo=w10) -> (error out=w34)
  RTFIFO Delete(error in=w34, rt fifo=w9) -> (error out=w35)
  Udp Close(connection ID=w8, error in=w35) -> (error out=w36)
  disable {
    frame TARGET_TYPE != "RT", Default {
      w37 = w36
    }
    frame TARGET_TYPE == "RT" {
      call "Transport Clean Up.gvi"(LTE Transport Sessions=w6, MAC process ID=w2, MAC log file=w1, error in=w36) -> (error out=w37)
    }
  }
  RTFIFO Delete(error in=w37, rt fifo=w5) -> (error out=w38)
  RTFIFO Delete(error in=w38, rt fifo=w4) -> (error out=w39)
  RTFIFO Delete(error in=w39, rt fifo=w3) -> (error out=w40)
  Merge Errors($"error in", w40, w25) -> (error out=w41)
  $"error out" <- w41
