vi "Setup RF.gvi"   [LabVIEW NXG 4.0.0]
# Configures RF parameters like reference clock, center frequency, gain, etc. and initiates data transfer from or to the antenna.
# Can be used to configure either the RX or the TX RF depending on the specified scope.
inputs:
  "USRP RIO session in": "niUsrpRio Session.gtype"  # USRP session cluster containing different handles and references, and device and characterization data.
  "antenna port": string = "TX1"
  "correct impairments": bool = TRUE  # If enabled, the device's correction information is applied to the signal.
  "error in": error
  "scope": string  # Specifies whether RX or TX should be configured, and selects the used RF port. For example, rx/RF 0 selects the RF 0 port to be configured for RX reception.
  "frequency [Hz]": f64  # Requested center frequency, in Hz, to acquire the signal from and generate the signal at.
  "power level/gain [dB]": f64  # Requested RX gain/TX output power level.
outputs:
  "coerced frequency [Hz]": f64  # Actual center frequency, in Hz, to acquire the signal from and generate the signal at.
  "USRP RIO session out": "niUsrpRio Session.gtype"  # USRP session cluster containing different handles and references, and device and characterization data.
  "coerced gain [dB]": f64  # actual RX gain/TX output power level
  "error out": error
types:
  "Register Bus Session.gtype" = Queue<"Session Data.gtype">
  "Semaphore.gtype" = i32
  "DB Queue Reference.gtype" = Queue<"Daughterboard Data.gtype">
  "EEPROM Header.gtype" = cluster{"Checksum": u32, "Product Code": u16, "Hardware Current Version": u16, "Hardware Oldest Compatible Version": u16, "EEPROM Map Current Version": u16, "EEPROM Map Oldest Compatible Version": u16, "User Password": string, "Pointer to Factory Header": u32, "Pointer to User Header": u32, "Recommended Interval": u16, "Number of Reserved Bytes": i32, "Number of Daughterboards": u8, "Daughterboard IDs": u16[], "Daughterboard Serial Numbers": string[]}
  "EEPROM Device Data Header.gtype" = cluster{"Checksum": u32, "Number of Channels": u8, "Number of Gain Settings": u16[], "Pointer to Characterization Data": u32[], "Number of Reserved Bytes": i32, "Number of Frequencies": u16[]}
  "EEPROM Characterization Header.gtype" = cluster{"Checksum": u32, "Date": timestamp, "Temperature": f32, "Misc. Info": string, "Pointer to Device Data Header": u32, "Number of Reserved Bytes": i32}
  "Characterization Data.gtype" = cluster{"Gains[dB]": f64[], "Frequencies [Hz]": f64[], "IQ Imbalance Table": "IQ Imbalance.gtype"[], "Measured Gains[dB]": f64[][]}
  "niUsrpRio Session.gtype" = cluster{"FPGA Interface": any, "RIO Interface Number": u32, "Data Clock Rate": u32, "FPGA Data Clock Rate": u32, "Global Settings Register Bus": "Register Bus Session.gtype", "Radio 0 Settings Register Bus": "Register Bus Session.gtype", "Radio 1 Settings Register Bus": "Register Bus Session.gtype", "Radio Settings Bus Semaphore": "Semaphore.gtype", "DB Queues": "DB Queue Reference.gtype"[], "Characterization Data Valid?": bool, "EEPROM Header": "EEPROM Header.gtype", "Device Data Header": "EEPROM Device Data Header.gtype", "EEPROM Characterization Header": "EEPROM Characterization Header.gtype", "Characterization Data": "Characterization Data.gtype"[], "FPGA Current Version": u32, "FPGA Oldest Compatible Version": u32, "Fixed Logic Current Version": u32, "Fixed Logic Oldest Compatible Version": u32, "FPGA Radio Settings Bus Current Version": u32, "FPGA Radio Settings Bus Oldest Compatible Version": u32, "FPGA Board Config Current Version": u32, "FPGA Board Config Oldest Compatible Version": u32, "Daughterboard Clock Rate": u32}
uses:
  NI::USRPRIO::ConfigV1Host::Parse Scope.gvi
  Host SubVIs::Configure Signal (Level).gvi
  NI::G Core::Error::Filter Error Code.gvi
  Host SubVIs::Configure Signal (Gain).gvi
  AFW::LTE::RF Control::Initiate Stream.gvi
diagram:
  case ($"error in") {
    frame Error {
      w1 = $"power level/gain [dB]"
      w2 = $"frequency [Hz]"
      w3 = $"USRP RIO session in"
      w4 = $"error in"
    }
    frame No Error {
      call "Parse Scope.gvi"(niusrprio session in=$"USRP RIO session in", error in=$"error in", scope=$scope) -> (niusrprio session out=w5, device subfunction=w6, error out=w7)
      case (w6) {
        frame "tx", Default {
          call "Configure Signal (Level).gvi"(active antenna=$"antenna port", lo frequency [hz]=-1, niusrprio session in=w5, sample rate [s/s]=30720000, frequency [hz]=$"frequency [Hz]", level [dbm]=$"power level/gain [dB]", error in=w7, scope=$scope, correct impairments?=$"correct impairments") -> (coerced lo frequency [hz]=w10, niusrprio session out=w11, coerced frequency [hz]=w12, coerced level [dbm]=w13, error out=w14)
          call "Filter Error Code.gvi"(error in=w14, code to clear=-1074100585) -> (error out=w15)
          case (FALSE) {
            frame False, Default {
              w16 = w12
              w17 = w15
              w18 = w13
              w19 = w11
              w20 = -1
              w21 = $"correct impairments"
              w22 = $scope
              w23 = $"power level/gain [dB]"
            }
            frame True {
              call "Configure Signal (Level).gvi"(active antenna=$"antenna port", lo frequency [hz]=-1, niusrprio session in=w11, sample rate [s/s]=30720000, frequency [hz]=$"frequency [Hz]", level [dbm]=10, error in=w15, scope=$scope, correct impairments?=$"correct impairments") -> (niusrprio session out=w19, coerced frequency [hz]=w16, coerced level [dbm]=w18, error out=w24)
              w25 = error {"status"=FALSE, "code"=5000, "source"="lte_setup_rf.gvi"}
              Merge Errors(w24, w25) -> (error out=w17)
              w20 = -1
              w21 = $"correct impairments"
              w22 = $scope
              w23 = 10
            }
          }
          Subtract(x=w12, y=w10) -> w26
          Absolute Value(x=w26) -> w27
          Is Greater(x=w27, y=100000) -> w28
          case (w28) {
            frame False, Default {
              w2 = w16
              w9 = w17
              w1 = w18
              w8 = w19
            }
            frame True {
              call "Configure Signal (Level).gvi"(active antenna=$"antenna port", lo frequency [hz]=w20, niusrprio session in=w19, sample rate [s/s]=30720000, frequency [hz]=w10, level [dbm]=w23, error in=w17, scope=w22, correct impairments?=w21) -> (niusrprio session out=w8, coerced frequency [hz]=w2, coerced level [dbm]=w1, error out=w29)
              w30 = error {"status"=FALSE, "code"=5001, "source"="lte_setup_rf.gvi"}
              Merge Errors(w29, w30) -> (error out=w9)
            }
          }
        }
        frame "rx" {
          call "Configure Signal (Gain).gvi"(active antenna=$"antenna port", lo frequency [hz]=-1, niusrprio session in=w5, sample rate [s/s]=30720000, frequency [hz]=$"frequency [Hz]", gain [db]=$"power level/gain [dB]", error in=w7, scope=$scope, correct impairments?=$"correct impairments") -> (coerced lo frequency [hz]=w31, niusrprio session out=w32, coerced frequency [hz]=w33, coerced gain [db]=w34, error out=w35)
          Subtract(x=w33, y=w31) -> w36
          Absolute Value(x=w36) -> w37
          Is Greater(x=w37, y=100000) -> w38
          case (w38) {
            frame False, Default {
              w2 = w33
              w9 = w35
              w1 = w34
              w8 = w32
            }
            frame True {
              call "Configure Signal (Gain).gvi"(active antenna=$"antenna port", lo frequency [hz]=-1, niusrprio session in=w32, sample rate [s/s]=30720000, frequency [hz]=w31, gain [db]=$"power level/gain [dB]", error in=w35, scope=$scope, correct impairments?=$"correct impairments") -> (niusrprio session out=w8, coerced frequency [hz]=w2, coerced gain [db]=w1, error out=w39)
              w40 = error {"status"=FALSE, "code"=5001, "source"="lte_setup_rf.gvi"}
              Merge Errors(w39, w40) -> (error out=w9)
            }
          }
        }
      }
      disable {
        frame Enabled {
          w4 = w9
          w3 = w8
        }
        frame Disabled {
          call "Initiate Stream.gvi"(niusrprio session in=w8, error in=w9, scope=$scope) -> (niusrprio session out=w3, error out=w4)
        }
      }
    }
  }
  $"USRP RIO session out" <- w3
  $"error out" <- w4
  $"coerced frequency [Hz]" <- w2
  $"coerced gain [dB]" <- w1
