vi "Setup RX.gvi"   [LabVIEW NXG 4.0.0]
# Configures the RF part of the receiver, including the reference clock, center frequency, gain, and used RF port.
# Triggers the reception of data from the RX antenna.
inputs:
  "session in": "Host Session.gtype"
  "RX port": "USRP RX RF Port.gtype" = "RX2/RF0"  # Selects one of the USRP RIO ports that is used for data reception.
  "error in": error
  "RX frequency [Hz]": f64 = 2400000000  # Requested center frequency, in Hz, to acquire the signal from.
  "gain value [dB]": f64  # Requested RX gain, in dB.
outputs:
  "session out": "Host Session.gtype"  # Contains session information such as used target, FlexRIO and USRP sessions, FPGA reference, and queue references.
  "coerced gain [dB]": f64  # Actual applied RX gain values, in dB.
  "error out": error
  "coerced frequency [Hz]": f64  # Actual center frequency, in Hz, to acquire the signal from.
types:
  "USRP RX RF Port.gtype" = enum{"RX1/RF0", "RX2/RF0", "RX1/RF1", "RX2/RF1"}
  "Transport Session.gtype" = cluster{"FIFO pathname": string, "pipe reader": "Pipe Reader.gtype", "pipe writer": "Pipe Writer.gtype", "transport in RT FIFO": RTFifoRefnum<u8[]>, "transport out RT FIFO": RTFifoRefnum<u8[]>, "transport in timing source name": string, "transport in timing trigger ID": u8, "transport out timing source name": string, "transport out timing trigger ID": u8, "maximum API message size": u32}
  "Register Bus Session.gtype" = Queue<"Session Data.gtype">
  "Semaphore.gtype" = i32
  "DB Queue Reference.gtype" = Queue<"Daughterboard Data.gtype">
  "niUsrpRio Session.gtype" = cluster{"FPGA Interface": any, "RIO Interface Number": u32, "Data Clock Rate": u32, "FPGA Data Clock Rate": u32, "Global Settings Register Bus": "Register Bus Session.gtype", "Radio 0 Settings Register Bus": "Register Bus Session.gtype", "Radio 1 Settings Register Bus": "Register Bus Session.gtype", "Radio Settings Bus Semaphore": "Semaphore.gtype", "DB Queues": "DB Queue Reference.gtype"[], "Characterization Data Valid?": bool, "EEPROM Header": "EEPROM Header.gtype", "Device Data Header": "EEPROM Device Data Header.gtype", "EEPROM Characterization Header": "EEPROM Characterization Header.gtype", "Characterization Data": "Characterization Data.gtype"[], "FPGA Current Version": u32, "FPGA Oldest Compatible Version": u32, "Fixed Logic Current Version": u32, "Fixed Logic Oldest Compatible Version": u32, "FPGA Radio Settings Bus Current Version": u32, "FPGA Radio Settings Bus Oldest Compatible Version": u32, "FPGA Board Config Current Version": u32, "FPGA Board Config Oldest Compatible Version": u32, "Daughterboard Clock Rate": u32}
  T1 = cluster{"FPGA ref": any, "bus instance": u32, "instruction FIFO depth": u32, "executing on FPGA target": bool, "show error call chain": bool}
  T2 = cluster{"Actual Gain [dB]": f64, "Attenuation Table Index": i32}
  T3 = cluster{"Attenuation Table [dB]": f64[][], "Frequencies [Hz]": f64[], "IQ Imbalance Table": "IQ Imbalance.gtype"[], "Gain Table": T2[][]}
  T4 = cluster{"FlexRIO Register Bus": Queue<T1>, "RX Characterization Data": T3, "TX Characterization Data": T3, "FPGA Interface": any}
  T5 = cluster{"transport block size": u32, "CRC ok": bool, "user data": u32}
  "Link Direction.gtype" = enum{"DL", "UL"}
  T6 = cluster{"MAC Stub RX Payload Information FIFO": RTFifoRefnum<"MAC Stub RX Payload Information.gtype">, "MAC Stub RX Confirmation Information FIFO": RTFifoRefnum<u64[16]>, "MAC Stub RX UL Payload Information FIFO": RTFifoRefnum<f64[23]>}
  T7 = cluster{"MAC Stub TX Input Terminals FIFO": RTFifoRefnum<"MAC Stub TX Input Terminals.gtype">, "MAC Stub TX Output Terminals FIFO": RTFifoRefnum<"MAC Stub TX Output Terminals.gtype">}
  T8 = cluster{"MAC Stub RX Interface": T6, "MAC Stub TX Interface": T7}
  "Host Session.gtype" = cluster{"target": enum{"USRP", "FlexRIO"}, "real time mode": bool, "MAC Stub enabled": bool, "DMA FIFO read timeout": i32, "timed loop period": i64, "LTE Transport Sessions": "Transport Session.gtype"[], "USRP session": "niUsrpRio Session.gtype", "FlexRIO session": T4, "UDP RX session": UdpNetworkConnectionRefnum, "UDP TX session": UdpNetworkConnectionRefnum, "sync found FIFO": RTFifoRefnum<bool>, "PDCCH CRC OK FIFO": RTFifoRefnum<bool>, "DL PDCCH status FIFO": RTFifoRefnum<cluster{"CRC ok": bool, "subframe number": u32}>, "DL PDSCH status FIFO": RTFifoRefnum<cluster{"CRC ok": bool, "subframe number": u32}>, "DL SINR FIFO": RTFifoRefnum<f64[]>, "PDSCH user data FIFO": RTFifoRefnum<u32>, "PDSCH user data UDP FIFO": RTFifoRefnum<T5>, "PDSCH user data throughput FIFO": RTFifoRefnum<T5>, "PUSCH user data FIFO": RTFifoRefnum<u32>, "PUSCH user data UDP FIFO": RTFifoRefnum<T5>, "PUSCH user data throughput FIFO": RTFifoRefnum<T5>, "UE feedback info FIFO": RTFifoRefnum<u8[]>, "Request information FIFO": RTFifoRefnum<"Request Information.gtype">, "UDP TX outbound FIFO": RTFifoRefnum<u8[]>, "UDP RX inbound FIFO": RTFifoRefnum<u8[]>, "stop notifier": Notifier<string>, "DL RX scope": string, "UL RX scope": string, "external MAC log file": string, "external MAC process ID": u32, "TX link direction": "Link Direction.gtype", "RX link direction": "Link Direction.gtype", "Sychronization FIFO": RTFifoRefnum<i32>, "RT Loop Interfaces": T8}
uses:
  AFW::LTE::RF Control::Unbundle Session.gvi
  AFW::LTE::RF Control::Setup RF.gvi
  NI::G Core::Error::Filter Error Code.gvi
diagram:
  call "Unbundle Session.gvi"(session=$"session in") -> (RX link direction=w1, DL FPGA Interface=w2, USRP session=w3)
  w4 = 2  # antenna ports per RF
  Type Cast(type=u8 0, x=$"RX port") -> w5
  Quotient And Remainder(x=w5, y=w4) -> (floor(x/y)=w6, x-y*floor(x/y)=w7)
  Format Into String(formatString="rx/RF %d", errIn=$"error in", w6) -> (outString=w8, errOut=w9)
  case (w1) {
    frame "DL", Default {
      Property Node(instance in=$"session in", "DL RX scope"=w8) -> (instance out=w10)
    }
    frame "UL" {
      Property Node(instance in=$"session in", "UL RX scope"=w8) -> (instance out=w10)
    }
  }
  $"session out" <- w10
  # w6: RF
  Increment(x=w7) -> w11
  Format Into String(formatString="RX%d", errIn=$"error in", w11) -> (outString=w12, errOut=w13)
  Merge Errors(w13, w9) -> (error out=w14)
  call "Setup RF.gvi"(frequency [Hz]=$"RX frequency [Hz]", power level/gain [dB]=$"gain value [dB]", USRP RIO session in=w3, correct impairments=TRUE, error in=w14, scope=w8, antenna port=w12) -> (coerced gain [dB]=w15, coerced frequency [Hz]=w16, error out=w17)
  To Signed 32 Bit Integer(number=w6) -> w18
  Property Node(instance in=w2, "RX RF channel"=w18, error in=w17) -> (error out=w19)
  call "Filter Error Code.gvi"(error in=w19, code to clear=5001) -> (error out=w20, error cleared?=w21)
  case (w21) {
    frame False, Default { }
    frame True {
      w22 = "The RX frequency was set to a coerced value because the provided value was out of bounds."
      One Button Dialog(message=w22)
    }
  }
  $"error out" <- w20
  $"coerced gain [dB]" <- w15
  $"coerced frequency [Hz]" <- w16
