vi "Setup TX.gvi"   [LabVIEW NXG 4.0.0]
# Configures the RF part of the transmitter, including the reference clock, center frequency, output power level, and used RF port.
# Triggers the transmission of calculated baseband data to the TX antenna.
inputs:
  "session in": "Host Session.gtype"
  "TX frequency [Hz]": f64  # Requested center frequency, in Hz, to generate the signal at.
  "TX power level [dB]": f64  # Requested output power level, in dB.
  "TX port": enum{"TX1/RF0", "TX1/RF1"} = "TX1/RF0"  # Selects one of the USRP RIO ports that is used for data transmission.
  "RF timing offset": i32  # TX RF timing offset, in number of samples, on the LTE sample rate (30.72 MS/s). Only used for independent TX (i.e. DL or eNodeB mode). This number is converted to number of samples on RF clock rate (for example, 200 MS/s) before the value is written to the FPGA.
  "error in": error
  "timing advance": u32  # Timing advance in baseband samples. Triggers the TX the configured number of samples earlier to ensure that TX and RX are aligned at the antenna.
outputs:
  "coerced output power [dB]": f64  # Actual output power level of the signal, in dB.
  "error out": error
  "session dup": "Host Session.gtype"  # Contains session information such as used target, FlexRIO and USRP sessions, FPGA reference, and queue references.
  "coerced frequency [Hz]": f64  # Actual center frequency, in Hz, to generate the signal at.
  "coerced power level setting [dB]": f64  # Coerced requested output power level of the signal, in dB. This value should be the same as TX power level [dB] as long as you configure a power level within the supported range.
types:
  "Transport Session.gtype" = cluster{"FIFO pathname": string, "pipe reader": "Pipe Reader.gtype", "pipe writer": "Pipe Writer.gtype", "transport in RT FIFO": RTFifoRefnum<u8[]>, "transport out RT FIFO": RTFifoRefnum<u8[]>, "transport in timing source name": string, "transport in timing trigger ID": u8, "transport out timing source name": string, "transport out timing trigger ID": u8, "maximum API message size": u32}
  "Register Bus Session.gtype" = Queue<"Session Data.gtype">
  "Semaphore.gtype" = i32
  "DB Queue Reference.gtype" = Queue<"Daughterboard Data.gtype">
  "niUsrpRio Session.gtype" = cluster{"FPGA Interface": any, "RIO Interface Number": u32, "Data Clock Rate": u32, "FPGA Data Clock Rate": u32, "Global Settings Register Bus": "Register Bus Session.gtype", "Radio 0 Settings Register Bus": "Register Bus Session.gtype", "Radio 1 Settings Register Bus": "Register Bus Session.gtype", "Radio Settings Bus Semaphore": "Semaphore.gtype", "DB Queues": "DB Queue Reference.gtype"[], "Characterization Data Valid?": bool, "EEPROM Header": "EEPROM Header.gtype", "Device Data Header": "EEPROM Device Data Header.gtype", "EEPROM Characterization Header": "EEPROM Characterization Header.gtype", "Characterization Data": "Characterization Data.gtype"[], "FPGA Current Version": u32, "FPGA Oldest Compatible Version": u32, "Fixed Logic Current Version": u32, "Fixed Logic Oldest Compatible Version": u32, "FPGA Radio Settings Bus Current Version": u32, "FPGA Radio Settings Bus Oldest Compatible Version": u32, "FPGA Board Config Current Version": u32, "FPGA Board Config Oldest Compatible Version": u32, "Daughterboard Clock Rate": u32}
  T1 = cluster{"FPGA ref": any, "bus instance": u32, "instruction FIFO depth": u32, "executing on FPGA target": bool, "show error call chain": bool}
  T2 = cluster{"Actual Gain [dB]": f64, "Attenuation Table Index": i32}
  T3 = cluster{"Attenuation Table [dB]": f64[][], "Frequencies [Hz]": f64[], "IQ Imbalance Table": "IQ Imbalance.gtype"[], "Gain Table": T2[][]}
  T4 = cluster{"FlexRIO Register Bus": Queue<T1>, "RX Characterization Data": T3, "TX Characterization Data": T3, "FPGA Interface": any}
  T5 = cluster{"transport block size": u32, "CRC ok": bool, "user data": u32}
  "Link Direction.gtype" = enum{"DL", "UL"}
  T6 = cluster{"MAC Stub RX Payload Information FIFO": RTFifoRefnum<"MAC Stub RX Payload Information.gtype">, "MAC Stub RX Confirmation Information FIFO": RTFifoRefnum<u64[16]>, "MAC Stub RX UL Payload Information FIFO": RTFifoRefnum<f64[23]>}
  T7 = cluster{"MAC Stub TX Input Terminals FIFO": RTFifoRefnum<"MAC Stub TX Input Terminals.gtype">, "MAC Stub TX Output Terminals FIFO": RTFifoRefnum<"MAC Stub TX Output Terminals.gtype">}
  T8 = cluster{"MAC Stub RX Interface": T6, "MAC Stub TX Interface": T7}
  "Host Session.gtype" = cluster{"target": enum{"USRP", "FlexRIO"}, "real time mode": bool, "MAC Stub enabled": bool, "DMA FIFO read timeout": i32, "timed loop period": i64, "LTE Transport Sessions": "Transport Session.gtype"[], "USRP session": "niUsrpRio Session.gtype", "FlexRIO session": T4, "UDP RX session": UdpNetworkConnectionRefnum, "UDP TX session": UdpNetworkConnectionRefnum, "sync found FIFO": RTFifoRefnum<bool>, "PDCCH CRC OK FIFO": RTFifoRefnum<bool>, "DL PDCCH status FIFO": RTFifoRefnum<cluster{"CRC ok": bool, "subframe number": u32}>, "DL PDSCH status FIFO": RTFifoRefnum<cluster{"CRC ok": bool, "subframe number": u32}>, "DL SINR FIFO": RTFifoRefnum<f64[]>, "PDSCH user data FIFO": RTFifoRefnum<u32>, "PDSCH user data UDP FIFO": RTFifoRefnum<T5>, "PDSCH user data throughput FIFO": RTFifoRefnum<T5>, "PUSCH user data FIFO": RTFifoRefnum<u32>, "PUSCH user data UDP FIFO": RTFifoRefnum<T5>, "PUSCH user data throughput FIFO": RTFifoRefnum<T5>, "UE feedback info FIFO": RTFifoRefnum<u8[]>, "Request information FIFO": RTFifoRefnum<"Request Information.gtype">, "UDP TX outbound FIFO": RTFifoRefnum<u8[]>, "UDP RX inbound FIFO": RTFifoRefnum<u8[]>, "stop notifier": Notifier<string>, "DL RX scope": string, "UL RX scope": string, "external MAC log file": string, "external MAC process ID": u32, "TX link direction": "Link Direction.gtype", "RX link direction": "Link Direction.gtype", "Sychronization FIFO": RTFifoRefnum<i32>, "RT Loop Interfaces": T8}
uses:
  AFW::LTE::RF Control::Unbundle Session.gvi
  AFW::LTE::Conversion::Compute TX Trigger Offset.gvi
  AFW::LTE::RF Control::Setup RF.gvi
  NI::G Core::Error::Filter Error Code.gvi
diagram:
  $"session dup" <- $"session in"
  call "Unbundle Session.gvi"(session=$"session in") -> (TX link direction=w1, DL FPGA Interface=w2, USRP session=w3)
  Property Node(instance in=w3) -> ("Data Clock Rate"=w4, instance out=w5)
  Type Cast(type=u16 0, x=$"TX port") -> w6
  To Signed 32 Bit Integer(number=w6) -> w7
  Quotient And Remainder(x=w4, y=100) -> (floor(x/y)=w8)
  case (w1) {
    frame "DL", Default {
      w9 = 17239
    }
    frame "UL" {
      w9 = 17230
    }
  }
  call "Compute TX Trigger Offset.gvi"(processing delay [samples]=w9, timing advance [samples]=$"timing advance", clock cycles per radio frame=w8) -> (TX trigger offset=w10)
  Property Node(instance in=$"session in") -> ("USRP session:Data Clock Rate"=w11)
  To Double Precision Float(number=w11) -> w12
  To Double Precision Float(number=$"RF timing offset") -> w13
  # Recalc 30.72MS to RF clock rate
  Divide(x=w13, y=30720000) -> w14
  Multiply(w12, w14) -> w15
  To Signed 32 Bit Integer(number=w15) -> w16
  Property Node(instance in=w2, "TX start trigger count"=w8, "BB processing delay"=w10, "TX RF channel"=w7, "TX RF trigger offset"=w16, error in=$"error in") -> (error out=w17)
  Format Into String(formatString="tx/RF %d", errIn=w17, $"TX port") -> (outString=w18, errOut=w19)
  call "Setup RF.gvi"(frequency [Hz]=$"TX frequency [Hz]", power level/gain [dB]=$"TX power level [dB]", USRP RIO session in=w5, correct impairments=FALSE, error in=w19, scope=w18, antenna port="TX1") -> (coerced gain [dB]=w20, coerced frequency [Hz]=w21, error out=w22)
  $"coerced output power [dB]" <- w20
  $"coerced frequency [Hz]" <- w21
  call "Filter Error Code.gvi"(error in=w22, code to clear=5000) -> (error out=w23, error cleared?=w24)
  call "Filter Error Code.gvi"(error in=w23, code to clear=5001) -> (error out=w25, error cleared?=w26)
  $"error out" <- w25
  case (w26) {
    frame False, Default { }
    frame True {
      w27 = "The UE TX frequency was set to a coerced value because the provided value was out of bounds."
      One Button Dialog(message=w27)
    }
  }
  case (w24) {
    frame False, Default {
      w28 = $"TX power level [dB]"
    }
    frame True {
      w29 = "The UE TX Power Level was set to a default value because the provided value was out of bounds."
      One Button Dialog(message=w29)
      w28 = 10
    }
  }
  $"coerced power level setting [dB]" <- w28
