vi "USRP Calculate Level From Gain.gvi"   [LabVIEW NXG 4.0.0]
# Lookup RX reference level, in dBm, at a specified gain for a specified frequency.
inputs:
  "niUsrpRio Session": "niUsrpRio Session.gtype"  # The USRP RIO session cluster containing device-specific parameters.
  "gain": f64  # RX gain at which to look up the reference level, in Hz.
  "frequency": f64  # RX frequency at which to look up the reference level, in Hz.
  "error in": error
  "scope": string  # RX port to be used
outputs:
  "niUsrpRio Session (out)": "niUsrpRio Session.gtype"  # The USRP RIO session cluster containing device-specific parameters.
  "level": f64  # Reference level at input gain, in dB.
  "error out": error
types:
  "Register Bus Session.gtype" = Queue<"Session Data.gtype">
  "Semaphore.gtype" = i32
  "DB Queue Reference.gtype" = Queue<"Daughterboard Data.gtype">
  "EEPROM Header.gtype" = cluster{"Checksum": u32, "Product Code": u16, "Hardware Current Version": u16, "Hardware Oldest Compatible Version": u16, "EEPROM Map Current Version": u16, "EEPROM Map Oldest Compatible Version": u16, "User Password": string, "Pointer to Factory Header": u32, "Pointer to User Header": u32, "Recommended Interval": u16, "Number of Reserved Bytes": i32, "Number of Daughterboards": u8, "Daughterboard IDs": u16[], "Daughterboard Serial Numbers": string[]}
  "EEPROM Device Data Header.gtype" = cluster{"Checksum": u32, "Number of Channels": u8, "Number of Gain Settings": u16[], "Pointer to Characterization Data": u32[], "Number of Reserved Bytes": i32, "Number of Frequencies": u16[]}
  "EEPROM Characterization Header.gtype" = cluster{"Checksum": u32, "Date": timestamp, "Temperature": f32, "Misc. Info": string, "Pointer to Device Data Header": u32, "Number of Reserved Bytes": i32}
  "Characterization Data.gtype" = cluster{"Gains[dB]": f64[], "Frequencies [Hz]": f64[], "IQ Imbalance Table": "IQ Imbalance.gtype"[], "Measured Gains[dB]": f64[][]}
  "niUsrpRio Session.gtype" = cluster{"FPGA Interface": any, "RIO Interface Number": u32, "Data Clock Rate": u32, "FPGA Data Clock Rate": u32, "Global Settings Register Bus": "Register Bus Session.gtype", "Radio 0 Settings Register Bus": "Register Bus Session.gtype", "Radio 1 Settings Register Bus": "Register Bus Session.gtype", "Radio Settings Bus Semaphore": "Semaphore.gtype", "DB Queues": "DB Queue Reference.gtype"[], "Characterization Data Valid?": bool, "EEPROM Header": "EEPROM Header.gtype", "Device Data Header": "EEPROM Device Data Header.gtype", "EEPROM Characterization Header": "EEPROM Characterization Header.gtype", "Characterization Data": "Characterization Data.gtype"[], "FPGA Current Version": u32, "FPGA Oldest Compatible Version": u32, "Fixed Logic Current Version": u32, "Fixed Logic Oldest Compatible Version": u32, "FPGA Radio Settings Bus Current Version": u32, "FPGA Radio Settings Bus Oldest Compatible Version": u32, "FPGA Board Config Current Version": u32, "FPGA Board Config Oldest Compatible Version": u32, "Daughterboard Clock Rate": u32}
uses:
  NI::G Core::Error::Legacy::Error Cluster From Error Code.gvi
  NI::USRPRIO::ConfigV1Host::Map Channel to Characterization Data Index.gvi
  NI::USRPRIO::ConfigV1Host::Parse Scope.gvi
diagram:
  Property Node(instance in=$"niUsrpRio Session") -> ("Characterization Data Valid?"=w1, instance out=w2)
  case (w1) {
    frame False, Default {
      w5 = "-1074100584: USRP RIO: The device does not contain valid characterization data, which is required to configure reference level, output power, or correct IQ impairments."
      call "Error Cluster From Error Code.gvi"(error code=-1074100584, error message=w5, show call chain?=TRUE, is warning?=FALSE) -> (error out=w6)
      Merge Errors($"error in", w6) -> (error out=w4)
      w3 = w2
    }
    frame True {
      w3 = w2
      w4 = $"error in"
    }
  }
  $"niUsrpRio Session (out)" <- w3
  case (w4) {
    frame No Error {
      Property Node(instance in=w3) -> ("EEPROM Header:EEPROM Map Current Version"=w9, "Characterization Data"=w10)
      call "Map Channel to Characterization Data Index.gvi"(error in=w4, scope=$scope) -> (index=w11, error out=w12)
      call "Parse Scope.gvi"(niusrprio session in=w3, error in=w12, scope=$scope) -> (device subfunction=w13, error out=w14)
      Array Index(array=w10) -> (out0[w11]=w15)
      Property Node(instance in=w15) -> ("Gains[dB]"=w16, "Measured Gains[dB]"=w17, "Frequencies [Hz]"=w18)
      Array Index(array=w16) -> (out0[0]=w19)
      Array Index(array=w17) -> (out0[_, 0]=w20)
      Threshold 1D Array(array of numbers or points=w18, threshold y=$frequency) -> w21
      Interpolate 1D Array(array of numbers or points=w20, fractional index or x=w21) -> w22
      case (w13) {
        frame "rx", Default {
          case (w9) {
            frame 2, Default {
              Subtract(x=w19, y=$gain) -> w23
              Add(w23, w22) -> w8
            }
            frame 0..1 {
              Subtract(x=$gain, y=w19) -> w24
              Add(w24, w22) -> w25
              Subtract(x=16.0206, y=w25) -> w8
            }
          }
          w7 = w14
        }
        frame "tx" {
          Subtract(x=$gain, y=w19) -> w26
          Add(w26, w22) -> w8
          w7 = w14
        }
      }
    }
    frame Error {
      w7 = w4
      w8 = default
    }
  }
  $level <- w8
  $"error out" <- w7
