vi "eNodeB Host Initialization.gvi"   [LabVIEW NXG 4.0.0]
# Opens a session to a specific USRP RIO device, downloads the FPGA bitfile, runs the FPGA, and starts all the target to host and host to target DMA transfers.
# All the queues used in the eNodeB host application are obtained and the session cluster is initialized with queue references and the USRP session.
inputs:
  "USRP device": string = "RIO0"  # Specific USRP RIO device to open a session to.
  "session in": "Host Session.gtype"  # Contains session information such as used target, FlexRIO and USRP sessions, FPGA reference, and queue references.
  "error in": error
  "reference clock source": string = "Internal"  # The used reference clock input. Valid values are Internal, REF IN / ClkIn, PXI_CLK, and GPS.
  "transport instance id": u8
  "external MAC": bool
  "command": string
  "arguments": string
outputs:
  "error out": error
  "session": "Host Session.gtype"
  "device bandwidth": u16  # Detected instantaneous device bandwidth
types:
  "Transport Session.gtype" = cluster{"FIFO pathname": string, "pipe reader": "Pipe Reader.gtype", "pipe writer": "Pipe Writer.gtype", "transport in RT FIFO": RTFifoRefnum<u8[]>, "transport out RT FIFO": RTFifoRefnum<u8[]>, "transport in timing source name": string, "transport in timing trigger ID": u8, "transport out timing source name": string, "transport out timing trigger ID": u8, "maximum API message size": u32}
  "Register Bus Session.gtype" = Queue<"Session Data.gtype">
  "Semaphore.gtype" = i32
  "DB Queue Reference.gtype" = Queue<"Daughterboard Data.gtype">
  "niUsrpRio Session.gtype" = cluster{"FPGA Interface": any, "RIO Interface Number": u32, "Data Clock Rate": u32, "FPGA Data Clock Rate": u32, "Global Settings Register Bus": "Register Bus Session.gtype", "Radio 0 Settings Register Bus": "Register Bus Session.gtype", "Radio 1 Settings Register Bus": "Register Bus Session.gtype", "Radio Settings Bus Semaphore": "Semaphore.gtype", "DB Queues": "DB Queue Reference.gtype"[], "Characterization Data Valid?": bool, "EEPROM Header": "EEPROM Header.gtype", "Device Data Header": "EEPROM Device Data Header.gtype", "EEPROM Characterization Header": "EEPROM Characterization Header.gtype", "Characterization Data": "Characterization Data.gtype"[], "FPGA Current Version": u32, "FPGA Oldest Compatible Version": u32, "Fixed Logic Current Version": u32, "Fixed Logic Oldest Compatible Version": u32, "FPGA Radio Settings Bus Current Version": u32, "FPGA Radio Settings Bus Oldest Compatible Version": u32, "FPGA Board Config Current Version": u32, "FPGA Board Config Oldest Compatible Version": u32, "Daughterboard Clock Rate": u32}
  T1 = cluster{"FPGA ref": any, "bus instance": u32, "instruction FIFO depth": u32, "executing on FPGA target": bool, "show error call chain": bool}
  T2 = cluster{"Actual Gain [dB]": f64, "Attenuation Table Index": i32}
  T3 = cluster{"Attenuation Table [dB]": f64[][], "Frequencies [Hz]": f64[], "IQ Imbalance Table": "IQ Imbalance.gtype"[], "Gain Table": T2[][]}
  T4 = cluster{"FlexRIO Register Bus": Queue<T1>, "RX Characterization Data": T3, "TX Characterization Data": T3, "FPGA Interface": any}
  T5 = cluster{"transport block size": u32, "CRC ok": bool, "user data": u32}
  "Link Direction.gtype" = enum{"DL", "UL"}
  T6 = cluster{"MAC Stub RX Payload Information FIFO": RTFifoRefnum<"MAC Stub RX Payload Information.gtype">, "MAC Stub RX Confirmation Information FIFO": RTFifoRefnum<u64[16]>, "MAC Stub RX UL Payload Information FIFO": RTFifoRefnum<f64[23]>}
  T7 = cluster{"MAC Stub TX Input Terminals FIFO": RTFifoRefnum<"MAC Stub TX Input Terminals.gtype">, "MAC Stub TX Output Terminals FIFO": RTFifoRefnum<"MAC Stub TX Output Terminals.gtype">}
  T8 = cluster{"MAC Stub RX Interface": T6, "MAC Stub TX Interface": T7}
  "Host Session.gtype" = cluster{"target": enum{"USRP", "FlexRIO"}, "real time mode": bool, "MAC Stub enabled": bool, "DMA FIFO read timeout": i32, "timed loop period": i64, "LTE Transport Sessions": "Transport Session.gtype"[], "USRP session": "niUsrpRio Session.gtype", "FlexRIO session": T4, "UDP RX session": UdpNetworkConnectionRefnum, "UDP TX session": UdpNetworkConnectionRefnum, "sync found FIFO": RTFifoRefnum<bool>, "PDCCH CRC OK FIFO": RTFifoRefnum<bool>, "DL PDCCH status FIFO": RTFifoRefnum<cluster{"CRC ok": bool, "subframe number": u32}>, "DL PDSCH status FIFO": RTFifoRefnum<cluster{"CRC ok": bool, "subframe number": u32}>, "DL SINR FIFO": RTFifoRefnum<f64[]>, "PDSCH user data FIFO": RTFifoRefnum<u32>, "PDSCH user data UDP FIFO": RTFifoRefnum<T5>, "PDSCH user data throughput FIFO": RTFifoRefnum<T5>, "PUSCH user data FIFO": RTFifoRefnum<u32>, "PUSCH user data UDP FIFO": RTFifoRefnum<T5>, "PUSCH user data throughput FIFO": RTFifoRefnum<T5>, "UE feedback info FIFO": RTFifoRefnum<u8[]>, "Request information FIFO": RTFifoRefnum<"Request Information.gtype">, "UDP TX outbound FIFO": RTFifoRefnum<u8[]>, "UDP RX inbound FIFO": RTFifoRefnum<u8[]>, "stop notifier": Notifier<string>, "DL RX scope": string, "UL RX scope": string, "external MAC log file": string, "external MAC process ID": u32, "TX link direction": "Link Direction.gtype", "RX link direction": "Link Direction.gtype", "Sychronization FIFO": RTFifoRefnum<i32>, "RT Loop Interfaces": T8}
  T9 = cluster{"read mode": enum{"polling", "blocking"}, "write mode": enum{"polling", "blocking"}}
  "Message Type ID Defined.gtype" = u16
  "General Message Header.gtype" = cluster{"message type ID": "Message Type ID Defined.gtype", "reference ID": u16, "instance ID": u8}
  "SAP Sub Header.gtype" = cluster{"SFN": u16, "TTI index": u8, "number of submessages": u8, "confirmation mode": u8, "Reserved": u32}
  "Request Information.gtype" = cluster{"message header": "General Message Header.gtype", "SAP sub header": "SAP Sub Header.gtype"}
uses:
  AFW::Common::USRP::Read Device Bandwidth.gvi
  NI::USRPRIO::ConfigV1Host::Open 2.gvi
  NI::USRPRIO::ConfigV1Host::Enable Front End.gvi
  AFW::Common::USRP::Check USRP Data Clock Rate and Bandwidth.gvi
  AFW::Common::Create Stop Notifier.gvi
  AFW::LTE::Configuration::Setup RT Parameters.gvi
  AFW::LTE::Configuration::Setup RT Interface.gvi
  AFW::LTE::Configuration::Configure RF TX Trigger Generator.gvi
  AFW::LTE::Configuration::UL RX FIFO Initialization.gvi
  AFW::LTE::Configuration::DL TX FIFO Initialization.gvi
diagram:
  case ($"reference clock source") {
    frame "Internal" {
      w1 = $"reference clock source"
      w2 = default
    }
    frame "REF IN / ClkIn" {
      w1 = "REF IN"
      w2 = default
    }
    frame "GPS" {
      w1 = $"reference clock source"
      w2 = default
    }
    frame "PXI_CLK", Default {
      w3 = error {"status"=TRUE, "code"=1, "source"="PXI_CLK reference clock not supported for USRP target"}
      w1 = "Internal"
      w2 = w3
    }
  }
  FPGA Open Node(RIO address=$"USRP device", error in=$"error in", run?=FALSE) -> (error out=w4, reference out=w5)
  call "Read Device Bandwidth.gvi"(FPGA reference in=w5, error in=w4) -> (error out=w6, bandwidth=w7, FPGA reference out=w8)
  case (w7) {
    frame "40 MHz" {
      FPGA Close Node(error in=w6, reference in=w8) -> (error out=w11)
      FPGA Open Node(RIO address=$"USRP device", error in=w11, run?=FALSE) -> (error out=w10, reference out=w9)
    }
    frame Default {
      w9 = w8
      w10 = w6
    }
  }
  FPGA Download Node(error in=w10, reference in=w9) -> (error out=w12, reference out=w13)
  FPGA Run Node(error in=w12, reference in=w13) -> (error out=w14, reference out=w15)
  Merge Errors(w14, w2) -> (error out=w16)
  call "Open 2.gvi"(fpga ref=w15, reference frequency source=w1, gpsdo power enable=TRUE, timeout=1, error in=w16, scope="") -> (niusrprio session out=w17, error out=w18)
  call "Enable Front End.gvi"(niusrprio session in=w17, enable=FALSE, error in=w18, scope="rx") -> (niusrprio session out=w19, error out=w20)
  call "Enable Front End.gvi"(niusrprio session in=w19, enable=FALSE, error in=w20, scope="tx") -> (niusrprio session out=w21, error out=w22)
  call "Check USRP Data Clock Rate and Bandwidth.gvi"(niusrprio session in=w21, error in=w22) -> (niusrprio session out=w23, error out=w24)
  RTFIFO Create(create if not found?=TRUE, error in=w24, name="", r/w modes=T9 {"read mode"="blocking", "write mode"="blocking"}, size=10000, type=u32 0) -> (error out=w25, rt fifo=w26)
  RTFIFO Create(create if not found?=TRUE, error in=w25, name="", r/w modes=T9 {"read mode"="blocking", "write mode"="blocking"}, size=10000, type=T5 {all zero or empty}) -> (error out=w27, rt fifo=w28)
  RTFIFO Create(create if not found?=TRUE, error in=w27, name="", r/w modes=T9 {"read mode"="blocking", "write mode"="blocking"}, size=10000, type=T5 {all zero or empty}) -> (error out=w29, rt fifo=w30)
  call "Create Stop Notifier.gvi"(error in=w29) -> (error out=w31, stop notifier=w32)
  Not(x=$"external MAC") -> w33
  call "Setup RT Parameters.gvi"(MAC Stub enabled?=w33, command line=$command, arguments=$arguments, error in=w31, transport instance id=$"transport instance id") -> (log file=w34, process ID=w35, real time mode=w36, DMA FIFO read timeout (ms)=w37, timed loop period=w38, error out=w39, LTE Transport Sessions=w40)
  RTFIFO Create(error in=w39, name="Request information FIFO", r/w modes=T9 {"read mode"="blocking", "write mode"="blocking"}, size=10, type="Request Information.gtype" {all zero or empty}) -> (error out=w41, rt fifo=w42)
  RTFIFO Create(elements in array=65535, error in=w41, name="UDP TX outbound FIFO", r/w modes=T9 {"read mode"="blocking", "write mode"="blocking"}, size=100, type=u8[] []) -> (error out=w43, rt fifo=w44)
  RTFIFO Create(elements in array=1, error in=w43, name="Synchronization FIFO", r/w modes=T9 {"read mode"="blocking", "write mode"="blocking"}, size=1, type=i32 0) -> (error out=w45, rt fifo=w46)
  call "Setup RT Interface.gvi"(error in=w45) -> (RT Loop Interfaces=w47, error out=w48)
  Property Node(instance in=$"session in", "USRP session"=w23, "PUSCH user data FIFO"=w26, "PUSCH user data UDP FIFO"=w28, "PUSCH user data throughput FIFO"=w30, "stop notifier"=w32, "real time mode"=w36, "DMA FIFO read timeout"=w37, "timed loop period"=w38, "MAC Stub enabled"=w33, "LTE Transport Sessions"=w40, "Request information FIFO"=w42, "UDP TX outbound FIFO"=w44, "external MAC log file"=w34, "external MAC process ID"=w35, "Sychronization FIFO"=w46, "RT Loop Interfaces"=w47, "TX link direction"="DL", "RX link direction"="UL") -> (instance out=w49)
  $session <- w49
  call "Configure RF TX Trigger Generator.gvi"(session=w49, error in=w48) -> (session dup=w50, error out=w51)
  call "UL RX FIFO Initialization.gvi"(session=w50, error in=w51) -> (error out=w52)
  call "DL TX FIFO Initialization.gvi"(session=w50, error in=w51) -> (error out=w53)
  Merge Errors(w52, w53) -> (error out=w54)
  $"error out" <- w54
  Scan Value(default (0 dbl)=0, format string="%d", string=w7) -> (value=w55)
  $"device bandwidth" <- w55
