vi "Host eNodeB.gvi"   [LabVIEW NXG 4.0.0]
# Enqueue an element into the stop notifier if error in indicates an error. Call after each loop on host top level to synchronize host shut down in case of any error.
panel controls:
  "RIO Device": string = "RIO0"  # The RIO address of the RF hardware device
  "eNB TX Frequency": f64 = 2000000000  # DL TX center frequency, allowed range depends on used RF device
  "eNB Max RF TX Power": f64 = 10  # Maximum RF transmit output power (upper bound - achievable for a full scale complex sine wave (CW) signal) Note: The actual time-domain RF transmit power depends on the configured resource allocation and is typically at least 15dB lower to allow for the OFDM PAPR backoff.
  "UDP Receive Port": u16 = 50000  # The UDP port the host monitors for incoming packets to be transferred to the FPGA PDSCH chain.
  "Reference Clock Source": string = "Internal"  # Configures the Reference Clock source used for the transceiver chain. Internal: Device internal clock REF IN / ClkIn: Clock input at the RF device (i.e. rear connector pane at USRP RIO, front connector pane for NI 579x) PXI_CLK: Backplane clock from the PXI Chassis (NI 579x only) GPS: GPS module (NI USRP RIO 295x only)
  "stop": bool
  "eNB TX RF Port (USRP)": enum{"TX1/RF0", "TX1/RF1"} = "TX1/RF0"  # Selects the HW RF port where the DL TX is transmitted (USRP RIO only).
  "eNB RX Frequency": f64 = 1800000000  # UL RX center frequency, allowed range depends on used RF device
  "symbol number for PUSCH constellation": u8 = 4  # The OFDM symbol number used for displaying constellation data for PUSCH IQ samples.
  "eNB RX RF Port (USRP)": "USRP RX RF Port.gtype" = "RX2/RF1"  # Selects the HW RF port the UL RX will be received from (USRP RIO only)
  "eNB Transmitter": bool  # Enables or disables the transmitter using the current configuration.
  "eNB Receiver": bool  # Enables or disables the receiver using the current configuration.
  "eNB Manual Gain": f64  # Controls the analog RX gain in case eNB AGC is switched off.
  "eNB AGC": bool = TRUE  # Enables or disables the automated gain control on the receiver side. If enabled the analog RX gain of the RF device will be automatically configured within its valid range to meet a target range for the baseband receive power.
  "Rate Adaption": bool  # If enabled, eNB TX MCS is automatically adapted to reported/measured Wideband SINR [dB] to handle with channel quality fluctuations. The adaptation is calibrated so that the applied MCS produces about 5% to 10% BLER under current MCS conditions. If that is not desired, SINR Offset [dB] needs to be modified.
  "SINR Offset": f64 = 3  # This value is effectively subtracted from the reported SINR before looking up the MCS in the adaptation table (i.e. if a positive offset is configured, a higher reported SINR is required to adapt to a certain MCS to avoid block errors).
  "eNB TX UE Context": T2 = {"RNTI"=10, "Use UERS"=FALSE, "Antenna Port"=7, "CCE Offset"=0}
    # UE specific parameters for DL transmission.
    # USE UERS: If enabled, the DL transmitter feeds UE-specific reference signals into the PDSCH data stream. The usage of UERS is closely related to Transmission Mode 9 defined in the LTE standard 3GPP TS 36.213 §7.1.
    # RNTI: The radio network temporary identifier used for PDSCH scrambling and PDCCH CRC mask generation.
    # Antenna Port: The antenna port used for generating UERS, Range: 7…14 according to 3GPP TS 36.213 §7.1.
    # CCE Offset: First control channel element to be used for PDCCH transmission. According to 3GPP TS 36.211 §6.8.1/.2.
  "eNB RX UE Context": cluster{"RNTI": u16, "SRS Configuration": T3} = {10, TRUE, "0x200", TRUE}
    # UE-specific parameters for UL reception.
    # RNTI: The radio network temporary identifier used for PUSCH scrambling.
    # SRS Configuration: The configuration used for receiving sounding reference signals.
    # SRS Enabled: If TRUE, SRS location is reserved as last symbol in each UL subframe (FDD, TDD) and last 2 symbols in each special subframe (TDD) (according to 3GPP TS 36.211 §5.5.3.3: FDD: srs-SubframeConfig = 0, TDD: srs-SubframeConfig = 7).
    # SRS Subframe Allocation: Bitmap determining the subframes actually used for SRS transmission. Periodicity of 10, leftmost bit represents subframe 0.
    # Transmission Comb: Parameter transmissionComb k_TC determining if even (0) or odd (1) subcarriers are used for SRS transmission/reception. See also 3GPP TS 36.211 §5.5.3.2.
  "eNB TX Frame Structure": enum{"FDD", "TDD 5 5"} = "FDD"  # Select between frequency division duplex (FDD) and time division duplex (TDD) using subframe configuration 5 and special subframe configuration 5 (3GPP TS 36.211 §4)
  "eNB RX Frame Structure": enum{"FDD", "TDD 5 5"} = "FDD"  # Select between FDD (frequency division duplex) and TDD (time division duplex) using subframe configuration 5 and special subframe configuration 5 (3GPP TS 36.211 §4).
  "eNB RX Cell ID": u16  # The physical Cell ID used for PUSCH scrambling
  "eNB TX Cell ID": u16  # Physical cell ID used for PSS, CRS, UERS sequence generation and PDCCH/PDSCH scrambling. [0…511].
  "eNB Timing Offset": i32
  "session": "Host Session.gtype"
  "Command": string = "MACsimpleENB"  # Command to execute for external MAC
  "External MAC": bool  # When enabled a program is executed on the RT described by command line and arguments. This switch applies for RT only. When disabled an internal basic MAC will be executed.
  "Arguments": string = "10000 4 FF"  # Arguments to pass to the external MAC.
  "Stop on API Confirmation Errors": bool
  "eNB TX DCI": "DCI Message.gtype" = {"Active"=TRUE, "MCS"="MCS 17 (64-QAM, rate ~0.43)", "Resource Block Allocation (4 PRB/bit)"=8388607}
  "eNB RX DCI": "DCI Message.gtype" = {"Active"=TRUE, "MCS"="MCS 0 (QPSK, rate ~0.12)", "Resource Block Allocation (4 PRB/bit)"=29360128}
  "Transport Instance ID": u8
panel indicators:
  "FPGA Ready": bool  # Signals that the FPGA bitfile has been downloaded and that the device has been initialized and is ready for configuration. (Initialization can take up to 20 seconds.).
  "eNB TX Active": bool  # Signals that all eNB TX control configurations have been applied and the transmitter is running.
  "eNB Coerced Max RF TX Power": f64  # Indicates the coerced value actually used as maximum RF transmit output power level after applying the device’s capabilities (range and resolution limitations) to the configured eNB Maximum RF TX Power [dBm].
  "Data Transfer In": bool  # Indicates that the configured UDP stream is receiving data on the configured Receive Port.
  "Packet Loss In": bool  # Indicates that the system loses UDP data due to overload. Data inflow from UDP port is higher than configured PDSCH throughput.
  "eNB TX Power Spectrum": T1  # Shows the power spectrum of the DL TX baseband signal transferred to the RF.
  "eNB Coerced Gain": f64  # The actual used analog RX RF gain either set by AGC, if enabled, or by UE Manual Gain Value [dB]
  "eNB ADC Values Clipped": bool  # Indicates a numeric overflow at the ADC output. Overflows can be caused when the analog RX RF gain too high or the receive power level too high.
  "eNB Baseband RX Power": f64
  "eNB DDC Values Clipped": bool  # Indicates a numeric overflow at the output of the digital downconversion block Overflows can be caused when the analog RX RF gain too high or the receive power level too high.
  "eNB RX Power Spectrum": T1  # Shows the power spectrum of the UL RX baseband signal received from RF.
  "PUSCH Constellation": c128[]  # Constellation of RX IQ samples allocated for PUSCH transmission after equalization. Only samples for the configured OFDM Symbol-Nr (PUSCH) are displayed.
  "eNB Failure / Block Error Rate (BLER)": f64  # Graphical display of PUSCH reception block error rate.
  "eNB RX Active": bool  # Signals that all eNB RX control configurations have been applied and the receiver is running.
  "PUSCH Throughput": f64  # The achieved throughput on the PUSCH channel.
  "Radio Frame Number": u16  # The number of the latest successfully received report ranging from 0…1023.
  "Reported DL ACK/NACK": enum{"NACK", "ACK", "DTX"}[]  # Array showing the latest received DL ACK/NACK report from UE side.
  "Average DL error rate": f64
  "Reported DL Block Error Rate": f64  # Graphical and numerical representation of the DL receiver block error rate on the UE side reported back to the eNodeB.
  "TX starting": bool
  "eNB TX IFFT Output Clipped": bool  # Indicates a numeric overflow after the IFFT.
  "eNB RF RX Power": f64
  "power calibration offset [dB]": f64
  "Reported Subband SINR [dB]": f64[]  # The reported SINR for each subband occupying 8 PRBs. Comparable to Reporting Mode 3-0 in 3GPP TS 36.213 §7.2.1. Usage of CRS or UERS for estimation depends on setting of Use UERS switch in UE RX System Parameters on the UE side
  "Reported WB SINR": f64  # The reported SINR over the full 20MHz band using cell specific reference signals.
  "eNB RF TX Power": f64  # Actual eNB RF transmit power in dBm.
  "eNB Baseband TX Power": f64  # Actual eNB baseband transmit power level [baseband output power level] in dB full scale.
  "PUSCH BLER (current)": f64
  "eNB Applied Gain": f64
  "PHY Timing Indication Received": u32
  "TTI": u8
  "SFN": u16
  "Max MAC TX Delay": u32
  "Error Report": string
  "UL RX Indication CRC OK": bool
  "Evaluation Errors": u32
  "Negatives": u32
  "Tab": i32
  "device bandwidth [MHz]": u16
  "External MAC Output": string
  "IP Packets Size Exeeded Count": u32
  "Received Confirmations": T12
types:
  T1 = cluster{"f0": f64, "df": f64, "magnitude": f64[]}
  "USRP RX RF Port.gtype" = enum{"RX1/RF0", "RX2/RF0", "RX1/RF1", "RX2/RF1"}
  T2 = cluster{"RNTI": u16, "Use UERS": bool, "Antenna Port": UFXP(4.0), "CCE Offset": u8}
  T3 = cluster{"SRS Enabled": bool, "SRS Subframe Allocation": UFXP(10.0), "Transmission Comb": bool}
  "Transport Session.gtype" = cluster{"FIFO pathname": string, "pipe reader": "Pipe Reader.gtype", "pipe writer": "Pipe Writer.gtype", "transport in RT FIFO": RTFifoRefnum<u8[]>, "transport out RT FIFO": RTFifoRefnum<u8[]>, "transport in timing source name": string, "transport in timing trigger ID": u8, "transport out timing source name": string, "transport out timing trigger ID": u8, "maximum API message size": u32}
  "Register Bus Session.gtype" = Queue<"Session Data.gtype">
  "Semaphore.gtype" = i32
  "DB Queue Reference.gtype" = Queue<"Daughterboard Data.gtype">
  "niUsrpRio Session.gtype" = cluster{"FPGA Interface": any, "RIO Interface Number": u32, "Data Clock Rate": u32, "FPGA Data Clock Rate": u32, "Global Settings Register Bus": "Register Bus Session.gtype", "Radio 0 Settings Register Bus": "Register Bus Session.gtype", "Radio 1 Settings Register Bus": "Register Bus Session.gtype", "Radio Settings Bus Semaphore": "Semaphore.gtype", "DB Queues": "DB Queue Reference.gtype"[], "Characterization Data Valid?": bool, "EEPROM Header": "EEPROM Header.gtype", "Device Data Header": "EEPROM Device Data Header.gtype", "EEPROM Characterization Header": "EEPROM Characterization Header.gtype", "Characterization Data": "Characterization Data.gtype"[], "FPGA Current Version": u32, "FPGA Oldest Compatible Version": u32, "Fixed Logic Current Version": u32, "Fixed Logic Oldest Compatible Version": u32, "FPGA Radio Settings Bus Current Version": u32, "FPGA Radio Settings Bus Oldest Compatible Version": u32, "FPGA Board Config Current Version": u32, "FPGA Board Config Oldest Compatible Version": u32, "Daughterboard Clock Rate": u32}
  T4 = cluster{"FPGA ref": any, "bus instance": u32, "instruction FIFO depth": u32, "executing on FPGA target": bool, "show error call chain": bool}
  T5 = cluster{"Actual Gain [dB]": f64, "Attenuation Table Index": i32}
  T6 = cluster{"Attenuation Table [dB]": f64[][], "Frequencies [Hz]": f64[], "IQ Imbalance Table": "IQ Imbalance.gtype"[], "Gain Table": T5[][]}
  T7 = cluster{"FlexRIO Register Bus": Queue<T4>, "RX Characterization Data": T6, "TX Characterization Data": T6, "FPGA Interface": any}
  T8 = cluster{"transport block size": u32, "CRC ok": bool, "user data": u32}
  "Link Direction.gtype" = enum{"DL", "UL"}
  T9 = cluster{"MAC Stub RX Payload Information FIFO": RTFifoRefnum<"MAC Stub RX Payload Information.gtype">, "MAC Stub RX Confirmation Information FIFO": RTFifoRefnum<u64[16]>, "MAC Stub RX UL Payload Information FIFO": RTFifoRefnum<f64[23]>}
  T10 = cluster{"MAC Stub TX Input Terminals FIFO": RTFifoRefnum<"MAC Stub TX Input Terminals.gtype">, "MAC Stub TX Output Terminals FIFO": RTFifoRefnum<"MAC Stub TX Output Terminals.gtype">}
  T11 = cluster{"MAC Stub RX Interface": T9, "MAC Stub TX Interface": T10}
  "Host Session.gtype" = cluster{"target": enum{"USRP", "FlexRIO"}, "real time mode": bool, "MAC Stub enabled": bool, "DMA FIFO read timeout": i32, "timed loop period": i64, "LTE Transport Sessions": "Transport Session.gtype"[], "USRP session": "niUsrpRio Session.gtype", "FlexRIO session": T7, "UDP RX session": UdpNetworkConnectionRefnum, "UDP TX session": UdpNetworkConnectionRefnum, "sync found FIFO": RTFifoRefnum<bool>, "PDCCH CRC OK FIFO": RTFifoRefnum<bool>, "DL PDCCH status FIFO": RTFifoRefnum<cluster{"CRC ok": bool, "subframe number": u32}>, "DL PDSCH status FIFO": RTFifoRefnum<cluster{"CRC ok": bool, "subframe number": u32}>, "DL SINR FIFO": RTFifoRefnum<f64[]>, "PDSCH user data FIFO": RTFifoRefnum<u32>, "PDSCH user data UDP FIFO": RTFifoRefnum<T8>, "PDSCH user data throughput FIFO": RTFifoRefnum<T8>, "PUSCH user data FIFO": RTFifoRefnum<u32>, "PUSCH user data UDP FIFO": RTFifoRefnum<T8>, "PUSCH user data throughput FIFO": RTFifoRefnum<T8>, "UE feedback info FIFO": RTFifoRefnum<u8[]>, "Request information FIFO": RTFifoRefnum<"Request Information.gtype">, "UDP TX outbound FIFO": RTFifoRefnum<u8[]>, "UDP RX inbound FIFO": RTFifoRefnum<u8[]>, "stop notifier": Notifier<string>, "DL RX scope": string, "UL RX scope": string, "external MAC log file": string, "external MAC process ID": u32, "TX link direction": "Link Direction.gtype", "RX link direction": "Link Direction.gtype", "Sychronization FIFO": RTFifoRefnum<i32>, "RT Loop Interfaces": T11}
  "Confirmation States.gtype" = enum{"Success", "Unknown Message", "Message not Supported", "Unknown Parameter (Set)", "Missing Parameter (Set)", "Parameter (Set) Repetition", "Range Violation", "State Violation", "Timeout", "Config Payload Mismatch", "Length Mismatch", "Input Buffer Full", "Internal Error", "Instance ID Mismatch"}
  T12 = cluster{"Element 1": "Confirmation States.gtype"[], "Value": u64[]}
  T13 = enum{"MCS 0 (QPSK, rate ~0.12)", "MCS 1 (QPSK, rate ~0.15)", "MCS 2 (QPSK, rate ~0.19)", "MCS 3 (QPSK, rate ~0.25)", "MCS 4 (QPSK, rate ~0.30)", "MCS 5 (QPSK, rate ~0.37)", "MCS 6 (QPSK, rate ~0.44)", "MCS 7 (QPSK, rate ~0.51)", "MCS 8 (QPSK, rate ~0.59)", "MCS 9 (QPSK, rate ~0.66)", "MCS 10 (16-QAM, rate ~0.33)", "MCS 11 (16-QAM, rate ~0.37)", "MCS 12 (16-QAM, rate ~0.42)", "MCS 13 (16-QAM, rate ~0.48)", "MCS 14 (16-QAM, rate ~0.54)", "MCS 15 (16-QAM, rate ~0.60)", "MCS 16 (16-QAM, rate ~0.64)", "MCS 17 (64-QAM, rate ~0.43)", "MCS 18 (64-QAM, rate ~0.46)", "MCS 19 (64-QAM, rate ~0.50)", "MCS 20 (64-QAM, rate ~0.55)", "MCS 21 (64-QAM, rate ~0.60)", "MCS 22 (64-QAM, rate ~0.65)", "MCS 23 (64-QAM, rate ~0.70)", "MCS 24 (64-QAM, rate ~0.75)", "MCS 25 (64-QAM, rate ~0.80)", "MCS 26 (64-QAM, rate ~0.85)", "MCS 27 (64-QAM, rate ~0.89)", "MCS 28 (64-QAM, rate ~0.93)"}
  "DCI Message.gtype" = cluster{"Active": bool, "MCS": T13, "Resource Block Allocation (4 PRB/bit)": UFXP(25.0)}
  "MAC Stub TX Input Terminals.gtype" = cluster{"TX Frame Structure": enum{"FDD", "TDD 5 5"}, "eNB TX UE Context": T2, "eNB TX DCI": "DCI Message.gtype", "Wideband SINR": f64, "Rate Adaption": bool, "SINR Offset": f64}
  "MAC Stub TX Output Terminals.gtype" = cluster{"eNB TX DCI": "DCI Message.gtype", "IP Packets Size Exeeded Count": u32}
  "MAC Stub RX Payload Information.gtype" = cluster{"RX Indication CRC OK": bool, "MPDU Disassembly Failed": bool, "Radio Frame Number": u16, "Reported WB SINR": f64, "DL error rate": f64}
uses:
  AFW::LTE::RF Control::eNodeB Host Initialization.gvi
  AFW::LTE::MAC::Read External MAC Output.gvi
  NI::G Core::Error::Display Error.gvi
  AFW::LTE::L1L2 API::Transport::Transport.gvi
  AFW::LTE::L1L2 API::Transport::Get Transport Session.gvi
  AFW::LTE::Utilities::Check Loop Stop Condition.gvi
  AFW::LTE::L1L2 API::Transport::Transport Read From Transport.gvi
  AFW::LTE::L1L2 API::PHY Receive Timing Indication.gvi
  AFW::LTE::Conversion::Check Subframe for Transmit.gvi
  AFW::LTE::Conversion::MCS Regulation.gvi
  AFW::LTE::MAC::MAC Prepare Tx Config.gvi
  AFW::LTE::MAC::MAC PDU Assembly.gvi
  AFW::LTE::L1L2 API::PHY TX Request Confirm Abstraction.gvi
  AFW::LTE::MAC::MAC Enque Requests.gvi
  AFW::LTE::L1L2 API::Transport::Transport Send To Transport.gvi
  AFW::LTE::Conversion::Remove Timed Loop Abort Error.gvi
  AFW::Common::Stop On Error.gvi
  AFW::LTE::L1L2 API::Decode General Message Header.gvi
  NI::G Core::Error::Build Error Cluster.gvi
  AFW::LTE::L1L2 API::Handle DL TX Confirm.gvi
  AFW::LTE::L1L2 API::PHY Receive RX Indication.gvi
  AFW::LTE::Conversion::Extract Payload.gvi
  AFW::LTE::Conversion::Align Feedback Data.gvi
  AFW::LTE::Conversion::Interpret PUSCH Payload.gvi
  AFW::LTE::Conversion::Calculate Average Error Rate.gvi
  AFW::LTE::PHY SAP::Receive Timing Indication RT.gvi
  AFW::Common::Timing Measurement::Get Time.gvi
  AFW::LTE::MAC::TTI Counter to SFN and TTI.gvi
  AFW::Common::Counters::Counter U16 Dominant Increment.gvi
  AFW::LTE::L1L2 API::Encode PHY SAP Timing Indication.gvi
  AFW::LTE::Configuration::Send Dynamic UL Configuration.gvi
  AFW::LTE::L1L2 API::PHY TX Request Confirm Handler.gvi
  AFW::LTE::Configuration::Send Dynamic DL TX Configuration.gvi
  AFW::LTE::PHY SAP::Send Dynamic DL Tx Payload.gvi
  AFW::Common::Timing Measurement::Get and Hold Maximum.gvi
  AFW::LTE::PHY SAP::Receice PUSCH Decoding Status.gvi
  AFW::LTE::Conversion::PDSCH Channel Decoder Status from U32.gvi
  AFW::LTE::PHY SAP::Receive PUSCH MAC PDU.gvi
  AFW::LTE::L1L2 API::Encode PHY SAP UL RX Indication.gvi
  NI::G Core::Error::Filter Error Codes.gvi
  NI::G Core::Error::Is Error.gvi
  AFW::Common::Check Stop.gvi
  AFW::LTE::Utilities::Write Configuration to RT.gvi
  AFW::LTE::Utilities::Read Status from RT.gvi
  AFW::LTE::Conversion::Read UL Data.gvi
  AFW::LTE::Configuration::Receive Timing Indication.gvi
  AFW::LTE::UDP Interface::Receive UDP Data.gvi
  AFW::LTE::Conversion::Determine Configuration Trigger.gvi
  AFW::LTE::Configuration::Disable UL RX.gvi
  AFW::LTE::Configuration::Setup UL RX Baseband.gvi
  AFW::LTE::RF Control::Setup RX.gvi
  AFW::LTE::Configuration::Disable DL TX.gvi
  AFW::LTE::Configuration::Setup DL TX Baseband.gvi
  AFW::LTE::RF Control::Setup TX.gvi
  AFW::LTE::Configuration::Setup DL TX Set Active.gvi
  AFW::LTE::UDP Interface::Check UDP Port In Use.gvi
  AFW::Common::Create Stop.gvi
  AFW::LTE::Utilities::Trigger Stop Timed Loops.gvi
  AFW::LTE::Conversion::Read PUSCH Decoder Status.gvi
  AFW::LTE::Conversion::Get ADC and IFFT Status.gvi
  AFW::LTE::Conversion::Read UL BB Power.gvi
  AFW::LTE::Conversion::Read TX BB Power.gvi
  AFW::LTE::RF Control::Calculate Power Calibration Offset.gvi
  AFW::LTE::RF Control::Control Power Gain.gvi
  AFW::LTE::RF Control::Apply AGC Output.gvi
  AFW::LTE::Conversion::Read TX Data.gvi
  AFW::LTE::Conversion::Calculate TX Power Spectrum.gvi
  AFW::LTE::Conversion::Read RX Data.gvi
  AFW::LTE::Conversion::Calculate RX Power Spectrum.gvi
  AFW::LTE::Conversion::Read Constellation Data.gvi
  AFW::LTE::Conversion::Calculate UL Throughput and BLER.gvi
  AFW::LTE::RF Control::eNodeB Host Cleanup.gvi
  AFW::LTE::Conversion::LTE Generate Error Report.gvi
diagram:
  sequence {
    frame 0 {
      # Set Controls to default values
      $"eNB Transmitter" <- FALSE
      $"eNB Receiver" <- FALSE
      $"FPGA Ready" <- FALSE
      $"eNB RX Active" <- FALSE
      $"eNB TX Active" <- FALSE
      $"TX starting" <- FALSE
      $"eNB TX Power Spectrum" <- T1 {all zero or empty}
      $"eNB RX Power Spectrum" <- T1 {all zero or empty}
      $"eNB Coerced Gain" <- 0
      $"eNB Coerced Max RF TX Power" <- 0
      $"PUSCH Throughput" <- 0
      $"Reported WB SINR" <- 0
      $"Average DL error rate" <- 0
      $"eNB Failure / Block Error Rate (BLER)" <- 0
      $"Reported DL Block Error Rate" <- 0
      $"Reported Subband SINR [dB]" <- f64[] []
      $"PUSCH Constellation" <- c128[] []
      $"Radio Frame Number" <- 0
      $"Reported DL ACK/NACK" <- enum{"NACK", "ACK", "DTX"}[] []
      $"Error Report" <- ""
    }
  }
  sequence {
    frame 0 {
      w1 = $Arguments
      w2 = $Command
      w3 = $"External MAC"
      w4 = $session
      w5 = $"RIO Device"
      w6 = $"Reference Clock Source"
      w7 = $"Transport Instance ID"
    }
  }
  call "eNodeB Host Initialization.gvi"(reference clock source=w6, transport instance id=w7, session in=w4, USRP device=w5, error in=no error, external MAC=w3, command=w2, arguments=w1) -> (session=w8, device bandwidth=w9, error out=w10)
  call "Read External MAC Output.gvi"(session=w8, error in=w10, full log=TRUE) -> (session dup=w11, external MAC log output=w12, error out=w13)
  sequence {
    frame 0 {
      $session <- w11
      call "Display Error.gvi"(type of dialog="continue or stop message", error in=w13)
    }
  }
  disable {
    frame TARGET_TYPE == "RT", Default {
      call "Transport.gvi"(session=w11, error in=w13) -> (error out=w15)
      call "Get Transport Session.gvi"(Session=w11, Transport Session Select="Transport PHY Timing to MAC") -> (Session dup=w16, LTE Transport Session=w17)
      w18 = 100  # priority in
      Property Node(instance in=w17) -> ("transport out timing source name"=w19)
      s1 = "MAC Stub TX Input Terminals.gtype" {all zero or empty}  # shift register
      timed loop {
        Left Execution System Border Node(priority_in=w18)
        Left Timing Statistics Border Node() -> (wakeupreason_out=w20)
        call "Get Transport Session.gvi"(Session=w16, Transport Session Select="Transport PHY Timing to MAC") -> (Session dup=w21, LTE Transport Session=w22)
        Left Timing Error Border Node(error_in=w13) -> (error_out=w23)
        call "Check Loop Stop Condition.gvi"(session in=w16, error in=w23) -> (stop execution=w24, error out=w25)
        Property Node(instance in=w16) -> ("RT Loop Interfaces:MAC Stub TX Interface:MAC Stub TX Input Terminals FIFO"=w26)
        RTFIFO Read(element=s1, error in=w25, rt fifo=w26, timeout in ms=0) -> (element out=w27, error out=w28)
        Property Node(instance in=w27) -> ("TX Frame Structure"=w29, instance out=w30)
        Not(x=w24) -> w31
        call "Transport Read From Transport.gvi"(API transport session=w22, allow read fail=w31, error in=w28) -> (transport out=w32, transport read success=w33, error out=w34)
        case (w33) {
          frame False {
            w35 = w34
            w36 = w30
          }
          frame True {
            call "PHY Receive Timing Indication.gvi"(api transport in=w32, error in=w34) -> (SFN=w37, TTI index=w38, error out=w39)
            call "Check Subframe for Transmit.gvi"(frame structure=w29, subframe index=w38, UL TX=FALSE, error in=w39) -> (allow DL transmit=w40, error out=w41)
            case (w40) {
              frame False, Default {
                w35 = w41
                w36 = w30
              }
              frame True {
                Property Node(instance in=w30) -> ("eNB TX UE Context"=w42, "eNB TX DCI"=w43, "Wideband SINR"=w44, "SINR Offset"=w45, "Rate Adaption"=w46, instance out=w47)
                case (w46) {
                  frame False, Default {
                    w48 = w43
                    w49 = w41
                    w50 = w42
                    w51 = w29
                    w52 = w37
                    w53 = w38
                  }
                  frame True {
                    call "MCS Regulation.gvi"(DCI in=w43, wideband SNR=w44, SNR offset [dB]=w45, UE context=w42) -> (DCI out=w48)
                    w49 = w41
                    w50 = w42
                    w51 = w29
                    w52 = w37
                    w53 = w38
                  }
                }
                Property Node(instance in=w47, "eNB TX DCI"=w48) -> (instance out=w36)
                Property Node(instance in=w21) -> ("RT Loop Interfaces:MAC Stub TX Interface:MAC Stub TX Output Terminals FIFO"=w54)
                w55 = 200  # maximal execution time MPU assembly
                Property Node(instance in=w21) -> ("Request information FIFO"=w56, "UDP TX outbound FIFO"=w57, instance out=w58)
                call "MAC Prepare Tx Config.gvi"(frame structure=w51, SFN=w52, TTI index=w53, error in=w49, eNB TX UE Context=w50, eNB TX DCI=w48) -> (MAC TX Config=w59, error out=w60)
                call "MAC PDU Assembly.gvi"(data FIFO in=w57, MAC TX config in=w59, error in=w60, maximal execution time=w55) -> (MAC TX config out=w61, MAC PDU=w62, MAC PDU Size=w63, error out=w64, IP Packets size exceeded=w65)
                Feedback Node(input=w66) -> w67
                Add(w65, w67) -> w66
                Property Node(instance in="MAC Stub TX Output Terminals.gtype" {all zero or empty}, "eNB TX DCI"=w48, "IP Packets Size Exeeded Count"=w66) -> (instance out=w68)
                call "PHY TX Request Confirm Abstraction.gvi"(MAC TX Config=w61, MAC PDU=w62, MAC PDU Size=w63, error in=w64, Device Location="eNB") -> (api transport out=w69, requests=w70, error out=w71)
                call "Get Transport Session.gvi"(Session=w58, Transport Session Select="Transport MAC to PHY") -> (LTE Transport Session=w72)
                call "MAC Enque Requests.gvi"(RT FIFO reference=w56, requests=w70, error in=w71) -> (error out=w73)
                call "Transport Send To Transport.gvi"(API transport session=w72, transport in=w69, error in=w73) -> (error out=w74)
                RTFIFO Write(element=w68, error in=w74, overwrite on timeout=TRUE, rt fifo=w54, timeout in ms=0) -> (error out=w35)
              }
            }
          }
        }
        Right Timing Error Border Node(error_in=w35) -> (error_out=w75)
        Left Timing Source Border Node[AlarmName=L, DefaultTimingSourceName="1 MHz", DefaultTimingSourceType=2](mode_in="Process missed periods, ignore original phase", period_in=1, source_in=w19, structure_in="MAC Stub Tx")
        next s1 = w36
        stop if w24
      }
      call "Remove Timed Loop Abort Error.gvi"(error in=w75, wake up reason=w20) -> (error out=w76)
      call "Stop On Error.gvi"(error in=w76, error source prefix="MAC Stub Tx") -> (error out=w77)
      call "Get Transport Session.gvi"(Session=w11, Transport Session Select="Transport PHY to MAC") -> (Session dup=w78, LTE Transport Session=w79)
      Property Node(instance in=w79) -> ("transport out timing source name"=w80)
      w81 = 98  # priority in
      # Transport layer moves packets from L1 to MAC Stub implementation or external MAC
      timed loop {
        Left Execution System Border Node(priority_in=w81)
        Left Timing Statistics Border Node() -> (wakeupreason_out=w82)
        call "Get Transport Session.gvi"(Session=w78, Transport Session Select="Transport PHY to MAC") -> (Session dup=w83, LTE Transport Session=w84)
        Left Timing Error Border Node(error_in=w13) -> (error_out=w85)
        call "Check Loop Stop Condition.gvi"(session in=w78, error in=w85) -> (stop execution=w86, error out=w87)
        Not(x=w86) -> w88
        call "Transport Read From Transport.gvi"(API transport session=w84, allow read fail=w88, error in=w87) -> (transport out=w89, transport read success=w90, error out=w91)
        case (w90) {
          frame False {
            w92 = w91
          }
          frame True {
            call "Decode General Message Header.gvi"(message data in=w89, error in=w91) -> (decoded general message header=w93, error out=w94)
            Property Node(instance in=w83) -> ("RT Loop Interfaces:MAC Stub RX Interface"=w95)
            Property Node(instance in=w93) -> ("message type ID"=w96)
            case (w96) {
              frame 0, Default {
                call "Build Error Cluster.gvi"(code=-1, description="MAC Stub Rx: unexpected API message", error in=w94) -> (error out=w92)
              }
              frame 16898 {
                Property Node(instance in=w95) -> ("MAC Stub RX Confirmation Information FIFO"=w97)
                # PHY_CNF
                Property Node(instance in=w83) -> ("Request information FIFO"=w98)
                call "Handle DL TX Confirm.gvi"(RT FIFO reference=w98, api transport in=w89, clear confirmation errors=TRUE, error in=w94) -> (confirm received counts=w99, negative confirm received count=w100, confirmation evaluation error count=w101, error out=w102)
                Property Node(instance in=w99) -> ("Value"=w103)
                To Unsigned 64 Bit Integer(number=w101) -> w104
                Build Array(w103, w100, w104) -> w105
                Type Cast(type=u64[16] [0, 0, 0, 0, 0, 0, 0, 0, 0, 0, 0, 0, 0, 0, 0, 0], x=w105) -> w106
                RTFIFO Write(element=w106, error in=w102, overwrite on timeout=TRUE, rt fifo=w97, timeout in ms=0) -> (error out=w92)
              }
              frame 17409 {
                call "PHY Receive RX Indication.gvi"(api transport in=w89, expected device location="eNB", error in=w94) -> (MAC RX Config=w107, MAC PDU=w108, error out=w109)
                # PHY_ULSCH_RX_IND
                Property Node(instance in=w107) -> ("CRC Result"=w110)
                Is Greater Than 0(x=w110) -> w111
                case (w111) {
                  frame False, Default {
                    w112 = w109
                    w113 = NaN
                    w114 = 0
                    w115 = NaN
                    w116 = FALSE
                  }
                  frame True {
                    call "Extract Payload.gvi"(transport block=w108) -> (payload=w117)
                    Feedback Node(initial value=u8[] [], input=w118) -> w119
                    Build Array(w119, w117) -> w120
                    call "Align Feedback Data.gvi"(data in=w120) -> (remaining portion=w118, feedback payload=w121)
                    Is Empty Array(array=w121) -> w122
                    Not(x=w122) -> w123
                    case (w123) {
                      frame False, Default {
                        w112 = w109
                        w113 = NaN
                        w114 = 0
                        w115 = NaN
                        w116 = FALSE
                      }
                      frame True {
                        call "Interpret PUSCH Payload.gvi"(PUSCH payload=w121) -> (radioframe number=w114, ACK/NACK=w124, subband SNR=w125, wideband SNR=w126)
                        To Double Precision Float(number=w126) -> w115
                        Property Node(instance in=w95) -> ("MAC Stub RX UL Payload Information FIFO"=w127)
                        To Double Precision Float(number=w125) -> w128
                        Type Cast(type=f64[13] [0, 0, 0, 0, 0, 0, 0, 0, 0, 0, 0, 0, 0], x=w128) -> w129
                        Type Cast(type=u16[10] [0, 0, 0, 0, 0, 0, 0, 0, 0, 0], x=w124) -> w130
                        To Double Precision Float(number=w130) -> w131
                        Build Array(w129, w131) -> w132
                        RTFIFO Write(element=w132, error in=w109, overwrite on timeout=TRUE, rt fifo=w127, timeout in ms=0) -> (error out=w112)
                        call "Calculate Average Error Rate.gvi"(ACK/NACK=w124) -> (error rate=w113)
                        w116 = TRUE
                      }
                    }
                  }
                }
                # retain previous values when no feedback data is available
                Property Node(instance in=w95) -> ("MAC Stub RX Payload Information FIFO"=w133)
                Feedback Node(enable?=w116, input=w115) -> w134
                Feedback Node(enable?=w116, input=w113) -> w135
                Property Node(instance in="MAC Stub RX Payload Information.gtype" {all zero or empty}, "RX Indication CRC OK"=w111, "Radio Frame Number"=w114, "Reported WB SINR"=w134, "DL error rate"=w135) -> (instance out=w136)
                RTFIFO Write(element=w136, error in=w94, overwrite on timeout=TRUE, rt fifo=w133, timeout in ms=0) -> (error out=w137)
                Merge Errors(w112, w137) -> (error out=w92)
              }
            }
          }
        }
        Right Timing Error Border Node(error_in=w92) -> (error_out=w138)
        Left Timing Source Border Node[AlarmName=L, DefaultTimingSourceName="1 MHz", DefaultTimingSourceType=2](mode_in="Process missed periods, ignore original phase", period_in=1, source_in=w80, structure_in="MAC Stub Rx")
        stop if w86
      }
      call "Remove Timed Loop Abort Error.gvi"(error in=w138, wake up reason=w82) -> (error out=w139)
      call "Stop On Error.gvi"(error in=w139, error source prefix="MAC Stub Rx") -> (error out=w140)
      Property Node(instance in=w11) -> ("timed loop period"=w141, instance out=w142)
      w143 = 100  # priority in
      timed loop {
        # receive PHY TTI timing indication (one per ms)
        Left Execution System Border Node(priority_in=w143)
        Left Timing Statistics Border Node()
        Left Timing Error Border Node(error_in=w13) -> (error_out=w144)
        call "Check Loop Stop Condition.gvi"(session in=w142, error in=w144) -> (stop execution=w145, error out=w146)
        call "Receive Timing Indication RT.gvi"(session=w142, eNB TX Active=$"eNB TX Active", error in=w146) -> (subframe index=w147, subframe index valid=w148, error out=w149)
        case (w148) {
          frame False {
            w150 = w149
            w151 = w148
            w152 = w142
          }
          frame True, Default {
            call "Get Time.gvi"(error in_2=w149) -> (tick count (us)=w153, error out_2=w154)
            call "TTI Counter to SFN and TTI.gvi"(TTI counter=w147, error in=w154) -> (SFN=w155, TTI=w156, error out=w157)
            call "Counter U16 Dominant Increment.gvi"() -> (count out=w158)
            call "Encode PHY SAP Timing Indication.gvi"(reference ID=w158, SFN=w155, TTI index=w156, error in=w157) -> (encoded PHY SAP Timing Indication=w159, error out=w160)
            call "Get Transport Session.gvi"(Session=w142, Transport Session Select="Transport PHY Timing to MAC") -> (Session dup=w152, LTE Transport Session=w161)
            call "Transport Send To Transport.gvi"(API transport session=w161, transport in=w159, error in=w160) -> (error out=w150)
            $SFN <- w155
            $TTI <- w156
            $"PHY Timing Indication Received" <- w153
            w151 = w148
          }
        }
        Logical And(w151, $"eNB RX Active") -> w162
        case (w162) {
          frame False, Default {
            w163 = w150
          }
          frame True {
            call "Send Dynamic UL Configuration.gvi"(session=w152, UE context=$"eNB RX UE Context", DCI=$"eNB RX DCI", error in=w150, scope="RX") -> (error out=w163)
          }
        }
        Right Timing Error Border Node(error_in=w163) -> (error_out=w164)
        Left Timing Source Border Node[AlarmName=L, DefaultTimingSourceName="1 MHz", DefaultTimingSourceType=2](mode_in="Discard missed periods, ignore original phase", period_in=w141, structure_in="PHY SAP Tim")
        stop if w145
      }
      call "Stop On Error.gvi"(error in=w164, error source prefix="PHY SAP Tim") -> (error out=w165)
      call "Get Transport Session.gvi"(Session=w11, Transport Session Select="Transport MAC to PHY") -> (Session dup=w166, LTE Transport Session=w167)
      Property Node(instance in=w167) -> ("transport out timing source name"=w168)
      w169 = 99  # priority in
      timed loop {
        Left Execution System Border Node(priority_in=w169)
        # handover TX request to PHY FPGA
        Left Timing Statistics Border Node()
        call "Get Transport Session.gvi"(Session=w166, Transport Session Select="Transport MAC to PHY") -> (Session dup=w170, LTE Transport Session=w171)
        Left Timing Error Border Node(error_in=w13) -> (error_out=w172)
        call "Check Loop Stop Condition.gvi"(session in=w166, error in=w172) -> (stop execution=w173, error out=w174)
        Not(x=w173) -> w175
        call "Transport Read From Transport.gvi"(API transport session=w171, allow read fail=w175, error in=w174) -> (transport out=w176, transport read success=w177, error out=w178)
        call "Get Time.gvi"(error in=w178) -> (error out=w179, tick count (us)=w180)
        Subtract(x=w180, y=$"PHY Timing Indication Received") -> w181
        w182 = 700  # maximal allowed TX processing time [us]
        # reserve time buffer to transmit TX data to FPGA
        Is Greater(x=w181, y=w182) -> w183
        case (w177) {
          frame True {
            Property Node(instance in=$"eNB TX UE Context") -> ("Use UERS"=w186)
            call "PHY TX Request Confirm Handler.gvi"(TX request too late=w183, api transport in=w176, Expected SFN=$SFN, Expected TTI index=$TTI, Expected Device Location="eNB", error in=w179, frame structure=$"eNB TX Frame Structure", use UERS=w186) -> (output valid=w187, api transport out=w188, TX UE Context=w189, TX DCI=w190, TX Data=w191, error out=w192)
            Logical And(w187, $"eNB TX Active") -> w185
            case (w185) {
              frame False, Default {
                w193 = w192
                w194 = w170
              }
              frame True {
                call "Send Dynamic DL TX Configuration.gvi"(session=w170, UE context=w189, DCI in=w190, error in=w192) -> (session dup=w195, error out=w196)
                call "Send Dynamic DL Tx Payload.gvi"(session in=w195, TX data=w191, error in=w196) -> (session out=w194, error out=w193)
              }
            }
            Array Size(array=w188) -> (size(s)=w197)
            Is Greater Than 0(x=w197) -> w198
            case (w198) {
              frame False, Default {
                call "Build Error Cluster.gvi"(code=-1, description="Confirmation message response is empty.", error in=w193) -> (error out=w184)
              }
              frame True {
                call "Get Transport Session.gvi"(Session=w194, Transport Session Select="Transport PHY to MAC") -> (LTE Transport Session=w199)
                call "Transport Send To Transport.gvi"(API transport session=w199, transport in=w188, error in=w193) -> (error out=w184)
              }
            }
          }
          frame False {
            w184 = w179
            w185 = w177
          }
        }
        call "Get Time.gvi"(error in=w184) -> (error out=w200, tick count (us)=w201)
        Right Timing Error Border Node(error_in=w200) -> (error_out=w202)
        case (w185) {
          frame True {
            Subtract(x=w201, y=$"PHY Timing Indication Received") -> w203
            call "Get and Hold Maximum.gvi"(value=w203) -> (max value=w204)
            $"Max MAC TX Delay" <- w204
          }
          frame False { }
        }
        Left Timing Source Border Node[AlarmName=L, DefaultTimingSourceName="1 MHz", DefaultTimingSourceType=2](mode_in="Process missed periods, ignore original phase", period_in=1, source_in=w168, structure_in="PHY SAP Tx")
        stop if w173
      }
      call "Stop On Error.gvi"(error in=w202, error source prefix="PHY SAP Tx") -> (error out=w205)
      Property Node(instance in=w11) -> ("timed loop period"=w206, instance out=w207)
      w208 = 98  # priority in
      timed loop {
        Left Execution System Border Node(priority_in=w208)
        Left Timing Statistics Border Node()
        Left Timing Error Border Node(error_in=w13) -> (error_out=w209)
        call "Check Loop Stop Condition.gvi"(session in=w207, error in=w209) -> (stop execution=w210)
        call "Receice PUSCH Decoding Status.gvi"(session=w207) -> (PUSCH Decoding Status=w211, PUSCH Decoding Status valid=w212, error out=w213)
        case (w212) {
          frame False, Default {
            w214 = w213
          }
          frame True {
            Property Node(instance in=w207) -> ("PUSCH user data throughput FIFO"=w215, instance out=w216)
            call "PDSCH Channel Decoder Status from U32.gvi"(bit vector in=w211) -> (PDSCH decoder status=w217)
            Property Node(instance in=w217) -> ("user data"=w218, "transport block size"=w219, "CRC ok"=w220, instance out=w221)
            RTFIFO Write(element=w221, error in=w213, rt fifo=w215) -> (error out=w222)
            call "Receive PUSCH MAC PDU.gvi"(session=w216, transport block size=w219, error in=w222) -> (MAC PDU=w223, error out=w224)
            call "Get Transport Session.gvi"(Session=w216, Transport Session Select="Transport PHY to MAC") -> (LTE Transport Session=w225)
            Boolean To 0 Or 1(Boolean=w220) -> (0, 1=w226)
            To Unsigned 8 Bit Integer(number=w226) -> w227
            Array Size(array=w223) -> (size(s)=w228)
            To Unsigned 32 Bit Integer(number=w228) -> w229
            To Unsigned 8 Bit Integer(number=w218) -> w230
            call "Counter U16 Dominant Increment.gvi"() -> (count out=w231)
            Property Node(instance in=$"eNB RX UE Context") -> ("RNTI"=w232)
            call "Encode PHY SAP UL RX Indication.gvi"(reference ID=w231, SFN=0, TTI index=w230, MAC PDU=w223, MAC PDU Size=w229, RNTI=w232, CRC Result=w227) -> (encoded UL RX Indication=w233)
            call "Transport Send To Transport.gvi"(API transport session=w225, transport in=w233, error in=w224) -> (error out=w214)
          }
        }
        Right Timing Error Border Node(error_in=w214) -> (error_out=w234)
        Left Timing Source Border Node[AlarmName=L, DefaultTimingSourceName="1 MHz", DefaultTimingSourceType=2](mode_in="Discard missed periods, ignore original phase", period_in=w206, structure_in="PHY SAP Rx")
        stop if w210
      }
      call "Stop On Error.gvi"(error in=w234, error source prefix="PHY SAP Rx") -> (error out=w235)
      s2 = w13  # shift register
      while {
        Wait(time to wait=1)
        Property Node(instance in=$session) -> ("UDP TX outbound FIFO"=w236, "UDP TX session"=w237)
        s3 = s2  # shift register
        while {
          Udp Read I Pv 6 Binary(connection ID=w237, error in=s3, max size=10240, timeout ms=0) -> (data out=w240, error out=w241)
          call "Filter Error Codes.gvi"(codes to clear=[1, 113, 66, 56], error in=w241) -> (codes cleared=w242, error cleared?=w243, error out=w244)
          Search 1D Array(1D array=w242, element=113) -> (index of element=w245)
          Is Greater Or Equal To 0(x=w245) -> w246
          Search 1D Array(1D array=w242, element=56) -> (index of element=w247)
          Is Greater Or Equal To 0(x=w247) -> w248
          Not(x=w248) -> w249
          Is Empty Array(array=w240) -> w250
          Not(x=w250) -> w251
          Logical And(w249, w251) -> w252
          case (w243) {
            frame True {
              w253 = w244
            }
            frame False {
              RTFIFO Write(element=w240, error in=w244, overwrite on timeout=TRUE, rt fifo=w236, timeout in ms=0) -> (error out=w253)
            }
          }
          call "Is Error.gvi"(error in=w253) -> (error?=w254)
          Logical Or(w254, w243, w250) -> w255
          append w246 to w238
          append w252 to w239
          next s3 = w253
          stop if w255
        }
        Or Array Elements(Boolean array=w238) -> (logical OR=w256)
        $"Packet Loss In" <- w256
        Or Array Elements(Boolean array=w239) -> (logical OR=w257)
        $"Data Transfer In" <- w257
        call "Check Stop.gvi"(error in=s3) -> (error out=w258, stop=w259)
        next s2 = w258
        stop if w259
      }
      call "Stop On Error.gvi"(error in=s2) -> (error out=w260)
      s4 = w13  # shift register
      while {
        call "Write Configuration to RT.gvi"(session in=w11, eNB TX DCI in=$"eNB TX DCI", eNB TX UE context=$"eNB TX UE Context", eNB TX frame structure=$"eNB TX Frame Structure", error in=s4, rate adaption=$"Rate Adaption", SINR offset=$"SINR Offset", wideband SINR=$"Reported WB SINR") -> (session dup=w261, eNB TX DCI out=w262, IP packets size exeeded count=w263, error out=w264)
        call "Read Status from RT.gvi"(session in=w261, error in=w264) -> (Reported WB SINR=w265, Reported Subband SINR [dB]=w266, Reported DL ACK/NACK=w267, DL error rate=w268, negatives=w269, evaluation errors=w270, received confirmations=w271, error out=w272, Radio Frame Number=w273, DL RX indication CRC OK=w274)
        $"Radio Frame Number" <- w273
        Wait Until Next Multiple(multiple to wait=100)
        $"UL RX Indication CRC OK" <- w274
        $"Average DL error rate" <- w268
        Tick Count() -> (timer value=w275)
        Feedback Node(input=w276) -> w277
        Is Greater Or Equal(x=w275, y=w277) -> w278
        case (w278) {
          frame False, Default {
            w276 = w277
          }
          frame True {
            $"Reported DL Block Error Rate" <- w268
            Add(w275, 1000) -> w276
          }
        }
        case ($"Rate Adaption") {
          frame False, Default { }
          frame True {
            $"eNB TX DCI" <- w262
          }
        }
        call "Check Stop.gvi"(error in=w272) -> (stop=w279, error out=w280)
        $"IP Packets Size Exeeded Count" <- w263
        $Negatives <- w269
        $"Evaluation Errors" <- w270
        $"Received Confirmations" <- w271
        $"Reported DL ACK/NACK" <- w267
        $"Reported Subband SINR [dB]" <- w266
        $"Reported WB SINR" <- w265
        next s4 = w280
        stop if w279
      }
      call "Stop On Error.gvi"(error in=s4) -> (error out=w281)
      Build Array(w77, w140, w15, w165, w205, w235, w260, w281) -> w14
    }
    frame TARGET_TYPE != "RT" {
      s5 = w13  # shift register
      s6 = 0  # shift register
      while {
        Wait Until Next Multiple(multiple to wait=100)
        call "Read UL Data.gvi"(error in=s5, session=$session) -> (error out=w282, output valid=w283, radioframe number=w284, DL ACK/NACK=w285, subband SNR=w286, wideband SNR=w287)
        # read and decode PUSCH feedback information
        # use feedback information to apply correct MCS
        # 5
        case (w283) {
          frame False, Default {
            w288 = s6
            w289 = w282
          }
          frame True {
            $"Radio Frame Number" <- w284
            $"Reported DL ACK/NACK" <- w285
            To Double Precision Float(number=w286) -> w290
            $"Reported Subband SINR [dB]" <- w290
            To Double Precision Float(number=w287) -> w291
            $"Reported WB SINR" <- w291
            call "Calculate Average Error Rate.gvi"(ACK/NACK=w285) -> (error rate=w292)
            $"Average DL error rate" <- w292
            Increment(x=s6) -> w288
            Quotient And Remainder(x=w288, y=10) -> (x-y*floor(x/y)=w293)
            Is Equal To 0(x=w293) -> w294
            case (w294) {
              frame False, Default { }
              frame True {
                $"Reported DL Block Error Rate" <- w292
              }
            }
            w289 = w282
          }
        }
        call "Check Stop.gvi"(error in=w289) -> (error out=w295, stop=w296)
        next s5 = w295
        next s6 = w288
        stop if w296
      }
      call "Stop On Error.gvi"(error in=s5) -> (error out=w297)
      s7 = w13  # shift register
      while {
        # use SINR information to apply correct MCS
        case ($"eNB TX Active") {
          frame False, Default {
            Wait(time to wait=10)
            w298 = s7
            w299 = TRUE
          }
          frame True {
            call "Receive Timing Indication.gvi"(session=$session, error in=s7) -> (session dup=w300, new timing indication=w299, error out=w301)
            case (w299) {
              frame False, Default {
                w298 = w301
              }
              frame True {
                case ($"Rate Adaption") {
                  frame False, Default {
                    w302 = $"eNB TX DCI"
                    w303 = w301
                  }
                  frame True {
                    call "MCS Regulation.gvi"(DCI in=$"eNB TX DCI", wideband SNR=$"Reported WB SINR", SNR offset [dB]=$"SINR Offset", UE context=$"eNB TX UE Context") -> (DCI out=w302)
                    w303 = w301
                  }
                }
                call "Send Dynamic DL TX Configuration.gvi"(session=w300, UE context=$"eNB TX UE Context", DCI in=w302, error in=w303) -> (DCI modified=w304, coerced DCI=w305, error out=w298)
                case (w304) {
                  frame False, Default { }
                  frame True {
                    $"eNB TX DCI" <- w305
                  }
                }
              }
            }
          }
        }
        Logical And(w299, $"eNB RX Active") -> w306
        # 5
        case (w306) {
          frame False, Default {
            w307 = w298
          }
          frame True {
            call "Send Dynamic UL Configuration.gvi"(session=$session, UE context=$"eNB RX UE Context", DCI=$"eNB RX DCI", error in=w298, scope="RX") -> (error out=w307)
          }
        }
        call "Check Stop.gvi"(error in=w307) -> (error out=w308, stop=w309)
        next s7 = w308
        stop if w309
      }
      call "Stop On Error.gvi"(error in=s7) -> (error out=w310)
      s8 = w13  # shift register
      s9 = 0  # shift register
      while {
        # receive UDP data from network and send it to the FPGA as PDSCH payload data of the transmitter
        # read received PDSCH payload data from FPGA and send it to the specified UDP port
        Wait Until Next Multiple(multiple to wait=0)
        call "Receive UDP Data.gvi"(eNB TX active=$"eNB TX Active", session=$session, UDP packet counter in=s9, error in=s8) -> (UDP packet counter out=w311, error out=w312, FIFO full=w313, data transfer=w314)
        $"Packet Loss In" <- w313
        $"Data Transfer In" <- w314
        # 6
        call "Check Stop.gvi"(error in=w312) -> (error out=w315, stop=w316)
        next s8 = w315
        next s9 = w311
        stop if w316
      }
      call "Stop On Error.gvi"(error in=s8) -> (error out=w317)
      Build Array(w297, w310, w317) -> w14
    }
  }
  s10 = w13  # shift register
  while {
    Wait Until Next Multiple(multiple to wait=100)
    case (s10) {
      frame Error {
        w318 = s10
      }
      frame No Error {
        $"FPGA Ready" <- TRUE
        w318 = s10
      }
    }
    call "Determine Configuration Trigger.gvi"(RX enabled=$"eNB Receiver", TX enabled=$"eNB Transmitter") -> (trigger RX configuration=w319, trigger TX configuration=w320)
    # configure eNB RX/TX baseband and RF when enabled
    case (w319) {
      frame False, Default {
        w321 = w318
      }
      frame True {
        case ($"eNB Receiver") {
          frame False, Default {
            call "Disable UL RX.gvi"(session=$session, error in=w318) -> (error out=w321)
            sequence {
              frame 0 {
                $"eNB RX Active" <- FALSE
              }
            }
          }
          frame True {
            Property Node(instance in=$session) -> ("real time mode"=w322)
            call "Setup UL RX Baseband.gvi"(UE Context=$"eNB RX UE Context", DCI=$"eNB RX DCI", session in=$session, frame structure=$"eNB RX Frame Structure", cell ID=$"eNB RX Cell ID", error in=w318, real time mode=w322) -> (session dup=w323, error out=w324)
            call "Setup RX.gvi"(session in=w323, RX frequency [Hz]=$"eNB RX Frequency", gain value [dB]=$"eNB Coerced Gain", error in=w324, RX port=$"eNB RX RF Port (USRP)") -> (session out=w325, coerced gain [dB]=w326, coerced frequency [Hz]=w327, error out=w328)
            $session <- w325
            $"eNB Coerced Gain" <- w326
            $"eNB RX Frequency" <- w327
            case (w328) {
              frame Error {
                $"eNB Receiver" <- FALSE
                w321 = w328
              }
              frame No Error {
                $"eNB RX Active" <- TRUE
                w321 = w328
              }
            }
          }
        }
      }
    }
    # 1
    case (w320) {
      frame False, Default {
        w329 = w318
      }
      frame True {
        case ($"eNB Transmitter") {
          frame False, Default {
            sequence {
              frame 0 {
                $"eNB TX Active" <- FALSE
              }
              frame 1 {
                Wait(time to wait=10)
              }
            }
            call "Disable DL TX.gvi"(session=$session, error in=w318) -> (error out=w329)
          }
          frame True {
            case (w318) {
              frame Error {
                w330 = w318
              }
              frame No Error {
                $"TX starting" <- TRUE
                w330 = w318
              }
            }
            Property Node(instance in=$session) -> ("real time mode"=w331)
            call "Setup DL TX Baseband.gvi"(UE context=$"eNB TX UE Context", DCI=$"eNB TX DCI", session in=$session, frame structure=$"eNB TX Frame Structure", cell ID=$"eNB TX Cell ID", error in=w330, UDP receive port=$"UDP Receive Port", real time mode=w331) -> (session out=w332, error out=w333)
            call "Setup TX.gvi"(timing advance=0, session in=w332, TX frequency [Hz]=$"eNB TX Frequency", TX power level [dB]=$"eNB Max RF TX Power", error in=w333, TX port=$"eNB TX RF Port (USRP)", RF timing offset=$"eNB Timing Offset") -> (coerced power level setting [dB]=w334, session dup=w335, coerced output power [dB]=w336, coerced frequency [Hz]=w337, error out=w338)
            $session <- w335
            case (w338) {
              frame No Error, Default {
                $"eNB TX Active" <- TRUE
                $"TX starting" <- FALSE
                call "Setup DL TX Set Active.gvi"(session in=w335, error in=w338) -> (error out=w329)
              }
              frame Error {
                $"eNB Transmitter" <- FALSE
                $"TX starting" <- FALSE
                call "Check UDP Port In Use.gvi"(error in=w338) -> (error out=w329)
              }
            }
            $"eNB Coerced Max RF TX Power" <- w336
            $"eNB TX Frequency" <- w337
            $"eNB Max RF TX Power" <- w334
          }
        }
      }
    }
    Merge Errors(w321, w329) -> (error out=w339)
    call "Create Stop.gvi"(error in=w339, stop in=$stop) -> (error out=w340)
    # synchronize the exit condition across all loops of the host application
    call "Check Stop.gvi"(error in=w340) -> (error out=w341, stop=w342)
    case (w342) {
      frame False, Default {
        w343 = w341
      }
      frame True {
        call "Trigger Stop Timed Loops.gvi"(Session=$session, error in=w341) -> (error out=w343)
        # Disable TX and RX to
        # ensure proper shutdown
        $"eNB Receiver" <- FALSE
        $"eNB Transmitter" <- FALSE
      }
    }
    Feedback Node[DelayCount=3](input=w342) -> w344
    next s10 = w343
    stop if w344
  }
  call "Stop On Error.gvi"(error in=s10) -> (error out=w345)
  s11 = w13  # shift register
  while (iteration -> i1) {
    Wait Until Next Multiple(multiple to wait=50)
    disable {
      frame TARGET_TYPE == "RT", Default {
        w346 = $session
        w347 = s11
      }
      frame TARGET_TYPE != "RT" {
        call "Read PUSCH Decoder Status.gvi"(session in=$session, error in=s11) -> (session dup=w346, error out=w347)
      }
    }
    call "Get ADC and IFFT Status.gvi"(session in=w346, error in=w347) -> (RX DDC values clipped=w348, TX IFFT output clipped=w349, session dup=w350, ADC values clipped=w351, error out=w352)
    call "Read UL BB Power.gvi"(session in=w350, error in=w352) -> (session dup=w353, RX baseband input power=w354, error out=w355)
    call "Read TX BB Power.gvi"(session in=w353, TX reference level [dBm]=$"eNB Coerced Max RF TX Power", error in=w355) -> (session dup=w356, TX power [dBm]=w357, TX baseband power [dBFS]=w358, error out=w359)
    call "Calculate Power Calibration Offset.gvi"(session in=w356, error in=w359, frequency [Hz]=$"eNB RX Frequency") -> (session dup=w360, power calibration offset [dB]=w361, error out=w362)
    $"power calibration offset [dB]" <- w361
    Not(x=$"eNB AGC") -> w363
    call "Control Power Gain.gvi"(expected signal range lower bound=-17, use manual gain=w363, BB input power=w354, gain in=$"eNB Coerced Gain", manual gain value [dB]=$"eNB Manual Gain", expected signal range upper bound=-15, power calibration offset [dB]=w361) -> (RF input power [dBm]=w364, power [dBFS]=w365, gain out=w366)
    # read sync status and baseband power levels from FPGA and feed them into automatic gain control (AGC)
    # use manual gain value if AGC is disabled
    # configure frequency offset on FPGA
    # read PUSCH decoder status
    Logical And(not $"TX starting", $"eNB Receiver", $"eNB RX Active") -> w367
    # 2
    case (w367) {
      frame False, Default {
        w368 = w362
      }
      frame True {
        call "Apply AGC Output.gvi"(session=w360, apply values=w367, AGC output=w366, error in=w362) -> (coerced gain [dB]=w369, error out=w368)
        $"eNB Coerced Gain" <- w369
      }
    }
    call "Check Stop.gvi"(error in=w368) -> (error out=w370, stop=w371)
    $"eNB RF TX Power" <- w357
    $"eNB Baseband TX Power" <- w358
    $"eNB Baseband RX Power" <- w365
    $"eNB RF RX Power" <- w364
    $"eNB Applied Gain" <- $"eNB Coerced Gain"
    $"eNB ADC Values Clipped" <- w351
    $"eNB TX IFFT Output Clipped" <- w349
    To Unsigned 32 Bit Integer(number=i1) -> w372
    Quotient And Remainder(x=w372, y=10) -> (x-y*floor(x/y)=w373)
    Is Equal To 0(x=w373) -> w374
    Logical Or(w348, w374) -> w375
    Feedback Node(enable?=w375, input=w348) -> w376
    Feedback Node(enable?=w374, input=w376) -> w377
    $"eNB DDC Values Clipped" <- w377
    next s11 = w370
    stop if w371
  }
  call "Stop On Error.gvi"(error in=s11) -> (error out=w378)
  s12 = w13  # shift register
  while (iteration -> i2) {
    Wait Until Next Multiple(multiple to wait=20)
    Quotient And Remainder(x=i2, y=5) -> (x-y*floor(x/y)=w379)
    # read RX/TX baseband data values and PDCCH/PDSCH constellation data from FPGA and draw corresponding diagrams
    # 3
    case (w379) {
      frame 0, Default {
        call "Read TX Data.gvi"(session=$session, error in=s12) -> (TX baseband data=w381, error out=w382)
        call "Calculate TX Power Spectrum.gvi"(TX data=w381, error in=w382, coerced gain [dB]=$"eNB Coerced Max RF TX Power") -> (TX power spectrum=w383, error out=w380)
        $"eNB TX Power Spectrum" <- w383
      }
      frame 1 {
        call "Read RX Data.gvi"(session=$session, error in=s12) -> (RX data=w384, error out=w385)
        call "Calculate RX Power Spectrum.gvi"(RX data=w384, coerced gain [dB]=$"eNB Coerced Gain", error in=w385, power calibration offset [dB]=$"power calibration offset [dB]") -> (RX power spectrum=w386, error out=w380)
        $"eNB RX Power Spectrum" <- w386
      }
      frame 2 {
        call "Read Constellation Data.gvi"(session=$session, symbol number for display=$"symbol number for PUSCH constellation", error in=s12, RX tab=-1) -> (display data out=w387, constellation data=w388, error out=w380)
        case (w387) {
          frame False, Default { }
          frame True {
            $"PUSCH Constellation" <- w388
          }
        }
      }
      frame 3 {
        case ($"External MAC") {
          frame False, Default {
            w380 = s12
          }
          frame True {
            call "Read External MAC Output.gvi"(session=$session, error in=s12, full log=FALSE) -> (external MAC log output=w389, error out=w380)
            $"External MAC Output" <- w389
          }
        }
      }
      frame 4 {
        w380 = s12
      }
    }
    call "Check Stop.gvi"(error in=w380) -> (error out=w390, stop=w391)
    next s12 = w390
    stop if w391
  }
  sequence {
    frame 0 {
      call "Read External MAC Output.gvi"(session=$session, error in=s12, full log=TRUE) -> (external MAC log output=w392, error out=w393)
      $"External MAC Output" <- w392
    }
  }
  call "Stop On Error.gvi"(error in=w393) -> (error out=w394)
  s13 = 0  # shift register
  s14 = w13  # shift register
  while {
    Wait Until Next Multiple(multiple to wait=1000)
    # compute throughput and block error rate and draw corresponding diagrams
    Tick Count() -> (timer value=w395)
    Subtract(x=w395, y=s13) -> w396
    call "Calculate UL Throughput and BLER.gvi"(session=$session, time difference=w396, error in=s14) -> (UL throughput (current)=w397, UL BLER=w398, error out=w399)
    # 4
    case ($"eNB RX Active") {
      frame False, Default { }
      frame True {
        $"PUSCH Throughput" <- w397
        $"eNB Failure / Block Error Rate (BLER)" <- w398
        $"PUSCH BLER (current)" <- w398
      }
    }
    call "Check Stop.gvi"(error in=w399) -> (error out=w400, stop=w401)
    next s13 = w395
    next s14 = w400
    stop if w401
  }
  call "Stop On Error.gvi"(error in=s14) -> (error out=w402)
  Build Array(w345, w378, w394, w402, w14) -> w403
  sequence {
    frame 0 {
      call "eNodeB Host Cleanup.gvi"(session=$session, error in=no error) -> (error out=w404)
      Build Array(w403, w404) -> w405
      $"FPGA Ready" <- FALSE
    }
  }
  call "LTE Generate Error Report.gvi"(error in=w405) -> (error report=w406, error occured=w407)
  $"Error Report" <- w406
  case (w407) {
    frame False, Default { }
    frame True {
      # Switch to status tab
      # in case of error
      $Tab <- 2
    }
  }
  $"External MAC Output" <- w12
  $"device bandwidth [MHz]" <- w9
