vi "Configure Rx.gvi"   [LabVIEW NXG 4.0.0]
inputs:
  "tx config": T4 = {"rf enable 0"=FALSE, "rf config 0"={"antenna"="RX2", "frequency"=2000000000, "lo frequency"=-1, "level"=0}, "rf enable 1"=FALSE, "rf config 1"={"antenna"="RX2", "frequency"=2000000000, "lo frequency"=-1, "level"=0}, "transfer mode"="Finite", "sample rate"=10000000, "number of samples"=8192, "start trigger"="Immediate", "tone frequency"=100000}
  "niUsrpRio Session": "niUsrpRio Session.gtype", required
  "rx config": T2 = {"rf enable 0"=FALSE, "rf config 0"={"antenna"="RX2", "frequency"=2000000000, "lo frequency"=-1, "level"=0}, "rf enable 1"=FALSE, "rf config 1"={"antenna"="RX2", "frequency"=2000000000, "lo frequency"=-1, "level"=0}, "transfer mode"="Finite", "sample rate"=10000000, "number of samples"=8192, "start trigger"="Immediate"}, required
  "error in": error
outputs:
  "rx config out": T2
  "niUsrpRio Session (out)": "niUsrpRio Session.gtype"
  "rx.enabled channels": string[]
  "vertical range": f64[]
  "error out": error
  "rx.coerced configurations": T3
types:
  "Register Bus Session.gtype" = Queue<"Session Data.gtype">
  "Semaphore.gtype" = i32
  "DB Queue Reference.gtype" = Queue<"Daughterboard Data.gtype">
  "EEPROM Header.gtype" = cluster{"Checksum": u32, "Product Code": u16, "Hardware Current Version": u16, "Hardware Oldest Compatible Version": u16, "EEPROM Map Current Version": u16, "EEPROM Map Oldest Compatible Version": u16, "User Password": string, "Pointer to Factory Header": u32, "Pointer to User Header": u32, "Recommended Interval": u16, "Number of Reserved Bytes": i32, "Number of Daughterboards": u8, "Daughterboard IDs": u16[], "Daughterboard Serial Numbers": string[]}
  "EEPROM Device Data Header.gtype" = cluster{"Checksum": u32, "Number of Channels": u8, "Number of Gain Settings": u16[], "Pointer to Characterization Data": u32[], "Number of Reserved Bytes": i32, "Number of Frequencies": u16[]}
  "EEPROM Characterization Header.gtype" = cluster{"Checksum": u32, "Date": timestamp, "Temperature": f32, "Misc. Info": string, "Pointer to Device Data Header": u32, "Number of Reserved Bytes": i32}
  "Characterization Data.gtype" = cluster{"Gains[dB]": f64[], "Frequencies [Hz]": f64[], "IQ Imbalance Table": "IQ Imbalance.gtype"[], "Measured Gains[dB]": f64[][]}
  "niUsrpRio Session.gtype" = cluster{"FPGA Interface": any, "RIO Interface Number": u32, "Data Clock Rate": u32, "FPGA Data Clock Rate": u32, "Global Settings Register Bus": "Register Bus Session.gtype", "Radio 0 Settings Register Bus": "Register Bus Session.gtype", "Radio 1 Settings Register Bus": "Register Bus Session.gtype", "Radio Settings Bus Semaphore": "Semaphore.gtype", "DB Queues": "DB Queue Reference.gtype"[], "Characterization Data Valid?": bool, "EEPROM Header": "EEPROM Header.gtype", "Device Data Header": "EEPROM Device Data Header.gtype", "EEPROM Characterization Header": "EEPROM Characterization Header.gtype", "Characterization Data": "Characterization Data.gtype"[], "FPGA Current Version": u32, "FPGA Oldest Compatible Version": u32, "Fixed Logic Current Version": u32, "Fixed Logic Oldest Compatible Version": u32, "FPGA Radio Settings Bus Current Version": u32, "FPGA Radio Settings Bus Oldest Compatible Version": u32, "FPGA Board Config Current Version": u32, "FPGA Board Config Oldest Compatible Version": u32, "Daughterboard Clock Rate": u32}
  T1 = cluster{"antenna": string, "frequency": f64, "lo frequency": f64, "level": f64}
  "Start Trigger.gtype" = enum{"Software", "Digital Edge", "Rx Start Trigger", "Tx Start Trigger", "Immediate", "Future Time Event"}
  T2 = cluster{"rf enable 0": bool, "rf config 0": T1, "rf enable 1": bool, "rf config 1": T1, "transfer mode": enum{"Finite", "Continuous"}, "sample rate": f64, "number of samples": u32, "start trigger": "Start Trigger.gtype"}
  T3 = cluster{"coerced frequencies": f64[], "coerced lo frequencies": f64[], "coerced levels": f64[], "coerced sample rates": f64[]}
  T4 = cluster{"rf enable 0": bool, "rf config 0": T1, "rf enable 1": bool, "rf config 1": T1, "transfer mode": enum{"Finite", "Continuous"}, "sample rate": f64, "number of samples": u32, "start trigger": "Start Trigger.gtype", "tone frequency": f64}
uses:
  Host SubVIs::Construct Channels.gvi
  Host SubVIs::Configure Signal (Level).gvi
  Host SubVIs::Configure Start Trigger.gvi
  Host SubVIs::Configure Stream.gvi
diagram:
  Property Node(instance in=$"tx config") -> ("sample rate"=w1, "number of samples"=w2)
  Property Node(instance in=$"rx config", "sample rate"=w1, "number of samples"=8192) -> ("rf enable 0"=w3, "rf config 0"=w4, "rf enable 1"=w5, "rf config 1"=w6, "transfer mode"=w7, "start trigger"=w8, instance out=w9)
  w10 = cluster{"rf enable 0": bool, "rf config 0": T1} {all zero or empty}
  Property Node(instance in=w10, "rf enable 0"=w3, "rf config 0"=w4) -> (instance out=w11)
  w12 = cluster{"rf enable 1": bool, "rf config 1": T1} {all zero or empty}
  Property Node(instance in=w12, "rf enable 1"=w5, "rf config 1"=w6) -> (instance out=w13)
  Build Array(w11, w13) -> w14
  call "Construct Channels.gvi"(channel configurations=w14, scope="rx") -> (enabled channels=w15, enabled channel configurations=w16)
  Array Size(array=w15) -> (size(s)=w17)
  case (w17) {
    frame 0 {
      w18 = default
      w19 = default
      w20 = default
      w21 = default
      w22 = $"niUsrpRio Session"
      w23 = $"error in"
      w24 = default
      w25 = default
    }
    frame Default {
      s1 = $"error in"  # shift register
      for {
        w26 = each element of w15
        w27 = each element of w16
        Property Node(instance in=w27) -> ("frequency"=w28, "level"=w29, "antenna"=w30, "lo frequency"=w31)
        call "Configure Signal (Level).gvi"(active antenna=w30, lo frequency [hz]=w31, niusrprio session in=$"niUsrpRio Session", sample rate [s/s]=w1, frequency [hz]=w28, level [dbm]=w29, error in=s1, scope=w26) -> (coerced lo frequency [hz]=w32, niusrprio session out=w33, coerced sample rate [s/s]=w34, coerced frequency [hz]=w35, coerced level [dbm]=w36, error out=w37, coerced vertical range [vpp]=w38)
        call "Configure Start Trigger.gvi"(niusrprio session in=w33, start trigger=w8, error in=w37, scope=w26) -> (niusrprio session out=w39, error out=w40)
        Is Equal To 0(x=w7) -> w41
        call "Configure Stream.gvi"(niusrprio session in=w39, number of samples is finite=w41, number of samples=w2, error in=w40, scope=w26) -> (niusrprio session out=w22, error out=w42)
        append w38 to w24
        append w34 to w18
        append w35 to w19
        append w36 to w20
        append w32 to w21
        append w26 to w25
        next s1 = w42
      }
      w23 = s1
    }
  }
  $"vertical range" <- w24
  $"rx.enabled channels" <- w25
  $"niUsrpRio Session (out)" <- w22
  $"error out" <- w23
  $"rx config out" <- w9
  Property Node(instance in=T3 {all zero or empty}, "coerced sample rates"=w18, "coerced frequencies"=w19, "coerced levels"=w20, "coerced lo frequencies"=w21) -> (instance out=w43)
  $"rx.coerced configurations" <- w43
