vi "Configure Signal (Common).gvi"   [LabVIEW NXG 4.0.0]
# Configures the DSP and signal path for the channel based on the input signal parameters. Input Parameters Sample Rate the requested rate, in samples per second, the signal will be sampled at. Frequency is the requested frequency, in hertz, to acquire the signal from/generate the signal at. Level is the requested power level, in dBm, of the signal. Gain is the requested amount of gain, in dB. LO Frequency is the requested frequency, in hertz, to tune the local oscillator to. The default value of -1 sets the LO to the value of the 'Frequency' input. If the value is not -1, the LO will be set to that value, and the DSP will handle the difference between the 'Frequency' and the 'LO Frequency'. Active Antenna is the antenna to use for this channel. Correct Impairments applies the correction information of the device to the signal.
inputs:
  "configure signal mode": "Configure Signal Mode.gtype" = "Gain"
  "niusrprio session": "niUsrpRio Session.gtype", required
  "signal parameters": "Configure Signal Parameters.gtype"
  "error in": error
  "scope": string = "rx", required
  "correct impairments?": bool = TRUE
outputs:
  "coerced signal parameters": "Configure Signal Parameters.gtype"
  "niusrprio session 2": "niUsrpRio Session.gtype"
  "error out": error
types:
  "Register Bus Session.gtype" = Queue<"Session Data.gtype">
  "Semaphore.gtype" = i32
  "DB Queue Reference.gtype" = Queue<"Daughterboard Data.gtype">
  "EEPROM Header.gtype" = cluster{"Checksum": u32, "Product Code": u16, "Hardware Current Version": u16, "Hardware Oldest Compatible Version": u16, "EEPROM Map Current Version": u16, "EEPROM Map Oldest Compatible Version": u16, "User Password": string, "Pointer to Factory Header": u32, "Pointer to User Header": u32, "Recommended Interval": u16, "Number of Reserved Bytes": i32, "Number of Daughterboards": u8, "Daughterboard IDs": u16[], "Daughterboard Serial Numbers": string[]}
  "EEPROM Device Data Header.gtype" = cluster{"Checksum": u32, "Number of Channels": u8, "Number of Gain Settings": u16[], "Pointer to Characterization Data": u32[], "Number of Reserved Bytes": i32, "Number of Frequencies": u16[]}
  "EEPROM Characterization Header.gtype" = cluster{"Checksum": u32, "Date": timestamp, "Temperature": f32, "Misc. Info": string, "Pointer to Device Data Header": u32, "Number of Reserved Bytes": i32}
  "Characterization Data.gtype" = cluster{"Gains[dB]": f64[], "Frequencies [Hz]": f64[], "IQ Imbalance Table": "IQ Imbalance.gtype"[], "Measured Gains[dB]": f64[][]}
  "niUsrpRio Session.gtype" = cluster{"FPGA Interface": any, "RIO Interface Number": u32, "Data Clock Rate": u32, "FPGA Data Clock Rate": u32, "Global Settings Register Bus": "Register Bus Session.gtype", "Radio 0 Settings Register Bus": "Register Bus Session.gtype", "Radio 1 Settings Register Bus": "Register Bus Session.gtype", "Radio Settings Bus Semaphore": "Semaphore.gtype", "DB Queues": "DB Queue Reference.gtype"[], "Characterization Data Valid?": bool, "EEPROM Header": "EEPROM Header.gtype", "Device Data Header": "EEPROM Device Data Header.gtype", "EEPROM Characterization Header": "EEPROM Characterization Header.gtype", "Characterization Data": "Characterization Data.gtype"[], "FPGA Current Version": u32, "FPGA Oldest Compatible Version": u32, "Fixed Logic Current Version": u32, "Fixed Logic Oldest Compatible Version": u32, "FPGA Radio Settings Bus Current Version": u32, "FPGA Radio Settings Bus Oldest Compatible Version": u32, "FPGA Board Config Current Version": u32, "FPGA Board Config Oldest Compatible Version": u32, "Daughterboard Clock Rate": u32}
  "Configure Signal Mode.gtype" = enum{"Gain", "Level"}
  "Configure Signal Parameters.gtype" = cluster{"gain/level": f64, "sample rate [S/s]": f64, "frequency [Hz]": f64, "LO frequency [Hz]": f64, "active antenna": string}
  "IQ Impairments.gtype" = cluster{"inline gain I": FXP(1.17), "inline gain Q": FXP(1.17), "cross gain I": FXP(1.17), "cross gain Q": FXP(1.17), "pre-gain offset I": FXP(1.17), "pre-gain offset Q": FXP(1.17), "post-gain offset I": FXP(1.17), "post-gain offset Q": FXP(1.17)}
  "IQ Gain.gtype" = cluster{"gain I": FXP(3.21), "gain Q": FXP(3.21)}
uses:
  Host SubVIs::Configure Frequency.gvi
  NI::USRPRIO::ConfigV1Host::Configure Active Antenna.gvi
  NI::USRPRIO::ConfigV1Host::Calculate Level Range.gvi
  NI::USRPRIO::ConfigV1Host::Calculate Gain Setting.gvi
  NI::USRPRIO::ConfigV1Host::Configure Gain.gvi
  NI::USRPRIO::ConfigV1Host::Calculate IQ Imbalance Correction.gvi
  NI::USRPRIO::ConfigV1Host::Parse Scope.gvi
  Host SubVIs::Calculate Sample Rate.gvi
  NI::G Core::Error::Legacy::Error Cluster From Error Code.gvi
diagram:
  Property Node(instance in=$"signal parameters") -> ("LO frequency [Hz]"=w1, "frequency [Hz]"=w2, "active antenna"=w3, "gain/level"=w4, "sample rate [S/s]"=w5)
  call "Configure Frequency.gvi"(niusrprio session in=$"niusrprio session", wait for lo to lock=TRUE, lo frequency=w1, frequency=w2, error in=$"error in", scope=$scope) -> (niusrprio session out=w6, coerced lo frequency=w7, coerced frequency=w8, error out=w9)
  call "Configure Active Antenna.gvi"(niusrprio session in=w6, active antenna=w3, error in=w9, scope=$scope) -> (niusrprio session out=w10, coerced active antenna=w11, error out=w12)
  case ($"configure signal mode") {
    frame "Gain", Default {
      w13 = w10
      w14 = w7
      w15 = w12
      w16 = w4
      w17 = w4
    }
    frame "Level" {
      call "Calculate Level Range.gvi"(niusrprio session in=w10, frequency=w7, error in=w12, scope=$scope) -> (niusrprio session out=w18, min level=w19, max level=w20, error out=w21)
      In Range And Coerce[IncludeHighLimit=True](lower limit=w19, upper limit=w20, x=w4) -> (coerced(x)=w17)
      call "Calculate Gain Setting.gvi"(niusrprio session in=w18, level=w17, frequency=w7, error in=w21, scope=$scope) -> (niusrprio session out=w13, gain=w16, error out=w15)
      w14 = w7
    }
  }
  call "Configure Gain.gvi"(niusrprio session in=w13, gain=w16, error in=w15, scope=$scope) -> (niusrprio session out=w22, coerced gain=w23, error out=w24)
  # coerced analog gain
  # desired analog gain
  # coerced level
  case ($"correct impairments?") {
    frame False, Default {
      w29 = "IQ Impairments.gtype" {"inline gain I"=0.999992370605, "inline gain Q"=0.999992370605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}
      Property Node(instance in=w29) -> ("inline gain I"=w30)
      To Double Precision Float(number=w30) -> w28
      w25 = w22
      w26 = w24
      w27 = w29
    }
    frame True {
      call "Calculate IQ Imbalance Correction.gvi"(niusrprio session in=w22, frequency=w14, error in=w24, scope=$scope) -> (niusrprio session out=w25, iq imbalance correction=w27, correction gain=w28, error out=w26)
    }
  }
  call "Parse Scope.gvi"(niusrprio session in=w25, error in=w26, scope=$scope) -> (niusrprio session out=w31, device subfunction=w32, device subfunction channel=w33, error out=w34)
  $"niusrprio session 2" <- w31
  Property Node(instance in=w25) -> ("Data Clock Rate"=w35)
  call "Calculate Sample Rate.gvi"(data clock rate=w35, sample rate=w5) -> (decimation sample rate=w36, coerced sample rate=w37)
  # coerced analog gain (dB)
  Property Node(instance in=w31) -> ("FPGA Interface"=w38)
  Dynamic Fpga Interface Cast(reference in=w38, type="Streaming Xvcr FPGA Ref.gtype" constant) -> (reference out=w39)
  # desired analog gain (dB)
  # desired level (dBm)
  # coerced LO frequency
  # coerced frequency
  # coerced sample rate
  # coerced active antenna
  case (w32) {
    frame "rx", Default {
      case (w33) {
        frame "0", Default {
          Property Node(instance in=w39, "rx.output sample rate"=w36, "rx 0.impairments"=w27, error in=w34) -> (error out=w40)
        }
        frame "1" {
          Property Node(instance in=w39, "rx.output sample rate"=w36, "rx 1.impairments"=w27, error in=w34) -> (error out=w40)
        }
      }
      Logarithm Base 10(x=w28) -> w42
      Multiply(w42, 20) -> w43
      case ($"configure signal mode") {
        frame "Gain", Default {
          Add(w43, w23) -> w41
        }
        frame "Level" {
          Subtract(x=w23, y=w16) -> w44
          Add(w43, w44) -> w45
          Subtract(x=w17, y=w45) -> w41
        }
      }
    }
    frame "tx" {
      Reciprocal(x=w28) -> w46
      # compensate for the
      # gain of the imbalance
      # correction
      Absolute Value(x=w46) -> w47
      Is Greater(x=w47, y=4) -> w48
      # limit of DSP gain
      case (w48) {
        frame False, Default {
          w49 = no error
        }
        frame True {
          w50 = "5006: Requested correction exceeds gain range of onboard DSP."
          call "Error Cluster From Error Code.gvi"(error code=5006, error message=w50, show call chain?=TRUE, is warning?=FALSE) -> (error out=w49)
        }
      }
      Merge Errors(w34, w49) -> (error out=w51)
      Property Node(instance in="IQ Gain.gtype" {"gain I"=1, "gain Q"=1}, "gain I"=w46, "gain Q"=w46) -> (instance out=w52)
      case (w33) {
        frame "1" {
          Property Node(instance in=w39, "tx.input sample rate"=w36, "tx 1.impairments"=w27, "tx 1.gain"=w52, error in=w51) -> (error out=w40)
        }
        frame "0", Default {
          Property Node(instance in=w39, "tx.input sample rate"=w36, "tx 0.impairments"=w27, "tx 0.gain"=w52, error in=w51) -> (error out=w40)
        }
      }
      case ($"configure signal mode") {
        frame "Gain", Default {
          w41 = w23
        }
        frame "Level" {
          Subtract(x=w23, y=w16) -> w53
          Add(w53, w17) -> w41
        }
      }
    }
  }
  $"error out" <- w40
  Property Node(instance in="Configure Signal Parameters.gtype" {all zero or empty}, "gain/level"=w41, "LO frequency [Hz]"=w7, "frequency [Hz]"=w8, "sample rate [S/s]"=w37, "active antenna"=w11) -> (instance out=w54)
  $"coerced signal parameters" <- w54
