vi "Configure Time (Multi).gvi"   [LabVIEW NXG 4.0.0]
# Sets the time on the FPGA to match the time of the host. Setting the FPGA time is required to enable future events.
# Nodes that must execute before this node:
# Open and Configure.gvi
# Input Parameters
# niUsrpRio Session is the object created by the Open node and used as the session handle for the USRP RIO design library.
# error in describes error conditions that occur before this node runs. This input provides standard 'error in' functionality.
# Output Parameters
# niUsrpRio Session (out) is the niUsrpRio session used in all subsequent USRP RIO design library host nodes.
# time is the current time set on the device(s). Use time to set a start trigger time for Initiate and Fetch/Generate Time.
# error out contains error information. This output provides standard 'error out' functionality.
inputs:
  "niUsrpRio Sessions": "niUsrpRio Session.gtype"[], required
  "error in": error
outputs:
  "niUsrpRio Sessions (out)": "niUsrpRio Session.gtype"[]
  "time": timestamp  # is the current time set on the device(s). Use time to set a start trigger time for Initiate and Fetch/Generate Time.
  "error out": error
types:
  "Register Bus Session.gtype" = Queue<"Session Data.gtype">
  "Semaphore.gtype" = i32
  "DB Queue Reference.gtype" = Queue<"Daughterboard Data.gtype">
  "EEPROM Header.gtype" = cluster{"Checksum": u32, "Product Code": u16, "Hardware Current Version": u16, "Hardware Oldest Compatible Version": u16, "EEPROM Map Current Version": u16, "EEPROM Map Oldest Compatible Version": u16, "User Password": string, "Pointer to Factory Header": u32, "Pointer to User Header": u32, "Recommended Interval": u16, "Number of Reserved Bytes": i32, "Number of Daughterboards": u8, "Daughterboard IDs": u16[], "Daughterboard Serial Numbers": string[]}
  "EEPROM Device Data Header.gtype" = cluster{"Checksum": u32, "Number of Channels": u8, "Number of Gain Settings": u16[], "Pointer to Characterization Data": u32[], "Number of Reserved Bytes": i32, "Number of Frequencies": u16[]}
  "EEPROM Characterization Header.gtype" = cluster{"Checksum": u32, "Date": timestamp, "Temperature": f32, "Misc. Info": string, "Pointer to Device Data Header": u32, "Number of Reserved Bytes": i32}
  "Characterization Data.gtype" = cluster{"Gains[dB]": f64[], "Frequencies [Hz]": f64[], "IQ Imbalance Table": "IQ Imbalance.gtype"[], "Measured Gains[dB]": f64[][]}
  "niUsrpRio Session.gtype" = cluster{"FPGA Interface": any, "RIO Interface Number": u32, "Data Clock Rate": u32, "FPGA Data Clock Rate": u32, "Global Settings Register Bus": "Register Bus Session.gtype", "Radio 0 Settings Register Bus": "Register Bus Session.gtype", "Radio 1 Settings Register Bus": "Register Bus Session.gtype", "Radio Settings Bus Semaphore": "Semaphore.gtype", "DB Queues": "DB Queue Reference.gtype"[], "Characterization Data Valid?": bool, "EEPROM Header": "EEPROM Header.gtype", "Device Data Header": "EEPROM Device Data Header.gtype", "EEPROM Characterization Header": "EEPROM Characterization Header.gtype", "Characterization Data": "Characterization Data.gtype"[], "FPGA Current Version": u32, "FPGA Oldest Compatible Version": u32, "Fixed Logic Current Version": u32, "Fixed Logic Oldest Compatible Version": u32, "FPGA Radio Settings Bus Current Version": u32, "FPGA Radio Settings Bus Oldest Compatible Version": u32, "FPGA Board Config Current Version": u32, "FPGA Board Config Oldest Compatible Version": u32, "Daughterboard Clock Rate": u32}
uses:
  NI::USRPRIO::TimeV1Host::Initialize (Multi).gvi
  NI::USRPRIO::TimeV1Host::Set Time (Multi).gvi
  NI::USRPRIO::TimeV1Host::Get Time (Multi).gvi
diagram:
  call "Initialize (Multi).gvi"(niusrprio sessions in=$"niUsrpRio Sessions", error in=$"error in") -> (niusrprio sessions out=w1, error out=w2)
  Get Current Time() -> (current time=w3)
  call "Set Time (Multi).gvi"(niusrprio sessions in=w1, time=w3, error in=w2, when="next cptr") -> (niusrprio sessions out=w4, error out=w5)
  call "Get Time (Multi).gvi"(niusrprio sessions in=w4, error in=w5, when="now") -> (niusrprio sessions out=w6, times=w7, error out=w8)
  $"niUsrpRio Sessions (out)" <- w6
  $"error out" <- w8
  Array Index(array=w7) -> (out0[_]=w9)
  $time <- w9
