vi "Configure Tx.gvi"   [LabVIEW NXG 4.0.0]
inputs:
  "niUsrpRio Session": "niUsrpRio Session.gtype", required
  "tx config": T2 = {"rf enable 0"=FALSE, "rf config 0"={"antenna"="TX1", "frequency"=2000000000, "lo frequency"=-1, "level"=0}, "rf enable 1"=FALSE, "rf config 1"={"antenna"="TX1", "frequency"=2000000000, "lo frequency"=-1, "level"=0}, "transfer mode"="Finite", "sample rate"=10000000, "number of samples"=8192, "start trigger"="Immediate", "tone frequency"=100000}, required
  "error in": error
outputs:
  "niUsrpRio Session (out)": "niUsrpRio Session.gtype"
  "tx.enabled channels": string[]
  "I": i16[]
  "Q": i16[]
  "error out": error
  "tx.output waveform": waveform<f64>[]
  "tx.coerced configurations": T3
panel indicators:
  "tx config out": T2
types:
  "Register Bus Session.gtype" = Queue<"Session Data.gtype">
  "Semaphore.gtype" = i32
  "DB Queue Reference.gtype" = Queue<"Daughterboard Data.gtype">
  "EEPROM Header.gtype" = cluster{"Checksum": u32, "Product Code": u16, "Hardware Current Version": u16, "Hardware Oldest Compatible Version": u16, "EEPROM Map Current Version": u16, "EEPROM Map Oldest Compatible Version": u16, "User Password": string, "Pointer to Factory Header": u32, "Pointer to User Header": u32, "Recommended Interval": u16, "Number of Reserved Bytes": i32, "Number of Daughterboards": u8, "Daughterboard IDs": u16[], "Daughterboard Serial Numbers": string[]}
  "EEPROM Device Data Header.gtype" = cluster{"Checksum": u32, "Number of Channels": u8, "Number of Gain Settings": u16[], "Pointer to Characterization Data": u32[], "Number of Reserved Bytes": i32, "Number of Frequencies": u16[]}
  "EEPROM Characterization Header.gtype" = cluster{"Checksum": u32, "Date": timestamp, "Temperature": f32, "Misc. Info": string, "Pointer to Device Data Header": u32, "Number of Reserved Bytes": i32}
  "Characterization Data.gtype" = cluster{"Gains[dB]": f64[], "Frequencies [Hz]": f64[], "IQ Imbalance Table": "IQ Imbalance.gtype"[], "Measured Gains[dB]": f64[][]}
  "niUsrpRio Session.gtype" = cluster{"FPGA Interface": any, "RIO Interface Number": u32, "Data Clock Rate": u32, "FPGA Data Clock Rate": u32, "Global Settings Register Bus": "Register Bus Session.gtype", "Radio 0 Settings Register Bus": "Register Bus Session.gtype", "Radio 1 Settings Register Bus": "Register Bus Session.gtype", "Radio Settings Bus Semaphore": "Semaphore.gtype", "DB Queues": "DB Queue Reference.gtype"[], "Characterization Data Valid?": bool, "EEPROM Header": "EEPROM Header.gtype", "Device Data Header": "EEPROM Device Data Header.gtype", "EEPROM Characterization Header": "EEPROM Characterization Header.gtype", "Characterization Data": "Characterization Data.gtype"[], "FPGA Current Version": u32, "FPGA Oldest Compatible Version": u32, "Fixed Logic Current Version": u32, "Fixed Logic Oldest Compatible Version": u32, "FPGA Radio Settings Bus Current Version": u32, "FPGA Radio Settings Bus Oldest Compatible Version": u32, "FPGA Board Config Current Version": u32, "FPGA Board Config Oldest Compatible Version": u32, "Daughterboard Clock Rate": u32}
  T1 = cluster{"antenna": string, "frequency": f64, "lo frequency": f64, "level": f64}
  "Start Trigger.gtype" = enum{"Software", "Digital Edge", "Rx Start Trigger", "Tx Start Trigger", "Immediate", "Future Time Event"}
  T2 = cluster{"rf enable 0": bool, "rf config 0": T1, "rf enable 1": bool, "rf config 1": T1, "transfer mode": enum{"Finite", "Continuous"}, "sample rate": f64, "number of samples": u32, "start trigger": "Start Trigger.gtype", "tone frequency": f64}
  T3 = cluster{"coerced frequencies": f64[], "coerced lo frequencies": f64[], "coerced levels": f64[], "coerced sample rates": f64[]}
uses:
  Host SubVIs::Construct Channels.gvi
  Host SubVIs::Generate Waveform (Multi-Array).gvi
  Host SubVIs::Configure Signal (Level).gvi
  Host SubVIs::Configure Start Trigger.gvi
  Host SubVIs::Configure Stream.gvi
diagram:
  Property Node(instance in=$"tx config") -> ("rf enable 0"=w1, "rf config 0"=w2, "rf enable 1"=w3, "rf config 1"=w4, "transfer mode"=w5, "start trigger"=w6, "tone frequency"=w7, instance out=w8)
  w9 = cluster{"rf enable 0": bool, "rf config 0": T1} {all zero or empty}
  Property Node(instance in=w9, "rf enable 0"=w1, "rf config 0"=w2) -> (instance out=w10)
  w11 = cluster{"rf enable 1": bool, "rf config 1": T1} {all zero or empty}
  Property Node(instance in=w11, "rf enable 1"=w3, "rf config 1"=w4) -> (instance out=w12)
  Build Array(w10, w12) -> w13
  call "Construct Channels.gvi"(channel configurations=w13, scope="tx") -> (enabled channels=w14, enabled channel configurations=w15)
  Array Size(array=w14) -> (size(s)=w16)
  case (w16) {
    frame 0 {
      w17 = default
      w18 = default
      w19 = default
      w20 = default
      w21 = default
      w22 = $"niUsrpRio Session"
      w23 = $"error in"
      w24 = default
      w25 = default
      w26 = default
      w27 = default
    }
    frame Default {
      call "Generate Waveform (Multi-Array).gvi"(tx config in=w8, tone frequency=w7, amplitude=0.5) -> (tx config out=w27, i=w24, q=w25, waveform=w26, Sample Number=w28, error out=w29, Fs=w30)
      s1 = $"error in"  # shift register
      for {
        w31 = each element of w15
        w32 = each element of w14
        Property Node(instance in=w31) -> ("frequency"=w33, "level"=w34, "antenna"=w35, "lo frequency"=w36)
        call "Configure Signal (Level).gvi"(active antenna=w35, lo frequency [hz]=w36, niusrprio session in=$"niUsrpRio Session", sample rate [s/s]=w30, frequency [hz]=w33, level [dbm]=w34, error in=s1, scope=w32) -> (coerced lo frequency [hz]=w37, niusrprio session out=w38, coerced sample rate [s/s]=w39, coerced frequency [hz]=w40, coerced level [dbm]=w41, error out=w42)
        # w6: >> start trigger >>
        # w5: >> number of samples is finite >>
        # w28: >> number of samples >>
        call "Configure Start Trigger.gvi"(niusrprio session in=w38, start trigger=w6, error in=w42, scope=w32) -> (niusrprio session out=w43, error out=w44)
        Is Equal To 0(x=w5) -> w45
        # w45: >> number of samples is finite >>
        call "Configure Stream.gvi"(niusrprio session in=w43, number of samples is finite=w45, number of samples=w28, error in=w44, scope=w32) -> (niusrprio session out=w22, error out=w46)
        append w37 to w20
        append w41 to w19
        append w40 to w18
        append w39 to w17
        append w32 to w21
        next s1 = w46
      }
      Merge Errors(s1, w29) -> (error out=w23)
      Array Index(array=w17)
    }
  }
  $"tx.enabled channels" <- w21
  $"niUsrpRio Session (out)" <- w22
  $"error out" <- w23
  $I <- w24
  $Q <- w25
  $"tx.output waveform" <- w26
  $"tx config out" <- w27
  Property Node(instance in=T3 {all zero or empty}, "coerced sample rates"=w17, "coerced frequencies"=w18, "coerced levels"=w19, "coerced lo frequencies"=w20) -> (instance out=w47)
  $"tx.coerced configurations" <- w47
