vi "Generate Waveform (Multi-Array).gvi"   [LabVIEW NXG 4.0.0]
inputs:
  "tx config in": T2 = {"rf enable 0"=FALSE, "rf config 0"={"antenna"="TX1", "frequency"=2000000000, "lo frequency"=-1, "level"=0}, "rf enable 1"=FALSE, "rf config 1"={"antenna"="TX1", "frequency"=2000000000, "lo frequency"=-1, "level"=0}, "transfer mode"="Finite", "sample rate"=10000000, "number of samples"=8192, "start trigger"="Immediate", "tone frequency"=100000}
  "number of samples": u32 = 300000
  "sample rate": f64 = 10000000
  "tone frequency": f64 = 130000
  "amplitude": f64 = 1
outputs:
  "tx config out": T2
  "i": i16[]
  "q": i16[]
  "waveform": waveform<f64>[]
  "error out": error
  "Sample Number": u32
  "Fs": f64
panel indicators:
  "i_1": i16[]
  "q_1": i16[]
  "i_2": i16[]
  "q_2": i16[]
  "I_Comb": i16[][][]
  "Q_Comb": i16[][][]
  "i_3": i16[]
  "q_3": i16[]
  "i_4": i16[]
  "q_4": i16[]
types:
  T1 = cluster{"antenna": string, "frequency": f64, "lo frequency": f64, "level": f64}
  "Start Trigger.gtype" = enum{"Software", "Digital Edge", "Rx Start Trigger", "Tx Start Trigger", "Immediate", "Future Time Event"}
  T2 = cluster{"rf enable 0": bool, "rf config 0": T1, "rf enable 1": bool, "rf config 1": T1, "transfer mode": enum{"Finite", "Continuous"}, "sample rate": f64, "number of samples": u32, "start trigger": "Start Trigger.gtype", "tone frequency": f64}
uses:
  NI::Analysis::Generation::Sine Waveform.gvi
  Host SubVIs::test.mli::Test
diagram:
  call "Sine Waveform.gvi"(sample rate=$"sample rate", samples=$"number of samples", amplitude=$amplitude, frequency=$"tone frequency", phase in=90) -> (sine wave=w1, error out=w2)
  call "Sine Waveform.gvi"(sample rate=$"sample rate", samples=$"number of samples", amplitude=$amplitude, frequency=$"tone frequency", phase in=0) -> (sine wave=w3, error out=w4)
  Build Array(w1, w3)
  Property Node(instance in=w1) -> ("Y"=w5)
  Multiply(w5, 32767) -> w6
  To Signed 16 Bit Integer(number=w6) -> w7
  $i <- w7
  Property Node(instance in=w3) -> ("Y"=w8)
  Multiply(w8, 32767) -> w9
  To Signed 16 Bit Integer(number=w9) -> w10
  $q <- w10
  Merge Errors(w2, w4) -> (error out=w11)
  $"error out" <- w11
  call "Test"() -> (output=w12, Fs=w13)
  Property Node(instance in=$"tx config in") -> (instance out=w14)
  Array Size(array=w12) -> (size(s)=w15)
  Array Index(array=w15) -> (out0[0]=w16)
  To Unsigned 32 Bit Integer(number=w16) -> w17
  Property Node(instance in=w14, "number of samples"=w17, "sample rate"=w13) -> (instance out=w18)
  $"tx config out" <- w18
  $"Sample Number" <- w17
  $Fs <- w13
  # Sampling Time
  Reciprocal(x=w13) -> w19
  Array Index(array=w12) -> (out0[_, 2]=w20)
  Complex To Real And Imaginary(x + iy=w20) -> (x=w21, y=w22)
  Build Waveform Node(Y=w22, dt=w19) -> (output waveform=w23)
  Property Node(instance in=w23) -> ("Y"=w24, instance out=w25)
  Build Waveform Node(Y=w21, dt=w19) -> (output waveform=w26)
  Property Node(instance in=w26) -> ("Y"=w27, instance out=w28)
  # Sampling Time
  Reciprocal(x=w13) -> w29
  Array Index(array=w12) -> (out0[_, 2]=w30)
  Complex To Real And Imaginary(x + iy=w30) -> (x=w31, y=w32)
  Build Waveform Node(Y=w32, dt=w29) -> (output waveform=w33)
  Property Node(instance in=w33) -> ("Y"=w34, instance out=w35)
  Build Waveform Node(Y=w31, dt=w29) -> (output waveform=w36)
  Property Node(instance in=w36) -> ("Y"=w37, instance out=w38)
  # Sampling Time
  Reciprocal(x=w13) -> w39
  Array Index(array=w12) -> (out0[_, 1]=w40)
  Complex To Real And Imaginary(x + iy=w40) -> (x=w41, y=w42)
  Build Waveform Node(Y=w42, dt=w39) -> (output waveform=w43)
  Build Waveform Node(Y=w41, dt=w39) -> (output waveform=w44)
  # Sampling Time
  Reciprocal(x=w13) -> w45
  Array Index(array=w12) -> (out0[_, 0]=w46)
  Complex To Real And Imaginary(x + iy=w46) -> (x=w47, y=w48)
  Build Waveform Node(Y=w47, dt=w45) -> (output waveform=w49)
  Build Waveform Node(Y=w48, dt=w45) -> (output waveform=w50)
  Build Array(w49, w50) -> w51
  Build Array(w51, w44) -> w52
  Build Array(w52, w43) -> w53
  Build Array(w53, w38) -> w54
  Build Array(w54, w35) -> w55
  Build Array(w55, w28) -> w56
  Build Array(w56, w25) -> w57
  $waveform <- w57
  Property Node(instance in=w49) -> ("Y"=w58)
  Multiply(w58, 32767) -> w59
  To Signed 16 Bit Integer(number=w59) -> w60
  $i_1 <- w60
  Property Node(instance in=w50) -> ("Y"=w61)
  Multiply(w61, 32767) -> w62
  To Signed 16 Bit Integer(number=w62) -> w63
  $q_1 <- w63
  Property Node(instance in=w44) -> ("Y"=w64)
  Multiply(w64, 32767) -> w65
  To Signed 16 Bit Integer(number=w65) -> w66
  $i_2 <- w66
  Build Array(w60, w66) -> w67
  Multiply(w37, 32767) -> w68
  To Signed 16 Bit Integer(number=w68) -> w69
  Multiply(w27, 32767) -> w70
  To Signed 16 Bit Integer(number=w70) -> w71
  Build Array(w69, w71) -> w72
  Build Array(w67, w72) -> w73
  $I_Comb <- w73
  Property Node(instance in=w43) -> ("Y"=w74)
  Multiply(w74, 32767) -> w75
  To Signed 16 Bit Integer(number=w75) -> w76
  $q_2 <- w76
  $i_3 <- w69
  Build Array(w63, w76) -> w77
  Multiply(w34, 32767) -> w78
  To Signed 16 Bit Integer(number=w78) -> w79
  Multiply(w24, 32767) -> w80
  To Signed 16 Bit Integer(number=w80) -> w81
  Build Array(w79, w81) -> w82
  Build Array(w77, w82) -> w83
  $Q_Comb <- w83
  $q_3 <- w79
  $i_4 <- w71
  $q_4 <- w81
