vi "Initiate and Trigger.gvi"   [LabVIEW NXG 4.0.0]
inputs:
  "niUsrpRio Sessions": "niUsrpRio Session.gtype"[], required
  "start trigger": "Start Trigger.gtype" = "Immediate", required
  "start trigger time": timestamp, required
  "error in": error
  "scope": string = "rx", required
outputs:
  "niUsrpRio Sessions (out)": "niUsrpRio Session.gtype"[]
  "error out": error
types:
  "Register Bus Session.gtype" = Queue<"Session Data.gtype">
  "Semaphore.gtype" = i32
  "DB Queue Reference.gtype" = Queue<"Daughterboard Data.gtype">
  "EEPROM Header.gtype" = cluster{"Checksum": u32, "Product Code": u16, "Hardware Current Version": u16, "Hardware Oldest Compatible Version": u16, "EEPROM Map Current Version": u16, "EEPROM Map Oldest Compatible Version": u16, "User Password": string, "Pointer to Factory Header": u32, "Pointer to User Header": u32, "Recommended Interval": u16, "Number of Reserved Bytes": i32, "Number of Daughterboards": u8, "Daughterboard IDs": u16[], "Daughterboard Serial Numbers": string[]}
  "EEPROM Device Data Header.gtype" = cluster{"Checksum": u32, "Number of Channels": u8, "Number of Gain Settings": u16[], "Pointer to Characterization Data": u32[], "Number of Reserved Bytes": i32, "Number of Frequencies": u16[]}
  "EEPROM Characterization Header.gtype" = cluster{"Checksum": u32, "Date": timestamp, "Temperature": f32, "Misc. Info": string, "Pointer to Device Data Header": u32, "Number of Reserved Bytes": i32}
  "Characterization Data.gtype" = cluster{"Gains[dB]": f64[], "Frequencies [Hz]": f64[], "IQ Imbalance Table": "IQ Imbalance.gtype"[], "Measured Gains[dB]": f64[][]}
  "niUsrpRio Session.gtype" = cluster{"FPGA Interface": any, "RIO Interface Number": u32, "Data Clock Rate": u32, "FPGA Data Clock Rate": u32, "Global Settings Register Bus": "Register Bus Session.gtype", "Radio 0 Settings Register Bus": "Register Bus Session.gtype", "Radio 1 Settings Register Bus": "Register Bus Session.gtype", "Radio Settings Bus Semaphore": "Semaphore.gtype", "DB Queues": "DB Queue Reference.gtype"[], "Characterization Data Valid?": bool, "EEPROM Header": "EEPROM Header.gtype", "Device Data Header": "EEPROM Device Data Header.gtype", "EEPROM Characterization Header": "EEPROM Characterization Header.gtype", "Characterization Data": "Characterization Data.gtype"[], "FPGA Current Version": u32, "FPGA Oldest Compatible Version": u32, "Fixed Logic Current Version": u32, "Fixed Logic Oldest Compatible Version": u32, "FPGA Radio Settings Bus Current Version": u32, "FPGA Radio Settings Bus Oldest Compatible Version": u32, "FPGA Board Config Current Version": u32, "FPGA Board Config Oldest Compatible Version": u32, "Daughterboard Clock Rate": u32}
  "Start Trigger.gtype" = enum{"Software", "Digital Edge", "Rx Start Trigger", "Tx Start Trigger", "Immediate", "Future Time Event"}
uses:
  Host SubVIs::Initiate Stream.gvi
  Host SubVIs::Trigger Time.gvi
  Host SubVIs::Send Software Start Trigger.gvi
diagram:
  # The slaves must be ready to receive a trigger before the master sends one. Initiate Stream will cause a trigger when using an Immediate start trigger. Run Initiate Stream on the slaves before the master.
  Reverse 1D Array(array=$"niUsrpRio Sessions") -> (reversed array=w1)
  s1 = $"error in"  # shift register
  for {
    w2 = each element of w1
    call "Initiate Stream.gvi"(niusrprio session in=w2, error in=s1, scope=$scope) -> (niusrprio session out=w3, error out=w4)
    next s1 = w4
  }
  case ($"start trigger") {
    frame "Future Time Event" {
      call "Trigger Time.gvi"(niUsrpRio Sessions=$"niUsrpRio Sessions", start trigger time=$"start trigger time", error in=s1, scope=$scope) -> (error out=w5)
      w6 = $"niUsrpRio Sessions"
    }
    frame Default {
      w5 = s1
      w6 = $"niUsrpRio Sessions"
    }
    frame "Software" {
      call "Send Software Start Trigger.gvi"(niusrprio session in=w3, error in=s1, scope=$scope) -> (error out=w5)
      w6 = $"niUsrpRio Sessions"
    }
  }
  $"niUsrpRio Sessions (out)" <- w6
  $"error out" <- w5
