vi "Multi-Device Rx Streaming Signal (Host).gvi"   [LabVIEW NXG 4.0.0]
# This template is for the Simple NI-USRP Streaming design, a design that shows the basics of streaming data to and from an NI USRP-294x/295x device. Refer to the block diagram for more information about how to use this template.
panel controls:
  "Tab": i32
  "rx.stop": bool
  "Tab_2": i32
  "rx config": T5 = {"rf enable 0"=TRUE, "rf config 0"={"Antenna RF 0"="RX2", "Frequency RF 0 [Hz]"=2000000000, "LO Frequency RF 0 [Hz]"=-1, "Reference Level RF 0 [dBm]"=0}, "rf enable 1"=TRUE, "rf config 1"={"Antenna RF 1"="RX2", "Frequency RF 1 [Hz]"=2000000000, "LO Frequency RF 1 [Hz]"=-1, "Reference Level RF 1 [dBm]"=0}, "Acquisition Mode"="Finite", "Sample Rate [S/s]"=10000000, "Number of Samples"=8192, "Start Trigger"="Immediate"}
  "USRP RIO devices": string[] = ["RIO0", "RIO1"]
  "Reference Frequency Source": string = "REF IN"
  "FPGA I/O for Synchronization": string = "SyncAux"
panel indicators:
  "Power Spectrum": T1[]
  "Power Level": f64[][]
  "I & Q Data": f64[][]
  "Acquiring": bool
  "RX Coerced Configurations": T6[]
types:
  T1 = cluster{"f0": f64, "df": f64, "magnitude": f64[]}
  T2 = cluster{"Antenna RF 0": string, "Frequency RF 0 [Hz]": f64, "LO Frequency RF 0 [Hz]": f64, "Reference Level RF 0 [dBm]": f64}
  T3 = cluster{"Antenna RF 1": string, "Frequency RF 1 [Hz]": f64, "LO Frequency RF 1 [Hz]": f64, "Reference Level RF 1 [dBm]": f64}
  T4 = enum{"Software", "Digital Edge", "Rx Start Trigger", "Tx Start Trigger", "Immediate", "Future Time Event"}
  T5 = cluster{"rf enable 0": bool, "rf config 0": T2, "rf enable 1": bool, "rf config 1": T3, "Acquisition Mode": enum{"Finite", "Continuous"}, "Sample Rate [S/s]": f64, "Number of Samples": u32, "Start Trigger": T4}
  T6 = cluster{"Coerced Frequencies [Hz]": f64[], "Coerced LO Frequencies [Hz]": f64[], "Coerced Levels [dBm]": f64[], "Coerced Sample Rates [S/s]": f64[]}
uses:
  Host SubVIs::Open and Configure Device.gvi
  Host SubVIs::Configure Synchronization.gvi
  Host SubVIs::Initiate and Fetch (Multi).gvi
  NI::G Core::Timing::Elapsed Timer.gvi
  Host SubVIs::Calculate Power.gvi
  Host SubVIs::Close Device.gvi
  NI::G Core::Error::Display Error.gvi
diagram:
  w1 = $"Reference Frequency Source"
  w2 = $"FPGA I/O for Synchronization"
  w3 = $"rx config"
  # 1. Open and configure device
  # 2. Configure time
  # 3. Receive data
  # 4. Close device
  # 1.
  for {
    w4 = each element of $"USRP RIO devices"
    call "Open and Configure Device.gvi"(rx config=w3, USRP RIO Device=w4, reference frequency source=w1, which bitfile=w2) -> (niUsrpRio Session (out)=w9, rx.coerced configurations=w10, error out=w11, rx channels=w12)
    append w10 to w5
    append w12 to w6
    append w11 to w7
    append w9 to w8
  }
  Merge Errors(w7) -> (error out=w13)
  # 2.
  call "Configure Synchronization.gvi"(niusrprio sessions in=w8, error in=w13, scope="rx") -> (niusrprio sessions out=w14, error out=w15)
  s1 = w15  # shift register
  while (iteration -> i1) {
    Is Equal To 0(x=i1) -> w16
    # 3.
    call "Initiate and Fetch (Multi).gvi"(niUsrpRio Sessions=w14, first iteration=w16, error in=s1, rx channels=w6) -> (niUsrpRio Sessions (out)=w17, complex baseband data=w18, error out=w19)
    call "Elapsed Timer.gvi"(target time=0.05) -> (time has elapsed=w20)
    case (w20) {
      frame False, Default { }
      frame True {
        call "Calculate Power.gvi"(waveform=w18) -> (Power Spectrum=w21, Power Level=w22, I & Q Data=w23)
        $"Power Spectrum" <- w21
        $"Power Level" <- w22
        $"I & Q Data" <- w23
      }
    }
    Logical Or(w19, $"rx.stop") -> w24
    Not(x=w24) -> w25
    $Acquiring <- w25
    next s1 = w19
    stop if w24
  }
  # 4.
  for {
    w26 = each element of w17
    call "Close Device.gvi"(niusrprio session in=w26, error in=s1) -> (error out=w28)
    append w28 to w27
  }
  Merge Errors(w27) -> (error out=w29)
  call "Display Error.gvi"(error in=w29, type of dialog="OK message + warnings")
  $"RX Coerced Configurations" <- w5
