vi "Multi-Device Tx Streaming Time (Host).gvi"   [LabVIEW NXG 4.0.0]
# This template is for the Simple NI-USRP Streaming design, a design that shows the basics of streaming data to and from an NI USRP-294x/295x device. Refer to the block diagram for more information about how to use this template.
panel controls:
  "Tab": i32
  "tx.stop": bool
  "Tab_2": i32
  "tx config": T4 = {"rf enable 0"=TRUE, "rf config 0"={"Antenna RF 0"="TX1", "Frequency RF 0 [Hz]"=2000000000, "LO Frequency RF 0 [Hz]"=-1, "Output Power RF 0 [dBm]"=0}, "rf enable 1"=TRUE, "rf config 1"={"Antenna RF 1"="TX1", "Frequency RF 1 [Hz]"=2000000000, "LO Frequency RF 1 [Hz]"=-1, "Output Power RF 1 [dBm]"=0}, "Generation Mode"="Finite", "Sample Rate [S/s]"=10000000, "Number of Samples"=8192, "Start Trigger"="Future Time Event", "Tone Frequency [Hz]"=100000}
  "USRP RIO devices": string[] = ["RIO0", "RIO1"]
  "Reference Frequency Source": string = "REF IN"
panel indicators:
  "Output Waveform": waveform<f64>[]
  "Generating": bool
  "TX Coerced Configurations": T5[]
types:
  T1 = cluster{"Antenna RF 0": string, "Frequency RF 0 [Hz]": f64, "LO Frequency RF 0 [Hz]": f64, "Output Power RF 0 [dBm]": f64}
  T2 = cluster{"Antenna RF 1": string, "Frequency RF 1 [Hz]": f64, "LO Frequency RF 1 [Hz]": f64, "Output Power RF 1 [dBm]": f64}
  T3 = enum{"Software", "Digital Edge", "Rx Start Trigger", "Tx Start Trigger", "Immediate", "Future Time Event"}
  T4 = cluster{"rf enable 0": bool, "rf config 0": T1, "rf enable 1": bool, "rf config 1": T2, "Generation Mode": enum{"Finite", "Continuous"}, "Sample Rate [S/s]": f64, "Number of Samples": u32, "Start Trigger": T3, "Tone Frequency [Hz]": f64}
  T5 = cluster{"Coerced Frequencies [Hz]": f64[], "Coerced LO Frequencies [Hz]": f64[], "Coerced Output Powers [dBm]": f64[], "Coerced Sample Rates [S/s]": f64[]}
uses:
  Host SubVIs::Open and Configure Device.gvi
  Host SubVIs::Configure Time (Multi).gvi
  Host SubVIs::Initiate and Generate Time (Multi).gvi
  Host SubVIs::Close Device.gvi
  NI::G Core::Error::Display Error.gvi
diagram:
  w1 = $"Reference Frequency Source"
  w2 = $"tx config"
  # 1. Open and configure device
  # 2. Configure time
  # 3. Transmit data
  # 4. Close device
  # 1.
  for {
    w3 = each element of $"USRP RIO devices"
    call "Open and Configure Device.gvi"(tx config=w2, USRP RIO Device=w3, reference frequency source=w1) -> (niUsrpRio Session (out)=w8, tx.coerced configurations=w9, tx.output waveform=w10, error out=w11, tx channels=w12)
    append w9 to w4
    append w12 to w5
    append w11 to w6
    append w8 to w7
  }
  Merge Errors(w6) -> (error out=w13)
  # 2.
  call "Configure Time (Multi).gvi"(niUsrpRio Sessions=w7, error in=w13) -> (niUsrpRio Sessions (out)=w14, time=w15, error out=w16)
  Time Stamp Add(x=w15, y=2) -> w17
  s1 = w16  # shift register
  s2 = w17  # shift register
  while (iteration -> i1) {
    Is Equal To 0(x=i1) -> w18
    # 3.
    call "Initiate and Generate Time (Multi).gvi"(niUsrpRio Sessions=w14, first iteration=w18, start trigger time=s2, error in=s1, tx channels=w5) -> (niUsrpRio Sessions (out)=w19, error out=w20)
    Logical Or(w20, $"tx.stop") -> w21
    Not(x=w21) -> w22
    $Generating <- w22
    Time Stamp Add(x=s2, y=0.1) -> w23
    next s1 = w20
    next s2 = w23
    stop if w21
  }
  # 4.
  for {
    w24 = each element of w19
    call "Close Device.gvi"(niusrprio session in=w24, error in=s1) -> (error out=w26)
    append w26 to w25
  }
  Merge Errors(w25) -> (error out=w27)
  call "Display Error.gvi"(error in=w27, type of dialog="OK message + warnings")
  $"TX Coerced Configurations" <- w4
  $"Output Waveform" <- w10
