vi "Multi-Device Tx+Rx Streaming Time (Host).gvi"   [LabVIEW NXG 4.0.0]
# This template is for the Simple NI-USRP Streaming design, a design that shows the basics of streaming data to and from an NI USRP-294x/295x device. Refer to the block diagram for more information about how to use this template.
panel controls:
  "Tab": i32
  "stop": bool
  "Tab_2": i32
  "tx config": T5 = {"rf enable 0"=TRUE, "rf config 0"={"Antenna RF 0"="TX1", "Frequency RF 0 [Hz]"=2000000000, "LO Frequency RF 0 [Hz]"=-1, "Output Power RF 0 [dBm]"=0}, "rf enable 1"=TRUE, "rf config 1"={"Antenna RF 1"="TX1", "Frequency RF 1 [Hz]"=2000000000, "LO Frequency RF 1 [Hz]"=-1, "Output Power RF 1 [dBm]"=0}, "Generation Mode"="Finite", "Sample Rate [S/s]"=10000000, "Number of Samples"=8192, "Start Trigger"="Future Time Event", "Tone Frequency [Hz]"=100000}
  "rx config": T8 = {"rf enable 0"=TRUE, "rf config 0"={"Antenna RF 0"="RX2", "Frequency RF 0 [Hz]"=2000000000, "LO Frequency RF 0 [Hz]"=-1, "Reference Level RF 0 [dBm]"=0}, "rf enable 1"=TRUE, "rf config 1"={"Antenna RF 1"="RX2", "Frequency RF 1 [Hz]"=2000000000, "LO Frequency RF 1 [Hz]"=-1, "Reference Level RF 1 [dBm]"=0}, "Acquisition Mode"="Finite", "Sample Rate [S/s]"=10000000, "Number of Samples"=8192, "Start Trigger"="Future Time Event"}
  "USRP RIO devices": string[] = ["RIO0", "RIO1"]
  "Reference Frequency Source": string = "REF IN"
panel indicators:
  "Power Spectrum": T1[]
  "Power Level": f64[][]
  "I & Q Data": f64[][]
  "Output Waveform": waveform<f64>[]
  "Active": bool
  "TX Coerced Configurations": T9[]
  "RX Coerced Configurations": T10[]
  "Numeric": u32
types:
  T1 = cluster{"f0": f64, "df": f64, "magnitude": f64[]}
  T2 = cluster{"Antenna RF 0": string, "Frequency RF 0 [Hz]": f64, "LO Frequency RF 0 [Hz]": f64, "Output Power RF 0 [dBm]": f64}
  T3 = cluster{"Antenna RF 1": string, "Frequency RF 1 [Hz]": f64, "LO Frequency RF 1 [Hz]": f64, "Output Power RF 1 [dBm]": f64}
  T4 = enum{"Software", "Digital Edge", "Rx Start Trigger", "Tx Start Trigger", "Immediate", "Future Time Event"}
  T5 = cluster{"rf enable 0": bool, "rf config 0": T2, "rf enable 1": bool, "rf config 1": T3, "Generation Mode": enum{"Finite", "Continuous"}, "Sample Rate [S/s]": f64, "Number of Samples": u32, "Start Trigger": T4, "Tone Frequency [Hz]": f64}
  T6 = cluster{"Antenna RF 0": string, "Frequency RF 0 [Hz]": f64, "LO Frequency RF 0 [Hz]": f64, "Reference Level RF 0 [dBm]": f64}
  T7 = cluster{"Antenna RF 1": string, "Frequency RF 1 [Hz]": f64, "LO Frequency RF 1 [Hz]": f64, "Reference Level RF 1 [dBm]": f64}
  T8 = cluster{"rf enable 0": bool, "rf config 0": T6, "rf enable 1": bool, "rf config 1": T7, "Acquisition Mode": enum{"Finite", "Continuous"}, "Sample Rate [S/s]": f64, "Number of Samples": u32, "Start Trigger": T4}
  T9 = cluster{"Coerced Frequencies [Hz]": f64[], "Coerced LO Frequencies [Hz]": f64[], "Coerced Output Powers [dBm]": f64[], "Coerced Sample Rates [S/s]": f64[]}
  T10 = cluster{"Coerced Frequencies [Hz]": f64[], "Coerced LO Frequencies [Hz]": f64[], "Coerced Levels [dBm]": f64[], "Coerced Sample Rates [S/s]": f64[]}
uses:
  Host SubVIs::Open and Configure Device.gvi
  Host SubVIs::Configure Time (Multi).gvi
  NI::USRPRIO::TimeV1Host::Get Time (Multi).gvi
  Host SubVIs::Initiate and Fetch Time (Multi).gvi
  NI::G Core::Timing::Elapsed Timer.gvi
  Host SubVIs::Calculate Power.gvi
  Host SubVIs::Initiate and Generate Time (Multi).gvi
  Host SubVIs::Close Device.gvi
  NI::G Core::Error::Display Error.gvi
diagram:
  w1 = $"Reference Frequency Source"
  w2 = $"rx config"
  w3 = $"tx config"
  # 1. Open and configure device.
  # 2. Configure time.
  # 3. Retrieve and generate data 100 ms from the current time.
  # 4. Close device.
  # 1.
  for {
    w4 = each element of $"USRP RIO devices"
    call "Open and Configure Device.gvi"(rx config=w2, tx config=w3, USRP RIO Device=w4, reference frequency source=w1) -> (niUsrpRio Session (out)=w11, rx.coerced configurations=w12, tx.coerced configurations=w13, tx.output waveform=w14, error out=w15, rx channels=w16, tx channels=w17)
    append w13 to w5
    append w12 to w6
    append w17 to w7
    append w16 to w8
    append w15 to w9
    append w11 to w10
  }
  Merge Errors(w9) -> (error out=w18)
  # 2.
  call "Configure Time (Multi).gvi"(niUsrpRio Sessions=w10, error in=w18) -> (niUsrpRio Sessions (out)=w19, error out=w20)
  s1 = w20  # shift register
  while (iteration -> i1) {
    call "Get Time (Multi).gvi"(niusrprio sessions in=w19, error in=s1) -> (niusrprio sessions out=w21, times=w22, error out=w23)
    Array Index(array=w22) -> (out0[_]=w24)
    Time Stamp Add(x=w24, y=0.1) -> w25
    Is Equal To 0(x=i1) -> w26
    call "Initiate and Fetch Time (Multi).gvi"(niUsrpRio Sessions=w21, first iteration=w26, start trigger time=w25, error in=w23, rx channels=w8) -> (complex baseband data=w27, error out=w28)
    # 3.
    call "Elapsed Timer.gvi"(target time=0.05) -> (time has elapsed=w29)
    call "Elapsed Timer.gvi"(target time=1) -> (time has elapsed=w30)
    case (w29) {
      frame False, Default { }
      frame True {
        call "Calculate Power.gvi"(waveform=w27) -> (Power Spectrum=w31, Power Level=w32, I & Q Data=w33)
        $"Power Spectrum" <- w31
        $"Power Level" <- w32
        Feedback Node(input=w34) -> w35
        case (w30) {
          frame True {
            $Numeric <- w35
          }
          frame False { }
        }
        $"I & Q Data" <- w33
        Feedback Node(initial value=0, input=w34) -> w36
        case (w30) {
          frame True {
            w37 = 0
          }
          frame False {
            w37 = w36
          }
        }
        Increment(x=w37) -> w34
      }
    }
    call "Initiate and Generate Time (Multi).gvi"(niUsrpRio Sessions=w21, first iteration=w26, start trigger time=w25, error in=w23, tx channels=w7) -> (niUsrpRio Sessions (out)=w38, error out=w39)
    Merge Errors(w28, w39) -> (error out=w40)
    Logical Or(w40, $stop) -> w41
    Not(x=w41) -> w42
    $Active <- w42
    next s1 = w40
    stop if w41
  }
  # 4.
  for {
    w43 = each element of w38
    call "Close Device.gvi"(niusrprio session in=w43, error in=s1) -> (error out=w45)
    append w45 to w44
  }
  Merge Errors(w44) -> (error out=w46)
  call "Display Error.gvi"(error in=w46, type of dialog="OK message + warnings")
  $"RX Coerced Configurations" <- w6
  $"TX Coerced Configurations" <- w5
  $"Output Waveform" <- w14
