vi "Streaming Xcvr Sync PPS (FPGA).gvi"   [LabVIEW NXG 4.0.0]
panel controls:
  "reg.host read.go rcvd 0": bool
  "reg.notify host.go rcvd 0": bool
  "reg.reset 0": bool
    # specifies whether the state machine that controls the processing of register instructions is reset to the state where it is ready for a new register instruction. The state machine stays in this state until this parameter is set to FALSE.
    # The reg.reset parameter must be wired to a control on the top-level FPGA VI, because the parameter must be accessible to the Register Bus Host library from the FPGA Interface Read/Write Control function. The control must have a pre-defined name based on the value passed to the bus instance parameter of the Open Session VI in the Register Bus Host library. The format of the name is 'reg.reset N', where N is the instance number of the Register Bus Host library and Register Bus FPGA library. For example, if the name is 'reg.reset 0', the instance number of this library is 0.
  "RF 0/Rx/Enable": bool
  "RF 0/Tx/Enable": bool
  "RF 1/Rx/Enable": bool
  "RF 1/Tx/Enable": bool
  "tx.trigger enable": bool
  "tx.trigger sync enable": bool
  "tx 0.stream enable": bool
  "tx 1.stream enable": bool
  "tx.software trigger": bool
  "tx.reset": bool
  "tx.abort": bool
  "tx.samples to generate": u32
  "tx 0.gain": "IQ Gain.gtype"
  "tx 0.frequency shift": FXP(0.48)
  "tx 0.phase": FXP(0.21)
  "tx 0.impairments": "IQ Impairments.gtype"
  "tx.input sample rate": UFXP(1.47)
  "tx.delay": FXP(0.18)
  "tx 1.gain": "IQ Gain.gtype"
  "tx 1.frequency shift": FXP(0.48)
  "tx 1.phase": FXP(0.21)
  "tx 1.impairments": "IQ Impairments.gtype"
  "rx.trigger enable": bool
  "rx.trigger sync enable": bool
  "rx 0.stream enable": bool
  "rx 1.stream enable": bool
  "rx.software trigger": bool
  "rx.reset": bool
  "rx.abort": bool
  "rx.samples to acquire": u32
  "rx 0.impairments": "IQ Impairments.gtype"
  "rx 0.frequency shift": FXP(0.48)
  "rx 0.phase": FXP(0.21)
  "rx.output sample rate": UFXP(1.47)
  "rx.delay": FXP(0.16)
  "rx 1.impairments": "IQ Impairments.gtype"
  "rx 1.frequency shift": FXP(0.48)
  "rx 1.phase": FXP(0.21)
  "tx.trigger select": "Start Trigger.gtype" = "Software"
  "rx.trigger select": "Start Trigger.gtype" = "Software"
panel indicators:
  "reg.notify host.go 0": bool
  "reg.host read.data 0": "Read Cmd Data.gtype"
  "tx.samples processed": u32
  "tx.number of fifo underflows": u32
  "tx 0.number of IQ data overflows": u64
  "tx 1.number of IQ data overflows": u64
  "tx.dsp reset done": bool
  "rx.samples processed": u32
  "rx.number of fifo overflows": u32
  "rx 0.number of IQ data overflows": u64
  "rx 1.number of IQ data overflows": u64
  "rx.dsp reset done": bool
  "tx.state": "Stream Control State.gtype"
  "rx.state": "Stream Control State.gtype"
types:
  "Read Cmd Data.gtype" = cluster{"go": bool, "data": u32}
  "IQ Gain.gtype" = cluster{"gain I": FXP(3.21), "gain Q": FXP(3.21)}
  "IQ Impairments.gtype" = cluster{"inline gain I": FXP(1.17), "inline gain Q": FXP(1.17), "cross gain I": FXP(1.17), "cross gain Q": FXP(1.17), "pre-gain offset I": FXP(1.17), "pre-gain offset Q": FXP(1.17), "post-gain offset I": FXP(1.17), "post-gain offset Q": FXP(1.17)}
  "Start Trigger.gtype" = enum{"Software", "Digital Edge", "Rx Start Trigger", "Tx Start Trigger", "Immediate", "Future Time Event"}
  "Stream Control State.gtype" = enum{"Idle", "Active"}
  T1 = cluster{"rx.state": "Stream Control State.gtype", "rx.samples processed": u32, "rx.number of fifo overflows": u32, "rx 0.number of IQ data overflows": u64, "rx 1.number of IQ data overflows": u64, "rx.dsp reset done": bool}
  "DDC Parameters.gtype" = cluster{"output sample rate": UFXP(1.47), "delay": FXP(0.16), "frequency shift": FXP(0.48), "impairments": "IQ Impairments.gtype", "phase": FXP(0.21)}
  T2 = cluster{"rx.trigger enable": bool, "rx.trigger sync enable": bool, "rx 0.stream enable": bool, "rx 1.stream enable": bool, "rx.software trigger": bool, "rx.reset": bool, "rx.abort": bool, "rx.samples to acquire": u32, "ddc parameters": "DDC Parameters.gtype"[2], "rx.trigger select": "Start Trigger.gtype"}
  T3 = cluster{"tx.state": "Stream Control State.gtype", "tx.samples processed": u32, "tx.number of fifo underflows": u32, "tx 0.number of IQ data overflows": u64, "tx 1.number of IQ data overflows": u64, "tx.dsp reset done": bool}
  "DUC Parameters.gtype" = cluster{"frequency shift": FXP(0.48), "impairments": "IQ Impairments.gtype", "phase": FXP(0.21), "input sample rate": UFXP(1.47), "gain": "IQ Gain.gtype", "delay": FXP(0.18)}
  T4 = cluster{"tx.trigger enable": bool, "tx.trigger sync enable": bool, "tx 0.stream enable": bool, "tx 1.stream enable": bool, "tx.software trigger": bool, "tx.reset": bool, "tx.abort": bool, "tx.samples to generate": u32, "duc parameters": "DUC Parameters.gtype"[2], "tx.trigger select": "Start Trigger.gtype"}
uses:
  FPGA SubVIs::Create Resources.gvi
  NI::SDR::RegisterBusV1FPGA::Process.gcdl
  FPGA SubVIs::Registers.gcdl
  FPGA SubVIs::LEDs.gvi
  NI::USRPRIO::ConfigV1FPGA::Process.gvi
  FPGA SubVIs::Start Triggers Sync PPS Trig.gcdl
  FPGA SubVIs::Rx.gcdl
  FPGA SubVIs::Tx.gcdl
diagram:
  call "Create Resources.gvi"() -> (config.resources=w1, sync.resources=w2, time.resources=w3)
  clock-driven loop (clock = "40 MHz Onboard Clock") forever {  # Register Bus and Required Controls/Indicators
    # REQUIRED
    Io Write(data=$"RF 0/Rx/Enable", reference in="RF 0/Rx/Enable")
    Io Write(data=$"RF 0/Tx/Enable", reference in="RF 0/Tx/Enable")
    Io Write(data=$"RF 1/Rx/Enable", reference in="RF 1/Rx/Enable")
    Io Write(data=$"RF 1/Tx/Enable", reference in="RF 1/Tx/Enable")
    w4 = "NI::SDR::RegisterBusV1FPGA::niInstr Register Bus v0.grsc::reg.host instruction fifo 0"
    Feedback Node(input=w5) -> w6
    Feedback Node(input=w7) -> w8
    call "Process.gcdl"(reg.notify host.go rcvd=$"reg.notify host.go rcvd 0", reg.host read.go rcvd=$"reg.host read.go rcvd 0", read completion=w6, reg.reset=$"reg.reset 0", reg.host instruction fifo=w4, ready for output=w8) -> (reg.notify host.go=w9, reg.host read.data=w10, register instruction=w11)
    $"reg.notify host.go 0" <- w9
    $"reg.host read.data 0" <- w10
    call "Registers.gcdl"(register instruction=w11, config.resources=w1, sync.resources=w2, time.resources=w3) -> (ready for input=w7, read completion out=w5)
  }
  call "LEDs.gvi"()
  call "Process.gvi"(resources=w1)
  Register Create(initial value=T1 {all zero or empty}) -> (reference out=w12)
  Register Create(initial value=T2 {all zero or empty}) -> (reference out=w13)
  Register Create(initial value=T3 {all zero or empty}) -> (reference out=w14)
  Register Create(initial value=T4 {all zero or empty}) -> (reference out=w15)
  clock-driven loop (clock = "Data Clock") forever {  # Streaming Transceiver Engine
    Register Read(reference in=w13) -> (data=w16)
    Register Read(reference in=w15) -> (data=w17)
    call "Start Triggers Sync PPS Trig.gcdl"(sync.resources=w2, rx.parameters=w16, tx.parameters=w17) -> (rx.start trigger=w18, tx.start trigger=w19)
    call "Rx.gcdl"(rx.parameters=w16, rx.start trigger=w18) -> (rx.status=w20)
    Register Write(data=w20, reference in=w12)
    call "Tx.gcdl"(tx.parameters=w17, tx.start trigger=w19) -> (tx.status=w21)
    Register Write(data=w21, reference in=w14)
  }
  clock-driven loop (clock = "40 MHz Onboard Clock") forever {
    Property Node(instance in="DUC Parameters.gtype" {all zero or empty}, "gain"=$"tx 0.gain", "frequency shift"=$"tx 0.frequency shift", "phase"=$"tx 0.phase", "impairments"=$"tx 0.impairments", "input sample rate"=$"tx.input sample rate", "delay"=$"tx.delay") -> (instance out=w22)
    Property Node(instance in="DUC Parameters.gtype" {all zero or empty}, "delay"=$"tx.delay", "input sample rate"=$"tx.input sample rate", "gain"=$"tx 1.gain", "frequency shift"=$"tx 1.frequency shift", "phase"=$"tx 1.phase", "impairments"=$"tx 1.impairments") -> (instance out=w23)
    Build Array(w22, w23) -> w24
    Property Node(instance in=T4 {all zero or empty}, "tx.trigger select"=$"tx.trigger select", "tx.trigger enable"=$"tx.trigger enable", "tx.trigger sync enable"=$"tx.trigger sync enable", "tx 0.stream enable"=$"tx 0.stream enable", "tx 1.stream enable"=$"tx 1.stream enable", "tx.software trigger"=$"tx.software trigger", "tx.reset"=$"tx.reset", "tx.abort"=$"tx.abort", "tx.samples to generate"=$"tx.samples to generate", "duc parameters"=w24) -> (instance out=w25)
    Register Write(data=w25, reference in=w15)
    Register Read(reference in=w14) -> (data=w26)
    Property Node(instance in=w26) -> ("tx.state"=w27, "tx.samples processed"=w28, "tx.number of fifo underflows"=w29, "tx 0.number of IQ data overflows"=w30, "tx 1.number of IQ data overflows"=w31, "tx.dsp reset done"=w32)
    $"tx.state" <- w27
    $"tx.samples processed" <- w28
    $"tx.number of fifo underflows" <- w29
    $"tx 0.number of IQ data overflows" <- w30
    $"tx 1.number of IQ data overflows" <- w31
    $"tx.dsp reset done" <- w32
    Property Node(instance in="DDC Parameters.gtype" {all zero or empty}, "impairments"=$"rx 0.impairments", "frequency shift"=$"rx 0.frequency shift", "phase"=$"rx 0.phase", "output sample rate"=$"rx.output sample rate", "delay"=$"rx.delay") -> (instance out=w33)
    Property Node(instance in="DDC Parameters.gtype" {all zero or empty}, "delay"=$"rx.delay", "output sample rate"=$"rx.output sample rate", "impairments"=$"rx 1.impairments", "frequency shift"=$"rx 1.frequency shift", "phase"=$"rx 1.phase") -> (instance out=w34)
    Build Array(w33, w34) -> w35
    Property Node(instance in=T2 {all zero or empty}, "rx.trigger select"=$"rx.trigger select", "rx.trigger enable"=$"rx.trigger enable", "rx.trigger sync enable"=$"rx.trigger sync enable", "rx 0.stream enable"=$"rx 0.stream enable", "rx 1.stream enable"=$"rx 1.stream enable", "rx.software trigger"=$"rx.software trigger", "rx.reset"=$"rx.reset", "rx.abort"=$"rx.abort", "rx.samples to acquire"=$"rx.samples to acquire", "ddc parameters"=w35) -> (instance out=w36)
    Register Write(data=w36, reference in=w13)
    Register Read(reference in=w12) -> (data=w37)
    Property Node(instance in=w37) -> ("rx.state"=w38, "rx.samples processed"=w39, "rx.number of fifo overflows"=w40, "rx 0.number of IQ data overflows"=w41, "rx 1.number of IQ data overflows"=w42, "rx.dsp reset done"=w43)
    $"rx.state" <- w38
    $"rx.samples processed" <- w39
    $"rx.number of fifo overflows" <- w40
    $"rx 0.number of IQ data overflows" <- w41
    $"rx 1.number of IQ data overflows" <- w42
    $"rx.dsp reset done" <- w43
  }
