vi "Function.gvi"   [LabVIEW NXG 4.0.0]
panel indicators:
  "Array_2": u32[]
uses:
  NI::Sync::Error Message.gvi
diagram:
  w1 = path "H:\\TUM-PC\\Dokumente\\Thesis\\MATLAB_Testing\\GenerateLTEFrame\\test.bin"
  Read From Binary File(prompt (open existing file)="open exiting file", byte order="little-endian", count=-1, file (use dialog)=w1) -> (error out=w2, data=w3)
  call "Error Message.gvi"(instrument handle="", error in=w2)
  $Array_2 <- w3
