vi "Calculate IQ Power Level.gvi"   [LabVIEW NXG 4.0.0]
# Calculates the power level, in dBm, from the I/Q data.
inputs:
  "iq data": c128[], required
outputs:
  "power level (dBm)": f64[]
diagram:
  Complex To Real And Imaginary(x + iy=$"iq data") -> (x=w1, y=w2)
  Square(x=w1) -> w3
  # Convert (Volts-peak)^2 to dBm
  #
  # dBm = 10 * log(1000 * Vrms sq / 50)
  #          = 10 * log(1000 * ((Vpeak sq)/2) / 50)
  #          = 10 * log(1000 * (Vpeak sq) / 100)
  #          = 10 * log(10 * Vpeak sq)
  Square(x=w2) -> w4
  Add(w3, w4) -> w5
  Multiply(w5, 10) -> w6
  Logarithm Base 10(x=w6) -> w7
  Multiply(w7, 10) -> w8
  $"power level (dBm)" <- w8
