vi "Configure Synchronization.gvi"   [LabVIEW NXG 4.0.0]
# Configures and synchronizes NI USRP-294x/295x devices.
inputs:
  "niusrprio sessions in": "niUsrpRio Session.gtype"[], required
  "error in": error
  "scope": string = "rx", required
outputs:
  "niusrprio sessions out": "niUsrpRio Session.gtype"[]
  "error out": error
types:
  "Register Bus Session.gtype" = Queue<"Session Data.gtype">
  "Semaphore.gtype" = i32
  "DB Queue Reference.gtype" = Queue<"Daughterboard Data.gtype">
  "EEPROM Header.gtype" = cluster{"Checksum": u32, "Product Code": u16, "Hardware Current Version": u16, "Hardware Oldest Compatible Version": u16, "EEPROM Map Current Version": u16, "EEPROM Map Oldest Compatible Version": u16, "User Password": string, "Pointer to Factory Header": u32, "Pointer to User Header": u32, "Recommended Interval": u16, "Number of Reserved Bytes": i32, "Number of Daughterboards": u8, "Daughterboard IDs": u16[], "Daughterboard Serial Numbers": string[]}
  "EEPROM Device Data Header.gtype" = cluster{"Checksum": u32, "Number of Channels": u8, "Number of Gain Settings": u16[], "Pointer to Characterization Data": u32[], "Number of Reserved Bytes": i32, "Number of Frequencies": u16[]}
  "EEPROM Characterization Header.gtype" = cluster{"Checksum": u32, "Date": timestamp, "Temperature": f32, "Misc. Info": string, "Pointer to Device Data Header": u32, "Number of Reserved Bytes": i32}
  "Characterization Data.gtype" = cluster{"Gains[dB]": f64[], "Frequencies [Hz]": f64[], "IQ Imbalance Table": "IQ Imbalance.gtype"[], "Measured Gains[dB]": f64[][]}
  "niUsrpRio Session.gtype" = cluster{"FPGA Interface": any, "RIO Interface Number": u32, "Data Clock Rate": u32, "FPGA Data Clock Rate": u32, "Global Settings Register Bus": "Register Bus Session.gtype", "Radio 0 Settings Register Bus": "Register Bus Session.gtype", "Radio 1 Settings Register Bus": "Register Bus Session.gtype", "Radio Settings Bus Semaphore": "Semaphore.gtype", "DB Queues": "DB Queue Reference.gtype"[], "Characterization Data Valid?": bool, "EEPROM Header": "EEPROM Header.gtype", "Device Data Header": "EEPROM Device Data Header.gtype", "EEPROM Characterization Header": "EEPROM Characterization Header.gtype", "Characterization Data": "Characterization Data.gtype"[], "FPGA Current Version": u32, "FPGA Oldest Compatible Version": u32, "Fixed Logic Current Version": u32, "Fixed Logic Oldest Compatible Version": u32, "FPGA Radio Settings Bus Current Version": u32, "FPGA Radio Settings Bus Oldest Compatible Version": u32, "FPGA Board Config Current Version": u32, "FPGA Board Config Oldest Compatible Version": u32, "Daughterboard Clock Rate": u32}
uses:
  Host SubVIs::Configure Trigger Synchronization.gvi
  NI::USRPRIO::SyncV1Host::Host Driven Synchronization.gvi
diagram:
  $"niusrprio sessions out" <- $"niusrprio sessions in"
  Array Size(array=$"niusrprio sessions in") -> (size(s)=w1)
  # Only perform multi-device synchronization if there are multiple devices.
  case (w1) {
    frame ..1 {
      w2 = $"error in"
    }
    frame Default {
      s1 = $"error in"  # shift register
      for {
        w3 = each element of $"niusrprio sessions in"
        call "Configure Trigger Synchronization.gvi"(niusrprio session in=w3, enable trigger synchronization=FALSE, error in=s1, scope=$scope) -> (niusrprio session out=w5, error out=w6)
        append w5 to w4
        next s1 = w6
      }
      disable {
        frame Enabled {
          w7 = w4
          w8 = s1
        }
        frame Disabled {
          call "Host Driven Synchronization.gvi"(niusrprio sessions in=w4, error in=s1) -> (niusrprio sessions out=w7, error out=w8)
        }
      }
      s2 = w8  # shift register
      for {
        w9 = each element of w7
        call "Configure Trigger Synchronization.gvi"(niusrprio session in=w9, enable trigger synchronization=TRUE, error in=s2, scope=$scope) -> (error out=w10)
        next s2 = w10
      }
      w2 = s2
    }
  }
  $"error out" <- w2
