vi "Configure Tx.gvi"   [LabVIEW NXG 4.0.0]
inputs:
  "niUsrpRio Session": "niUsrpRio Session.gtype", required
  "tx config": T2 = {"rf enable 0"=FALSE, "rf config 0"={"antenna"="TX1", "frequency"=2000000000, "lo frequency"=-1, "level"=0}, "rf enable 1"=FALSE, "rf config 1"={"antenna"="TX1", "frequency"=2000000000, "lo frequency"=-1, "level"=0}, "transfer mode"="Finite", "sample rate"=10000000, "number of samples"=8192, "start trigger"="Immediate", "tone frequency"=100000}, required
  "error in": error
outputs:
  "niUsrpRio Session (out)": "niUsrpRio Session.gtype"
  "tx.enabled channels": string[]
  "I": i16[][]
  "Q": i16[][]
  "error out": error
  "tx.output waveform": waveform<f64>[]
  "tx.coerced configurations": T3
types:
  "Register Bus Session.gtype" = Queue<"Session Data.gtype">
  "Semaphore.gtype" = i32
  "DB Queue Reference.gtype" = Queue<"Daughterboard Data.gtype">
  "EEPROM Header.gtype" = cluster{"Checksum": u32, "Product Code": u16, "Hardware Current Version": u16, "Hardware Oldest Compatible Version": u16, "EEPROM Map Current Version": u16, "EEPROM Map Oldest Compatible Version": u16, "User Password": string, "Pointer to Factory Header": u32, "Pointer to User Header": u32, "Recommended Interval": u16, "Number of Reserved Bytes": i32, "Number of Daughterboards": u8, "Daughterboard IDs": u16[], "Daughterboard Serial Numbers": string[]}
  "EEPROM Device Data Header.gtype" = cluster{"Checksum": u32, "Number of Channels": u8, "Number of Gain Settings": u16[], "Pointer to Characterization Data": u32[], "Number of Reserved Bytes": i32, "Number of Frequencies": u16[]}
  "EEPROM Characterization Header.gtype" = cluster{"Checksum": u32, "Date": timestamp, "Temperature": f32, "Misc. Info": string, "Pointer to Device Data Header": u32, "Number of Reserved Bytes": i32}
  "Characterization Data.gtype" = cluster{"Gains[dB]": f64[], "Frequencies [Hz]": f64[], "IQ Imbalance Table": "IQ Imbalance.gtype"[], "Measured Gains[dB]": f64[][]}
  "niUsrpRio Session.gtype" = cluster{"FPGA Interface": any, "RIO Interface Number": u32, "Data Clock Rate": u32, "FPGA Data Clock Rate": u32, "Global Settings Register Bus": "Register Bus Session.gtype", "Radio 0 Settings Register Bus": "Register Bus Session.gtype", "Radio 1 Settings Register Bus": "Register Bus Session.gtype", "Radio Settings Bus Semaphore": "Semaphore.gtype", "DB Queues": "DB Queue Reference.gtype"[], "Characterization Data Valid?": bool, "EEPROM Header": "EEPROM Header.gtype", "Device Data Header": "EEPROM Device Data Header.gtype", "EEPROM Characterization Header": "EEPROM Characterization Header.gtype", "Characterization Data": "Characterization Data.gtype"[], "FPGA Current Version": u32, "FPGA Oldest Compatible Version": u32, "Fixed Logic Current Version": u32, "Fixed Logic Oldest Compatible Version": u32, "FPGA Radio Settings Bus Current Version": u32, "FPGA Radio Settings Bus Oldest Compatible Version": u32, "FPGA Board Config Current Version": u32, "FPGA Board Config Oldest Compatible Version": u32, "Daughterboard Clock Rate": u32}
  T1 = cluster{"antenna": string, "frequency": f64, "lo frequency": f64, "level": f64}
  "Start Trigger.gtype" = enum{"Software", "Digital Edge", "Rx Start Trigger", "Tx Start Trigger", "Immediate", "Future Time Event"}
  T2 = cluster{"rf enable 0": bool, "rf config 0": T1, "rf enable 1": bool, "rf config 1": T1, "transfer mode": enum{"Finite", "Continuous"}, "sample rate": f64, "number of samples": u32, "start trigger": "Start Trigger.gtype", "tone frequency": f64}
  T3 = cluster{"coerced frequencies": f64[], "coerced lo frequencies": f64[], "coerced levels": f64[], "coerced sample rates": f64[]}
uses:
  Host SubVIs::Construct Channels.gvi
  Host SubVIs::Configure Signal (Level).gvi
  Host SubVIs::Configure Start Trigger.gvi
  Host SubVIs::Configure Stream.gvi
  Host SubVIs::Generate Waveform (Multi-Array).gvi
diagram:
  Property Node(instance in=$"tx config") -> ("rf enable 0"=w1, "rf config 0"=w2, "rf enable 1"=w3, "rf config 1"=w4, "transfer mode"=w5, "sample rate"=w6, "number of samples"=w7, "start trigger"=w8, "tone frequency"=w9)
  w10 = cluster{"rf enable 0": bool, "rf config 0": T1} {all zero or empty}
  Property Node(instance in=w10, "rf enable 0"=w1, "rf config 0"=w2) -> (instance out=w11)
  w12 = cluster{"rf enable 1": bool, "rf config 1": T1} {all zero or empty}
  Property Node(instance in=w12, "rf enable 1"=w3, "rf config 1"=w4) -> (instance out=w13)
  Build Array(w11, w13) -> w14
  call "Construct Channels.gvi"(channel configurations=w14, scope="tx") -> (enabled channels=w15, enabled channel configurations=w16)
  Array Size(array=w15) -> (size(s)=w17)
  case (w17) {
    frame 0 {
      w18 = default
      w19 = default
      w20 = default
      w21 = default
      w22 = default
      w23 = $"niUsrpRio Session"
      w24 = $"error in"
      w25 = default
      w26 = default
      w27 = default
    }
    frame Default {
      s1 = $"error in"  # shift register
      for {
        w28 = each element of w16
        w29 = each element of w15
        Property Node(instance in=w28) -> ("frequency"=w30, "level"=w31, "antenna"=w32, "lo frequency"=w33)
        call "Configure Signal (Level).gvi"(active antenna=w32, lo frequency [hz]=w33, niusrprio session in=$"niUsrpRio Session", sample rate [s/s]=w6, frequency [hz]=w30, level [dbm]=w31, error in=s1, scope=w29) -> (coerced lo frequency [hz]=w34, niusrprio session out=w35, coerced sample rate [s/s]=w36, coerced frequency [hz]=w37, coerced level [dbm]=w38, error out=w39)
        # w8: >> start trigger >>
        # w5: >> number of samples is finite >>
        # w7: >> number of samples >>
        call "Configure Start Trigger.gvi"(niusrprio session in=w35, start trigger=w8, error in=w39, scope=w29) -> (niusrprio session out=w40, error out=w41)
        Is Equal To 0(x=w5) -> w42
        # w42: >> number of samples is finite >>
        call "Configure Stream.gvi"(niusrprio session in=w40, number of samples is finite=w42, number of samples=w7, error in=w41, scope=w29) -> (niusrprio session out=w23, error out=w43)
        append w34 to w21
        append w38 to w20
        append w37 to w19
        append w36 to w18
        append w29 to w22
        next s1 = w43
      }
      Array Index(array=w18) -> (out0[_]=w44)
      call "Generate Waveform (Multi-Array).gvi"(number of samples=w7, sample rate=w44, tone frequency=w9, amplitude=0.5) -> (i=w25, q=w26, waveform=w27, error out=w45)
      Merge Errors(s1, w45) -> (error out=w24)
    }
  }
  $"tx.enabled channels" <- w22
  $"niUsrpRio Session (out)" <- w23
  $"error out" <- w24
  $I <- w25
  $Q <- w26
  $"tx.output waveform" <- w27
  Property Node(instance in=T3 {all zero or empty}, "coerced sample rates"=w18, "coerced frequencies"=w19, "coerced levels"=w20, "coerced lo frequencies"=w21) -> (instance out=w46)
  $"tx.coerced configurations" <- w46
