vi "Generate Waveform (Multi-Array).gvi"   [LabVIEW NXG 4.0.0]
inputs:
  "number of samples": u32 = 300000
  "sample rate": f64 = 10000000
  "tone frequency": f64 = 130000
  "amplitude": f64 = 1
outputs:
  "i": i16[][]
  "q": i16[][]
  "waveform": waveform<f64>[]
  "error out": error
uses:
  NI::Analysis::Generation::Sine Waveform.gvi
diagram:
  call "Sine Waveform.gvi"(sample rate=$"sample rate", samples=$"number of samples", amplitude=$amplitude, frequency=$"tone frequency", phase in=90) -> (sine wave=w1, error out=w2)
  call "Sine Waveform.gvi"(sample rate=$"sample rate", samples=$"number of samples", amplitude=$amplitude, frequency=$"tone frequency", phase in=0) -> (sine wave=w3, error out=w4)
  Build Array(w1, w3) -> w5
  $waveform <- w5
  Property Node(instance in=w1) -> ("Y"=w6)
  Multiply(w6, 32767) -> w7
  To Signed 16 Bit Integer(number=w7) -> w8
  Divide(x=w8, y=[2]) -> w9
  To Signed 16 Bit Integer(number=w9) -> w10
  Build Array(w8, w10) -> w11
  $i <- w11
  Property Node(instance in=w3) -> ("Y"=w12)
  Multiply(w12, 32767) -> w13
  To Signed 16 Bit Integer(number=w13) -> w14
  Divide(x=w14, y=[2]) -> w15
  To Signed 16 Bit Integer(number=w15) -> w16
  Build Array(w14, w16) -> w17
  $q <- w17
  Merge Errors(w2, w4) -> (error out=w18)
  $"error out" <- w18
