vi "Initiate and Generate Time (Multi).gvi"   [LabVIEW NXG 4.0.0]
# Writes baseband waveform to the device then initiates generation.
# VIs that must execute before this VI:
# Open and Configure
# Configure Time
# Input Parameters
# niUsrpRio Session is the object created by the Open VI and used as the session handle for the USRP RIO design library.
# first iteration is used to determine if the device needs to be triggered. If this VI is in a loop, wire the iteration count to Equals Zero and then to this terminal. If this VI is not in a loop, wire a TRUE constant to this this terminal.
# start trigger time specifies the absolute time to initiate the start trigger. Only applies when the start trigger is set to Future Event.
# error in describes error conditions that occur before this node runs. This input provides standard 'error in' functionality.
# Output Parameters
# niUsrpRio Session (out) is the niUsrpRio session used in all subsequent USRP RIO design library host VIs.
# error out contains error information. This output provides standard 'error out' functionality.
inputs:
  "niUsrpRio Sessions": "niUsrpRio Session.gtype"[], required
  "first iteration": bool, required  # is used to determine if the device needs to be triggered. If this VI is in a loop, wire the iteration count to Equals Zero and then to this terminal. If this VI is not in a loop, wire a TRUE constant to this this terminal.
  "start trigger time": timestamp, required  # specifies the absolute time to initiate the start trigger. Only applies when the start trigger is set to Future Event.
  "error in": error
  "tx channels": T4[], required
outputs:
  "niUsrpRio Sessions (out)": "niUsrpRio Session.gtype"[]
  "error out": error
types:
  "Register Bus Session.gtype" = Queue<"Session Data.gtype">
  "Semaphore.gtype" = i32
  "DB Queue Reference.gtype" = Queue<"Daughterboard Data.gtype">
  "EEPROM Header.gtype" = cluster{"Checksum": u32, "Product Code": u16, "Hardware Current Version": u16, "Hardware Oldest Compatible Version": u16, "EEPROM Map Current Version": u16, "EEPROM Map Oldest Compatible Version": u16, "User Password": string, "Pointer to Factory Header": u32, "Pointer to User Header": u32, "Recommended Interval": u16, "Number of Reserved Bytes": i32, "Number of Daughterboards": u8, "Daughterboard IDs": u16[], "Daughterboard Serial Numbers": string[]}
  "EEPROM Device Data Header.gtype" = cluster{"Checksum": u32, "Number of Channels": u8, "Number of Gain Settings": u16[], "Pointer to Characterization Data": u32[], "Number of Reserved Bytes": i32, "Number of Frequencies": u16[]}
  "EEPROM Characterization Header.gtype" = cluster{"Checksum": u32, "Date": timestamp, "Temperature": f32, "Misc. Info": string, "Pointer to Device Data Header": u32, "Number of Reserved Bytes": i32}
  "Characterization Data.gtype" = cluster{"Gains[dB]": f64[], "Frequencies [Hz]": f64[], "IQ Imbalance Table": "IQ Imbalance.gtype"[], "Measured Gains[dB]": f64[][]}
  "niUsrpRio Session.gtype" = cluster{"FPGA Interface": any, "RIO Interface Number": u32, "Data Clock Rate": u32, "FPGA Data Clock Rate": u32, "Global Settings Register Bus": "Register Bus Session.gtype", "Radio 0 Settings Register Bus": "Register Bus Session.gtype", "Radio 1 Settings Register Bus": "Register Bus Session.gtype", "Radio Settings Bus Semaphore": "Semaphore.gtype", "DB Queues": "DB Queue Reference.gtype"[], "Characterization Data Valid?": bool, "EEPROM Header": "EEPROM Header.gtype", "Device Data Header": "EEPROM Device Data Header.gtype", "EEPROM Characterization Header": "EEPROM Characterization Header.gtype", "Characterization Data": "Characterization Data.gtype"[], "FPGA Current Version": u32, "FPGA Oldest Compatible Version": u32, "Fixed Logic Current Version": u32, "Fixed Logic Oldest Compatible Version": u32, "FPGA Radio Settings Bus Current Version": u32, "FPGA Radio Settings Bus Oldest Compatible Version": u32, "FPGA Board Config Current Version": u32, "FPGA Board Config Oldest Compatible Version": u32, "Daughterboard Clock Rate": u32}
  T1 = cluster{"antenna": string, "frequency": f64, "lo frequency": f64, "level": f64}
  "Start Trigger.gtype" = enum{"Software", "Digital Edge", "Rx Start Trigger", "Tx Start Trigger", "Immediate", "Future Time Event"}
  T2 = cluster{"rf enable 0": bool, "rf config 0": T1, "rf enable 1": bool, "rf config 1": T1, "transfer mode": enum{"Finite", "Continuous"}, "sample rate": f64, "number of samples": u32, "start trigger": "Start Trigger.gtype", "tone frequency": f64}
  T3 = cluster{"coerced frequencies": f64[], "coerced lo frequencies": f64[], "coerced levels": f64[], "coerced sample rates": f64[]}
  T4 = cluster{"tx config": T2, "reference frequency source": string, "tx.enabled channels": string[], "I": i16[][], "Q": i16[][], "tx.coerced configurations": T3}
uses:
  Host SubVIs::Check Stream Status.gvi
  Host SubVIs::Write Tx Data (I16 multi).gvi
  Host SubVIs::Initiate and Trigger.gvi
diagram:
  $"niUsrpRio Sessions (out)" <- $"niUsrpRio Sessions"
  Array Index(array=$"tx channels") -> (out0[_]=w1)
  Property Node(instance in=w1) -> ("tx.enabled channels"=w2, "tx config:start trigger"=w3, "tx config:transfer mode"=w4, "reference frequency source"=w5)
  Array Size(array=w2) -> (size(s)=w6)
  # #NOTE: To ameliorate Tx underflows during continuous generation, Check Stream Status does not need to run every loop iteration.
  case (w6) {
    frame 0 {
      # do nothing if there are zero enabled channels
      w7 = $"error in"
    }
    frame Default {
      case (w4) {
        frame "Finite" {
          s1 = $"error in"  # shift register
          while {
            # If there is a previous generation, wait for it to complete.
            s2 = s1  # shift register
            for {
              w8 = each element of $"niUsrpRio Sessions"
              call "Check Stream Status.gvi"(reference frequency source=w5, niusrprio session in=w8, error in=s2, scope="tx") -> (niusrprio session out=w11, done=w12, error out=w13)
              append w12 to w9
              append w11 to w10
              next s2 = w13
            }
            And Array Elements(Boolean array=w9) -> (logical AND=w14)
            Logical Or(s2, w14, $"first iteration") -> w15
            next s1 = s2
            stop if w15
          }
          case (w15) {
            frame False, Default {
              # Do nothing until the previous finite generation finishes before reinitiating.
              w7 = s1
            }
            frame True {
              s3 = s1  # shift register
              for {
                w16 = each element of w10
                w17 = each element of $"tx channels"
                Property Node(instance in=w17) -> ("tx.enabled channels"=w19, "I"=w20, "Q"=w21)
                s4 = s3  # shift register
                for {
                  w22 = each element of w19
                  call "Write Tx Data (I16 multi).gvi"(niusrprio session=w16, i=w20, q=w21, error in=s4, scope=w22) -> (niusrprio session 2=w23, error out=w24)
                  next s4 = w24
                }
                append w23 to w18
                next s3 = s4
              }
              call "Initiate and Trigger.gvi"(niUsrpRio Sessions=w18, start trigger=w3, start trigger time=$"start trigger time", error in=s3, scope="tx") -> (error out=w7)
            }
          }
        }
        frame "Continuous" {
          s5 = $"error in"  # shift register
          for {
            w25 = each element of $"niUsrpRio Sessions"
            call "Check Stream Status.gvi"(reference frequency source=w5, niusrprio session in=w25, error in=s5, scope="tx") -> (niusrprio session out=w27, error out=w28)
            append w27 to w26
            next s5 = w28
          }
          s6 = s5  # shift register
          for {
            w29 = each element of w26
            w30 = each element of $"tx channels"
            Property Node(instance in=w30) -> ("tx.enabled channels"=w32, "I"=w33, "Q"=w34)
            s7 = s6  # shift register
            for {
              w35 = each element of w32
              call "Write Tx Data (I16 multi).gvi"(niusrprio session=w29, i=w33, q=w34, error in=s7, scope=w35) -> (niusrprio session 2=w36, error out=w37)
              next s7 = w37
            }
            append w36 to w31
            next s6 = s7
          }
          case ($"first iteration") {
            frame False, Default {
              # Only initiate on first iteration.
              w7 = s6
            }
            frame True {
              call "Initiate and Trigger.gvi"(niUsrpRio Sessions=w31, start trigger=w3, start trigger time=$"start trigger time", error in=s6, scope="tx") -> (error out=w7)
            }
          }
        }
      }
    }
  }
  $"error out" <- w7
