vi "Initiate and Generate Time (Single).gvi"   [LabVIEW NXG 4.0.0]
# Writes baseband waveform to the device then initiates generation.
# VIs that must execute before this VI:
# Open and Configure
# Configure Time
# Input Parameters
# niUsrpRio Session is the object created by the Open VI and used as the session handle for the USRP RIO design library.
# first iteration is used to determine if the device needs to be triggered. If this VI is in a loop, wire the iteration count to Equals Zero and then to this terminal. If this VI is not in a loop, wire a TRUE constant to this this terminal.
# start trigger time specifies the absolute time to initiate the start trigger. Only applies when the start trigger is set to Future Event.
# error in describes error conditions that occur before this node runs. This input provides standard 'error in' functionality.
# Output Parameters
# niUsrpRio Session (out) is the niUsrpRio session used in all subsequent USRP RIO design library host VIs.
# error out contains error information. This output provides standard 'error out' functionality.
inputs:
  "niUsrpRio Session": "niUsrpRio Session.gtype", required  # is the object created by the Open VI and used as the session handle for the USRP RIO design library.
  "first iteration": bool, required  # is used to determine if the device needs to be triggered. If this VI is in a loop, wire the iteration count to Equals Zero and then to this terminal. If this VI is not in a loop, wire a TRUE constant to this this terminal.
  "start trigger time": timestamp, required  # specifies the absolute time to initiate the start trigger. Only applies when the start trigger is set to Future Event.
  "error in": error
  "tx channels": T4 = {"tx config"={"rf enable 0"=FALSE, "rf config 0"={"antenna"="TX1", "frequency"=2000000000, "lo frequency"=-1, "level"=0}, "rf enable 1"=FALSE, "rf config 1"={"antenna"="TX1", "frequency"=2000000000, "lo frequency"=-1, "level"=0}, "transfer mode"="Finite", "sample rate"=10000000, "number of samples"=8192, "start trigger"="Immediate", "tone frequency"=100000}, "reference frequency source"="Internal", "tx.enabled channels"=[], "I"=[], "Q"=[], "tx.coerced configurations"={"coerced frequencies"=[], "coerced lo frequencies"=[], "coerced levels"=[], "coerced sample rates"=[]}}, required
outputs:
  "niUsrpRio Session (out)": "niUsrpRio Session.gtype"  # is the niUsrpRio session used in all subsequent USRP RIO design library host VIs.
  "error out": error
types:
  "Register Bus Session.gtype" = Queue<"Session Data.gtype">
  "Semaphore.gtype" = i32
  "DB Queue Reference.gtype" = Queue<"Daughterboard Data.gtype">
  "EEPROM Header.gtype" = cluster{"Checksum": u32, "Product Code": u16, "Hardware Current Version": u16, "Hardware Oldest Compatible Version": u16, "EEPROM Map Current Version": u16, "EEPROM Map Oldest Compatible Version": u16, "User Password": string, "Pointer to Factory Header": u32, "Pointer to User Header": u32, "Recommended Interval": u16, "Number of Reserved Bytes": i32, "Number of Daughterboards": u8, "Daughterboard IDs": u16[], "Daughterboard Serial Numbers": string[]}
  "EEPROM Device Data Header.gtype" = cluster{"Checksum": u32, "Number of Channels": u8, "Number of Gain Settings": u16[], "Pointer to Characterization Data": u32[], "Number of Reserved Bytes": i32, "Number of Frequencies": u16[]}
  "EEPROM Characterization Header.gtype" = cluster{"Checksum": u32, "Date": timestamp, "Temperature": f32, "Misc. Info": string, "Pointer to Device Data Header": u32, "Number of Reserved Bytes": i32}
  "Characterization Data.gtype" = cluster{"Gains[dB]": f64[], "Frequencies [Hz]": f64[], "IQ Imbalance Table": "IQ Imbalance.gtype"[], "Measured Gains[dB]": f64[][]}
  "niUsrpRio Session.gtype" = cluster{"FPGA Interface": any, "RIO Interface Number": u32, "Data Clock Rate": u32, "FPGA Data Clock Rate": u32, "Global Settings Register Bus": "Register Bus Session.gtype", "Radio 0 Settings Register Bus": "Register Bus Session.gtype", "Radio 1 Settings Register Bus": "Register Bus Session.gtype", "Radio Settings Bus Semaphore": "Semaphore.gtype", "DB Queues": "DB Queue Reference.gtype"[], "Characterization Data Valid?": bool, "EEPROM Header": "EEPROM Header.gtype", "Device Data Header": "EEPROM Device Data Header.gtype", "EEPROM Characterization Header": "EEPROM Characterization Header.gtype", "Characterization Data": "Characterization Data.gtype"[], "FPGA Current Version": u32, "FPGA Oldest Compatible Version": u32, "Fixed Logic Current Version": u32, "Fixed Logic Oldest Compatible Version": u32, "FPGA Radio Settings Bus Current Version": u32, "FPGA Radio Settings Bus Oldest Compatible Version": u32, "FPGA Board Config Current Version": u32, "FPGA Board Config Oldest Compatible Version": u32, "Daughterboard Clock Rate": u32}
  T1 = cluster{"antenna": string, "frequency": f64, "lo frequency": f64, "level": f64}
  "Start Trigger.gtype" = enum{"Software", "Digital Edge", "Rx Start Trigger", "Tx Start Trigger", "Immediate", "Future Time Event"}
  T2 = cluster{"rf enable 0": bool, "rf config 0": T1, "rf enable 1": bool, "rf config 1": T1, "transfer mode": enum{"Finite", "Continuous"}, "sample rate": f64, "number of samples": u32, "start trigger": "Start Trigger.gtype", "tone frequency": f64}
  T3 = cluster{"coerced frequencies": f64[], "coerced lo frequencies": f64[], "coerced levels": f64[], "coerced sample rates": f64[]}
  T4 = cluster{"tx config": T2, "reference frequency source": string, "tx.enabled channels": string[], "I": i16[], "Q": i16[], "tx.coerced configurations": T3}
uses:
  Host SubVIs::Initiate and Generate Time (Multi).gvi
diagram:
  $"niUsrpRio Session (out)" <- $"niUsrpRio Session"
  Build Array($"tx channels") -> w1
  Build Array($"niUsrpRio Session") -> w2
  call "Initiate and Generate Time (Multi).gvi"(niUsrpRio Sessions=w2, first iteration=$"first iteration", start trigger time=$"start trigger time", error in=$"error in", tx channels=w1) -> (error out=w3)
  $"error out" <- w3
