vi "Open Device.gvi"   [LabVIEW NXG 4.0.0]
inputs:
  "usrp rio device": string = "RIO0"
  "reference frequency source": string = "Internal"
  "which bitfile": string = "Time"
  "error in": error
outputs:
  "niusrprio session out": "niUsrpRio Session.gtype"
  "error out": error
types:
  "Register Bus Session.gtype" = Queue<"Session Data.gtype">
  "Semaphore.gtype" = i32
  "DB Queue Reference.gtype" = Queue<"Daughterboard Data.gtype">
  "EEPROM Header.gtype" = cluster{"Checksum": u32, "Product Code": u16, "Hardware Current Version": u16, "Hardware Oldest Compatible Version": u16, "EEPROM Map Current Version": u16, "EEPROM Map Oldest Compatible Version": u16, "User Password": string, "Pointer to Factory Header": u32, "Pointer to User Header": u32, "Recommended Interval": u16, "Number of Reserved Bytes": i32, "Number of Daughterboards": u8, "Daughterboard IDs": u16[], "Daughterboard Serial Numbers": string[]}
  "EEPROM Device Data Header.gtype" = cluster{"Checksum": u32, "Number of Channels": u8, "Number of Gain Settings": u16[], "Pointer to Characterization Data": u32[], "Number of Reserved Bytes": i32, "Number of Frequencies": u16[]}
  "EEPROM Characterization Header.gtype" = cluster{"Checksum": u32, "Date": timestamp, "Temperature": f32, "Misc. Info": string, "Pointer to Device Data Header": u32, "Number of Reserved Bytes": i32}
  "Characterization Data.gtype" = cluster{"Gains[dB]": f64[], "Frequencies [Hz]": f64[], "IQ Imbalance Table": "IQ Imbalance.gtype"[], "Measured Gains[dB]": f64[][]}
  "niUsrpRio Session.gtype" = cluster{"FPGA Interface": any, "RIO Interface Number": u32, "Data Clock Rate": u32, "FPGA Data Clock Rate": u32, "Global Settings Register Bus": "Register Bus Session.gtype", "Radio 0 Settings Register Bus": "Register Bus Session.gtype", "Radio 1 Settings Register Bus": "Register Bus Session.gtype", "Radio Settings Bus Semaphore": "Semaphore.gtype", "DB Queues": "DB Queue Reference.gtype"[], "Characterization Data Valid?": bool, "EEPROM Header": "EEPROM Header.gtype", "Device Data Header": "EEPROM Device Data Header.gtype", "EEPROM Characterization Header": "EEPROM Characterization Header.gtype", "Characterization Data": "Characterization Data.gtype"[], "FPGA Current Version": u32, "FPGA Oldest Compatible Version": u32, "Fixed Logic Current Version": u32, "Fixed Logic Oldest Compatible Version": u32, "FPGA Radio Settings Bus Current Version": u32, "FPGA Radio Settings Bus Oldest Compatible Version": u32, "FPGA Board Config Current Version": u32, "FPGA Board Config Oldest Compatible Version": u32, "Daughterboard Clock Rate": u32}
uses:
  NI::USRPRIO::ConfigV1Host::Open 2.gvi
  NI::USRPRIO::ConfigV1Host::Enable Front End.gvi
diagram:
  case ($"which bitfile") {
    frame "SyncAux" {
      FPGA Open Node(RIO address=$"usrp rio device", error in=$"error in", run?=TRUE) -> (error out=w1, reference out=w2)
    }
    frame "SyncPps" {
      FPGA Open Node(RIO address=$"usrp rio device", error in=$"error in", run?=TRUE) -> (error out=w1, reference out=w2)
    }
    frame "Time", Default {
      FPGA Open Node(RIO address=$"usrp rio device", error in=$"error in", run?=TRUE) -> (error out=w1, reference out=w2)
    }
  }
  call "Open 2.gvi"(fpga ref=w2, reference frequency source=$"reference frequency source", error in=w1) -> (niusrprio session out=w3, error out=w4)
  call "Enable Front End.gvi"(niusrprio session in=w3, enable=FALSE, error in=w4, scope="rx") -> (niusrprio session out=w5, error out=w6)
  call "Enable Front End.gvi"(niusrprio session in=w5, enable=FALSE, error in=w6, scope="tx") -> (niusrprio session out=w7, error out=w8)
  $"niusrprio session out" <- w7
  $"error out" <- w8
