vi "Write Tx Data (U32).gvi"   [LabVIEW NXG 4.0.0]
# Writes Tx data to the device.
# Call Configure Stream and Initiate Stream before calling this VI.
# Input Parameters
# scope is the channel to write data to. The options are "rx/RF 0", "rx/RF 1", "tx/RF 0", and "tx/RF 1".
# niUsrpRio Session is the object created by the Open VI and used as the session handle for the USRP RIO design library.
# data is the Tx data to write to the device.
# timeout is how long, in seconds, to keep retrying before giving up.
# error in describes error conditions that occur before this node runs. This input provides standard 'error in' functionality.
# Output Parameters
# niUsrpRio Session (out) is the niUsrpRio session used in all subsequent USRP RIO design library host VIs.
# error out contains error information. This output provides standard 'error out' functionality.
inputs:
  "niusrprio session": "niUsrpRio Session.gtype"
  "data": u32[][]
  "timeout": f64 = 10
  "error in": error
  "scope": string
outputs:
  "niusrprio session 2": "niUsrpRio Session.gtype"
  "error out": error
panel controls:
  "constantdata": any
types:
  "Register Bus Session.gtype" = Queue<"Session Data.gtype">
  "Semaphore.gtype" = i32
  "DB Queue Reference.gtype" = Queue<"Daughterboard Data.gtype">
  "EEPROM Header.gtype" = cluster{"Checksum": u32, "Product Code": u16, "Hardware Current Version": u16, "Hardware Oldest Compatible Version": u16, "EEPROM Map Current Version": u16, "EEPROM Map Oldest Compatible Version": u16, "User Password": string, "Pointer to Factory Header": u32, "Pointer to User Header": u32, "Recommended Interval": u16, "Number of Reserved Bytes": i32, "Number of Daughterboards": u8, "Daughterboard IDs": u16[], "Daughterboard Serial Numbers": string[]}
  "EEPROM Device Data Header.gtype" = cluster{"Checksum": u32, "Number of Channels": u8, "Number of Gain Settings": u16[], "Pointer to Characterization Data": u32[], "Number of Reserved Bytes": i32, "Number of Frequencies": u16[]}
  "EEPROM Characterization Header.gtype" = cluster{"Checksum": u32, "Date": timestamp, "Temperature": f32, "Misc. Info": string, "Pointer to Device Data Header": u32, "Number of Reserved Bytes": i32}
  "Characterization Data.gtype" = cluster{"Gains[dB]": f64[], "Frequencies [Hz]": f64[], "IQ Imbalance Table": "IQ Imbalance.gtype"[], "Measured Gains[dB]": f64[][]}
  "niUsrpRio Session.gtype" = cluster{"FPGA Interface": any, "RIO Interface Number": u32, "Data Clock Rate": u32, "FPGA Data Clock Rate": u32, "Global Settings Register Bus": "Register Bus Session.gtype", "Radio 0 Settings Register Bus": "Register Bus Session.gtype", "Radio 1 Settings Register Bus": "Register Bus Session.gtype", "Radio Settings Bus Semaphore": "Semaphore.gtype", "DB Queues": "DB Queue Reference.gtype"[], "Characterization Data Valid?": bool, "EEPROM Header": "EEPROM Header.gtype", "Device Data Header": "EEPROM Device Data Header.gtype", "EEPROM Characterization Header": "EEPROM Characterization Header.gtype", "Characterization Data": "Characterization Data.gtype"[], "FPGA Current Version": u32, "FPGA Oldest Compatible Version": u32, "Fixed Logic Current Version": u32, "Fixed Logic Oldest Compatible Version": u32, "FPGA Radio Settings Bus Current Version": u32, "FPGA Radio Settings Bus Oldest Compatible Version": u32, "FPGA Board Config Current Version": u32, "FPGA Board Config Oldest Compatible Version": u32, "Daughterboard Clock Rate": u32}
uses:
  NI::USRPRIO::ConfigV1Host::Parse Scope.gvi
diagram:
  call "Parse Scope.gvi"(niusrprio session in=$"niusrprio session", error in=$"error in", scope=$scope) -> (niusrprio session out=w1, device subfunction channel=w2, error out=w3)
  $"niusrprio session 2" <- w1
  # I is in the lower bits,
  # Q is in the higher
  Property Node(instance in=w1) -> ("FPGA Interface"=w4)
  Dynamic Fpga Interface Cast(reference in=w4, type=$constantdata) -> (reference out=w5)
  Multiply($timeout, 1000) -> w6
  case (w2) {
    frame "0", Default {
      Array Index(array=$data) -> (out0[0, _]=w8)
      Host Fifo Write Node[FifoName="Shared::USRP Resources.grsc::Tx Stream 0"](data=w8, error in=w3, reference in=w5, timeout (ms)=w6) -> (error out=w7)
    }
    frame "1" {
      Array Index(array=$data) -> (out0[0, _]=w9)
      Host Fifo Write Node[FifoName="Shared::USRP Resources.grsc::Tx Stream 1"](data=w9, error in=w3, reference in=w5, timeout (ms)=w6) -> (error out=w7)
    }
  }
  $"error out" <- w7
