vi "Multi-Device Rx Streaming Time (Host).gvi"   [LabVIEW NXG 4.0.0]
# This template is for the Simple NI-USRP Streaming design, a design that shows the basics of streaming data to and from an NI USRP-294x/295x device. Refer to the block diagram for more information about how to use this template.
panel controls:
  "Tab": i32
  "rx.stop": bool
  "Tab_2": i32
  "rx config": T5 = {"rf enable 0"=TRUE, "rf config 0"={"Antenna RF 0"="RX2", "Frequency RF 0 [Hz]"=2000000000, "LO Frequency RF 0 [Hz]"=-1, "Reference Level RF 0 [dBm]"=0}, "rf enable 1"=TRUE, "rf config 1"={"Antenna RF 1"="RX2", "Frequency RF 1 [Hz]"=2000000000, "LO Frequency RF 1 [Hz]"=-1, "Reference Level RF 1 [dBm]"=0}, "Acquisition Mode"="Finite", "Sample Rate [S/s]"=10000000, "Number of Samples"=8192, "Start Trigger"="Future Time Event"}
  "USRP RIO devices": string[] = ["RIO0", "RIO1"]
  "Reference Frequency Source": string = "REF IN"
panel indicators:
  "Power Spectrum": T1[]
  "Power Level": f64[][]
  "I & Q Data": f64[][]
  "Acquiring": bool
  "RX Coerced Configurations": T6[]
types:
  T1 = cluster{"f0": f64, "df": f64, "magnitude": f64[]}
  T2 = cluster{"Antenna RF 0": string, "Frequency RF 0 [Hz]": f64, "LO Frequency RF 0 [Hz]": f64, "Reference Level RF 0 [dBm]": f64}
  T3 = cluster{"Antenna RF 1": string, "Frequency RF 1 [Hz]": f64, "LO Frequency RF 1 [Hz]": f64, "Reference Level RF 1 [dBm]": f64}
  T4 = enum{"Software", "Digital Edge", "Rx Start Trigger", "Tx Start Trigger", "Immediate", "Future Time Event"}
  T5 = cluster{"rf enable 0": bool, "rf config 0": T2, "rf enable 1": bool, "rf config 1": T3, "Acquisition Mode": enum{"Finite", "Continuous"}, "Sample Rate [S/s]": f64, "Number of Samples": u32, "Start Trigger": T4}
  T6 = cluster{"Coerced Frequencies [Hz]": f64[], "Coerced LO Frequencies [Hz]": f64[], "Coerced Levels [dBm]": f64[], "Coerced Sample Rates [S/s]": f64[]}
uses:
  Host SubVIs::Open and Configure Device.gvi
  Host SubVIs::Configure Time (Multi).gvi
  Host SubVIs::Initiate and Fetch Time (Multi).gvi
  NI::G Core::Timing::Elapsed Timer.gvi
  Host SubVIs::Calculate Power.gvi
  Host SubVIs::Close Device.gvi
  NI::G Core::Error::Display Error.gvi
diagram:
  w1 = $"Reference Frequency Source"
  w2 = $"rx config"
  # 1. Open and configure device
  # 2. Configure time
  # 3. Receive data
  # 4. Close device
  # 1.
  for {
    w3 = each element of $"USRP RIO devices"
    call "Open and Configure Device.gvi"(rx config=w2, USRP RIO Device=w3, reference frequency source=w1) -> (niUsrpRio Session (out)=w8, rx.coerced configurations=w9, error out=w10, rx channels=w11)
    append w9 to w4
    append w11 to w5
    append w10 to w6
    append w8 to w7
  }
  Merge Errors(w6) -> (error out=w12)
  # 2.
  call "Configure Time (Multi).gvi"(niUsrpRio Sessions=w7, error in=w12) -> (niUsrpRio Sessions (out)=w13, time=w14, error out=w15)
  Time Stamp Add(x=w14, y=2) -> w16
  s1 = w15  # shift register
  s2 = w16  # shift register
  while (iteration -> i1) {
    Is Equal To 0(x=i1) -> w17
    # 3.
    call "Initiate and Fetch Time (Multi).gvi"(niUsrpRio Sessions=w13, first iteration=w17, start trigger time=s2, error in=s1, rx channels=w5) -> (niUsrpRio Sessions (out)=w18, complex baseband data=w19, error out=w20)
    call "Elapsed Timer.gvi"(target time=0.05) -> (time has elapsed=w21)
    case (w21) {
      frame False, Default { }
      frame True {
        call "Calculate Power.gvi"(waveform=w19) -> (Power Spectrum=w22, Power Level=w23, I & Q Data=w24)
        $"Power Spectrum" <- w22
        $"Power Level" <- w23
        $"I & Q Data" <- w24
      }
    }
    Logical Or(w20, $"rx.stop") -> w25
    Not(x=w25) -> w26
    $Acquiring <- w26
    Time Stamp Add(x=s2, y=0.1) -> w27
    next s1 = w20
    next s2 = w27
    stop if w25
  }
  # 4.
  for {
    w28 = each element of w18
    call "Close Device.gvi"(niusrprio session in=w28, error in=s1) -> (error out=w30)
    append w30 to w29
  }
  Merge Errors(w29) -> (error out=w31)
  call "Display Error.gvi"(error in=w31, type of dialog="OK message + warnings")
  $"RX Coerced Configurations" <- w4
