vi "Multi-Device Tx Streaming Signal (Host).gvi"   [LabVIEW NXG 4.0.0]
# This template is for the Simple NI-USRP Streaming design, a design that shows the basics of streaming data to and from an NI USRP-294x/295x device. Refer to the block diagram for more information about how to use this template.
panel controls:
  "Tab": i32
  "tx.stop": bool
  "Tab_2": i32
  "tx config": T4 = {"rf enable 0"=TRUE, "rf config 0"={"Antenna RF 0"="TX1", "Frequency RF 0 [Hz]"=2000000000, "LO Frequency RF 0 [Hz]"=-1, "Output Power RF 0 [dBm]"=0}, "rf enable 1"=TRUE, "rf config 1"={"Antenna RF 1"="TX1", "Frequency RF 1 [Hz]"=2000000000, "LO Frequency RF 1 [Hz]"=-1, "Output Power RF 1 [dBm]"=0}, "Generation Mode"="Finite", "Sample Rate [S/s]"=10000000, "Number of Samples"=8192, "Start Trigger"="Immediate", "Tone Frequency [Hz]"=100000}
  "USRP RIO devices": string[] = ["RIO0", "RIO1"]
  "Reference Frequency Source": string = "REF IN"
  "FPGA I/O for Synchronization": string = "SyncAux"
panel indicators:
  "Output Waveform": waveform<f64>[]
  "Generating": bool
  "TX Coerced Configurations": T5[]
types:
  T1 = cluster{"Antenna RF 0": string, "Frequency RF 0 [Hz]": f64, "LO Frequency RF 0 [Hz]": f64, "Output Power RF 0 [dBm]": f64}
  T2 = cluster{"Antenna RF 1": string, "Frequency RF 1 [Hz]": f64, "LO Frequency RF 1 [Hz]": f64, "Output Power RF 1 [dBm]": f64}
  T3 = enum{"Software", "Digital Edge", "Rx Start Trigger", "Tx Start Trigger", "Immediate", "Future Time Event"}
  T4 = cluster{"rf enable 0": bool, "rf config 0": T1, "rf enable 1": bool, "rf config 1": T2, "Generation Mode": enum{"Finite", "Continuous"}, "Sample Rate [S/s]": f64, "Number of Samples": u32, "Start Trigger": T3, "Tone Frequency [Hz]": f64}
  T5 = cluster{"Coerced Frequencies [Hz]": f64[], "Coerced LO Frequencies [Hz]": f64[], "Coerced Output Powers [dBm]": f64[], "Coerced Sample Rates [S/s]": f64[]}
uses:
  Host SubVIs::Open and Configure Device.gvi
  Host SubVIs::Configure Synchronization.gvi
  Host SubVIs::Initiate and Generate (Multi).gvi
  Host SubVIs::Close Device.gvi
  NI::G Core::Error::Display Error.gvi
diagram:
  w1 = $"Reference Frequency Source"
  w2 = $"FPGA I/O for Synchronization"
  w3 = $"tx config"
  # 1. Open and configure device
  # 2. Configure synchronization
  # 3. Transmit data
  # 4. Close device
  # 1.
  for {
    w4 = each element of $"USRP RIO devices"
    call "Open and Configure Device.gvi"(tx config=w3, USRP RIO Device=w4, reference frequency source=w1, which bitfile=w2) -> (niUsrpRio Session (out)=w9, tx.coerced configurations=w10, tx.output waveform=w11, error out=w12, tx channels=w13)
    append w10 to w5
    append w13 to w6
    append w12 to w7
    append w9 to w8
  }
  Merge Errors(w7) -> (error out=w14)
  # 2.
  call "Configure Synchronization.gvi"(niusrprio sessions in=w8, error in=w14, scope="tx") -> (niusrprio sessions out=w15, error out=w16)
  s1 = w16  # shift register
  while (iteration -> i1) {
    Is Equal To 0(x=i1) -> w17
    # 3.
    call "Initiate and Generate (Multi).gvi"(niUsrpRio Sessions=w15, first iteration=w17, error in=s1, tx channels=w6) -> (niUsrpRio Sessions (out)=w18, error out=w19)
    Logical Or(w19, $"tx.stop") -> w20
    Not(x=w20) -> w21
    $Generating <- w21
    next s1 = w19
    stop if w20
  }
  # 4.
  for {
    w22 = each element of w18
    call "Close Device.gvi"(niusrprio session in=w22, error in=s1) -> (error out=w24)
    append w24 to w23
  }
  Merge Errors(w23) -> (error out=w25)
  call "Display Error.gvi"(error in=w25, type of dialog="OK message + warnings")
  $"TX Coerced Configurations" <- w5
  $"Output Waveform" <- w11
