vi "Streaming Xcvr Sync AUX (FPGA).gvi"   [LabVIEW NXG 4.0.0]
panel controls:
  "reg.host read.go rcvd 0": bool
  "reg.notify host.go rcvd 0": bool
  "reg.reset 0": bool
    # specifies whether the state machine that controls the processing of register instructions is reset to the state where it is ready for a new register instruction. The state machine stays in this state until this parameter is set to FALSE.
    # The reg.reset parameter must be wired to a control on the top-level FPGA VI, because the parameter must be accessible to the Register Bus Host library from the FPGA Interface Read/Write Control function. The control must have a pre-defined name based on the value passed to the bus instance parameter of the Open Session VI in the Register Bus Host library. The format of the name is 'reg.reset N', where N is the instance number of the Register Bus Host library and Register Bus FPGA library. For example, if the name is 'reg.reset 0', the instance number of this library is 0.
  "RF 0/Rx/Enable": bool
  "RF 0/Tx/Enable": bool
  "RF 1/Rx/Enable": bool
  "RF 1/Tx/Enable": bool
  "tx.trigger enable": bool
  "tx.trigger sync enable": bool
  "tx 0.stream enable": bool
  "tx 1.stream enable": bool
  "tx.software trigger": bool
  "tx.reset": bool
  "tx.abort": bool
  "tx.samples to generate": u32
  "tx 0.gain": "IQ Gain.gtype"
  "tx 0.frequency shift": FXP(0.48)
  "tx 0.phase": FXP(0.21)
  "tx 0.impairments": "IQ Impairments.gtype"
  "tx.input sample rate": UFXP(1.47)
  "tx.delay": FXP(0.18)
  "tx 1.gain": "IQ Gain.gtype"
  "tx 1.frequency shift": FXP(0.48)
  "tx 1.phase": FXP(0.21)
  "tx 1.impairments": "IQ Impairments.gtype"
  "rx.trigger enable": bool
  "rx.trigger sync enable": bool
  "rx 0.stream enable": bool
  "rx 1.stream enable": bool
  "rx.software trigger": bool
  "rx.reset": bool
  "rx.abort": bool
  "rx.samples to acquire": u32
  "rx 0.impairments": "IQ Impairments.gtype"
  "rx 0.frequency shift": FXP(0.48)
  "rx 0.phase": FXP(0.21)
  "rx.output sample rate": UFXP(1.47)
  "rx.delay": FXP(0.16)
  "rx 1.impairments": "IQ Impairments.gtype"
  "rx 1.frequency shift": FXP(0.48)
  "rx 1.phase": FXP(0.21)
  "tx.trigger select": "Start Trigger.gtype" = "Software"
  "rx.trigger select": "Start Trigger.gtype" = "Software"
panel indicators:
  "reg.notify host.go 0": bool
  "reg.host read.data 0": "Read Cmd Data.gtype"
  "tx.samples processed": u32
  "tx.number of fifo underflows": u32
  "tx 0.number of IQ data overflows": u64
  "tx 1.number of IQ data overflows": u64
  "tx.dsp reset done": bool
  "rx.samples processed": u32
  "rx.number of fifo overflows": u32
  "rx 0.number of IQ data overflows": u64
  "rx 1.number of IQ data overflows": u64
  "rx.dsp reset done": bool
  "tx.state": "Stream Control State.gtype"
  "rx.state": "Stream Control State.gtype"
types:
  "Read Cmd Data.gtype" = cluster{"go": bool, "data": u32}
  "IQ Gain.gtype" = cluster{"gain I": FXP(3.21), "gain Q": FXP(3.21)}
  "IQ Impairments.gtype" = cluster{"inline gain I": FXP(1.17), "inline gain Q": FXP(1.17), "cross gain I": FXP(1.17), "cross gain Q": FXP(1.17), "pre-gain offset I": FXP(1.17), "pre-gain offset Q": FXP(1.17), "post-gain offset I": FXP(1.17), "post-gain offset Q": FXP(1.17)}
  "Start Trigger.gtype" = enum{"Software", "Digital Edge", "Rx Start Trigger", "Tx Start Trigger", "Immediate", "Future Time Event"}
  "Stream Control State.gtype" = enum{"Idle", "Active"}
  T1 = cluster{"rx.state": "Stream Control State.gtype", "rx.samples processed": u32, "rx.number of fifo overflows": u32, "rx 0.number of IQ data overflows": u64, "rx 1.number of IQ data overflows": u64, "rx.dsp reset done": bool}
  "DDC Parameters.gtype" = cluster{"output sample rate": UFXP(1.47), "delay": FXP(0.16), "frequency shift": FXP(0.48), "impairments": "IQ Impairments.gtype", "phase": FXP(0.21)}
  T2 = cluster{"rx.trigger enable": bool, "rx.trigger sync enable": bool, "rx 0.stream enable": bool, "rx 1.stream enable": bool, "rx.software trigger": bool, "rx.reset": bool, "rx.abort": bool, "rx.samples to acquire": u32, "Element 10": "DDC Parameters.gtype"[2], "rx.trigger select": "Start Trigger.gtype"}
  T3 = cluster{"tx.state": "Stream Control State.gtype", "tx.samples processed": u32, "tx.number of fifo underflows": u32, "tx 0.number of IQ data overflows": u64, "tx 1.number of IQ data overflows": u64, "tx.dsp reset done": bool}
  "DUC Parameters.gtype" = cluster{"frequency shift": FXP(0.48), "impairments": "IQ Impairments.gtype", "phase": FXP(0.21), "input sample rate": UFXP(1.47), "gain": "IQ Gain.gtype", "delay": FXP(0.18)}
  T4 = cluster{"tx.trigger enable": bool, "tx.trigger sync enable": bool, "tx 0.stream enable": bool, "tx 1.stream enable": bool, "tx.software trigger": bool, "tx.reset": bool, "tx.abort": bool, "tx.samples to generate": u32, "Element 10": "DUC Parameters.gtype"[2], "tx.trigger select": "Start Trigger.gtype"}
uses:
  FPGA SubVIs::Create Resources.gvi
  NI::SDR::RegisterBusV1FPGA::Process.gcdl
  FPGA SubVIs::Registers.gcdl
  FPGA SubVIs::LEDs.gvi
  NI::USRPRIO::ConfigV1FPGA::Process.gvi
  FPGA SubVIs::Start Triggers Sync AUX.gcdl
  FPGA SubVIs::Rx.gcdl
  FPGA SubVIs::Tx.gcdl
diagram:
  call "Create Resources.gvi"() -> (config.resources=w1, sync.resources=w2, time.resources=w3)
  clock-driven loop (clock = "40 MHz Onboard Clock") forever {  # Register Bus and Required Controls/Indicators
    # REQUIRED
    Io Write(data=$"RF 0/Rx/Enable", reference in="RF 0/Rx/Enable")
    Io Write(data=$"RF 0/Tx/Enable", reference in="RF 0/Tx/Enable")
    Io Write(data=$"RF 1/Rx/Enable", reference in="RF 1/Rx/Enable")
    Io Write(data=$"RF 1/Tx/Enable", reference in="RF 1/Tx/Enable")
    w4 = "NI::SDR::RegisterBusV1FPGA::niInstr Register Bus v0.grsc::reg.host instruction fifo 0"
    Feedback Node(input=w5) -> w6
    Feedback Node(input=w7) -> w8
    call "Process.gcdl"(reg.notify host.go rcvd=$"reg.notify host.go rcvd 0", reg.host read.go rcvd=$"reg.host read.go rcvd 0", read completion=w6, reg.reset=$"reg.reset 0", reg.host instruction fifo=w4, ready for output=w8) -> (reg.notify host.go=w9, reg.host read.data=w10, register instruction=w11)
    $"reg.notify host.go 0" <- w9
    $"reg.host read.data 0" <- w10
    call "Registers.gcdl"(register instruction=w11, config.resources=w1, sync.resources=w2, time.resources=w3) -> (ready for input=w7, read completion out=w5)
  }
  call "LEDs.gvi"()
  call "Process.gvi"(resources=w1)
  Register Create(initial value=T1 {all zero or empty}) -> (reference out=w12)
  w13 = T2 {"Element 10"=[{0, 0, 0, 0, 0, 0, 0, 0, 0, 0, 0, 0}, {0, 0, 0, 0, 0, 0, 0, 0, 0, 0, 0, 0}], "rx.trigger select"="Software"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}
  Register Create(initial value=w13) -> (reference out=w14)
  Register Create(initial value=T3 {all zero or empty}) -> (reference out=w15)
  w16 = T4 {"Element 10"=[{0, 0, 0, 0, 0, 0, 0, 0, 0, 0, 0, 0, 0, 0}, {0, 0, 0, 0, 0, 0, 0, 0, 0, 0, 0, 0, 0, 0}], "tx.trigger select"="Software"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}
  Register Create(initial value=w16) -> (reference out=w17)
  clock-driven loop (clock = "Data Clock") forever {  # Streaming Transceiver Engine
    Register Read(reference in=w14) -> (data=w18)
    Register Read(reference in=w17) -> (data=w19)
    call "Start Triggers Sync AUX.gcdl"(sync.resources=w2, rx.parameters=w18, tx.parameters=w19) -> (rx.start trigger=w20, tx.start trigger=w21)
    call "Rx.gcdl"(rx.parameters=w18, rx.start trigger=w20) -> (rx.status=w22)
    Register Write(data=w22, reference in=w12)
    call "Tx.gcdl"(tx.parameters=w19, tx.start trigger=w21) -> (tx.status=w23)
    Register Write(data=w23, reference in=w15)
  }
  clock-driven loop (clock = "40 MHz Onboard Clock") forever {
    Property Node(instance in="DUC Parameters.gtype" {all zero or empty}, "gain"=$"tx 0.gain", "frequency shift"=$"tx 0.frequency shift", "phase"=$"tx 0.phase", "impairments"=$"tx 0.impairments", "input sample rate"=$"tx.input sample rate", "delay"=$"tx.delay") -> (instance out=w24)
    Property Node(instance in="DUC Parameters.gtype" {all zero or empty}, "delay"=$"tx.delay", "input sample rate"=$"tx.input sample rate", "gain"=$"tx 1.gain", "frequency shift"=$"tx 1.frequency shift", "phase"=$"tx 1.phase", "impairments"=$"tx 1.impairments") -> (instance out=w25)
    Build Array(w24, w25) -> w26
    w27 = T4 {"Element 10"=[{0, 0, 0, 0, 0, 0, 0, 0, 0, 0, 0, 0, 0, 0}, {0, 0, 0, 0, 0, 0, 0, 0, 0, 0, 0, 0, 0, 0}], "tx.trigger select"="Software"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}
    Property Node(instance in=w27, "tx.trigger select"=$"tx.trigger select", "tx.trigger enable"=$"tx.trigger enable", "tx.trigger sync enable"=$"tx.trigger sync enable", "tx 0.stream enable"=$"tx 0.stream enable", "tx 1.stream enable"=$"tx 1.stream enable", "tx.software trigger"=$"tx.software trigger", "tx.reset"=$"tx.reset", "tx.abort"=$"tx.abort", "tx.samples to generate"=$"tx.samples to generate", "Element 10"=w26) -> (instance out=w28)
    Register Write(data=w28, reference in=w17)
    Register Read(reference in=w15) -> (data=w29)
    Property Node(instance in=w29) -> ("tx.state"=w30, "tx.samples processed"=w31, "tx.number of fifo underflows"=w32, "tx 0.number of IQ data overflows"=w33, "tx 1.number of IQ data overflows"=w34, "tx.dsp reset done"=w35)
    $"tx.state" <- w30
    $"tx.samples processed" <- w31
    $"tx.number of fifo underflows" <- w32
    $"tx 0.number of IQ data overflows" <- w33
    $"tx 1.number of IQ data overflows" <- w34
    $"tx.dsp reset done" <- w35
    Property Node(instance in="DDC Parameters.gtype" {all zero or empty}, "impairments"=$"rx 0.impairments", "frequency shift"=$"rx 0.frequency shift", "phase"=$"rx 0.phase", "output sample rate"=$"rx.output sample rate", "delay"=$"rx.delay") -> (instance out=w36)
    Property Node(instance in="DDC Parameters.gtype" {all zero or empty}, "delay"=$"rx.delay", "output sample rate"=$"rx.output sample rate", "impairments"=$"rx 1.impairments", "frequency shift"=$"rx 1.frequency shift", "phase"=$"rx 1.phase") -> (instance out=w37)
    Build Array(w36, w37) -> w38
    w39 = T2 {"Element 10"=[{0, 0, 0, 0, 0, 0, 0, 0, 0, 0, 0, 0}, {0, 0, 0, 0, 0, 0, 0, 0, 0, 0, 0, 0}], "rx.trigger select"="Software"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}
    Property Node(instance in=w39, "rx.trigger select"=$"rx.trigger select", "rx.trigger enable"=$"rx.trigger enable", "rx.trigger sync enable"=$"rx.trigger sync enable", "rx 0.stream enable"=$"rx 0.stream enable", "rx 1.stream enable"=$"rx 1.stream enable", "rx.software trigger"=$"rx.software trigger", "rx.reset"=$"rx.reset", "rx.abort"=$"rx.abort", "rx.samples to acquire"=$"rx.samples to acquire", "Element 10"=w38) -> (instance out=w40)
    Register Write(data=w40, reference in=w14)
    Register Read(reference in=w12) -> (data=w41)
    Property Node(instance in=w41) -> ("rx.state"=w42, "rx.samples processed"=w43, "rx.number of fifo overflows"=w44, "rx 0.number of IQ data overflows"=w45, "rx 1.number of IQ data overflows"=w46, "rx.dsp reset done"=w47)
    $"rx.state" <- w42
    $"rx.samples processed" <- w43
    $"rx.number of fifo overflows" <- w44
    $"rx 0.number of IQ data overflows" <- w45
    $"rx 1.number of IQ data overflows" <- w46
    $"rx.dsp reset done" <- w47
  }
