vi "LEDs.gvi"   [LabVIEW NXG 4.0.0]
diagram:
  clock-driven loop (clock = "40 MHz Onboard Clock") {
    Io Read(reference in="Clock Chip Locked") -> (data=w1)
    Select(s=w1, t="Green", f="Off") -> w2
    Io Write(data=w2, reference in="LED/REF")
    Io Read(reference in="GPS Locked") -> (data=w3)
    Select(s=w3, t="Green", f="Off") -> w4
    Io Write(data=w4, reference in="LED/GPS")
    stop if FALSE
  }
  clock-driven loop (clock = "Data Clock") {
    Io Read(reference in="PPS Trig In") -> (data=w5)
    Select(s=w5, t="Green", f="Off") -> w6
    Io Write(data=w6, reference in="LED/PPS")
    stop if FALSE
  }
