vi "Configure Frequency Shift.gvi"   [LabVIEW NXG 4.0.0]
# Configures the digital frequency shift amount. Input Parameters niUsrpRio Session is the object created by the Open VI and used as the session handle for the USRP RIO design library. clock rate is the frequency, in hertz, the DSP blocks are running at. frequency shift is the amount, in hertz, to shift the frequency by. error in describes error conditions that occur before this node runs. This input provides standard 'error in' functionality. Output Parameters error out contains error information. This output provides standard 'error out' functionality.
inputs:
  "niusrprio session in": "niUsrpRio Session.gtype", required
  "clock rate": f64 = 120000000, required  # is the frequency, in hertz, the DSP blocks are running at.
  "frequency shift": f64, required  # is the amount, in hertz, to shift the frequency by.
  "error in": error
  "scope": string = "rx", required
outputs:
  "niusrprio session out": "niUsrpRio Session.gtype"
  "coerced frequency shift": f64
  "error out": error
types:
  "Register Bus Session.gtype" = Queue<"Session Data.gtype">
  "Semaphore.gtype" = i32
  "DB Queue Reference.gtype" = Queue<"Daughterboard Data.gtype">
  "EEPROM Header.gtype" = cluster{"Checksum": u32, "Product Code": u16, "Hardware Current Version": u16, "Hardware Oldest Compatible Version": u16, "EEPROM Map Current Version": u16, "EEPROM Map Oldest Compatible Version": u16, "User Password": string, "Pointer to Factory Header": u32, "Pointer to User Header": u32, "Recommended Interval": u16, "Number of Reserved Bytes": i32, "Number of Daughterboards": u8, "Daughterboard IDs": u16[], "Daughterboard Serial Numbers": string[]}
  "EEPROM Device Data Header.gtype" = cluster{"Checksum": u32, "Number of Channels": u8, "Number of Gain Settings": u16[], "Pointer to Characterization Data": u32[], "Number of Reserved Bytes": i32, "Number of Frequencies": u16[]}
  "EEPROM Characterization Header.gtype" = cluster{"Checksum": u32, "Date": timestamp, "Temperature": f32, "Misc. Info": string, "Pointer to Device Data Header": u32, "Number of Reserved Bytes": i32}
  "Characterization Data.gtype" = cluster{"Gains[dB]": f64[], "Frequencies [Hz]": f64[], "IQ Imbalance Table": "IQ Imbalance.gtype"[], "Measured Gains[dB]": f64[][]}
  "niUsrpRio Session.gtype" = cluster{"FPGA Interface": any, "RIO Interface Number": u32, "Data Clock Rate": u32, "FPGA Data Clock Rate": u32, "Global Settings Register Bus": "Register Bus Session.gtype", "Radio 0 Settings Register Bus": "Register Bus Session.gtype", "Radio 1 Settings Register Bus": "Register Bus Session.gtype", "Radio Settings Bus Semaphore": "Semaphore.gtype", "DB Queues": "DB Queue Reference.gtype"[], "Characterization Data Valid?": bool, "EEPROM Header": "EEPROM Header.gtype", "Device Data Header": "EEPROM Device Data Header.gtype", "EEPROM Characterization Header": "EEPROM Characterization Header.gtype", "Characterization Data": "Characterization Data.gtype"[], "FPGA Current Version": u32, "FPGA Oldest Compatible Version": u32, "Fixed Logic Current Version": u32, "Fixed Logic Oldest Compatible Version": u32, "FPGA Radio Settings Bus Current Version": u32, "FPGA Radio Settings Bus Oldest Compatible Version": u32, "FPGA Board Config Current Version": u32, "FPGA Board Config Oldest Compatible Version": u32, "Daughterboard Clock Rate": u32}
  "IQ Impairments.gtype" = cluster{"inline gain I": FXP(1.17), "inline gain Q": FXP(1.17), "cross gain I": FXP(1.17), "cross gain Q": FXP(1.17), "pre-gain offset I": FXP(1.17), "pre-gain offset Q": FXP(1.17), "post-gain offset I": FXP(1.17), "post-gain offset Q": FXP(1.17)}
  "DDC Parameters.gtype" = cluster{"output sample rate": UFXP(1.47), "delay": FXP(0.16), "frequency shift": FXP(0.48), "impairments": "IQ Impairments.gtype", "phase": FXP(0.21)}
uses:
  NI::USRPRIO::ConfigV1Host::Parse Scope.gvi
diagram:
  call "Parse Scope.gvi"(niusrprio session in=$"niusrprio session in", error in=$"error in", scope=$scope) -> (niusrprio session out=w1, device subfunction=w2, device subfunction channel=w3, error out=w4)
  $"niusrprio session out" <- w1
  Divide(x=$"frequency shift", y=$"clock rate") -> w5
  Property Node(instance in=w1) -> ("FPGA Interface"=w6)
  Dynamic Fpga Interface Cast(reference in=w6, type="Streaming Xvcr FPGA Ref.gtype" constant) -> (reference out=w7)
  case (w2) {
    frame "rx" {
      Negate(x=w5) -> w9
      case (w3) {
        frame "0" {
          Property Node(instance in=w7, "rx 0.frequency shift"=w9, error in=w4) -> (error out=w8)
        }
        frame "1" {
          Property Node(instance in=w7, "rx 1.frequency shift"=w9, error in=w4) -> (error out=w8)
        }
        frame "All" {
          Property Node(instance in=w7, "rx 0.frequency shift"=w9, "rx 1.frequency shift"=w9, error in=w4) -> (error out=w8)
        }
      }
    }
    frame "all" {
      Negate(x=w5) -> w10
      case (w3) {
        frame "0" {
          Property Node(instance in=w7, "rx 0.frequency shift"=w10, "tx 0.frequency shift"=w5, error in=w4) -> (error out=w8)
        }
        frame "1" {
          Property Node(instance in=w7, "rx 1.frequency shift"=w10, "tx 1.frequency shift"=w5, error in=w4) -> (error out=w8)
        }
        frame "All" {
          Property Node(instance in=w7, "rx 0.frequency shift"=w10, "rx 1.frequency shift"=w10, "tx 0.frequency shift"=w5, "tx 1.frequency shift"=w5, error in=w4) -> (error out=w8)
        }
      }
    }
    frame "tx" {
      case (w3) {
        frame "0" {
          Property Node(instance in=w7, "tx 0.frequency shift"=w5, error in=w4) -> (error out=w8)
        }
        frame "1" {
          Property Node(instance in=w7, "tx 1.frequency shift"=w5, error in=w4) -> (error out=w8)
        }
        frame "All" {
          Property Node(instance in=w7, "tx 0.frequency shift"=w5, "tx 1.frequency shift"=w5, error in=w4) -> (error out=w8)
        }
      }
    }
  }
  $"error out" <- w8
  # use a DSP typedef to get the fixed-point format of the frequency shift
  Property Node(instance in="DDC Parameters.gtype" {all zero or empty}) -> ("frequency shift"=w11)
  To Fixed Point(fixed-point type=w11, number=w5) -> w12: FXP(0.48) Saturate:ConvergentRounding
  Multiply(w12, $"clock rate") -> w13
  $"coerced frequency shift" <- w13
