vi "Configure Rx.gvi"   [LabVIEW NXG 4.0.0]
inputs:
  "Sample Number": u32 = 300000
  "niUsrpRio Session": "niUsrpRio Session.gtype", required
  "rx config": T2 = {"rf enable 0"=FALSE, "rf config 0"={"antenna"="RX2", "frequency"=2000000000, "lo frequency"=-1, "level"=0}, "rf enable 1"=FALSE, "rf config 1"={"antenna"="RX2", "frequency"=2000000000, "lo frequency"=-1, "level"=0}, "transfer mode"="Finite", "sample rate"=10000000, "number of samples"=8192, "start trigger"="Immediate"}, required
  "error in": error
  "Fs": f64 = 300000
outputs:
  "niUsrpRio Session (out)": "niUsrpRio Session.gtype"
  "rx.enabled channels": string[]
  "vertical range": f64[]
  "error out": error
  "rx.coerced configurations": T3
types:
  "Register Bus Session.gtype" = Queue<"Session Data.gtype">
  "Semaphore.gtype" = i32
  "DB Queue Reference.gtype" = Queue<"Daughterboard Data.gtype">
  "EEPROM Header.gtype" = cluster{"Checksum": u32, "Product Code": u16, "Hardware Current Version": u16, "Hardware Oldest Compatible Version": u16, "EEPROM Map Current Version": u16, "EEPROM Map Oldest Compatible Version": u16, "User Password": string, "Pointer to Factory Header": u32, "Pointer to User Header": u32, "Recommended Interval": u16, "Number of Reserved Bytes": i32, "Number of Daughterboards": u8, "Daughterboard IDs": u16[], "Daughterboard Serial Numbers": string[]}
  "EEPROM Device Data Header.gtype" = cluster{"Checksum": u32, "Number of Channels": u8, "Number of Gain Settings": u16[], "Pointer to Characterization Data": u32[], "Number of Reserved Bytes": i32, "Number of Frequencies": u16[]}
  "EEPROM Characterization Header.gtype" = cluster{"Checksum": u32, "Date": timestamp, "Temperature": f32, "Misc. Info": string, "Pointer to Device Data Header": u32, "Number of Reserved Bytes": i32}
  "Characterization Data.gtype" = cluster{"Gains[dB]": f64[], "Frequencies [Hz]": f64[], "IQ Imbalance Table": "IQ Imbalance.gtype"[], "Measured Gains[dB]": f64[][]}
  "niUsrpRio Session.gtype" = cluster{"FPGA Interface": any, "RIO Interface Number": u32, "Data Clock Rate": u32, "FPGA Data Clock Rate": u32, "Global Settings Register Bus": "Register Bus Session.gtype", "Radio 0 Settings Register Bus": "Register Bus Session.gtype", "Radio 1 Settings Register Bus": "Register Bus Session.gtype", "Radio Settings Bus Semaphore": "Semaphore.gtype", "DB Queues": "DB Queue Reference.gtype"[], "Characterization Data Valid?": bool, "EEPROM Header": "EEPROM Header.gtype", "Device Data Header": "EEPROM Device Data Header.gtype", "EEPROM Characterization Header": "EEPROM Characterization Header.gtype", "Characterization Data": "Characterization Data.gtype"[], "FPGA Current Version": u32, "FPGA Oldest Compatible Version": u32, "Fixed Logic Current Version": u32, "Fixed Logic Oldest Compatible Version": u32, "FPGA Radio Settings Bus Current Version": u32, "FPGA Radio Settings Bus Oldest Compatible Version": u32, "FPGA Board Config Current Version": u32, "FPGA Board Config Oldest Compatible Version": u32, "Daughterboard Clock Rate": u32}
  T1 = cluster{"antenna": string, "frequency": f64, "lo frequency": f64, "level": f64}
  "Start Trigger.gtype" = enum{"Software", "Digital Edge", "Rx Start Trigger", "Tx Start Trigger", "Immediate", "Future Time Event"}
  T2 = cluster{"rf enable 0": bool, "rf config 0": T1, "rf enable 1": bool, "rf config 1": T1, "transfer mode": enum{"Finite", "Continuous"}, "sample rate": f64, "number of samples": u32, "start trigger": "Start Trigger.gtype"}
  T3 = cluster{"coerced frequencies": f64[], "coerced lo frequencies": f64[], "coerced levels": f64[], "coerced sample rates": f64[]}
uses:
  Host SubVIs::Construct Channels.gvi
  Host SubVIs::Configure Signal (Level).gvi
  Host SubVIs::Configure Start Trigger.gvi
  Host SubVIs::Configure Stream.gvi
diagram:
  Property Node(instance in=$"rx config") -> ("rf enable 0"=w1, "rf config 0"=w2, "rf enable 1"=w3, "rf config 1"=w4, "transfer mode"=w5, "start trigger"=w6)
  w7 = cluster{"rf enable 0": bool, "rf config 0": T1} {all zero or empty}
  Property Node(instance in=w7, "rf enable 0"=w1, "rf config 0"=w2) -> (instance out=w8)
  w9 = cluster{"rf enable 1": bool, "rf config 1": T1} {all zero or empty}
  Property Node(instance in=w9, "rf enable 1"=w3, "rf config 1"=w4) -> (instance out=w10)
  Build Array(w8, w10) -> w11
  call "Construct Channels.gvi"(channel configurations=w11, scope="rx") -> (enabled channels=w12, enabled channel configurations=w13)
  Array Size(array=w12) -> (size(s)=w14)
  case (w14) {
    frame 0 {
      w15 = default
      w16 = default
      w17 = default
      w18 = default
      w19 = $"niUsrpRio Session"
      w20 = $"error in"
      w21 = default
      w22 = default
    }
    frame Default {
      s1 = $"error in"  # shift register
      for {
        w23 = each element of w12
        w24 = each element of w13
        Property Node(instance in=w24) -> ("frequency"=w25, "level"=w26, "antenna"=w27, "lo frequency"=w28)
        call "Configure Signal (Level).gvi"(active antenna=w27, lo frequency [hz]=w28, niusrprio session in=$"niUsrpRio Session", sample rate [s/s]=$Fs, frequency [hz]=w25, level [dbm]=w26, error in=s1, scope=w23) -> (coerced lo frequency [hz]=w29, niusrprio session out=w30, coerced sample rate [s/s]=w31, coerced frequency [hz]=w32, coerced level [dbm]=w33, error out=w34, coerced vertical range [vpp]=w35)
        call "Configure Start Trigger.gvi"(niusrprio session in=w30, start trigger=w6, error in=w34, scope=w23) -> (niusrprio session out=w36, error out=w37)
        Is Equal To 0(x=w5) -> w38
        call "Configure Stream.gvi"(niusrprio session in=w36, number of samples is finite=w38, number of samples=$"Sample Number", error in=w37, scope=w23) -> (niusrprio session out=w19, error out=w39)
        append w35 to w21
        append w31 to w15
        append w32 to w16
        append w33 to w17
        append w29 to w18
        append w23 to w22
        next s1 = w39
      }
      w20 = s1
    }
  }
  $"vertical range" <- w21
  $"rx.enabled channels" <- w22
  $"niUsrpRio Session (out)" <- w19
  $"error out" <- w20
  Property Node(instance in=T3 {all zero or empty}, "coerced sample rates"=w15, "coerced frequencies"=w16, "coerced levels"=w17, "coerced lo frequencies"=w18) -> (instance out=w40)
  $"rx.coerced configurations" <- w40
