vi "Configure Tx.gvi"   [LabVIEW NXG 4.0.0]
inputs:
  "niUsrpRio Session": "niUsrpRio Session.gtype", required
  "tx config": T2 = {"rf enable 0"=FALSE, "rf config 0"={"antenna"="TX1", "frequency"=2000000000, "lo frequency"=-1, "level"=0}, "rf enable 1"=FALSE, "rf config 1"={"antenna"="TX1", "frequency"=2000000000, "lo frequency"=-1, "level"=0}, "transfer mode"="Finite", "sample rate"=10000000, "number of samples"=8192, "start trigger"="Immediate", "tone frequency"=100000}, required
  "error in": error
outputs:
  "Sample Number": u32
  "niUsrpRio Session (out)": "niUsrpRio Session.gtype"
  "tx.enabled channels": string[]
  "I": i16[]
  "Q": i16[]
  "error out": error
  "tx.output waveform": waveform<f64>[]
  "tx.coerced configurations": T3
  "Fs": f64
types:
  "Register Bus Session.gtype" = Queue<"Session Data.gtype">
  "Semaphore.gtype" = i32
  "DB Queue Reference.gtype" = Queue<"Daughterboard Data.gtype">
  "EEPROM Header.gtype" = cluster{"Checksum": u32, "Product Code": u16, "Hardware Current Version": u16, "Hardware Oldest Compatible Version": u16, "EEPROM Map Current Version": u16, "EEPROM Map Oldest Compatible Version": u16, "User Password": string, "Pointer to Factory Header": u32, "Pointer to User Header": u32, "Recommended Interval": u16, "Number of Reserved Bytes": i32, "Number of Daughterboards": u8, "Daughterboard IDs": u16[], "Daughterboard Serial Numbers": string[]}
  "EEPROM Device Data Header.gtype" = cluster{"Checksum": u32, "Number of Channels": u8, "Number of Gain Settings": u16[], "Pointer to Characterization Data": u32[], "Number of Reserved Bytes": i32, "Number of Frequencies": u16[]}
  "EEPROM Characterization Header.gtype" = cluster{"Checksum": u32, "Date": timestamp, "Temperature": f32, "Misc. Info": string, "Pointer to Device Data Header": u32, "Number of Reserved Bytes": i32}
  "Characterization Data.gtype" = cluster{"Gains[dB]": f64[], "Frequencies [Hz]": f64[], "IQ Imbalance Table": "IQ Imbalance.gtype"[], "Measured Gains[dB]": f64[][]}
  "niUsrpRio Session.gtype" = cluster{"FPGA Interface": any, "RIO Interface Number": u32, "Data Clock Rate": u32, "FPGA Data Clock Rate": u32, "Global Settings Register Bus": "Register Bus Session.gtype", "Radio 0 Settings Register Bus": "Register Bus Session.gtype", "Radio 1 Settings Register Bus": "Register Bus Session.gtype", "Radio Settings Bus Semaphore": "Semaphore.gtype", "DB Queues": "DB Queue Reference.gtype"[], "Characterization Data Valid?": bool, "EEPROM Header": "EEPROM Header.gtype", "Device Data Header": "EEPROM Device Data Header.gtype", "EEPROM Characterization Header": "EEPROM Characterization Header.gtype", "Characterization Data": "Characterization Data.gtype"[], "FPGA Current Version": u32, "FPGA Oldest Compatible Version": u32, "Fixed Logic Current Version": u32, "Fixed Logic Oldest Compatible Version": u32, "FPGA Radio Settings Bus Current Version": u32, "FPGA Radio Settings Bus Oldest Compatible Version": u32, "FPGA Board Config Current Version": u32, "FPGA Board Config Oldest Compatible Version": u32, "Daughterboard Clock Rate": u32}
  T1 = cluster{"antenna": string, "frequency": f64, "lo frequency": f64, "level": f64}
  "Start Trigger.gtype" = enum{"Software", "Digital Edge", "Rx Start Trigger", "Tx Start Trigger", "Immediate", "Future Time Event"}
  T2 = cluster{"rf enable 0": bool, "rf config 0": T1, "rf enable 1": bool, "rf config 1": T1, "transfer mode": enum{"Finite", "Continuous"}, "sample rate": f64, "number of samples": u32, "start trigger": "Start Trigger.gtype", "tone frequency": f64}
  T3 = cluster{"coerced frequencies": f64[], "coerced lo frequencies": f64[], "coerced levels": f64[], "coerced sample rates": f64[]}
uses:
  Host SubVIs::Construct Channels.gvi
  Host SubVIs::Generate Waveform (Multi-Array).gvi
  Host SubVIs::Configure Signal (Level).gvi
  Host SubVIs::Configure Start Trigger.gvi
  Host SubVIs::Configure Stream.gvi
diagram:
  Property Node(instance in=$"tx config") -> ("rf enable 0"=w1, "rf config 0"=w2, "rf enable 1"=w3, "rf config 1"=w4, "transfer mode"=w5, "start trigger"=w6, "tone frequency"=w7)
  w8 = cluster{"rf enable 0": bool, "rf config 0": T1} {all zero or empty}
  Property Node(instance in=w8, "rf enable 0"=w1, "rf config 0"=w2) -> (instance out=w9)
  w10 = cluster{"rf enable 1": bool, "rf config 1": T1} {all zero or empty}
  Property Node(instance in=w10, "rf enable 1"=w3, "rf config 1"=w4) -> (instance out=w11)
  Build Array(w9, w11) -> w12
  call "Construct Channels.gvi"(channel configurations=w12, scope="tx") -> (enabled channels=w13, enabled channel configurations=w14)
  Array Size(array=w13) -> (size(s)=w15)
  case (w15) {
    frame 0 {
      w16 = default
      w17 = default
      w18 = default
      w19 = default
      w20 = default
      w21 = $"niUsrpRio Session"
      w22 = $"error in"
      w23 = default
      w24 = default
      w25 = default
      w26 = default
      w27 = default
    }
    frame Default {
      call "Generate Waveform (Multi-Array).gvi"(tone frequency=w7, amplitude=0.5) -> (i=w23, q=w24, waveform=w25, Sample Number=w26, error out=w28, Fs=w27)
      s1 = $"error in"  # shift register
      for {
        w29 = each element of w14
        w30 = each element of w13
        Property Node(instance in=w29) -> ("frequency"=w31, "level"=w32, "antenna"=w33, "lo frequency"=w34)
        call "Configure Signal (Level).gvi"(active antenna=w33, lo frequency [hz]=w34, niusrprio session in=$"niUsrpRio Session", sample rate [s/s]=w27, frequency [hz]=w31, level [dbm]=w32, error in=s1, scope=w30) -> (coerced lo frequency [hz]=w35, niusrprio session out=w36, coerced sample rate [s/s]=w37, coerced frequency [hz]=w38, coerced level [dbm]=w39, error out=w40)
        # w6: >> start trigger >>
        # w5: >> number of samples is finite >>
        # w26: >> number of samples >>
        call "Configure Start Trigger.gvi"(niusrprio session in=w36, start trigger=w6, error in=w40, scope=w30) -> (niusrprio session out=w41, error out=w42)
        Is Equal To 0(x=w5) -> w43
        # w43: >> number of samples is finite >>
        call "Configure Stream.gvi"(niusrprio session in=w41, number of samples is finite=w43, number of samples=w26, error in=w42, scope=w30) -> (niusrprio session out=w21, error out=w44)
        append w35 to w19
        append w39 to w18
        append w38 to w17
        append w37 to w16
        append w30 to w20
        next s1 = w44
      }
      Merge Errors(s1, w28) -> (error out=w22)
      Array Index(array=w16)
    }
  }
  $"tx.enabled channels" <- w20
  $"niUsrpRio Session (out)" <- w21
  $"error out" <- w22
  $I <- w23
  $Q <- w24
  $"tx.output waveform" <- w25
  $"Sample Number" <- w26
  $Fs <- w27
  Property Node(instance in=T3 {all zero or empty}, "coerced sample rates"=w16, "coerced frequencies"=w17, "coerced levels"=w18, "coerced lo frequencies"=w19) -> (instance out=w45)
  $"tx.coerced configurations" <- w45
