vi "Construct Channels.gvi"   [LabVIEW NXG 4.0.0]
# Creates a waveform to send to a device for generation. Input Parameters number of samples in the generated waveform. sample rate is the rate, in samples per second, that will be used to create the waveform. tone frequency is the frequency of the tone, in hertz, to generate. amplitude is used to set the amplitude of the tone. DSP overflow will occur if the 'amplitude' is too high. Output Parameters I is the real (I) portion of the generated waveform. Q is the imaginary (Q) portion of the generated waveform. Waveform is the generated waveform. error out contains error information. This output provides standard 'error out' functionality.
inputs:
  "channel configurations": T2[], required
  "scope": string, required
outputs:
  "enabled channels": string[]
  "enabled channel configurations": T1[]
types:
  T1 = cluster{"antenna": string, "frequency": f64, "lo frequency": f64, "level": f64}
  T2 = cluster{"channel enable": bool, "channel configuration": T1}
diagram:
  for (iteration -> i1) {
    w1 = each element of $"channel configurations"
    Number To Decimal String(number=i1) -> (decimal integer string=w4)
    Concatenate Strings($scope, "/RF", " ", w4) -> w5
    Property Node(instance in=w1) -> ("channel enable"=w6, "channel configuration"=w7)
    append w5 to w2 if w6
    append w7 to w3 if w6
  }
  $"enabled channels" <- w2
  $"enabled channel configurations" <- w3
