vi "Open and Configure Device.gvi"   [LabVIEW NXG 4.0.0]
# Opens a session to the USRP RIO design library, initializes the device and configures the RF components.
# Input Parameters
# USRP RIO device is the specific device to open a session to.
# reference frequency source is the reference source to use for the clocks of the device. The reference frequency must be 10 MHz.
# error in describes error conditions that occur before this node runs. This input provides standard 'error in' functionality.
# rx config is the set of configuration values for the Rx signal chain.
# tx config is the set of configuration values for the Tx signal chain.
# Output Parameters
# niUsrpRio Session (out) is the niUsrpRio session used in all subsequent USRP RIO design library host nodes.
# rx.coerced configurations are the actual configuration values for the Rx signal chain.
# tx.coerced configurations are the actual configuration values for the Tx signal chain.
# tx.output waveform is the baseband signal to use when transmitting.
# error out contains error information. This output provides standard 'error out' functionality.
inputs:
  "USRP RIO Device": string = "RIO0", required
  "reference frequency source": string = "Internal"  # is the reference source to use for the clocks of the device. The reference frequency must be 10 MHz.
  "which bitfile": string = "Time"
  "Wait for GPS Lock?": bool
  "error in": error
  "rx config": T3 = {"rf enable 0"=FALSE, "rf config 0"={"antenna"="RX2", "frequency"=2000000000, "lo frequency"=-1, "level"=0}, "rf enable 1"=FALSE, "rf config 1"={"antenna"="RX2", "frequency"=2000000000, "lo frequency"=-1, "level"=0}, "transfer mode"="Finite", "sample rate"=10000000, "number of samples"=8192, "start trigger"="Immediate"}  # is the set of configuration values for the Rx signal chain.
  "tx config": T5 = {"rf enable 0"=FALSE, "rf config 0"={"antenna"="TX1", "frequency"=2000000000, "lo frequency"=-1, "level"=0}, "rf enable 1"=FALSE, "rf config 1"={"antenna"="TX1", "frequency"=2000000000, "lo frequency"=-1, "level"=0}, "transfer mode"="Finite", "sample rate"=10000000, "number of samples"=8192, "start trigger"="Immediate", "tone frequency"=100000}  # is the set of configuration values for the Tx signal chain.
outputs:
  "niUsrpRio Session (out)": "niUsrpRio Session.gtype"  # is the niUsrpRio session used in all subsequent USRP RIO design library host VIs.
  "rx.coerced configurations": T1  # are the actual configuration values for the Rx signal chain.
  "tx.coerced configurations": T1  # are the actual configuration values for the Tx signal chain.
  "tx.output waveform": waveform<f64>[]  # is the baseband signal to use when transmitting.
  "error out": error
  "rx channels": T4
  "tx channels": T6
types:
  "Register Bus Session.gtype" = Queue<"Session Data.gtype">
  "Semaphore.gtype" = i32
  "DB Queue Reference.gtype" = Queue<"Daughterboard Data.gtype">
  "EEPROM Header.gtype" = cluster{"Checksum": u32, "Product Code": u16, "Hardware Current Version": u16, "Hardware Oldest Compatible Version": u16, "EEPROM Map Current Version": u16, "EEPROM Map Oldest Compatible Version": u16, "User Password": string, "Pointer to Factory Header": u32, "Pointer to User Header": u32, "Recommended Interval": u16, "Number of Reserved Bytes": i32, "Number of Daughterboards": u8, "Daughterboard IDs": u16[], "Daughterboard Serial Numbers": string[]}
  "EEPROM Device Data Header.gtype" = cluster{"Checksum": u32, "Number of Channels": u8, "Number of Gain Settings": u16[], "Pointer to Characterization Data": u32[], "Number of Reserved Bytes": i32, "Number of Frequencies": u16[]}
  "EEPROM Characterization Header.gtype" = cluster{"Checksum": u32, "Date": timestamp, "Temperature": f32, "Misc. Info": string, "Pointer to Device Data Header": u32, "Number of Reserved Bytes": i32}
  "Characterization Data.gtype" = cluster{"Gains[dB]": f64[], "Frequencies [Hz]": f64[], "IQ Imbalance Table": "IQ Imbalance.gtype"[], "Measured Gains[dB]": f64[][]}
  "niUsrpRio Session.gtype" = cluster{"FPGA Interface": any, "RIO Interface Number": u32, "Data Clock Rate": u32, "FPGA Data Clock Rate": u32, "Global Settings Register Bus": "Register Bus Session.gtype", "Radio 0 Settings Register Bus": "Register Bus Session.gtype", "Radio 1 Settings Register Bus": "Register Bus Session.gtype", "Radio Settings Bus Semaphore": "Semaphore.gtype", "DB Queues": "DB Queue Reference.gtype"[], "Characterization Data Valid?": bool, "EEPROM Header": "EEPROM Header.gtype", "Device Data Header": "EEPROM Device Data Header.gtype", "EEPROM Characterization Header": "EEPROM Characterization Header.gtype", "Characterization Data": "Characterization Data.gtype"[], "FPGA Current Version": u32, "FPGA Oldest Compatible Version": u32, "Fixed Logic Current Version": u32, "Fixed Logic Oldest Compatible Version": u32, "FPGA Radio Settings Bus Current Version": u32, "FPGA Radio Settings Bus Oldest Compatible Version": u32, "FPGA Board Config Current Version": u32, "FPGA Board Config Oldest Compatible Version": u32, "Daughterboard Clock Rate": u32}
  T1 = cluster{"coerced frequencies": f64[], "coerced lo frequencies": f64[], "coerced levels": f64[], "coerced sample rates": f64[]}
  T2 = cluster{"antenna": string, "frequency": f64, "lo frequency": f64, "level": f64}
  "Start Trigger.gtype" = enum{"Software", "Digital Edge", "Rx Start Trigger", "Tx Start Trigger", "Immediate", "Future Time Event"}
  T3 = cluster{"rf enable 0": bool, "rf config 0": T2, "rf enable 1": bool, "rf config 1": T2, "transfer mode": enum{"Finite", "Continuous"}, "sample rate": f64, "number of samples": u32, "start trigger": "Start Trigger.gtype"}
  T4 = cluster{"rx config": T3, "reference frequency source": string, "rx.enabled channels": string[], "vertical range": f64[], "rx.coerced configurations": T1}
  T5 = cluster{"rf enable 0": bool, "rf config 0": T2, "rf enable 1": bool, "rf config 1": T2, "transfer mode": enum{"Finite", "Continuous"}, "sample rate": f64, "number of samples": u32, "start trigger": "Start Trigger.gtype", "tone frequency": f64}
  T6 = cluster{"tx config": T5, "reference frequency source": string, "tx.enabled channels": string[], "I": i16[], "Q": i16[], "tx.coerced configurations": T1}
uses:
  Host SubVIs::Open Device.gvi
  Host SubVIs::Lock to GPS.gvi
  Host SubVIs::Configure Clocks.gvi
  Host SubVIs::Configure Tx.gvi
  Host SubVIs::Configure Rx.gvi
diagram:
  call "Open Device.gvi"(usrp rio device=$"USRP RIO Device", reference frequency source=$"reference frequency source", which bitfile=$"which bitfile", error in=$"error in") -> (niusrprio session out=w1, error out=w2)
  # #NOTE: Set "Wait for GPS Lock?" to true for GPSDO to lock to a satellite. The process may take up to 10 minutes.
  case ($"reference frequency source") {
    frame Default {
      w3 = w1
      w4 = w2
    }
    frame "GPS" {
      case ($"Wait for GPS Lock?") {
        frame True {
          call "Lock to GPS.gvi"(niusrprio session in=w1, error in=w2) -> (niusrprio session out=w5, error out=w6)
        }
        frame False {
          w5 = w1
          w6 = w2
        }
      }
      call "Configure Clocks.gvi"(niusrprio session in=w5, reference frequency source="GPS", error in=w6) -> (niusrprio session out=w3, error out=w4)
    }
  }
  call "Configure Tx.gvi"(niUsrpRio Session=w3, tx config=$"tx config", error in=w4) -> (tx.output waveform=w7, tx.coerced configurations=w8, niUsrpRio Session (out)=w9, tx.enabled channels=w10, I=w11, Q=w12, error out=w13, Sample Number=w14, Fs=w15)
  Property Node(instance in=T6 {all zero or empty}, "tx config"=$"tx config", "reference frequency source"=$"reference frequency source", "tx.enabled channels"=w10, "I"=w11, "Q"=w12, "tx.coerced configurations"=w8) -> (instance out=w16)
  $"tx channels" <- w16
  Property Node(instance in=$"rx config") -> ("rf enable 0"=w17, "rf config 0"=w18, "rf enable 1"=w19, "rf config 1"=w20, "transfer mode"=w21, "start trigger"=w22, instance out=w23)
  Property Node(instance in=w23, "rf enable 0"=w17, "rf config 0"=w18, "rf enable 1"=w19, "rf config 1"=w20, "transfer mode"=w21, "sample rate"=w15, "number of samples"=w14, "start trigger"=w22) -> (instance out=w24)
  call "Configure Rx.gvi"(niUsrpRio Session=w9, rx config=$"rx config", error in=w13, Sample Number=w14, Fs=w15) -> (rx.coerced configurations=w25, niUsrpRio Session (out)=w26, rx.enabled channels=w27, vertical range=w28, error out=w29)
  Property Node(instance in=T4 {all zero or empty}, "rx config"=w24, "reference frequency source"=$"reference frequency source", "rx.enabled channels"=w27, "vertical range"=w28, "rx.coerced configurations"=w25) -> (instance out=w30)
  $"rx channels" <- w30
  $"niUsrpRio Session (out)" <- w26
  $"error out" <- w29
  $"rx.coerced configurations" <- w25
  $"tx.coerced configurations" <- w8
  $"tx.output waveform" <- w7
