vi "Self Measure Rx IQ Offset.gvi"   [LabVIEW NXG 4.0.0]
inputs:
  "niusrprio session in": "niUsrpRio Session.gtype"
  "carrier freq": f64 = 2400000000
  "iq rate": f64 = 10000000
  "gain": f64 = 15
  "error in": error
  "channel": string = "rx/RF 0"
  "tuning settle": u32 = 100
  "number of samples": u32 = 10000
  "transient samples to throw out": i32 = 4000
outputs:
  "coerced frequency": f64
  "error out": error
  "offset": c128
panel controls:
  "active antenna": string = "RX1"
panel indicators:
  "waveform graph": waveform<f64>[]
  "niusrprio session out": "niUsrpRio Session.gtype"
types:
  "Register Bus Session.gtype" = Queue<"Session Data.gtype">
  "Semaphore.gtype" = i32
  "DB Queue Reference.gtype" = Queue<"Daughterboard Data.gtype">
  "EEPROM Header.gtype" = cluster{"Checksum": u32, "Product Code": u16, "Hardware Current Version": u16, "Hardware Oldest Compatible Version": u16, "EEPROM Map Current Version": u16, "EEPROM Map Oldest Compatible Version": u16, "User Password": string, "Pointer to Factory Header": u32, "Pointer to User Header": u32, "Recommended Interval": u16, "Number of Reserved Bytes": i32, "Number of Daughterboards": u8, "Daughterboard IDs": u16[], "Daughterboard Serial Numbers": string[]}
  "EEPROM Device Data Header.gtype" = cluster{"Checksum": u32, "Number of Channels": u8, "Number of Gain Settings": u16[], "Pointer to Characterization Data": u32[], "Number of Reserved Bytes": i32, "Number of Frequencies": u16[]}
  "EEPROM Characterization Header.gtype" = cluster{"Checksum": u32, "Date": timestamp, "Temperature": f32, "Misc. Info": string, "Pointer to Device Data Header": u32, "Number of Reserved Bytes": i32}
  "Characterization Data.gtype" = cluster{"Gains[dB]": f64[], "Frequencies [Hz]": f64[], "IQ Imbalance Table": "IQ Imbalance.gtype"[], "Measured Gains[dB]": f64[][]}
  "niUsrpRio Session.gtype" = cluster{"FPGA Interface": any, "RIO Interface Number": u32, "Data Clock Rate": u32, "FPGA Data Clock Rate": u32, "Global Settings Register Bus": "Register Bus Session.gtype", "Radio 0 Settings Register Bus": "Register Bus Session.gtype", "Radio 1 Settings Register Bus": "Register Bus Session.gtype", "Radio Settings Bus Semaphore": "Semaphore.gtype", "DB Queues": "DB Queue Reference.gtype"[], "Characterization Data Valid?": bool, "EEPROM Header": "EEPROM Header.gtype", "Device Data Header": "EEPROM Device Data Header.gtype", "EEPROM Characterization Header": "EEPROM Characterization Header.gtype", "Characterization Data": "Characterization Data.gtype"[], "FPGA Current Version": u32, "FPGA Oldest Compatible Version": u32, "Fixed Logic Current Version": u32, "Fixed Logic Oldest Compatible Version": u32, "FPGA Radio Settings Bus Current Version": u32, "FPGA Radio Settings Bus Oldest Compatible Version": u32, "FPGA Board Config Current Version": u32, "FPGA Board Config Oldest Compatible Version": u32, "Daughterboard Clock Rate": u32}
  "IQ Impairments.gtype" = cluster{"inline gain I": FXP(1.17), "inline gain Q": FXP(1.17), "cross gain I": FXP(1.17), "cross gain Q": FXP(1.17), "pre-gain offset I": FXP(1.17), "pre-gain offset Q": FXP(1.17), "post-gain offset I": FXP(1.17), "post-gain offset Q": FXP(1.17)}
uses:
  NI::USRPRIO::ConfigV1Host::Enable Front End.gvi
  NI::USRPRIO::ConfigV1Host::Configure LO.gvi
  NI::USRPRIO::ConfigV1Host::Wait until Done.gvi
  Host SubVIs::Calculate Sample Rate.gvi
  NI::USRPRIO::ConfigV1Host::Configure Active Antenna.gvi
  NI::USRPRIO::ConfigV1Host::Configure Gain.gvi
  Host SubVIs::Configure Start Trigger.gvi
  Host SubVIs::Configure Stream.gvi
  Host SubVIs::Initiate Stream.gvi
  Host SubVIs::Fetch Rx Data (CDB WDT).gvi
  NI::Analysis::Statistics::Mean (CDB).gvi
  Host SubVIs::Check Stream Status.gvi
diagram:
  case ($"error in") {
    frame No Error {
      call "Enable Front End.gvi"(niusrprio session in=$"niusrprio session in", enable=TRUE, error in=$"error in", scope=$channel) -> (niusrprio session out=w3, error out=w4)
      call "Configure LO.gvi"(niusrprio session in=w3, frequency=$"carrier freq", error in=w4, scope=$channel) -> (niusrprio session out=w5, coerced frequency=w6, error out=w7)
      $"coerced frequency" <- w6
      call "Wait until Done.gvi"(niusrprio session in=w5, what to wait for="LO Locked", error in=w7, scope=$channel) -> (niusrprio session out=w8, error out=w9)
      Property Node(instance in=w8) -> ("Data Clock Rate"=w10)
      call "Calculate Sample Rate.gvi"(data clock rate=w10, sample rate=$"iq rate") -> (decimation sample rate=w11, coerced sample rate=w12)
      Add($"number of samples", $"transient samples to throw out") -> w13
      w14 = "IQ Impairments.gtype" {"inline gain I"=0.999992370605, "inline gain Q"=0.999992370605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}
      Property Node(instance in=w8) -> ("FPGA Interface"=w15)
      Dynamic Fpga Interface Cast(reference in=w15, type=any constant) -> (reference out=w16)
      Property Node(instance in=w16, "rx.output sample rate"=w11, "rx 0.impairments"=w14, "rx 1.impairments"=w14, "rx 0.frequency shift"=0, "rx 1.frequency shift"=0, error in=w9) -> (error out=w17)
      call "Configure Active Antenna.gvi"(niusrprio session in=w8, active antenna=$"active antenna", error in=w17, scope=$channel) -> (niusrprio session out=w18, error out=w19)
      call "Configure Gain.gvi"(niusrprio session in=w18, gain=$gain, error in=w19, scope=$channel) -> (niusrprio session out=w20, error out=w21)
      sequence {
        frame 0 {
          # Wait for the RF filter to settle.  This can be removed if you are certain the RF filter setting did not change.
          Wait(time to wait=$"tuning settle")
        }
      }
      call "Configure Start Trigger.gvi"(niusrprio session in=w20, start trigger="Immediate", error in=w21, scope=$channel) -> (niusrprio session out=w22, error out=w23)
      call "Configure Stream.gvi"(niusrprio session in=w22, number of samples is finite=TRUE, number of samples=w13, error in=w23, scope=$channel) -> (niusrprio session out=w24, error out=w25)
      call "Initiate Stream.gvi"(niusrprio session in=w24, error in=w25, scope=$channel) -> (niusrprio session out=w26, error out=w27)
      call "Fetch Rx Data (CDB WDT).gvi"(leading samples to trim=$"transient samples to throw out", niusrprio session=w26, number of samples=w13, sample rate=w12, error in=w27, scope=$channel, vertical range [vpp]=2) -> (niusrprio session 2=w28, waveform=w29, error out=w30)
      Property Node(instance in=w29) -> ("dt"=w31, "Y"=w32)
      Complex To Real And Imaginary(x + iy=w32) -> (x=w33, y=w34)
      Build Waveform Node(Y=w33, dt=w31) -> (output waveform=w35)
      Build Waveform Node(Y=w34, dt=w31) -> (output waveform=w36)
      Build Array(w35, w36) -> w37
      $"waveform graph" <- w37
      call "Mean (CDB).gvi"(x=w32, error in=w30) -> (mean=w38, error out=w39)
      call "Check Stream Status.gvi"(niusrprio session in=w28, error in=w39, scope=$channel) -> (niusrprio session out=w2, error out=w1)
      $offset <- w38
    }
    frame Error {
      w1 = $"error in"
      w2 = $"niusrprio session in"
    }
  }
  $"niusrprio session out" <- w2
  $"error out" <- w1
