vi "Mat2TDMS.gvi"   [LabVIEW NXG 4.0.0]
diagram:
  w1 = "H:\\TUM-PC\\Dokumente\\Thesis\\MATLAB_Testing\\GenerateLTEFrame\\txWaveform.mat"
  String To Path(string=w1) -> (path=w2)
  Scan From File(formatString="TDMS", inputFile=w2, 1) -> (fileOut=w3)
  Write To Text File(file (use dialog)=w3, prompt (Choose or enter file path)="H:\\TUM-PC\\Dokumente\\test.txt", text="Hi there")
