vi "Rx Streaming (Host).gvi"   [LabVIEW NXG 4.0.0]
# This template is for the Simple NI-USRP Streaming design, a design that shows the basics of streaming data to and from an NI USRP-294x/295x device. Refer to the block diagram for more information about how to use this template.
panel controls:
  "Tab": i32
  "USRP RIO device": string = "RIO0"
  "Reference Frequency Source": string = "Internal"
  "rx.stop": bool
  "Tab_2": i32
  "rx config": T6 = {"rf enable 0"=TRUE, "rf config 0"={"Antenna RF 0"="RX2", "Frequency RF 0 [Hz]"=2000000000, "LO Frequency RF 0 [Hz]"=-1, "Reference Level RF 0 [dBm]"=0}, "rf enable 1"=TRUE, "rf config 1"={"Antenna RF 1"="RX2", "Frequency RF 1 [Hz]"=2000000000, "LO Frequency RF 1 [Hz]"=-1, "Reference Level RF 1 [dBm]"=0}, "Acquisition Mode"="Finite", "Sample Rate [S/s]"=10000000, "Number of Samples"=8192, "Start Trigger"="Immediate"}
panel indicators:
  "Power Spectrum": T1[]
  "Power Level": f64[][]
  "I & Q Data": f64[][]
  "RX Coerced Configurations": T2
  "Acquiring": bool
types:
  T1 = cluster{"f0": f64, "df": f64, "magnitude": f64[]}
  T2 = cluster{"Coerced Frequencies [Hz]": f64[], "Coerced LO Frequencies [Hz]": f64[], "Coerced Levels [dBm]": f64[], "Coerced Sample Rates [S/s]": f64[]}
  T3 = cluster{"Antenna RF 0": string, "Frequency RF 0 [Hz]": f64, "LO Frequency RF 0 [Hz]": f64, "Reference Level RF 0 [dBm]": f64}
  T4 = cluster{"Antenna RF 1": string, "Frequency RF 1 [Hz]": f64, "LO Frequency RF 1 [Hz]": f64, "Reference Level RF 1 [dBm]": f64}
  T5 = enum{"Software", "Digital Edge", "Rx Start Trigger", "Tx Start Trigger", "Immediate", "Future Time Event"}
  T6 = cluster{"rf enable 0": bool, "rf config 0": T3, "rf enable 1": bool, "rf config 1": T4, "Acquisition Mode": enum{"Finite", "Continuous"}, "Sample Rate [S/s]": f64, "Number of Samples": u32, "Start Trigger": T5}
uses:
  Host SubVIs::Open and Configure Device.gvi
  Host SubVIs::Initiate and Fetch (Single).gvi
  NI::G Core::Timing::Elapsed Timer.gvi
  Host SubVIs::Calculate Power.gvi
  Host SubVIs::Close Device.gvi
  NI::G Core::Error::Display Error.gvi
diagram:
  # 1. Open and configure device
  # 2. Receive data
  # 3. Close device
  # 1.
  call "Open and Configure Device.gvi"(rx config=$"rx config", USRP RIO Device=$"USRP RIO device", reference frequency source=$"Reference Frequency Source") -> (niUsrpRio Session (out)=w1, rx.coerced configurations=w2, error out=w3, rx channels=w4)
  s1 = w3  # shift register
  while (iteration -> i1) {
    Is Equal To 0(x=i1) -> w5
    # 2.
    call "Initiate and Fetch (Single).gvi"(niUsrpRio Session=w1, first iteration=w5, error in=s1, rx channels=w4) -> (niUsrpRio Session (out)=w6, complex baseband data=w7, error out=w8)
    call "Elapsed Timer.gvi"(target time=0.05) -> (time has elapsed=w9)
    case (w9) {
      frame False, Default { }
      frame True {
        call "Calculate Power.gvi"(waveform=w7) -> (Power Spectrum=w10, Power Level=w11, I & Q Data=w12)
        $"Power Spectrum" <- w10
        $"Power Level" <- w11
        $"I & Q Data" <- w12
      }
    }
    Logical Or(w8, $"rx.stop") -> w13
    Not(x=w13) -> w14
    $Acquiring <- w14
    next s1 = w8
    stop if w13
  }
  # 3.
  call "Close Device.gvi"(niusrprio session in=w6, error in=s1) -> (error out=w15)
  call "Display Error.gvi"(error in=w15, type of dialog="OK message + warnings")
  $"RX Coerced Configurations" <- w2
