vi "NI USRP Record and Playback.gvi"   [LabVIEW NXG 4.0.0]
# This VI is designed to provide basic recording and playback of RF signals. Acquisition and generation can be controlled independently, and the same file can be recorded and played back simultaneously. If the same file is used, playback will commence only when the file on disk is large enough to prime the generation buffer. The generation reference level assumes that the file was generated by the acquisition portion.
panel controls:
  "Application Tab Control": i32
  "RX Destination File": path = path "C:\\IQ-Playback.bin"  # Enter the name of the file you wish to store your acquisition in here. Click on the folder icon to the right in order to bring up a dialog to browse for a file.
  "RX USRP Configuration": T1 = {"USRP IP Address"="RIO1", "carrier frequency"=98000000, "IQ rate (S/s)"=5000000, "gain"=25, "active antenna"="RX1"}
  "Recording Stop": bool
  "Recording Start": bool
  "TX USRP Configuration": T1 = {"USRP IP Address"="RIO1", "carrier frequency"=433920000, "IQ rate (S/s)"=5000000, "gain"=25, "active antenna"="TX1"}
  "TX Destination File": path = path "C:\\IQ-Playback.bin"  # Enter the name of the file you wish to store your acquisition in here. Click on the folder icon to the right in order to bring up a dialog to browse for a file.
  "Playback Start": bool
  "Playback Stop": bool
  "Update Interval (ms)": u32 = 250
  "Show Acquired Data": bool = TRUE
  "Enable Display": bool
  "Max queue size": i32 = 100
  "Block Size": i32 = 250000
  "Application Stop": bool
panel indicators:
  "Total Record Duration (s)": f64
  "Actual Coerced RX Values": T1
  "Actual Coerced TX Values": T1
  "Total Playback Duration (s)": f64
  "Frequency Domain": T2
  "Max queue memory": i32
  "TX Queue % Full": f64
  "RX Queue % Full": f64
  "Generating": bool
  "Recording": bool
types:
  T1 = cluster{"USRP IP Address": "USRP niUSRPClass", "carrier frequency": f64, "IQ rate (S/s)": f64, "gain": f64, "active antenna": string}
  T2 = cluster{"f0": f64, "df": f64, "magnitude": f64[]}
  T3 = enum{"No averaging", "Vector averaging", "RMS averaging", "Peak hold"}
  T4 = cluster{"averaging mode": T3, "weighting mode": enum{"Linear", "Exponential"}, "number of averages": u32}
uses:
  My Computer::subVIs::RF Record and Playback Globals.gvi
  My Computer::subVIs::Multi-Loop Stop.gvi
  My Computer::subVIs::subVI_NI USRP Record and Playback Recorder.gvi
  My Computer::subVIs::subVI_NI USRP Record and Playback Generator.gvi
  NI::Analysis::Measurement::Power Spectrum for 1 Chan (CDB).gvi
  NI::Analysis::Measurement::Power Spectral Density for 1 Chan (CDB).gvi
  My Computer::subVIs::trapError.gvi
  NI::G Core::Error::Display Error.gvi
diagram:
  # Initalization
  sequence {
    frame 0 {
      call "RF Record and Playback Globals.gvi"(Operation="Initialize", Block Size=$"Block Size", Max queue size=$"Max queue size") -> (error out=w1)
      w2 = 16  # bytes/sample
      Multiply($"Max queue size", w2) -> w3
      Multiply($"Block Size", w3) -> w4
      $"Max queue memory" <- w4
      call "Multi-Loop Stop.gvi"(Reset?=TRUE)
    }
  }
  while {  # Acquisition Loop
    Wait Until Next Multiple(multiple to wait=250)
    $Recording <- $"Recording Start"
    case ($"Recording Start") {
      frame False, Default {
        w5 = w1
      }
      frame True {
        call "subVI_NI USRP Record and Playback Recorder.gvi"(Destination File=$"RX Destination File", USRP Configuration=$"RX USRP Configuration", error in (no error)=w1) -> (USRP Configuration Coercion=w6, Record Duration (s)=w7, error out=w5)
        $"Actual Coerced RX Values" <- w6
        $"Total Record Duration (s)" <- w7
      }
    }
    call "Multi-Loop Stop.gvi"(error in (no error)=w5) -> (Stop Out=w8)
    stop if w8
  }
  sequence {
    frame 0 { }
  }
  $Recording <- FALSE
  while {  # Generation Loop
    Wait Until Next Multiple(multiple to wait=250)
    $Generating <- $"Playback Start"
    case ($"Playback Start") {
      frame False, Default {
        w9 = w1
      }
      frame True {
        call "subVI_NI USRP Record and Playback Generator.gvi"(Destination File=$"TX Destination File", USRP Configuration=$"TX USRP Configuration", error in (no error)=w1) -> (USRP Configuration Coercion=w10, Playback Duration (s)=w11, error out (no error)=w9)
        $"Actual Coerced TX Values" <- w10
        $"Total Playback Duration (s)" <- w11
      }
    }
    call "Multi-Loop Stop.gvi"(error in (no error)=w9) -> (Stop Out=w12)
    stop if w12
  }
  sequence {
    frame 0 { }
  }
  $Generating <- FALSE
  while {  # Visualization Loop
    Wait Until Next Multiple(multiple to wait=$"Update Interval (ms)")
    case ($"Recording Stop") {
      frame False, Default { }
      frame True {
        call "RF Record and Playback Globals.gvi"(Operation="Stop Recording")
      }
    }
    case ($"Playback Stop") {
      frame False, Default { }
      frame True {
        call "RF Record and Playback Globals.gvi"(Operation="Stop Playback")
      }
    }
    case ($"Enable Display") {
      frame False, Default {
        w13 = w1
      }
      frame True {
        call "RF Record and Playback Globals.gvi"(Operation="Get State", error in (no error)=w1) -> (Record Data Queue Out=w14, Playback Data Queue Out=w15, error out=w16)
        case ($"Show Acquired Data") {
          frame True {
            Preview Queue Element(error in=w16, queue=w14, timeout in ms=1000) -> (element=w19, error out=w17)
            Property Node(instance in=$"RX USRP Configuration") -> ("IQ rate (S/s)"=w20)
            Reciprocal(x=w20) -> w21
            Build Waveform Node(Y=w19, dt=w21) -> (output waveform=w18)
          }
          frame False {
            Preview Queue Element(error in=w16, queue=w15, timeout in ms=1000) -> (element=w22, error out=w17)
            Property Node(instance in=$"TX USRP Configuration") -> ("IQ rate (S/s)"=w23)
            Reciprocal(x=w23) -> w24
            Build Waveform Node(Y=w22, dt=w24) -> (output waveform=w18)
          }
        }
        w25 = T4 {"averaging mode"="No averaging", "weighting mode"="Exponential", "number of averages"=10}
        case ("Power Spectral Density"(1)) {
          frame 0, Default {
            call "Power Spectrum for 1 Chan (CDB).gvi"(signal=w18, window type=1, averaging parameters=w25, dB on=TRUE, error in=w17, restart averaging=FALSE, window parameter=NaN) -> (power spectrum=w26, averaging done=w27, averages completed=w28, error out=w13)
          }
          frame 1 {
            call "Power Spectral Density for 1 Chan (CDB).gvi"(signal=w18, averaging parameters=w25, window type=1, dB on=TRUE, error in=w17, restart averaging=FALSE, window parameter=NaN) -> (power spectral density=w26, averaging done=w29, averages completed=w30, error out=w13)
          }
        }
        $"Frequency Domain" <- w26
      }
    }
    Is Equal(x=$"Application Tab Control", y="About") -> w31
    case (w31) {
      frame False, Default {
        w32 = w1
      }
      frame True {
        call "RF Record and Playback Globals.gvi"(Operation="Get State", error in (no error)=w1) -> (Record Data Queue Out=w33, Playback Data Queue Out=w34, error out=w35)
        Get Queue Status(error in=w35, queue=w33) -> (# elements in queue=w36, error out=w37, max queue size=w38)
        Divide(x=w36, y=w38) -> w39
        $"RX Queue % Full" <- w39
        Get Queue Status(error in=w37, queue=w34) -> (# elements in queue=w40, error out=w32, max queue size=w41)
        Divide(x=w40, y=w41) -> w42
        $"TX Queue % Full" <- w42
      }
    }
    Merge Errors(w32, w13) -> (error out=w43)
    w44 = 5  # queue timeout error
    call "trapError.gvi"(error in (no error)=w43, code=w44) -> (error out=w45)
    call "Multi-Loop Stop.gvi"(Stop 1=$"Application Stop", error in (no error)=w45) -> (Stop Out=w46)
    stop if w46
  }
  call "RF Record and Playback Globals.gvi"(Operation="Stop Playback", error in (no error)=w45) -> (error out=w47)
  call "RF Record and Playback Globals.gvi"(Operation="Stop Recording", error in (no error)=w47) -> (error out=w48)
  Merge Errors(w5, w9, w48) -> (error out=w49)
  call "RF Record and Playback Globals.gvi"(Operation="Destroy", error in (no error)=w49) -> (error out=w50)
  call "Display Error.gvi"(error in=w50)
