vi "Multi-Loop Stop.gvi"   [LabVIEW NXG 4.0.0]
inputs:
  "Reset?": bool
  "Stop 1": bool
  "Stop 2": bool
  "Stop 3": bool
  "Stop Array": bool[]
  "error in (no error)": error
outputs:
  "Stop Out": bool
diagram:
  s1 = uninitialised  # shift register
  while {
    Or Array Elements(Boolean array=$"Stop Array") -> (logical OR=w1)
    Property Node(instance in=$"error in (no error)") -> ("status"=w2)
    Logical Or(s1, $"Stop 1", $"Stop 2", $"Stop 3", w1, w2) -> w3
    case ($"Reset?") {
      frame False, Default {
        w4 = w3
      }
      frame True {
        w4 = FALSE
      }
    }
    next s1 = w4
    stop if TRUE
  }
  $"Stop Out" <- s1
