vi "RF Record and Playback Globals.gvi"   [LabVIEW NXG 4.0.0]
inputs:
  "Record Windows file handle": u32
  "Operation": "RF Record and Playback Globals Control.gtype" = "Initialize"
  "Block Size": i32 = 10000
  "Max queue size": i32 = 20
  "Record LabVIEW file refnum": ByteStreamFileRefnum
  "error in (no error)": error
outputs:
  "Playing": bool
  "Recording": bool
  "Record Data Queue Out": Queue<c128[]>
  "Playback Data Queue Out": Queue<c128[]>
  "Block Size Out": i32
  "error out": error
  "File Semaphore": "Semaphore.gtype"
  "Record LabVIEW file refnum out": ByteStreamFileRefnum
  "Record Windows file handle out": u32
panel indicators:
  "Max Queue Size Out": i32
types:
  "RF Record and Playback Globals Control.gtype" = enum{"Initialize", "Destroy", "Get State", "Set Record File References", "Start Recording", "Start Playback", "Stop Recording", "Stop Playback"}
  "Semaphore.gtype" = i32
  T1 = cluster{"semaphore": "Semaphore.gtype", "queue out": Queue<c128[]>, "queue out_2": Queue<c128[]>, "Block Size": i32, "Max queue size": i32, "Record LabVIEW file refnum out": ByteStreamFileRefnum, "Record Windows file handle out": u32, "Recording": bool, "Playing": bool}
uses:
  NI::G Core::Semaphore::Obtain Semaphore Reference.gvi
  NI::G Core::Semaphore::Release Semaphore Reference.gvi
diagram:
  s1 = uninitialised  # shift register
  while {
    case ($Operation) {
      frame "Initialize", Default {
        call "Obtain Semaphore Reference.gvi"(name="Record File Semaphore", error in=$"error in (no error)") -> (semaphore=w3, error out=w4)
        Obtain Queue(element data type=c128[] [], error in=w4, max queue size=$"Max queue size", name="Record Data") -> (error out=w5, queue out=w6)
        Obtain Queue(element data type=c128[] [], error in=w5, max queue size=$"Max queue size", name="Playback Data") -> (error out=w2, queue out=w7)
        w8 = ByteStreamFileRefnum constant  # Record LabVIEW file refnum out
        w9 = 0  # Record Windows file handle out
        w10 = FALSE  # Recording
        w11 = FALSE  # Playing
        Property Node(instance in=T1 {all zero or empty}, "semaphore"=w3, "queue out"=w6, "queue out_2"=w7, "Block Size"=$"Block Size", "Max queue size"=$"Max queue size", "Record LabVIEW file refnum out"=w8, "Record Windows file handle out"=w9, "Recording"=w10, "Playing"=w11) -> (instance out=w1)
      }
      frame "Destroy" {
        Property Node(instance in=s1, "Recording"=FALSE, "Playing"=FALSE) -> (instance out=w1)
        Property Node(instance in=s1) -> ("semaphore"=w12, "queue out"=w13, "queue out_2"=w14)
        call "Release Semaphore Reference.gvi"(semaphore=w12, force destroy=TRUE, error in=$"error in (no error)") -> (error out=w15)
        Release Queue(error in=w15, force destroy=TRUE, queue=w13) -> (error out=w16)
        Release Queue(error in=w16, force destroy=TRUE, queue=w14) -> (error out=w2)
      }
      frame "Get State" {
        Property Node(instance in=s1) -> ("semaphore"=w17, "queue out"=w18, "queue out_2"=w19, "Block Size"=w20, "Max queue size"=w21, "Record LabVIEW file refnum out"=w22, "Record Windows file handle out"=w23, "Recording"=w24, "Playing"=w25)
        $"File Semaphore" <- w17
        $"Record Data Queue Out" <- w18
        $"Playback Data Queue Out" <- w19
        $"Block Size Out" <- w20
        $"Max Queue Size Out" <- w21
        $"Record LabVIEW file refnum out" <- w22
        $"Record Windows file handle out" <- w23
        $Recording <- w24
        $Playing <- w25
        w1 = s1
        w2 = $"error in (no error)"
      }
      frame "Set Record File References" {
        Property Node(instance in=s1, "Record LabVIEW file refnum out"=$"Record LabVIEW file refnum", "Record Windows file handle out"=$"Record Windows file handle") -> (instance out=w1)
        w2 = $"error in (no error)"
      }
      frame "Start Recording" {
        Property Node(instance in=s1, "Recording"=TRUE) -> (instance out=w1)
        w2 = $"error in (no error)"
      }
      frame "Start Playback" {
        Property Node(instance in=s1, "Playing"=TRUE) -> (instance out=w1)
        w2 = $"error in (no error)"
      }
      frame "Stop Recording" {
        Property Node(instance in=s1, "Recording"=FALSE) -> (instance out=w1)
        w2 = $"error in (no error)"
      }
      frame "Stop Playback" {
        Property Node(instance in=s1, "Playing"=FALSE) -> (instance out=w1)
        w2 = $"error in (no error)"
      }
    }
    next s1 = w1
    stop if TRUE
  }
  $"error out" <- w2
