vi "subVI_NI USRP Record and Playback Generator.gvi"   [LabVIEW NXG 4.0.0]
# This example shows how to continuously stream new data from disk to an Arbitrary Waveform Generator while the device is generating. It also configures a PXI-5610 upconverter to upconvert the waveform to RF. This example is intended to be used for generating quantities of data that are significantly larger than the onboard memory.
inputs:
  "Destination File": path = path "C:\\BinaryIQData.bin"  # Enter the name of the file you wish to store your acquisition in here. Click on the folder icon to the right in order to bring up a dialog to browse for a file.
  "USRP Configuration": T1 = {"USRP IP Address"="192.168.10.3", "carrier frequency"=433920000, "IQ rate (S/s)"=5000000, "gain"=15, "active antenna"="TX1"}
  "error in (no error)": error
outputs:
  "USRP Configuration Coercion": T1
  "Playback Duration (s)": f64
  "error out (no error)": error
panel indicators:
  "Numeric": i32
types:
  T1 = cluster{"USRP IP Address": "USRP niUSRPClass", "carrier frequency": f64, "IQ rate (S/s)": f64, "gain": f64, "active antenna": string}
  T2 = enum{"big-endian, network order", "native, host-order", "little-endian"}
uses:
  NI::USRP::niUSRP Open Tx Session.gvi
  NI::USRP::niUSRP Configure Signal.gvi
  My Computer::subVIs::RF Record and Playback Globals.gvi
  NI::USRP::niUSRP Write Tx Data (CDB).gvi
  My Computer::subVIs::trapError.gvi
  NI::USRP::niUSRP Close Session.gvi
diagram:
  # NI-USRP Configuration
  # 1. Open a session to the USRP.
  # 2. Configure the generation type and session parameters.
  Property Node(instance in=$"USRP Configuration") -> ("IQ rate (S/s)"=w1, "carrier frequency"=w2, "gain"=w3, "active antenna"=w4, "USRP IP Address"=w5)
  # 1.
  call "niUSRP Open Tx Session.gvi"(device names=w5, error in=$"error in (no error)", reset=TRUE) -> (session handle out=w6, error out=w7)
  # 2.
  call "niUSRP Configure Signal.gvi"(active antenna=w4, session handle=w6, error in=w7, IQ rate=w1, carrier frequency=w2, gain=w3) -> (session handle out=w8, error out=w9, coerced IQ rate=w10, coerced carrier frequency=w11, coerced gain=w12)
  Property Node(instance in=$"USRP Configuration", "IQ rate (S/s)"=w10, "carrier frequency"=w11, "gain"=w12) -> (instance out=w13)
  $"USRP Configuration Coercion" <- w13
  # 1.
  Open Or Create Or Replace File(access (0:read/write)="read-only", error in=w9, file path (use dialog)=$"Destination File", operation (0:open)="open") -> (error out=w14, refnum out=w15)
  call "RF Record and Playback Globals.gvi"(Operation="Start Playback", error in (no error)=w14) -> (error out=w16)
  # 2.
  call "RF Record and Playback Globals.gvi"(Operation="Get State", error in (no error)=w16) -> (Playback Data Queue Out=w17, error out=w18)
  # Consumer Loop
  # 3. Dequeue a single element from the Data Queue (an array of the acquired Block Size).
  # 4. If dequeueing was successful, Write data to the niUSRP Write TX Data VI.
  # 5. Stop the loop if 1. the user requested Stop Playback, 2. an error was encountered, or 3. the Queue was empty
  # 6. Close the USRP session.
  # 7. Calculate record duration by dividing Total Samples Read by the number of Samples per Second
  s1 = w18  # shift register
  s2 = 0  # shift register
  while {
    # 3.
    # w17: Data Queue
    Dequeue Element(error in=s1, queue=w17, timeout in ms=3000) -> (element=w19, error out=w20, timed out?=w21)
    # This loop waits for space to become available for another block of data, dequeues the data and writes it.
    # 4.
    case (w21) {
      frame False, Default {
        call "niUSRP Write Tx Data (CDB).gvi"(session handle=w8, error in=w20, data=w19) -> (session handle out=w22, error out=w23)
      }
      frame True {
        w22 = w8
        w23 = w20
      }
    }
    # 5.
    call "RF Record and Playback Globals.gvi"(Operation="Get State", error in (no error)=w23) -> (Playing=w24, error out=w25)
    # w26: Total Samples Written
    Property Node(instance in=w25) -> ("status"=w27)
    Not(x=w24) -> w28
    Logical Or(w27, w28, w21) -> w29
    case (w29) {
      frame False, Default {
        w30 = w25
      }
      frame True {
        call "RF Record and Playback Globals.gvi"(Operation="Stop Playback", error in (no error)=w25) -> (error out=w30)
      }
    }
    Array Size(array=w19) -> (size(s)=w31)
    Add(w31, s2) -> w26
    next s1 = w30
    next s2 = w26
    stop if w29
  }
  Divide(x=s2, y=w10) -> w32
  # 7.
  $"Playback Duration (s)" <- w32
  # File IO
  # 3. Read one "block" of the file, block size set at acqusition
  # 4. Enqueue this block of data to the data queue to be written by the USRP in the consumer loop
  # 5. Do no stop playback on EOF, but exit the loop. Only stop playback if another error occurs, or the generation is stopped by the VI's parent through the functional global variable.
  # 6. Ignore EOF error.
  # 7. Close out file.
  # 8. Merge errors
  # File I/O and Queue Configuration
  # 1. Open or create the file using the Open/Create/Replace File VI.
  # 2. Acquire queue to transfer the acquired data between producer and consumer loops from functional global variable.
  while (iteration -> i1) {
    # w17: Playback Data Queue
    Wait(time to wait=1)
    # Consumer Loop - Reads data from disk and enqueues it; the queue blocks when full.
    # 3.
    Type Cast(type=T2 "big-endian, network order", x="little-endian") -> w33
    Read From Binary File(byte order=w33, data type=c128[] [], error in=w18, file (use dialog)=w15) -> (data=w34, error out=w35, refnum out=w36)
    # 4.
    Enqueue Element(element=w34, error in=w35, queue=w17, timeout in ms=3000) -> (error out=w37)
    call "RF Record and Playback Globals.gvi"(Operation="Get State", error in (no error)=w37) -> (Playing=w38, error out=w39)
    Property Node(instance in=w39) -> ("code"=w40)
    w41 = 4  # EOF Error
    Is Not Equal(x=w41, y=w40) -> w42
    Property Node(instance in=w39) -> ("status"=w43)
    Not(x=w38) -> w44
    Logical Or(w43, w44) -> w45
    # 5.
    Logical And(w42, w45) -> w46
    case (w46) {
      frame False, Default {
        w47 = w39
      }
      frame True {
        call "RF Record and Playback Globals.gvi"(Operation="Stop Playback", error in (no error)=w39) -> (error out=w47)
      }
    }
    $Numeric <- i1
    stop if w45
  }
  # 6.
  w48 = 4  # EOF Error
  call "trapError.gvi"(error in (no error)=w47, code=w48) -> (error out=w49)
  # 7.
  Close File(error in=w49, refnum=w36) -> (error out=w50)
  # 6.
  call "niUSRP Close Session.gvi"(session handle=w22, error in=s1) -> (error out=w51)
  # 8.
  Merge Errors(w51, w50) -> (error out=w52)
  call "RF Record and Playback Globals.gvi"(Operation="Stop Playback", error in (no error)=w52) -> (error out=w53)
  $"error out (no error)" <- w53
