vi "subVI_NI USRP Record and Playback Recorder.gvi"   [LabVIEW NXG 4.0.0]
# Recommended Input Signal: 100 MHz, 0dBm, sine wave
# This example requires NI-RFSA 2.0.1 or later.
# Devices Supported: NI PXI-5661
# VI Description:
# This example demonstrates using continuous acquisition to fetch IQ data while continuously streaming the data to a binary file using the Win32 File I/O VIs. The vertical range and the IQ rate of the NI Vector Signal Analyzer (VSA) are configured using the NI-RFSA VIs. The VSA is configured to run continuously with the niRFSA Configure Number of Samples.vi, and data is continuously fetched from the onboard memory of the device within the producer loop using the niRFSA Fetch IQ.vi.
# The producer loop continuously fetches data from onboard memory into the LabVIEW memory using DMA transfers. This data is placed into a queue in order to efficiently transfer the data to a parallel consumer loop where it is written file. If the sampling rate is low, the computer can fetch all the data from the VSA, so data is never overwritten.  However, at faster sampling rates, the computer will not be able to fetch the data before it is overwritten by new data. This results in the "data overwritten" error.
# The consumer loop continuously empties data from the queue and writes data to disk using the Win32 Write File.vi. The file is opened using the Win32 Open File.vi, which disables Windows caching during the write process, resulting in increased performance. However when Windows caching is disabled, data must be written to file in a multiple of the sector size of the disk (typically 512 bytes).
inputs:
  "Destination File": path = path "C:\\BinaryIQData.bin"  # Enter the name of the file you wish to store your acquisition in here. Click on the folder icon to the right in order to bring up a dialog to browse for a file.
  "USRP Configuration": T1 = {"USRP IP Address"="192.168.10.2", "carrier frequency"=98000000, "IQ rate (S/s)"=5000000, "gain"=15, "active antenna"="RX1"}
  "error in (no error)": error
outputs:
  "USRP Configuration Coercion": T1
  "Record Duration (s)": f64
  "error out": error
types:
  T1 = cluster{"USRP IP Address": "USRP niUSRPClass", "carrier frequency": f64, "IQ rate (S/s)": f64, "gain": f64, "active antenna": string}
  T2 = enum{"big-endian, network order", "native, host-order", "little-endian"}
uses:
  NI::USRP::niUSRP Open Rx Session.gvi
  NI::USRP::niUSRP Configure Signal.gvi
  My Computer::subVIs::RF Record and Playback Globals.gvi
  NI::USRP::niUSRP Initiate.gvi
  NI::USRP::niUSRP Fetch Rx Data (CDB).gvi
  NI::USRP::niUSRP Abort.gvi
  NI::USRP::niUSRP Close Session.gvi
diagram:
  # NI-USRP Configuration
  # 1. Open a session to the USRP.
  # 2. Configure the acquisition type and session parameters.
  # 3. Initiate the acquistion.
  Property Node(instance in=$"USRP Configuration") -> ("IQ rate (S/s)"=w1, "carrier frequency"=w2, "gain"=w3, "active antenna"=w4, "USRP IP Address"=w5)
  # 1.
  call "niUSRP Open Rx Session.gvi"(device names=w5, error in=$"error in (no error)") -> (session handle out=w6, error out=w7)
  # 2.
  call "niUSRP Configure Signal.gvi"(active antenna=w4, session handle=w6, error in=w7, IQ rate=w1, carrier frequency=w2, gain=w3) -> (session handle out=w8, error out=w9, coerced IQ rate=w10, coerced carrier frequency=w11, coerced gain=w12)
  Property Node(instance in=$"USRP Configuration", "IQ rate (S/s)"=w10, "carrier frequency"=w11, "gain"=w12) -> (instance out=w13)
  $"USRP Configuration Coercion" <- w13
  # File I/O and Queue Configuration
  # 1. Open or create the file using the Open/Create/Replace File VI.
  # 2. Acquire queue to transfer the acquired data between producer and consumer loops from functional global variable.
  # 1.
  Open Or Create Or Replace File(access (0:read/write)="write-only", error in=w9, file path (use dialog)=$"Destination File", operation (0:open)="replace or create") -> (error out=w14, refnum out=w15)
  call "RF Record and Playback Globals.gvi"(Operation="Set Record File References", Record LabVIEW file refnum=w15, error in (no error)=w14) -> (error out=w16)
  # 2.
  call "RF Record and Playback Globals.gvi"(Operation="Start Recording", error in (no error)=w16) -> (error out=w17)
  call "RF Record and Playback Globals.gvi"(Operation="Get State", error in (no error)=w17) -> (Record Data Queue Out=w18, Block Size Out=w19, error out=w20)
  # 3.
  call "niUSRP Initiate.gvi"(session handle=w8, error in=w20) -> (session handle out=w21, error out=w22)
  To Signed 64 Bit Integer(number=w19) -> w23
  # Producer Loop
  # 4. Fetch the requested number of samples with the NI-USRP Fetch RX Data VI.
  # 5. Place fetched data into the Record Data Queue.
  # 6. Stop the loop if 1. the user requested Stop Recording or an error was encountered.
  # 7. Stop and Close the USRP session.
  # 8. Merge and handle errors.
  # 9. Calculate record duration by dividing Total Samples Read by the number of Samples per Second
  s1 = 0  # shift register
  s2 = w22  # shift register
  while {
    # 4.
    # w23: Block Size
    call "niUSRP Fetch Rx Data (CDB).gvi"(session handle=w21, error in=s2, number of samples=w23) -> (session handle out=w24, error out=w25, data=w26)
    # 5.
    Enqueue Element(element=w26, error in=w25, queue=w18) -> (error out=w27)
    # Producer Loop - Fetching data from VSA and placing in queue
    call "RF Record and Playback Globals.gvi"(Operation="Get State", error in (no error)=w27) -> (Recording=w28, error out=w29)
    # w30: Total Samples Read
    Not(x=w28) -> w31
    # 6.
    Property Node(instance in=w29) -> ("status"=w32)
    Logical Or(w32, w31) -> w33
    case (w33) {
      frame False, Default {
        w34 = w29
      }
      frame True {
        call "RF Record and Playback Globals.gvi"(Operation="Stop Recording", error in (no error)=w29) -> (error out=w34)
      }
    }
    Add(w23, s1) -> w30
    next s1 = w30
    next s2 = w34
    stop if w33
  }
  # 7.
  call "niUSRP Abort.gvi"(session handle=w24, error in=s2) -> (session handle out=w35, error out=w36)
  call "niUSRP Close Session.gvi"(session handle=w35, error in=w36) -> (error out=w37)
  # Consumer Loop
  # 3. Dequeue a signle data element (an Array of length Block Size) from the queue.
  # 4. Write data to disk with the LabVIEW Write to Binary File VI.
  # 5. Exit Loop Only on 1. an error or 2. the user requested Stop Recording and the  Record Data Queue is empty.
  # 6. Close the reference to the file with the Close File VI.
  s3 = w20  # shift register
  while {
    w38 = 3000  # Timeout (ms)
    # 3.
    Dequeue Element(error in=s3, queue=w18, timeout in ms=w38) -> (element=w39, error out=w40, queue out=w41, timed out?=w42)
    # Consumer Loop - Emptying data from queue and writing to file
    case (w42) {
      frame False, Default {
        # 4.
        Type Cast(type=T2 "big-endian, network order", x="little-endian") -> w45
        Write To Binary File(byte order=w45, data=w39, error in=w40, file (use dialog)=w15, prepend=TRUE) -> (error out=w43, refnum out=w44)
      }
      frame True {
        w43 = w40
        w44 = w15
      }
    }
    Get Queue Status(error in=w43, queue=w41) -> (# elements in queue=w46, error out=w47, queue out=w48)
    call "RF Record and Playback Globals.gvi"(Operation="Get State", error in (no error)=w47) -> (Recording=w49, error out=w50)
    Property Node(instance in=w50) -> ("status"=w51)
    Is Less Or Equal To 0(x=w46) -> w52
    Not(x=w49) -> w53
    Logical And(w53, w52) -> w54
    # 5.
    Logical Or(w51, w54) -> w55
    case (w55) {
      frame False, Default {
        w56 = w50
      }
      frame True {
        call "RF Record and Playback Globals.gvi"(Operation="Stop Recording", error in (no error)=w50) -> (error out=w56)
      }
    }
    next s3 = w56
    stop if w55
  }
  # 6.
  Close File(error in=s3, refnum=w44) -> (error out=w57)
  Flush Queue(error in=w57, queue=w48) -> (error out=w58)
  Merge Errors(w37, w58) -> (error out=w59)
  # 8.
  call "RF Record and Playback Globals.gvi"(Operation="Stop Recording", error in (no error)=w59) -> (error out=w60)
  $"error out" <- w60
  Divide(x=s1, y=w10) -> w61
  # 9.
  $"Record Duration (s)" <- w61
