vi "trapError.gvi"   [LabVIEW Conversion 4.0.0]
inputs:
  "error in (no error)": error
  "code": i32  # code is the error or warning code. Right-click the error out indicator on the front panel and select Explain Error or Explain Warning from the shortcut menu for more information about the error.
outputs:
  "error out": error
diagram:
  Property Node(instance in=$"error in (no error)") -> ("code"=w1)
  Is Equal(x=w1, y=$code) -> w2
  Select(s=w2, t=no error, f=$"error in (no error)") -> w3
  $"error out" <- w3
