vi "Tx and Rx Streaming (Host).gvi"   [LabVIEW NXG 4.0.0]
# This template is for the Simple NI-USRP Streaming design, a design that shows the basics of streaming data to and from an NI USRP-294x/295x device. Refer to the block diagram for more information about how to use this template.
panel controls:
  "USRP RIO device": string = "RIO0"
  "Reference Frequency Source": string = "Internal"
  "tx.stop": bool
  "rx.stop": bool
  "Tab_2": i32
  "tx config": T4 = {"rf enable 0"=TRUE, "rf config 0"={"Antenna RF 0"="TX1", "Frequency RF 0 [Hz]"=2000000000, "LO Frequency RF 0 [Hz]"=-1, "Output Power RF 0 [dBm]"=0}, "rf enable 1"=TRUE, "rf config 1"={"Antenna RF 1"="TX1", "Frequency RF 1 [Hz]"=2000000000, "LO Frequency RF 1 [Hz]"=-1, "Output Power RF 1 [dBm]"=0}, "Generation Mode"="Finite", "Sample Rate [S/s]"=10000000, "Number of Samples"=8192, "Start Trigger"="Immediate", "Tone Frequency [Hz]"=100000}
  "rx config": T7 = {"rf enable 0"=TRUE, "rf config 0"={"Antenna RF 0"="RX2", "Frequency RF 0 [Hz]"=2000000000, "LO Frequency RF 0 [Hz]"=-1, "Reference Level RF 0 [dBm]"=0}, "rf enable 1"=TRUE, "rf config 1"={"Antenna RF 1"="RX2", "Frequency RF 1 [Hz]"=2000000000, "LO Frequency RF 1 [Hz]"=-1, "Reference Level RF 1 [dBm]"=0}, "Acquisition Mode"="Finite", "Sample Rate [S/s]"=10000000, "Number of Samples"=8192, "Start Trigger"="Immediate"}
  "Tab": i32
  "file path": path = path "c:\\temp\\test.bin"
panel indicators:
  "Acquiring": bool
  "Generating": bool
  "Output Waveform": waveform<f64>[]
  "TX Coerced Configurations": T8
  "RX Coerced Configurations": T9
  "Power Spectrum": T10[]
  "Power Level": f64[][]
  "I & Q Data": f64[][]
  "Numeric": u32
types:
  T1 = cluster{"Antenna RF 0": string, "Frequency RF 0 [Hz]": f64, "LO Frequency RF 0 [Hz]": f64, "Output Power RF 0 [dBm]": f64}
  T2 = cluster{"Antenna RF 1": string, "Frequency RF 1 [Hz]": f64, "LO Frequency RF 1 [Hz]": f64, "Output Power RF 1 [dBm]": f64}
  T3 = enum{"Software", "Digital Edge", "Rx Start Trigger", "Tx Start Trigger", "Immediate", "Future Time Event"}
  T4 = cluster{"rf enable 0": bool, "rf config 0": T1, "rf enable 1": bool, "rf config 1": T2, "Generation Mode": enum{"Finite", "Continuous"}, "Sample Rate [S/s]": f64, "Number of Samples": u32, "Start Trigger": T3, "Tone Frequency [Hz]": f64}
  T5 = cluster{"Antenna RF 0": string, "Frequency RF 0 [Hz]": f64, "LO Frequency RF 0 [Hz]": f64, "Reference Level RF 0 [dBm]": f64}
  T6 = cluster{"Antenna RF 1": string, "Frequency RF 1 [Hz]": f64, "LO Frequency RF 1 [Hz]": f64, "Reference Level RF 1 [dBm]": f64}
  T7 = cluster{"rf enable 0": bool, "rf config 0": T5, "rf enable 1": bool, "rf config 1": T6, "Acquisition Mode": enum{"Finite", "Continuous"}, "Sample Rate [S/s]": f64, "Number of Samples": u32, "Start Trigger": T3}
  T8 = cluster{"Coerced Frequencies [Hz]": f64[], "Coerced LO Frequencies [Hz]": f64[], "Coerced Output Powers [dBm]": f64[], "Coerced Sample Rates [S/s]": f64[]}
  T9 = cluster{"Coerced Frequencies [Hz]": f64[], "Coerced LO Frequencies [Hz]": f64[], "Coerced Levels [dBm]": f64[], "Coerced Sample Rates [S/s]": f64[]}
  T10 = cluster{"f0": f64, "df": f64, "magnitude": f64[]}
uses:
  Host SubVIs::Open and Configure Device.gvi
  Host SubVIs::Initiate and Fetch (Single).gvi
  NI::G Core::Timing::Elapsed Timer.gvi
  Host SubVIs::Calculate Power.gvi
  Host SubVIs::Initiate and Generate (Single).gvi
  Host SubVIs::Close Device.gvi
  NI::G Core::Error::Display Error.gvi
diagram:
  disable {
    frame Enabled { }
    frame Disabled {
      Open Or Create Or Replace File(access (0:read/write)="read/write", operation (0:open)="replace or create") -> (refnum out=w1)
    }
  }
  # 1. Open and configure device
  # 2a. Receive data
  # 2b. Transmit data
  # 3. Close device
  # 1.
  call "Open and Configure Device.gvi"(rx config=$"rx config", tx config=$"tx config", USRP RIO Device=$"USRP RIO device", reference frequency source=$"Reference Frequency Source") -> (niUsrpRio Session (out)=w2, rx.coerced configurations=w3, tx.coerced configurations=w4, tx.output waveform=w5, error out=w6, rx channels=w7, tx channels=w8)
  Obtain Queue(element data type=waveform<c128>[] [], name="IntermediateIQdata") -> (queue out=w9)
  # 3.
  s1 = w6  # shift register
  while (iteration -> i1) {
    Is Equal To 0(x=i1) -> w10
    call "Initiate and Fetch (Single).gvi"(niUsrpRio Session=w2, first iteration=w10, error in=s1, rx channels=w7) -> (niUsrpRio Session (out)=w11, complex baseband data=w12, error out=w13)
    call "Elapsed Timer.gvi"(target time=0.05) -> (time has elapsed=w14)
    call "Elapsed Timer.gvi"(target time=1) -> (time has elapsed=w15)
    # 2a.
    case (w14) {
      frame False, Default { }
      frame True {
        Array Index(array=w12) -> (out0[0]=w16)
        Property Node(instance in=w16)
        Array Index(array=w12)
        Feedback Node(input=w17) -> w18
        case (w15) {
          frame True {
            $Numeric <- w18
          }
          frame False { }
        }
        Feedback Node(initial value=0, input=w17) -> w19
        case (w15) {
          frame True {
            w20 = 0
          }
          frame False {
            w20 = w19
          }
        }
        Increment(x=w20) -> w17
        call "Calculate Power.gvi"(waveform=w12) -> (Power Spectrum=w21, Power Level=w22, I & Q Data=w23)
        $"Power Spectrum" <- w21
        $"Power Level" <- w22
        $"I & Q Data" <- w23
      }
    }
    Enqueue Element(element=w12, queue=w9) -> (queue out=w24)
    w25 = $"rx.stop"
    Logical Or(w13, w25) -> w26
    Not(x=w26) -> w27
    $Acquiring <- w27
    next s1 = w13
    stop if w26
  }
  sequence {
    frame 0 { }
  }
  TDMS Open(byte order="little-endian", file format version="2.0", file path=$"file path", operation="create or replace") -> (error out=w28, tdms file out=w29)
  while (after w25) {
    Dequeue Element(error in=w28, queue=w9) -> (element=w30, error out=w31)
    # File I/O Loop
    TDMS Write(channel name(s) in=["IQ1", "IQ2"], data=w30, error in=w31, group name in="Channels", tdms file=w29) -> (error out=w32, tdms file out=w33)
    Logical Or(w32, w25) -> w34
    stop if w34
  }
  s2 = w6  # shift register
  while (iteration -> i2) {
    Is Equal To 0(x=i2) -> w35
    # 2b.
    call "Initiate and Generate (Single).gvi"(niUsrpRio Session=w2, first iteration=w35, error in=s2, tx channels=w8) -> (error out=w36)
    Logical Or(w36, $"tx.stop") -> w37
    Not(x=w37) -> w38
    $Generating <- w38
    next s2 = w36
    stop if w37
  }
  Merge Errors(w32, s1, s2) -> (error out=w39)
  Release Queue(error in=w39, queue=w24) -> (error out=w40)
  TDMS Close(error in=w40, tdms file=w33) -> (error out=w41)
  call "Close Device.gvi"(niusrprio session in=w11, error in=w41) -> (error out=w42)
  call "Display Error.gvi"(error in=w42, type of dialog="OK message + warnings")
  $"RX Coerced Configurations" <- w3
  $"TX Coerced Configurations" <- w4
  $"Output Waveform" <- w5
